# Grasshopper definition 260218_LCRL_Roof_FacadeInterface [Feb-18 '26, 1637].ghx (Grasshopper 1.0.8)
# plug-ins: Speckle 2, Mensa, Pufferfish, Speckle.Connector.Grasshopper

# ---- group: Change Units to m
# Key
# Inputs
# Outputs
# Bake Items
# Parameters
c_script = CSharpScript()
# ---------- c_script: C# ----------
    doc.AdjustModelUnitSystem(UnitSystem.Meters, false);
    this.RhinoDocument.ModelAbsoluteTolerance = 0.0001;
# ---------- end c_script ----------

# ----
list = ValueList({"Globals": "https://app.speckle.systems/projects/fa2b5c68c0/models/73d1db8d95", "1.1 - Base_Surface": "https://app.speckle.systems/projects/fa2b5c68c0/models/1a387dc852", "1.4 - Planarization": "https://app.speckle.systems/projects/fa2b5c68c0/models/443f7f142a", "1.6 - Steel Design": "https://app.speckle.systems/projects/fa2b5c68c0/models/8b61bd92e6", "2.3 - Simple Model": "https://app.speckle.systems/projects/fa2b5c68c0/models/a04d32c35b", "2.4 - Detail Model": "https://app.speckle.systems/projects/fa2b5c68c0/models/a0711d77a8", "2.5 - Steel Development Model": "https://app.speckle.systems/projects/fa2b5c68c0/models/a207298a91", "3.3 - Fabrication Model ElementBase": "https://app.speckle.systems/projects/fa2b5c68c0/models/cd0b44e1b9"}, selected="Globals")
# - Title -
# Sub Title
# Evaluation
# Speckle
panel = Panel("https://app.speckle.systems/projects/fa2b5c68c0/models/b3338414f5")

list_2 = ValueList({"Globals": "https://app.speckle.systems/projects/fa2b5c68c0/models/73d1db8d95", "1.1 - Base_Surface": "https://app.speckle.systems/projects/fa2b5c68c0/models/1a387dc852", "1.4 - Planarization": "https://app.speckle.systems/projects/fa2b5c68c0/models/443f7f142a", "1.6 - Steel Design": "https://app.speckle.systems/projects/fa2b5c68c0/models/8b61bd92e6", "2.3 - Simple Model": "https://app.speckle.systems/projects/fa2b5c68c0/models/a04d32c35b", "2.4 - Detail Model": "https://app.speckle.systems/projects/fa2b5c68c0/models/a0711d77a8", "2.5 - Steel Development Model": "https://app.speckle.systems/projects/fa2b5c68c0/models/a207298a91", "3.3 - Fabrication Model ElementBase": "https://app.speckle.systems/projects/fa2b5c68c0/models/cd0b44e1b9"}, selected="1.1 - Base_Surface")
panel_2 = Panel(list_2)
receive = Receive(
    Stream=panel_2,
    AutoReceive=False,
    CurrentComponentState="up_to_date",
    ExpandOutput=True,
    LastInfoMessage="Lasath Siriwardena @ 06/10/2024 15:38:48: [Rev 7] Updated according to DD15+ IBB T130V01 (id:ceb9de41df)",
    ReceiveOnOpen=False,
    ReceivedCommitId="ceb9de41df",
    StreamWrapper="https://app.speckle.systems/projects/fa2b5c68c0/models/01-design/1-base_surface",
    selectedKitName="Objects")  # -> Info, Data
dso = DeconstructSpeckleObject(SpeckleObject=receive.Data, selectedKitName="Objects")  # -> Base_Surfaces, Brims, ChangeLog, Columns, Facade, Grid, Parent, Skylight_Shell

list_3 = ValueList({"Globals": "https://app.speckle.systems/projects/fa2b5c68c0/models/73d1db8d95", "1.1 - Base_Surface": "https://app.speckle.systems/projects/fa2b5c68c0/models/1a387dc852", "1.4 - Planarization": "https://app.speckle.systems/projects/fa2b5c68c0/models/443f7f142a", "1.6 - Steel Design": "https://app.speckle.systems/projects/fa2b5c68c0/models/8b61bd92e6", "2.3 - Simple Model": "https://app.speckle.systems/projects/fa2b5c68c0/models/a04d32c35b", "2.4 - Detail Model": "https://app.speckle.systems/projects/fa2b5c68c0/models/a0711d77a8", "2.5 - Steel Development Model": "https://app.speckle.systems/projects/fa2b5c68c0/models/a207298a91", "3.3 - Fabrication Model ElementBase": "https://app.speckle.systems/projects/fa2b5c68c0/models/cd0b44e1b9"}, selected="2.3 - Simple Model")
panel_3 = Panel(list_3)
receive_2 = Receive(
    Stream=panel_3,
    AutoReceive=False,
    CurrentComponentState="up_to_date",
    ExpandOutput=True,
    LastInfoMessage="Lasath Siriwardena @ 02/02/2026 07:15:46: [LPH5 Rev_7]DataDrop - DD17 WIP - Update Beam Widths (id:1cc5d3afe4)",
    ReceiveOnOpen=False,
    ReceivedCommitId="1cc5d3afe4",
    StreamWrapper="https://app.speckle.systems/projects/fa2b5c68c0/models/02-development/3-simple_model",
    selectedKitName="Objects")  # -> Info, Data
dso_2 = DeconstructSpeckleObject(SpeckleObject=receive_2.Data, selectedKitName="Objects")  # -> Parent, ReleaseNotes, Simple_Solids

sm = SpeckleModel(SpeckleUrl=panel, Server="https://app.speckle.systems", User="3768D47CC42C8B39627DD14A8B3B9221", Workspace="d845309581")
L = Load(SpeckleModel=sm, AutoReceive=False)  # -> Collection, Properties
panel_4 = Panel(list)
cselect = CollectionSelector(L.Collection, AutoSelectAllItems=False)
receive_3 = Receive(
    Stream=panel_4,
    AutoReceive=False,
    CurrentComponentState="up_to_date",
    ExpandOutput=True,
    LastInfoMessage="Lasath Siriwardena @ 02/22/2024 09:01:18: Updated Acoustics based on A610 V DD12 (id:2c90bcf47d)",
    ReceiveOnOpen=False,
    ReceivedCommitId="2c90bcf47d",
    StreamWrapper="https://app.speckle.systems/projects/fa2b5c68c0/models/globals",
    selectedKitName="Objects")  # -> Info, ArchicadMiddleTopOfGrid1, Cassette, Material, Steel
dso_3 = DeconstructSpeckleObject(SpeckleObject=dso.Facade, selectedKitName="Objects")  # -> IFC, Mesh, Outline
dso_4 = DeconstructSpeckleObject(SpeckleObject=receive_3.ArchicadMiddleTopOfGrid1, selectedKitName="Objects")  # -> X, Y, Z
dso_5 = DeconstructSpeckleObject(SpeckleObject=dso_2.Simple_Solids, selectedKitName="Objects")  # -> Acoustic, Id, IsOutsourced, RenderMaterial, Shell, ShellExtraPeices, ShellJSON, ShellPreCut, Type
qo = QuerySpeckleObjects(Collection=L.Collection, Path=cselect)
crv = Curve(dso_3.Outline)
geo = Geometry(dso_3.Outline)
pt = ConstructPoint(XCoordinate=dso_4.X, YCoordinate=dso_4.Y, ZCoordinate=dso_4.Z)
sdo = SpeckleDataObject(SpeckleDataObject=qo)  # -> SpeckleDataObject, Geometries, Name, Properties, Path
move = Move(Geometry=geo, Motion=pt)  # -> Geometry, Transform
dso_6 = DeconstructSpeckleObject(SpeckleObject=dso_5.ShellPreCut, selectedKitName="Objects")  # -> BottomContour, BottomHoles, FourValentEdgePlanes, MitrePlanes, Segment, TopContour
pselect = PropertySelector(sdo.Properties, AutoSelectAllItems=False)
pselect_2 = PropertySelector(sdo.Properties, AutoSelectAllItems=False)
qp = QueryProperties(Properties=sdo.Properties, Keys=pselect)
qp_2 = QueryProperties(Properties=sdo.Properties, Keys=pselect_2)  # -> flatten(Values)
string_filter = StringFilter(Text=qp_2, Object=sdo.SpeckleDataObject, Key="Konstruktionsvollholz")  # -> Text, ObjectIn, ObjectOut
string_filter_2 = StringFilter(Text=flatten(qp), Object=string_filter.ObjectIn, Key="DG")  # -> Text, ObjectIn, ObjectOut
clean = CleanTree(RemoveNulls=True, RemoveInvalid=True, RemoveEmpty=False, Tree=string_filter_2.ObjectIn)
sdo_2 = SpeckleDataObject(SpeckleDataObject=clean)  # -> SpeckleDataObject, Geometries, Name, Properties, Path
number_slider = Slider(10.4, range=0..100)
area = Area(Geometry=sdo_2.Geometries)  # -> Area, Centroid
pdecon = Deconstruct(Point=area.Centroid)  # -> XComponent, YComponent, ZComponent
larger = LargerThan(FirstNumber=pdecon.ZComponent, SecondNumber=number_slider)  # -> LargerThan, OrEqualTo
cull = CullPattern(List=sdo_2.Geometries, CullPattern=larger.LargerThan)  # -> flatten(List)
sg = SpeckleGeometry(SpeckleGeometry=cull)  # -> SpeckleGeometry, Geometry, Name, Properties, Color, Material, Path
clean_2 = CleanTree(RemoveNulls=True, RemoveInvalid=True, RemoveEmpty=False, Tree=sg.Geometry)
demesh = DeconstructMesh(Mesh=clean_2)  # -> Vertices, Faces, Colours, Normals
pdecon_2 = Deconstruct(Point=demesh.Vertices)  # -> XComponent, YComponent, ZComponent
sort = SortList(Keys=pdecon_2.ZComponent, ValuesA=demesh.Vertices)  # -> Keys, ValuesA
item = ListItem(List=sort.Keys, Index=0, Wrap=True)
larger_2 = LargerThan(FirstNumber=item, SecondNumber=number_slider)  # -> LargerThan, OrEqualTo
cull_2 = CullPattern(List=sg.Geometry, CullPattern=flatten(larger_2.LargerThan))  # -> flatten(List)
demesh_2 = DeconstructMesh(Mesh=cull_2)  # -> Vertices, Faces, Colours, Normals
project = Project(Geometry=demesh_2.Vertices, Plane=PlaneXY(0, 0, 0))  # -> Geometry, Transform
brec = BoundingRectangle(Geometry=flatten(project.Geometry), Plane=PlaneXY(0, 0, 0), Axis=0, Slide=0, Union=True)  # -> Bounding, DimensionX, DimensionY
brec_2 = BoundingRectangle(Geometry=project.Geometry, Plane=PlaneXY(0, 0, 0), Axis=0, Slide=0, Union=True)  # -> flatten(Bounding), DimensionX, DimensionY
neg = Negative(Value=Slider(0.14, range=0..1))
offset = OffsetCurve(Curve=brec.Bounding, Distance=neg, Corners=1)
ccx = CurveCurve(CurveA=brec_2.Bounding, CurveB=offset)  # -> Points, ParamsA, ParamsB
lng = ListLength(List=ccx.Points)
larger_3 = LargerThan(FirstNumber=lng, SecondNumber=0)  # -> LargerThan, OrEqualTo
swatch = ColourSwatch(SwatchColor=RGBA(255, 0, 0, 119))
cull_3 = CullPattern(List=brec_2.Bounding, CullPattern=invert(flatten(larger_3.LargerThan)))
cull_4 = CullPattern(List=cull_2, CullPattern=invert(flatten(larger_3.LargerThan)))
preview = CustomPreview(Geometry=cull_4, Material=swatch)
boundary = BoundarySurfaces(Edges=cull_3)
brec_3 = BoundingRectangle(Geometry=graft(boundary), Plane=PlaneXY(0, 0, 0), Axis=0, Slide=0, Union=True)  # -> Bounding, DimensionX, DimensionY
pln = Plane(brec_3.Bounding)
explode = Explode(Curve=brec_3.Bounding, Recursive=True)  # -> Segments, Vertices
area_2 = Area(Geometry=brec_3.Bounding)  # -> Area, Centroid
cluster = Cluster(L_2=cull_2, P_2=larger_3.LargerThan, L=brec_2.Bounding, P=larger_3.LargerThan, M=swatch)
len = Length(Curve=explode.Segments)
pl_origin = PlaneOrigin(Base=pln, Origin=area_2.Centroid)
sort_2 = SortList(Keys=len, ValuesA=explode.Segments)  # -> Keys, reverse(ValuesA)
item_2 = ListItem(List=sort_2.ValuesA, Index=0, Wrap=True)
align = AlignPlane(Plane=pl_origin, Direction=item_2)  # -> Plane, Angle
deplane = DeconstructPlane(Plane=align.Plane)  # -> Origin, XAxis, YAxis, ZAxis
pl = ConstructPlane(Origin=deplane.Origin, XAxis=deplane.XAxis, YAxis=deplane.ZAxis)
pcx = CurvePlane(Curve=brec_3.Bounding, Plane=pl)  # -> Points, ParamsC, ParamsP
pline = PolyLine(Vertices=pcx.Points, Closed=False)
len_2 = Length(Curve=pline)
smaller = SmallerThan(FirstNumber=len_2, SecondNumber=Slider(0.3, range=0..1))  # -> SmallerThan, OrEqualTo
cull_5 = CullPattern(List=brec_3.Bounding, CullPattern=invert(smaller.SmallerThan))  # -> flatten(List)
cull_6 = CullPattern(List=pline, CullPattern=invert(smaller.SmallerThan))  # -> flatten(List)
neg_2 = Negative(Value=Slider(0.1, range=0..1))
drec = DeconstructRectangle(Rectangle=cull_5)  # -> BasePlane, XInterval, YInterval
ext = ExtendCurve(Curve=cull_6, Type=0, Start=neg_2, End=neg_2)
boundary_2 = BoundarySurfaces(Edges=dso_6.BottomContour)
num = Number(drec.YInterval)
num_2 = Number(drec.XInterval)
min = Minimum(A=num_2, B=num)
geo_2 = Geometry(dso_6.Segment)
geo_3 = Geometry(dso_6.MitrePlanes)
pln_2 = Plane(boundary_2)
brec_4 = BoundingRectangle(Geometry=ext, Plane=PlaneXY(0, 0, 0), Axis=0, Slide=0, Union=True)  # -> Bounding, DimensionX, DimensionY
roundd = RoundToDecimalPlace(NumberX=min, DecimalPlace=3, RoundType=0)  # -> Rounded, Difference
Z = UnitZ(Factor=Slider(35, range=0..100))
c_script_2 = CSharpScript(x=roundd.Rounded)  # -> out, a; inputs x: list of Double
# ---------- c_script_2: C# ----------
// Grasshopper Script Instance
#region Usings
using System;
using System.Linq;
using System.Collections;
using System.Collections.Generic;
using System.Drawing;

using Rhino;
using Rhino.Geometry;

using Grasshopper;
using Grasshopper.Kernel;
using Grasshopper.Kernel.Data;
using Grasshopper.Kernel.Types;
#endregion

public class Script_Instance : GH_ScriptInstance
{
    #region Notes
    /* 
      Members:
        RhinoDoc RhinoDocument
        GH_Document GrasshopperDocument
        IGH_Component Component
        int Iteration

      Methods (Virtual & overridable):
        Print(string text)
        Print(string format, params object[] args)
        Reflect(object obj)
        Reflect(object obj, string method_name)
    */
    #endregion

    private void RunScript(List<double> x, object y, ref object a)
    {
        var list = x.Distinct().ToList();
        if(list.Count > 1)
            this.AddRuntimeMessage(GH_RuntimeMessageLevel.Error,"There is multiple lengths!!!!");
        else a = list;
    }
}
# ---------- end c_script_2 ----------
preview_2 = CustomPreview(Geometry=geo_2, Material=ColourSwatch(SwatchColor=RGBA(201, 201, 201, 119)))
division = Division(A=c_script_2.a, B=2)
neg_3 = Negative(Value=division)
offcrv = OffsetCurve(Curve=brec_4.Bounding, Plane=PlaneXY(0, 0, 0), Distance=division, BothSides=neg_3, Kinks=0, CapType=1)
extr = Extrude(Base=offcrv, Direction=Z)
bbx = BrepBrep(BrepA=boundary_2, BrepB=extr)  # -> Curves, Points
clean_3 = CleanTree(RemoveNulls=True, RemoveInvalid=True, RemoveEmpty=True, Tree=bbx.Curves)  # -> simplify(Tree)
trim = TrimTree(Depth=1)
tstat = TreeStatistics(Tree=clean_3)  # -> Paths, Length, Count
split = SplitTree(Data=simplify(dso_6.BottomContour), Masks=flatten(tstat.Paths))  # -> Positive, Negative
split_2 = SplitTree(Data=simplify(geo_3), Masks=flatten(tstat.Paths))  # -> Positive, Negative
lng_2 = ListLength(List=split_2.Positive)
pcx_2 = CurvePlane(Curve=clean_3, Plane=split_2.Positive)  # -> Points, ParamsC, ParamsP
dup = DuplicateData(Data=split.Positive, Number=lng_2, Order=True)  # -> simplify(graft(Data))
tstat_2 = TreeStatistics(Tree=pcx_2.Points)  # -> Paths, Length, Count
clean_4 = CleanTree(RemoveNulls=True, RemoveInvalid=True, RemoveEmpty=True, Tree=pcx_2.Points)
crv_cp = CurveClosestPoint(Point=pcx_2.Points, Curve=dup)  # -> Point, Parameter, Distance
smaller_2 = SmallerThan(FirstNumber=crv_cp.Distance, SecondNumber=0.01)  # -> SmallerThan, OrEqualTo
cull_7 = CullPattern(List=clean_4, CullPattern=smaller_2.SmallerThan)
clean_5 = CleanTree(RemoveNulls=True, RemoveInvalid=True, RemoveEmpty=True, Tree=cull_7)
tstat_3 = TreeStatistics(Tree=clean_5)  # -> Paths, Length, Count
split_3 = SplitTree(Data=simplify(graft(split_2.Positive)), Masks=flatten(tstat_3.Paths))  # -> Positive, Negative
pl_origin_2 = PlaneOrigin(Base=split_3.Positive, Origin=clean_5)
number_slider_2 = Slider(0.02, range=0..0.1)
dom = ConstructDomain(DomainStart=expr("-x/2", number_slider_2), DomainEnd=expr("x/2", number_slider_2))
rectangle = Rectangle(Plane=pl_origin_2, XSize=dom, YSize=Domain(-2, 2), Radius=0)  # -> Rectangle, Length
division_2 = Division(A=Slider(0.008, range=0..0.01), B=2)
boundary_3 = BoundarySurfaces(Edges=rectangle.Rectangle)
offsrf = OffsetSurface(Surface=boundary_3, Distance=division_2, BothSides=0, CreateSolid=True)

# ==== cluster Cluster
L = ClusterInput()
P = ClusterInput()
L_2 = ClusterInput()
P_2 = ClusterInput()
M = ClusterInput()
cull = CullPattern(List=L, CullPattern=invert(flatten(P)))
cull_2 = CullPattern(List=L_2, CullPattern=invert(flatten(P_2)))
preview = CustomPreview(Geometry=cull_2, Material=M)
boundary = BoundarySurfaces(Edges=cull)
brec = BoundingRectangle(Geometry=graft(boundary), Plane=PlaneXY(0, 0, 0), Axis=0, Slide=0, Union=True)  # -> Bounding, DimensionX, DimensionY
pln = Plane(brec.Bounding)
explode = Explode(Curve=brec.Bounding, Recursive=True)  # -> Segments, Vertices
area = Area(Geometry=brec.Bounding)  # -> Area, Centroid
len = Length(Curve=explode.Segments)
pl_origin = PlaneOrigin(Base=pln, Origin=area.Centroid)
sort = SortList(Keys=len, ValuesA=explode.Segments)  # -> Keys, reverse(ValuesA)
item = ListItem(List=sort.ValuesA, Index=0, Wrap=True)
