# Grasshopper definition SampleDefinition.ghx (Grasshopper 1.0.8)

# ---- group: Random Point Generation
number_slider = Slider(1000, range=0..1000)
rectangle = Rectangle(Plane=PlaneXY(0, 0, 0), XSize=number_slider, YSize=number_slider, Radius=0)  # -> Rectangle, Length
c_script = CSharpScript(rectangle=rectangle.Rectangle)  # -> out, a; inputs rectangle: Rectangle3d
# ---------- c_script: C# ----------
// Grasshopper Script Instance
#region Usings
using System;
using System.Linq;
using System.Collections;
using System.Collections.Generic;
using System.Drawing;

using Rhino;
using Rhino.Geometry;

using Grasshopper;
using Grasshopper.Kernel;
using Grasshopper.Kernel.Data;
using Grasshopper.Kernel.Types;
#endregion

public class Script_Instance : GH_ScriptInstance
{
  private void RunScript(Rectangle3d rectangle, ref object a)
  {
    Plane pl = rectangle.Plane;
    double w = rectangle.X.Length;
    double h = rectangle.Y.Length;

    if (w <= RhinoMath.ZeroTolerance || h <= RhinoMath.ZeroTolerance)
    {
      a = new List<Point3d>();
      return;
    }

    double targetStep = Math.Min(w, h) / 18.0;
    int nu = Math.Max(6, (int)Math.Round(w / targetStep));
    int nv = Math.Max(6, (int)Math.Round(h / targetStep));

    double amp = 0.14;
    double freq = 2.8;
    double twist = 2.2;

    List<Point3d> pts = new List<Point3d>(nu * nv);

    for (int j = 0; j < nv; j++)
    {
      double v = (nv == 1) ? 0.5 : (double)j / (double)(nv - 1);

      for (int i = 0; i < nu; i++)
      {
        double u = (nu == 1) ? 0.5 : (double)i / (double)(nu - 1);

        double uc = u - 0.5;
        double vc = v - 0.5;
        double r = Math.Sqrt(uc * uc + vc * vc);

        double ang = twist * (0.5 - r);
        double ca = Math.Cos(ang);
        double sa = Math.Sin(ang);

        double ur = 0.5 + (uc * ca - vc * sa);
        double vr = 0.5 + (uc * sa + vc * ca);

        double uWarp = ur + amp * Math.Sin(2.0 * Math.PI * (freq * vr + 0.35 * Math.Sin(2.0 * Math.PI * ur)));
        double vWarp = vr + amp * Math.Cos(2.0 * Math.PI * (freq * ur - 0.35 * Math.Cos(2.0 * Math.PI * vr)));

        double pull = 0.18 * Math.Exp(-3.2 * r);
        uWarp = uWarp + (0.5 - uWarp) * pull;
        vWarp = vWarp + (0.5 - vWarp) * pull;

        uWarp = Math.Max(0.0, Math.Min(1.0, uWarp));
        vWarp = Math.Max(0.0, Math.Min(1.0, vWarp));

        double x = rectangle.X.T0 + uWarp * rectangle.X.Length;
        double y = rectangle.Y.T0 + vWarp * rectangle.Y.Length;

        Point3d p = pl.Origin + pl.XAxis * x + pl.YAxis * y;
        pts.Add(p);
      }
    }

    a = pts;
  }
}
# ---------- end c_script ----------

# ---- group: Tower Create
xy = XYPlane(Origin=c_script.a)
cluster = Cluster(P=graft(xy))

# ---- group: Output
geo = Geometry(cluster)

# ==== cluster Cluster
P = ClusterInput()
number_slider = Slider(46, range=0..100)
rectangle = Rectangle(Plane=P, XSize=Slider(15, range=0..100), YSize=Slider(20, range=0..100), Radius=0)  # -> Rectangle, Length
series = Series(Start=0, Step=1, Count=number_slider)
Z = UnitZ(Factor=series)
move = Move(Geometry=rectangle.Rectangle, Motion=Z)  # -> Geometry, Transform
series_2 = Series(Start=0, Step=Slider(6, range=0..100), Count=number_slider)
area = Area(Geometry=move.Geometry)  # -> Area, Centroid
rotate = Rotate(Geometry=move.Geometry, Angle=degrees(series_2), Plane=area.Centroid)  # -> Geometry, Transform
boundary = BoundarySurfaces(Edges=rotate.Geometry)
offsrf = OffsetSurface(Surface=boundary, Distance=Slider(0.1, range=0..1), BothSides=0, CreateSolid=True)
O = ClusterOutput(offsrf)
