# Grasshopper definition SampleDefinition_Modified.ghx (Grasshopper 1.0.8)

# ---- group: Random Point Generation
number_slider = Slider(1000, range=0..1000)
rectangle = Rectangle(Plane=PlaneXY(0, 0, 0), XSize=number_slider, YSize=number_slider, Radius=0)  # -> Rectangle, Length
c_script = CSharpScript(rectangle=rectangle.Rectangle)  # -> out, a; inputs rectangle: Rectangle3d
# ---------- c_script: C# ----------
// Grasshopper Script Instance
#region Usings
using System;
using System.Linq;
using System.Collections;
using System.Collections.Generic;
using System.Drawing;

using Rhino;
using Rhino.Geometry;

using Grasshopper;
using Grasshopper.Kernel;
using Grasshopper.Kernel.Data;
using Grasshopper.Kernel.Types;
#endregion

public class Script_Instance : GH_ScriptInstance
{
  private void RunScript(Rectangle3d rectangle, ref object a)
  {
    Plane pl = rectangle.Plane;
    double w = rectangle.X.Length;
    double h = rectangle.Y.Length;

    List<Point3d> pts = new List<Point3d>();
    if (w <= RhinoMath.ZeroTolerance || h <= RhinoMath.ZeroTolerance)
    {
      a = pts;
      return;
    }

    Point3d c = rectangle.Center;
    double rMax = 0.5 * Math.Min(w, h);

    double phi = (1.0 + Math.Sqrt(5.0)) * 0.5;
    double b = Math.Log(phi) / (Math.PI * 0.5);

    int n = 280;
    int turns = 7;

    double tMax = turns * 2.0 * Math.PI;

    for (int i = 0; i < n; i++)
    {
      double t = (n == 1) ? 0.0 : (double)i / (double)(n - 1) * tMax;

      double r = rMax * (Math.Exp(b * t) - 1.0) / (Math.Exp(b * tMax) - 1.0);

      double x = r * Math.Cos(t);
      double y = r * Math.Sin(t);

      Point3d p = c + pl.XAxis * x + pl.YAxis * y;

      double u = rectangle.X.T0 + (p - pl.Origin) * pl.XAxis;
      double v = rectangle.Y.T0 + (p - pl.Origin) * pl.YAxis;

      if (u >= rectangle.X.T0 - 1e-9 && u <= rectangle.X.T1 + 1e-9 &&
          v >= rectangle.Y.T0 - 1e-9 && v <= rectangle.Y.T1 + 1e-9)
      {
        pts.Add(p);
      }
      else
      {
        Vector3d d = p - c;
        double ax = Math.Abs(d * pl.XAxis);
        double ay = Math.Abs(d * pl.YAxis);
        double s = 1.0;

        double halfW = 0.5 * w;
        double halfH = 0.5 * h;

        if (ax > RhinoMath.ZeroTolerance) s = Math.Min(s, halfW / ax);
        if (ay > RhinoMath.ZeroTolerance) s = Math.Min(s, halfH / ay);

        Point3d p2 = c + d * s;
        pts.Add(p2);
      }
    }

    a = pts;
  }
}
# ---------- end c_script ----------

# ---- group: Tower Create
xy = XYPlane(Origin=c_script.a)
cluster = Cluster(P=graft(xy))

# ---- group: Output
geo = Geometry(cluster)

# ==== cluster Cluster
number_slider = Slider(10, range=0..100)
P = ClusterInput()
rectangle = Rectangle(Plane=P, XSize=Slider(15, range=0..100), YSize=Slider(20, range=0..100), Radius=0)  # -> Rectangle, Length
series = Series(Start=0, Step=Slider(15, range=0..100), Count=number_slider)
Z = UnitZ(Factor=series)
move = Move(Geometry=rectangle.Rectangle, Motion=Z)  # -> Geometry, Transform
series_2 = Series(Start=0, Step=Slider(6, range=0..100), Count=number_slider)
area = Area(Geometry=move.Geometry)  # -> Area, Centroid
rotate = Rotate(Geometry=move.Geometry, Angle=degrees(series_2), Plane=area.Centroid)  # -> Geometry, Transform
deplane = DeconstructPlane(Plane=P)  # -> Origin, XAxis, YAxis, ZAxis
area_2 = Area(Geometry=rotate.Geometry)  # -> Area, Centroid
avr = Average(Input=flatten(area_2.Centroid))
line = LineSDL(Start=area_2.Centroid, Direction=deplane.YAxis, Length=1)
dist = Distance(PointA=area_2.Centroid, PointB=avr)
sort = SortList(Keys=flatten(dist))  # -> Keys, ValuesA
item = ListItem(List=sort.Keys, Index=0, Wrap=True)  # -> Item1, Item
dom = ConstructDomain(DomainStart=item.Item, DomainEnd=item.Item1)
dom_2 = ConstructDomain(DomainStart=Slider(0, range=0..100), DomainEnd=Slider(90, range=0..100))
remap = RemapNumbers(Value=dist, Source=dom, Target=dom_2)  # -> Mapped, Clipped
rotax = RotateAxis(Geometry=rotate.Geometry, Angle=degrees(remap.Mapped), Axis=line)  # -> Geometry, Transform
boundary = BoundarySurfaces(Edges=rotax.Geometry)
offsrf = OffsetSurface(Surface=boundary, Distance=Slider(0.1, range=0..1), BothSides=0, CreateSolid=True)
O = ClusterOutput(offsrf)
