# Grasshopper definition syn1000-old.ghx
# synthetic

mult = Multiplication(A=2.407, B=6.792)
rang = Range(A=mult, B=mult)
line = Line(A=mult, B=mult)
loft = Loft(A=mult, B=5.328)
shif = ShiftList(A=7.629, B=mult)
divi = DivideCurve(A=mult, B=rang)
cull = CullPattern(A=4.011, B=rang)
mult_2 = Multiplication(A=3.386, B=4.486)
addi = Addition(A=mult, B=rang)
divi_2 = DivideCurve(A=divi, B=2.7)
line_2 = Line(A=3.29, B=addi)
cons = ConstructPoint(A=8.122, B=addi)
line_3 = Line(A=divi, B=addi)
cull_2 = CullPattern(A=4.469, B=addi)
cons_2 = ConstructPoint(A=<missing>, B=2.388)
loft_2 = Loft(A=rang, B=5.207)
mult_3 = Multiplication(A=line_2, B=addi)
divi_3 = DivideCurve(A=mult, B=line)
cons_3 = ConstructPoint(A=line, B=9.172)
move = Move(A=addi, B=8.682)
rang_2 = Range(A=8.676, B=rang)
rota = Rotate(A=mult_3, B=mult_3)
line_4 = Line(A=<missing>, B=6.575)
shif_2 = ShiftList(A=4.041, B=9.679)
seri = Series(A=addi, B=1.264)  # -> R
# ---------- seri: C# ----------
int a = 285;
return a * 2;
# ---------- end seri ----------
cons_4 = ConstructPoint(A=4.239, B=8.928)
cons_5 = ConstructPoint(A=mult, B=rang)
shif_3 = ShiftList(A=5.192, B=7.383)
seri_2 = Series(A=line_2, B=rang_2)
disp = Dispatch(A=cons_5, B=6.943)
cons_6 = ConstructPoint(A=divi, B=9.845)
line_5 = Line(A=4.383, B=addi)
mult_4 = Multiplication(A=9.664, B=6.96)
cons_7 = ConstructPoint(A=<missing>, B=1.264)
rang_3 = Range(A=line_2, B=mult_3)
cons_8 = ConstructPoint(A=disp, B=seri_2)
mult_5 = Multiplication(A=4.011, B=addi)
rota_2 = Rotate(A=<missing>, B=8.898)
seri_3 = Series(A=3.958, B=7.345)
line_6 = Line(A=8.563, B=divi_3)
rang_4 = Range(A=mult_3, B=<missing>)  # -> R
# ---------- rang_4: C# ----------
int a = 815;
return a * 2;
# ---------- end rang_4 ----------
seri_4 = Series(A=7.263, B=line_4)
seri_5 = Series(A=mult, B=addi)
flip = FlipMatrix(A=mult, B=line_5)
shif_4 = ShiftList(A=<missing>, B=cons_7)
rang_5 = Range(A=4.59, B=line_3)
cull_3 = CullPattern(A=6.227, B=mult_3)
line_7 = Line(A=<missing>, B=6.266)
cons_9 = ConstructPoint(A=mult_4, B=1.241)
cons_10 = ConstructPoint(A=7.477, B=rang_2)
flip_2 = FlipMatrix(A=addi, B=rang_3)
seri_6 = Series(A=rota, B=disp)  # -> R
# ---------- seri_6: C# ----------
int a = 73;
return a * 2;
# ---------- end seri_6 ----------
seri_7 = Series(A=cons, B=<missing>)
mult_6 = Multiplication(A=7.527, B=addi)
divi_4 = DivideCurve(A=7.288, B=6.853)
line_8 = Line(A=rang_3, B=divi)
rang_6 = Range(A=rota, B=flip_2)
mult_7 = Multiplication(A=divi, B=cons_10)
seri_8 = Series(A=mult_4, B=cons_5)
move_2 = Move(A=<missing>, B=mult_5)
cons_11 = ConstructPoint(A=<missing>, B=<missing>)
loft_3 = Loft(A=seri_5, B=3.927)
flip_3 = FlipMatrix(A=2.888, B=<missing>)
addi_2 = Addition(A=line, B=0.137)
line_9 = Line(A=cons_8, B=seri_3)
cluster632 = Cluster(In=line_3)
loft_4 = Loft(A=cons_10, B=cons_10)
seri_9 = Series(A=rota, B=3.771)
cons_12 = ConstructPoint(A=seri_8, B=<missing>)
loft_5 = Loft(A=cons_6, B=8.085)
flip_4 = FlipMatrix(A=<missing>, B=seri_5)
seri_10 = Series(A=mult_7, B=loft)
cons_13 = ConstructPoint(A=loft_4, B=rang_2)
rota_3 = Rotate(A=cons_8, B=divi_2)
loft_6 = Loft(A=move_2, B=3.522)
flip_5 = FlipMatrix(A=8.049, B=cluster632)
rota_4 = Rotate(A=9.433, B=cons_7)
loft_7 = Loft(A=3.125, B=rota_4)
cons_14 = ConstructPoint(A=<missing>, B=cons_5)
rang_7 = Range(A=1.808, B=5.543)
seri_11 = Series(A=mult, B=line_2)
mult_8 = Multiplication(A=4.762, B=divi)
seri_12 = Series(A=mult, B=seri_6)
cons_15 = ConstructPoint(A=4.783, B=mult)  # -> R
# ---------- cons_15: C# ----------
int a = 232;
return a * 2;
# ---------- end cons_15 ----------
loft_8 = Loft(A=line_3, B=4.649)
cons_16 = ConstructPoint(A=<missing>, B=3.773)
rota_5 = Rotate(A=loft_6, B=addi_2)
disp_2 = Dispatch(A=5.198, B=rang_5)
rota_6 = Rotate(A=2.291, B=line_4)
loft_9 = Loft(A=seri_8, B=rota)
cluster729 = Cluster(In=line_8)
cull_4 = CullPattern(A=3.59, B=<missing>)
cons_17 = ConstructPoint(A=1.364, B=disp)
move_3 = Move(A=9.664, B=loft_4)
rang_8 = Range(A=divi, B=6.645)
cons_18 = ConstructPoint(A=cons_10, B=<missing>)
seri_13 = Series(A=seri_9, B=line_8)
rang_9 = Range(A=cons_7, B=1.435)
rota_7 = Rotate(A=5.294, B=shif_3)
addi_3 = Addition(A=8.31, B=8.605)
divi_5 = DivideCurve(A=rota_6, B=mult_5)
divi_6 = DivideCurve(A=3.235, B=<missing>)
seri_14 = Series(A=7.606, B=rang_3)
seri_15 = Series(A=7.913, B=3.921)
divi_7 = DivideCurve(A=line_8, B=divi)
cons_19 = ConstructPoint(A=<missing>, B=6.516)
rang_10 = Range(A=<missing>, B=3.493)
mult_9 = Multiplication(A=rang_10, B=line_4)
rang_11 = Range(A=mult_9, B=2.878)
addi_4 = Addition(A=mult_9, B=rang_2)
mult_10 = Multiplication(A=0.66, B=line_8)
cons_20 = ConstructPoint(A=rang, B=shif_2)
divi_8 = DivideCurve(A=cons, B=6.919)
rota_8 = Rotate(A=5.161, B=9.86)
rota_9 = Rotate(A=mult_3, B=seri_6)
seri_16 = Series(A=2.342, B=<missing>)
shif_5 = ShiftList(A=2.082, B=flip_5)
divi_9 = DivideCurve(A=<missing>, B=2.657)
mult_11 = Multiplication(A=0.148, B=9.142)
loft_10 = Loft(A=<missing>, B=seri_6)
line_10 = Line(A=6.164, B=seri_9)
cons_21 = ConstructPoint(A=<missing>, B=cull_2)
rota_10 = Rotate(A=9.184, B=<missing>)
cons_22 = ConstructPoint(A=9.767, B=mult_2)
mult_12 = Multiplication(A=<missing>, B=<missing>)
rota_11 = Rotate(A=<missing>, B=cons_5)  # -> R
# ---------- rota_11: C# ----------
int a = 20;
return a * 2;
# ---------- end rota_11 ----------
mult_13 = Multiplication(A=2.045, B=<missing>)
seri_17 = Series(A=0.093, B=<missing>)
mult_14 = Multiplication(A=4.662, B=rang_9)
line_11 = Line(A=addi_2, B=rang_6)
loft_11 = Loft(A=9.462, B=cons_13)
rota_12 = Rotate(A=loft_4, B=rang_2)
divi_10 = DivideCurve(A=seri_5, B=<missing>)
seri_18 = Series(A=mult_10, B=5.803)
mult_15 = Multiplication(A=seri_2, B=4.737)
addi_5 = Addition(A=7.356, B=8.053)
cons_23 = ConstructPoint(A=seri_2, B=<missing>)
line_12 = Line(A=rang_2, B=7.881)
seri_19 = Series(A=<missing>, B=seri_9)
addi_6 = Addition(A=2.006, B=mult)
disp_3 = Dispatch(A=rota_11, B=move_2)
line_13 = Line(A=3.103, B=0.361)
seri_20 = Series(A=rang_2, B=rota_11)
rang_12 = Range(A=<missing>, B=line_8)
shif_6 = ShiftList(A=5.446, B=addi)
rota_13 = Rotate(A=rang_6, B=shif_6)
move_4 = Move(A=cons_23, B=rota_12)
rota_14 = Rotate(A=<missing>, B=move_4)
loft_12 = Loft(A=mult, B=rota_14)
mult_16 = Multiplication(A=rang, B=loft_12)
line_14 = Line(A=loft_12, B=3.63)
move_5 = Move(A=mult, B=rota_14)
move_6 = Move(A=loft_12, B=mult)
line_15 = Line(A=rota_14, B=move_5)
loft_13 = Loft(A=move_6, B=addi)
cons_24 = ConstructPoint(A=cons_5, B=loft_13)
move_7 = Move(A=cons_24, B=mult_9)
cons_25 = ConstructPoint(A=move_7, B=rang)
addi_7 = Addition(A=cons_25, B=cons_24)
rota_15 = Rotate(A=cons_24, B=rota_13)
loft_14 = Loft(A=rang, B=cons_24)
disp_4 = Dispatch(A=9.286, B=move_7)
cons_26 = ConstructPoint(A=loft_12, B=move_7)
rota_16 = Rotate(A=rota_14, B=cons_25)
line_16 = Line(A=cons_25, B=line)
addi_8 = Addition(A=move_7, B=mult_9)
addi_9 = Addition(A=<missing>, B=loft_14)
line_17 = Line(A=mult, B=move_7)
line_18 = Line(A=line_14, B=loft_14)
disp_5 = Dispatch(A=move_5, B=divi)
rang_13 = Range(A=move_5, B=move_5)
divi_11 = DivideCurve(A=<missing>, B=move_5)
cons_27 = ConstructPoint(A=rang, B=loft_12)
rang_14 = Range(A=divi_2, B=disp_4)
line_19 = Line(A=5.459, B=rota_16)
cons_28 = ConstructPoint(A=disp_4, B=<missing>)
mult_17 = Multiplication(A=move_5, B=rota_13)
disp_6 = Dispatch(A=<missing>, B=rota_16)
shif_7 = ShiftList(A=rang, B=line_15)
rota_17 = Rotate(A=move_5, B=loft_12)
addi_10 = Addition(A=move_6, B=divi)
move_8 = Move(A=cons_24, B=move_6)
addi_11 = Addition(A=addi_8, B=addi_7)
seri_21 = Series(A=cons_27, B=<missing>)
line_20 = Line(A=loft_14, B=rota_13)
flip_6 = FlipMatrix(A=line_14, B=2.468)
disp_7 = Dispatch(A=mult_16, B=rota_17)
rang_15 = Range(A=disp_5, B=8.781)
seri_22 = Series(A=move_6, B=shif_7)
seri_23 = Series(A=<missing>, B=seri_22)
loft_15 = Loft(A=0.959, B=disp_5)
loft_16 = Loft(A=5.915, B=addi_7)
cons_29 = ConstructPoint(A=3.221, B=cons_25)
divi_12 = DivideCurve(A=rota_17, B=line_14)
line_21 = Line(A=seri_23, B=mult_3)
cull_5 = CullPattern(A=7.575, B=move_5)
rota_18 = Rotate(A=rota_14, B=mult)
cons_30 = ConstructPoint(A=addi_10, B=move_6)
seri_24 = Series(A=mult_9, B=rang_13)
disp_8 = Dispatch(A=3.942, B=loft_13)
addi_12 = Addition(A=<missing>, B=loft_16)
divi_13 = DivideCurve(A=cull, B=line_15)
mult_18 = Multiplication(A=3.876, B=divi_13)
divi_14 = DivideCurve(A=loft_2, B=cons_24)
line_22 = Line(A=rota_14, B=<missing>)
move_9 = Move(A=cons_27, B=cons_29)
seri_25 = Series(A=line_15, B=cons_26)
rang_16 = Range(A=cons_29, B=addi)
addi_13 = Addition(A=disp_6, B=4.813)
divi_15 = DivideCurve(A=line_4, B=cull_5)
rang_17 = Range(A=line_10, B=divi_15)
cons_31 = ConstructPoint(A=loft_13, B=rang_17)
disp_9 = Dispatch(A=move_8, B=mult_3)
addi_14 = Addition(A=shif_7, B=mult_3)
shif_8 = ShiftList(A=seri_22, B=mult_2)
move_10 = Move(A=divi_2, B=loft_15)
line_23 = Line(A=loft_13, B=divi)
addi_15 = Addition(A=line_19, B=divi_2)
rota_19 = Rotate(A=2.725, B=loft_12)
loft_17 = Loft(A=loft_12, B=line_5)
cull_6 = CullPattern(A=divi_15, B=rota)
move_11 = Move(A=disp, B=move_7)
seri_26 = Series(A=seri, B=loft_14)
mult_19 = Multiplication(A=mult_16, B=move_7)
cons_32 = ConstructPoint(A=loft_2, B=rang_17)
rota_20 = Rotate(A=disp_8, B=5.403)
move_12 = Move(A=4.08, B=seri_22)
divi_16 = DivideCurve(A=cull, B=loft_12)
line_24 = Line(A=cons, B=loft_13)
cons_33 = ConstructPoint(A=mult, B=line_15)
move_13 = Move(A=rota_19, B=rota)
rang_18 = Range(A=addi_8, B=divi)
rota_21 = Rotate(A=cons_30, B=line)
seri_27 = Series(A=8.332, B=cons_28)
divi_17 = DivideCurve(A=loft_14, B=3.153)
cons_34 = ConstructPoint(A=cons_30, B=1.938)
mult_20 = Multiplication(A=cons_31, B=loft_13)
mult_21 = Multiplication(A=rota_17, B=rota_14)
addi_16 = Addition(A=rota_17, B=disp_7)
loft_18 = Loft(A=loft_12, B=rang_2)
seri_28 = Series(A=divi_11, B=<missing>)
mult_22 = Multiplication(A=loft_12, B=mult_5)
addi_17 = Addition(A=cull_6, B=1.158)
flip_7 = FlipMatrix(A=cons_33, B=rang_2)
seri_29 = Series(A=divi_12, B=<missing>)
addi_18 = Addition(A=mult_16, B=8.159)
addi_19 = Addition(A=rang_6, B=line_15)
mult_23 = Multiplication(A=disp_7, B=2.254)
shif_9 = ShiftList(A=move_6, B=addi)
addi_20 = Addition(A=rang_5, B=divi_11)
divi_18 = DivideCurve(A=seri_2, B=move_13)
loft_19 = Loft(A=cons_26, B=<missing>)
move_14 = Move(A=cons_31, B=mult)
cons_35 = ConstructPoint(A=0.671, B=line_24)
addi_21 = Addition(A=shif_7, B=mult_3)
seri_30 = Series(A=line_2, B=rota_14)
rota_22 = Rotate(A=loft_18, B=cull_5)
divi_19 = DivideCurve(A=rota, B=loft_12)
mult_24 = Multiplication(A=divi_16, B=rang_6)
flip_8 = FlipMatrix(A=move_7, B=rang_5)
rota_23 = Rotate(A=disp_5, B=shif_2)
loft_20 = Loft(A=rota_14, B=disp_5)
seri_31 = Series(A=addi_17, B=0.019)
mult_25 = Multiplication(A=shif_3, B=addi_7)
divi_20 = DivideCurve(A=addi_19, B=mult_16)
flip_9 = FlipMatrix(A=0.607, B=move_5)
move_15 = Move(A=rang_6, B=mult_23)
addi_22 = Addition(A=mult_16, B=<missing>)
rang_19 = Range(A=1.131, B=divi_19)
mult_26 = Multiplication(A=cons_5, B=cons_30)
move_16 = Move(A=<missing>, B=rota_18)
cull_7 = CullPattern(A=rota_21, B=line)
line_25 = Line(A=1.768, B=mult_22)
line_26 = Line(A=addi_19, B=<missing>)
disp_10 = Dispatch(A=rota_16, B=seri_27)
rota_24 = Rotate(A=rang, B=move_5)
rota_25 = Rotate(A=rota_18, B=rota_24)
mult_27 = Multiplication(A=rota_25, B=6.167)
divi_21 = DivideCurve(A=rota_25, B=mult)
seri_32 = Series(A=rota_25, B=mult_9)
line_27 = Line(A=rota_25, B=<missing>)
cons_36 = ConstructPoint(A=cons_25, B=divi_21)
line_28 = Line(A=rang, B=divi_21)
disp_11 = Dispatch(A=mult_27, B=1.326)
cons_37 = ConstructPoint(A=divi_21, B=line_15)
cons_38 = ConstructPoint(A=line_27, B=rota_25)
rang_20 = Range(A=cons_38, B=line_19)
cons_39 = ConstructPoint(A=cons_38, B=cons)
divi_22 = DivideCurve(A=mult_27, B=9.78)
loft_21 = Loft(A=addi_19, B=cons_8)
rang_21 = Range(A=shif_7, B=line_8)
loft_22 = Loft(A=<missing>, B=rang_15)
rota_26 = Rotate(A=line_3, B=divi_11)
loft_23 = Loft(A=rang, B=move_7)
mult_28 = Multiplication(A=seri_24, B=mult_2)
move_17 = Move(A=cons_7, B=addi_21)
line_29 = Line(A=seri_6, B=cons_30)
seri_33 = Series(A=move_7, B=move_15)
line_30 = Line(A=shif_7, B=flip_9)
shif_10 = ShiftList(A=mult_5, B=move_5)
cons_40 = ConstructPoint(A=rang_18, B=2.225)
loft_24 = Loft(A=move_15, B=seri_8)
cull_8 = CullPattern(A=move_6, B=mult_23)
loft_25 = Loft(A=move_3, B=move_8)
rang_22 = Range(A=addi_22, B=loft_14)
line_31 = Line(A=8.425, B=addi_16)
divi_23 = DivideCurve(A=disp_4, B=loft_18)
line_32 = Line(A=shif_8, B=mult)
shif_11 = ShiftList(A=<missing>, B=disp_8)  # -> R
# ---------- shif_11: C# ----------
int a = 762;
return a * 2;
# ---------- end shif_11 ----------
disp_12 = Dispatch(A=<missing>, B=rang_21)
divi_24 = DivideCurve(A=shif_8, B=0.29)
seri_34 = Series(A=cons_33, B=disp_5)
cluster50 = Cluster(In=rota_19)
mult_29 = Multiplication(A=<missing>, B=divi_16)
rota_27 = Rotate(A=divi, B=line_15)
cons_41 = ConstructPoint(A=mult_23, B=seri_8)
move_18 = Move(A=mult_5, B=rota_17)
loft_26 = Loft(A=<missing>, B=flip_7)
rang_23 = Range(A=rang_11, B=cons_33)
addi_23 = Addition(A=cons_27, B=cull_6)
rota_28 = Rotate(A=rang, B=cull_5)
line_33 = Line(A=rota_14, B=addi_21)
seri_35 = Series(A=disp_7, B=rota_17)
shif_12 = ShiftList(A=cons_24, B=cons_12)
cons_42 = ConstructPoint(A=rang_18, B=move_2)
cons_43 = ConstructPoint(A=4.28, B=line_19)
rang_24 = Range(A=rota_15, B=seri_31)
cluster826 = Cluster(In=cons_39)
addi_24 = Addition(A=loft_16, B=line_21)
cons_44 = ConstructPoint(A=4.332, B=move_6)
seri_36 = Series(A=rota_28, B=rota_19)
addi_25 = Addition(A=rota_18, B=shif_7)
divi_25 = DivideCurve(A=cluster50, B=addi_21)
move_19 = Move(A=divi_25, B=2.103)
addi_26 = Addition(A=move_19, B=rang_17)
rang_25 = Range(A=move_19, B=8.913)
rota_29 = Rotate(A=divi_21, B=move_19)
loft_27 = Loft(A=move_19, B=cons_24)
move_20 = Move(A=<missing>, B=rota_29)
cons_45 = ConstructPoint(A=9.847, B=move_19)
seri_37 = Series(A=3.425, B=move_19)
rota_30 = Rotate(A=cons_45, B=shif_7)
seri_38 = Series(A=rota_29, B=9.141)
rota_31 = Rotate(A=6.402, B=cons_45)
rota_32 = Rotate(A=loft_27, B=5.598)
rota_33 = Rotate(A=move_19, B=mult_2)
move_21 = Move(A=cons_45, B=rang_13)
loft_28 = Loft(A=loft_27, B=seri_28)
seri_39 = Series(A=loft_22, B=rota_30)
cull_9 = CullPattern(A=mult_7, B=cons_45)
line_34 = Line(A=rota_17, B=shif_10)
rota_34 = Rotate(A=loft_17, B=1.853)
line_35 = Line(A=1.008, B=shif_9)
divi_26 = DivideCurve(A=loft_13, B=shif_4)
addi_27 = Addition(A=divi_2, B=cons_24)
line_36 = Line(A=shif_2, B=seri_37)
rota_35 = Rotate(A=move_19, B=addi_17)
addi_28 = Addition(A=rota_28, B=rota_2)
cons_46 = ConstructPoint(A=cons_37, B=seri_16)
seri_40 = Series(A=2.827, B=addi_7)
move_22 = Move(A=addi_25, B=rang_6)
move_23 = Move(A=<missing>, B=mult_29)
disp_13 = Dispatch(A=seri_35, B=<missing>)
flip_10 = FlipMatrix(A=line_24, B=6.471)
loft_29 = Loft(A=rota_14, B=mult_11)
line_37 = Line(A=cull_7, B=addi_19)
addi_29 = Addition(A=cons_25, B=6.266)
line_38 = Line(A=loft_24, B=mult_15)
seri_41 = Series(A=cons_19, B=cluster50)
cons_47 = ConstructPoint(A=divi_20, B=rota_19)
cluster147 = Cluster(In=divi_15)
loft_30 = Loft(A=seri_19, B=rang_13)
loft_31 = Loft(A=mult_5, B=cluster50)
addi_30 = Addition(A=loft_17, B=loft_3)
seri_42 = Series(A=addi_20, B=mult_22)
rota_36 = Rotate(A=loft_21, B=seri_19)
loft_32 = Loft(A=8.009, B=cluster50)
seri_43 = Series(A=flip_8, B=0.815)
move_24 = Move(A=seri_26, B=cons_25)
loft_33 = Loft(A=line_33, B=rota_11)
rang_26 = Range(A=7.564, B=loft_14)
rota_37 = Rotate(A=cons_39, B=seri_30)
rang_27 = Range(A=cons_38, B=line_8)
addi_31 = Addition(A=cons_5, B=5.112)
rang_28 = Range(A=flip_2, B=line_30)
rota_38 = Rotate(A=0.596, B=addi_19)
addi_32 = Addition(A=line_8, B=6.129)
addi_33 = Addition(A=5.689, B=8.024)
shif_13 = ShiftList(A=cons_33, B=<missing>)
loft_34 = Loft(A=move_15, B=seri_19)
rang_29 = Range(A=3.734, B=<missing>)
rota_39 = Rotate(A=2.073, B=0.161)
seri_44 = Series(A=line_30, B=cull)
divi_27 = DivideCurve(A=loft_17, B=divi_20)
addi_34 = Addition(A=<missing>, B=<missing>)
seri_45 = Series(A=8.673, B=move_10)
cull_10 = CullPattern(A=loft_31, B=mult_15)
cull_11 = CullPattern(A=line_8, B=mult_3)
divi_28 = DivideCurve(A=seri_36, B=seri_36)
flip_11 = FlipMatrix(A=rota_14, B=divi_10)
addi_35 = Addition(A=9.168, B=<missing>)
addi_36 = Addition(A=disp_7, B=<missing>)
seri_46 = Series(A=mult_8, B=addi_36)
cons_48 = ConstructPoint(A=2.405, B=seri_46)  # -> R
# ---------- cons_48: C# ----------
int a = 497;
return a * 2;
# ---------- end cons_48 ----------
move_25 = Move(A=cons_48, B=addi_7)
rota_40 = Rotate(A=cons_3, B=cons_48)
flip_12 = FlipMatrix(A=1.394, B=seri_46)
move_26 = Move(A=cons_24, B=seri_46)
mult_30 = Multiplication(A=seri_35, B=loft_4)
addi_37 = Addition(A=loft_17, B=divi_3)
move_27 = Move(A=cons_45, B=8.163)
loft_35 = Loft(A=0.875, B=seri_35)
seri_47 = Series(A=<missing>, B=flip_8)
addi_38 = Addition(A=seri_7, B=loft_21)
cons_49 = ConstructPoint(A=move_11, B=2.476)
rota_41 = Rotate(A=rota_24, B=9.391)
line_39 = Line(A=<missing>, B=0.8)
line_40 = Line(A=move_16, B=0.848)
addi_39 = Addition(A=cons_14, B=cons_48)
seri_48 = Series(A=<missing>, B=<missing>)
move_28 = Move(A=seri_11, B=rang_2)
line_41 = Line(A=rota_19, B=cons_5)
divi_29 = DivideCurve(A=loft_4, B=seri_9)
addi_40 = Addition(A=flip_9, B=cons_13)
move_29 = Move(A=rota_17, B=disp_5)
cons_50 = ConstructPoint(A=line, B=cluster50)
disp_14 = Dispatch(A=seri_20, B=cull_8)
divi_30 = DivideCurve(A=<missing>, B=cons_19)
cons_51 = ConstructPoint(A=cons_30, B=3.425)
disp_15 = Dispatch(A=<missing>, B=addi_35)
mult_31 = Multiplication(A=divi_25, B=rang_2)
line_42 = Line(A=shif_3, B=seri_47)
flip_13 = FlipMatrix(A=rota_22, B=9.188)
rang_30 = Range(A=disp_2, B=addi_35)
cull_12 = CullPattern(A=line_31, B=flip_3)
line_43 = Line(A=5.041, B=loft_15)
seri_49 = Series(A=<missing>, B=0.246)
cons_52 = ConstructPoint(A=9.621, B=2.957)
addi_41 = Addition(A=rang_19, B=8.348)
move_30 = Move(A=seri_20, B=7.664)
divi_31 = DivideCurve(A=mult_16, B=line_8)
seri_50 = Series(A=rota_28, B=flip_2)
loft_36 = Loft(A=line_5, B=cons_24)
addi_42 = Addition(A=loft_36, B=divi_2)
line_44 = Line(A=move_15, B=divi_7)
cons_53 = ConstructPoint(A=disp, B=cons_6)
cons_54 = ConstructPoint(A=7.88, B=<missing>)
cluster244 = Cluster(In=<missing>)
rota_42 = Rotate(A=2.665, B=disp_3)
cons_55 = ConstructPoint(A=cull_8, B=rang_21)
divi_32 = DivideCurve(A=disp_4, B=<missing>)
addi_43 = Addition(A=line_31, B=8.207)
rang_31 = Range(A=rang_6, B=rang_12)
divi_33 = DivideCurve(A=line_15, B=loft_15)
line_45 = Line(A=loft_23, B=disp_14)
loft_37 = Loft(A=<missing>, B=7.732)
loft_38 = Loft(A=cons_40, B=6.858)
divi_34 = DivideCurve(A=move_3, B=rota_11)
cons_56 = ConstructPoint(A=seri_36, B=divi_34)
move_31 = Move(A=cons_56, B=cons_24)
rota_43 = Rotate(A=rota_14, B=cons_56)
mult_32 = Multiplication(A=1.577, B=cons_56)
loft_39 = Loft(A=cons_56, B=mult)
divi_35 = DivideCurve(A=seri_23, B=cons_56)
loft_40 = Loft(A=line, B=cons_56)
mult_33 = Multiplication(A=move_31, B=move_31)
addi_44 = Addition(A=loft_39, B=divi_21)
mult_34 = Multiplication(A=move_31, B=mult)
disp_16 = Dispatch(A=rota_25, B=divi_35)
rota_44 = Rotate(A=mult_32, B=9.706)
divi_36 = DivideCurve(A=loft_40, B=mult_16)
addi_45 = Addition(A=cons_24, B=rota_43)
cons_57 = ConstructPoint(A=6.737, B=mult_32)
divi_37 = DivideCurve(A=divi_35, B=mult_33)
line_46 = Line(A=0.265, B=loft_40)
loft_41 = Loft(A=rota_15, B=divi_36)
move_32 = Move(A=rota_43, B=cons_48)
seri_51 = Series(A=rota_43, B=<missing>)
shif_14 = ShiftList(A=loft_14, B=cons_57)
line_47 = Line(A=move_5, B=cons_56)
rota_45 = Rotate(A=disp_5, B=cons_56)  # -> R
# ---------- rota_45: C# ----------
int a = 656;
return a * 2;
# ---------- end rota_45 ----------
divi_38 = DivideCurve(A=9.047, B=rota_43)
line_48 = Line(A=rang, B=move_32)
seri_52 = Series(A=addi_45, B=divi_11)
seri_53 = Series(A=6.096, B=line_46)
addi_46 = Addition(A=loft_2, B=mult_33)
addi_47 = Addition(A=mult_3, B=divi_36)
rota_46 = Rotate(A=loft_40, B=line_47)
cons_58 = ConstructPoint(A=loft_13, B=seri_53)
line_49 = Line(A=addi_45, B=mult_3)
move_33 = Move(A=line_49, B=cons_2)  # -> R
# ---------- move_33: C# ----------
int a = 868;
return a * 2;
# ---------- end move_33 ----------
seri_54 = Series(A=5.232, B=divi_35)
cons_59 = ConstructPoint(A=8.522, B=mult_32)
loft_42 = Loft(A=seri_23, B=seri_52)
divi_39 = DivideCurve(A=cons_25, B=cons_56)
seri_55 = Series(A=line_49, B=loft_15)
mult_35 = Multiplication(A=mult_32, B=rota_13)
rang_32 = Range(A=4.077, B=loft_40)
mult_36 = Multiplication(A=cons_27, B=loft_40)  # -> R
# ---------- mult_36: C# ----------
int a = 444;
return a * 2;
# ---------- end mult_36 ----------
move_34 = Move(A=cons_58, B=<missing>)
mult_37 = Multiplication(A=divi_36, B=seri_3)
loft_43 = Loft(A=disp_5, B=seri_52)
seri_56 = Series(A=loft_12, B=rota_45)
addi_48 = Addition(A=cons_56, B=cons_7)
loft_44 = Loft(A=addi_45, B=rota_43)
rota_47 = Rotate(A=cull_5, B=rang_32)
cull_13 = CullPattern(A=disp, B=move_32)
line_50 = Line(A=loft_40, B=addi_48)
seri_57 = Series(A=loft_12, B=loft_40)
flip_14 = FlipMatrix(A=<missing>, B=addi_48)
addi_49 = Addition(A=shif_2, B=move_31)
loft_45 = Loft(A=9.189, B=line_46)
mult_38 = Multiplication(A=disp_8, B=addi_48)
addi_50 = Addition(A=rota_13, B=line_46)
cons_60 = ConstructPoint(A=rang_14, B=addi_47)
mult_39 = Multiplication(A=<missing>, B=mult_35)
line_51 = Line(A=mult_32, B=seri_3)
divi_40 = DivideCurve(A=divi_36, B=rang_15)
move_35 = Move(A=loft_42, B=rang_13)
move_36 = Move(A=rota, B=rota_47)
rang_33 = Range(A=line_51, B=addi_44)
rota_48 = Rotate(A=loft_40, B=0.006)
move_37 = Move(A=rota_43, B=mult_36)
disp_17 = Dispatch(A=loft_40, B=move_31)
mult_40 = Multiplication(A=divi_40, B=line_5)
rang_34 = Range(A=mult_40, B=move_6)
move_38 = Move(A=3.349, B=rang_34)
move_39 = Move(A=rang_34, B=4.731)
divi_41 = DivideCurve(A=move_38, B=0.547)
cons_61 = ConstructPoint(A=move_39, B=mult_9)
rang_35 = Range(A=cons, B=rang_34)
line_52 = Line(A=rang_35, B=divi_11)
addi_51 = Addition(A=seri_8, B=rang_34)
rang_36 = Range(A=seri_5, B=divi_36)
seri_58 = Series(A=rang_19, B=cons_59)
seri_59 = Series(A=loft_41, B=seri_22)
seri_60 = Series(A=8.851, B=cons_58)
shif_15 = ShiftList(A=rang_35, B=loft_18)
line_53 = Line(A=cons, B=rang_35)
cons_62 = ConstructPoint(A=cons_59, B=seri_24)
rang_37 = Range(A=seri_58, B=line_3)
loft_46 = Loft(A=2.705, B=mult_35)
rang_38 = Range(A=cons_6, B=addi_51)
seri_61 = Series(A=rang_34, B=seri_12)
move_40 = Move(A=seri_60, B=<missing>)
loft_47 = Loft(A=cons_56, B=seri_53)
move_41 = Move(A=seri_53, B=rang_35)
cons_63 = ConstructPoint(A=loft_45, B=6.331)
cons_64 = ConstructPoint(A=mult_7, B=loft_40)
line_54 = Line(A=cluster50, B=mult_40)
seri_62 = Series(A=shif_10, B=mult_32)
cons_65 = ConstructPoint(A=seri_57, B=2.636)
rang_39 = Range(A=<missing>, B=addi_45)
seri_63 = Series(A=loft_14, B=line_46)
seri_64 = Series(A=line_46, B=rota_14)
move_42 = Move(A=divi_13, B=seri_62)
seri_65 = Series(A=addi_50, B=line_49)
mult_41 = Multiplication(A=rang_10, B=disp_17)  # -> R
# ---------- mult_41: C# ----------
int a = 921;
return a * 2;
# ---------- end mult_41 ----------
addi_52 = Addition(A=rang_3, B=rang_38)
divi_42 = DivideCurve(A=cons_64, B=rota_25)
disp_18 = Dispatch(A=4.924, B=seri_52)
divi_43 = DivideCurve(A=9.905, B=mult_33)
line_55 = Line(A=mult_36, B=cons_60)
line_56 = Line(A=7.73, B=move_31)  # -> R
# ---------- line_56: C# ----------
int a = 179;
return a * 2;
# ---------- end line_56 ----------
rota_49 = Rotate(A=<missing>, B=cons_64)
seri_66 = Series(A=loft_42, B=cons_20)
rang_40 = Range(A=seri_59, B=4.628)
loft_48 = Loft(A=move_32, B=rang_36)
move_43 = Move(A=addi_49, B=3.955)
mult_42 = Multiplication(A=rota_11, B=loft_39)
cull_14 = CullPattern(A=divi_40, B=rang_29)
move_44 = Move(A=divi_16, B=seri_58)
loft_49 = Loft(A=move_37, B=cull_14)
cons_66 = ConstructPoint(A=rang_32, B=addi_14)
seri_67 = Series(A=cull_2, B=loft_44)
addi_53 = Addition(A=2.413, B=divi_42)
rota_50 = Rotate(A=flip_2, B=mult_38)
addi_54 = Addition(A=rota, B=flip_2)
mult_43 = Multiplication(A=line_15, B=cull_5)
cull_15 = CullPattern(A=cons_19, B=5.371)
rota_51 = Rotate(A=0.3, B=3.169)
line_57 = Line(A=rota_12, B=1.821)
loft_50 = Loft(A=3.594, B=cons_23)
line_58 = Line(A=seri_35, B=<missing>)
divi_44 = DivideCurve(A=divi_31, B=loft_13)
seri_68 = Series(A=line_34, B=divi_2)  # -> R
# ---------- seri_68: C# ----------
int a = 338;
return a * 2;
# ---------- end seri_68 ----------
rota_52 = Rotate(A=move_3, B=rota_34)
divi_45 = DivideCurve(A=cons_2, B=loft_45)
line_59 = Line(A=<missing>, B=shif_6)
seri_69 = Series(A=mult_2, B=move_29)
mult_44 = Multiplication(A=<missing>, B=rota_25)
divi_46 = DivideCurve(A=rota_36, B=loft_28)
divi_47 = DivideCurve(A=divi_23, B=addi_6)
rota_53 = Rotate(A=mult_38, B=3.657)
divi_48 = DivideCurve(A=move_37, B=8.4)
addi_55 = Addition(A=move_23, B=3.788)
mult_45 = Multiplication(A=loft_23, B=seri_41)
move_45 = Move(A=cons_31, B=rang_40)
line_60 = Line(A=move_27, B=divi_17)
flip_15 = FlipMatrix(A=rang_14, B=seri_23)
shif_16 = ShiftList(A=loft_29, B=move_22)
addi_56 = Addition(A=flip_2, B=rota_24)
loft_51 = Loft(A=move_30, B=divi_20)
loft_52 = Loft(A=cons_6, B=disp_7)
rota_54 = Rotate(A=rota_17, B=<missing>)
divi_49 = DivideCurve(A=shif_7, B=line_24)
shif_17 = ShiftList(A=disp_3, B=5.455)
mult_46 = Multiplication(A=addi_33, B=disp_13)
cons_67 = ConstructPoint(A=4.51, B=seri_20)
flip_16 = FlipMatrix(A=6.864, B=cons_27)
move_46 = Move(A=rang_22, B=5.182)
rang_41 = Range(A=seri_21, B=seri_18)
cons_68 = ConstructPoint(A=rang_32, B=8.536)
rang_42 = Range(A=divi_28, B=cons_6)
move_47 = Move(A=rang_42, B=rota_19)
disp_19 = Dispatch(A=cons_25, B=move_47)
move_48 = Move(A=seri_51, B=move_47)
disp_20 = Dispatch(A=disp_19, B=<missing>)
shif_18 = ShiftList(A=divi_30, B=disp_20)
move_49 = Move(A=line_29, B=move_47)
mult_47 = Multiplication(A=cons_30, B=line)
move_50 = Move(A=loft_31, B=rota_51)
move_51 = Move(A=<missing>, B=seri_7)
cull_16 = CullPattern(A=5.912, B=9.506)
seri_70 = Series(A=cluster147, B=line_60)
move_52 = Move(A=divi_44, B=cons_42)
mult_48 = Multiplication(A=mult_20, B=5.623)
rota_55 = Rotate(A=1.085, B=cons_57)
cons_69 = ConstructPoint(A=divi_19, B=mult_19)
loft_53 = Loft(A=9.005, B=divi)
loft_54 = Loft(A=addi_31, B=rang_2)
addi_57 = Addition(A=rang_8, B=loft_54)
move_53 = Move(A=addi_57, B=cons_24)
cons_70 = ConstructPoint(A=move_53, B=9.308)
cons_71 = ConstructPoint(A=addi_57, B=cons_24)
cons_72 = ConstructPoint(A=4.402, B=cons_70)
rang_43 = Range(A=cons_72, B=mult_24)
loft_55 = Loft(A=7.106, B=cons_70)
rota_56 = Rotate(A=rang, B=addi_57)  # -> R
# ---------- rota_56: C# ----------
int a = 126;
return a * 2;
# ---------- end rota_56 ----------
flip_17 = FlipMatrix(A=move_53, B=move_31)
cons_73 = ConstructPoint(A=addi_57, B=addi_7)
addi_58 = Addition(A=rota_25, B=cons_72)
line_61 = Line(A=mult, B=cons_72)
addi_59 = Addition(A=cons_72, B=addi_57)
seri_71 = Series(A=addi_57, B=mult_2)
cull_17 = CullPattern(A=cons_70, B=move_53)
move_54 = Move(A=cons_70, B=loft_40)
line_62 = Line(A=mult_27, B=cons_70)
loft_56 = Loft(A=cons_72, B=1.151)
divi_50 = DivideCurve(A=2.141, B=addi_58)
divi_51 = DivideCurve(A=cons_73, B=move_7)
mult_49 = Multiplication(A=cons_56, B=flip_17)
seri_72 = Series(A=addi_58, B=8.325)
mult_50 = Multiplication(A=cons_24, B=rota_56)
line_63 = Line(A=cons_70, B=addi_45)
rota_57 = Rotate(A=rota_56, B=addi_58)
mult_51 = Multiplication(A=move_53, B=cull_17)
rota_58 = Rotate(A=addi_8, B=move_54)
addi_60 = Addition(A=cons_73, B=cons_36)
line_64 = Line(A=shif, B=rota_56)
move_55 = Move(A=3.609, B=flip_17)
loft_57 = Loft(A=line_62, B=cons_24)
addi_61 = Addition(A=rota_56, B=rota_16)
line_65 = Line(A=rota_15, B=seri_71)
disp_21 = Dispatch(A=line_62, B=cons_31)
rota_59 = Rotate(A=cons_71, B=addi_45)
addi_62 = Addition(A=addi, B=addi_58)
seri_73 = Series(A=mult_50, B=seri_22)
rota_60 = Rotate(A=1.848, B=seri_72)
move_56 = Move(A=loft_56, B=cons_56)
line_66 = Line(A=cons_30, B=mult_50)
mult_52 = Multiplication(A=cons_73, B=cons_72)
seri_74 = Series(A=loft_40, B=move_55)
flip_18 = FlipMatrix(A=rota_57, B=<missing>)
loft_58 = Loft(A=seri_73, B=<missing>)
addi_63 = Addition(A=seri_73, B=divi_11)
flip_19 = FlipMatrix(A=rota_56, B=line)
cluster341 = Cluster(In=flip_19)
cons_74 = ConstructPoint(A=cluster341, B=cons_25)
disp_22 = Dispatch(A=cluster341, B=3.601)
loft_59 = Loft(A=cluster341, B=cons_73)
addi_64 = Addition(A=disp_22, B=addi_42)
rota_61 = Rotate(A=cluster341, B=seri_32)
move_57 = Move(A=disp_22, B=move_38)
cons_75 = ConstructPoint(A=rang_43, B=disp_22)
flip_20 = FlipMatrix(A=loft_59, B=4.092)
seri_75 = Series(A=move_54, B=cluster341)
loft_60 = Loft(A=rota_16, B=loft_59)
line_67 = Line(A=disp_22, B=mult_27)
move_58 = Move(A=cluster341, B=loft_15)
rang_44 = Range(A=line_66, B=cons_24)
move_59 = Move(A=seri_71, B=mult_49)
move_60 = Move(A=addi_58, B=<missing>)
addi_65 = Addition(A=line, B=seri_74)
mult_53 = Multiplication(A=divi_50, B=flip_20)
divi_52 = DivideCurve(A=cons_75, B=<missing>)
addi_66 = Addition(A=rota_56, B=<missing>)
line_68 = Line(A=disp_8, B=flip_18)
move_61 = Move(A=addi_11, B=cons_72)
seri_76 = Series(A=cons_28, B=move_59)
addi_67 = Addition(A=cons_71, B=loft_14)
loft_61 = Loft(A=move_55, B=rang_3)
disp_23 = Dispatch(A=loft_59, B=line_3)
cons_76 = ConstructPoint(A=disp_23, B=flip_19)
seri_77 = Series(A=cons_76, B=cons_70)
disp_24 = Dispatch(A=cons_76, B=mult_27)
move_62 = Move(A=0.291, B=cons_76)
seri_78 = Series(A=addi_10, B=disp_24)
line_69 = Line(A=cons_76, B=move_31)
rota_62 = Rotate(A=cons_76, B=mult_3)
addi_68 = Addition(A=cons_76, B=loft_13)
flip_21 = FlipMatrix(A=addi_62, B=rang_15)
divi_53 = DivideCurve(A=addi_57, B=1.69)
rota_63 = Rotate(A=line_62, B=rota_45)
rang_45 = Range(A=line_66, B=rota_46)
line_70 = Line(A=rang_45, B=rang_35)
line_71 = Line(A=cons_72, B=line_3)
loft_62 = Loft(A=addi_64, B=disp_24)
seri_79 = Series(A=rang_35, B=rota_57)
cons_77 = ConstructPoint(A=rota_25, B=cons_73)
line_72 = Line(A=seri_46, B=move_60)
cons_78 = ConstructPoint(A=rota_57, B=<missing>)
seri_80 = Series(A=loft_61, B=cons_45)
loft_63 = Loft(A=mult_2, B=addi_58)
loft_64 = Loft(A=move_60, B=loft_13)
loft_65 = Loft(A=loft_60, B=disp_7)
addi_69 = Addition(A=loft_61, B=move_56)
divi_54 = DivideCurve(A=0.313, B=addi_57)
addi_70 = Addition(A=cons_72, B=line)
addi_71 = Addition(A=1.44, B=rota_56)
addi_72 = Addition(A=line_63, B=seri_23)
shif_19 = ShiftList(A=mult_6, B=move_55)
line_73 = Line(A=addi_66, B=line_5)
cons_79 = ConstructPoint(A=cons_76, B=disp_22)
move_63 = Move(A=line_22, B=flip_21)  # -> R
# ---------- move_63: C# ----------
int a = 974;
return a * 2;
# ---------- end move_63 ----------
seri_81 = Series(A=rang_32, B=cull_17)
flip_22 = FlipMatrix(A=divi_54, B=seri_28)
loft_66 = Loft(A=<missing>, B=cons_71)
line_74 = Line(A=rota_59, B=divi_54)  # -> R
# ---------- line_74: C# ----------
int a = 603;
return a * 2;
# ---------- end line_74 ----------
rota_64 = Rotate(A=loft_60, B=<missing>)
rota_65 = Rotate(A=rang_44, B=line_21)
rota_66 = Rotate(A=rota_59, B=0.764)
rota_67 = Rotate(A=addi_45, B=loft_61)
move_64 = Move(A=rang_2, B=rota_67)
line_75 = Line(A=cluster341, B=move_64)
loft_67 = Loft(A=line_75, B=disp_11)
move_65 = Move(A=line_75, B=loft_57)
rang_46 = Range(A=cons_76, B=9.84)
line_76 = Line(A=rota_25, B=shif_19)
move_66 = Move(A=seri_75, B=rang)
disp_25 = Dispatch(A=loft_56, B=rang_6)
cons_80 = ConstructPoint(A=disp_25, B=rota_64)
mult_54 = Multiplication(A=rang_44, B=rota_2)
divi_55 = DivideCurve(A=divi_36, B=addi_62)
mult_55 = Multiplication(A=seri_80, B=<missing>)
addi_73 = Addition(A=line_74, B=rota_18)
rang_47 = Range(A=cull_17, B=line_4)
mult_56 = Multiplication(A=line_76, B=divi_36)
loft_68 = Loft(A=rota_58, B=5.41)
mult_57 = Multiplication(A=mult_51, B=<missing>)
line_77 = Line(A=rota_56, B=move_21)
cons_81 = ConstructPoint(A=4.445, B=flip_19)
mult_58 = Multiplication(A=cull_17, B=cons)
addi_74 = Addition(A=flip_22, B=cons_56)
line_78 = Line(A=cons_72, B=5.48)
rota_68 = Rotate(A=rota_67, B=rota_56)
shif_20 = ShiftList(A=cons_58, B=rota_59)
move_67 = Move(A=addi_57, B=flip_17)
line_79 = Line(A=3.52, B=flip_17)
mult_59 = Multiplication(A=loft_63, B=2.962)
loft_69 = Loft(A=rota_56, B=line_9)
addi_75 = Addition(A=move_3, B=loft_59)
seri_82 = Series(A=addi_58, B=seri_72)
cons_82 = ConstructPoint(A=rang_2, B=divi_54)
shif_21 = ShiftList(A=move_13, B=seri_71)
move_68 = Move(A=shif_21, B=2.393)
divi_56 = DivideCurve(A=5.715, B=move_68)
move_69 = Move(A=seri_23, B=divi_56)
shif_22 = ShiftList(A=addi_58, B=move_69)
seri_83 = Series(A=<missing>, B=move_68)
seri_84 = Series(A=line_63, B=addi_57)
rota_69 = Rotate(A=rota_25, B=flip_18)  # -> R
# ---------- rota_69: C# ----------
int a = 391;
return a * 2;
# ---------- end rota_69 ----------
seri_85 = Series(A=addi_57, B=7.289)
rota_70 = Rotate(A=line_75, B=seri_21)
rang_48 = Range(A=6.562, B=loft_63)
seri_86 = Series(A=divi_23, B=cull_17)
loft_70 = Loft(A=move_53, B=mult_4)
shif_23 = ShiftList(A=<missing>, B=divi_54)
mult_60 = Multiplication(A=5.648, B=cons_81)
mult_61 = Multiplication(A=cons_72, B=disp_17)
seri_87 = Series(A=rang_2, B=rota_57)
loft_71 = Loft(A=cons_56, B=cluster341)
seri_88 = Series(A=<missing>, B=cull_17)
rang_49 = Range(A=flip_18, B=loft_18)
flip_23 = FlipMatrix(A=<missing>, B=mult_52)
mult_62 = Multiplication(A=move_48, B=line_74)
rota_71 = Rotate(A=line_61, B=addi_42)
seri_89 = Series(A=flip_18, B=loft_21)
cull_18 = CullPattern(A=move_53, B=mult_10)
rota_72 = Rotate(A=rota_7, B=line_78)
line_80 = Line(A=rota_57, B=4.722)
rota_73 = Rotate(A=flip_17, B=loft_12)
rota_74 = Rotate(A=line_77, B=<missing>)
seri_90 = Series(A=<missing>, B=divi_54)
line_81 = Line(A=6.819, B=mult_49)
rang_50 = Range(A=divi_19, B=rota_67)
divi_57 = DivideCurve(A=mult_50, B=rang_9)
mult_63 = Multiplication(A=flip_19, B=rang_19)
loft_72 = Loft(A=move_55, B=move_11)
line_82 = Line(A=<missing>, B=cons_78)
cons_83 = ConstructPoint(A=rang_47, B=loft_70)
addi_76 = Addition(A=rota_21, B=flip_19)
rota_75 = Rotate(A=move_67, B=seri_46)
line_83 = Line(A=line_28, B=mult_61)
loft_73 = Loft(A=<missing>, B=cons_79)
addi_77 = Addition(A=mult_49, B=loft_12)
rota_76 = Rotate(A=line_77, B=9.567)
rang_51 = Range(A=line_63, B=divi_13)
loft_74 = Loft(A=cons_16, B=move_61)
disp_26 = Dispatch(A=rota_68, B=divi_14)
divi_58 = DivideCurve(A=line_73, B=mult_27)
mult_64 = Multiplication(A=line, B=cons_71)
cons_84 = ConstructPoint(A=divi_43, B=mult_52)
seri_91 = Series(A=divi_51, B=cons_27)
line_84 = Line(A=disp_24, B=rota_76)
rota_77 = Rotate(A=mult_2, B=seri_72)
cluster923 = Cluster(In=move_56)
cons_85 = ConstructPoint(A=line_79, B=cons_24)
addi_78 = Addition(A=rang_5, B=divi_57)
rota_78 = Rotate(A=seri_67, B=addi_78)
mult_65 = Multiplication(A=rang_43, B=rota_78)
shif_24 = ShiftList(A=line_77, B=disp_13)
move_70 = Move(A=loft_60, B=addi_45)
line_85 = Line(A=cons_72, B=<missing>)
flip_24 = FlipMatrix(A=addi_61, B=move_36)
divi_59 = DivideCurve(A=flip_18, B=mult_52)
mult_66 = Multiplication(A=line_61, B=divi_54)
cons_86 = ConstructPoint(A=addi_70, B=mult_16)
shif_25 = ShiftList(A=move_60, B=addi_58)
loft_75 = Loft(A=seri_30, B=cons_70)
loft_76 = Loft(A=line_4, B=cull_17)
seri_92 = Series(A=addi_71, B=<missing>)
mult_67 = Multiplication(A=rota_56, B=rang_34)
addi_79 = Addition(A=mult_2, B=mult_60)
mult_68 = Multiplication(A=flip_8, B=seri_75)
mult_69 = Multiplication(A=loft_34, B=line_76)
divi_60 = DivideCurve(A=mult_29, B=cons_79)
addi_80 = Addition(A=7.618, B=mult_50)
flip_25 = FlipMatrix(A=cons_73, B=4.959)
cons_87 = ConstructPoint(A=mult_49, B=<missing>)  # -> R
# ---------- cons_87: C# ----------
int a = 709;
return a * 2;
# ---------- end cons_87 ----------
loft_77 = Loft(A=<missing>, B=loft_71)
disp_27 = Dispatch(A=seri_41, B=cons_81)
mult_70 = Multiplication(A=seri_23, B=line_71)
mult_71 = Multiplication(A=loft_19, B=loft_75)
rota_79 = Rotate(A=8.349, B=loft_75)
line_86 = Line(A=divi_57, B=shif_19)
seri_93 = Series(A=rota_56, B=8.071)
rota_80 = Rotate(A=addi_75, B=<missing>)
move_71 = Move(A=rota_18, B=move_64)
flip_26 = FlipMatrix(A=move_3, B=cons_73)
mult_72 = Multiplication(A=<missing>, B=rota_78)
shif_26 = ShiftList(A=rota_57, B=rota_30)
divi_61 = DivideCurve(A=4.528, B=line_85)
rota_81 = Rotate(A=flip, B=cons_71)
rota_82 = Rotate(A=flip_24, B=loft_7)
seri_94 = Series(A=addi_16, B=loft_13)
move_72 = Move(A=shif_7, B=seri_11)
cons_88 = ConstructPoint(A=move_72, B=addi_58)
mult_73 = Multiplication(A=addi_57, B=cons_88)
line_87 = Line(A=mult_73, B=cons_48)
seri_95 = Series(A=addi_58, B=mult_73)
cons_89 = ConstructPoint(A=cons_88, B=line_14)
divi_62 = DivideCurve(A=move_38, B=mult_73)
cluster535 = Cluster(In=cons_88)
loft_78 = Loft(A=cons_88, B=addi_14)
mult_74 = Multiplication(A=rang_40, B=cluster535)
mult_75 = Multiplication(A=<missing>, B=seri_19)
loft_79 = Loft(A=divi_29, B=cons_7)
line_88 = Line(A=1.934, B=seri_8)
rang_52 = Range(A=move_29, B=line_35)
rang_53 = Range(A=2.64, B=rang_36)
rota_83 = Rotate(A=divi_25, B=mult_58)
disp_28 = Dispatch(A=7.572, B=line_58)
line_89 = Line(A=flip_8, B=loft_40)
addi_81 = Addition(A=rota_27, B=rang_36)
seri_96 = Series(A=addi_78, B=move_54)
addi_82 = Addition(A=disp, B=rota_13)
addi_83 = Addition(A=5.723, B=addi_22)
rota_84 = Rotate(A=divi_42, B=mult_58)
line_90 = Line(A=5.599, B=rang)
shif_27 = ShiftList(A=line_12, B=4.975)
addi_84 = Addition(A=seri_11, B=8.294)
addi_85 = Addition(A=line_14, B=cons_47)
seri_97 = Series(A=rang_41, B=addi_55)
cons_90 = ConstructPoint(A=cull_11, B=cons_75)
move_73 = Move(A=rota_11, B=seri_57)
addi_86 = Addition(A=rang_5, B=flip_24)
seri_98 = Series(A=1.935, B=7.637)
move_74 = Move(A=mult_29, B=seri_59)
loft_80 = Loft(A=seri_59, B=divi_8)
