# Grasshopper definition syn200-new.ghx
# synthetic

grap = GraphMapper(A=0.162, B=2.781)
mult = Multiplication(A=grap, B=grap)
line = Line(A=grap, B=<missing>)
loft = Loft(A=5.991, B=grap)
move = Move(A=loft, B=9.883)
addi = Addition(A=move, B=9.914)
seri = Series(A=grap, B=4.712)
loft_2 = Loft(A=4.33, B=<missing>)
move_2 = Move(A=mult, B=mult)
loft_3 = Loft(A=<missing>, B=line)
divi = DivideCurve(A=grap, B=grap)
loft_4 = Loft(A=line, B=<missing>)
mod86 = ConstructPoint(A=1.144, B=mult)
cons = ConstructPoint(A=addi, B=grap)
rota = Rotate(A=loft, B=3.213)
divi_2 = DivideCurve(A=grap, B=grap)
move_3 = Move(A=move_2, B=line)
rang = Range(A=1.914, B=loft_3)
mult_2 = Multiplication(A=loft_4, B=loft_3)
seri_2 = Series(A=<missing>, B=8.666)
rota_2 = Rotate(A=divi_2, B=divi_2)
grad = Gradient(A=loft_3, B=<missing>)
pane = Panel(A=move_3, B=mult)
cons_2 = ConstructPoint(A=pane, B=<missing>)
loft_5 = Loft(A=grap, B=move_3)
bool = BooleanToggle(A=rang, B=move)
pane_2 = Panel(A=8.464, B=line)
move_4 = Move(A=cons_2, B=cons)
addi_2 = Addition(A=rota_2, B=move_2)
mult_3 = Multiplication(A=mult, B=4.368)
line_2 = Line(A=move_3, B=7.415)
move_5 = Move(A=move_3, B=grad)
seri_3 = Series(A=6.444, B=bool)
move_6 = Move(A=<missing>, B=3.555)
rang_2 = Range(A=divi_2, B=grap)
line_3 = Line(A=rang_2, B=loft)
pane_3 = Panel(A=line_3, B=line_3)
cons_3 = ConstructPoint(A=line_3, B=grap)
loft_6 = Loft(A=0.73, B=line_3)
grad_2 = Gradient(A=1.865, B=loft_6)
bool_2 = BooleanToggle(A=cons_3, B=3.183)
move_7 = Move(A=move_2, B=pane_3)
mult_4 = Multiplication(A=cons_3, B=0.342)
move_8 = Move(A=<missing>, B=cons_3)
move_9 = Move(A=loft_4, B=cons_3)
divi_3 = DivideCurve(A=pane_3, B=grap)
addi_3 = Addition(A=move_7, B=grad_2)
divi_4 = DivideCurve(A=cons_3, B=loft)
divi_5 = DivideCurve(A=seri_2, B=bool_2)
rota_3 = Rotate(A=line_3, B=5.187)
mod20 = Range(A=divi_2, B=mult)  # -> R
# ---------- mod20: C# ----------
int a = 20;
int b = a + 1;
return b * 3;
# ---------- end mod20 ----------
mult_5 = Multiplication(A=move_2, B=mult_3)
seri_4 = Series(A=mult_5, B=divi)
cons_4 = ConstructPoint(A=move, B=seri_4)
rota_4 = Rotate(A=cons_4, B=loft)
seri_5 = Series(A=cons_4, B=cons_4)
move_10 = Move(A=move_2, B=line_3)
mod62 = ConstructPoint(A=divi_4, B=move_3)
mult_6 = Multiplication(A=move_5, B=rang)
loft_7 = Loft(A=move_5, B=move_3)
line_4 = Line(A=addi, B=2.198)
addi_4 = Addition(A=move_5, B=7.034)
mult_7 = Multiplication(A=mod86, B=loft_3)
line_5 = Line(A=grap, B=grap)
move_11 = Move(A=0.088, B=mult)
addi_5 = Addition(A=move_11, B=3.815)
cons_5 = ConstructPoint(A=addi_5, B=cons_3)
mod100 = Move(A=addi_5, B=<missing>)
divi_6 = DivideCurve(A=addi_5, B=4.206)
bool_3 = BooleanToggle(A=move, B=cons_5)  # -> R
# ---------- bool_3: C# ----------
int a = 73;
int b = a + 1;
return b * 3;
# ---------- end bool_3 ----------
rota_5 = Rotate(A=loft_6, B=mod100)
mod88 = Series(A=move, B=addi_5)
move_12 = Move(A=move_7, B=addi_5)
move_13 = Move(A=<missing>, B=mod100)
bool_4 = BooleanToggle(A=seri_2, B=mod100)
grad_3 = Gradient(A=cons_5, B=addi)
cons_6 = ConstructPoint(A=mod100, B=cons_3)
pane_4 = Panel(A=move_4, B=mod100)
move_14 = Move(A=move_3, B=divi)
mult_8 = Multiplication(A=move_2, B=loft_5)
loft_8 = Loft(A=3.38, B=move_7)
cons_7 = ConstructPoint(A=addi_2, B=loft_4)
loft_9 = Loft(A=1.307, B=loft_4)
move_15 = Move(A=bool_3, B=loft_3)
cluster147 = Cluster()
cons_8 = ConstructPoint(A=<missing>, B=cons_6)
seri_6 = Series(A=grap, B=mult)
move_16 = Move(A=2.233, B=grap)
cons_9 = ConstructPoint(A=move_2, B=grad)
cluster50 = Cluster(In=mult_8)
mod64 = Multiplication(A=mult_5, B=addi_2)
move_17 = Move(A=mult_8, B=move_5)
mod92 = Addition(A=seri_4, B=move_10)
mult_9 = Multiplication(A=cons_5, B=loft_9)
seri_7 = Series(A=bool_4, B=bool_3)
loft_10 = Loft(A=9.637, B=mult_6)
pane_5 = Panel(A=move_13, B=divi_3)
rota_6 = Rotate(A=cons_4, B=move_11)
rang_3 = Range(A=mult, B=bool)
move_18 = Move(A=divi_2, B=rota_2)
move_19 = Move(A=move_18, B=mod62)
rota_7 = Rotate(A=move_19, B=seri_7)
mult_10 = Multiplication(A=loft_3, B=<missing>)
move_20 = Move(A=move_3, B=line_2)
bool_5 = BooleanToggle(A=6.724, B=loft)
cons_10 = ConstructPoint(A=loft_5, B=cons_9)
divi_7 = DivideCurve(A=divi_4, B=bool)
loft_11 = Loft(A=bool_2, B=loft_6)
move_21 = Move(A=4.242, B=move_17)
line_6 = Line(A=move_2, B=<missing>)
rang_4 = Range(A=mult_2, B=grap)
move_22 = Move(A=divi_3, B=rota_3)
cons_11 = ConstructPoint(A=grad_2, B=loft_9)
mult_11 = Multiplication(A=grap, B=addi_2)
addi_6 = Addition(A=seri_7, B=mult_11)
rota_8 = Rotate(A=1.169, B=move_16)
rang_5 = Range(A=line_2, B=7.234)
mult_12 = Multiplication(A=loft_4, B=line_2)
seri_8 = Series(A=cons_3, B=loft)
divi_8 = DivideCurve(A=addi_5, B=line_5)
rang_6 = Range(A=move_14, B=loft_9)
mult_13 = Multiplication(A=bool_3, B=mod100)
rang_7 = Range(A=0.73, B=move_14)
cons_12 = ConstructPoint(A=cons_10, B=move_20)
cons_13 = ConstructPoint(A=addi_5, B=cons)
bool_6 = BooleanToggle(A=grap, B=addi_2)
rang_8 = Range(A=6.994, B=mod20)
addi_7 = Addition(A=grad, B=mult_5)
line_7 = Line(A=line, B=rota_8)
loft_12 = Loft(A=cons_10, B=6.908)
rota_9 = Rotate(A=<missing>, B=loft_12)
loft_13 = Loft(A=rota_9, B=0.548)
move_23 = Move(A=rota_9, B=grad_2)
line_8 = Line(A=move_19, B=rota_9)
grad_4 = Gradient(A=<missing>, B=rota_9)
mod128 = Move(A=rota_9, B=cons_3)
loft_14 = Loft(A=line_8, B=7.449)
pane_6 = Panel(A=move_2, B=rota_9)
mult_14 = Multiplication(A=loft_13, B=grad_2)
line_9 = Line(A=divi, B=rota_9)
rang_9 = Range(A=loft_7, B=rota_9)
addi_8 = Addition(A=divi, B=cons_9)
mult_15 = Multiplication(A=<missing>, B=move_14)
grad_5 = Gradient(A=move_21, B=divi_2)
rota_10 = Rotate(A=move_10, B=bool_5)
seri_9 = Series(A=<missing>, B=<missing>)
addi_9 = Addition(A=move_18, B=8.056)
cons_14 = ConstructPoint(A=divi_2, B=rang_8)
loft_15 = Loft(A=pane, B=mult_10)
rota_11 = Rotate(A=loft_8, B=move)
grad_6 = Gradient(A=mult_2, B=8.552)
mult_16 = Multiplication(A=divi_7, B=mod88)
divi_9 = DivideCurve(A=move_17, B=<missing>)
cons_15 = ConstructPoint(A=rang_5, B=move)
loft_16 = Loft(A=bool_6, B=divi_7)
line_10 = Line(A=seri_4, B=move_7)
rang_10 = Range(A=cons_10, B=line_10)
mult_17 = Multiplication(A=rang_10, B=seri_4)
mod194 = Loft(A=move_6, B=<missing>)
move_24 = Move(A=seri_6, B=addi_9)
rota_12 = Rotate(A=line_2, B=rang_8)
addi_10 = Addition(A=addi_9, B=<missing>)
loft_17 = Loft(A=cons_14, B=mult_2)
divi_10 = DivideCurve(A=loft_17, B=seri_3)
mult_18 = Multiplication(A=grap, B=divi_10)
addi_11 = Addition(A=mult_18, B=seri_4)
grap_2 = GraphMapper(A=pane_3, B=mult_18)
loft_18 = Loft(A=addi_11, B=mod128)
loft_19 = Loft(A=mult_18, B=8.963)
mult_19 = Multiplication(A=bool_2, B=addi_11)
line_11 = Line(A=addi_5, B=addi_11)
divi_11 = DivideCurve(A=move, B=mult_18)
move_25 = Move(A=addi_7, B=8.237)
cons_16 = ConstructPoint(A=bool_2, B=seri_2)
move_26 = Move(A=cons_5, B=7.425)
addi_12 = Addition(A=divi, B=<missing>)
mult_20 = Multiplication(A=grad_5, B=bool_4)
cons_17 = ConstructPoint(A=loft_11, B=<missing>)
cons_18 = ConstructPoint(A=rota_11, B=rang_2)
move_27 = Move(A=grad_6, B=loft_8)
