# Grasshopper definition syn200-old.ghx
# synthetic

mult = Multiplication(A=<missing>, B=<missing>)
loft = Loft(A=5.991, B=<missing>)
move = Move(A=loft, B=9.883)
addi = Addition(A=move, B=9.914)
seri = Series(A=<missing>, B=4.712)
move_2 = Move(A=mult, B=mult)
divi = DivideCurve(A=<missing>, B=<missing>)
cons = ConstructPoint(A=1.144, B=mult)
cons_2 = ConstructPoint(A=addi, B=<missing>)
rota = Rotate(A=loft, B=3.213)
divi_2 = DivideCurve(A=<missing>, B=<missing>)
move_3 = Move(A=move_2, B=<missing>)
cull = CullPattern(A=5.509, B=seri)
rota_2 = Rotate(A=divi_2, B=divi_2)
flip = FlipMatrix(A=3.083, B=addi)
divi_3 = DivideCurve(A=<missing>, B=<missing>)
addi_2 = Addition(A=move_3, B=<missing>)
addi_3 = Addition(A=rota_2, B=move_2)
mult_2 = Multiplication(A=mult, B=4.368)
seri_2 = Series(A=6.444, B=<missing>)
disp = Dispatch(A=<missing>, B=rota)
rang = Range(A=divi_2, B=<missing>)
line = Line(A=rang, B=loft)
cons_3 = ConstructPoint(A=line, B=<missing>)
loft_2 = Loft(A=line, B=4.352)
mult_3 = Multiplication(A=cons_3, B=0.342)
divi_4 = DivideCurve(A=cons_3, B=loft)
rota_3 = Rotate(A=line, B=5.187)
rang_2 = Range(A=divi_2, B=mult)  # -> R
# ---------- rang_2: C# ----------
int a = 20;
return a * 2;
# ---------- end rang_2 ----------
mult_4 = Multiplication(A=move_2, B=mult_2)
seri_3 = Series(A=mult_4, B=divi)
cons_4 = ConstructPoint(A=move, B=seri_3)
rota_4 = Rotate(A=cons_4, B=loft)
seri_4 = Series(A=cons_4, B=cons_4)
move_4 = Move(A=move_2, B=line)
line_2 = Line(A=addi, B=2.198)
line_3 = Line(A=<missing>, B=<missing>)
move_5 = Move(A=0.088, B=mult)
addi_4 = Addition(A=move_5, B=3.815)
cons_5 = ConstructPoint(A=addi_4, B=cons_3)
divi_5 = DivideCurve(A=addi_4, B=4.206)
seri_5 = Series(A=move, B=addi_4)
move_6 = Move(A=move_3, B=addi_4)
loft_3 = Loft(A=3.38, B=move_3)
cluster147 = Cluster()
cull_2 = CullPattern(A=loft, B=<missing>)
seri_6 = Series(A=<missing>, B=mult)
move_7 = Move(A=2.233, B=<missing>)
cons_6 = ConstructPoint(A=move_2, B=<missing>)
mult_5 = Multiplication(A=mult_4, B=addi_3)
addi_5 = Addition(A=seri_3, B=move_4)
seri_7 = Series(A=<missing>, B=<missing>)
rota_5 = Rotate(A=cons_4, B=move_5)
rang_3 = Range(A=mult, B=<missing>)
disp_2 = Dispatch(A=rota_2, B=addi)
move_8 = Move(A=divi_2, B=rota_2)
divi_6 = DivideCurve(A=divi_4, B=<missing>)
loft_4 = Loft(A=<missing>, B=loft_2)
line_4 = Line(A=move_2, B=flip)
flip_2 = FlipMatrix(A=move_4, B=divi_3)
move_9 = Move(A=divi_3, B=rota_3)
mult_6 = Multiplication(A=<missing>, B=addi_3)
addi_6 = Addition(A=mult_6, B=seri_7)
rota_6 = Rotate(A=1.169, B=move_7)
seri_8 = Series(A=cons_3, B=loft)
divi_7 = DivideCurve(A=addi_4, B=line_3)
cons_7 = ConstructPoint(A=addi_4, B=cons_2)
rang_4 = Range(A=6.994, B=rang_2)
addi_7 = Addition(A=<missing>, B=mult_4)
cull_3 = CullPattern(A=divi_4, B=addi_7)  # -> R
# ---------- cull_3: C# ----------
int a = 126;
return a * 2;
# ---------- end cull_3 ----------
loft_5 = Loft(A=4.33, B=cull_3)
addi_8 = Addition(A=divi, B=cons_6)
rota_7 = Rotate(A=move_4, B=<missing>)
cull_4 = CullPattern(A=<missing>, B=divi_3)
cull_5 = CullPattern(A=rota_5, B=seri)  # -> R
# ---------- cull_5: C# ----------
int a = 179;
return a * 2;
# ---------- end cull_5 ----------
addi_9 = Addition(A=move_8, B=8.056)
flip_3 = FlipMatrix(A=3.219, B=addi_9)
cons_8 = ConstructPoint(A=<missing>, B=flip_3)
line_5 = Line(A=<missing>, B=flip_3)
loft_6 = Loft(A=flip_3, B=line_5)
loft_7 = Loft(A=line_5, B=flip_3)
move_10 = Move(A=addi_4, B=flip_3)
move_11 = Move(A=move_2, B=line_5)
rang_5 = Range(A=1.914, B=loft_6)
mult_7 = Multiplication(A=loft_7, B=loft_6)
seri_9 = Series(A=flip_3, B=8.666)
move_12 = Move(A=flip_3, B=cons_3)
rota_8 = Rotate(A=loft_2, B=move_10)
loft_8 = Loft(A=<missing>, B=move_11)
move_13 = Move(A=loft_7, B=cons_3)
move_14 = Move(A=cons_8, B=cons_2)
line_6 = Line(A=move_11, B=7.415)
move_15 = Move(A=move_11, B=<missing>)
move_16 = Move(A=flip_3, B=3.555)
divi_8 = DivideCurve(A=seri_9, B=<missing>)
move_17 = Move(A=flip_3, B=move_10)
cons_9 = ConstructPoint(A=divi_4, B=move_11)
move_18 = Move(A=move_8, B=cons_9)
rota_9 = Rotate(A=move_18, B=seri_7)
mult_8 = Multiplication(A=move_15, B=rang_5)
loft_9 = Loft(A=move_15, B=move_11)
cons_10 = ConstructPoint(A=move_10, B=cons_3)
addi_10 = Addition(A=move_15, B=7.034)
mult_9 = Multiplication(A=cons, B=loft_6)
move_19 = Move(A=move_11, B=divi)
mult_10 = Multiplication(A=move_2, B=loft_8)
cons_11 = ConstructPoint(A=addi_3, B=loft_7)
loft_10 = Loft(A=1.307, B=loft_7)
cull_6 = CullPattern(A=flip_3, B=seri_9)
move_20 = Move(A=<missing>, B=loft_6)
cons_12 = ConstructPoint(A=disp, B=cons_10)
cluster50 = Cluster(In=mult_10)
move_21 = Move(A=mult_10, B=move_15)
mult_11 = Multiplication(A=cons_5, B=loft_10)
loft_11 = Loft(A=9.637, B=mult_8)
mult_12 = Multiplication(A=loft_6, B=flip_3)
move_22 = Move(A=move_11, B=line_6)
cons_13 = ConstructPoint(A=loft_8, B=cons_6)
move_23 = Move(A=4.242, B=move_21)
rang_6 = Range(A=mult_7, B=<missing>)
cons_14 = ConstructPoint(A=<missing>, B=loft_10)
disp_3 = Dispatch(A=move_5, B=move_15)
rang_7 = Range(A=line_6, B=7.234)
mult_13 = Multiplication(A=loft_7, B=line_6)
rang_8 = Range(A=move_19, B=loft_10)
mult_14 = Multiplication(A=<missing>, B=move_10)
rang_9 = Range(A=0.73, B=move_19)
cons_15 = ConstructPoint(A=cons_13, B=move_22)
line_7 = Line(A=line_5, B=rota_6)
loft_12 = Loft(A=cons_13, B=6.908)
disp_4 = Dispatch(A=mult_6, B=move_13)
mult_15 = Multiplication(A=flip, B=move_19)
seri_10 = Series(A=cull_6, B=cull_6)
flip_4 = FlipMatrix(A=3.094, B=mult_12)
cons_16 = ConstructPoint(A=divi_2, B=rang_4)
cull_7 = CullPattern(A=move_5, B=move_22)
loft_13 = Loft(A=<missing>, B=mult_12)
rota_10 = Rotate(A=loft_3, B=move)
mult_16 = Multiplication(A=divi_6, B=seri_5)
divi_9 = DivideCurve(A=move_21, B=flip_3)
cons_17 = ConstructPoint(A=rang_7, B=move)
shif = ShiftList(A=0.521, B=mult_7)
loft_14 = Loft(A=divi_6, B=<missing>)
disp_5 = Dispatch(A=seri_10, B=seri_7)
line_8 = Line(A=seri_3, B=move_3)
rang_10 = Range(A=cons_13, B=line_8)
mult_17 = Multiplication(A=rang_10, B=seri_3)
loft_15 = Loft(A=move_16, B=cull_6)
move_24 = Move(A=seri_6, B=addi_9)
shif_2 = ShiftList(A=<missing>, B=line_5)
rota_11 = Rotate(A=line_6, B=rang_4)
addi_11 = Addition(A=addi_9, B=flip_3)
flip_5 = FlipMatrix(A=7.117, B=loft_8)
rota_12 = Rotate(A=flip_5, B=loft_12)
loft_16 = Loft(A=rota_12, B=0.548)
move_25 = Move(A=rota_12, B=<missing>)
line_9 = Line(A=move_18, B=rota_12)
move_26 = Move(A=rota_12, B=cons_3)
loft_17 = Loft(A=line_9, B=7.449)
mult_18 = Multiplication(A=loft_16, B=<missing>)
line_10 = Line(A=divi, B=rota_12)
rang_11 = Range(A=loft_9, B=rota_12)
disp_6 = Dispatch(A=line_6, B=loft_17)
loft_18 = Loft(A=cons_16, B=mult_7)
divi_10 = DivideCurve(A=loft_18, B=seri_2)
mult_19 = Multiplication(A=<missing>, B=divi_10)
addi_12 = Addition(A=mult_19, B=seri_3)
loft_19 = Loft(A=addi_12, B=move_26)
loft_20 = Loft(A=mult_19, B=8.963)
mult_20 = Multiplication(A=<missing>, B=addi_12)
line_11 = Line(A=addi_4, B=addi_12)
divi_11 = DivideCurve(A=move, B=mult_19)
move_27 = Move(A=addi_7, B=8.237)
cons_18 = ConstructPoint(A=<missing>, B=seri_9)
move_28 = Move(A=cons_5, B=7.425)
addi_13 = Addition(A=divi, B=cull_3)
mult_21 = Multiplication(A=<missing>, B=<missing>)
cons_19 = ConstructPoint(A=loft_4, B=cull_7)
cons_20 = ConstructPoint(A=rota_10, B=rang)
move_29 = Move(A=<missing>, B=loft_3)
