# Grasshopper definition syn3000-old.ghx
# synthetic

seri = Series(A=6.791, B=7.067)
rang = Range(A=<missing>, B=4.197)
addi = Addition(A=<missing>, B=seri)
divi = DivideCurve(A=7.447, B=<missing>)
divi_2 = DivideCurve(A=4.465, B=<missing>)
cons = ConstructPoint(A=seri, B=seri)
cluster2863 = Cluster()
rota = Rotate(A=<missing>, B=seri)
line = Line(A=seri, B=addi)
flip = FlipMatrix(A=seri, B=1.875)
move = Move(A=<missing>, B=addi)
mult = Multiplication(A=divi, B=<missing>)
move_2 = Move(A=0.052, B=divi)
cons_2 = ConstructPoint(A=<missing>, B=<missing>)
loft = Loft(A=addi, B=<missing>)
cull = CullPattern(A=7.451, B=5.445)
cons_3 = ConstructPoint(A=1.588, B=<missing>)
loft_2 = Loft(A=<missing>, B=<missing>)
line_2 = Line(A=line, B=<missing>)
loft_3 = Loft(A=line, B=divi)
seri_2 = Series(A=8.047, B=divi)
loft_4 = Loft(A=<missing>, B=9.678)
cons_4 = ConstructPoint(A=<missing>, B=divi)
flip_2 = FlipMatrix(A=1.472, B=<missing>)
rota_2 = Rotate(A=rota, B=<missing>)
move_3 = Move(A=<missing>, B=line)
cluster1893 = Cluster(In=divi_2)
mult_2 = Multiplication(A=2.693, B=9.154)
divi_3 = DivideCurve(A=6.89, B=loft_2)
seri_3 = Series(A=line, B=<missing>)
addi_2 = Addition(A=<missing>, B=move)
rota_3 = Rotate(A=<missing>, B=<missing>)
disp = Dispatch(A=seri, B=rota)
cons_5 = ConstructPoint(A=seri_2, B=2.037)
move_4 = Move(A=<missing>, B=loft_4)
disp_2 = Dispatch(A=<missing>, B=seri_2)
line_3 = Line(A=2.081, B=7.963)
seri_4 = Series(A=7.34, B=<missing>)
divi_4 = DivideCurve(A=divi_3, B=rota)
rang_2 = Range(A=<missing>, B=<missing>)
cons_6 = ConstructPoint(A=seri, B=9.642)
divi_5 = DivideCurve(A=line_2, B=move)
cons_7 = ConstructPoint(A=move, B=loft_4)
addi_3 = Addition(A=0.671, B=<missing>)
mult_3 = Multiplication(A=<missing>, B=6.225)
addi_4 = Addition(A=divi_2, B=divi_2)
addi_5 = Addition(A=move_4, B=<missing>)
line_4 = Line(A=3.861, B=5.988)
shif = ShiftList(A=move_2, B=addi_2)
seri_5 = Series(A=loft_2, B=0.121)
shif_2 = ShiftList(A=seri, B=addi)
loft_5 = Loft(A=<missing>, B=addi_2)
cluster438 = Cluster(In=<missing>)
disp_3 = Dispatch(A=1.127, B=<missing>)
seri_6 = Series(A=<missing>, B=divi_4)
loft_6 = Loft(A=divi_5, B=line_2)
rota_4 = Rotate(A=divi, B=<missing>)
line_5 = Line(A=0.23, B=<missing>)
rang_3 = Range(A=6.444, B=rota)
seri_7 = Series(A=loft_3, B=1.925)
shif_3 = ShiftList(A=divi_4, B=seri)
flip_3 = FlipMatrix(A=rang_2, B=loft_2)
cons_8 = ConstructPoint(A=rang_2, B=line)
divi_6 = DivideCurve(A=<missing>, B=<missing>)
rang_4 = Range(A=divi, B=rang_2)
move_5 = Move(A=8.586, B=rota)
mult_4 = Multiplication(A=loft_4, B=disp_3)
cons_9 = ConstructPoint(A=5.107, B=rang_2)
line_6 = Line(A=3.55, B=0.188)
move_6 = Move(A=shif_2, B=0.165)
flip_4 = FlipMatrix(A=cons_4, B=loft_2)
line_7 = Line(A=cons_2, B=loft_4)
loft_7 = Loft(A=loft_5, B=5.432)
cons_10 = ConstructPoint(A=<missing>, B=loft)
rota_5 = Rotate(A=7.095, B=9.402)
seri_8 = Series(A=<missing>, B=6.98)
cons_11 = ConstructPoint(A=seri_3, B=line_2)
cons_12 = ConstructPoint(A=divi_4, B=divi_4)
rang_5 = Range(A=seri_5, B=rang_2)
rang_6 = Range(A=1.597, B=cons_6)
mult_5 = Multiplication(A=rota_3, B=flip_3)
addi_6 = Addition(A=seri_5, B=7.051)
mult_6 = Multiplication(A=divi, B=shif_2)
disp_4 = Dispatch(A=addi_2, B=shif_3)  # -> R
# ---------- disp_4: C# ----------
int a = 656;
return a * 2;
# ---------- end disp_4 ----------
disp_5 = Dispatch(A=cons_8, B=<missing>)
loft_8 = Loft(A=loft_5, B=8.122)
disp_6 = Dispatch(A=5.092, B=seri_6)
loft_9 = Loft(A=rota, B=loft_4)
cons_13 = ConstructPoint(A=<missing>, B=cons_8)
addi_7 = Addition(A=move_6, B=line_2)
line_8 = Line(A=5.595, B=loft_5)
seri_9 = Series(A=loft_5, B=line_2)
addi_8 = Addition(A=<missing>, B=6.509)
mult_7 = Multiplication(A=seri, B=0.407)
loft_10 = Loft(A=shif_3, B=<missing>)
seri_10 = Series(A=rota, B=<missing>)
shif_4 = ShiftList(A=1.105, B=<missing>)
divi_7 = DivideCurve(A=flip, B=rang_6)
cons_14 = ConstructPoint(A=flip, B=divi_3)
cull_2 = CullPattern(A=1.015, B=4.893)
loft_11 = Loft(A=move_2, B=<missing>)
cons_15 = ConstructPoint(A=cons_8, B=loft_3)
loft_12 = Loft(A=loft_3, B=flip)
loft_13 = Loft(A=<missing>, B=rang_6)
cons_16 = ConstructPoint(A=cons_4, B=8.007)
cull_3 = CullPattern(A=cons_12, B=4.331)
addi_9 = Addition(A=1.796, B=disp_4)
line_9 = Line(A=3.775, B=<missing>)
line_10 = Line(A=line_6, B=line_7)
addi_10 = Addition(A=2.037, B=5.923)
mult_8 = Multiplication(A=loft_8, B=6.673)
mult_9 = Multiplication(A=cons_13, B=<missing>)
rang_7 = Range(A=6.986, B=loft_2)
line_11 = Line(A=rang_5, B=shif_3)
rota_6 = Rotate(A=flip_3, B=8.95)
line_12 = Line(A=loft_2, B=loft_2)
mult_10 = Multiplication(A=shif_3, B=loft_3)
shif_5 = ShiftList(A=flip_3, B=cons_8)
shif_6 = ShiftList(A=<missing>, B=divi)
mult_11 = Multiplication(A=cons_6, B=flip_3)
move_7 = Move(A=line_2, B=addi_6)
rota_7 = Rotate(A=0.314, B=move_3)
shif_7 = ShiftList(A=addi_3, B=cons_15)
seri_11 = Series(A=line_2, B=loft_12)
rang_8 = Range(A=addi_4, B=2.802)
addi_11 = Addition(A=8.284, B=<missing>)
cons_17 = ConstructPoint(A=cons_5, B=0.214)
disp_7 = Dispatch(A=loft_7, B=cons_15)
addi_12 = Addition(A=rota, B=seri)
mult_12 = Multiplication(A=shif_2, B=<missing>)
rang_9 = Range(A=seri_10, B=divi)
line_13 = Line(A=loft_3, B=shif_3)
cons_18 = ConstructPoint(A=4.196, B=<missing>)
divi_8 = DivideCurve(A=6.261, B=cons_12)
mult_13 = Multiplication(A=loft_5, B=mult_7)  # -> R
# ---------- mult_13: C# ----------
int a = 497;
return a * 2;
# ---------- end mult_13 ----------
divi_9 = DivideCurve(A=1.064, B=5.535)
rota_8 = Rotate(A=disp_4, B=shif_6)
cons_19 = ConstructPoint(A=loft_10, B=loft_3)
cons_20 = ConstructPoint(A=shif_3, B=<missing>)
line_14 = Line(A=<missing>, B=addi_2)
rota_9 = Rotate(A=disp_4, B=7.538)
move_8 = Move(A=<missing>, B=5.291)
line_15 = Line(A=<missing>, B=9.916)
addi_13 = Addition(A=<missing>, B=<missing>)
mult_14 = Multiplication(A=<missing>, B=loft_8)
rang_10 = Range(A=1.381, B=rang_7)
line_16 = Line(A=loft_10, B=shif_2)
addi_14 = Addition(A=<missing>, B=divi_3)
cons_21 = ConstructPoint(A=4.782, B=line_12)
loft_14 = Loft(A=rota_6, B=shif_3)
cons_22 = ConstructPoint(A=seri_2, B=rang_5)
move_9 = Move(A=flip_3, B=cons_14)
rang_11 = Range(A=rang_7, B=<missing>)  # -> R
# ---------- rang_11: C# ----------
int a = 444;
return a * 2;
# ---------- end rang_11 ----------
cull_4 = CullPattern(A=divi_6, B=mult_5)
flip_5 = FlipMatrix(A=flip_3, B=<missing>)
rota_10 = Rotate(A=seri_10, B=divi)
mult_15 = Multiplication(A=seri_6, B=6.482)
loft_15 = Loft(A=loft_10, B=9.937)
loft_16 = Loft(A=9.103, B=move_5)
rota_11 = Rotate(A=8.305, B=cons_16)
seri_12 = Series(A=3.852, B=cons_4)
cluster2766 = Cluster()
seri_13 = Series(A=addi_12, B=<missing>)
line_17 = Line(A=1.273, B=7.649)
cons_23 = ConstructPoint(A=addi_5, B=0.603)
rota_12 = Rotate(A=loft_2, B=<missing>)
cull_5 = CullPattern(A=shif_3, B=divi_4)
shif_8 = ShiftList(A=3.397, B=cons_8)
seri_14 = Series(A=divi_5, B=8.009)
move_10 = Move(A=<missing>, B=1.687)
divi_10 = DivideCurve(A=4.835, B=flip)
rang_12 = Range(A=flip_3, B=line)
cull_6 = CullPattern(A=rota, B=cons_15)
line_18 = Line(A=loft_10, B=addi_6)
loft_17 = Loft(A=line_18, B=<missing>)
cons_24 = ConstructPoint(A=addi_2, B=2.008)
rota_13 = Rotate(A=7.386, B=8.269)
loft_18 = Loft(A=4.568, B=mult_6)
cons_25 = ConstructPoint(A=rang, B=<missing>)
mult_16 = Multiplication(A=addi_9, B=<missing>)
rota_14 = Rotate(A=<missing>, B=<missing>)
move_11 = Move(A=5.529, B=move)
line_19 = Line(A=shif_7, B=rota)
loft_19 = Loft(A=3.571, B=<missing>)
rang_13 = Range(A=5.799, B=rota_6)
seri_15 = Series(A=cons_12, B=rota_12)
divi_11 = DivideCurve(A=mult_12, B=mult_12)
cons_26 = ConstructPoint(A=<missing>, B=addi)
seri_16 = Series(A=rang_9, B=line_12)
line_20 = Line(A=6.369, B=4.407)
cull_7 = CullPattern(A=line_12, B=addi_2)  # -> R
# ---------- cull_7: C# ----------
int a = 338;
return a * 2;
# ---------- end cull_7 ----------
seri_17 = Series(A=divi_7, B=3.885)
rang_14 = Range(A=mult_12, B=9.645)
loft_20 = Loft(A=divi_6, B=9.531)
move_12 = Move(A=flip_3, B=6.787)
line_21 = Line(A=<missing>, B=seri_3)
rang_15 = Range(A=loft_9, B=cons_8)
cluster1796 = Cluster(In=move_5)
cons_27 = ConstructPoint(A=3.089, B=addi_14)
flip_6 = FlipMatrix(A=rang_7, B=2.608)
line_22 = Line(A=rota, B=5.974)
loft_21 = Loft(A=5.622, B=3.555)
rota_15 = Rotate(A=addi, B=6.181)
shif_9 = ShiftList(A=rang_5, B=divi_4)
flip_7 = FlipMatrix(A=seri_10, B=<missing>)  # -> R
# ---------- flip_7: C# ----------
int a = 285;
return a * 2;
# ---------- end flip_7 ----------
disp_8 = Dispatch(A=divi_5, B=8.273)
line_23 = Line(A=rang_7, B=rang_11)
seri_18 = Series(A=mult_5, B=line_2)
loft_22 = Loft(A=move_9, B=rang_6)
mult_17 = Multiplication(A=loft_10, B=seri_2)
seri_19 = Series(A=addi_12, B=line_18)
move_13 = Move(A=1.541, B=4.048)
line_24 = Line(A=<missing>, B=line)
cull_8 = CullPattern(A=cons_9, B=cons_24)
cull_9 = CullPattern(A=7.703, B=<missing>)
line_25 = Line(A=cons_4, B=<missing>)
line_26 = Line(A=rang_11, B=move_3)
rota_16 = Rotate(A=cons_4, B=disp_3)
line_27 = Line(A=4.421, B=loft_13)
move_14 = Move(A=line_2, B=6.101)
divi_12 = DivideCurve(A=seri_5, B=2.766)
seri_20 = Series(A=cull_5, B=<missing>)
divi_13 = DivideCurve(A=addi_12, B=<missing>)
seri_21 = Series(A=cons_26, B=flip_3)
move_15 = Move(A=<missing>, B=shif_8)  # -> R
# ---------- move_15: C# ----------
int a = 232;
return a * 2;
# ---------- end move_15 ----------
move_16 = Move(A=line_22, B=shif_3)
addi_15 = Addition(A=cons_14, B=mult_6)
flip_8 = FlipMatrix(A=6.408, B=divi_3)
move_17 = Move(A=<missing>, B=rota_12)
addi_16 = Addition(A=cons_6, B=<missing>)
rota_17 = Rotate(A=flip_6, B=rang_4)
loft_23 = Loft(A=<missing>, B=cons_5)
cons_28 = ConstructPoint(A=cons_4, B=rota_2)
move_18 = Move(A=<missing>, B=7.524)
loft_24 = Loft(A=move_3, B=disp_4)
rang_16 = Range(A=cons_24, B=flip_7)
seri_22 = Series(A=seri, B=5.284)
rang_17 = Range(A=<missing>, B=8.928)
mult_18 = Multiplication(A=divi_3, B=cons_12)
divi_14 = DivideCurve(A=divi_11, B=mult_7)
rota_18 = Rotate(A=seri_10, B=addi)
rota_19 = Rotate(A=seri_16, B=addi_14)  # -> R
# ---------- rota_19: C# ----------
int a = 179;
return a * 2;
# ---------- end rota_19 ----------
rang_18 = Range(A=shif_4, B=8.185)
cluster341 = Cluster(In=mult_12)
cons_29 = ConstructPoint(A=rang_11, B=addi_15)
cons_30 = ConstructPoint(A=move_15, B=shif_8)
seri_23 = Series(A=flip_7, B=flip_8)
move_19 = Move(A=divi_11, B=<missing>)
loft_25 = Loft(A=loft, B=2.715)
mult_19 = Multiplication(A=shif_8, B=divi_5)
seri_24 = Series(A=move_7, B=6.771)
addi_17 = Addition(A=cons_19, B=line_22)
cons_31 = ConstructPoint(A=8.037, B=line_13)
move_20 = Move(A=cull_6, B=loft_2)
line_28 = Line(A=seri_17, B=loft_4)
move_21 = Move(A=0.266, B=6.842)
rang_19 = Range(A=9.208, B=5.283)
cull_10 = CullPattern(A=<missing>, B=divi_11)  # -> R
# ---------- cull_10: C# ----------
int a = 126;
return a * 2;
# ---------- end cull_10 ----------
flip_9 = FlipMatrix(A=5.526, B=divi_5)
loft_26 = Loft(A=8.786, B=5.869)
mult_20 = Multiplication(A=shif_2, B=7.887)
divi_15 = DivideCurve(A=<missing>, B=4.793)
loft_27 = Loft(A=cons_2, B=1.649)
mult_21 = Multiplication(A=move_2, B=divi_5)
divi_16 = DivideCurve(A=7.024, B=3.075)
seri_25 = Series(A=2.662, B=cons_29)
loft_28 = Loft(A=flip, B=loft_5)
cons_32 = ConstructPoint(A=2.411, B=seri_24)
addi_18 = Addition(A=cons_6, B=rota_2)
cons_33 = ConstructPoint(A=loft_25, B=8.729)
cull_11 = CullPattern(A=5.055, B=move_8)
seri_26 = Series(A=line_19, B=cons_20)  # -> R
# ---------- seri_26: C# ----------
int a = 2988;
return a * 2;
# ---------- end seri_26 ----------
move_22 = Move(A=rota, B=rota)
loft_29 = Loft(A=line_22, B=shif_3)  # -> R
# ---------- loft_29: C# ----------
int a = 73;
return a * 2;
# ---------- end loft_29 ----------
addi_19 = Addition(A=rang_9, B=rang_9)
seri_27 = Series(A=rang_6, B=mult_12)
disp_9 = Dispatch(A=rang_4, B=7.903)
rang_20 = Range(A=rang_2, B=rota_3)
rota_20 = Rotate(A=<missing>, B=rang_7)
divi_17 = DivideCurve(A=mult_10, B=cull_2)
seri_28 = Series(A=6.24, B=9.359)
seri_29 = Series(A=disp_4, B=cull_7)
divi_18 = DivideCurve(A=1.41, B=divi)
cons_34 = ConstructPoint(A=rang_6, B=cons_28)
mult_22 = Multiplication(A=move_17, B=cons_9)
rang_21 = Range(A=loft_18, B=<missing>)
rang_22 = Range(A=divi_16, B=loft_24)
divi_19 = DivideCurve(A=line_9, B=divi_14)
flip_10 = FlipMatrix(A=line_11, B=<missing>)
seri_30 = Series(A=loft_22, B=loft_4)
seri_31 = Series(A=mult_12, B=<missing>)
divi_20 = DivideCurve(A=move_5, B=7.291)
cons_35 = ConstructPoint(A=<missing>, B=6.043)
seri_32 = Series(A=<missing>, B=9.192)  # -> R
# ---------- seri_32: C# ----------
int a = 2935;
return a * 2;
# ---------- end seri_32 ----------
divi_21 = DivideCurve(A=seri, B=seri_5)  # -> R
# ---------- divi_21: C# ----------
int a = 20;
return a * 2;
# ---------- end divi_21 ----------
rang_23 = Range(A=2.089, B=7.313)
loft_30 = Loft(A=rota_15, B=8.193)
mult_23 = Multiplication(A=9.348, B=rota_6)
mult_24 = Multiplication(A=rota_6, B=divi_6)
addi_20 = Addition(A=mult_10, B=cull_10)
move_23 = Move(A=rang_4, B=addi_2)
divi_22 = DivideCurve(A=cons_18, B=seri_15)
addi_21 = Addition(A=divi_10, B=rang_2)
seri_33 = Series(A=divi_13, B=mult_20)
divi_23 = DivideCurve(A=0.21, B=9.296)
divi_24 = DivideCurve(A=<missing>, B=rang_7)
divi_25 = DivideCurve(A=2.441, B=divi_8)
line_29 = Line(A=2.29, B=7.865)
mult_25 = Multiplication(A=loft_22, B=5.492)
line_30 = Line(A=<missing>, B=cons_6)
loft_31 = Loft(A=<missing>, B=loft_16)
addi_22 = Addition(A=disp_6, B=<missing>)
move_24 = Move(A=7.144, B=move_17)
loft_32 = Loft(A=loft_24, B=<missing>)
cull_12 = CullPattern(A=<missing>, B=3.465)
flip_11 = FlipMatrix(A=seri_23, B=divi_9)
mult_26 = Multiplication(A=rang, B=loft_8)
divi_26 = DivideCurve(A=<missing>, B=7.327)
mult_27 = Multiplication(A=<missing>, B=line_10)
move_25 = Move(A=cons, B=addi_12)
rota_21 = Rotate(A=1.934, B=mult_20)  # -> R
# ---------- rota_21: C# ----------
int a = 2882;
return a * 2;
# ---------- end rota_21 ----------
addi_23 = Addition(A=loft_15, B=divi_17)
loft_33 = Loft(A=rang_7, B=seri)
mult_28 = Multiplication(A=addi, B=rang_5)
seri_34 = Series(A=shif_3, B=rang_2)
seri_35 = Series(A=rang_9, B=addi_2)
loft_34 = Loft(A=<missing>, B=addi_14)
addi_24 = Addition(A=rang_6, B=rota_19)
rota_22 = Rotate(A=disp_5, B=divi_8)
loft_35 = Loft(A=3.818, B=<missing>)
addi_25 = Addition(A=move_13, B=seri_24)
seri_36 = Series(A=shif_9, B=seri_5)
cons_36 = ConstructPoint(A=line_13, B=5.261)
rota_23 = Rotate(A=divi_18, B=3.499)
line_31 = Line(A=2.284, B=2.387)
divi_27 = DivideCurve(A=loft_2, B=rota)
rota_24 = Rotate(A=seri_15, B=divi_11)
move_26 = Move(A=mult_12, B=cons_21)
mult_29 = Multiplication(A=disp, B=<missing>)
rang_24 = Range(A=cons_29, B=6.097)
seri_37 = Series(A=<missing>, B=divi_9)
disp_10 = Dispatch(A=6.882, B=shif_2)
divi_28 = DivideCurve(A=0.547, B=addi_12)
mult_30 = Multiplication(A=1.596, B=mult_10)
move_27 = Move(A=rota_6, B=loft_34)
rang_25 = Range(A=disp_3, B=move_15)
rota_25 = Rotate(A=line_3, B=cons_5)
addi_26 = Addition(A=divi_24, B=loft_20)
rota_26 = Rotate(A=<missing>, B=seri_34)
move_28 = Move(A=7.314, B=move_4)
cons_37 = ConstructPoint(A=3.493, B=5.03)
rota_27 = Rotate(A=cons_25, B=5.834)
divi_29 = DivideCurve(A=5.486, B=6.546)
seri_38 = Series(A=divi_4, B=line_25)
addi_27 = Addition(A=addi_12, B=seri_5)
seri_39 = Series(A=line_16, B=line_22)
rota_28 = Rotate(A=seri, B=seri_34)
mult_31 = Multiplication(A=rota_12, B=3.519)
divi_30 = DivideCurve(A=rang_4, B=6.396)
rota_29 = Rotate(A=mult, B=5.637)
loft_36 = Loft(A=rang_19, B=line_12)
line_32 = Line(A=rota_2, B=shif_4)
line_33 = Line(A=<missing>, B=rota_18)
seri_40 = Series(A=0.9, B=line_33)  # -> R
# ---------- seri_40: C# ----------
int a = 1080;
return a * 2;
# ---------- end seri_40 ----------
seri_41 = Series(A=seri_40, B=6.391)
cull_13 = CullPattern(A=4.524, B=seri_40)
rota_30 = Rotate(A=seri_40, B=0.983)
cons_38 = ConstructPoint(A=seri_40, B=rang_2)
cons_39 = ConstructPoint(A=mult_21, B=<missing>)
rota_31 = Rotate(A=3.744, B=move_19)
cull_14 = CullPattern(A=line_2, B=<missing>)
rota_32 = Rotate(A=cons_20, B=seri_23)
line_34 = Line(A=rang_10, B=rota_2)
mult_32 = Multiplication(A=rang_19, B=move_18)
seri_42 = Series(A=rang_3, B=5.431)
loft_37 = Loft(A=line_10, B=rang_5)
shif_10 = ShiftList(A=8.854, B=mult_6)
cons_40 = ConstructPoint(A=7.106, B=shif_4)
line_35 = Line(A=shif_3, B=6.948)
addi_28 = Addition(A=<missing>, B=6.71)
mult_33 = Multiplication(A=line_11, B=8.046)
cons_41 = ConstructPoint(A=rang_6, B=line_2)
seri_43 = Series(A=line_13, B=line_2)
rang_26 = Range(A=move_26, B=cons_26)
rota_33 = Rotate(A=rang_2, B=9.481)
divi_31 = DivideCurve(A=4.914, B=seri)
rota_34 = Rotate(A=<missing>, B=mult_18)
cons_42 = ConstructPoint(A=<missing>, B=8.068)
seri_44 = Series(A=addi_27, B=5.337)
seri_45 = Series(A=2.471, B=8.374)
seri_46 = Series(A=loft_18, B=divi_13)
loft_38 = Loft(A=line_6, B=3.954)
line_36 = Line(A=<missing>, B=cons_29)
loft_39 = Loft(A=divi_13, B=<missing>)
rota_35 = Rotate(A=loft_3, B=mult_30)
loft_40 = Loft(A=cons_6, B=3.298)
line_37 = Line(A=<missing>, B=9.404)
addi_29 = Addition(A=<missing>, B=move_18)
cons_43 = ConstructPoint(A=flip_7, B=seri_17)
addi_30 = Addition(A=cons, B=8.481)  # -> R
# ---------- addi_30: C# ----------
int a = 2670;
return a * 2;
# ---------- end addi_30 ----------
flip_12 = FlipMatrix(A=3.945, B=divi_13)
rota_36 = Rotate(A=rota_7, B=3.531)
divi_32 = DivideCurve(A=shif_3, B=seri_15)
flip_13 = FlipMatrix(A=loft_10, B=rota)
divi_33 = DivideCurve(A=divi_21, B=loft_33)
move_29 = Move(A=divi_21, B=addi)
addi_31 = Addition(A=seri_15, B=1.448)
seri_47 = Series(A=5.698, B=divi_12)
addi_32 = Addition(A=<missing>, B=shif_5)
seri_48 = Series(A=loft_29, B=loft_3)
divi_34 = DivideCurve(A=<missing>, B=seri_17)
line_38 = Line(A=<missing>, B=rota_18)
loft_41 = Loft(A=shif_5, B=9.572)
move_30 = Move(A=move_16, B=loft_25)
loft_42 = Loft(A=0.962, B=4.607)
cons_44 = ConstructPoint(A=line_11, B=loft_14)
cluster1699 = Cluster(In=cons_14)
rang_27 = Range(A=loft_9, B=0.529)
rang_28 = Range(A=seri_11, B=addi_24)
rang_29 = Range(A=divi_12, B=addi_12)
move_31 = Move(A=line_11, B=flip_6)
cull_15 = CullPattern(A=line, B=rota_12)
cons_45 = ConstructPoint(A=2.825, B=loft_2)
move_32 = Move(A=5.867, B=mult_12)
move_33 = Move(A=seri_21, B=5.181)
mult_34 = Multiplication(A=rang_5, B=move_26)
move_34 = Move(A=move_23, B=3.145)
line_39 = Line(A=mult_33, B=9.278)
addi_33 = Addition(A=divi_13, B=cull_10)
line_40 = Line(A=rota_20, B=addi_28)
move_35 = Move(A=7.002, B=line_40)
rota_37 = Rotate(A=<missing>, B=move_35)
seri_49 = Series(A=<missing>, B=rota_37)
line_41 = Line(A=rota_28, B=move_35)
line_42 = Line(A=rota_33, B=line_12)
rota_38 = Rotate(A=cons_21, B=rota_6)
line_43 = Line(A=5.842, B=cons_2)
cluster1214 = Cluster(In=cons_41)
rota_39 = Rotate(A=divi_6, B=<missing>)
loft_43 = Loft(A=seri_18, B=3.913)
seri_50 = Series(A=<missing>, B=<missing>)
shif_11 = ShiftList(A=divi_30, B=rota)
addi_34 = Addition(A=rota_24, B=<missing>)
rota_40 = Rotate(A=9.336, B=divi_33)
divi_35 = DivideCurve(A=<missing>, B=cons_38)
move_36 = Move(A=8.74, B=9.498)
flip_14 = FlipMatrix(A=5.65, B=0.768)
divi_36 = DivideCurve(A=5.196, B=mult_7)
cons_46 = ConstructPoint(A=line_22, B=rang_5)
mult_35 = Multiplication(A=2.185, B=loft_21)
line_44 = Line(A=cons_12, B=<missing>)
cons_47 = ConstructPoint(A=rota_3, B=rota_19)
cons_48 = ConstructPoint(A=loft_14, B=<missing>)
cull_16 = CullPattern(A=mult_18, B=mult_33)
addi_35 = Addition(A=loft_3, B=loft_5)
line_45 = Line(A=rota_20, B=flip)
rota_41 = Rotate(A=2.044, B=9.848)
loft_44 = Loft(A=mult_17, B=5.078)
move_37 = Move(A=<missing>, B=divi_16)
cons_49 = ConstructPoint(A=divi_8, B=addi_6)
mult_36 = Multiplication(A=8.431, B=line_40)
flip_15 = FlipMatrix(A=6.069, B=<missing>)
rota_42 = Rotate(A=6.803, B=divi_19)
seri_51 = Series(A=cons_26, B=7.552)
divi_37 = DivideCurve(A=seri_5, B=loft_2)
seri_52 = Series(A=seri, B=divi_14)
cluster244 = Cluster(In=seri_10)
seri_53 = Series(A=loft_3, B=<missing>)
disp_11 = Dispatch(A=move_29, B=move_31)
mult_37 = Multiplication(A=<missing>, B=loft_36)
seri_54 = Series(A=0.605, B=move_29)
mult_38 = Multiplication(A=6.364, B=<missing>)
addi_36 = Addition(A=2.195, B=divi_32)
rang_30 = Range(A=<missing>, B=move_17)
loft_45 = Loft(A=move_16, B=cons_41)
mult_39 = Multiplication(A=rota_33, B=rang_23)
cull_17 = CullPattern(A=mult_15, B=rang_26)
cons_50 = ConstructPoint(A=loft_42, B=1.44)
rang_31 = Range(A=cull_8, B=line)
divi_38 = DivideCurve(A=<missing>, B=line_43)
mult_40 = Multiplication(A=<missing>, B=<missing>)
loft_46 = Loft(A=mult_40, B=4.708)
move_38 = Move(A=3.635, B=loft_46)
loft_47 = Loft(A=loft_46, B=cull)
move_39 = Move(A=3.354, B=divi_13)
move_40 = Move(A=4.501, B=3.688)
divi_39 = DivideCurve(A=4.212, B=0.99)
line_46 = Line(A=loft_33, B=rang_29)
addi_37 = Addition(A=mult_28, B=<missing>)
flip_16 = FlipMatrix(A=addi_14, B=addi_14)
line_47 = Line(A=rota_19, B=divi_3)
mult_41 = Multiplication(A=<missing>, B=rang_6)
divi_40 = DivideCurve(A=6.629, B=<missing>)
rang_32 = Range(A=loft_21, B=seri_14)
rang_33 = Range(A=5.187, B=rota_15)
addi_38 = Addition(A=seri, B=move_26)
mult_42 = Multiplication(A=cons_7, B=move_33)
shif_12 = ShiftList(A=rang_19, B=rang_20)
mult_43 = Multiplication(A=3.57, B=seri_10)
cons_51 = ConstructPoint(A=2.277, B=8.319)
disp_12 = Dispatch(A=loft_45, B=<missing>)
rota_43 = Rotate(A=rota_4, B=<missing>)
move_41 = Move(A=<missing>, B=move)
line_48 = Line(A=loft_27, B=<missing>)
loft_48 = Loft(A=cull_3, B=cons_28)
seri_55 = Series(A=mult_19, B=mult_15)
cons_52 = ConstructPoint(A=<missing>, B=addi_14)
flip_17 = FlipMatrix(A=0.433, B=cons_41)  # -> R
# ---------- flip_17: C# ----------
int a = 2405;
return a * 2;
# ---------- end flip_17 ----------
addi_39 = Addition(A=cons_39, B=loft_21)
line_49 = Line(A=addi_27, B=<missing>)
seri_56 = Series(A=addi_12, B=3.297)
loft_49 = Loft(A=<missing>, B=flip_13)
move_42 = Move(A=divi_3, B=divi)
rang_34 = Range(A=cull_10, B=addi_19)
loft_50 = Loft(A=addi_2, B=line_46)
line_50 = Line(A=3.303, B=mult_10)
loft_51 = Loft(A=<missing>, B=2.608)
line_51 = Line(A=divi_36, B=rang_19)
cons_53 = ConstructPoint(A=line_51, B=flip_14)
line_52 = Line(A=rota, B=cons_53)
loft_52 = Loft(A=mult_3, B=cons_53)
loft_53 = Loft(A=move_12, B=loft_52)
divi_41 = DivideCurve(A=loft_53, B=8.187)  # -> R
# ---------- divi_41: C# ----------
int a = 2511;
return a * 2;
# ---------- end divi_41 ----------
rota_44 = Rotate(A=cons_53, B=5.839)
move_43 = Move(A=seri_17, B=disp_9)
move_44 = Move(A=1.715, B=shif_5)
rota_45 = Rotate(A=<missing>, B=4.022)
divi_42 = DivideCurve(A=loft_13, B=<missing>)
line_53 = Line(A=move_32, B=line_45)
rota_46 = Rotate(A=addi_16, B=mult_37)
line_54 = Line(A=seri_5, B=flip_2)
disp_13 = Dispatch(A=seri_24, B=move_22)
rang_35 = Range(A=9.513, B=addi_17)
addi_40 = Addition(A=rota_13, B=6.872)
divi_43 = DivideCurve(A=disp_6, B=2.915)
shif_13 = ShiftList(A=1.417, B=mult_38)
cull_18 = CullPattern(A=4.874, B=<missing>)
move_45 = Move(A=cons_6, B=3.139)
move_46 = Move(A=rang_29, B=seri_25)
line_55 = Line(A=cons_45, B=<missing>)
flip_18 = FlipMatrix(A=cons_12, B=divi_3)
seri_57 = Series(A=mult_28, B=rang_10)
divi_44 = DivideCurve(A=<missing>, B=flip_14)
divi_45 = DivideCurve(A=line_35, B=seri_15)
divi_46 = DivideCurve(A=loft_30, B=seri_43)
line_56 = Line(A=<missing>, B=move_16)
cons_54 = ConstructPoint(A=seri, B=8.887)
loft_54 = Loft(A=seri_15, B=cons_54)
loft_55 = Loft(A=loft_54, B=<missing>)  # -> R
# ---------- loft_55: C# ----------
int a = 1027;
return a * 2;
# ---------- end loft_55 ----------
mult_44 = Multiplication(A=loft_54, B=<missing>)
rota_47 = Rotate(A=cons_4, B=loft_54)
rang_36 = Range(A=loft_54, B=mult_3)
move_47 = Move(A=<missing>, B=rang_36)
cons_55 = ConstructPoint(A=addi_6, B=rang_36)
addi_41 = Addition(A=move_17, B=rang_36)
rota_48 = Rotate(A=loft_54, B=cluster438)
rota_49 = Rotate(A=9.416, B=loft_54)
line_57 = Line(A=rang_6, B=line_12)
line_58 = Line(A=7.393, B=divi_4)
divi_47 = DivideCurve(A=flip_13, B=divi_4)
shif_14 = ShiftList(A=move_4, B=move_43)
divi_48 = DivideCurve(A=move_7, B=addi_6)
addi_42 = Addition(A=loft_33, B=8.014)
rang_37 = Range(A=9.747, B=divi_14)
loft_56 = Loft(A=divi_31, B=6.201)
line_59 = Line(A=mult_15, B=seri_35)
rota_50 = Rotate(A=7.74, B=<missing>)
seri_58 = Series(A=2.93, B=<missing>)
addi_43 = Addition(A=cons_55, B=seri_24)
mult_45 = Multiplication(A=9.479, B=<missing>)
seri_59 = Series(A=2.541, B=4.892)
line_60 = Line(A=rota_19, B=rang_10)
loft_57 = Loft(A=mult_43, B=move_6)
divi_49 = DivideCurve(A=disp_12, B=disp_11)
flip_19 = FlipMatrix(A=6.555, B=line_21)
loft_58 = Loft(A=<missing>, B=addi_27)
line_61 = Line(A=move_22, B=divi_36)
loft_59 = Loft(A=rang_9, B=seri_52)
cons_56 = ConstructPoint(A=loft_59, B=addi_14)
cons_57 = ConstructPoint(A=cons_56, B=seri)
loft_60 = Loft(A=cons_57, B=cons_57)
mult_46 = Multiplication(A=5.216, B=cons_56)
addi_44 = Addition(A=<missing>, B=loft_60)
addi_45 = Addition(A=loft_60, B=2.008)
rota_51 = Rotate(A=line, B=cons_56)
cull_19 = CullPattern(A=loft_60, B=<missing>)
mult_47 = Multiplication(A=rota_51, B=loft_2)
mult_48 = Multiplication(A=rota_51, B=rota)
move_48 = Move(A=cons_56, B=addi)
move_49 = Move(A=seri, B=cons_57)
move_50 = Move(A=disp_2, B=mult_46)
move_51 = Move(A=divi_3, B=cons_56)
divi_50 = DivideCurve(A=flip, B=move_48)
divi_51 = DivideCurve(A=mult_48, B=9.062)
cons_58 = ConstructPoint(A=move_48, B=8.751)
move_52 = Move(A=cons_5, B=cull_19)
cons_59 = ConstructPoint(A=seri_2, B=mult_48)
move_53 = Move(A=cons_56, B=line_2)
rang_38 = Range(A=line_2, B=mult_47)
cons_60 = ConstructPoint(A=mult_48, B=cull_2)
mult_49 = Multiplication(A=7.779, B=move_49)
addi_46 = Addition(A=move_6, B=mult_46)
move_54 = Move(A=9.835, B=cons_59)
loft_61 = Loft(A=shif_4, B=move_48)
line_62 = Line(A=loft_2, B=mult_46)
cons_61 = ConstructPoint(A=1.847, B=addi_44)
move_55 = Move(A=rang_3, B=mult_48)
mult_50 = Multiplication(A=1.602, B=mult_47)
line_63 = Line(A=divi_50, B=<missing>)
mult_51 = Multiplication(A=cons_56, B=seri_40)
disp_14 = Dispatch(A=rota, B=move_48)
shif_15 = ShiftList(A=2.011, B=addi_46)
disp_15 = Dispatch(A=disp_6, B=move_51)
mult_52 = Multiplication(A=cons_57, B=shif_3)
cons_62 = ConstructPoint(A=cons_57, B=<missing>)
divi_52 = DivideCurve(A=move_49, B=7.251)
divi_53 = DivideCurve(A=loft_14, B=loft_60)
loft_62 = Loft(A=cull_2, B=cons_61)
divi_54 = DivideCurve(A=mult_5, B=rota_51)
divi_55 = DivideCurve(A=disp_14, B=<missing>)
divi_56 = DivideCurve(A=5.918, B=loft_60)
seri_60 = Series(A=2.449, B=divi_56)
loft_63 = Loft(A=seri_60, B=8.702)
move_56 = Move(A=7.552, B=seri_60)
loft_64 = Loft(A=move_56, B=4.968)
move_57 = Move(A=move_56, B=cons_2)
divi_57 = DivideCurve(A=0.499, B=move_56)
addi_47 = Addition(A=move_56, B=<missing>)
move_58 = Move(A=2.057, B=seri_60)
rota_52 = Rotate(A=loft_61, B=move_53)
addi_48 = Addition(A=disp_14, B=8.973)
divi_58 = DivideCurve(A=loft_4, B=line_62)
seri_61 = Series(A=cons_60, B=<missing>)
line_64 = Line(A=loft_61, B=7.351)
rang_39 = Range(A=rota_6, B=move_53)
disp_16 = Dispatch(A=0.912, B=move_49)
mult_53 = Multiplication(A=divi_50, B=seri_20)
mult_54 = Multiplication(A=addi_48, B=rang_38)
seri_62 = Series(A=rang_38, B=4.441)
addi_49 = Addition(A=2.398, B=move_49)
divi_59 = DivideCurve(A=mult_7, B=cons_57)
move_59 = Move(A=divi_50, B=mult_47)
rota_53 = Rotate(A=move_48, B=seri_16)
mult_55 = Multiplication(A=loft_63, B=shif_8)
cons_63 = ConstructPoint(A=rota_51, B=addi)
move_60 = Move(A=flip, B=rang_38)
divi_60 = DivideCurve(A=cluster341, B=disp_16)
rota_54 = Rotate(A=<missing>, B=line_64)
cull_20 = CullPattern(A=rang_11, B=divi_53)
addi_50 = Addition(A=cons_5, B=seri_62)
mult_56 = Multiplication(A=divi_54, B=loft_21)
divi_61 = DivideCurve(A=2.555, B=cons_63)
rota_55 = Rotate(A=<missing>, B=mult_47)
divi_62 = DivideCurve(A=<missing>, B=mult_48)
divi_63 = DivideCurve(A=divi_54, B=<missing>)
shif_16 = ShiftList(A=line_13, B=rota_51)
disp_17 = Dispatch(A=cons_56, B=8.051)
rota_56 = Rotate(A=<missing>, B=rang_39)
cons_64 = ConstructPoint(A=4.074, B=rang_38)
cull_21 = CullPattern(A=rang_38, B=addi_6)
seri_63 = Series(A=mult_56, B=cons_41)
divi_64 = DivideCurve(A=7.934, B=divi_55)
cull_22 = CullPattern(A=6.863, B=move_52)
cluster729 = Cluster(In=divi_54)
addi_51 = Addition(A=rang_19, B=move_60)
divi_65 = DivideCurve(A=line_64, B=1.977)
line_65 = Line(A=5.838, B=rota_52)
seri_64 = Series(A=cons_59, B=mult_31)
addi_52 = Addition(A=divi_23, B=addi_50)
rang_40 = Range(A=move_3, B=shif_16)
shif_17 = ShiftList(A=addi_49, B=rang_23)
addi_53 = Addition(A=move_28, B=cull_19)
rota_57 = Rotate(A=8.48, B=mult_47)
loft_65 = Loft(A=<missing>, B=line_62)
seri_65 = Series(A=line_62, B=shif_9)
disp_18 = Dispatch(A=0.367, B=mult_46)
move_61 = Move(A=cons_57, B=4.55)
cons_65 = ConstructPoint(A=divi_55, B=divi_23)
move_62 = Move(A=seri_10, B=7.433)
addi_54 = Addition(A=rota_24, B=3.22)
rang_41 = Range(A=cons_46, B=<missing>)
flip_20 = FlipMatrix(A=loft_2, B=rota_24)
seri_66 = Series(A=rang_9, B=rang_9)
move_63 = Move(A=divi_27, B=7.763)
cons_66 = ConstructPoint(A=6.84, B=addi_33)
loft_66 = Loft(A=shif_6, B=<missing>)
divi_66 = DivideCurve(A=8.026, B=divi_64)
rang_42 = Range(A=disp_9, B=rota_49)
mult_57 = Multiplication(A=line_33, B=divi_54)
cons_67 = ConstructPoint(A=disp_3, B=1.714)
rota_58 = Rotate(A=disp_10, B=line_39)
addi_55 = Addition(A=6.228, B=rang_10)
rang_43 = Range(A=divi_59, B=1.678)
rota_59 = Rotate(A=seri_35, B=mult_23)
cons_68 = ConstructPoint(A=3.993, B=<missing>)  # -> R
# ---------- cons_68: C# ----------
int a = 2246;
return a * 2;
# ---------- end cons_68 ----------
seri_67 = Series(A=7.968, B=addi_43)
cons_69 = ConstructPoint(A=divi_41, B=3.928)
cons_70 = ConstructPoint(A=rang_11, B=1.861)
move_64 = Move(A=divi_37, B=flip_6)
divi_67 = DivideCurve(A=<missing>, B=divi_11)
divi_68 = DivideCurve(A=mult_18, B=seri_56)
addi_56 = Addition(A=seri_3, B=divi_5)
line_66 = Line(A=cluster244, B=move_48)
cons_71 = ConstructPoint(A=seri_21, B=9.44)
cull_23 = CullPattern(A=move_62, B=<missing>)
divi_69 = DivideCurve(A=rang_38, B=cons_21)
line_67 = Line(A=cons_21, B=<missing>)
loft_67 = Loft(A=divi_8, B=rota)
line_68 = Line(A=<missing>, B=loft_60)
loft_68 = Loft(A=seri, B=cons_7)
cull_24 = CullPattern(A=move_23, B=rota_29)
rota_60 = Rotate(A=line_13, B=6.63)
rang_44 = Range(A=<missing>, B=seri_53)
disp_19 = Dispatch(A=1.727, B=rota_49)
shif_18 = ShiftList(A=cons_57, B=cons_9)
seri_68 = Series(A=mult_20, B=0.022)
cons_72 = ConstructPoint(A=4.735, B=divi_15)
line_69 = Line(A=3.896, B=divi_14)
seri_69 = Series(A=5.568, B=9.551)
mult_58 = Multiplication(A=<missing>, B=loft_2)
shif_19 = ShiftList(A=4.035, B=cull_4)
addi_57 = Addition(A=divi_41, B=6.55)
line_70 = Line(A=divi_29, B=line_48)
divi_70 = DivideCurve(A=<missing>, B=1.824)
rang_45 = Range(A=seri_5, B=shif_2)
mult_59 = Multiplication(A=flip_6, B=line_16)
rota_61 = Rotate(A=rang_34, B=seri_16)
shif_20 = ShiftList(A=seri_3, B=shif_3)
cons_73 = ConstructPoint(A=move_53, B=seri_20)
rota_62 = Rotate(A=seri_21, B=move_16)
move_65 = Move(A=addi_56, B=seri)
rota_63 = Rotate(A=divi_37, B=8.062)
rang_46 = Range(A=cull_15, B=0.811)
mult_60 = Multiplication(A=rang_24, B=flip_20)
line_71 = Line(A=4.475, B=seri_33)
rang_47 = Range(A=move_7, B=shif_4)
shif_21 = ShiftList(A=disp_16, B=seri_19)
flip_21 = FlipMatrix(A=rota_34, B=move_63)
cons_74 = ConstructPoint(A=divi_11, B=move_10)
line_72 = Line(A=2.748, B=loft_36)
move_66 = Move(A=3.914, B=8.658)
rang_48 = Range(A=addi_40, B=cons_30)
flip_22 = FlipMatrix(A=loft_21, B=disp_8)
disp_20 = Dispatch(A=line_66, B=6.731)
move_67 = Move(A=<missing>, B=<missing>)
loft_69 = Loft(A=rota_26, B=addi_40)
cluster2572 = Cluster(In=line_44)
line_73 = Line(A=6.747, B=shif_7)
line_74 = Line(A=mult_41, B=divi_3)
mult_61 = Multiplication(A=rang_10, B=9.415)
line_75 = Line(A=line_61, B=loft_29)
mult_62 = Multiplication(A=5.448, B=flip_14)
mult_63 = Multiplication(A=5.679, B=5.19)
divi_71 = DivideCurve(A=mult_63, B=shif_9)
rota_64 = Rotate(A=divi_71, B=seri_60)
divi_72 = DivideCurve(A=rota_64, B=move_3)
cons_75 = ConstructPoint(A=rota_64, B=cull_19)
rota_65 = Rotate(A=move, B=divi_71)
divi_73 = DivideCurve(A=seri_47, B=divi_72)
move_68 = Move(A=<missing>, B=0.365)
line_76 = Line(A=cons_6, B=seri_2)
flip_23 = FlipMatrix(A=mult_34, B=6.897)
mult_64 = Multiplication(A=move_31, B=line_64)
addi_58 = Addition(A=seri_35, B=move_60)
addi_59 = Addition(A=disp_8, B=divi_33)
cons_76 = ConstructPoint(A=rang_14, B=<missing>)
move_69 = Move(A=mult_20, B=loft_2)
loft_70 = Loft(A=shif_8, B=mult_60)
flip_24 = FlipMatrix(A=flip_20, B=loft_59)
mult_65 = Multiplication(A=0.131, B=addi_56)
divi_74 = DivideCurve(A=cons_6, B=rota_52)
rota_66 = Rotate(A=0.292, B=loft_54)
shif_22 = ShiftList(A=rang_24, B=addi_31)
addi_60 = Addition(A=cons_7, B=<missing>)
mult_66 = Multiplication(A=addi_32, B=2.596)
mult_67 = Multiplication(A=move_29, B=4.518)
move_70 = Move(A=5.006, B=addi_3)
cluster2087 = Cluster(In=seri_15)
shif_23 = ShiftList(A=seri_69, B=2.714)
mult_68 = Multiplication(A=divi_24, B=cons_60)
cons_77 = ConstructPoint(A=move_5, B=flip_10)
rota_67 = Rotate(A=rota_58, B=5.577)
divi_75 = DivideCurve(A=7.509, B=flip_6)
move_71 = Move(A=loft_29, B=seri_56)
mult_69 = Multiplication(A=divi_67, B=line_46)
rang_49 = Range(A=rang_2, B=cull_10)
divi_76 = DivideCurve(A=loft_33, B=<missing>)
divi_77 = DivideCurve(A=line_2, B=mult_47)
cons_78 = ConstructPoint(A=divi_45, B=line_11)
mult_70 = Multiplication(A=move_22, B=seri_27)
loft_71 = Loft(A=rang_33, B=line_46)
mult_71 = Multiplication(A=addi_35, B=divi_33)
cull_25 = CullPattern(A=8.378, B=divi_13)
mult_72 = Multiplication(A=line_11, B=divi_31)
move_72 = Move(A=7.734, B=addi_3)
mult_73 = Multiplication(A=seri_66, B=cons_39)
shif_24 = ShiftList(A=3.826, B=divi_9)
addi_61 = Addition(A=disp_5, B=loft_26)
flip_25 = FlipMatrix(A=rang_36, B=3.186)
cluster1602 = Cluster(In=disp_18)
rang_50 = Range(A=line_47, B=0.304)
mult_74 = Multiplication(A=divi_13, B=mult_12)
seri_70 = Series(A=mult_63, B=move_33)
shif_25 = ShiftList(A=move_43, B=loft_34)
mult_75 = Multiplication(A=seri_66, B=disp_16)
rota_68 = Rotate(A=addi_57, B=<missing>)
divi_78 = DivideCurve(A=rang_7, B=flip_14)
rota_69 = Rotate(A=<missing>, B=0.28)
seri_71 = Series(A=addi_19, B=flip_20)
loft_72 = Loft(A=flip_14, B=flip_7)
seri_72 = Series(A=loft_13, B=move_72)
rota_70 = Rotate(A=6.982, B=line_67)
cluster1117 = Cluster()
seri_73 = Series(A=3.339, B=<missing>)
cons_79 = ConstructPoint(A=6.628, B=<missing>)
addi_62 = Addition(A=2.908, B=rang_32)
rang_51 = Range(A=<missing>, B=mult_10)
addi_63 = Addition(A=move_48, B=3.225)
rang_52 = Range(A=5.371, B=9.233)
flip_26 = FlipMatrix(A=line_22, B=rang_22)
move_73 = Move(A=divi_10, B=addi_59)
seri_74 = Series(A=9.685, B=6.183)
mult_76 = Multiplication(A=shif_10, B=2.915)
mult_77 = Multiplication(A=1.637, B=4.73)
move_74 = Move(A=2.068, B=line_61)
seri_75 = Series(A=mult_31, B=0.477)
cons_80 = ConstructPoint(A=9.486, B=seri_5)
line_77 = Line(A=rang_19, B=<missing>)
loft_73 = Loft(A=line_61, B=line_77)
cons_81 = ConstructPoint(A=<missing>, B=rang_26)
cluster632 = Cluster()
move_75 = Move(A=<missing>, B=cull_25)
mult_78 = Multiplication(A=<missing>, B=cons_7)
loft_74 = Loft(A=<missing>, B=addi_19)
line_78 = Line(A=seri, B=rang_47)
shif_26 = ShiftList(A=loft_61, B=0.425)
cull_26 = CullPattern(A=cons_64, B=divi_50)
seri_76 = Series(A=line_63, B=<missing>)
loft_75 = Loft(A=move_41, B=cons_5)
seri_77 = Series(A=rang_47, B=<missing>)
move_76 = Move(A=9.609, B=4.447)
rang_53 = Range(A=<missing>, B=line_67)
loft_76 = Loft(A=cull_2, B=loft_65)
line_79 = Line(A=flip_24, B=<missing>)
line_80 = Line(A=mult_41, B=<missing>)
cull_27 = CullPattern(A=<missing>, B=rang_24)
mult_79 = Multiplication(A=line_35, B=loft_2)
line_81 = Line(A=divi_21, B=loft_29)
cluster147 = Cluster(In=loft_49)
line_82 = Line(A=loft_59, B=loft_61)
divi_79 = DivideCurve(A=<missing>, B=move)
rota_71 = Rotate(A=0.586, B=mult_12)
rang_54 = Range(A=flip_13, B=line_44)
mult_80 = Multiplication(A=rang_26, B=rang_54)
loft_77 = Loft(A=rang, B=mult_80)
rang_55 = Range(A=mult_80, B=loft_54)
cons_82 = ConstructPoint(A=<missing>, B=mult_80)
rota_72 = Rotate(A=8.078, B=mult_80)
divi_80 = DivideCurve(A=rota_72, B=cons_3)
addi_64 = Addition(A=loft_77, B=divi_71)
seri_78 = Series(A=mult_80, B=addi_3)
rota_73 = Rotate(A=6.6, B=divi_80)
cons_83 = ConstructPoint(A=rang_55, B=<missing>)
rota_74 = Rotate(A=rota_64, B=cons_82)
addi_65 = Addition(A=6.696, B=loft_77)
seri_79 = Series(A=mult_80, B=<missing>)
line_83 = Line(A=mult_80, B=cons_56)
addi_66 = Addition(A=loft_77, B=move_6)
divi_81 = DivideCurve(A=9.055, B=<missing>)
seri_80 = Series(A=<missing>, B=flip_16)
disp_21 = Dispatch(A=seri_72, B=9.324)
seri_81 = Series(A=<missing>, B=seri_28)
rang_56 = Range(A=<missing>, B=<missing>)
line_84 = Line(A=cons_4, B=loft_55)
seri_82 = Series(A=line_63, B=addi_17)  # -> R
# ---------- seri_82: C# ----------
int a = 1875;
return a * 2;
# ---------- end seri_82 ----------
cull_28 = CullPattern(A=rota_43, B=loft_65)
rota_75 = Rotate(A=cull_25, B=rang_26)
mult_81 = Multiplication(A=move_16, B=7.774)
cons_84 = ConstructPoint(A=mult_35, B=rota_15)
flip_27 = FlipMatrix(A=shif_3, B=flip_6)
addi_67 = Addition(A=addi_12, B=mult_28)
cons_85 = ConstructPoint(A=rota_6, B=flip_13)
rota_76 = Rotate(A=6.616, B=move_42)
mult_82 = Multiplication(A=cluster244, B=9.091)
loft_78 = Loft(A=cull_23, B=cons_48)
move_77 = Move(A=divi_27, B=flip_7)
addi_68 = Addition(A=cluster341, B=move_31)
line_85 = Line(A=<missing>, B=addi_68)
cull_29 = CullPattern(A=cons_56, B=line_85)
divi_82 = DivideCurve(A=line_85, B=loft_63)
cons_86 = ConstructPoint(A=line_2, B=line_85)
mult_83 = Multiplication(A=cull_29, B=2.916)
addi_69 = Addition(A=cons_86, B=cons_39)
loft_79 = Loft(A=move_26, B=loft_58)
divi_83 = DivideCurve(A=cull_2, B=flip_14)
loft_80 = Loft(A=seri_52, B=mult_37)
move_78 = Move(A=seri_14, B=addi_59)
rang_57 = Range(A=0.402, B=2.081)
divi_84 = DivideCurve(A=flip_16, B=<missing>)
divi_85 = DivideCurve(A=4.916, B=cons_53)
line_86 = Line(A=<missing>, B=<missing>)
disp_22 = Dispatch(A=<missing>, B=<missing>)
mult_84 = Multiplication(A=cons_73, B=3.365)
seri_83 = Series(A=cons_31, B=cons_5)
rota_77 = Rotate(A=rang_33, B=move_2)
move_79 = Move(A=2.482, B=rota_35)
line_87 = Line(A=3.283, B=0.028)
divi_86 = DivideCurve(A=move_49, B=8.63)
seri_84 = Series(A=loft_45, B=seri_33)
cons_87 = ConstructPoint(A=9.959, B=mult_68)
rang_58 = Range(A=<missing>, B=<missing>)
move_80 = Move(A=seri, B=5.663)
divi_87 = DivideCurve(A=8.688, B=divi_12)
move_81 = Move(A=addi_14, B=2.519)
rang_59 = Range(A=shif_3, B=rota_19)
move_82 = Move(A=mult_79, B=line_47)
loft_81 = Loft(A=rang_18, B=move_48)
cons_88 = ConstructPoint(A=<missing>, B=line_11)
mult_85 = Multiplication(A=flip_9, B=5.375)
seri_85 = Series(A=mult_7, B=loft_49)
shif_27 = ShiftList(A=mult_13, B=move_53)
rang_60 = Range(A=move_29, B=loft_71)
loft_82 = Loft(A=mult_23, B=4.922)
seri_86 = Series(A=2.875, B=rang_46)
seri_87 = Series(A=9.156, B=addi_15)
line_88 = Line(A=<missing>, B=<missing>)
disp_23 = Dispatch(A=rota_3, B=flip_5)
addi_70 = Addition(A=loft_20, B=rang_26)
cons_89 = ConstructPoint(A=loft_61, B=move_78)
line_89 = Line(A=<missing>, B=2.044)
loft_83 = Loft(A=mult_24, B=loft_79)
seri_88 = Series(A=mult_29, B=seri_73)
mult_86 = Multiplication(A=<missing>, B=7.167)
cons_90 = ConstructPoint(A=move_18, B=addi_42)
mult_87 = Multiplication(A=7.338, B=rang_41)
move_83 = Move(A=4.691, B=line_32)
disp_24 = Dispatch(A=flip_2, B=divi_3)
disp_25 = Dispatch(A=seri_63, B=mult_64)
loft_84 = Loft(A=loft_71, B=line_38)
rota_78 = Rotate(A=addi_61, B=loft_68)
move_84 = Move(A=seri_55, B=line_21)
loft_85 = Loft(A=<missing>, B=9.08)
seri_89 = Series(A=seri_35, B=cull_9)
flip_28 = FlipMatrix(A=2.299, B=6.907)
line_90 = Line(A=seri_15, B=rang_2)
move_85 = Move(A=mult_59, B=addi_37)
rota_79 = Rotate(A=move_22, B=line_22)
shif_28 = ShiftList(A=rota_76, B=divi_87)
rota_80 = Rotate(A=<missing>, B=1.021)
rota_81 = Rotate(A=<missing>, B=rang_32)
rang_61 = Range(A=0.085, B=line_64)
seri_90 = Series(A=disp_3, B=<missing>)
mult_88 = Multiplication(A=cons_15, B=rang_26)
divi_88 = DivideCurve(A=6.277, B=cull_5)
line_91 = Line(A=1.113, B=cons_12)
cull_30 = CullPattern(A=divi_30, B=divi_52)
mult_89 = Multiplication(A=loft_80, B=loft_41)
mult_90 = Multiplication(A=3.077, B=3.411)
cons_91 = ConstructPoint(A=cons_16, B=4.525)
mult_91 = Multiplication(A=cons_32, B=4.212)
cons_92 = ConstructPoint(A=move_65, B=line_56)  # -> R
# ---------- cons_92: C# ----------
int a = 1716;
return a * 2;
# ---------- end cons_92 ----------
seri_91 = Series(A=<missing>, B=mult_79)
loft_86 = Loft(A=mult_79, B=loft_70)
divi_89 = DivideCurve(A=addi, B=addi_16)
disp_26 = Dispatch(A=disp_4, B=3.33)
rang_62 = Range(A=move_56, B=loft_69)
cull_31 = CullPattern(A=addi_12, B=seri_5)
line_92 = Line(A=seri_75, B=addi_49)
rang_63 = Range(A=<missing>, B=<missing>)
rang_64 = Range(A=loft_33, B=mult_7)
move_86 = Move(A=flip_28, B=line_22)
loft_87 = Loft(A=2.566, B=<missing>)
move_87 = Move(A=line_22, B=move_29)
cull_32 = CullPattern(A=4.435, B=cons_21)
rota_82 = Rotate(A=divi_4, B=1.231)
addi_71 = Addition(A=line, B=<missing>)
rota_83 = Rotate(A=rota_3, B=move_29)
addi_72 = Addition(A=1.732, B=cull_7)
addi_73 = Addition(A=8.239, B=move_64)
rang_65 = Range(A=7.64, B=5.757)
line_93 = Line(A=loft_34, B=mult_59)
cons_93 = ConstructPoint(A=seri_28, B=addi_54)
seri_92 = Series(A=cons_93, B=rota_70)
mult_92 = Multiplication(A=4.143, B=6.651)
mult_93 = Multiplication(A=mult_92, B=rota_79)
rota_84 = Rotate(A=mult_93, B=5.039)
seri_93 = Series(A=mult_93, B=move_35)
seri_94 = Series(A=<missing>, B=seri_93)
divi_90 = DivideCurve(A=0.47, B=seri_93)
addi_74 = Addition(A=3.545, B=seri_53)
addi_75 = Addition(A=seri_29, B=<missing>)
addi_76 = Addition(A=<missing>, B=mult_61)
loft_88 = Loft(A=0.351, B=mult_11)
divi_91 = DivideCurve(A=6.025, B=loft_50)
move_88 = Move(A=rota_62, B=cons_15)
mult_94 = Multiplication(A=rota_79, B=8.557)
cull_33 = CullPattern(A=<missing>, B=addi_36)
line_94 = Line(A=seri_54, B=3.081)
divi_92 = DivideCurve(A=8.118, B=4.554)
seri_95 = Series(A=addi_19, B=addi_32)
move_89 = Move(A=cons_16, B=5.123)
rota_85 = Rotate(A=loft_58, B=rota_58)
cons_94 = ConstructPoint(A=<missing>, B=cons_16)
seri_96 = Series(A=rota_64, B=<missing>)
disp_27 = Dispatch(A=move_55, B=line_40)
rota_86 = Rotate(A=addi_12, B=<missing>)
rang_66 = Range(A=1.146, B=loft_2)
cull_34 = CullPattern(A=rang_64, B=line_2)
addi_77 = Addition(A=addi_27, B=seri_56)
seri_97 = Series(A=8.749, B=3.002)
line_95 = Line(A=rang_32, B=3.226)
seri_98 = Series(A=loft_87, B=5.667)
addi_78 = Addition(A=divi_33, B=divi_78)
loft_89 = Loft(A=mult_4, B=rang_49)
cons_95 = ConstructPoint(A=cons_14, B=cons_59)
seri_99 = Series(A=cons_59, B=cons_95)
move_90 = Move(A=cons_53, B=seri_99)
rang_67 = Range(A=2.58, B=seri_99)
rota_87 = Rotate(A=<missing>, B=seri_99)
mult_95 = Multiplication(A=rota_3, B=rang_67)
move_91 = Move(A=mult_3, B=rang_67)
line_96 = Line(A=<missing>, B=seri_99)
cluster2281 = Cluster(In=move_90)
move_92 = Move(A=move_90, B=1.582)
line_97 = Line(A=move_47, B=rota_87)
line_98 = Line(A=line_96, B=mult_93)
seri_100 = Series(A=<missing>, B=line_96)
cull_35 = CullPattern(A=0.73, B=rang_67)
cull_36 = CullPattern(A=5.768, B=move_92)
addi_79 = Addition(A=seri_99, B=seri_23)
move_93 = Move(A=move_90, B=move_8)
seri_101 = Series(A=divi_70, B=move_91)
rang_68 = Range(A=7.894, B=rota_3)
line_99 = Line(A=flip_27, B=0.541)
loft_90 = Loft(A=rota_45, B=move_80)
move_94 = Move(A=divi_66, B=4.929)
seri_102 = Series(A=line_53, B=mult_85)
mult_96 = Multiplication(A=rang_34, B=5.339)
mult_97 = Multiplication(A=0.216, B=rota_10)
loft_91 = Loft(A=cull_23, B=3.964)
cons_96 = ConstructPoint(A=6.758, B=rota_49)
shif_29 = ShiftList(A=rang_35, B=addi_21)
cons_97 = ConstructPoint(A=3.603, B=rota_49)
loft_92 = Loft(A=addi_58, B=line_24)
line_100 = Line(A=cons_60, B=8.187)
rota_88 = Rotate(A=<missing>, B=1.686)
move_95 = Move(A=seri_82, B=divi_75)
addi_80 = Addition(A=move_30, B=5.144)
mult_98 = Multiplication(A=2.771, B=3.822)
addi_81 = Addition(A=cons_17, B=8.472)
cluster2960 = Cluster()
seri_103 = Series(A=3.947, B=rota_12)
cons_98 = ConstructPoint(A=mult_18, B=flip_18)
line_101 = Line(A=line_47, B=move_42)
line_102 = Line(A=divi_68, B=move_87)
loft_93 = Loft(A=5.567, B=addi_77)
line_103 = Line(A=4.681, B=loft_78)
addi_82 = Addition(A=cull_23, B=2.497)
cull_37 = CullPattern(A=7.49, B=cons_18)
line_104 = Line(A=rota_49, B=rang_65)
line_105 = Line(A=move_82, B=divi_40)
flip_29 = FlipMatrix(A=2.893, B=seri_86)
loft_94 = Loft(A=cons_28, B=line_64)
rota_89 = Rotate(A=cull_16, B=flip_28)
seri_104 = Series(A=rota_34, B=<missing>)
move_96 = Move(A=rota, B=rang_19)
addi_83 = Addition(A=rota, B=mult_64)  # -> R
# ---------- addi_83: C# ----------
int a = 1557;
return a * 2;
# ---------- end addi_83 ----------
line_106 = Line(A=rota_4, B=cull_33)
seri_105 = Series(A=9.788, B=cons_95)
addi_84 = Addition(A=move_76, B=mult_40)
shif_30 = ShiftList(A=line_51, B=cons_81)
divi_93 = DivideCurve(A=0.991, B=<missing>)
cluster2475 = Cluster(In=divi_77)
rang_69 = Range(A=8.983, B=9.053)
disp_28 = Dispatch(A=1.172, B=loft_52)
cons_99 = ConstructPoint(A=loft_2, B=4.514)
addi_85 = Addition(A=flip_27, B=flip_18)
flip_30 = FlipMatrix(A=seri_39, B=divi_36)
line_107 = Line(A=9.875, B=line_61)
seri_106 = Series(A=1.661, B=divi_11)
mult_99 = Multiplication(A=rang_19, B=cons_57)
rang_70 = Range(A=seri_21, B=rang_66)
rota_90 = Rotate(A=mult, B=cons_12)
seri_107 = Series(A=rang_23, B=move_33)
divi_94 = DivideCurve(A=seri_16, B=8.694)
move_97 = Move(A=divi_94, B=<missing>)
loft_95 = Loft(A=divi_71, B=move_97)
cons_100 = ConstructPoint(A=move_97, B=line_3)
seri_108 = Series(A=loft_95, B=4.522)
cons_101 = ConstructPoint(A=move_97, B=seri_44)
divi_95 = DivideCurve(A=rang_43, B=loft_95)
rang_71 = Range(A=seri_85, B=rota_80)
cons_102 = ConstructPoint(A=rota_3, B=mult_35)
cons_103 = ConstructPoint(A=<missing>, B=<missing>)
rota_91 = Rotate(A=5.336, B=addi_31)
loft_96 = Loft(A=divi_70, B=<missing>)
line_108 = Line(A=4.665, B=addi_17)
loft_97 = Loft(A=4.787, B=divi_13)
flip_31 = FlipMatrix(A=<missing>, B=rota_82)
mult_100 = Multiplication(A=divi_44, B=<missing>)
cons_104 = ConstructPoint(A=rota_13, B=6.713)
cluster1990 = Cluster(In=cull_15)
disp_29 = Dispatch(A=cluster1699, B=<missing>)
seri_109 = Series(A=addi_62, B=rang_47)
loft_98 = Loft(A=disp_25, B=divi_68)
line_109 = Line(A=loft_58, B=shif_23)
seri_110 = Series(A=0.725, B=seri_73)
move_98 = Move(A=6.419, B=<missing>)
line_110 = Line(A=<missing>, B=seri_57)
flip_32 = FlipMatrix(A=divi_21, B=mult_79)
addi_86 = Addition(A=1.809, B=flip_32)
flip_33 = FlipMatrix(A=addi_86, B=4.234)
move_99 = Move(A=cons_53, B=addi_86)
shif_31 = ShiftList(A=seri_99, B=addi_86)
cull_38 = CullPattern(A=addi_86, B=loft_60)  # -> R
# ---------- cull_38: C# ----------
int a = 921;
return a * 2;
# ---------- end cull_38 ----------
flip_34 = FlipMatrix(A=rang_67, B=cull_38)
rang_72 = Range(A=loft_3, B=addi_86)
move_100 = Move(A=cull_38, B=line_2)
cull_39 = CullPattern(A=seri, B=addi_86)
cull_40 = CullPattern(A=line_3, B=flip_33)
line_111 = Line(A=move_99, B=move_57)
rang_73 = Range(A=cons_56, B=move_100)
mult_101 = Multiplication(A=mult, B=flip_33)
line_112 = Line(A=rang_72, B=<missing>)
line_113 = Line(A=line_112, B=move_61)
rang_74 = Range(A=<missing>, B=line_113)
seri_111 = Series(A=line_113, B=0.529)
rota_92 = Rotate(A=<missing>, B=rang_72)
rota_93 = Rotate(A=cull_38, B=rang_55)
cons_105 = ConstructPoint(A=rang_73, B=<missing>)
line_114 = Line(A=8.01, B=line_112)
cons_106 = ConstructPoint(A=flip_33, B=cons_14)
mult_102 = Multiplication(A=5.32, B=flip_34)
divi_96 = DivideCurve(A=5.522, B=line_112)
seri_112 = Series(A=addi_14, B=rang_72)
move_101 = Move(A=loft_16, B=addi_86)
mult_103 = Multiplication(A=rang_73, B=cons_53)
mult_104 = Multiplication(A=mult_101, B=3.634)
divi_97 = DivideCurve(A=divi_96, B=<missing>)
loft_99 = Loft(A=cons_83, B=mult_103)
line_115 = Line(A=line_113, B=<missing>)
rota_94 = Rotate(A=6.688, B=line_113)
rota_95 = Rotate(A=cull_38, B=divi_6)
seri_113 = Series(A=7.717, B=rota_93)
rota_96 = Rotate(A=cons_29, B=mult_103)
mult_105 = Multiplication(A=rota_6, B=rang_73)
loft_100 = Loft(A=move_18, B=cull_39)
loft_101 = Loft(A=seri_112, B=<missing>)
rang_75 = Range(A=move_100, B=9.548)
move_102 = Move(A=move_100, B=<missing>)
loft_102 = Loft(A=cull_16, B=move_101)
move_103 = Move(A=cons_48, B=rota_92)
seri_114 = Series(A=addi_86, B=seri_15)
line_116 = Line(A=rota_96, B=seri)
divi_98 = DivideCurve(A=flip_33, B=9.697)
divi_99 = DivideCurve(A=5.575, B=rang_73)
addi_87 = Addition(A=rang_75, B=6.772)
divi_100 = DivideCurve(A=cons_7, B=flip_33)
line_117 = Line(A=rang_75, B=<missing>)
rota_97 = Rotate(A=rang_6, B=cull_38)
cons_107 = ConstructPoint(A=<missing>, B=line_116)
mult_106 = Multiplication(A=line_116, B=mult_59)
rang_76 = Range(A=rang_72, B=divi_31)
mult_107 = Multiplication(A=divi_98, B=3.547)
seri_115 = Series(A=line_46, B=1.412)
loft_103 = Loft(A=seri_115, B=divi_3)
seri_116 = Series(A=5.329, B=loft_103)
addi_88 = Addition(A=loft_103, B=cons_56)
disp_30 = Dispatch(A=<missing>, B=loft_103)
cons_108 = ConstructPoint(A=loft_103, B=<missing>)
mult_108 = Multiplication(A=loft_103, B=rang)
addi_89 = Addition(A=cons_57, B=seri_116)
divi_101 = DivideCurve(A=8.719, B=addi_88)
cons_109 = ConstructPoint(A=seri_116, B=3.499)
seri_117 = Series(A=rang, B=seri_116)
move_104 = Move(A=move_90, B=cons_108)
cluster2378 = Cluster(In=mult_108)
move_105 = Move(A=addi_88, B=addi)
cons_110 = ConstructPoint(A=rota, B=addi_88)
shif_32 = ShiftList(A=<missing>, B=disp_30)
loft_104 = Loft(A=disp_30, B=loft_55)
rota_98 = Rotate(A=loft_95, B=divi_101)
line_118 = Line(A=seri_117, B=rota)
cons_111 = ConstructPoint(A=cons_108, B=5.48)
move_106 = Move(A=loft_103, B=<missing>)
line_119 = Line(A=mult, B=disp_30)
shif_33 = ShiftList(A=disp_30, B=cons_53)
mult_109 = Multiplication(A=move_3, B=cons_110)
shif_34 = ShiftList(A=8.319, B=move_104)
loft_105 = Loft(A=addi_89, B=7.018)
rota_99 = Rotate(A=9.907, B=mult_108)
flip_35 = FlipMatrix(A=loft_103, B=addi)
rota_100 = Rotate(A=cons_110, B=loft_60)
move_107 = Move(A=loft_103, B=<missing>)
seri_118 = Series(A=loft_3, B=addi_89)
move_108 = Move(A=divi_3, B=loft_103)
loft_106 = Loft(A=seri_116, B=cons_7)
cons_112 = ConstructPoint(A=seri_116, B=6.87)
loft_107 = Loft(A=addi_88, B=flip_2)
loft_108 = Loft(A=<missing>, B=addi_88)
move_109 = Move(A=line_113, B=mult_108)
cull_41 = CullPattern(A=move_106, B=<missing>)
move_110 = Move(A=loft_103, B=<missing>)
seri_119 = Series(A=rota_3, B=line_119)
rang_77 = Range(A=addi_89, B=9.461)
addi_90 = Addition(A=move_106, B=flip_33)
disp_31 = Dispatch(A=move_106, B=rang_2)
addi_91 = Addition(A=loft_103, B=2.829)
loft_109 = Loft(A=addi_91, B=addi_31)
rota_101 = Rotate(A=loft_109, B=6.302)
seri_120 = Series(A=<missing>, B=loft_109)
loft_110 = Loft(A=rota_101, B=move_97)
mult_110 = Multiplication(A=loft_109, B=line_3)
move_111 = Move(A=0.528, B=move_105)
cons_113 = ConstructPoint(A=move_107, B=move_5)
cons_114 = ConstructPoint(A=seri_3, B=cons_108)
cull_42 = CullPattern(A=7.501, B=rota_101)
cons_115 = ConstructPoint(A=flip_35, B=3.806)
line_120 = Line(A=loft_108, B=6.326)
loft_111 = Loft(A=loft_103, B=cons_12)
addi_92 = Addition(A=addi_88, B=loft_3)
seri_121 = Series(A=addi_91, B=6.214)  # -> R
# ---------- seri_121: C# ----------
int a = 603;
return a * 2;
# ---------- end seri_121 ----------
line_121 = Line(A=move_106, B=mult_46)
addi_93 = Addition(A=<missing>, B=move_105)
addi_94 = Addition(A=6.141, B=shif_33)
move_112 = Move(A=disp_5, B=cull_42)
rota_102 = Rotate(A=flip_2, B=rota_100)
mult_111 = Multiplication(A=loft_54, B=loft_107)
rang_78 = Range(A=move_108, B=2.508)
move_113 = Move(A=addi_91, B=seri_10)
rang_79 = Range(A=rota_100, B=addi_2)
loft_112 = Loft(A=5.788, B=loft_106)
divi_102 = DivideCurve(A=divi_101, B=loft_13)
mult_112 = Multiplication(A=5.272, B=addi_91)
seri_122 = Series(A=cons_110, B=<missing>)
rota_103 = Rotate(A=seri_120, B=move_97)
mult_113 = Multiplication(A=divi_101, B=mult_93)
loft_113 = Loft(A=0.575, B=move_110)
addi_95 = Addition(A=flip_35, B=flip_3)
rota_104 = Rotate(A=rota_100, B=<missing>)
line_122 = Line(A=move_105, B=move_113)
addi_96 = Addition(A=move_110, B=rota_51)
seri_123 = Series(A=cons_59, B=shif_33)
move_114 = Move(A=disp_30, B=mult_11)
flip_36 = FlipMatrix(A=cons_114, B=rota_30)
divi_103 = DivideCurve(A=addi_95, B=divi)
shif_35 = ShiftList(A=move_107, B=mult_6)
loft_114 = Loft(A=addi_88, B=addi_89)
rota_105 = Rotate(A=2.474, B=cons_113)
shif_36 = ShiftList(A=seri_116, B=move_50)
loft_115 = Loft(A=move_109, B=flip_36)
addi_97 = Addition(A=line_14, B=addi_96)
loft_116 = Loft(A=loft_103, B=flip_3)
rota_106 = Rotate(A=seri_116, B=<missing>)
cull_43 = CullPattern(A=line_3, B=addi_89)
mult_114 = Multiplication(A=4.907, B=move_107)
flip_37 = FlipMatrix(A=divi_8, B=move_110)
rang_80 = Range(A=9.394, B=flip_37)
loft_117 = Loft(A=rang_80, B=<missing>)
line_123 = Line(A=addi_88, B=loft_8)
cons_116 = ConstructPoint(A=loft_112, B=2.828)
rota_107 = Rotate(A=line_119, B=rang_73)
divi_104 = DivideCurve(A=move_106, B=move_5)
seri_124 = Series(A=seri_118, B=shif_32)
loft_118 = Loft(A=cull_42, B=loft_5)
divi_105 = DivideCurve(A=8.551, B=rota_105)
seri_125 = Series(A=move_47, B=divi_103)
mult_115 = Multiplication(A=mult_7, B=addi_95)
divi_106 = DivideCurve(A=divi_50, B=move_110)
rota_108 = Rotate(A=mult_114, B=move_111)
line_124 = Line(A=loft_106, B=loft_111)
rang_81 = Range(A=seri_99, B=move_113)
divi_107 = DivideCurve(A=<missing>, B=loft_109)
shif_37 = ShiftList(A=cons_114, B=divi_11)
addi_98 = Addition(A=<missing>, B=addi_95)
addi_99 = Addition(A=loft_114, B=shif_32)
shif_38 = ShiftList(A=rota_104, B=1.712)
mult_116 = Multiplication(A=loft_103, B=rota_105)
move_115 = Move(A=rota_101, B=rota_101)
addi_100 = Addition(A=loft_112, B=seri_40)
shif_39 = ShiftList(A=disp_31, B=1.75)
line_125 = Line(A=loft_114, B=rota_93)
disp_32 = Dispatch(A=addi_95, B=line)
rang_82 = Range(A=rang_79, B=mult_5)
addi_101 = Addition(A=addi_96, B=disp_30)
rang_83 = Range(A=divi_10, B=rota_101)
cons_117 = ConstructPoint(A=seri_122, B=cull_38)
disp_33 = Dispatch(A=rota_65, B=rang_77)
rota_109 = Rotate(A=divi_103, B=move_49)
shif_40 = ShiftList(A=cons_114, B=rota_84)
seri_126 = Series(A=addi_14, B=move_107)
shif_41 = ShiftList(A=move_15, B=move_107)
move_116 = Move(A=shif_41, B=9.238)
loft_119 = Loft(A=move_116, B=move_97)
mult_117 = Multiplication(A=addi, B=cons_110)
addi_102 = Addition(A=addi_89, B=loft_2)
disp_34 = Dispatch(A=rang_81, B=rang_72)
divi_108 = DivideCurve(A=cons_112, B=addi_6)
seri_127 = Series(A=cons_24, B=loft_112)
loft_120 = Loft(A=rang_10, B=shif_36)
rota_110 = Rotate(A=move_106, B=move_3)
flip_38 = FlipMatrix(A=7.393, B=line_119)
loft_121 = Loft(A=rota_106, B=divi_55)
loft_122 = Loft(A=divi_9, B=addi_92)
divi_109 = DivideCurve(A=rang_12, B=seri_119)
line_126 = Line(A=9.208, B=divi_109)
rota_111 = Rotate(A=line_126, B=move_35)
rota_112 = Rotate(A=rota_111, B=divi_101)
cull_44 = CullPattern(A=move_2, B=rota_112)
divi_110 = DivideCurve(A=line_126, B=cull)
cons_118 = ConstructPoint(A=addi_92, B=<missing>)
mult_118 = Multiplication(A=3.641, B=rota_107)
flip_39 = FlipMatrix(A=<missing>, B=divi_102)
shif_42 = ShiftList(A=8.579, B=loft_106)
cull_45 = CullPattern(A=addi_88, B=move_2)
mult_119 = Multiplication(A=cull_7, B=addi_95)
disp_35 = Dispatch(A=<missing>, B=disp_31)
divi_111 = DivideCurve(A=rota_105, B=move_53)
divi_112 = DivideCurve(A=flip_35, B=shif_41)
rota_113 = Rotate(A=<missing>, B=move_106)
disp_36 = Dispatch(A=rang_5, B=addi_95)
rota_114 = Rotate(A=line_119, B=seri_15)
seri_128 = Series(A=mult_119, B=loft_116)
flip_40 = FlipMatrix(A=divi_106, B=mult_117)
addi_103 = Addition(A=cons_114, B=5.133)
rang_84 = Range(A=disp_33, B=7.734)
rota_115 = Rotate(A=rang_20, B=divi_103)
rota_116 = Rotate(A=seri_127, B=move_51)
divi_113 = DivideCurve(A=7.569, B=loft_111)
loft_123 = Loft(A=rang_2, B=flip_35)
mult_120 = Multiplication(A=move_106, B=divi_11)
addi_104 = Addition(A=loft_111, B=rang_38)
loft_124 = Loft(A=divi_106, B=<missing>)
cons_119 = ConstructPoint(A=cons_114, B=seri_2)
seri_129 = Series(A=line_119, B=addi_86)
loft_125 = Loft(A=disp_32, B=cons_53)
rang_85 = Range(A=rota_87, B=rota_109)
divi_114 = DivideCurve(A=6.459, B=addi_91)
cull_46 = CullPattern(A=loft_111, B=mult_24)
addi_105 = Addition(A=<missing>, B=shif_35)
rang_86 = Range(A=move_107, B=cons_8)
rota_117 = Rotate(A=addi_104, B=addi_92)
seri_130 = Series(A=<missing>, B=seri_121)
divi_115 = DivideCurve(A=rota_12, B=loft_111)
mult_121 = Multiplication(A=loft_116, B=shif_4)
rota_118 = Rotate(A=divi_30, B=loft_106)
move_117 = Move(A=move_26, B=cull_46)
cull_47 = CullPattern(A=<missing>, B=loft_122)
loft_126 = Loft(A=move_111, B=loft_124)
addi_106 = Addition(A=mult_7, B=loft_103)
seri_131 = Series(A=rang_14, B=disp_30)
divi_116 = DivideCurve(A=move_60, B=shif_33)
flip_41 = FlipMatrix(A=cons_22, B=line_123)
rang_87 = Range(A=disp_32, B=seri_126)
cons_120 = ConstructPoint(A=loft_108, B=rota_25)
divi_117 = DivideCurve(A=rang_25, B=cull_46)
addi_107 = Addition(A=cull_4, B=addi_92)
seri_132 = Series(A=loft_124, B=cons_24)
cons_121 = ConstructPoint(A=<missing>, B=loft_114)
divi_118 = DivideCurve(A=seri_21, B=rang_79)
cull_48 = CullPattern(A=line_123, B=line_2)
mult_122 = Multiplication(A=move_114, B=loft_30)
addi_108 = Addition(A=rota_101, B=loft_18)
mult_123 = Multiplication(A=6.758, B=flip_41)
move_118 = Move(A=flip_36, B=line_3)
flip_42 = FlipMatrix(A=mult_108, B=mult_16)
move_119 = Move(A=rang_87, B=loft_2)
mult_124 = Multiplication(A=addi_98, B=flip_13)
rang_88 = Range(A=rang_23, B=shif_32)
loft_127 = Loft(A=seri_131, B=rota_34)
loft_128 = Loft(A=cull_46, B=shif_6)
loft_129 = Loft(A=mult_21, B=mult_121)
rang_89 = Range(A=mult_120, B=mult_80)
mult_125 = Multiplication(A=rota_7, B=rota_106)
line_127 = Line(A=loft_122, B=seri_43)
shif_43 = ShiftList(A=flip_2, B=move_111)
divi_119 = DivideCurve(A=<missing>, B=loft_108)
cons_122 = ConstructPoint(A=addi_91, B=flip_6)
addi_109 = Addition(A=addi_106, B=mult_33)
rang_90 = Range(A=mult_18, B=divi_103)
rang_91 = Range(A=1.758, B=move_110)
seri_133 = Series(A=addi_106, B=cons_5)
move_120 = Move(A=seri_63, B=addi_105)
move_121 = Move(A=divi_53, B=shif_41)
rota_119 = Rotate(A=cull_15, B=mult_119)
loft_130 = Loft(A=line_114, B=flip_41)
loft_131 = Loft(A=move_35, B=cons_114)
loft_132 = Loft(A=rota_11, B=mult_108)
seri_134 = Series(A=move_31, B=move_111)
rota_120 = Rotate(A=addi_89, B=shif_9)
rang_92 = Range(A=divi_64, B=loft_115)
seri_135 = Series(A=cull_15, B=cons_113)
cons_123 = ConstructPoint(A=<missing>, B=move_113)
move_122 = Move(A=cons_123, B=0.406)
flip_43 = FlipMatrix(A=move_122, B=line_113)
rota_121 = Rotate(A=loft_109, B=move_122)
rang_93 = Range(A=flip_43, B=6.395)
cons_124 = ConstructPoint(A=<missing>, B=move_122)
loft_133 = Loft(A=flip_43, B=addi_64)
move_123 = Move(A=flip_43, B=rota_100)
mult_126 = Multiplication(A=mult_41, B=addi_98)
seri_136 = Series(A=3.152, B=line_119)
loft_134 = Loft(A=move_26, B=cons_109)
divi_120 = DivideCurve(A=divi_18, B=rota_114)  # -> R
# ---------- divi_120: C# ----------
int a = 2299;
return a * 2;
# ---------- end divi_120 ----------
mult_127 = Multiplication(A=divi_114, B=<missing>)
addi_110 = Addition(A=cons_112, B=1.724)
cull_49 = CullPattern(A=rang_79, B=cons_63)
seri_137 = Series(A=addi_106, B=rota_43)
mult_128 = Multiplication(A=mult_12, B=cull_46)
addi_111 = Addition(A=cull_15, B=move_110)
seri_138 = Series(A=seri_28, B=seri_118)
mult_129 = Multiplication(A=mult_113, B=5.016)
move_124 = Move(A=addi_99, B=rota_92)
loft_135 = Loft(A=divi_110, B=cons_5)
rota_122 = Rotate(A=cull_12, B=move_109)
divi_121 = DivideCurve(A=move_106, B=divi_37)
rota_123 = Rotate(A=addi_31, B=rang_88)
divi_122 = DivideCurve(A=seri_53, B=cons_123)
rota_124 = Rotate(A=rang_4, B=divi_103)
move_125 = Move(A=cons_53, B=seri_131)
addi_112 = Addition(A=move_50, B=addi_92)
line_128 = Line(A=loft_121, B=rota_28)
divi_123 = DivideCurve(A=rota_114, B=8.392)
line_129 = Line(A=loft_122, B=flip_33)
loft_136 = Loft(A=mult, B=rota_106)
move_126 = Move(A=cons_34, B=loft_118)
seri_139 = Series(A=divi_115, B=line_61)
move_127 = Move(A=rang_78, B=<missing>)
addi_113 = Addition(A=rota_104, B=mult_42)
move_128 = Move(A=divi_101, B=0.251)
divi_124 = DivideCurve(A=addi_92, B=addi_89)
seri_140 = Series(A=divi_102, B=flip_5)
seri_141 = Series(A=0.958, B=disp_36)
rang_94 = Range(A=cull_14, B=flip_35)
disp_37 = Dispatch(A=move_116, B=seri_93)
line_130 = Line(A=loft_21, B=addi_106)
loft_137 = Loft(A=line_11, B=divi_102)
seri_142 = Series(A=divi_106, B=rota)
move_129 = Move(A=move_101, B=shif_38)
addi_114 = Addition(A=cull_24, B=rang_94)
move_130 = Move(A=seri_132, B=rota_32)
move_131 = Move(A=rang_92, B=seri_40)
divi_125 = DivideCurve(A=seri_128, B=<missing>)
shif_44 = ShiftList(A=rang_80, B=cons_2)
divi_126 = DivideCurve(A=0.733, B=loft_118)
loft_138 = Loft(A=flip_14, B=cons_108)
cons_125 = ConstructPoint(A=cons_110, B=rota_108)
cull_50 = CullPattern(A=line_63, B=loft_122)
divi_127 = DivideCurve(A=rota_101, B=shif_14)
rang_95 = Range(A=move_122, B=loft_4)
divi_128 = DivideCurve(A=rota_103, B=cons_62)
loft_139 = Loft(A=addi_112, B=cons_48)
move_132 = Move(A=divi, B=divi_121)
rang_96 = Range(A=rota_106, B=divi_33)
seri_143 = Series(A=divi_46, B=mult_120)
addi_115 = Addition(A=<missing>, B=disp_30)
divi_129 = DivideCurve(A=divi_22, B=divi_114)
divi_130 = DivideCurve(A=flip_7, B=shif_41)
cons_126 = ConstructPoint(A=<missing>, B=rota_118)
mult_130 = Multiplication(A=5.135, B=addi_92)
line_131 = Line(A=0.099, B=cons_122)
cons_127 = ConstructPoint(A=move_99, B=divi_109)
mult_131 = Multiplication(A=3.533, B=loft_103)
mult_132 = Multiplication(A=<missing>, B=addi_112)
divi_131 = DivideCurve(A=seri, B=move_106)
line_132 = Line(A=rang_96, B=divi_52)
rang_97 = Range(A=divi_121, B=loft_30)
cons_128 = ConstructPoint(A=rang_11, B=seri_118)
cull_51 = CullPattern(A=shif_41, B=<missing>)
rota_125 = Rotate(A=disp_32, B=move_60)
addi_116 = Addition(A=loft_111, B=loft_13)
move_133 = Move(A=move_34, B=addi_105)
line_133 = Line(A=addi_32, B=rota_119)
cons_129 = ConstructPoint(A=seri_121, B=seri_48)
addi_117 = Addition(A=rang_77, B=<missing>)
cons_130 = ConstructPoint(A=<missing>, B=cons_113)  # -> R
# ---------- cons_130: C# ----------
int a = 1928;
return a * 2;
# ---------- end cons_130 ----------
shif_45 = ShiftList(A=loft_128, B=loft_20)
divi_132 = DivideCurve(A=5.953, B=mult_113)
seri_144 = Series(A=mult_118, B=mult_123)
cons_131 = ConstructPoint(A=move_32, B=addi_95)
line_134 = Line(A=addi_38, B=loft_128)
divi_133 = DivideCurve(A=move_105, B=6.591)
loft_140 = Loft(A=seri_64, B=cons_109)
cons_132 = ConstructPoint(A=4.332, B=addi_108)
move_134 = Move(A=addi_102, B=line_133)
cons_133 = ConstructPoint(A=rang_88, B=cull_19)
move_135 = Move(A=seri_116, B=divi_76)
rota_126 = Rotate(A=rang_33, B=mult_120)
mult_133 = Multiplication(A=rota_106, B=cull_10)
seri_145 = Series(A=rota_107, B=2.423)
mult_134 = Multiplication(A=4.099, B=move_104)
rota_127 = Rotate(A=move_120, B=divi_121)
divi_134 = DivideCurve(A=5.24, B=divi_102)
seri_146 = Series(A=<missing>, B=divi_129)
divi_135 = DivideCurve(A=disp_36, B=loft_50)
rota_128 = Rotate(A=<missing>, B=divi_130)
rota_129 = Rotate(A=addi_57, B=seri_131)
rang_98 = Range(A=addi_91, B=flip_13)
loft_141 = Loft(A=divi_114, B=divi_56)
mult_135 = Multiplication(A=rota_100, B=<missing>)
addi_118 = Addition(A=rota_100, B=addi_49)
rota_130 = Rotate(A=cons_112, B=<missing>)
disp_38 = Dispatch(A=move_15, B=seri_120)
line_135 = Line(A=seri_17, B=line_121)
divi_136 = DivideCurve(A=seri_143, B=rota_54)
line_136 = Line(A=seri_126, B=cons_110)
seri_147 = Series(A=<missing>, B=loft_118)
cons_134 = ConstructPoint(A=seri_65, B=line_131)
cons_135 = ConstructPoint(A=8.988, B=rang_96)
line_137 = Line(A=cons_6, B=mult_119)
flip_44 = FlipMatrix(A=seri_116, B=mult_64)
seri_148 = Series(A=seri_131, B=divi_11)  # -> R
# ---------- seri_148: C# ----------
int a = 1663;
return a * 2;
# ---------- end seri_148 ----------
addi_119 = Addition(A=line_112, B=cons_127)
mult_136 = Multiplication(A=seri_118, B=move_101)
move_136 = Move(A=rang_41, B=move_104)
shif_46 = ShiftList(A=rota_52, B=line_129)
move_137 = Move(A=line_61, B=loft_116)
loft_142 = Loft(A=addi_104, B=rang_6)
loft_143 = Loft(A=shif_41, B=6.981)
mult_137 = Multiplication(A=move_111, B=loft_109)
rota_131 = Rotate(A=<missing>, B=divi_118)
rota_132 = Rotate(A=move_125, B=addi_68)
move_138 = Move(A=seri_123, B=divi_59)
seri_149 = Series(A=rang_91, B=6.715)
cons_136 = ConstructPoint(A=divi_121, B=loft_87)
move_139 = Move(A=3.75, B=addi_95)
divi_137 = DivideCurve(A=seri_121, B=6.205)
move_140 = Move(A=<missing>, B=addi_101)
rota_133 = Rotate(A=<missing>, B=flip_35)
cull_52 = CullPattern(A=cons_16, B=divi_133)
shif_47 = ShiftList(A=mult_115, B=line_112)
cull_53 = CullPattern(A=line_129, B=disp_23)
addi_120 = Addition(A=2.608, B=move_113)
divi_138 = DivideCurve(A=5.078, B=loft_116)
rota_134 = Rotate(A=<missing>, B=disp_36)
rota_135 = Rotate(A=divi_114, B=<missing>)
addi_121 = Addition(A=rota_123, B=rota_15)
addi_122 = Addition(A=line_61, B=loft_109)
move_141 = Move(A=shif_32, B=move_2)
addi_123 = Addition(A=cull_46, B=seri_114)
seri_150 = Series(A=rota_118, B=loft_107)  # -> R
# ---------- seri_150: C# ----------
int a = 1504;
return a * 2;
# ---------- end seri_150 ----------
cons_137 = ConstructPoint(A=rang_91, B=loft_56)
rota_136 = Rotate(A=cons_44, B=mult_122)
cons_138 = ConstructPoint(A=loft_29, B=mult_28)
rang_99 = Range(A=rang_45, B=line)
divi_139 = DivideCurve(A=loft_123, B=mult_33)
rota_137 = Rotate(A=<missing>, B=move_61)
disp_39 = Dispatch(A=rang_7, B=addi_67)
line_138 = Line(A=shif_5, B=disp_31)
seri_151 = Series(A=rang_38, B=cull_4)
divi_140 = DivideCurve(A=disp_9, B=cons_41)
addi_124 = Addition(A=0.894, B=3.578)
rang_100 = Range(A=divi_78, B=disp_16)
seri_152 = Series(A=divi_45, B=line_51)
addi_125 = Addition(A=move_110, B=seri_35)
line_139 = Line(A=addi_116, B=line_50)
cons_139 = ConstructPoint(A=seri_29, B=flip_24)
rota_138 = Rotate(A=flip_33, B=cons_89)
addi_126 = Addition(A=2.091, B=seri_99)
line_140 = Line(A=move_3, B=addi_32)
mult_138 = Multiplication(A=divi_101, B=divi_106)
line_141 = Line(A=addi_101, B=<missing>)  # -> R
# ---------- line_141: C# ----------
int a = 1451;
return a * 2;
# ---------- end line_141 ----------
cluster1505 = Cluster(In=addi_35)
seri_153 = Series(A=7.844, B=cons_131)
move_142 = Move(A=flip_14, B=1.81)
line_142 = Line(A=seri_18, B=mult_82)
addi_127 = Addition(A=rota_104, B=mult_4)
divi_141 = DivideCurve(A=cons_126, B=move_92)
line_143 = Line(A=line_96, B=cons_117)
addi_128 = Addition(A=<missing>, B=divi_11)
addi_129 = Addition(A=8.689, B=rota_123)
cull_54 = CullPattern(A=seri_129, B=mult_51)
cull_55 = CullPattern(A=rang_6, B=rang_35)
rota_139 = Rotate(A=8.545, B=divi_137)
cull_56 = CullPattern(A=seri_56, B=mult_61)
mult_139 = Multiplication(A=<missing>, B=flip_18)
divi_142 = DivideCurve(A=move_74, B=divi_131)
seri_154 = Series(A=addi_77, B=<missing>)
rota_140 = Rotate(A=rota_28, B=2.041)
line_144 = Line(A=6.471, B=loft_61)
rang_101 = Range(A=divi_14, B=divi_12)
addi_130 = Addition(A=disp, B=rang_101)
cons_140 = ConstructPoint(A=rang_101, B=loft_113)
cull_57 = CullPattern(A=addi_130, B=2.985)
divi_143 = DivideCurve(A=<missing>, B=addi_130)
seri_155 = Series(A=addi_130, B=4.983)
cull_58 = CullPattern(A=cons_140, B=mult_80)
cons_141 = ConstructPoint(A=cull_57, B=3.444)
rota_141 = Rotate(A=loft_54, B=addi_130)
cons_142 = ConstructPoint(A=cull_57, B=divi)
cons_143 = ConstructPoint(A=addi_130, B=divi_71)
rota_142 = Rotate(A=loft_60, B=cons_143)
rang_102 = Range(A=rota_141, B=loft_55)
flip_45 = FlipMatrix(A=addi_130, B=rota)
cons_144 = ConstructPoint(A=7.626, B=addi_130)
move_143 = Move(A=addi_130, B=addi_130)
cons_145 = ConstructPoint(A=divi_101, B=cons_142)  # -> R
# ---------- cons_145: C# ----------
int a = 868;
return a * 2;
# ---------- end cons_145 ----------
rota_143 = Rotate(A=seri_155, B=<missing>)
divi_144 = DivideCurve(A=cons_4, B=divi_143)
line_145 = Line(A=3.415, B=cons_142)
move_144 = Move(A=rota_141, B=move_3)
rang_103 = Range(A=move_56, B=rang_102)
seri_156 = Series(A=divi_101, B=cons_142)
line_146 = Line(A=move_90, B=cons_141)
rang_104 = Range(A=cons_142, B=move_90)
addi_131 = Addition(A=move_143, B=cons_57)
loft_144 = Loft(A=cull_57, B=seri_117)
move_145 = Move(A=<missing>, B=rota_141)
rota_144 = Rotate(A=seri_155, B=cull_38)
divi_145 = DivideCurve(A=6.748, B=line_145)
disp_40 = Dispatch(A=addi_130, B=<missing>)
line_147 = Line(A=loft_144, B=seri_60)
cons_146 = ConstructPoint(A=cons_141, B=loft_55)
cons_147 = ConstructPoint(A=rang_67, B=rang_104)
mult_140 = Multiplication(A=<missing>, B=divi_144)
loft_145 = Loft(A=cons_4, B=cons_142)
line_148 = Line(A=addi_130, B=cons_110)
rota_145 = Rotate(A=<missing>, B=line_146)
mult_141 = Multiplication(A=cull_57, B=line_112)
line_149 = Line(A=line_146, B=mult_93)
move_146 = Move(A=divi_143, B=rota_2)
mult_142 = Multiplication(A=cull_42, B=divi_144)
mult_143 = Multiplication(A=loft_54, B=divi_144)
loft_146 = Loft(A=addi_91, B=cons_146)
seri_157 = Series(A=cull_57, B=<missing>)
mult_144 = Multiplication(A=move_7, B=mult_141)
rang_105 = Range(A=mult_13, B=addi_130)
divi_146 = DivideCurve(A=cons_144, B=8.496)
cons_148 = ConstructPoint(A=move_110, B=seri_155)
rang_106 = Range(A=8.532, B=rang_105)
seri_158 = Series(A=flip_45, B=<missing>)
cons_149 = ConstructPoint(A=cons_145, B=cons_6)
flip_46 = FlipMatrix(A=rang_105, B=cluster1796)
divi_147 = DivideCurve(A=seri_155, B=<missing>)
rota_146 = Rotate(A=divi_144, B=cons_58)
cons_150 = ConstructPoint(A=3.605, B=loft_145)
move_147 = Move(A=0.697, B=rang_105)
move_148 = Move(A=mult_141, B=2.938)
move_149 = Move(A=move_6, B=line_147)
addi_132 = Addition(A=<missing>, B=rang_104)
seri_159 = Series(A=rang_104, B=addi_14)
addi_133 = Addition(A=addi_131, B=7.981)
seri_160 = Series(A=<missing>, B=seri_157)
line_150 = Line(A=rang_9, B=mult_141)
rang_107 = Range(A=3.044, B=cons_142)
rota_147 = Rotate(A=rang_38, B=move_148)
mult_145 = Multiplication(A=addi_131, B=mult_47)
cons_151 = ConstructPoint(A=line_147, B=3.021)
divi_148 = DivideCurve(A=cons_145, B=mult_5)
move_150 = Move(A=addi_132, B=divi_15)
seri_161 = Series(A=<missing>, B=addi_130)
cons_152 = ConstructPoint(A=rota_141, B=loft_29)
loft_147 = Loft(A=<missing>, B=cons_148)
seri_162 = Series(A=cons_142, B=loft_104)
line_151 = Line(A=<missing>, B=seri_159)
loft_148 = Loft(A=seri_33, B=loft_144)
line_152 = Line(A=<missing>, B=cons_141)
mult_146 = Multiplication(A=rota_143, B=move_5)
loft_149 = Loft(A=line_147, B=divi_2)
mult_147 = Multiplication(A=<missing>, B=line_152)
move_151 = Move(A=cons_148, B=divi_24)
line_153 = Line(A=line_29, B=line_146)
move_152 = Move(A=rota_30, B=addi_133)
seri_163 = Series(A=seri_24, B=line_146)
rota_148 = Rotate(A=cons_42, B=rang_106)
loft_150 = Loft(A=line_153, B=rota_3)
divi_149 = DivideCurve(A=seri_39, B=mult_140)
flip_47 = FlipMatrix(A=move_146, B=divi_22)
rota_149 = Rotate(A=addi_130, B=disp)
line_154 = Line(A=seri_43, B=rang_105)
cons_153 = ConstructPoint(A=cons_145, B=rota_3)
rota_150 = Rotate(A=cons_150, B=<missing>)
rota_151 = Rotate(A=8.801, B=loft_147)
rang_108 = Range(A=cull_57, B=rang_11)
disp_41 = Dispatch(A=loft_27, B=rota_141)
line_155 = Line(A=cons_2, B=line_148)
divi_150 = DivideCurve(A=flip_47, B=mult_17)
line_156 = Line(A=5.94, B=loft_144)
divi_151 = DivideCurve(A=seri_156, B=mult_140)
divi_152 = DivideCurve(A=move_143, B=move_34)
mult_148 = Multiplication(A=seri_46, B=cons_153)
move_153 = Move(A=line_155, B=6.14)
addi_134 = Addition(A=rota_141, B=0.622)
addi_135 = Addition(A=<missing>, B=seri_157)
disp_42 = Dispatch(A=divi_56, B=mult_141)
flip_48 = FlipMatrix(A=flip_47, B=<missing>)
move_154 = Move(A=mult_59, B=flip_47)
cons_154 = ConstructPoint(A=rang_108, B=move_9)
rang_109 = Range(A=rang_94, B=move_148)
rang_110 = Range(A=rota_146, B=addi_35)  # -> R
# ---------- rang_110: C# ----------
int a = 2034;
return a * 2;
# ---------- end rang_110 ----------
move_155 = Move(A=line_39, B=cons_149)
cons_155 = ConstructPoint(A=cons_141, B=<missing>)
mult_149 = Multiplication(A=mult_141, B=shif_7)
move_156 = Move(A=cons_152, B=cons_67)
seri_164 = Series(A=loft_70, B=rang_106)
move_157 = Move(A=7.464, B=line_152)
divi_153 = DivideCurve(A=divi_54, B=seri_161)
line_157 = Line(A=mult_149, B=cluster341)
addi_136 = Addition(A=seri_72, B=loft_148)
cons_156 = ConstructPoint(A=cons_141, B=cull_17)
addi_137 = Addition(A=cons_145, B=mult_43)
mult_150 = Multiplication(A=divi_143, B=seri_19)
seri_165 = Series(A=mult_144, B=shif_6)
addi_138 = Addition(A=divi_152, B=rota_48)
move_158 = Move(A=rota_143, B=<missing>)
move_159 = Move(A=addi_34, B=seri_165)
rota_152 = Rotate(A=loft_24, B=mult_144)
addi_139 = Addition(A=divi_149, B=cull_4)
mult_151 = Multiplication(A=cons_69, B=line_152)
move_160 = Move(A=move_143, B=move_86)
mult_152 = Multiplication(A=line_145, B=rota_18)
addi_140 = Addition(A=rang_5, B=seri_157)
rota_153 = Rotate(A=<missing>, B=seri_156)
move_161 = Move(A=<missing>, B=cons_145)
divi_154 = DivideCurve(A=8.11, B=rota_151)
seri_166 = Series(A=rota_152, B=mult_24)
move_162 = Move(A=divi_152, B=3.839)
seri_167 = Series(A=move_143, B=seri_73)
rota_154 = Rotate(A=mult_41, B=divi_7)
rota_155 = Rotate(A=1.493, B=disp_36)
line_158 = Line(A=loft_11, B=rota_155)
rang_111 = Range(A=line_158, B=1.206)
rang_112 = Range(A=rang_111, B=divi_71)
rota_156 = Rotate(A=<missing>, B=line_158)
move_163 = Move(A=1.886, B=line_158)
addi_141 = Addition(A=rang_111, B=2.176)
move_164 = Move(A=line_158, B=addi)
addi_142 = Addition(A=<missing>, B=rang_112)
cons_157 = ConstructPoint(A=addi_141, B=move_97)
mult_153 = Multiplication(A=9.053, B=rang_112)
cons_158 = ConstructPoint(A=<missing>, B=addi_142)
mult_154 = Multiplication(A=move_164, B=flip_43)
rota_157 = Rotate(A=mult_46, B=line_158)
rang_113 = Range(A=loft_106, B=line_158)
mult_155 = Multiplication(A=rang_80, B=addi_141)
mult_156 = Multiplication(A=move_108, B=rota_156)
rang_114 = Range(A=4.356, B=rota_157)
seri_168 = Series(A=cons_57, B=rang_113)
line_159 = Line(A=move_164, B=move_109)
addi_143 = Addition(A=line_158, B=addi_91)
cons_159 = ConstructPoint(A=rang_114, B=line_2)
addi_144 = Addition(A=move_163, B=move_47)
line_160 = Line(A=seri_168, B=addi_86)
cons_160 = ConstructPoint(A=line_158, B=divi_96)
line_161 = Line(A=addi_142, B=cons_58)
divi_155 = DivideCurve(A=addi_143, B=1.083)
loft_151 = Loft(A=addi_143, B=addi_141)
cons_161 = ConstructPoint(A=divi_155, B=seri_3)
addi_145 = Addition(A=addi_143, B=line_28)
addi_146 = Addition(A=line_160, B=rang_107)
divi_156 = DivideCurve(A=line_158, B=rang_26)
loft_152 = Loft(A=cons_161, B=loft_4)
seri_169 = Series(A=move_154, B=rang_113)
addi_147 = Addition(A=move_39, B=seri_168)
disp_43 = Dispatch(A=mult_153, B=<missing>)
addi_148 = Addition(A=move_164, B=6.016)
rota_158 = Rotate(A=6.508, B=line_158)
seri_170 = Series(A=1.151, B=addi_12)
loft_153 = Loft(A=rang_33, B=line_137)
mult_157 = Multiplication(A=0.086, B=<missing>)
disp_44 = Dispatch(A=rang_26, B=cons_48)
seri_171 = Series(A=line_35, B=seri_28)
loft_154 = Loft(A=addi_31, B=seri_133)
cluster1020 = Cluster(In=cons_103)
seri_172 = Series(A=addi_12, B=7.698)
seri_173 = Series(A=divi_66, B=addi_19)
loft_155 = Loft(A=line_61, B=line_57)
cons_162 = ConstructPoint(A=line_78, B=mult_7)
seri_174 = Series(A=move_23, B=seri_43)
seri_175 = Series(A=move_88, B=cons_42)
move_165 = Move(A=1.23, B=addi_85)  # -> R
# ---------- move_165: C# ----------
int a = 1398;
return a * 2;
# ---------- end move_165 ----------
rang_115 = Range(A=3.891, B=move_140)
line_162 = Line(A=<missing>, B=loft_94)
shif_48 = ShiftList(A=move_154, B=disp_13)
loft_156 = Loft(A=addi_82, B=<missing>)
addi_149 = Addition(A=divi_92, B=line_108)
mult_158 = Multiplication(A=9.292, B=loft_51)
line_163 = Line(A=rang_111, B=6.532)
cons_163 = ConstructPoint(A=cluster438, B=4.809)
rota_159 = Rotate(A=rota_38, B=<missing>)
disp_45 = Dispatch(A=shif_20, B=<missing>)
rota_160 = Rotate(A=5.138, B=move_59)
rang_116 = Range(A=rang_3, B=mult_102)
line_164 = Line(A=move_30, B=rang_14)
rota_161 = Rotate(A=rang_90, B=cluster2378)
divi_157 = DivideCurve(A=<missing>, B=shif_6)
loft_157 = Loft(A=disp_24, B=addi_100)
addi_150 = Addition(A=3.329, B=move_124)
cons_164 = ConstructPoint(A=loft_10, B=cluster1893)
loft_158 = Loft(A=6.388, B=line_37)
rang_117 = Range(A=4.211, B=loft_6)
seri_176 = Series(A=rang_10, B=loft_33)
mult_159 = Multiplication(A=cull_5, B=flip_14)
rang_118 = Range(A=loft_30, B=cons_63)
cons_165 = ConstructPoint(A=rota, B=rota_61)
rota_162 = Rotate(A=2.108, B=rang_29)
rota_163 = Rotate(A=rota_83, B=rota_82)
move_166 = Move(A=rota_163, B=move_132)
flip_49 = FlipMatrix(A=mult_37, B=rota_163)
rang_119 = Range(A=move_166, B=cons_56)
mult_160 = Multiplication(A=addi_130, B=move_166)
disp_46 = Dispatch(A=seri_99, B=move_166)
move_167 = Move(A=move_166, B=move_166)
rang_120 = Range(A=mult_160, B=line_113)
seri_177 = Series(A=line_119, B=rang_120)
line_165 = Line(A=0.14, B=seri_177)
rang_121 = Range(A=seri_177, B=move_122)
rota_164 = Rotate(A=move_166, B=disp_46)
shif_49 = ShiftList(A=disp_46, B=seri_116)
mult_161 = Multiplication(A=<missing>, B=disp_46)
line_166 = Line(A=move_166, B=7.346)
line_167 = Line(A=cons, B=flip_49)
addi_151 = Addition(A=rang_120, B=move_99)
divi_158 = DivideCurve(A=mult_160, B=line_158)
shif_50 = ShiftList(A=shif_49, B=flip_33)
addi_152 = Addition(A=<missing>, B=shif_49)
rang_122 = Range(A=<missing>, B=move_166)
cons_166 = ConstructPoint(A=flip_49, B=loft_103)
cluster1408 = Cluster(In=rang_119)
seri_178 = Series(A=cull_57, B=disp_46)
divi_159 = DivideCurve(A=3.084, B=rang_120)
rang_123 = Range(A=move_105, B=rang_119)
rota_165 = Rotate(A=0.176, B=rang_120)
rang_124 = Range(A=shif_49, B=9.224)
cons_167 = ConstructPoint(A=addi_151, B=flip_43)
flip_50 = FlipMatrix(A=rota_164, B=5.518)
seri_179 = Series(A=flip_49, B=addi_130)
addi_153 = Addition(A=divi_111, B=seri_179)
move_168 = Move(A=rang_112, B=addi_153)
move_169 = Move(A=flip_49, B=loft_60)  # -> R
# ---------- move_169: C# ----------
int a = 815;
return a * 2;
# ---------- end move_169 ----------
move_170 = Move(A=rota_143, B=mult_160)
move_171 = Move(A=cons_166, B=mult_80)
cons_168 = ConstructPoint(A=seri_178, B=addi_89)
cull_59 = CullPattern(A=mult_161, B=cons_110)
loft_159 = Loft(A=move_166, B=3.7)
seri_180 = Series(A=move_166, B=rota_64)
flip_51 = FlipMatrix(A=loft_2, B=seri_179)
mult_162 = Multiplication(A=shif_50, B=rang_67)
rota_166 = Rotate(A=cons_143, B=move_169)
divi_160 = DivideCurve(A=seri_178, B=rota_101)
cons_169 = ConstructPoint(A=flip_51, B=2.852)
divi_161 = DivideCurve(A=cons_7, B=cull_59)
cons_170 = ConstructPoint(A=addi_3, B=rang_124)
move_172 = Move(A=loft_159, B=move_104)
line_168 = Line(A=move_166, B=rota_143)
rang_125 = Range(A=divi_159, B=7.072)
mult_163 = Multiplication(A=<missing>, B=rota_164)
line_169 = Line(A=move_104, B=seri_179)
cull_60 = CullPattern(A=seri_179, B=4.005)
line_170 = Line(A=divi_161, B=5.485)
loft_160 = Loft(A=cons_168, B=2.398)
cons_171 = ConstructPoint(A=cons_6, B=divi_161)
mult_164 = Multiplication(A=seri_92, B=move_166)
flip_52 = FlipMatrix(A=seri_179, B=7.057)
mult_165 = Multiplication(A=disp_46, B=line_13)
shif_51 = ShiftList(A=cons_168, B=4.25)
line_171 = Line(A=8.533, B=seri_178)
rota_167 = Rotate(A=mult_13, B=addi_151)
divi_162 = DivideCurve(A=5.609, B=shif_51)
shif_52 = ShiftList(A=mult_80, B=cluster1408)
cull_61 = CullPattern(A=line_12, B=cons_171)
flip_53 = FlipMatrix(A=mult_165, B=1.877)
mult_166 = Multiplication(A=rota_164, B=cull_3)
move_173 = Move(A=addi_151, B=seri_179)
shif_53 = ShiftList(A=cons_148, B=seri_179)
divi_163 = DivideCurve(A=<missing>, B=move_166)
divi_164 = DivideCurve(A=flip_52, B=cluster341)
cons_172 = ConstructPoint(A=cull_59, B=addi_153)
rota_168 = Rotate(A=shif_50, B=move_57)
addi_154 = Addition(A=cull_39, B=disp_46)
rota_169 = Rotate(A=move_173, B=cons_149)
line_172 = Line(A=cluster1408, B=loft_63)
loft_161 = Loft(A=rota_164, B=1.685)
rota_170 = Rotate(A=flip_52, B=move_55)
cons_173 = ConstructPoint(A=cons_110, B=move_169)
flip_54 = FlipMatrix(A=addi_14, B=rang_119)
rota_171 = Rotate(A=rota_141, B=seri_179)
rang_126 = Range(A=mult_101, B=move_169)
addi_155 = Addition(A=seri_177, B=shif_4)
mult_167 = Multiplication(A=7.349, B=divi_161)
shif_54 = ShiftList(A=move_173, B=line_123)
rota_172 = Rotate(A=<missing>, B=move_173)
cluster2669 = Cluster(In=move_167)
line_173 = Line(A=cons_170, B=cons_144)  # -> R
# ---------- line_173: C# ----------
int a = 2723;
return a * 2;
# ---------- end line_173 ----------
rota_173 = Rotate(A=shif_53, B=mult_28)
loft_162 = Loft(A=seri_179, B=move_91)
move_174 = Move(A=seri_116, B=flip_52)
line_174 = Line(A=addi_2, B=addi_151)
rang_127 = Range(A=divi_2, B=rota_171)
addi_156 = Addition(A=divi_22, B=divi_161)
rang_128 = Range(A=flip_51, B=rota_15)
rang_129 = Range(A=mult_161, B=rang_102)  # -> R
# ---------- rang_129: C# ----------
int a = 2617;
return a * 2;
# ---------- end rang_129 ----------
addi_157 = Addition(A=loft_162, B=cons_7)
rang_130 = Range(A=cons_166, B=rota_56)
addi_158 = Addition(A=divi_162, B=3.093)
mult_168 = Multiplication(A=shif_16, B=flip_54)
addi_159 = Addition(A=cons_26, B=loft_161)
mult_169 = Multiplication(A=line_22, B=divi_163)
rang_131 = Range(A=cons_149, B=rang_119)
line_175 = Line(A=rang_111, B=move_172)
addi_160 = Addition(A=move_171, B=cons_5)
cons_174 = ConstructPoint(A=mult_39, B=seri_179)
rang_132 = Range(A=rang_127, B=addi_6)
seri_181 = Series(A=move_171, B=rang_9)
loft_163 = Loft(A=seri_31, B=cons_173)
seri_182 = Series(A=mult_147, B=loft_162)
divi_165 = DivideCurve(A=rota_171, B=cluster341)
move_175 = Move(A=seri_48, B=divi_164)
addi_161 = Addition(A=cons_169, B=cons_149)
addi_162 = Addition(A=divi_160, B=9.014)
cons_175 = ConstructPoint(A=divi_162, B=line_83)
cons_176 = ConstructPoint(A=line_174, B=loft_6)
move_176 = Move(A=line_166, B=5.424)
move_177 = Move(A=divi_164, B=9.132)
line_176 = Line(A=move_177, B=addi_32)
loft_164 = Loft(A=move_19, B=line_174)
addi_163 = Addition(A=cons_149, B=shif_51)
loft_165 = Loft(A=loft_124, B=move_171)
seri_183 = Series(A=divi_158, B=<missing>)
mult_170 = Multiplication(A=addi_56, B=flip_54)
rota_174 = Rotate(A=cons_166, B=0.728)
loft_166 = Loft(A=addi_99, B=loft_165)
addi_164 = Addition(A=loft_124, B=cons_173)
disp_47 = Dispatch(A=seri_183, B=7.29)
rang_133 = Range(A=cons_152, B=rang_127)
rota_175 = Rotate(A=move_169, B=move_148)
cull_62 = CullPattern(A=flip_52, B=shif_14)
line_177 = Line(A=move_174, B=cull_20)
rang_134 = Range(A=rang_119, B=rang_19)
divi_166 = DivideCurve(A=rang_119, B=6.725)
divi_167 = DivideCurve(A=disp_46, B=mult_79)
rang_135 = Range(A=rota_171, B=move_24)
seri_184 = Series(A=addi_159, B=5.977)
rang_136 = Range(A=<missing>, B=addi_164)
loft_167 = Loft(A=shif_50, B=line_53)
rota_176 = Rotate(A=seri_179, B=line_62)
seri_185 = Series(A=addi_35, B=rang_126)
cons_177 = ConstructPoint(A=cull_59, B=cons_22)
divi_168 = DivideCurve(A=move_19, B=rota_176)  # -> R
# ---------- divi_168: C# ----------
int a = 1610;
return a * 2;
# ---------- end divi_168 ----------
flip_55 = FlipMatrix(A=rota_173, B=rota_20)
loft_168 = Loft(A=move_117, B=flip_55)
cull_63 = CullPattern(A=loft, B=loft_168)
rang_137 = Range(A=seri_133, B=shif_50)
seri_186 = Series(A=divi_163, B=3.484)
divi_169 = DivideCurve(A=<missing>, B=cull_62)
seri_187 = Series(A=move_169, B=divi_47)
flip_56 = FlipMatrix(A=line_168, B=divi)
rota_177 = Rotate(A=rota_59, B=rota_174)
addi_165 = Addition(A=4.453, B=flip_49)
rang_138 = Range(A=9.233, B=line_172)
rota_178 = Rotate(A=flip_54, B=line_38)
loft_169 = Loft(A=rota_176, B=8.988)
cons_178 = ConstructPoint(A=line_108, B=rota_176)
cons_179 = ConstructPoint(A=rota_167, B=flip_44)
line_178 = Line(A=seri_181, B=move_3)
line_179 = Line(A=divi_12, B=<missing>)
cluster535 = Cluster(In=cull_5)
addi_166 = Addition(A=loft_61, B=<missing>)
rang_139 = Range(A=<missing>, B=disp_16)
rota_179 = Rotate(A=rota_69, B=cons_12)
loft_170 = Loft(A=rota_179, B=<missing>)
cull_64 = CullPattern(A=<missing>, B=loft_170)
addi_167 = Addition(A=cluster2378, B=loft_170)
line_180 = Line(A=2.669, B=seri_85)
cons_180 = ConstructPoint(A=loft_4, B=addi_16)
rang_140 = Range(A=move_68, B=move_15)
cons_181 = ConstructPoint(A=seri_151, B=<missing>)
loft_171 = Loft(A=6.232, B=addi_24)
move_178 = Move(A=cons_18, B=seri_107)
rota_180 = Rotate(A=mult_70, B=<missing>)
seri_188 = Series(A=6.839, B=line_67)
line_181 = Line(A=rota_63, B=seri_53)  # -> R
# ---------- line_181: C# ----------
int a = 1345;
return a * 2;
# ---------- end line_181 ----------
seri_189 = Series(A=<missing>, B=2.054)
cons_182 = ConstructPoint(A=1.711, B=5.575)
line_182 = Line(A=rang_79, B=5.272)
seri_190 = Series(A=loft_56, B=loft_56)
divi_170 = DivideCurve(A=<missing>, B=<missing>)
seri_191 = Series(A=seri_23, B=<missing>)
addi_168 = Addition(A=rota_155, B=rang_44)
rang_141 = Range(A=addi_27, B=8.483)
disp_48 = Dispatch(A=divi_71, B=rota_149)
addi_169 = Addition(A=6.478, B=cull_9)
addi_170 = Addition(A=seri_130, B=loft_125)
rota_181 = Rotate(A=cons_129, B=divi_75)
rang_142 = Range(A=move_130, B=cons_98)
divi_171 = DivideCurve(A=0.56, B=divi_89)
loft_172 = Loft(A=rang_48, B=addi_119)
seri_192 = Series(A=seri_103, B=mult_12)
rang_143 = Range(A=7.328, B=move_71)
loft_173 = Loft(A=8.067, B=mult_63)
line_183 = Line(A=mult_159, B=8.112)
rang_144 = Range(A=cons_47, B=divi_46)
line_184 = Line(A=6.572, B=mult_82)
mult_171 = Multiplication(A=<missing>, B=addi_85)
mult_172 = Multiplication(A=3.22, B=<missing>)
seri_193 = Series(A=flip_8, B=rota_90)
addi_171 = Addition(A=addi_20, B=4.712)
mult_173 = Multiplication(A=move_43, B=<missing>)
mult_174 = Multiplication(A=<missing>, B=divi_47)
loft_174 = Loft(A=rota_79, B=1.652)
rang_145 = Range(A=flip_28, B=5.282)
addi_172 = Addition(A=<missing>, B=seri_6)
rota_182 = Rotate(A=cons_110, B=mult_117)
move_179 = Move(A=cull_2, B=mult_159)
seri_194 = Series(A=move_160, B=mult_139)
loft_175 = Loft(A=<missing>, B=move_77)
seri_195 = Series(A=<missing>, B=shif_2)
divi_172 = DivideCurve(A=<missing>, B=8.401)  # -> R
# ---------- divi_172: C# ----------
int a = 1292;
return a * 2;
# ---------- end divi_172 ----------
rota_183 = Rotate(A=3.954, B=mult_4)
rota_184 = Rotate(A=rota_91, B=seri_14)
move_180 = Move(A=rota_184, B=seri_147)
mult_175 = Multiplication(A=move_116, B=move_180)
divi_173 = DivideCurve(A=mult_175, B=line)
addi_173 = Addition(A=3.654, B=<missing>)
seri_196 = Series(A=cons_126, B=seri_27)
loft_176 = Loft(A=4.188, B=line_130)
rang_146 = Range(A=rang_65, B=seri_136)
loft_177 = Loft(A=mult_93, B=<missing>)
move_181 = Move(A=divi_51, B=0.672)
cons_183 = ConstructPoint(A=addi_77, B=move_121)
loft_178 = Loft(A=9.175, B=flip_9)
rang_147 = Range(A=addi_108, B=shif_17)
flip_57 = FlipMatrix(A=5.282, B=line_6)
rota_185 = Rotate(A=move_97, B=disp_12)
rota_186 = Rotate(A=mult_73, B=rang_112)
rota_187 = Rotate(A=rota_106, B=divi_108)
addi_174 = Addition(A=mult_134, B=divi_75)
shif_55 = ShiftList(A=divi_9, B=loft_119)
disp_49 = Dispatch(A=line_46, B=5.556)
mult_176 = Multiplication(A=rota_111, B=loft)
rang_148 = Range(A=loft_62, B=cons_26)
rota_188 = Rotate(A=move_80, B=shif_3)
addi_175 = Addition(A=loft_30, B=line)
loft_179 = Loft(A=line_16, B=rota_12)
cons_184 = ConstructPoint(A=cluster147, B=loft_116)
cons_185 = ConstructPoint(A=2.54, B=rang_144)
rang_149 = Range(A=rang_6, B=<missing>)
move_182 = Move(A=addi_104, B=cons_47)
addi_176 = Addition(A=mult_115, B=seri_17)
mult_177 = Multiplication(A=line_138, B=move_82)
cons_186 = ConstructPoint(A=mult_38, B=move_166)
shif_56 = ShiftList(A=rang, B=seri_98)
addi_177 = Addition(A=5.098, B=divi_42)
divi_174 = DivideCurve(A=mult_48, B=0.935)
loft_180 = Loft(A=cons_136, B=rota_76)
loft_181 = Loft(A=rota_41, B=shif_28)
rota_189 = Rotate(A=rota_52, B=3.019)
loft_182 = Loft(A=divi_96, B=rang_49)  # -> R
# ---------- loft_182: C# ----------
int a = 1239;
return a * 2;
# ---------- end loft_182 ----------
cons_187 = ConstructPoint(A=mult_107, B=shif_33)
rota_190 = Rotate(A=5.302, B=divi_131)
loft_183 = Loft(A=rota_89, B=6.668)
seri_197 = Series(A=line_67, B=0.232)
divi_175 = DivideCurve(A=cons_161, B=seri_165)
move_183 = Move(A=6.707, B=<missing>)
rang_150 = Range(A=0.149, B=rang_10)
mult_178 = Multiplication(A=rang_29, B=loft_145)
line_185 = Line(A=rang_70, B=cull_50)
rang_151 = Range(A=0.085, B=loft_91)
cull_65 = CullPattern(A=line_68, B=divi_3)
seri_198 = Series(A=<missing>, B=divi_79)
cull_66 = CullPattern(A=cons_181, B=<missing>)
seri_199 = Series(A=addi_113, B=rang_146)
shif_57 = ShiftList(A=rota_156, B=3.096)
loft_184 = Loft(A=loft_152, B=cull_39)
line_186 = Line(A=9.777, B=loft_78)
rota_191 = Rotate(A=5.448, B=rang_7)
line_187 = Line(A=cons_91, B=3.255)
move_184 = Move(A=move_83, B=<missing>)
divi_176 = DivideCurve(A=divi_27, B=<missing>)
addi_178 = Addition(A=line_81, B=move_71)
rota_192 = Rotate(A=flip, B=rang_23)
cons_188 = ConstructPoint(A=move_31, B=rota_192)
mult_179 = Multiplication(A=loft_103, B=cons_188)
shif_58 = ShiftList(A=addi_130, B=cons_188)
cons_189 = ConstructPoint(A=cons_188, B=cons_53)
loft_185 = Loft(A=loft_54, B=cons_188)
shif_59 = ShiftList(A=cons_188, B=disp_30)
cons_190 = ConstructPoint(A=seri_155, B=cons_189)
addi_179 = Addition(A=shif_58, B=rang)
loft_186 = Loft(A=2.397, B=cons_188)
cons_191 = ConstructPoint(A=1.701, B=shif_59)
line_188 = Line(A=cons_188, B=0.707)
shif_60 = ShiftList(A=loft_54, B=cons_188)
cons_192 = ConstructPoint(A=cons_191, B=flip_33)
cull_67 = CullPattern(A=rang_119, B=cons_189)
cons_193 = ConstructPoint(A=cull_57, B=loft_185)
rota_193 = Rotate(A=7.781, B=cons_190)
divi_177 = DivideCurve(A=cons_188, B=<missing>)
cons_194 = ConstructPoint(A=rang_120, B=loft_186)
move_185 = Move(A=move_57, B=cons_192)
line_189 = Line(A=cons_188, B=6.11)
rota_194 = Rotate(A=5.822, B=cons_188)  # -> R
# ---------- rota_194: C# ----------
int a = 709;
return a * 2;
# ---------- end rota_194 ----------
cons_195 = ConstructPoint(A=shif_58, B=move_169)
addi_180 = Addition(A=seri_179, B=divi_177)
shif_61 = ShiftList(A=rota_142, B=divi_177)
rota_195 = Rotate(A=cons_195, B=move_48)
divi_178 = DivideCurve(A=divi_177, B=shif_34)
addi_181 = Addition(A=shif_60, B=rang_2)
rota_196 = Rotate(A=move_108, B=shif_59)
move_186 = Move(A=rang_2, B=mult_179)
divi_179 = DivideCurve(A=mult_179, B=loft_106)
rang_152 = Range(A=shif_58, B=divi_3)
seri_200 = Series(A=7.59, B=line_189)
cons_196 = ConstructPoint(A=rota_196, B=<missing>)
rang_153 = Range(A=addi_92, B=mult_179)
move_187 = Move(A=rang_153, B=3.202)
line_190 = Line(A=cons_192, B=cons_6)
rang_154 = Range(A=rota_194, B=loft)
rota_197 = Rotate(A=move_122, B=seri_200)
cons_197 = ConstructPoint(A=line_119, B=move_186)
divi_180 = DivideCurve(A=9.291, B=mult_179)
cons_198 = ConstructPoint(A=rang_152, B=flip_5)
rang_155 = Range(A=seri_200, B=cons_56)
flip_58 = FlipMatrix(A=line_188, B=5.48)
addi_182 = Addition(A=line_190, B=cons_124)
rota_198 = Rotate(A=divi_177, B=move_169)
move_188 = Move(A=cons_195, B=loft_16)
addi_183 = Addition(A=move_8, B=seri_200)
cons_199 = ConstructPoint(A=loft_186, B=rota_194)
flip_59 = FlipMatrix(A=cons_195, B=7.768)
cull_68 = CullPattern(A=shif_59, B=seri_11)
mult_180 = Multiplication(A=divi_177, B=cull_2)
loft_187 = Loft(A=cons_192, B=line_13)
mult_181 = Multiplication(A=cons_188, B=addi_143)
move_189 = Move(A=divi_8, B=move_186)
seri_201 = Series(A=3.678, B=cons_188)
move_190 = Move(A=divi_180, B=cluster438)
addi_184 = Addition(A=line_148, B=move_186)
loft_188 = Loft(A=rota_193, B=seri_117)
seri_202 = Series(A=cons_197, B=3.306)
rota_199 = Rotate(A=rota_197, B=cull_39)
divi_181 = DivideCurve(A=seri_200, B=9.682)
loft_189 = Loft(A=addi_99, B=move_186)
flip_60 = FlipMatrix(A=cons_188, B=rang_7)
cons_200 = ConstructPoint(A=1.504, B=addi_180)
rota_200 = Rotate(A=cull_68, B=divi_143)
loft_190 = Loft(A=addi_180, B=seri_119)
mult_182 = Multiplication(A=line_189, B=cull_39)
loft_191 = Loft(A=move_189, B=mult_109)
rota_201 = Rotate(A=cons_188, B=seri_155)
rang_156 = Range(A=divi_177, B=rang_80)
divi_182 = DivideCurve(A=cons_196, B=rang)
rota_202 = Rotate(A=divi_110, B=move_189)
move_191 = Move(A=addi_2, B=line_189)
move_192 = Move(A=line_189, B=addi_89)
rota_203 = Rotate(A=loft_185, B=cull_29)
mult_183 = Multiplication(A=line_9, B=shif_58)
seri_203 = Series(A=cons_9, B=cons_200)
loft_192 = Loft(A=shif_61, B=cons_171)
loft_193 = Loft(A=cons_192, B=addi_130)
mult_184 = Multiplication(A=rota_53, B=flip_60)
mult_185 = Multiplication(A=cons_190, B=<missing>)
cons_201 = ConstructPoint(A=loft_114, B=divi_179)
shif_62 = ShiftList(A=cons_188, B=6.391)
mult_186 = Multiplication(A=rota_167, B=rang_152)
mult_187 = Multiplication(A=cons_57, B=rang_155)
loft_194 = Loft(A=addi_21, B=shif_58)
rota_204 = Rotate(A=move_104, B=move_189)
seri_204 = Series(A=<missing>, B=loft_185)
line_191 = Line(A=cons_108, B=rota_198)
rota_205 = Rotate(A=loft_193, B=mult_50)
mult_188 = Multiplication(A=cons_191, B=cull_3)
seri_205 = Series(A=divi_180, B=5.655)
loft_195 = Loft(A=1.226, B=cons_194)
divi_183 = DivideCurve(A=divi_27, B=cons_188)
seri_206 = Series(A=3.527, B=cons_194)
mult_189 = Multiplication(A=loft_185, B=divi_36)
loft_196 = Loft(A=divi_33, B=seri_200)
seri_207 = Series(A=mult_15, B=rota_197)
rang_157 = Range(A=shif_59, B=addi_12)
divi_184 = DivideCurve(A=loft_123, B=move_188)
loft_197 = Loft(A=addi_99, B=shif_62)
mult_190 = Multiplication(A=loft_194, B=flip_41)
divi_185 = DivideCurve(A=seri_203, B=loft_116)  # -> R
# ---------- divi_185: C# ----------
int a = 2352;
return a * 2;
# ---------- end divi_185 ----------
move_193 = Move(A=move_190, B=line_83)
flip_61 = FlipMatrix(A=rota_103, B=mult_183)
divi_186 = DivideCurve(A=shif_60, B=addi_52)
loft_198 = Loft(A=flip_60, B=move_56)
line_192 = Line(A=flip_13, B=cons_188)
divi_187 = DivideCurve(A=addi_88, B=mult_179)
seri_208 = Series(A=divi_183, B=7.409)
addi_185 = Addition(A=move_190, B=<missing>)
addi_186 = Addition(A=disp_31, B=seri_200)  # -> R
# ---------- addi_186: C# ----------
int a = 2193;
return a * 2;
# ---------- end addi_186 ----------
cons_202 = ConstructPoint(A=1.004, B=rang_156)
loft_199 = Loft(A=line_192, B=disp_30)
shif_63 = ShiftList(A=move_43, B=loft_186)
move_194 = Move(A=seri_19, B=divi_187)
loft_200 = Loft(A=mult_93, B=cull_68)
divi_188 = DivideCurve(A=move_192, B=<missing>)
cons_203 = ConstructPoint(A=cons_188, B=rota_64)
mult_191 = Multiplication(A=shif_43, B=mult_186)
rota_206 = Rotate(A=rota_124, B=loft_196)
mult_192 = Multiplication(A=rota_58, B=divi_177)
line_193 = Line(A=seri_55, B=addi_180)
mult_193 = Multiplication(A=shif_61, B=loft_42)
divi_189 = DivideCurve(A=rang_108, B=addi_183)
move_195 = Move(A=cons_188, B=<missing>)
rota_207 = Rotate(A=move_100, B=divi_181)
mult_194 = Multiplication(A=4.609, B=divi_177)
cull_69 = CullPattern(A=move_186, B=move_19)
cons_204 = ConstructPoint(A=3.151, B=loft_185)  # -> R
# ---------- cons_204: C# ----------
int a = 1981;
return a * 2;
# ---------- end cons_204 ----------
line_194 = Line(A=cons_196, B=<missing>)
addi_187 = Addition(A=flip_9, B=move_186)
rota_208 = Rotate(A=divi_177, B=move)
shif_64 = ShiftList(A=divi_177, B=rota_15)
move_196 = Move(A=seri_6, B=flip_59)
loft_201 = Loft(A=rota_193, B=rang_73)
disp_50 = Dispatch(A=mult_28, B=move_190)
loft_202 = Loft(A=divi_37, B=rang_152)
divi_190 = DivideCurve(A=line_7, B=shif_62)  # -> R
# ---------- divi_190: C# ----------
int a = 1822;
return a * 2;
# ---------- end divi_190 ----------
divi_191 = DivideCurve(A=move_19, B=seri_208)
mult_195 = Multiplication(A=addi_68, B=shif_63)
cons_205 = ConstructPoint(A=flip_60, B=rota_52)
rang_158 = Range(A=loft_192, B=addi_16)
divi_192 = DivideCurve(A=rota_207, B=mult_133)
loft_203 = Loft(A=loft_190, B=move_154)
rang_159 = Range(A=shif_60, B=rang_42)
cons_206 = ConstructPoint(A=cull_69, B=loft_120)
rang_160 = Range(A=divi_180, B=3.526)
line_195 = Line(A=<missing>, B=seri_200)
mult_196 = Multiplication(A=seri_52, B=loft_186)
cons_207 = ConstructPoint(A=<missing>, B=seri_200)
cons_208 = ConstructPoint(A=line_93, B=rota_196)
line_196 = Line(A=cons_26, B=divi_191)
rota_209 = Rotate(A=rota_208, B=cons_198)
move_197 = Move(A=seri_114, B=line_192)
line_197 = Line(A=move_189, B=<missing>)
line_198 = Line(A=loft_192, B=move_171)
addi_188 = Addition(A=4.825, B=shif_64)
rang_161 = Range(A=mult_181, B=cull_39)
seri_209 = Series(A=seri_131, B=divi_178)
flip_62 = FlipMatrix(A=rota_204, B=cons_48)
rota_210 = Rotate(A=0.337, B=shif_62)
divi_193 = DivideCurve(A=seri_93, B=rota_195)
cons_209 = ConstructPoint(A=shif_29, B=divi_193)
seri_210 = Series(A=cons_209, B=rota_51)
mult_197 = Multiplication(A=rota_145, B=cons_209)
rang_162 = Range(A=cons_195, B=9.588)
disp_51 = Dispatch(A=4.124, B=rota_194)
loft_204 = Loft(A=addi_99, B=shif_63)
mult_198 = Multiplication(A=<missing>, B=rang_152)
rota_211 = Rotate(A=move_195, B=loft_104)
move_198 = Move(A=move_189, B=9.798)
line_199 = Line(A=shif_63, B=rota_41)
move_199 = Move(A=divi_114, B=flip_59)
line_200 = Line(A=mult_61, B=<missing>)
addi_189 = Addition(A=2.912, B=move_32)
rang_163 = Range(A=<missing>, B=<missing>)
mult_199 = Multiplication(A=cons_63, B=shif_5)
divi_194 = DivideCurve(A=move_64, B=move_143)
divi_195 = DivideCurve(A=<missing>, B=loft_2)
cull_70 = CullPattern(A=rang_45, B=addi_58)
cons_210 = ConstructPoint(A=mult_52, B=<missing>)
cons_211 = ConstructPoint(A=shif_58, B=divi)
divi_196 = DivideCurve(A=divi_180, B=cons_211)
line_201 = Line(A=1.897, B=divi_196)
loft_205 = Loft(A=divi_196, B=cons_53)
line_202 = Line(A=divi_196, B=move_35)
seri_211 = Series(A=disp_30, B=divi_196)
cons_212 = ConstructPoint(A=divi_196, B=4.311)
addi_190 = Addition(A=seri_211, B=addi_88)
loft_206 = Loft(A=line_201, B=cons_188)
cull_71 = CullPattern(A=loft_205, B=cons_108)
addi_191 = Addition(A=seri_211, B=seri_155)
cons_213 = ConstructPoint(A=seri_211, B=loft_205)
loft_207 = Loft(A=loft_206, B=loft_55)
mult_200 = Multiplication(A=shif_34, B=loft_205)
rota_212 = Rotate(A=divi_196, B=rota_143)
disp_52 = Dispatch(A=rang_67, B=line_202)
rang_164 = Range(A=2.602, B=loft_205)
divi_197 = DivideCurve(A=seri_211, B=move_3)
rota_213 = Rotate(A=line_201, B=rota_98)
cons_214 = ConstructPoint(A=divi_196, B=7.258)
cons_215 = ConstructPoint(A=line_202, B=cons_142)
line_203 = Line(A=addi_190, B=line_2)
addi_192 = Addition(A=rang, B=seri_211)
divi_198 = DivideCurve(A=loft_2, B=cons_213)
flip_63 = FlipMatrix(A=seri_120, B=line_203)
line_204 = Line(A=addi_88, B=seri_211)
rang_165 = Range(A=loft_207, B=cluster1893)
seri_212 = Series(A=cull_71, B=rota_47)
cons_216 = ConstructPoint(A=rang_113, B=cons_212)
rang_166 = Range(A=flip_63, B=divi_179)
rang_167 = Range(A=mult_108, B=cons_212)
seri_213 = Series(A=move_164, B=cons_213)
cons_217 = ConstructPoint(A=loft_207, B=rang_122)
rota_214 = Rotate(A=cons_59, B=seri_211)
move_200 = Move(A=cons_14, B=cons_213)
cons_218 = ConstructPoint(A=move_108, B=cons_213)
divi_199 = DivideCurve(A=seri_213, B=6.601)
line_205 = Line(A=seri_117, B=cons_213)
loft_208 = Loft(A=divi_196, B=2.707)
cons_219 = ConstructPoint(A=cons_13, B=flip_63)
line_206 = Line(A=5.078, B=loft_205)
loft_209 = Loft(A=<missing>, B=loft_207)
addi_193 = Addition(A=divi_196, B=addi_92)
seri_214 = Series(A=mult_200, B=cons_218)
rota_215 = Rotate(A=<missing>, B=line_203)
cons_220 = ConstructPoint(A=<missing>, B=addi_191)
rota_216 = Rotate(A=5.427, B=divi_196)
rang_168 = Range(A=disp_46, B=divi_196)
loft_210 = Loft(A=flip_63, B=mult_52)
seri_215 = Series(A=loft_208, B=seri_6)
cons_221 = ConstructPoint(A=line_203, B=disp_2)
line_207 = Line(A=line_201, B=rang_12)
cons_222 = ConstructPoint(A=rang_166, B=move_190)
flip_64 = FlipMatrix(A=cons_213, B=<missing>)
disp_53 = Dispatch(A=seri_215, B=divi_14)
cons_223 = ConstructPoint(A=move_55, B=addi_192)
rota_217 = Rotate(A=cons_222, B=line_149)
mult_201 = Multiplication(A=rota_18, B=addi_190)
rota_218 = Rotate(A=rota_212, B=move_116)
rota_219 = Rotate(A=5.541, B=loft_206)
move_201 = Move(A=seri_92, B=addi_190)
rota_220 = Rotate(A=rang_127, B=seri_213)
cons_224 = ConstructPoint(A=divi_11, B=disp_53)
line_208 = Line(A=5.154, B=loft_208)
divi_200 = DivideCurve(A=line_24, B=divi_196)
flip_65 = FlipMatrix(A=mult_201, B=<missing>)
rota_221 = Rotate(A=cons_212, B=2.242)
cons_225 = ConstructPoint(A=loft_130, B=cons_220)
rota_222 = Rotate(A=move_39, B=cons_221)
seri_216 = Series(A=line_208, B=cons_38)
divi_201 = DivideCurve(A=cull_71, B=flip_8)
flip_66 = FlipMatrix(A=mult_62, B=line_201)
move_202 = Move(A=mult_200, B=mult_32)
addi_194 = Addition(A=divi_80, B=line_206)
seri_217 = Series(A=line_53, B=flip_63)
move_203 = Move(A=cons_224, B=rota_33)
flip_67 = FlipMatrix(A=divi_200, B=7.781)
divi_202 = DivideCurve(A=9.322, B=loft_206)
rota_223 = Rotate(A=addi_96, B=cull_71)
line_209 = Line(A=addi_190, B=<missing>)
line_210 = Line(A=addi_193, B=divi_166)
mult_202 = Multiplication(A=move_200, B=<missing>)
flip_68 = FlipMatrix(A=line_204, B=divi_21)
addi_195 = Addition(A=<missing>, B=rang_164)
seri_218 = Series(A=mult_201, B=loft_87)
move_204 = Move(A=seri_218, B=mult_172)
rang_169 = Range(A=seri, B=move_204)
seri_219 = Series(A=seri_92, B=rang_169)
divi_203 = DivideCurve(A=seri_11, B=seri_217)
divi_204 = DivideCurve(A=divi_201, B=flip_35)
divi_205 = DivideCurve(A=mult_165, B=line_202)
rota_224 = Rotate(A=loft_78, B=loft_34)
line_211 = Line(A=<missing>, B=cull_4)
divi_206 = DivideCurve(A=line_211, B=cull_18)
cons_226 = ConstructPoint(A=line_38, B=flip_28)
seri_220 = Series(A=4.002, B=divi_36)
move_205 = Move(A=<missing>, B=seri_116)
cons_227 = ConstructPoint(A=rang_96, B=4.168)
cull_72 = CullPattern(A=cull_57, B=move_137)  # -> R
# ---------- cull_72: C# ----------
int a = 1186;
return a * 2;
# ---------- end cull_72 ----------
mult_203 = Multiplication(A=loft_124, B=addi_115)
cull_73 = CullPattern(A=divi_152, B=divi_96)
loft_211 = Loft(A=4.842, B=divi_88)
cull_74 = CullPattern(A=cons_54, B=loft_72)
disp_54 = Dispatch(A=6.299, B=loft_96)
rota_225 = Rotate(A=move_137, B=cons_141)
rota_226 = Rotate(A=rota_63, B=7.74)
cons_228 = ConstructPoint(A=6.83, B=rota_214)
seri_221 = Series(A=seri_35, B=mult_117)
move_206 = Move(A=loft_154, B=rota_132)
move_207 = Move(A=cull_37, B=divi_12)
loft_212 = Loft(A=loft_115, B=seri_53)
divi_207 = DivideCurve(A=7.212, B=<missing>)
addi_196 = Addition(A=divi_128, B=line_169)
addi_197 = Addition(A=<missing>, B=line_50)
mult_204 = Multiplication(A=shif_45, B=3.454)
addi_198 = Addition(A=seri_35, B=divi_118)
line_212 = Line(A=divi_48, B=move_37)
seri_222 = Series(A=1.838, B=move_152)
disp_55 = Dispatch(A=<missing>, B=move_74)
rang_170 = Range(A=flip_67, B=divi_32)
rang_171 = Range(A=rota_178, B=mult_140)
rota_227 = Rotate(A=mult_90, B=addi_12)
addi_199 = Addition(A=line_39, B=2.94)
move_208 = Move(A=2.133, B=seri_21)
line_213 = Line(A=<missing>, B=flip_14)
move_209 = Move(A=addi_77, B=line_213)
rota_228 = Rotate(A=<missing>, B=move_209)
move_210 = Move(A=divi_196, B=rota_228)
line_214 = Line(A=rota_228, B=mult_160)
addi_200 = Addition(A=rota_228, B=disp_30)
move_211 = Move(A=cons_57, B=move_209)
loft_213 = Loft(A=move_209, B=6.752)
rang_172 = Range(A=addi_130, B=line_214)
rota_229 = Rotate(A=<missing>, B=move_209)
rota_230 = Rotate(A=addi_200, B=addi_130)
loft_214 = Loft(A=move_209, B=cons_189)
disp_56 = Dispatch(A=move_2, B=move_211)
move_212 = Move(A=rang_55, B=move_211)
seri_223 = Series(A=move_209, B=rota_100)
mult_205 = Multiplication(A=3.752, B=rota_230)
divi_208 = DivideCurve(A=move_116, B=rota_228)
move_213 = Move(A=flip_35, B=addi_200)
addi_201 = Addition(A=move_209, B=mult)
loft_215 = Loft(A=rota_100, B=move_211)
loft_216 = Loft(A=loft_215, B=shif_60)
move_214 = Move(A=addi_86, B=loft_216)
mult_206 = Multiplication(A=loft_216, B=line_85)
flip_69 = FlipMatrix(A=flip_49, B=move_214)
rota_231 = Rotate(A=<missing>, B=loft_216)
rota_232 = Rotate(A=cons_109, B=move_214)
cons_229 = ConstructPoint(A=flip_43, B=loft_216)
cons_230 = ConstructPoint(A=mult_206, B=disp_2)
move_215 = Move(A=rota_229, B=loft_144)
divi_209 = DivideCurve(A=loft_214, B=3.889)
loft_217 = Loft(A=rota_228, B=addi_86)
rang_173 = Range(A=rota_228, B=rang_55)
move_216 = Move(A=move_90, B=move_209)
flip_70 = FlipMatrix(A=cons_7, B=rota_230)
cons_231 = ConstructPoint(A=rota_230, B=rang_36)
addi_202 = Addition(A=5.572, B=loft_214)
cons_232 = ConstructPoint(A=<missing>, B=loft_214)
line_215 = Line(A=loft_217, B=7.341)
addi_203 = Addition(A=cons_169, B=move_214)
cull_75 = CullPattern(A=loft_60, B=rota_229)
rota_233 = Rotate(A=move_169, B=cons_231)
cons_233 = ConstructPoint(A=addi_201, B=seri_156)
line_216 = Line(A=addi_6, B=addi_201)
disp_57 = Dispatch(A=5.598, B=addi_200)
cons_234 = ConstructPoint(A=move_215, B=<missing>)
divi_210 = DivideCurve(A=cons_166, B=loft_215)
rota_234 = Rotate(A=cull_57, B=move_213)  # -> R
# ---------- rota_234: C# ----------
int a = 550;
return a * 2;
# ---------- end rota_234 ----------
addi_204 = Addition(A=line_214, B=seri_10)
disp_58 = Dispatch(A=rota_2, B=rota_229)
move_217 = Move(A=loft_217, B=cons_169)
seri_224 = Series(A=cull_75, B=<missing>)
move_218 = Move(A=<missing>, B=rota_228)
addi_205 = Addition(A=shif_4, B=loft_216)
move_219 = Move(A=rota_230, B=loft_54)
addi_206 = Addition(A=disp_57, B=cons_16)
rota_235 = Rotate(A=seri_200, B=rota_228)
move_220 = Move(A=addi_203, B=addi_142)
loft_218 = Loft(A=4.178, B=move_211)
line_217 = Line(A=move_49, B=move_213)
rota_236 = Rotate(A=line_52, B=disp_58)
addi_207 = Addition(A=flip_70, B=divi_7)
rang_174 = Range(A=move_104, B=loft_214)
rota_237 = Rotate(A=6.831, B=addi_202)
cons_235 = ConstructPoint(A=mult_13, B=move_216)
seri_225 = Series(A=<missing>, B=move_209)  # -> R
# ---------- seri_225: C# ----------
int a = 391;
return a * 2;
# ---------- end seri_225 ----------
addi_208 = Addition(A=<missing>, B=seri_224)
loft_219 = Loft(A=move_211, B=rota_214)
mult_207 = Multiplication(A=disp_31, B=cull_75)
divi_211 = DivideCurve(A=line_216, B=mult_101)
rang_175 = Range(A=flip_2, B=line_216)
loft_220 = Loft(A=rota_8, B=disp_58)
mult_208 = Multiplication(A=<missing>, B=loft_215)
rang_176 = Range(A=cons_18, B=addi_200)
cull_76 = CullPattern(A=rota_230, B=<missing>)
move_221 = Move(A=4.197, B=seri_223)
line_218 = Line(A=rota_228, B=addi)
rota_238 = Rotate(A=rota_233, B=seri_223)
line_219 = Line(A=flip_36, B=cons_233)
move_222 = Move(A=seri_40, B=move_213)
move_223 = Move(A=rang_113, B=rota_233)
rang_177 = Range(A=rota_229, B=rota_12)
cons_236 = ConstructPoint(A=loft_2, B=rota_228)
cons_237 = ConstructPoint(A=seri_6, B=rota_234)
rota_239 = Rotate(A=addi_93, B=disp_56)
rota_240 = Rotate(A=mult_207, B=loft_103)
cons_238 = ConstructPoint(A=7.612, B=addi_204)
line_220 = Line(A=loft_108, B=cons_231)
mult_209 = Multiplication(A=move_213, B=line_171)
divi_212 = DivideCurve(A=addi_93, B=loft_213)
cull_77 = CullPattern(A=loft_219, B=shif_9)
loft_221 = Loft(A=cons_236, B=rota_194)
mult_210 = Multiplication(A=mult_207, B=8.018)
line_221 = Line(A=rang_177, B=seri_117)
mult_211 = Multiplication(A=cons, B=move_216)
shif_65 = ShiftList(A=mult_205, B=loft_10)
mult_212 = Multiplication(A=rota_17, B=addi_201)
divi_213 = DivideCurve(A=cull_77, B=cons_14)
addi_209 = Addition(A=rota_228, B=divi_7)
mult_213 = Multiplication(A=mult_205, B=line_202)
rang_178 = Range(A=loft_4, B=rang_173)
cons_239 = ConstructPoint(A=mult_109, B=cons_237)
rota_241 = Rotate(A=rota_198, B=mult_212)
mult_214 = Multiplication(A=addi_209, B=shif_33)
addi_210 = Addition(A=move_210, B=cons_12)
move_224 = Move(A=move_166, B=addi_204)
seri_226 = Series(A=move_38, B=loft_220)
loft_222 = Loft(A=rota_234, B=mult)
divi_214 = DivideCurve(A=rota_229, B=move_9)
move_225 = Move(A=loft_29, B=rang_176)
line_222 = Line(A=shif_41, B=move_221)
mult_215 = Multiplication(A=rota_240, B=<missing>)
mult_216 = Multiplication(A=seri_3, B=move_221)
line_223 = Line(A=line_221, B=9.192)
cons_240 = ConstructPoint(A=rota_230, B=2.457)
divi_215 = DivideCurve(A=line_222, B=cons_215)
cons_241 = ConstructPoint(A=mult_47, B=rota_228)
divi_216 = DivideCurve(A=line_218, B=move_170)
mult_217 = Multiplication(A=seri_225, B=divi_71)
line_224 = Line(A=rang_104, B=divi_213)
loft_223 = Loft(A=disp_31, B=loft_215)
addi_211 = Addition(A=cons_231, B=6.537)
line_225 = Line(A=3.392, B=mult_217)
loft_224 = Loft(A=line_224, B=mult_160)
seri_227 = Series(A=seri_224, B=addi_133)
rang_179 = Range(A=addi_192, B=rang_174)
cons_242 = ConstructPoint(A=divi_209, B=rang_8)
flip_71 = FlipMatrix(A=rang_177, B=seri_2)
loft_225 = Loft(A=cons_241, B=mult_52)
divi_217 = DivideCurve(A=loft_215, B=divi_4)
divi_218 = DivideCurve(A=seri_223, B=cons_119)
move_226 = Move(A=9.992, B=mult_207)
line_226 = Line(A=loft_61, B=mult_217)
mult_218 = Multiplication(A=loft_3, B=rota_229)
line_227 = Line(A=addi_201, B=<missing>)
loft_226 = Loft(A=divi_214, B=rota_114)
seri_228 = Series(A=move_218, B=disp_58)
move_227 = Move(A=flip_71, B=0.064)
cons_243 = ConstructPoint(A=line_225, B=cons_172)
divi_219 = DivideCurve(A=seri_120, B=loft_224)
flip_72 = FlipMatrix(A=rota_229, B=divi_53)
shif_66 = ShiftList(A=cluster1408, B=move_211)
seri_229 = Series(A=rota_238, B=rota_102)
shif_67 = ShiftList(A=rota_234, B=<missing>)
seri_230 = Series(A=line_28, B=seri_224)
disp_59 = Dispatch(A=divi_11, B=rota_229)
line_228 = Line(A=addi_35, B=move_213)
seri_231 = Series(A=seri_174, B=line_228)
seri_232 = Series(A=seri_231, B=<missing>)
cons_244 = ConstructPoint(A=loft_223, B=0.48)
seri_233 = Series(A=6.624, B=disp_58)
shif_68 = ShiftList(A=move_225, B=cons_20)
cons_245 = ConstructPoint(A=rota_235, B=addi_91)
loft_227 = Loft(A=loft_215, B=line_112)
cull_78 = CullPattern(A=rota_230, B=addi_16)
loft_228 = Loft(A=addi_211, B=shif_53)
loft_229 = Loft(A=<missing>, B=loft_225)
move_228 = Move(A=rota_111, B=loft_215)
rang_180 = Range(A=loft_15, B=cons_232)
divi_220 = DivideCurve(A=seri_228, B=rota_156)
line_229 = Line(A=loft_206, B=cull_76)
rota_242 = Rotate(A=move_209, B=disp_3)
rota_243 = Rotate(A=mult_212, B=mult_119)
rota_244 = Rotate(A=divi_38, B=mult_205)
addi_212 = Addition(A=cons_231, B=rang_20)
shif_69 = ShiftList(A=divi_27, B=rota_234)
disp_60 = Dispatch(A=seri_224, B=rota_33)
addi_213 = Addition(A=mult_24, B=rota_233)
cons_246 = ConstructPoint(A=move_215, B=rang_176)
rota_245 = Rotate(A=8.12, B=mult_213)
rota_246 = Rotate(A=rang_176, B=line_37)
mult_219 = Multiplication(A=move_215, B=6.281)
loft_230 = Loft(A=flip_59, B=line_214)
rang_181 = Range(A=move_104, B=seri_225)
seri_234 = Series(A=move_43, B=loft_223)
addi_214 = Addition(A=<missing>, B=addi_208)
cons_247 = ConstructPoint(A=mult_213, B=6.817)
loft_231 = Loft(A=4.652, B=rota_228)
move_229 = Move(A=line_214, B=1.092)
addi_215 = Addition(A=rota_243, B=addi_48)
rota_247 = Rotate(A=rang_176, B=divi_152)
line_230 = Line(A=disp_59, B=<missing>)
divi_221 = DivideCurve(A=5.632, B=loft_229)
move_230 = Move(A=disp_59, B=loft_33)
loft_232 = Loft(A=seri_126, B=rota_243)
loft_233 = Loft(A=divi_213, B=mult_54)
rang_182 = Range(A=<missing>, B=move_227)
loft_234 = Loft(A=disp_59, B=shif_62)
line_231 = Line(A=7.314, B=mult_212)
seri_235 = Series(A=rang_177, B=seri_117)
cons_248 = ConstructPoint(A=addi_35, B=seri_224)
rota_248 = Rotate(A=cull_75, B=4.84)
mult_220 = Multiplication(A=loft_216, B=9.979)
loft_235 = Loft(A=line_218, B=mult_146)
cull_79 = CullPattern(A=line_227, B=1.845)
mult_221 = Multiplication(A=rota_61, B=line_216)
addi_216 = Addition(A=line_224, B=seri_43)
rota_249 = Rotate(A=seri_126, B=rota_245)
disp_61 = Dispatch(A=rota_194, B=addi_200)
cons_249 = ConstructPoint(A=mult_216, B=rang)
mult_222 = Multiplication(A=addi_88, B=loft_223)
seri_236 = Series(A=line_218, B=move_190)
line_232 = Line(A=cull_7, B=addi_208)
move_231 = Move(A=cull_9, B=loft_234)
divi_222 = DivideCurve(A=rang_179, B=cull_29)
loft_236 = Loft(A=move_30, B=rota_242)
move_232 = Move(A=loft_236, B=line_171)
addi_217 = Addition(A=move_232, B=1.496)
rang_183 = Range(A=addi_201, B=3.9)
line_233 = Line(A=divi_121, B=rota_241)
rang_184 = Range(A=<missing>, B=seri_230)
loft_237 = Loft(A=move_192, B=rota_245)
cull_80 = CullPattern(A=rota_244, B=4.468)
mult_223 = Multiplication(A=addi_200, B=seri_63)
cons_250 = ConstructPoint(A=rota_242, B=8.424)
disp_62 = Dispatch(A=1.157, B=seri_223)
seri_237 = Series(A=divi_217, B=loft_9)
addi_218 = Addition(A=loft_208, B=addi_210)
shif_70 = ShiftList(A=cons_41, B=shif_69)
mult_224 = Multiplication(A=seri_223, B=loft_56)  # -> R
# ---------- mult_224: C# ----------
int a = 1769;
return a * 2;
# ---------- end mult_224 ----------
line_234 = Line(A=addi_105, B=loft_222)
loft_238 = Loft(A=divi_218, B=3.008)
line_235 = Line(A=line_225, B=addi_10)
addi_219 = Addition(A=cons_113, B=rota_229)
divi_223 = DivideCurve(A=rang_177, B=cull)
move_233 = Move(A=rang_176, B=cluster438)
shif_71 = ShiftList(A=line_218, B=<missing>)
seri_238 = Series(A=divi_214, B=move_229)
line_236 = Line(A=cons_231, B=loft_113)
loft_239 = Loft(A=rota_56, B=cons_239)
addi_220 = Addition(A=disp_61, B=7.583)
loft_240 = Loft(A=mult_205, B=7.673)
mult_225 = Multiplication(A=seri_179, B=shif_69)
loft_241 = Loft(A=divi_32, B=move_214)
divi_224 = DivideCurve(A=1.001, B=shif_70)
rota_250 = Rotate(A=mult_220, B=rota_64)
seri_239 = Series(A=seri_58, B=line_228)
addi_221 = Addition(A=addi_200, B=<missing>)
move_234 = Move(A=<missing>, B=cons_237)
addi_222 = Addition(A=rota_234, B=loft_128)
cons_251 = ConstructPoint(A=move_228, B=<missing>)
move_235 = Move(A=divi_216, B=addi_204)
rota_251 = Rotate(A=disp_62, B=divi_168)
divi_225 = DivideCurve(A=addi_12, B=addi_209)
loft_242 = Loft(A=loft_240, B=rota_230)
cons_252 = ConstructPoint(A=rota_175, B=loft_224)
mult_226 = Multiplication(A=seri_75, B=shif_71)
move_236 = Move(A=rota_233, B=addi_37)
cons_253 = ConstructPoint(A=flip_71, B=addi_219)
flip_73 = FlipMatrix(A=loft_26, B=shif_69)
seri_240 = Series(A=flip_66, B=addi_213)
rota_252 = Rotate(A=line_108, B=line_227)
loft_243 = Loft(A=<missing>, B=addi_209)
rota_253 = Rotate(A=disp_19, B=move_235)
divi_226 = DivideCurve(A=0.068, B=seri_234)
mult_227 = Multiplication(A=cons_35, B=loft_233)
addi_223 = Addition(A=shif_71, B=rang_156)
cons_254 = ConstructPoint(A=addi_188, B=move_212)
move_237 = Move(A=mult_207, B=flip_40)
cull_81 = CullPattern(A=shif_41, B=addi_208)
flip_74 = FlipMatrix(A=cons_231, B=cons_63)
cons_255 = ConstructPoint(A=cons_233, B=shif_31)
cons_256 = ConstructPoint(A=move_86, B=flip_72)
move_238 = Move(A=<missing>, B=rota_233)
mult_228 = Multiplication(A=3.83, B=cons_253)
move_239 = Move(A=addi_215, B=cons_208)
mult_229 = Multiplication(A=cons_31, B=cons_249)
cons_257 = ConstructPoint(A=seri_225, B=divi_75)
seri_241 = Series(A=seri_223, B=6.504)
loft_244 = Loft(A=addi_213, B=4.089)
line_237 = Line(A=cons_231, B=move_196)
loft_245 = Loft(A=move_209, B=cons_82)
line_238 = Line(A=line_81, B=divi_4)
rota_254 = Rotate(A=<missing>, B=rota_28)
disp_63 = Dispatch(A=loft_21, B=1.391)
loft_246 = Loft(A=1.028, B=0.616)
line_239 = Line(A=mult_52, B=cons_136)
disp_64 = Dispatch(A=line_61, B=line_101)
cons_258 = ConstructPoint(A=line_76, B=disp_14)
rang_185 = Range(A=mult_70, B=cons_138)
line_240 = Line(A=cluster535, B=cull_10)
cull_82 = CullPattern(A=divi_59, B=cull_2)
rang_186 = Range(A=loft_49, B=<missing>)
seri_242 = Series(A=loft_234, B=line_64)
cull_83 = CullPattern(A=move_42, B=<missing>)
cons_259 = ConstructPoint(A=<missing>, B=rota_48)
cons_260 = ConstructPoint(A=divi_114, B=disp_14)
cons_261 = ConstructPoint(A=9.65, B=line_93)
cull_84 = CullPattern(A=rang_96, B=divi_79)
loft_247 = Loft(A=cons_226, B=rota_33)
rota_255 = Rotate(A=rota_155, B=3.665)  # -> R
# ---------- rota_255: C# ----------
int a = 1133;
return a * 2;
# ---------- end rota_255 ----------
rota_256 = Rotate(A=loft_30, B=6.203)
loft_248 = Loft(A=divi_36, B=divi_155)
rota_257 = Rotate(A=mult_170, B=cons_227)
disp_65 = Dispatch(A=cons_45, B=seri_119)
cons_262 = ConstructPoint(A=mult_137, B=<missing>)
line_241 = Line(A=seri_208, B=3.177)
loft_249 = Loft(A=addi_98, B=loft_21)
rota_258 = Rotate(A=rota_12, B=loft_182)
loft_250 = Loft(A=disp_22, B=move_93)
line_242 = Line(A=cons_149, B=line_214)
addi_224 = Addition(A=divi_45, B=<missing>)
line_243 = Line(A=line_103, B=cull_34)
rang_187 = Range(A=3.746, B=disp_53)
rota_259 = Rotate(A=seri_68, B=cons_123)
cons_263 = ConstructPoint(A=addi_85, B=move_140)
move_240 = Move(A=0.072, B=cons_139)
rang_188 = Range(A=loft_51, B=seri_46)
line_244 = Line(A=flip_52, B=divi_6)
addi_225 = Addition(A=4.227, B=move_8)
cull_85 = CullPattern(A=mult_199, B=move_10)
move_241 = Move(A=addi_82, B=mult_47)
shif_72 = ShiftList(A=cons_88, B=addi_79)
move_242 = Move(A=mult_173, B=rota_247)
seri_243 = Series(A=loft_168, B=3.731)
loft_251 = Loft(A=<missing>, B=move_113)
seri_244 = Series(A=loft_147, B=addi_192)
shif_73 = ShiftList(A=2.062, B=line_118)
loft_252 = Loft(A=move_239, B=move_80)
cull_86 = CullPattern(A=cons_195, B=cull)
loft_253 = Loft(A=loft_243, B=addi_152)
divi_227 = DivideCurve(A=loft_232, B=<missing>)
rota_260 = Rotate(A=rota_11, B=addi_127)
line_245 = Line(A=<missing>, B=move_118)
