# Grasshopper definition DataDrop 16.gh (Grasshopper 1.0.7)
# plug-ins: Speckle 2, Pufferfish, ClipperComponents, LunchBox, LCRL.Grasshopper, Human, eleFront, Mensa, Sandbox Topology, Heteroptera, NGon, MetaHopper

# Key
# Inputs
# Outputs
# Bake Items
# Parameters
c_script = CSharpScript()
# ---------- c_script: C# ----------
    doc.AdjustModelUnitSystem(UnitSystem.Meters, false);
# ---------- end c_script ----------

panel = Panel("https://app.speckle.systems/projects/fa2b5c68c0/models/1a387dc852")
receive = Receive(
    Stream=panel,
    AutoReceive=False,
    CurrentComponentState="up_to_date",
    ExpandOutput=True,
    LastInfoMessage="Lasath Siriwardena @ 06/10/2024 15:38:48: [Rev 7] Updated according to DD15+ IBB T130V01 (id:ceb9de41df)",
    ReceiveOnOpen=True,
    ReceivedCommitId="ceb9de41df",
    StreamWrapper="https://app.speckle.systems/projects/fa2b5c68c0/models/01-design/1-base_surface",
    selectedKitName="Objects")  # -> Info, Data
dso = DeconstructSpeckleObject(SpeckleObject=receive.Data, selectedKitName="Objects")  # -> Base_Surfaces, Brims, ChangeLog, Columns, Facade, Grid, Parent, Skylight_Shell

# ----
# Speckle
number_slider = Slider(0, range=0..100)
number_slider_2 = Slider(8, range=0..10)
merge = Merge(Data1=number_slider, Data2=number_slider_2)
data = Data("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")  # disabled
brim_branches = Panel("{0,8;*}")
concat = Concatenate(FragmentA="{", FragmentB=number_slider, FragmentC=",", FragmentD=number_slider_2, FragmentE=";", FragmentF="*}")

dso_2 = DeconstructSpeckleObject(SpeckleObject=receive.Data, selectedKitName="Objects")  # -> Base_Surfaces, Brims, ChangeLog, Columns, Facade, Grid, Parent, Skylight_Shell
dso_3 = DeconstructSpeckleObject(SpeckleObject=dso.Facade, selectedKitName="Objects")  # -> IFC, Mesh, Outline

deserialize = Deserialize(Json=data)  # disabled
dso_4 = DeconstructSpeckleObject(SpeckleObject=dso.Facade, selectedKitName="Objects")  # -> IFC, Mesh, Outline

flatten = FlattenTree(Tree=dso.Base_Surfaces, Path="{0}")  # disabled
c_script_2 = CSharpScript(x=simplify(graft(flatten)), y=flatten(dso.Brims))  # -> out, A; inputs x: tree, y: list; disabled
# ---------- c_script_2: C# ----------
    DataTree<object> tree = x;
    foreach (var item in y)
    {
      int len = tree.BranchCount;
      tree.Add(item, new GH_Path(len));
    }
    A = tree;
# ---------- end c_script_2 ----------

geo = Geometry(dso_4.Outline)

receive_2 = Receive(
    Stream="https://speckle.xyz/projects/fa2b5c68c0/models/6f0c5e029f",
    AutoReceive=False,
    CurrentComponentState="up_to_date",
    ExpandOutput=True,
    LastInfoMessage="Lasath Siriwardena @ 08/06/2024 09:01:54: Updated Data from Felix - 240712_250_cassettes.3dm (id:ac9615ec9e)",
    ReceiveOnOpen=True,
    ReceivedCommitId="ac9615ec9e",
    StreamWrapper="https://speckle.xyz/projects/fa2b5c68c0/models/03-fabrication/02-outsourcing",
    selectedKitName="Objects")  # -> Info, Data
dso_5 = DeconstructSpeckleObject(SpeckleObject=receive_2.Data, selectedKitName="Objects")  # -> Geometry, GH_Path, IsOutsourced, Type

panel_2 = Panel("https://app.speckle.systems/projects/fa2b5c68c0/models/a8081a08c3")
receive_3 = Receive(
    Stream=panel_2,
    AutoReceive=False,
    CurrentComponentState="up_to_date",
    ExpandOutput=True,
    LastInfoMessage="Lasath Siriwardena @ 06/14/2025 14:28:20: DD16 WIP - Fixed DataTree of Edges (id:364fae2aff)",
    ReceiveOnOpen=True,
    ReceivedCommitId="364fae2aff",
    StreamWrapper="https://app.speckle.systems/projects/fa2b5c68c0/models/10-structural/04-connections",
    selectedKitName="Objects")  # -> Info, Data
dso_6 = DeconstructSpeckleObject(SpeckleObject=receive_3.Data, selectedKitName="Objects")  # -> Parent, Roof
dso_7 = DeconstructSpeckleObject(SpeckleObject=dso_6.Roof, selectedKitName="Objects")  # -> BeamWidthsSegmentDT, BottomPlateKerto, CrossScrewSpecialCase5d, FingerJointEdgeType, FingerJointEdges, ScrewsEdgeDT
dso_8 = DeconstructSpeckleObject(SpeckleObject=dso_7.BottomPlateKerto, selectedKitName="Objects")  # -> GH_Path, IsBottmPlateKerto, Paths

panel_3 = Panel("https://app.speckle.systems/projects/fa2b5c68c0/models/afb4a95b2b")
receive_4 = Receive(
    Stream=panel_3,
    AutoReceive=False,
    CurrentComponentState="up_to_date",
    ExpandOutput=True,
    LastInfoMessage="Lasath Siriwardena @ 07/28/2025 12:27:22: Fixed Missing Fabrication Data (id:ecb96cefa4)",
    ReceiveOnOpen=True,
    ReceivedCommitId="ecb96cefa4",
    StreamWrapper="https://app.speckle.systems/projects/fa2b5c68c0/models/04-onsite/01-pockets",
    selectedKitName="Objects")  # -> Info, Data
dso_9 = DeconstructSpeckleObject(SpeckleObject=receive_4.Data, selectedKitName="Objects")  # -> FabricationData, Geometry, GH_Path

receive_5 = Receive(
    Stream="https://speckle.xyz/projects/fa2b5c68c0/models/bdd416d68b",
    AutoReceive=False,
    CurrentComponentState="up_to_date",
    ExpandOutput=True,
    LastInfoMessage="Lasath Siriwardena @ 10/18/2024 15:11:36: LPH5 Update Screw Pairs DD15+++ (id:206591aa4c)",
    ReceiveOnOpen=True,
    ReceivedCommitId="206591aa4c",
    StreamWrapper="https://speckle.xyz/projects/fa2b5c68c0/models/10-structural/02-development",
    selectedKitName="Objects")  # -> Info, Data

dso_10 = DeconstructSpeckleObject(SpeckleObject=receive_5.Data, selectedKitName="Objects")  # -> Parent, Roof
panel_4 = Panel(receive_5.Info)
dso_11 = DeconstructSpeckleObject(SpeckleObject=dso_10.Roof, selectedKitName="Objects")  # -> BeamWidths, BeamPoints, BottomHoleAdjusted, GH_Path
cluster = Cluster_6(D_2=dso_11.BeamWidths, D=dso_11.GH_Path)
cluster_2 = Cluster_6(D_2=dso_11.BeamPoints, D=dso_11.GH_Path)
cluster_3 = Cluster_6(D_2=dso_11.BottomHoleAdjusted, D=dso_11.GH_Path)
clean = CleanTree(RemoveNulls=True, RemoveInvalid=True, RemoveEmpty=True, Tree=cluster)  # -> simplify(Tree)

panel_5 = Panel(dso_5.IsOutsourced)
tree = CreateTree(Data=dso_9.Geometry, Path=dso_9.GH_Path)
tree_2 = CreateTree(Data=dso_9.FabricationData, Path=dso_9.GH_Path)

area = Area(Geometry=tree)  # -> Area, Centroid
cullpt = CullDuplicates(Points=area.Centroid, Tolerance=0.0001, CullMode=1)  # -> Points, Indices, Valence
item = ListItem(List=tree, Index=cullpt.Indices, Wrap=True)

panel_6 = Panel("https://app.speckle.systems/projects/fa2b5c68c0/models/bec8474d8d")
receive_6 = Receive(
    Stream=panel_6,
    AutoReceive=False,
    CurrentComponentState="up_to_date",
    ExpandOutput=True,
    LastInfoMessage="Tobias Schwinn @ 06/10/2024 08:24:32: Add missing cutouts at brim column heads (id:f56576bac1)",
    ReceiveOnOpen=True,
    ReceivedCommitId="f56576bac1",
    StreamWrapper="https://app.speckle.systems/projects/fa2b5c68c0/models/12-fhz",
    selectedKitName="Objects")  # -> Info, Data
panel_7 = Panel(receive_6.Info)
dso_12 = DeconstructSpeckleObject(SpeckleObject=receive_6.Data, selectedKitName="Objects")  # -> Brim_cutout, Downpipes, Elevator_vent, Pin_cutout, Pipes, PVDucts, Ventilation_duct

beam_tolerance = Slider(0.01, range=0..1)
acoustic_offset = Slider(0.03, range=0..1)
tstat = TreeStatistics(Tree=item)  # -> Paths, Length, Count

geo_2 = Geometry(cluster_3)
edges = BrepEdges(Brep=geo_2)  # -> Naked, Interior, NonManifold
join = JoinCurves(Curves=edges.Naked, Preserve=False)  # -> simplify(Curves)
len = Length(Curve=join)
sort = SortList(Keys=len, ValuesA=join)  # -> Keys, ValuesA
c_script_3 = CSharpScript(x=sort.ValuesA)  # -> out, A; inputs x: list
# ---------- c_script_3: C# ----------
    if(x.Count == 2)
      A = x;
# ---------- end c_script_3 ----------
clean_2 = CleanTree(RemoveNulls=True, RemoveInvalid=True, RemoveEmpty=True, Tree=c_script_3.A)  # -> simplify(Tree)
item_2 = ListItem(List=clean_2, Index=0, Wrap=True)  # -> Item, Item1
c_script_4 = CSharpScript(x=sort.ValuesA)  # -> out, A; inputs x: list
# ---------- c_script_4: C# ----------
    if(x.Count == 2)
      A = x[0];
# ---------- end c_script_4 ----------
crvprox = CurveProximity(CurveA=item_2.Item, CurveB=item_2.Item1)  # -> PointA, PointB, Distance

swatch = ColourSwatch(SwatchColor=RGB(250, 0, 0))  # disabled
swatch_2 = ColourSwatch(SwatchColor=RGB(0, 0, 0))  # disabled
swatch_3 = ColourSwatch(SwatchColor=RGB(250, 0, 0))  # disabled
swatch_4 = ColourSwatch(SwatchColor=RGB(0, 0, 0))  # disabled
number_slider_3 = Slider(2, range=0..10)  # disabled
panel_8 = Panel("*")  # disabled
concat_2 = Concatenate(FragmentA="{", FragmentB=number_slider_3, FragmentE=";", FragmentC=panel_8, FragmentD="}")  # disabled
swatch_5 = ColourSwatch(SwatchColor=RGB(250, 0, 0))  # disabled
swatch_6 = ColourSwatch(SwatchColor=RGB(0, 0, 0))  # disabled
data_2 = Data(dso_8.Paths)

panel_9 = Panel("""{3;48}
{3;155}
{5;48}
{5;155}
{6;51}
{6;64}""")

panel_10 = Panel("""{1;49}
{1;86}
{3;50}
{3;153}
{5;50}
{5;153}
{7;49}
{7;86}""")

panel_11 = Panel("""{1;62}
{2;42}
{2;61}
{2;74}
{2;75}
{2;84}
{2;103}
{3;73}
{3;83}
{3;120}
{3;130}
{4;42}
{4;61}
{4;74}
{4;75}
{4;84}
{4;103}
{5;73}
{5;83}
{5;120}
{5;130}
{6;94}
{7;62}""")

panel_12 = Panel("https://app.speckle.systems/projects/fa2b5c68c0/models/8b61bd92e6")
receive_7 = Receive(
    Stream=panel_12,
    AutoReceive=False,
    CurrentComponentState="up_to_date",
    ExpandOutput=True,
    LastInfoMessage="Lasath Siriwardena @ 07/21/2025 09:53:38: Updated T612 Column Head to match 250627 Update (id:70cae0025d)",
    ReceiveOnOpen=False,
    ReceivedCommitId="70cae0025d",
    StreamWrapper="https://app.speckle.systems/projects/fa2b5c68c0/models/01-design/6-steel",
    selectedKitName="Objects")  # -> Info, Data
panel_13 = Panel(receive_7.Info)
dso_13 = DeconstructSpeckleObject(SpeckleObject=receive_7.Data, selectedKitName="Objects")  # -> Field, Ridge, UPE
dso_14 = DeconstructSpeckleObject(SpeckleObject=dso_13.Ridge, selectedKitName="Objects")  # -> Brim_column_heads, Brim_column_profile, Column_heads, Dowel_plug, Flanschbleche, Ridge_bolts, Ridge_fin_column, Ridge_fins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
dso_15 = DeconstructSpeckleObject(SpeckleObject=dso_14.Column_heads, selectedKitName="Objects")  # -> Crown_bolts, Crown_plates, Crown_plates_path, Dowel_plug, Head_plates, Konstruktionsbolzen, Stahl_duebel, Stiffeners, Wood_screw_column_head

panel_14 = Panel("https://app.speckle.systems/projects/fa2b5c68c0/models/a207298a91")
receive_8 = Receive(
    Stream=panel_14,
    AutoReceive=False,
    CurrentComponentState="up_to_date",
    ExpandOutput=True,
    LastInfoMessage="Lasath Siriwardena @ 07/21/2025 10:49:39: LPH5 Rev 7 - DD 16 - Updated Column T612 250627 (id:ebcb749f35)",
    ReceiveOnOpen=False,
    ReceivedCommitId="ebcb749f35",
    StreamWrapper="https://app.speckle.systems/projects/fa2b5c68c0/models/02-development/5-solid_steel",
    selectedKitName="Objects")  # -> Info, Data
dso_16 = DeconstructSpeckleObject(SpeckleObject=receive_8.Data, selectedKitName="Objects")  # -> Parent, ReleaseNotes, Solids
dso_17 = DeconstructSpeckleObject(SpeckleObject=dso_16.Solids, selectedKitName="Objects")  # -> Field, Ridge, UPE
dso_18 = DeconstructSpeckleObject(SpeckleObject=dso_17.Ridge, selectedKitName="Objects")  # -> Column_heads, Column_heads_brim, Dowel_plugs, Flanschblech, Flanschblech_solidOperator, Ridge_plates, Tension_elements, Winkelverbinder
dso_19 = DeconstructSpeckleObject(SpeckleObject=dso_18.Column_heads, selectedKitName="Objects")  # -> Bolt_centerlines, Bolts, Crown_plates, Dowel_plugs, Head_plates, Stiffener_centerlines, Stiffener_solidOperator, Stiffeners

panel_15 = Panel(receive_8.Info)

dso_20 = DeconstructSpeckleObject(SpeckleObject=dso_17.Field, selectedKitName="Objects")  # -> Bolt, Column_heads, GH_Path, Top_plate
dso_21 = DeconstructSpeckleObject(SpeckleObject=dso_19.Crown_plates, selectedKitName="Objects")  # -> Geometry, JSON, PreCut
dso_22 = DeconstructSpeckleObject(SpeckleObject=dso_20.Column_heads, selectedKitName="Objects")  # -> Geometry, JSON
dso_23 = DeconstructSpeckleObject(SpeckleObject=dso_20.Top_plate, selectedKitName="Objects")  # -> Geometry, JSON; disabled
dso_24 = DeconstructSpeckleObject(SpeckleObject=dso_18.Winkelverbinder, selectedKitName="Objects")  # -> Geometry, GeometryJSON, PreCut, Screws; disabled
dso_25 = DeconstructSpeckleObject(SpeckleObject=dso_18.Ridge_plates, selectedKitName="Objects")  # -> Geometry, JSON, PreCut
c_script_5 = CSharpScript(x=dso_23.JSON)  # -> out, A; inputs x: String; disabled
# ---------- c_script_5: C# ----------
    A = Brep.FromJSON(x);
# ---------- end c_script_5 ----------
c_script_6 = CSharpScript(x=dso_21.JSON)  # -> out, A; inputs x: String; disabled; same code as c_script_5
c_script_7 = CSharpScript(x=dso_25.JSON)  # -> out, A; inputs x: String; disabled; same code as c_script_5
c_script_8 = CSharpScript(x=dso_24.GeometryJSON)  # -> out, A; inputs x: String; disabled
# ---------- c_script_8: C# ----------
    if(x!=null) A = Brep.FromJSON(x);
# ---------- end c_script_8 ----------

addtop_and_bottom_tol = BooleanToggle(False)
tension_band_bottom_cut = Slider(0.02, range=0..1)
tension_band_top_and_bttom_tolerance = Slider(0.05, range=0..1)
fin_tolerance = Slider(0.01, range=0..0.01)

geo_3 = Geometry(dso_22.Geometry)
geo_4 = Geometry([c_script_5.A, dso_22.Geometry])
geo_5 = Geometry(dso_24.PreCut)
geo_6 = Geometry(dso_19.Head_plates)
geo_7 = Geometry(dso_18.Column_heads_brim)
geo_8 = Geometry(dso_18.Flanschblech)
geo_9 = Geometry(dso_21.PreCut)
geo_10 = Geometry(c_script_7.A)
geo_11 = Geometry(dso_19.Stiffeners)
geo_12 = Geometry(dso_18.Tension_elements)

geo_13 = Geometry(dso_25.PreCut)

dso_26 = DeconstructSpeckleObject(SpeckleObject=dso_14.Ridge_fins, selectedKitName="Objects")  # -> Ridge_fins, Thickness
tree_3 = CreateTree(Data=flatten(dso_26.Ridge_fins), Path=flatten(dso_14.Ridge_fins_path))
join_2 = BrepJoin(Breps=tree_3)  # -> Breps, Closed
fmerge = MergeFaces(Brep=join_2.Breps)  # -> Breps, Before, After

item_3 = ListItem(List=flatten(dso_26.Thickness), Index=0, Wrap=True)

dso_27 = DeconstructSpeckleObject(SpeckleObject=dso_14.Tension_elements, selectedKitName="Objects")  # -> Tension_elements, Thickness
trim = TrimTree(Tree=simplify(dso_27.Tension_elements), Depth=1)
join_3 = BrepJoin(Breps=trim)  # -> Breps, Closed
trim_2 = TrimTree(Tree=simplify(dso_27.Thickness), Depth=1)
fmerge_2 = MergeFaces(Brep=join_3.Breps)  # -> Breps, Before, After

division = Division(A=item_3, B=1000)
fin_thickness = Slider(0.01, range=0..0.02)
panel_16 = Panel(division)
dso_28 = DeconstructSpeckleObject(SpeckleObject=dso_15.Crown_plates, selectedKitName="Objects")  # -> Column_crowns, Precut_outlines, Thickness
item_4 = ListItem(List=flatten(dso_28.Thickness), Index=0, Wrap=True)
division_2 = Division(A=item_4, B=1000)
panel_17 = Panel(division_2)

division_3 = Division(A=trim_2, B=2000)
item_5 = ListItem(List=division_3, Index=0, Wrap=True)
neg = Negative(Value=item_5)

boundary = BoundarySurfaces(Edges=dso_28.Precut_outlines)
merge_2 = Merge(Data1=boundary, Data2=dso_15.Head_plates, Data3=dso_15.Stiffeners)

preview = CustomPreview(Geometry=merge_2, Material=ColourSwatch(SwatchColor=RGBA(255, 0, 149, 66)))  # disabled

panel_18 = Panel(merge_2)
dso_29 = DeconstructSpeckleObject(SpeckleObject=dso_15.Head_plates, selectedKitName="Objects")  # -> Drill_holes, Head_plates, Thickness

dso_30 = DeconstructSpeckleObject(SpeckleObject=dso_2.Columns, selectedKitName="Objects")  # -> Centerlines, Profile, Type
tree_4 = CreateTree(Data=flatten(boundary), Path=flatten(dso_15.Crown_plates_path))
pt = Point(Point(0, 0, -10))
geo_14 = Geometry(fmerge.Breps)

# ----
# Head Plate Solid Operator
geo_15 = Geometry(dso_29.Head_plates)
trim_3 = TrimTree(Tree=simplify(geo_15), Depth=1)
split = SplitTree(Data=trim_3, Masks=flatten("{1}"))  # -> Positive, Negative
explode = Explode(Curve=split.Positive, Recursive=True)  # -> Segments, Vertices
len_2 = Length(Curve=explode.Segments)
sort_2 = SortList(Keys=len_2)  # -> reverse(Keys), ValuesA
item_6 = ListItem(List=flatten(sort_2.Keys), Index=0, Wrap=True)  # -> Item, Item1
dso_31 = DeconstructSpeckleObject(SpeckleObject=dso_15.Head_plates, selectedKitName="Objects")  # -> Drill_holes, Head_plates, Thickness
neg_2 = Negative(Value=item_6.Item)
merge_3 = Merge(Data1=item_6.Item, Data2=neg_2)
Y = UnitY(Factor=merge_3)
move = Move(Geometry=split.Positive, Motion=Y)  # -> Geometry, Transform
geo_16 = Geometry(dso_31.Head_plates)
area_2 = Area(Geometry=move.Geometry)  # -> Area, Centroid
area_3 = Area(Geometry=flatten(geo_16))  # -> Area, Centroid
pln = Plane(move.Geometry)
item_7 = ListItem(List=pln, Index=0, Wrap=True)
cp = ClosestPoint(Point=area_2.Centroid, Cloud=flatten(area_3.Centroid))  # -> ClosestPoint, CPIndex, Distance
item_8 = ListItem(List=flatten(geo_16), Index=cp.CPIndex, Wrap=True)
merge_4 = Merge(Data1=simplify(graft(item_8)), Data2=simplify(graft(move.Geometry)))
brec = BoundingRectangle(Geometry=merge_4, Plane=graft(pln), Axis=0, Slide=0, Union=True)  # -> flatten(Bounding), DimensionX, DimensionY
head_plate_tolerance = Slider(0.015, range=0..1)
area_4 = Area(Geometry=brec.Bounding)  # -> Area, Centroid
scale_nu = ScaleNU(Geometry=brec.Bounding, Plane=area_4.Centroid, ScaleX=Slider(800, range=0..1000), ScaleY=1, ScaleZ=1)  # -> Geometry, Transform
disc = Discontinuity(Curve=scale_nu.Geometry, Level=1)  # -> Points, Parameters
panel_19 = Panel("""0
-1""")
sort_pt = SortPoints(Points=disc.Points)  # -> Points, Indices
item_9 = ListItem(List=sort_pt.Points, Index=graft(panel_19), Wrap=True)
scale_nu_2 = ScaleNU(Geometry=scale_nu.Geometry, Plane=flatten(item_9), ScaleX=1, ScaleY=Slider(10, range=0..1000), ScaleZ=1)  # -> Geometry, Transform
Z = UnitZ(Factor=head_plate_tolerance)
move_2 = Move(Geometry=scale_nu_2.Geometry, Motion=Z)  # -> Geometry, Transform
Z_2 = UnitZ(Factor=-5)
boundary_2 = BoundarySurfaces(Edges=move_2.Geometry)
extr = Extrude(Base=boundary_2, Direction=Z_2)  # -> flatten(Extrusion)

offsrf = OffsetSurface(Surface=fmerge_2.Breps, Distance=item_5, BothSides=neg, CreateSolid=True)
area_5 = Area(Geometry=offsrf)  # -> Area, Centroid
item_10 = ListItem(List=flatten(area_5.Centroid), Index=0, Wrap=True)
xy = XYPlane(Origin=item_10)
pdecon = Deconstruct(Point=item_10)  # -> XComponent, YComponent, ZComponent

geo_17 = Geometry(fmerge_2.Breps)
disc_2 = Discontinuity(Curve=geo_17, Level=1)  # -> Points, Parameters
sort_pt_2 = SortPoints(Points=disc_2.Points)  # -> Points, Indices
item_11 = ListItem(List=reverse(sort_pt_2.Points), Index=0, Wrap=True)
scale_nu_3 = ScaleNU(Geometry=geo_17, Plane=item_11, ScaleX=1, ScaleY=1, ScaleZ=expr("3", 1))  # -> Geometry, Transform

extension_out = Slider(0.18, range=0..1)
end_height = Slider(0.06, range=0..0.1)

# ----
# West Column Plate
dso_32 = DeconstructSpeckleObject(SpeckleObject=flatten(dso_14.Ridge_fin_column), selectedKitName="Objects")  # -> flatten(Ridge_fins), flatten(Thickness)
pln_2 = Plane(dso_32.Ridge_fins)
scale_nu_4 = ScaleNU(Geometry=dso_32.Ridge_fins, Plane=pln_2, ScaleX=2, ScaleY=1, ScaleZ=1)  # -> Geometry, Transform
division_4 = Division(A=dso_32.Thickness, B=2000)
offsrf_2 = OffsetSurface(Surface=scale_nu_4.Geometry, Distance=division_4, BothSides=expr("-x", division_4), CreateSolid=True)
geo_18 = Geometry(offsrf_2)

dso_33 = DeconstructSpeckleObject(SpeckleObject=dso_15.Stiffeners, selectedKitName="Objects")  # -> Surfaces, Thickness
xz = XZPlane(Origin=Point(0, 0, 0))

crv = Curve(geo_14)
area_6 = Area(Geometry=geo_14)  # -> Area, Centroid
disc_3 = Discontinuity(Curve=crv, Level=1)  # -> Points, Parameters
plfit = PlaneFit(Points=disc_3.Points)  # -> Plane, Deviation
pl_origin = PlaneOrigin(Base=plfit.Plane, Origin=area_6.Centroid)

item_12 = ListItem(List=geo_14, Index=0, Wrap=True)
merge_5 = Merge(Data1=simplify(tree_4), Data2=simplify(item_12))
brec_2 = BoundingRectangle(Geometry=flatten(merge_5), Plane=PlaneXY(0, 0, 0), Axis=0, Slide=0, Union=True)  # -> Bounding, DimensionX, DimensionY

pdecon_2 = Deconstruct(Point=disc_2.Points)  # -> XComponent, YComponent, ZComponent
sort_3 = SortList(Keys=pdecon_2.ZComponent, ValuesA=disc_2.Points)  # -> Keys, ValuesA
item_13 = ListItem(List=reverse(sort_3.ValuesA), Index=[0, 1], Wrap=True)
avr = Average(Input=item_13)

brec_3 = BoundingRectangle(Geometry=dso_33.Surfaces, Plane=xz, Axis=0, Slide=0, Union=True)  # -> Bounding, DimensionX, DimensionY

explode_2 = Explode(Curve=crv, Recursive=True)  # -> Segments, Vertices
len_3 = Length(Curve=explode_2.Segments)
sort_4 = SortList(Keys=len_3, ValuesA=explode_2.Segments)  # -> Keys, reverse(ValuesA)
item_14 = ListItem(List=sort_4.ValuesA, Index=0, Wrap=True)
vec = Vector(item_14)

disc_4 = Discontinuity(Curve=brec_3.Bounding, Level=1)  # -> Points, Parameters

drec = DeconstuctRectangle(Rectangle=geo_17)  # -> BasePlane, XInterval, YInterval
deplane = DeconstructPlane(Plane=drec.BasePlane)  # -> Origin, XAxis, YAxis, ZAxis
pl = ConstructPlane(Origin=deplane.Origin, XAxis=deplane.XAxis, YAxis=Vector(0, 1, 0))

# ----
# Tension Band Bottom Cut Solid Operator
panel_20 = Panel(pdecon.ZComponent)

pdecon_3 = Deconstruct(Point=disc_4.Points)  # -> XComponent, YComponent, ZComponent

bbox = BoundingBox(Content=offsrf, Plane=PlaneXY(0, 0, 0))  # -> Box, Box_2
debox = DeconstructBox(Box=bbox.Box_2)  # -> Plane, X, Y, Z
num = Number(debox.Z)
item_15 = ListItem(List=flatten(num), Index=0, Wrap=True)

extremums = MinMax(Number=flatten(pdecon_3.ZComponent))  # -> Minimum, Maximum

align = AlignPlane(Plane=pl_origin, Direction=vec)  # -> Plane, Angle
brec_4 = BoundingRectangle(Geometry=geo_14, Plane=align.Plane, Axis=0, Slide=0, Union=True)  # -> Bounding, DimensionX, DimensionY
scale_nu_5 = ScaleNU(Geometry=brec_4.Bounding, Plane=brec_4.Bounding, ScaleX=2, ScaleY=1, ScaleZ=1)  # -> Geometry, Transform

project = Project(Geometry=brec_2.Bounding, Plane=pt)  # -> Geometry, Transform
Z_3 = UnitZ(Factor=20)
extr_2 = Extrude(Base=project.Geometry, Direction=Z_3)
cap = CapHoles(Brep=extr_2)
split_2 = SplitWithBrep(Curve=scale_nu_5.Geometry, Brep=cap)  # -> Curve, Points
clscrv = CloseCurve(Curve=split_2.Curve, CloseType=0, Bulge=0.5, Tolerance=0)  # -> Closed, R
area_7 = Area(Geometry=clscrv.Closed)  # -> Area, Centroid
brepinc = PointInBrep(Brep=cap, Point=area_7.Centroid, Strict=False)
cull = CullPattern(List=clscrv.Closed, CullPattern=brepinc)  # -> simplify(List)
clean_3 = CleanTree(RemoveNulls=True, RemoveInvalid=True, RemoveEmpty=True, Tree=cull)

brec_5 = BoundingRectangle(Geometry=flatten(dso_30.Centerlines), Plane=PlaneXY(0, 0, 0), Axis=0, Slide=0, Union=True)  # -> Bounding, DimensionX, DimensionY
area_8 = Area(Geometry=brec_5.Bounding)  # -> Area, Centroid
scale_nu_6 = ScaleNU(Geometry=brec_5.Bounding, Plane=area_8.Centroid, ScaleX=1.5, ScaleY=1, ScaleZ=1)  # -> Geometry, Transform
project_2 = Project(Geometry=scale_nu_6.Geometry, Plane=pt)  # -> Geometry, Transform
offset = OffsetCurve(Curve=project_2.Geometry, Distance=10, Corners=1)
rdiff = RegionDifference(CurvesA=offset, CurvesB=project_2.Geometry)
boundary_3 = BoundarySurfaces(Edges=rdiff)
extr_3 = Extrude(Base=boundary_3, Direction=Z_3)

panel_21 = Panel("""5
1
1
1
1
1
1
5""")
area_9 = Area(Geometry=scale_nu_3.Geometry)  # -> Area, Centroid
scale_nu_7 = ScaleNU(Geometry=scale_nu_3.Geometry, Plane=area_9.Centroid, ScaleX=1, ScaleY=1, ScaleZ=graft(panel_21))  # -> Geometry, Transform

division_5 = Division(A=item_15, B=2)
addition = Addition(A=division_5, B=tension_band_bottom_cut)
Z_4 = UnitZ(Factor=expr("-x", addition))

geo_19 = Geometry(geo_18)

move_3 = Move(Geometry=xy, Motion=Z_4)  # -> Geometry, Transform
planesrf = PlaneSurface(Plane=move_3.Geometry, XSize=Domain(-100, 100), YSize=Domain(-100, 100))
offsrf_3 = OffsetSurface(Surface=planesrf, Distance=expr("-X", Slider(1, range=0..1)), BothSides=0, CreateSolid=True)

tstat_2 = TreeStatistics(Tree=clean_3)  # -> Paths, Length, Count
split_3 = SplitTree(Data=simplify(scale_nu_5.Geometry), Masks=flatten(tstat_2.Paths))  # -> Positive, Negative
merge_6 = Merge(Data1=clean_3, Data2=split_3.Negative)

item_16 = ListItem(List=trim_2, Index=0, Wrap=True)
division_6 = Division(A=item_16, B=2000)

project_3 = Project(Geometry=merge_6, Plane=pl_origin)  # -> Geometry, Transform
trim_4 = TrimWithBrep(Curve=project_3.Geometry, Brep=extr_3)  # -> Inside, Outside
clscrv_2 = CloseCurve(Curve=trim_4.Outside, CloseType=0, Bulge=0.5, Tolerance=0)  # -> Closed, R

split_4 = SplitTree(Data=simplify(division_6), Masks=flatten("{!0,7}"))  # -> Positive, Negative
number_slider_4 = Slider(0, range=0..100)
division_7 = Division(A=dso_33.Thickness, B=2000)

cso = CreateSpeckleObject(
    FrameBase=move_3.Geometry,
    Geo=planesrf,
    OffsetPositive=number_slider_4,
    OffsetNegative=number_slider_4,
    Name="Tension Band Bottom Cut",
    Type="Planar",
    selectedKitName="Objects")

neg_3 = Negative(Value=division_7)
number_slider_5 = Slider(0, range=0..100)

deplane_2 = DeconstructPlane(Plane=pln_2)  # -> Origin, XAxis, YAxis, ZAxis
pl_2 = ConstructPlane(Origin=deplane_2.Origin, XAxis=deplane_2.ZAxis, YAxis=deplane_2.YAxis)

crv_2 = Curve(tree_4)
disc_5 = Discontinuity(Curve=crv_2, Level=1)  # -> Points, Parameters
join_4 = JoinCurves(Curves=crv_2, Preserve=False)  # -> simplify(Curves)
plfit_2 = PlaneFit(Points=disc_5.Points)  # -> Plane, Deviation
polyoffset = PolylineOffset(
    Polylines=graft(join_4),
    Distance=fin_tolerance,
    Plane=graft(plfit_2.Plane),
    Tolerance=0.001,
    ClosedFillet=1,
    OpenFillet=1,
    Miter=2)  # -> simplify(Contour), Holes
boundary_4 = BoundarySurfaces(Edges=polyoffset.Contour)
crv_3 = Curve(polyoffset.Holes)
offsrf_4 = OffsetSurface(Surface=boundary_4, Distance=expr("x/2", panel_17), BothSides=expr("-x/2", panel_17), CreateSolid=True)  # -> simplify(Offset)

vdis = VectorDisplay(Anchor=deplane_2.Origin, Vector=deplane_2.ZAxis)
xz_2 = XZPlane(Origin=item_9)
item_17 = ListItem(List=flatten(xz_2), Index=0, Wrap=True)  # -> Item, Item1
flippln = FlipPlane(Plane=item_17.Item1, FlipX=False, FlipY=False, FlipZ=True)  # -> Flipped, R
number_slider_6 = Slider(0, range=0..100)
pln_3 = Plane(pln)
merge_7 = Merge(Data1=item_17.Item, Data2=flippln.Flipped)
neg_4 = Negative(Value=division_4)

cso_2 = CreateSpeckleObject(
    FrameBase=pln_2,
    FrameEnd=pl_2,
    Geo=geo_18,
    OffsetPositive=division_4,
    OffsetNegative=neg_4,
    Name="Column Fin Plate",
    Type="Planar",
    selectedKitName="Objects")

deplane_3 = DeconstructPlane(Plane=merge_7)  # -> Origin, XAxis, YAxis, ZAxis

cso_3 = CreateSpeckleObject(
    FrameBase=pln_3,
    FrameEnd=merge_7,
    Geo=extr,
    OffsetPositive=number_slider_6,
    OffsetNegative=number_slider_6,
    Name="Head Plate",
    Type="Planar",
    selectedKitName="Objects")

vdis_2 = VectorDisplay(Anchor=deplane_3.Origin, Vector=deplane_3.ZAxis)
tstat_3 = TreeStatistics(Tree=offsrf_4)  # -> Paths, Length, Count

dso_34 = DeconstructSpeckleObject(SpeckleObject=dso_13.Field, selectedKitName="Objects")  # -> Column_head, Gh_path
dso_35 = DeconstructSpeckleObject(SpeckleObject=dso_34.Column_head, selectedKitName="Objects")  # -> Head_plates, Hollow_tube, Pin_srf, Top_plate, Top_plate_screw, Wood_screws

dso_36 = DeconstructSpeckleObject(SpeckleObject=receive_6.Data, selectedKitName="Objects")  # -> Brim_cutout, Downpipes, Elevator_vent, Pin_cutout, Pipes, PVDucts, Ventilation_duct

area_10 = Area(Geometry=dso_36.Downpipes)  # -> Area, Centroid
scale_nu_8 = ScaleNU(Geometry=dso_36.Downpipes, Plane=area_10.Centroid, ScaleX=1, ScaleY=1, ScaleZ=2)  # -> Geometry, Transform
debrep = DeconstructBrep(Brep=scale_nu_8.Geometry)  # -> Faces, Edges, Vertices
shrinktrimsrf = ShrinkTrimmedSurface(Surface=debrep.Faces)  # -> Shrunken, Underlying, R
join_5 = BrepJoin(Breps=shrinktrimsrf.Shrunken)  # -> flatten(Breps), Closed

dso_37 = DeconstructSpeckleObject(SpeckleObject=tree_2, selectedKitName="Objects")  # -> BottomPlane, ReferencePoint, ToolPath, TopPlate
dist = Distance(PointA=dso_37.BottomPlane, PointB=dso_37.TopPlate)
geo_20 = Geometry(dso_37.BottomPlane)
pl_offset = PlaneOffset(BasePlane=dso_37.BottomPlane, Offset=dist)
pln_4 = Plane(geo_20)
cso_4 = CreateSpeckleObject(
    FrameBase=pln_4,
    Geo=graft(item),
    ToolPath=dso_37.ToolPath,
    OffsetPositive=dist,
    OffsetNegative=Slider(0, range=0..100),
    Name="Onsite Pockets",
    Type="Pocket",
    selectedKitName="Objects")
trim_5 = TrimTree(Tree=cso_4, Depth=1)

number_slider_7 = Slider(0, range=0..100)
number_slider_8 = Slider(0.1, range=0..0.1)
neg_5 = Negative(Value=number_slider_8)

bottom_offset = Slider(0.02, range=0..0.1)
segment_thickness = Slider(0.2, range=0..1)
end_clearence = Slider(0.05, range=0..1)
tfj = Slider(0.032, range=0..0.1)
efj = Slider(0.1, range=0.01..1)

finger_joints = BooleanToggle(False)

thicker_bottom_plate = BooleanToggle(True)

data_3 = Data(cluster)
data_4 = Data(cluster_2)
data_5 = Data(cluster_3)

data_6 = Data(tstat.Paths)

number_slider_9 = Slider(0.015, range=0..0.1)
number_slider_10 = Slider(0.1, range=0..1)

# ---- group: Offset of Split (90mm To, 110mm Bottom
number_slider_11 = Slider(0, range=0..0.01)

# ----
off_ibb_drawing_t130 = BooleanToggle(True)

clt_offset = Slider(0.03, range=0..0.1)
clt_offset_2 = Slider(0.02, range=0..0.1)
clt_offset_3 = Slider(0.02, range=0..0.1)
merge_8 = Merge(Data1=clt_offset, Data2=clt_offset_2, Data3=clt_offset_3)

offset_from_top_of_top_plate = Slider(0.01, range=0..0.01)
number_slider_12 = Slider(0.3, range=0..1)
screw_length = Slider(0.1, range=0..0.1)
spacing_d = Slider(5, range=0..10)
diameter = Slider(6, range=0..10)

# ---- group: Scales the beam to steps of 2cm with a min of 2cm
# For MB it should be zero
raw_beam_offset = Slider(0, range=0..0.1)

# ----
note = Panel("""[LPH5 Rev_7] 
- Updated Brim to 1.6m -Updated Onsite Holes""")

monotone = BooleanToggle(False)
panel_22 = Panel("""Shell
Shell_Index
Type""")
panel_23 = Panel("B1")  # disabled
panel_24 = Panel("B1")  # disabled
panel_25 = Panel("B2")  # disabled
panel_26 = Panel("B1")  # disabled
panel_27 = Panel("B2")  # disabled

note_2 = Panel(note)

manual = BooleanToggle(False)
panel_28 = Panel("https://speckle.xyz/streams/fa2b5c68c0/branches/02-development%2F6-connections_battens")
_3s_plate = _3SPlate(ActiveMaterialIndex=2)
_3s_plate_2 = _3SPlate(ActiveMaterialIndex=4)

# ---- group: Planar Poly
# - LCRL LPH5 Development Model  -
# Evaluation
panel_29 = Panel("https://app.speckle.systems/projects/fa2b5c68c0/models/443f7f142a")

# ----
sdet = StreamDetails(Stream=panel_29)  # -> StreamID, Name, Description, CreatedAt, UpdatedAt, Public, Collaborators, Branches
receive_9 = Receive(
    Stream=panel_29,
    AutoReceive=False,
    CurrentComponentState="up_to_date",
    ExpandOutput=True,
    LastInfoMessage="Lasath Siriwardena @ 07/30/2025 09:44:40: [Rev_7] Brim Update to 1.6m Plan Width (id:81b3c8a0d6)",
    ReceiveOnOpen=False,
    ReceivedCommitId="81b3c8a0d6",
    StreamWrapper="https://app.speckle.systems/projects/fa2b5c68c0/models/01-design/4-planarization",
    selectedKitName="Objects")  # -> Info, Data
panel_30 = Panel(receive_9.Info)

# ---- group: Planar Poly (continued)
dso_38 = DeconstructSpeckleObject(SpeckleObject=receive_9.Data, selectedKitName="Objects")  # -> Parent, Roof
dso_39 = DeconstructSpeckleObject(SpeckleObject=dso_38.Roof, selectedKitName="Objects")  # -> Base_Surface, Segments
dso_40 = DeconstructSpeckleObject(SpeckleObject=dso_39.Segments, selectedKitName="Objects")  # -> Fibre_dir, HasColumn, HasVent, Id, Polyline, Rect, Type, Vent

# ----
edges_2 = BrepEdges(Brep=dso_39.Base_Surface)  # -> Naked, Interior, NonManifold
join_6 = JoinCurves(Curves=edges_2.Naked, Preserve=False)
len_4 = Length(Curve=join_6)
sort_5 = SortList(Keys=len_4, ValuesA=join_6)  # -> Keys, reverse(ValuesA)
item_18 = ListItem(List=sort_5.ValuesA, Index=0, Wrap=True)

c_script_9 = CSharpScript(x=dso_40.Type, y=ColourSwatch(SwatchColor=RGBA(255, 0, 77, 30)), z=ColourSwatch(SwatchColor=RGBA(0, 255, 60, 19)))  # -> out, A; inputs x: String
# ---------- c_script_9: C# ----------
    if(x.Contains("solid")) A = y;
    else A = z;
# ---------- end c_script_9 ----------
boundary_5 = BoundarySurfaces(Edges=dso_40.Polyline)

crv_4 = Curve(dso_40.Vent)

area_11 = Area(Geometry=dso_40.Polyline)  # -> Area, Centroid
item_19 = ListItem(List=dso_3.Outline, Index=0, Wrap=True)
project_4 = Project(Geometry=area_11.Centroid, Plane=PlaneXY(0, 0, 0))  # -> Geometry, Transform
brec_6 = BoundingRectangle(Geometry=item_19, Plane=PlaneXY(0, 0, 0), Axis=0, Slide=0, Union=True)  # -> Bounding, DimensionX, DimensionY
project_5 = Project(Geometry=brec_6.Bounding, Plane=PlaneXY(0, 0, 0))  # -> Geometry, Transform
incurve = PointInCurve(Point=project_4.Geometry, Curve=project_5.Geometry)  # -> Relationship, Point
equals = Equality(FirstNumber=incurve.Relationship, SecondNumber=2)  # -> Equality, Inequality
cull_2 = CullPattern(List=project_4.Geometry, CullPattern=equals.Equality)  # -> simplify(List)
clean_4 = CleanTree(RemoveNulls=True, RemoveInvalid=True, RemoveEmpty=True, Tree=cull_2)
tstat_4 = TreeStatistics(Tree=clean_4)  # -> Paths, Length, Count
tag = TextTag(Location=flatten(clean_4), Text=tstat_4.Paths)

trim_6 = TrimTree(Tree=simplify(dso_40.Polyline), Depth=1)
python = GhPythonScript(x="3_090", y=dso_40.Id)  # -> out, a
# ---------- python: Python ----------
if x == y : a = True;
else : a = False;
# ---------- end python ----------

area_12 = Area(Geometry=dso_40.Polyline)  # -> Area, Centroid
pln_5 = Plane(dso_40.Rect)
pl_origin_2 = PlaneOrigin(Base=pln_5, Origin=area_12.Centroid)

preview_2 = CustomPreview(Geometry=boundary_5, Material=c_script_9.A)
previewlw = CustomPreviewLineweights(Geometry=crv_4, Shader=ColourSwatch(SwatchColor=RGB(255, 255, 255)), Thickness=Slider(3, range=0..10), Absolute=False)

tstat_5 = TreeStatistics(Tree=simplify(area_12.Centroid))  # -> Paths, Length, Count
cull_3 = CullPattern(List=dso_40.Polyline, CullPattern=python.a)

tstat_6 = TreeStatistics(Tree=simplify(dso_40.Polyline))  # -> Paths, Length, Count
tree_5 = CreateTree(Data=panel_5, Path=tstat_6.Paths)

trim_7 = TrimTree(Tree=simplify(dso_40.Polyline), Depth=1)

poly_topo_edge = PolygonTopologyEdge(ListOfPolylines=trim_6, Tolerance=0.001)  # -> ListOfEdges, LoopEdgeStructure, EdgeLoopStructure
poly_topo_edge_filter = PolygonTopologyEdgeFilter(EdgeList=poly_topo_edge.ListOfEdges, EdgeLoopStructure=poly_topo_edge.EdgeLoopStructure, ValencyFilter=1)  # -> ListOfEdgeIDs, ListOfEdges
join_7 = JoinCurves(Curves=poly_topo_edge_filter.ListOfEdges, Preserve=False)
len_5 = Length(Curve=join_7)
sort_6 = SortList(Keys=len_5, ValuesA=join_7)  # -> Keys, reverse(ValuesA)
item_20 = ListItem(List=sort_6.ValuesA, Index=0, Wrap=True)

string_filter = StringFilter(Text=dso_40.Type, Object=dso_40.Polyline, Key="ridge")  # -> Text, Object

crv_5 = Curve(dso_7.FingerJointEdges)
project_6 = Project(Geometry=item_18, Plane=PlaneXY(0, 0, 0))  # -> Geometry, Transform
midpt = CurveMiddle(Curve=flatten(crv_5))
project_7 = Project(Geometry=midpt, Plane=PlaneXY(0, 0, 0))  # -> flatten(Geometry), Transform
incurves = PointInCurves(Point=project_7.Geometry, Curves=flatten(project_6.Geometry))  # -> Relationship, Index, Point
tstat_7 = TreeStatistics(Tree=simplify(project_6.Geometry))  # -> Paths, Length, Count
path = ConstructPath(Indices=graft(incurves.Index))  # -> flatten(Branch)
tree_6 = CreateTree(Data=flatten(crv_5), Path=path, Ensure=tstat_7.Paths)

crv_6 = Curve(dso_40.Polyline)
crv_7 = Curve(dso_40.Polyline)

data_7 = Data(tree_5)
txt = Text(simplify(dso_40.Id))

panel_31 = Panel("https://app.speckle.systems/projects/fa2b5c68c0/models/73d1db8d95")

receive_10 = Receive(
    Stream=panel_31,
    AutoReceive=False,
    CurrentComponentState="up_to_date",
    ExpandOutput=True,
    LastInfoMessage="Lasath Siriwardena @ 02/22/2024 09:01:18: Updated Acoustics based on A610 V DD12 (id:2c90bcf47d)",
    ReceiveOnOpen=True,
    ReceivedCommitId="2c90bcf47d",
    StreamWrapper="https://app.speckle.systems/projects/fa2b5c68c0/models/globals",
    selectedKitName="Objects")  # -> Info, ArchicadMiddleTopOfGrid1, Cassette, Material, Steel

dso_41 = DeconstructSpeckleObject(SpeckleObject=receive_10.Cassette, selectedKitName="Objects")  # -> AcousticBatten, AcousticThickness, Beam_layer, Beam_Width, Bottom_layer, InsulationThickness, Top_layer
dso_42 = DeconstructSpeckleObject(SpeckleObject=receive_10.ArchicadMiddleTopOfGrid1, selectedKitName="Objects")  # -> X, Y, Z
vec_2 = VectorXYZ(XComponent=dso_42.X, YComponent=dso_42.Y, ZComponent=dso_42.Z)  # -> Vector, Length

move_4 = Move(Geometry=geo, Motion=vec_2.Vector)  # -> Geometry, Transform
move_5 = Move(Geometry=pl_origin_2, Motion=vec_2.Vector)  # -> Geometry, Transform
move_6 = Move(Geometry=pl_origin_2, Motion=vec_2.Vector)  # -> Geometry, Transform
addition_2 = Addition(A=dso_41.Bottom_layer, B=dso_41.Beam_layer, C=dso_41.Top_layer)
tag_2 = TextTag(Location=flatten(move_6.Geometry), Text=tstat_5.Paths)
division_8 = Division(A=addition_2, B=2)
buildup = DefineCassetteBuildup(LayerThickness=dso_41.Bottom_layer, Beam_layer=dso_41.Beam_layer, Top_layer=dso_41.Top_layer, includeCenterValues=False)  # -> BuildupKey, BuildupValue

# ----
# Globals
layer_thickness = Panel(dso_41.AcousticThickness)
layer_thickness_2 = Panel(dso_41.Bottom_layer)
layer_thickness_3 = Panel(dso_41.InsulationThickness)
layer_thickness_4 = Panel(dso_41.Beam_layer)
layer_thickness_5 = Panel(dso_41.Top_layer)
panel_32 = Panel(buildup.BuildupValue)

buildup_2 = DefineCassetteBuildup(LayerThickness=dso_41.Bottom_layer, Beam_layer=dso_41.Beam_layer, Top_layer=dso_41.Top_layer, includeCenterValues=True)  # -> BuildupKey, BuildupValue
addition_3 = Addition(A=dso_41.Top_layer, B=dso_41.Bottom_layer, C=dso_41.Beam_layer)
panel_33 = Panel(addition_3)
panel_34 = Panel(buildup.BuildupKey)
panel_35 = Panel(buildup_2.BuildupKey)
panel_36 = Panel(buildup_2.BuildupValue)
item_21 = ListItem(List=buildup.BuildupValue, Index=Slider(2, range=0..10), Wrap=True)
item_22 = ListItem(List=buildup.BuildupValue, Index=Slider(1, range=0..10), Wrap=True)
panel_37 = Panel(item_21)
panel_38 = Panel(item_22)

merge_9 = Merge(Data1=dso_12.Elevator_vent, Data2=dso_12.Pipes, Data3=dso_12.Ventilation_duct)  # -> flatten(Result)
boundary_6 = BoundarySurfaces(Edges=dso_40.Polyline)
move_7 = Move(Geometry=boundary_6, Motion=vec_2.Vector)  # -> Geometry, Transform
clash = Clash(FirstSet=move_7.Geometry, SecondSet=merge_9, Distance=0, L=100)  # -> ClashCount, ClashPoints, ClashRadii, simplify(FirstIndex), SecondIndex
clean_5 = CleanTree(RemoveNulls=True, RemoveInvalid=True, RemoveEmpty=True, Tree=clash.FirstIndex)

tstat_8 = TreeStatistics(Tree=clean_5)  # -> Paths, Length, Count

crv_8 = Curve(trim_7)
num_2 = Number(division_8)
geo_21 = Geometry(dso_39.Base_Surface)
vec_3 = Vector(vec_2.Vector)

list = ValueList({"Gradient": 0, "Constant": 1, "Structural": 2, "Struct/Grad": 3}, selected="Struct/Grad")
data_8 = Data(tstat_8.Paths)
data_9 = Data(dso_40.Polyline)
data_10 = Data(dso_40.Type)
num_3 = Number(clean)

boundary_7 = BoundarySurfaces(Edges=item_2.Item)
offsrf_5 = OffsetSurface(Surface=boundary_7, Distance=1, BothSides=-1, CreateSolid=True)
tstat_9 = TreeStatistics(Tree=boundary_7)  # -> Paths, Length, Count
split_5 = SplitTree(Data=simplify(data_9), Masks=flatten(tstat_9.Paths))  # -> Positive, Negative
boundary_8 = BoundarySurfaces(Edges=split_5.Positive)
bbx = BrepBrep(BrepA=boundary_8, BrepB=simplify(offsrf_5))  # -> Curves, Points

area_13 = Area(Geometry=bbx.Curves)  # -> Area, Centroid
tstat_10 = TreeStatistics(Tree=bbx.Curves)  # -> Paths, Length, Count
tag_3 = TextTag(Location=flatten(area_13.Centroid), Text=tstat_10.Paths)

panel_39 = Panel("""{6;108}
{6;79}
{6;118}
{6;94}
{6;64}
{7;76}
{6;92}""")
panel_40 = Panel("""{3;52}
{3;151}
{5;52}
{5;151}""")
tstat_11 = TreeStatistics(Tree=simplify(bbx.Curves))  # -> Paths, Length, Count
split_6 = SplitTree(Data=simplify(data_10), Masks=flatten(tstat_11.Paths))  # -> Positive, Negative
tstat_12 = TreeStatistics(Tree=simplify(split_6.Negative))  # -> Paths, Length, Count
merge_10 = Merge(Data1=panel_40, Data2=tstat_12.Paths)

division_9 = Division(A=num_3, B=100)
extremums_2 = MinMax(Number=division_9)  # -> Minimum, Maximum
split_7 = SplitTree(Data=simplify(extremums_2.Maximum), Masks=flatten(tstat_4.Paths))  # -> Positive, Negative

# ----
# Brim Flange Band Solid Operator
clean_6 = CleanTree(RemoveNulls=True, RemoveInvalid=True, RemoveEmpty=True, Tree=dso_18.Flanschblech)
item_23 = ListItem(List=clean_6, Index=0, Wrap=True)
geo_22 = Geometry(flatten(item_23))
debrep_2 = DeconstructBrep(Brep=geo_22)  # -> Faces, Edges, Vertices
sort_pt_3 = SortPoints(Points=debrep_2.Vertices)  # -> reverse(Points), Indices
item_24 = ListItem(List=sort_pt_3.Points, Index=0, Wrap=True)
scale_nu_9 = ScaleNU(Geometry=geo_22, Plane=flatten(item_24), ScaleX=1, ScaleY=1, ScaleZ=5)  # -> Geometry, Transform
area_14 = Area(Geometry=scale_nu_9.Geometry)  # -> Area, Centroid
scale_nu_10 = ScaleNU(Geometry=scale_nu_9.Geometry, Plane=flatten(area_14.Centroid), ScaleX=4, ScaleY=400, ScaleZ=1)  # -> Geometry, Transform
move_8 = Move(Geometry=scale_nu_10.Geometry, Motion=expr("-x", vec_2.Vector))  # -> Geometry, Transform

# ----
# Brim Drain Extension
cluster_4 = Cluster_44(D=trim_7, y=extension_out, C=end_height, num=num_2)
geo_23 = Geometry(cluster_4)

geo_24 = Geometry(dso_35.Hollow_tube)
edges_3 = BrepEdges(Brep=geo_24)  # -> Naked, Interior, NonManifold
join_8 = JoinCurves(Curves=edges_3.Naked, Preserve=False)
area_15 = Area(Geometry=join_8)  # -> Area, Centroid
item_25 = ListItem(List=area_15.Centroid, Index=0, Wrap=True)  # -> Item, Item1
avr_2 = Average(Input=area_15.Centroid)
vec2pt = Vector2Pt(PointA=item_25.Item, PointB=item_25.Item1, Unitize=False)  # -> Vector, Length
pl_3 = PlaneNormal(Origin=avr_2, ZAxis=vec2pt.Vector)
scale_nu_11 = ScaleNU(Geometry=geo_24, Plane=pl_3, ScaleX=1, ScaleY=1, ScaleZ=5)  # -> Geometry, Transform
cap_2 = CapHoles(Brep=scale_nu_11.Geometry)  # -> flatten(Brep)
move_9 = Move(Geometry=cap_2, Motion=vec_2.Vector)  # -> Geometry, Transform

merge_11 = Merge(
    Data1=join_5.Breps,
    Data2=dso_36.Elevator_vent,
    Data3=dso_36.Pipes,
    Data4=dso_36.PVDucts,
    Data5=dso_36.Ventilation_duct,
    Data6=move_9.Geometry,
    Data7=dso_36.Brim_cutout)  # -> flatten(Result)
pln_6 = Plane(move_5.Geometry)
pln_7 = Plane(move_5.Geometry)
data_11 = Data(buildup.BuildupValue)

# ----
# Acoustic Battens + Screws
dso_43 = DeconstructSpeckleObject(SpeckleObject=dso_41.AcousticBatten, selectedKitName="Objects")  # -> PadddingBehindAcousticPanel, PaddingThickness, Spacing, Thickness, Width

# ---- group: Top Layer Thickness
num_4 = Number(dso_41.Top_layer)

# ----
dso_44 = DeconstructSpeckleObject(SpeckleObject=receive_10.Material, selectedKitName="Objects")  # -> Acoustic, BeamMaterial, BottomPlateMaterial, SolidSegment, TopPlateMaterial

dual = Panel("https://speckle.xyz/streams/")
panel_41 = Panel(panel_30)
panel_42 = Panel(receive_10.Info)
panel_43 = Panel(receive.Info)
merge_12 = Merge(Data1=panel_41, Data2=panel_43, Data3=panel_42, Data4=panel_13, Data5=panel_7, Data6=receive.Info, Data7=panel_15)
python_2 = GhPythonScript(x=merge_12)  # -> out, a
# ---------- python_2: Python ----------
arr = x.split(":")
id = arr[-1]
id = id[:-1]

a = id
# ---------- end python_2 ----------

concat_3 = Concatenate(FragmentA=dual, FragmentB=sdet.StreamID, FragmentC="/commits/")

concat_4 = Concatenate(FragmentA=concat_3, FragmentB=python_2.a)
url_of_commit = Panel(concat_4)

# ----
# Bottom Hole
crvprox_2 = CurveProximity(CurveA=bbx.Curves, CurveB=boundary_8)  # -> PointA, PointB, Distance

# ---- group: Modification requestion Simon 250207
split_8 = SplitTree(Data=simplify(crvprox_2.Distance), Masks=flatten("{6;25}"))  # -> Positive, Negative
addition_4 = Addition(A=split_8.Positive, B=0.1)
merge_13 = Merge(Data1=addition_4, Data2=split_8.Negative)

# ----
cluster_5 = Cluster_14(
    shell_7_swap=Toggle(True),
    M=data_8,
    x=data_10,
    crv=data_9,
    office_extra_acoustic_area=panel_39,
    M_2=merge_10,
    beam_width=list,
    beam_width_2=split_7.Positive,
    fabrication_offset=Slider(0.02, range=0..0.1),
    structural_offset=merge_13)  # -> L, A, R
data_12 = Data(cluster_5.L)

trim_8 = TrimTree(Tree=data_12, Depth=1)
tstat_13 = TreeStatistics(Tree=split_7.Positive)  # -> Paths, Length, Count
split_9 = SplitTree(Data=trim_8, Masks=flatten("{!6,7;*}"))  # -> Positive, Negative
split_10 = SplitTree(Data=data_12, Masks=flatten(tstat_13.Paths))  # -> Positive, Negative
area_16 = Area(Geometry=split_10.Positive)  # -> Area, Centroid
area_17 = Area(Geometry=split_9.Positive)  # -> Area, Centroid
area_18 = Area(Geometry=split_9.Negative)  # -> Area, Centroid
ma = MassAddition(Input=flatten(area_17.Area))  # -> Result, PartialResults
ma_2 = MassAddition(Input=flatten(area_18.Area))  # -> Result, PartialResults

# ----
# Bottom Hole Area Check
extremums_3 = MinMax(Number=flatten(division_9))  # -> Minimum, Maximum
gradient = Gradient(
    LowerLimit=extremums_3.Minimum,
    UpperLimit=extremums_3.Maximum,
    Parameter=split_7.Positive,
    stops=[0: RGB(0, 128, 0), 0.5: RGB(255, 255, 0), 1: RGB(255, 0, 0)])
tag_4 = TextTag(Location=area_16.Centroid, Text=split_7.Positive, Colour=gradient)
panel_44 = Panel(ma_2.Result)
panel_45 = Panel(ma.Result)

area_19 = Area(Geometry=data_12)  # -> Area, Centroid
area_20 = Area(Geometry=data_12)  # -> Area, Centroid
smaller = SmallerThan(FirstNumber=area_20.Area, SecondNumber=area_19.Area)  # -> SmallerThan, OrEqualTo
c_script_10 = CSharpScript(x=smaller.SmallerThan)  # -> out, A; inputs x: Boolean
# ---------- c_script_10: C# ----------
    if(x) A = "red";
    else A = "green";
# ---------- end c_script_10 ----------
previewlw_2 = CustomPreviewLineweights(Geometry=data_12, Shader=c_script_10.A, Absolute=False)

move_10 = Move(Geometry=data_12, Motion=vec_2.Vector)  # -> Geometry, Transform
previewlw_3 = CustomPreviewLineweights(
    Geometry=move_10.Geometry,
    Shader=ColourSwatch(SwatchColor=RGB(255, 255, 255)),
    Thickness=Slider(3, range=0..10),
    Absolute=False)

clean_7 = CleanTree(RemoveNulls=True, RemoveInvalid=True, RemoveEmpty=True, Tree=data_12)
boundary_9 = BoundarySurfaces(Edges=clean_7)  # -> simplify(Surfaces)

planesrf_2 = PlaneSurface(Plane=PlaneXY(0, 0, 0), XSize=Domain(-10, 10), YSize=Domain(-10, 10))
flip = Flip(Surface=boundary_9, Guide=planesrf_2)  # -> Surface, Result

item_26 = ListItem(List=buildup.BuildupValue, Index=2, Wrap=True)
offsrf_6 = OffsetSurface(Surface=flip.Surface, Distance=item_26, BothSides=-1, CreateSolid=True)  # -> simplify(Offset)

match = MatchTree(Tree=offsrf_6, Guide=clean_7)
tstat_14 = TreeStatistics(Tree=match)  # -> Paths, Length, Count

split_11 = SplitTree(Data=division_9, Masks=flatten(tstat_14.Paths))  # -> Positive, Negative
crv_9 = Curve(dso_40.Polyline)
split_12 = SplitTree(Data=simplify(crv_9), Masks=flatten(tstat_14.Paths))  # -> Positive, Negative
planar = IsPlanar(Surface=split_12.Positive, Interior=True)  # -> Planar, Plane
neg_6 = Negative(Value=split_11.Positive)
c_script_11 = CSharpScript(x=split_12.Positive, y=neg_6, z=planar.Plane)  # -> out, A; inputs x: Polyline, y: list of Double, z: Plane
# ---------- c_script_11: C# ----------
    A = OffsetPolylineVariable(x, y, z);
# ---------- c_script_11: C# additional code ----------
  public Polyline OffsetPolylineVariable(Polyline polyline, List<double> distances, Plane plane)
  {
    // Check if polyline is valid
    if (!polyline.IsValid)
      throw new ArgumentException("Provided polyline is not valid.");

    // Check if the distances count is the same as the segment count
    if (polyline.SegmentCount != distances.Count)
    {
      throw new ArgumentException("Number of distances does not match the number of polyline segments.");
    }

    //List<Point3d> newVertices = new List<Point3d>();
    List<Line> shiftedLines = new List<Line>();
    for (int i = 0; i < polyline.SegmentCount; i++)
    {
      Line segment = polyline.SegmentAt(i);

      Vector3d offsetDirection = Vector3d.CrossProduct(segment.Direction, plane.Normal);
      offsetDirection.Unitize();
      offsetDirection *= distances[i]; // scale by the distance

      Point3d start = segment.From + offsetDirection;
      Point3d end = segment.To + offsetDirection;
      shiftedLines.Add(new Line(start, end));
    }
    List<int> failedEdges = new List<int>();
    return IntersectionLinesToPolyline(shiftedLines, out failedEdges);
  }

  public Polyline IntersectionLinesToPolyline(List<Line> segments, out List<int> failedEdges)
  {
    failedEdges = new List<int>();
    Polyline offsetPolyline = new Polyline();
    for (int i = 0; i < segments.Count; i++)
    {
      int nextIndex = i == segments.Count - 1 ? 0 : i + 1;
      double a,b;
      if (Rhino.Geometry.Intersect.Intersection.LineLine(segments[i], segments[nextIndex], out  a, out  b))
      {
        double angle = Vector3d.VectorAngle(segments[i].Direction, segments[nextIndex].Direction);
        double angleDeg = RhinoMath.ToDegrees(angle);
        if (angle > Math.PI) angle = 2 * Math.PI - angle;
        if (angle < RhinoMath.ToRadians(1))
        {
          offsetPolyline.Add(segments[nextIndex].PointAt(0));
          failedEdges.Add(i);
        }
        else
        {
          Point3d pt = segments[i].PointAt(a);
          offsetPolyline.Add(pt);
        }
      }
      else
      {
        failedEdges.Add(i);
        offsetPolyline.Add(segments[nextIndex].PointAt(0));
      }
    }

    ShiftRightWrap(offsetPolyline, 01);
    offsetPolyline.Add(offsetPolyline[0]);

    return offsetPolyline;
  }

  public void ShiftRightWrap(Polyline polyline, int positions)
  {
    if (polyline == null || !polyline.IsValid)
      return;

    positions = positions % polyline.Count;

    if (positions == 0)
      return;

    var shifted = polyline.Skip(polyline.Count - positions).Concat(polyline.Take(polyline.Count - positions)).ToList();

    polyline.Clear();
    foreach (var pt in shifted)
    {
      polyline.Add(pt);
    }
  }
# ---------- end c_script_11 ----------

boundary_10 = BoundarySurfaces(Edges=c_script_11.A)
xy_2 = XYPlane(Origin=Point(0, 0, 0))
flip_2 = Flip(Surface=boundary_10, Guide=xy_2)  # -> Surface, Result
offsrf_7 = OffsetSurface(Surface=flip_2.Surface, Distance=panel_37, BothSides=panel_38, CreateSolid=True)  # -> flatten(Offset)

move_11 = Move(Geometry=data_12, Motion=expr("x", vec_2.Vector))  # -> Geometry, Transform

split_13 = SplitTree(Data=crv_8, Masks=flatten("{0,8}"))  # -> Positive, Negative
split_14 = SplitTree(Data=split_13.Negative, Masks=flatten("{6}"))  # -> Positive, Negative
graft = GraftTree(Tree=split_14.Positive, IncludeEmptyLists=True, IncludeNullItems=True)
Z_5 = UnitZ(Factor=1)
generate_mitre_planes_between_segments = GenerateMitrePlanesBetweenSegments(Polyline=crv_8, NakedEdgeGuideVector=Z_5)  # -> MitrePlanes, Neighbours, PolylinePlanes, BoundingRectangle

poly_topo_point = PolygonTopologyPoint(ListOfPolylines=split_13.Positive, Tolerance=0.001)  # -> ListOfPoints, LoopPointStructure, PointLoopStructure
c_script_12 = CSharpScript(x=poly_topo_point.ListOfPoints, y=poly_topo_point.LoopPointStructure)  # -> out, A; inputs x: tree of Point3d, y: tree of Int32
# ---------- c_script_12: C# ----------
        DataTree<Polyline> output = new DataTree<Polyline>();
    for (int i = 0; i < y.BranchCount; i++)
    {
      int mainIndex = y.Path(i)[0];
            Polyline poly = new Polyline();
            for (int j = 0; j < y.Branch(i).Count; j++)
            {
              poly.Add(x.Branch(mainIndex)[y.Branch(i)[j]]);
            }
            poly.Add(poly[0]);
            output.Add(poly, new GH_Path(mainIndex));
    }
    A = output;
# ---------- end c_script_12 ----------
boundary_11 = BoundarySurfaces(Edges=graft(c_script_12.A))
trim_9 = TrimTree(Tree=boundary_11, Depth=1)
match_2 = MatchTree(Tree=trim_9, Guide=split_13.Positive)

cluster_6 = Cluster_42(crv=split_14.Positive, O=num_2, L=dso_39.Base_Surface)  # -> R_3, R, L_2, L_3, R_2, T
geo_25 = Geometry(flatten(cluster_6.L_3))
geo_26 = Geometry(flatten(cluster_6.L_2))
geo_27 = Geometry(cluster_6.R)
geo_28 = Geometry(cluster_6.R_2)
match_3 = MatchTree(Tree=geo_27, Guide=split_14.Positive)  # -> graft(Tree)
match_4 = MatchTree(Tree=geo_28, Guide=graft)
match_5 = MatchTree(Tree=geo_25, Guide=split_14.Positive)  # -> graft(Tree)
match_6 = MatchTree(Tree=geo_26, Guide=split_14.Positive)  # -> graft(Tree)

poly_topo_edge_2 = PolygonTopologyEdge(ListOfPolylines=flatten(geo_26), Tolerance=0.001)  # -> ListOfEdges, LoopEdgeStructure, EdgeLoopStructure; disabled
poly_topo_edge_filter_2 = PolygonTopologyEdgeFilter(EdgeList=poly_topo_edge_2.ListOfEdges, EdgeLoopStructure=poly_topo_edge_2.EdgeLoopStructure, ValencyFilter=1)  # -> ListOfEdgeIDs, ListOfEdges; disabled
previewlw_4 = CustomPreviewLineweights(Geometry=poly_topo_edge_filter_2.ListOfEdges, Shader=swatch_2, Thickness=10, Absolute=False)  # disabled

poly_topo_edge_3 = PolygonTopologyEdge(ListOfPolylines=flatten(geo_25), Tolerance=0.001)  # -> ListOfEdges, LoopEdgeStructure, EdgeLoopStructure; disabled
poly_topo_edge_filter_3 = PolygonTopologyEdgeFilter(EdgeList=poly_topo_edge_3.ListOfEdges, EdgeLoopStructure=poly_topo_edge_3.EdgeLoopStructure, ValencyFilter=1)  # -> ListOfEdgeIDs, ListOfEdges; disabled
previewlw_5 = CustomPreviewLineweights(Geometry=poly_topo_edge_filter_3.ListOfEdges, Shader=swatch, Thickness=10, Absolute=False)  # disabled

data_13 = Data(vec_3)
geo_29 = Geometry(graft(generate_mitre_planes_between_segments.PolylinePlanes))

merge_14 = Merge(Data1=match_2, Data2=split_14.Negative)
crv_10 = Curve(merge_14)

generate_offset_polylines = GenerateOffsetPolylines(
    Polyline=crv_10,
    Offset=num_2,
    OptionalEdgeVectorOverride=Z_5,
    AngleTolerance=degrees(1),
    OffsetMethod=2,
    nonPlanar=False,
    virtual4Valent=False)  # -> OffsetPolylines, FourValenceNodes
generate_offset_polylines_2 = GenerateOffsetPolylines(
    Polyline=crv_10,
    Offset=expr("-x", num_2),
    OptionalEdgeVectorOverride=Z_5,
    AngleTolerance=degrees(1),
    OffsetMethod=2,
    nonPlanar=False,
    virtual4Valent=True)  # -> OffsetPolylines, FourValenceNodes
simplify = Simplify(Curve=generate_offset_polylines.OffsetPolylines)
simplify_2 = Simplify(Curve=generate_offset_polylines_2.OffsetPolylines)
merge_15 = Merge(Data1=simplify(graft(simplify)), Data2=simplify(graft(crv_10)), Data3=simplify(graft(simplify_2)))
loft_polylines = LoftPolylines(Polylines=merge_15)  # -> LoftedPlate, Report, Debug
trim_10 = TrimTree(Tree=loft_polylines.LoftedPlate, Depth=1)

cluster_7 = Cluster_33(
    d1=generate_offset_polylines.FourValenceNodes,
    D_2=trim_10,
    d2=generate_offset_polylines_2.FourValenceNodes,
    D=generate_mitre_planes_between_segments.MitrePlanes)  # -> D_3, N

poly_topo_edge_4 = PolygonTopologyEdge(ListOfPolylines=flatten(simplify), Tolerance=0.001)  # -> ListOfEdges, LoopEdgeStructure, EdgeLoopStructure; disabled
poly_topo_edge_filter_4 = PolygonTopologyEdgeFilter(EdgeList=poly_topo_edge_4.ListOfEdges, EdgeLoopStructure=poly_topo_edge_4.EdgeLoopStructure, ValencyFilter=1)  # -> ListOfEdgeIDs, ListOfEdges; disabled
previewlw_6 = CustomPreviewLineweights(Geometry=poly_topo_edge_filter_4.ListOfEdges, Shader=swatch_4, Thickness=10, Absolute=False)  # disabled

poly_topo_edge_5 = PolygonTopologyEdge(ListOfPolylines=flatten(simplify_2), Tolerance=0.001)  # -> ListOfEdges, LoopEdgeStructure, EdgeLoopStructure; disabled
poly_topo_edge_filter_5 = PolygonTopologyEdgeFilter(EdgeList=poly_topo_edge_5.ListOfEdges, EdgeLoopStructure=poly_topo_edge_5.EdgeLoopStructure, ValencyFilter=1)  # -> ListOfEdgeIDs, ListOfEdges; disabled
previewlw_7 = CustomPreviewLineweights(Geometry=poly_topo_edge_filter_5.ListOfEdges, Shader=swatch_3, Thickness=10, Absolute=False)  # disabled

merge_16 = Merge(Data1=match_3, Data2=graft(trim_10))
merge_17 = Merge(Data1=match_5, Data2=simplify(simplify_2))
merge_18 = Merge(Data1=match_6, Data2=simplify)
merge_19 = Merge(Data1=match_4, Data2=cluster_7.N)

geo_30 = Geometry(simplify(cluster_7.D_3))
crv_11 = Curve(simplify(merge_18))
crv_12 = Curve(simplify(merge_17))
geo_31 = Geometry(merge_19)
geo_32 = Geometry(merge_16)

split_15 = SplitTree(Data=geo_32, Masks=flatten(concat_2))  # -> Positive, Negative; disabled

move_12 = Move(Geometry=geo_31, Motion=vec_3)  # -> Geometry, Transform
move_13 = Move(Geometry=crv_12, Motion=vec_3)  # -> Geometry, Transform
move_14 = Move(Geometry=crv_11, Motion=vec_3)  # -> Geometry, Transform
move_15 = Move(Geometry=geo_32, Motion=vec_3)  # -> Geometry, Transform
move_16 = Move(Geometry=cluster_5.L, Motion=vec_3)  # -> Geometry, Transform
move_17 = Move(Geometry=geo_30, Motion=vec_3)  # -> Geometry, Transform

clean_8 = CleanTree(RemoveNulls=True, RemoveInvalid=True, RemoveEmpty=False, Tree=move_16.Geometry)

clean_9 = CleanTree(RemoveNulls=True, RemoveInvalid=True, RemoveEmpty=False, Tree=move_17.Geometry)
cso_5 = CreateSpeckleObject(
    MitrePlanes=move_12.Geometry,
    BottomContour=move_13.Geometry,
    TopContour=move_14.Geometry,
    Segment=move_15.Geometry,
    BottomHoles=clean_8,
    FourValentEdgePlanes=clean_9,
    selectedKitName="Objects")

number_slider_13 = Slider(0.0001, range=0..0.0001)  # disabled
number_slider_14 = Slider(1e-05, range=0..1e-05)  # disabled
number_slider_15 = Slider(0.0001, range=0..0.0001)  # disabled
number_slider_16 = Slider(1e-05, range=0..1e-05)  # disabled
poly_topo_point_2 = PolygonTopologyPoint(ListOfPolylines=flatten(crv_11), Tolerance=number_slider_13)  # -> ListOfPoints, LoopPointStructure, PointLoopStructure; disabled
poly_topo_point_3 = PolygonTopologyPoint(ListOfPolylines=flatten(crv_11), Tolerance=number_slider_14)  # -> ListOfPoints, LoopPointStructure, PointLoopStructure; disabled
poly_topo_point_4 = PolygonTopologyPoint(ListOfPolylines=flatten(crv_12), Tolerance=number_slider_15)  # -> ListOfPoints, LoopPointStructure, PointLoopStructure; disabled
poly_topo_point_5 = PolygonTopologyPoint(ListOfPolylines=flatten(crv_12), Tolerance=number_slider_16)  # -> ListOfPoints, LoopPointStructure, PointLoopStructure; disabled
cp_2 = ClosestPoint(Point=poly_topo_point_3.ListOfPoints, Cloud=poly_topo_point_2.ListOfPoints)  # -> ClosestPoint, CPIndex, Distance; disabled
cp_3 = ClosestPoint(Point=poly_topo_point_5.ListOfPoints, Cloud=poly_topo_point_4.ListOfPoints)  # -> ClosestPoint, CPIndex, Distance; disabled
item_27 = ListItem(List=poly_topo_point_2.ListOfPoints, Index=cp_2.CPIndex, Wrap=True)  # disabled
item_28 = ListItem(List=poly_topo_point_4.ListOfPoints, Index=cp_3.CPIndex, Wrap=True)  # disabled
ln = Line(StartPoint=poly_topo_point_3.ListOfPoints, EndPoint=item_27)  # disabled
ln_2 = Line(StartPoint=poly_topo_point_5.ListOfPoints, EndPoint=item_28)  # disabled
clean_10 = CleanTree(RemoveNulls=True, RemoveInvalid=True, RemoveEmpty=False, Tree=ln)  # disabled
clean_11 = CleanTree(RemoveNulls=True, RemoveInvalid=True, RemoveEmpty=False, Tree=ln_2)  # disabled
len_6 = Length(Curve=clean_10)  # disabled
len_7 = Length(Curve=clean_11)  # disabled
sort_7 = SortList(Keys=len_6)  # -> reverse(Keys), ValuesA; disabled
sort_8 = SortList(Keys=len_7)  # -> reverse(Keys), ValuesA; disabled

poly_topo_edge_6 = PolygonTopologyEdge(ListOfPolylines=flatten(crv_11), Tolerance=0.001)  # -> ListOfEdges, LoopEdgeStructure, EdgeLoopStructure; disabled
poly_topo_edge_filter_6 = PolygonTopologyEdgeFilter(EdgeList=poly_topo_edge_6.ListOfEdges, EdgeLoopStructure=poly_topo_edge_6.EdgeLoopStructure, ValencyFilter=1)  # -> ListOfEdgeIDs, ListOfEdges; disabled
previewlw_8 = CustomPreviewLineweights(Geometry=poly_topo_edge_filter_6.ListOfEdges, Shader=swatch_6, Thickness=10, Absolute=False)  # disabled

poly_topo_edge_7 = PolygonTopologyEdge(ListOfPolylines=flatten(crv_12), Tolerance=0.001)  # -> ListOfEdges, LoopEdgeStructure, EdgeLoopStructure; disabled
poly_topo_edge_filter_7 = PolygonTopologyEdgeFilter(EdgeList=poly_topo_edge_7.ListOfEdges, EdgeLoopStructure=poly_topo_edge_7.EdgeLoopStructure, ValencyFilter=1)  # -> ListOfEdgeIDs, ListOfEdges; disabled
previewlw_9 = CustomPreviewLineweights(Geometry=poly_topo_edge_filter_7.ListOfEdges, Shader=swatch_5, Thickness=10, Absolute=False)  # disabled

midpt_2 = CurveMiddle(Curve=clean_10)  # disabled
midpt_3 = CurveMiddle(Curve=clean_11)  # disabled
panel_46 = Panel(sort_7.Keys)  # disabled
panel_47 = Panel(sort_8.Keys)  # disabled
geo_33 = Geometry(move_17.Geometry)

# ----
# Acoustic Panel
offset_from_beams = Slider(0.02, range=0..0.1)

tstat_15 = TreeStatistics(Tree=clean_7)  # -> Paths, Length, Count
split_16 = SplitTree(Data=simplify(dso_40.Polyline), Masks=flatten(tstat_15.Paths))  # -> Positive, Negative
planar_2 = IsPlanar(Surface=split_16.Positive, Interior=True)  # -> Planar, Plane
xy_3 = XYPlane(Origin=Point(0, 0, 0))

split_17 = SplitTree(Data=division_9, Masks=flatten(tstat_15.Paths))  # -> Positive, Negative
addition_5 = Addition(A=offset_from_beams, B=split_17.Positive)

neg_7 = Negative(Value=addition_5)
c_script_13 = CSharpScript(x=split_16.Positive, y=neg_7, z=planar_2.Plane)  # -> out, A; inputs x: Polyline, y: list of Double, z: Plane; same code as c_script_11
boundary_12 = BoundarySurfaces(Edges=c_script_13.A)
flip_3 = Flip(Surface=boundary_12, Guide=xy_3)  # -> Surface, Result

explode_3 = Explode(Curve=split_16.Positive, Recursive=True)  # -> Segments, Vertices
midpt_4 = CurveMiddle(Curve=explode_3.Segments)

geo_34 = Geometry(geo_32)
crv_13 = Curve(simplify(dso_40.Polyline))
area_21 = Area(Geometry=flatten(crv_13))  # -> Area, Centroid
number_slider_17 = Slider(20, range=0..100)

split_18 = SplitTree(Data=flip_2.Surface, Masks=flatten(data_2))  # -> Positive, Negative
offsrf_8 = OffsetSurface(Surface=split_18.Negative, Distance=panel_37, BothSides=panel_38, CreateSolid=True)

clean_12 = CleanTree(RemoveNulls=True, RemoveInvalid=True, RemoveEmpty=True, Tree=dso_40.Vent)  # -> simplify(Tree)
tstat_16 = TreeStatistics(Tree=crv_13)  # -> Paths, Length, Count
boundary_13 = BoundarySurfaces(Edges=clean_12)

area_22 = Area(Geometry=flatten(clean_12))  # -> Area, Centroid
cp_4 = ClosestPoint(Point=area_22.Centroid, Cloud=area_21.Centroid)  # -> ClosestPoint, CPIndex, Distance
item_29 = ListItem(List=tstat_16.Paths, Index=cp_4.CPIndex, Wrap=True)
clean_13 = CleanTree(RemoveNulls=True, RemoveInvalid=True, RemoveEmpty=False, Tree=boundary_13)

# ----
# Acoustic Battens + Screws
merge_20 = Merge(Data1=panel_9, Data2=panel_10, Data3=panel_11)

split_19 = SplitTree(Data=simplify(c_script_13.A), Masks=flatten(merge_20))  # -> Positive, Negative
tstat_17 = TreeStatistics(Tree=simplify(split_19.Negative))  # -> Paths, Length, Count
panel_48 = Panel(tstat_17.Paths)

entwine = Entwine(Branch00=panel_48, Branch01=panel_9, Branch02=panel_10, Branch03=panel_11, FlattenInputs=True)
entwine_2 = Entwine(
    Branch00=Slider(625, range=0..1000),
    Branch01=Slider(400, range=0..1000),
    Branch02=Slider(625, range=0..1000),
    Branch03=Slider(400, range=0..1000),
    FlattenInputs=True)
entwine_3 = Entwine(
    Branch00=Slider(60, range=0..100),
    Branch01=Slider(60, range=0..100),
    Branch02=Slider(60, range=0..100),
    Branch03=Slider(60, range=0..100),
    FlattenInputs=True)

c_script_14 = CSharpScript(path=entwine, spacing=entwine_2, height=entwine_3)  # -> out, A, B; inputs path: list of String, spacing: Double, height: Double
# ---------- c_script_14: C# ----------
    DataTree<double> spacings = new DataTree<double>();
    DataTree<double> heights = new DataTree<double>();

    for (int i = 0; i < path.Count; i++)
    {
      spacings.Add(spacing / 1000, new GH_Path(ConvertStringToIntArray(path[i])));
      heights.Add(height / 1000, new GH_Path(ConvertStringToIntArray(path[i])));

    }

    A = spacings;
    B = heights;
# ---------- c_script_14: C# additional code ----------
  public static int[] ConvertStringToIntArray(string input)
  {
    if (string.IsNullOrWhiteSpace(input))
      return new int[0];

    input = input.Trim('{', '}');
    string[] parts = input.Split(';');
    int[] intArray = new int[parts.Length];

    for (int i = 0; i < parts.Length; i++)
    {
      if (!int.TryParse(parts[i], out intArray[i]))
      {
        throw new FormatException("Input string contains invalid numbers.");
      }
    }

    return intArray;
  }
# ---------- end c_script_14 ----------

subtraction = Subtraction(A=panel_37, B=c_script_14.B)
subtraction_2 = Subtraction(A=subtraction, B=dso_41.AcousticThickness)
acoustic_top = Panel(subtraction)
acoustic_bottom = Panel(subtraction_2)
pl_offset_2 = PlaneOffset(BasePlane=planar_2.Plane, Offset=acoustic_bottom)

data_14 = Data(c_script_14.A)
data_15 = Data(c_script_14.B)

offsrf_9 = OffsetSurface(Surface=flip_3.Surface, Distance=1, BothSides=acoustic_bottom, CreateSolid=True)  # -> simplify(Offset)

crv_14 = Curve(dso_40.Polyline)
area_23 = Area(Geometry=crv_14)  # -> Area, Centroid
tstat_18 = TreeStatistics(Tree=area_23.Centroid)  # -> Paths, Length, Count

xy_4 = XYPlane(Origin=Point(0, 0, 0))
project_8 = Project(Geometry=item_20, Plane=xy_4)  # -> Geometry, Transform
Z_6 = UnitZ(Factor=Slider(20, range=0..100))

area_24 = Area(Geometry=project_8.Geometry)  # -> Area, Centroid
scale_nu_12 = ScaleNU(Geometry=project_8.Geometry, Plane=area_24.Centroid, ScaleX=2, ScaleY=1, ScaleZ=1)  # -> Geometry, Transform

offsrf_10 = OffsetSurface(Surface=clean_13, Distance=2, BothSides=-2, CreateSolid=True)

project_9 = Project(Geometry=scale_nu_12.Geometry, Plane=xy_4)  # -> Geometry, Transform

split_20 = SplitTree(Data=geo_34, Masks=flatten(tstat_14.Paths))  # -> Positive, Negative

split_21 = SplitTree(Data=split_20.Negative, Masks=flatten(item_29))  # -> Positive, Negative
sdiff = SolidDifference(BrepsA=split_21.Positive, BrepsB=flatten(offsrf_10))
merge_21 = Merge(Data1=split_21.Negative, Data2=sdiff)

polyoffset_2 = PolylineOffset(
    Polylines=project_9.Geometry,
    Distance=Slider(1, range=0..1),
    Plane=xy_4,
    Tolerance=0.0001,
    ClosedFillet=1,
    OpenFillet=1,
    Miter=2)  # -> Contour, Holes
rdiff_2 = RegionDifference(CurvesA=polyoffset_2.Contour, CurvesB=project_9.Geometry)
boundary_14 = BoundarySurfaces(Edges=rdiff_2)
move_18 = Move(Geometry=boundary_14, Motion=expr("-x", Z_6))  # -> Geometry, Transform
extr_4 = Extrude(Base=move_18.Geometry, Direction=expr("2*x", Z_6))  # -> simplify(Extrusion)

toggle = GroupToggle(ToggleActive=True, ToggleVisible=False)  # disabled
txt_2 = Text(cluster_5.A)

sort_val = SortDuplicateValues(ValueList=flatten(dso_15.Crown_plates_path))  # -> UniqueValues, Indices
split_22 = SplitTree(Data=simplify(txt_2), Masks=flatten(sort_val.UniqueValues))  # -> Positive, Negative
c_script_15 = CSharpScript(x=split_22.Positive, y="_column")  # -> out, A; inputs x: String, y: String
# ---------- c_script_15: C# ----------
    if(!x.Contains(y))
      A = x + y;
    else
      A = x;
# ---------- end c_script_15 ----------
merge_22 = Merge(Data1=c_script_15.A, Data2=split_22.Negative)

split_23 = SplitTree(Data=simplify(merge_22), Masks=flatten("{0,8;*}"))  # -> Positive, Negative
c_script_16 = CSharpScript(x=split_23.Positive, y="_brim")  # -> out, A; inputs x: String, y: String; same code as c_script_15
merge_23 = Merge(Data1=c_script_16.A, Data2=split_23.Negative)

# ----
# Stiffener Solid Operator
geo_35 = Geometry(dso_19.Stiffener_solidOperator)

split_24 = SplitTree(Data=simplify(geo_35), Masks=flatten("{0,7;*}"))  # -> Positive, Negative
area_25 = Area(Geometry=split_24.Positive)  # -> Area, Centroid
pdecon_4 = Deconstruct(Point=area_25.Centroid)  # -> XComponent, YComponent, ZComponent
sort_9 = SortList(Keys=pdecon_4.ZComponent, ValuesA=split_24.Positive)  # -> Keys, ValuesA
split_25 = SplitList(List=sort_9.ValuesA, Index=4)  # -> simplify(ListA), ListB
merge_24 = Merge(Data1=split_24.Negative, Data2=split_25.ListA)

move_19 = Move(Geometry=merge_24, Motion=expr("-x", vec_2.Vector))  # -> Geometry, Transform

area_26 = Area(Geometry=move_19.Geometry)  # -> Area, Centroid
pdecon_5 = Deconstruct(Point=area_26.Centroid)  # -> XComponent, YComponent, ZComponent
pt_2 = ConstructPoint(XCoordinate=pdecon_5.XComponent, YCoordinate=pdecon_5.YComponent, ZCoordinate=extremums.Minimum)
xz_3 = XZPlane(Origin=pt_2)
brec_7 = BoundingRectangle(Geometry=graft(move_19.Geometry), Plane=graft(xz_3), Axis=0, Slide=0, Union=True)  # -> Bounding, DimensionX, DimensionY
division_10 = Division(A=Slider(30, range=0..100), B=brec_7.DimensionY)
pln_8 = Plane(xz_3)

move_20 = Move(Geometry=geo_35, Motion=expr("-x", vec_2.Vector))  # -> Geometry, Transform
sovk = SpeckleObjectValueByKey(Object=dso_19.Crown_plates, Key="PreCut", selectedKitName="Objects")  # disabled
geo_36 = Geometry(dso_19.Stiffeners)  # disabled
move_21 = Move(Geometry=geo_36, Motion=expr("-x", vec_2.Vector))  # -> Geometry, Transform; disabled
move_22 = Move(Geometry=sovk, Motion=expr("-x", vec_2.Vector))  # -> Geometry, Transform; disabled
debrep_3 = DeconstructBrep(Brep=move_19.Geometry)  # -> Faces, Edges, Vertices
area_27 = Area(Geometry=debrep_3.Faces)  # -> Area, Centroid
smaller_2 = SmallerThan(FirstNumber=area_27.Area, SecondNumber=0.001)  # -> SmallerThan, OrEqualTo
cull_4 = CullPattern(List=debrep_3.Faces, CullPattern=invert(smaller_2.SmallerThan))
area_28 = Area(Geometry=cull_4)  # -> Area, Centroid
pdecon_6 = Deconstruct(Point=area_28.Centroid)  # -> XComponent, YComponent, ZComponent
sort_10 = SortList(Keys=pdecon_6.ZComponent, ValuesA=cull_4, ValuesB=area_28.Centroid)  # -> Keys, reverse(ValuesA), reverse(ValuesB)
item_30 = ListItem(List=sort_10.ValuesB, Index=0, Wrap=True)
item_31 = ListItem(List=sort_10.ValuesA, Index=0, Wrap=True)
explode_4 = Explode(Curve=item_31, Recursive=True)  # -> simplify(Segments), Vertices
pln_9 = Plane(item_31)

len_8 = Length(Curve=explode_4.Segments)
sort_11 = SortList(Keys=len_8, ValuesA=explode_4.Segments)  # -> Keys, reverse(ValuesA)

item_32 = ListItem(List=sort_11.ValuesA, Index=0, Wrap=True)  # -> simplify(Item)
end = EndPoints(Curve=item_32)  # -> Start, End
merge_25 = Merge(Data1=end.Start, Data2=end.End)
sort_pt_4 = SortPoints(Points=merge_25)  # -> Points, Indices
item_33 = ListItem(List=sort_pt_4.Points, Index=0, Wrap=True)  # -> Item, Item1
vec2pt_2 = Vector2Pt(PointA=item_33.Item, PointB=item_33.Item1, Unitize=False)  # -> Vector, Length
pl_4 = ConstructPlane(Origin=item_30, XAxis=vec2pt_2.Vector, YAxis=Vector(0, 1, 0))

cso_6 = CreateSpeckleObject(
    FrameBase=pln_8,
    FrameEnd=pl_4,
    Geo=move_19.Geometry,
    OffsetPositive=division_7,
    OffsetNegative=neg_3,
    Name="Stiffener",
    Type="Planar",
    selectedKitName="Objects")  # -> flatten(SpeckleObject)

# ----
# Solid Operators
geo_37 = Geometry(offsrf_3)
geo_38 = Geometry(extr)

# ----
# Brim Zugband Cut - A612
bbox_2 = BoundingBox(Content=scale_nu_10.Geometry, Plane=PlaneXY(0, 0, 0), UnionBox=True)  # -> Box, Box_2
box_corners = BoxCorners(Box=bbox_2.Box)  # -> CornerA, CornerB, CornerC, CornerD, CornerE, CornerF, CornerG, CornerH
item_34 = ListItem(List=flatten(box_corners.CornerE), Index=0, Wrap=True)
pdecon_7 = Deconstruct(Point=item_34)  # -> XComponent, YComponent, ZComponent

bbox_3 = BoundingBox(Content=geo_17, Plane=pl)  # -> Box, Box_2
area_29 = Area(Geometry=geo_17)  # -> Area, Centroid
debox_2 = DeconstructBox(Box=bbox_3.Box)  # -> Plane, X, Y, Z
dedomain = DeconstructDomain(Domain=debox_2.Z)  # -> Start, End
subtraction_3 = Subtraction(A=dedomain.End, B=dedomain.Start)
item_35 = ListItem(List=flatten(trim_2), Index=0, Wrap=True)
division_11 = Division(A=item_35, B=1000)

# ----
# Tension Band Solid Operator
number_slider_18 = Slider(2, range=0..10)
area_30 = Area(Geometry=geo_17)  # -> Area, Centroid

multiplication = Multiplication(A=number_slider_18, B=tension_band_top_and_bttom_tolerance)
addition_6 = Addition(A=subtraction_3, B=multiplication)
division_12 = Division(A=addition_6, B=subtraction_3)
scale_nu_13 = ScaleNU(Geometry=geo_17, Plane=area_29.Centroid, ScaleX=1, ScaleY=1, ScaleZ=division_12)  # -> Geometry, Transform
filter = StreamFilter(Gate=addtop_and_bottom_tol, Stream0=scale_nu_7.Geometry, Stream1=scale_nu_13.Geometry)
offsrf_11 = OffsetSurface(Surface=filter, Distance=expr("x/2", division_11), BothSides=expr("-x/2", division_11), CreateSolid=True)

pl_origin_3 = PlaneOrigin(Base=filter, Origin=area_30.Centroid)
split_26 = SplitTree(Data=simplify(offsrf_11), Masks=flatten("{!0,7}"))  # -> Positive, Negative
split_27 = SplitTree(Data=simplify(pl_origin_3), Masks=flatten("{!0,7}"))  # -> Positive, Negative

# ---- group: Top Notch
split_28 = SplitTree(Data=simplify(avr), Masks=flatten("{!0,7}"))  # -> Positive, Negative
Z_7 = UnitZ(Factor=1)
pl_5 = PlaneNormal(Origin=split_28.Positive, ZAxis=Z_7)
deplane_4 = DeconstructPlane(Plane=split_27.Positive)  # -> Origin, XAxis, YAxis, ZAxis
align_2 = AlignPlane(Plane=pl_5, Direction=deplane_4.XAxis)  # -> Plane, Angle

# ----
pln_10 = Plane(split_27.Positive)
pln_11 = Plane(align_2.Plane)
geo_39 = Geometry(split_26.Positive)
pln_12 = Plane(split_27.Negative)
geo_40 = Geometry(split_26.Negative)

cso_7 = CreateSpeckleObject(
    FrameBase=pln_10,
    FrameEnd=pln_11,
    Geo=geo_39,
    OffsetPositive=split_4.Positive,
    OffsetNegative=split_4.Positive,
    Name="Tension Band",
    Type="Planar",
    selectedKitName="Objects")

cso_8 = CreateSpeckleObject(
    FrameBase=pln_12,
    Geo=geo_40,
    OffsetPositive=split_4.Negative,
    OffsetNegative=split_4.Negative,
    Name="Tension Band Brims",
    Type="Planar",
    selectedKitName="Objects")

merge_26 = Merge(Data1=cso_7, Data2=cso_8)  # -> flatten(Result)

geo_41 = Geometry(offsrf_11)

geo_42 = Geometry(move_19.Geometry)

crv_15 = Curve(clscrv_2.Closed)

boundary_15 = BoundarySurfaces(Edges=crv_15)
clean_14 = CleanTree(RemoveNulls=True, RemoveInvalid=True, RemoveEmpty=True, Tree=string_filter.Object)  # -> simplify(Tree)
area_31 = Area(Geometry=boundary_15)  # -> Area, Centroid
pln_13 = Plane(simplify(pl_origin_2))
boundary_16 = BoundarySurfaces(Edges=clean_14)
msphere = MeshSphere(Base=area_31.Centroid, Radius=0.05, UCount=3, VCount=3)
clash_2 = Clash(FirstSet=boundary_16, SecondSet=flatten(msphere), Distance=0, L=100)  # -> ClashCount, ClashPoints, ClashRadii, FirstIndex, SecondIndex
item_36 = ListItem(List=flatten(crv_15), Index=clash_2.SecondIndex, Wrap=True)
clean_15 = CleanTree(RemoveNulls=True, RemoveInvalid=True, RemoveEmpty=True, Tree=item_36)
boundary_17 = BoundarySurfaces(Edges=clean_15)
join_9 = BrepJoin(Breps=boundary_17)  # -> Breps, Closed
fmerge_3 = MergeFaces(Brep=join_9.Breps)  # -> Breps, Before, After
edges_4 = BrepEdges(Brep=fmerge_3.Breps)  # -> Naked, Interior, NonManifold
trim_11 = TrimTree(Tree=simplify(edges_4.Naked), Depth=1)

# ----
# Ridge Fins & Column Head Solid Operator
join_10 = JoinCurves(Curves=trim_11, Preserve=False)  # -> simplify(Curves)
item_37 = ListItem(List=item_36, Index=0, Wrap=True)
tstat_19 = TreeStatistics(Tree=simplify(clean_15))  # -> Paths, Length, Count
split_29 = SplitTree(Data=pln_13, Masks=flatten(tstat_19.Paths))  # -> Positive, Negative
runion = RegionUnion(Curves=clean_15, Plane=split_29.Positive)

disc_6 = Discontinuity(Curve=runion, Level=1)  # -> Points, Parameters
plfit_3 = PlaneFit(Points=disc_6.Points)  # -> Plane, Deviation
polyoffset_3 = PolylineOffset(
    Polylines=graft(runion),
    Distance=fin_tolerance,
    Plane=graft(plfit_3.Plane),
    Tolerance=0.001,
    ClosedFillet=2,
    OpenFillet=1,
    Miter=2)  # -> simplify(Contour), Holes
boundary_18 = BoundarySurfaces(Edges=polyoffset_3.Contour)
crv_16 = Curve(polyoffset_3.Holes)
offsrf_12 = OffsetSurface(Surface=boundary_18, Distance=expr("x/2", panel_16), BothSides=expr("-x/2", panel_16), CreateSolid=True)  # -> simplify(Offset)

explode_5 = Explode(Curve=runion, Recursive=True)  # -> Segments, Vertices
len_9 = Length(Curve=explode_5.Segments)
sort_12 = SortList(Keys=len_9, ValuesA=explode_5.Segments)  # -> Keys, reverse(ValuesA)
item_38 = ListItem(List=sort_12.ValuesA, Index=0, Wrap=True)

c_script_17 = CSharpScript(x=item_38)  # -> out, A; inputs x: Vector3d
# ---------- c_script_17: C# ----------
    Vector3d dir = new Vector3d(x);
    if(x.IsParallelTo(Vector3d.YAxis, Math.PI / 2) < 0) dir.Reverse();
    A = dir;
# ---------- end c_script_17 ----------
area_32 = Area(Geometry=runion)  # -> Area, Centroid
division_13 = Division(A=panel_16, B=2)
pl_origin_4 = PlaneOrigin(Base=plfit_3.Plane, Origin=area_32.Centroid)
align_3 = AlignPlane(Plane=pl_origin_4, Direction=c_script_17.A)  # -> Plane, Angle
bbox_4 = BoundingBox(Content=offsrf_12, Plane=align_3.Plane)  # -> Box, Box_2
neg_8 = Negative(Value=division_13)

tstat_20 = TreeStatistics(Tree=simplify(plfit_3.Plane))  # -> Paths, Length, Count
split_30 = SplitTree(Data=simplify(clean_14), Masks=flatten(tstat_20.Paths))  # -> Positive, Negative
deplane_5 = DeconstructPlane(Plane=align_3.Plane)  # -> Origin, XAxis, YAxis, ZAxis
box_corners_2 = BoxCorners(Box=bbox_4.Box)  # -> CornerA, CornerB, CornerC, CornerD, CornerE, CornerF, CornerG, CornerH
line = LineSDL(Start=deplane_5.Origin, Direction=deplane_5.XAxis, Length=1)
brec_8 = BoundingRectangle(Geometry=split_30.Positive, Plane=align_3.Plane, Axis=0, Slide=0, Union=True)  # -> Bounding, DimensionX, DimensionY
brec_9 = BoundingRectangle(Geometry=bbox_4.Box, Plane=align_3.Plane, Axis=0, Slide=0, Union=True)  # -> Bounding, DimensionX, DimensionY
pl_3pt = Plane3Pt(PointA=box_corners_2.CornerC, PointB=box_corners_2.CornerD, PointC=box_corners_2.CornerG)
clx = CurveLine(Curve=simplify(brec_8.Bounding), Line=simplify(line))  # -> Points, Params, Count
item_39 = ListItem(List=clx.Points, Index=0, Wrap=True)  # -> Item, Item1
ln_3 = Line(StartPoint=item_39.Item, EndPoint=item_39.Item1)
midpt_5 = CurveMiddle(Curve=ln_3)
pl_origin_5 = PlaneOrigin(Base=align_3.Plane, Origin=midpt_5)

debrep_4 = DeconstructBrep(Brep=bbox_4.Box)  # -> Faces, Edges, Vertices
deplane_6 = DeconstructPlane(Plane=align_3.Plane)  # -> Origin, XAxis, YAxis, ZAxis
area_33 = Area(Geometry=debrep_4.Faces)  # -> Area, Centroid
pdecon_8 = Deconstruct(Point=area_33.Centroid)  # -> XComponent, YComponent, ZComponent
sort_13 = SortList(Keys=pdecon_8.ZComponent, ValuesA=area_33.Centroid)  # -> Keys, reverse(ValuesA)
brep = Brep(bbox_4.Box)
item_40 = ListItem(List=sort_13.ValuesA, Index=0, Wrap=True)
pl_6 = ConstructPlane(Origin=simplify(item_40), XAxis=deplane_6.XAxis, YAxis=deplane_6.ZAxis)

cso_9 = CreateSpeckleObject(
    FrameBase=pl_origin_5,
    FrameEnd=pl_6,
    Line=ln_3,
    Geo=brep,
    OffsetPositive=division_13,
    OffsetNegative=neg_8,
    Name="Slits",
    Type="Planar",
    selectedKitName="Objects")  # -> simplify(SpeckleObject)

merge_27 = Merge(Data1=offsrf_12, Data2=offsrf_4)
tstat_21 = TreeStatistics(Tree=merge_27)  # -> Paths, Length, Count

geo_43 = Geometry(dso_36.Pipes)
geo_44 = Geometry(dso_36.Ventilation_duct)
geo_45 = Geometry(dso_36.Elevator_vent)
merge_28 = Merge(Data1=geo_44, Data2=geo_43, Data3=geo_45)
split_31 = SplitTree(Data=simplify(pl_origin_2), Masks=flatten("{6;*}"))  # -> Positive, Negative

move_23 = Move(Geometry=merge_28, Motion=expr("-x", vec_2.Vector))  # -> Geometry, Transform

geo_46 = Geometry(dso_36.Brim_cutout)

move_24 = Move(Geometry=geo_46, Motion=expr("-x", vec_2.Vector))  # -> Geometry, Transform

bbox_5 = BoundingBox(Content=move_24.Geometry, Plane=PlaneXY(0, 0, 0))  # -> Box, Box_2
area_34 = Area(Geometry=move_24.Geometry)  # -> Area, Centroid
debox_3 = DeconstructBox(Box=bbox_5.Box)  # -> Plane, X, Y, Z
num_5 = Number(debox_3.Z)
xy_5 = XYPlane(Origin=area_34.Centroid)
division_14 = Division(A=num_5, B=2)
neg_9 = Negative(Value=division_14)

pln_14 = Plane(xy_5)

cso_10 = CreateSpeckleObject(
    FrameBase=pln_14,
    Geo=move_24.Geometry,
    OffsetPositive=division_14,
    OffsetNegative=neg_9,
    Name="Brim Cutouts",
    Type="Hole",
    selectedKitName="Objects")

merge_29 = Merge(Data1=join_5.Breps, Data2=dso_36.PVDucts, Data3=move_9.Geometry)  # -> flatten(Result)

move_25 = Move(Geometry=merge_29, Motion=expr("-x", vec_2.Vector))  # -> Geometry, Transform

debrep_5 = DeconstructBrep(Brep=move_25.Geometry)  # -> Faces, Edges, Vertices
area_35 = Area(Geometry=debrep_5.Faces)  # -> Area, Centroid
pdecon_9 = Deconstruct(Point=area_35.Centroid)  # -> XComponent, YComponent, ZComponent
sort_14 = SortList(Keys=pdecon_9.ZComponent, ValuesA=debrep_5.Faces)  # -> Keys, ValuesA
item_41 = ListItem(List=sort_14.ValuesA, Index=0, Wrap=True)
c_script_18 = CSharpScript(x=item_41)  # -> out, flatten(A); inputs x: Plane
# ---------- c_script_18: C# ----------
    if(Vector3d.Multiply(x.ZAxis, Vector3d.ZAxis) < 0) x.Flip();
    A = x;
# ---------- end c_script_18 ----------

pln_15 = Plane(c_script_18.A)

cso_11 = CreateSpeckleObject(
    FrameBase=pln_15,
    Geo=move_25.Geometry,
    OffsetPositive=number_slider_7,
    OffsetNegative=number_slider_7,
    Name="Pipes",
    Type="Hole",
    selectedKitName="Objects")

cap_3 = CapHoles(Brep=merge_11)

cap_4 = CapHoles(Brep=merge_11)

crv_17 = Curve(flatten(dso_28.Precut_outlines))
project_10 = Project(Geometry=crv_17, Plane=PlaneXY(0, 0, 0))  # -> Geometry, Transform
boundary_19 = BoundarySurfaces(Edges=project_10.Geometry)
join_11 = BrepJoin(Breps=boundary_19)  # -> Breps, Closed
fmerge_4 = MergeFaces(Brep=join_11.Breps)  # -> Breps, Before, After
Z_8 = UnitZ(Factor=50)

crv_18 = Curve(fmerge_4.Breps)
simplify_3 = SimplifyCurve(Curve=crv_18)  # -> Curve, Simplified
polyoffset_4 = PolylineOffset(
    Polylines=simplify_3.Curve,
    Distance=Slider(0.01, range=0..0.1),
    Plane=Plane(origin=(0, 0, 0), x=(0, 0, 0), y=(0, 0, 0)),
    Tolerance=0.001,
    ClosedFillet=1,
    OpenFillet=1,
    Miter=2)  # -> Contour, Holes
boundary_20 = BoundarySurfaces(Edges=polyoffset_4.Contour)

extr_5 = Extrude(Base=boundary_20, Direction=Z_8)  # -> flatten(Extrusion)

crv_19 = Curve(dso_40.Polyline)
crv_20 = Curve(tree_6)
vec_4 = Vector(vec_2.Vector)
geo_47 = Geometry(extr_5)

filter_2 = StreamFilter(Gate=finger_joints, Stream1=geo_47)
filter_3 = StreamFilter(Gate=finger_joints, Stream1=crv_19)
filter_4 = StreamFilter(Gate=finger_joints, Stream1=crv_20)
move_26 = Move(Geometry=filter_4, Motion=vec_2.Vector)  # -> Geometry, Transform
previewlw_10 = CustomPreviewLineweights(Geometry=move_26.Geometry, Shader=ColourSwatch(SwatchColor=RGB(255, 255, 255)), Thickness=10, Absolute=False)
filter_5 = StreamFilter(Gate=finger_joints, Stream1=vec_4)

shell = Slider(1, range=0..10)
shell_2 = Slider(2, range=0..10)
shell_3 = Slider(3, range=0..10)
shell_4 = Slider(4, range=0..10)
shell_5 = Slider(5, range=0..10)
shell_6 = Slider(6, range=0..10)
shell_7 = Slider(7, range=0..10)
path_2 = ConstructPath(Indices=shell)
path_3 = ConstructPath(Indices=shell_2)
path_4 = ConstructPath(Indices=shell_3)
path_5 = ConstructPath(Indices=shell_4)
path_6 = ConstructPath(Indices=shell_5)
path_7 = ConstructPath(Indices=shell_6)
path_8 = ConstructPath(Indices=shell_7)
branch = TreeBranch(Tree=simplify(filter_4), Path=path_2, MaintainPaths=True)
branch_2 = TreeBranch(Tree=simplify(filter_4), Path=path_3, MaintainPaths=True)
branch_3 = TreeBranch(Tree=simplify(filter_4), Path=path_4, MaintainPaths=True)
branch_4 = TreeBranch(Tree=simplify(filter_4), Path=path_5, MaintainPaths=True)
branch_5 = TreeBranch(Tree=simplify(filter_4), Path=path_6, MaintainPaths=True)
branch_6 = TreeBranch(Tree=simplify(filter_4), Path=path_7, MaintainPaths=True)
branch_7 = TreeBranch(Tree=simplify(filter_4), Path=path_8, MaintainPaths=True)

data_16 = Data(item)
data_17 = Data(tstat.Paths)
data_18 = Data(tree_5)
data_19 = Data(dso_8.Paths)

clean_16 = CleanTree(RemoveNulls=True, RemoveInvalid=True, RemoveEmpty=True, Tree=data_19)  # -> simplify(flatten(Tree))
split_32 = SplitTree(Data=simplify(crv_6), Masks=flatten(clean_16))  # -> Positive, Negative
clean_17 = CleanTree(RemoveNulls=True, RemoveInvalid=True, RemoveEmpty=True, Tree=data_19)  # -> simplify(flatten(Tree))
data_20 = Data(clean_16)

# ----
# Build up
number_slider_19 = Slider(0.049, range=0..0.1)
item_42 = ListItem(List=data_11, Index=0, Wrap=True)  # -> Item, Item1, Item2, Item3

subtraction_4 = Subtraction(A=panel_33, B=dso_41.Top_layer, C=number_slider_19)

buildup_3 = DefineCassetteBuildup(LayerThickness=number_slider_19, Layer1=subtraction_4, Top_layer=dso_41.Top_layer, includeCenterValues=False)  # -> BuildupKey, BuildupValue

item_43 = ListItem(List=buildup_3.BuildupValue, Index=0, Wrap=True)  # -> Item, Item1, Item2, Item3
offsrf_13 = OffsetSurface(Surface=split_18.Positive, Distance=item_43.Item2, BothSides=item_43.Item1, CreateSolid=True)
merge_30 = Merge(Data1=simplify(offsrf_8), Data2=simplify(offsrf_13))  # -> flatten(Result)

item_44 = ListItem(List=buildup_3.BuildupValue, Index=0, Wrap=True)  # -> Item, Item1, Item2, Item3

filter_6 = StreamFilter(Gate=thicker_bottom_plate, Stream0=offsrf_7, Stream1=merge_30)

tree_7 = CreateTree(Data=filter_6, Path=tstat_14.Paths)
merge_31 = Merge(Data1=match, Data2=tree_7)
sunion = SolidUnion(Breps=merge_31)
sdiff_2 = SolidDifference(BrepsA=split_20.Positive, BrepsB=sunion)

merge_32 = Merge(Data1=merge_21, Data2=sdiff_2)

tstat_22 = TreeStatistics(Tree=merge_32)  # -> Paths, Length, Count
trim_12 = TrimTree(Tree=merge_32, Depth=1)
python_3 = GhPythonScript(x=merge_32)  # -> out, a; inputs x: Brep
# ---------- python_3: Python ----------
a = x.Vertices;
# ---------- end python_3 ----------
lng = ListLength(List=trim_12)

dup = DuplicateData(Data=extr_4, Number=lng, Order=True)  # -> simplify(graft(Data))

brepinc_2 = PointInBrep(Brep=dup, Point=python_3.a, Strict=True)
ma_3 = MassAddition(Input=brepinc_2)  # -> Result, PartialResults
larger = LargerThan(FirstNumber=ma_3.Result, SecondNumber=0)  # -> LargerThan, OrEqualTo
cull_5 = CullPattern(List=tstat_22.Paths, CullPattern=flatten(larger.LargerThan))

split_33 = SplitTree(Data=dup, Masks=flatten(cull_5))  # -> Positive, Negative
split_34 = SplitTree(Data=merge_32, Masks=flatten(cull_5))  # -> Positive, Negative
sdiff_3 = SolidDifference(BrepsA=split_34.Positive, BrepsB=split_33.Positive)
clean_18 = CleanTree(RemoveNulls=True, RemoveInvalid=True, RemoveEmpty=False, Tree=sdiff_3)
merge_33 = Merge(Data1=clean_18, Data2=split_34.Negative)

geo_48 = Geometry(merge_33)

dispatch = Dispatch(List=flatten(geo_48), DispatchPattern=dso_5.IsOutsourced)  # -> ListA, ListB
preview_3 = CustomPreview(
    Geometry=dispatch.ListA,
    Material={diffuse=RGB(221, 160, 221), emission=RGB(66, 48, 66), shine=0.5, specular=RGB(255, 255, 255), transparency=0})
preview_4 = CustomPreview(Geometry=dispatch.ListB, Material=ColourSwatch(SwatchColor=RGBA(255, 255, 255, 64)))

clean_19 = CleanTree(RemoveNulls=True, RemoveInvalid=True, RemoveEmpty=True, Tree=flatten(geo_48))
lng_2 = ListLength(List=flatten(geo_48))
lng_3 = ListLength(List=clean_19)
panel_49 = Panel([lng_3, lng_2])

preview_5 = CustomPreview(Geometry=merge_33, Material=ColourSwatch(SwatchColor=RGBA(89, 94, 153, 61)))

geo_49 = Geometry(geo_48)

string_filter_2 = StringFilter(Text=txt_2, Object=geo_49, Key="ridge")  # -> Text, Object
clean_20 = CleanTree(RemoveNulls=True, RemoveInvalid=True, RemoveEmpty=True, Tree=string_filter_2.Object)  # -> simplify(Tree)

split_35 = SplitTree(Data=clean_20, Masks=flatten("{0,8;*}"))  # -> Positive, Negative
move_27 = Move(Geometry=split_35.Positive, Motion=vec_2.Vector)  # -> Geometry, Transform
trim_13 = TrimTree(Tree=move_27.Geometry, Depth=1)
bbox_6 = BoundingBox(Content=trim_13, Plane=PlaneXY(0, 0, 0), UnionBox=True)  # -> Box, Box_2
box_corners_3 = BoxCorners(Box=bbox_6.Box)  # -> CornerA, CornerB, CornerC, CornerD, CornerE, CornerF, CornerG, CornerH
item_45 = ListItem(List=flatten(box_corners_3.CornerB), Index=0, Wrap=True)
pdecon_10 = Deconstruct(Point=item_45)  # -> XComponent, YComponent, ZComponent
subtraction_5 = Subtraction(A=pdecon_10.ZComponent, B=pdecon_7.ZComponent)
Z_9 = UnitZ(Factor=subtraction_5)
move_28 = Move(Geometry=move_8.Geometry, Motion=Z_9)  # -> Geometry, Transform

sdiff_4 = SolidDifference(BrepsA=clean_20, BrepsB=geo_37)
sdiff_5 = SolidDifference(BrepsA=sdiff_4, BrepsB=geo_38)
sdiff_6 = SolidDifference(BrepsA=sdiff_5, BrepsB=flatten(geo_41))

# ---- group: Match A612
filter_7 = StreamFilter(Gate=Toggle(True), Stream0=move_8.Geometry, Stream1=move_28.Geometry)

# ----
debrep_6 = DeconstructBrep(Brep=filter_7)  # -> Faces, Edges, Vertices
area_36 = Area(Geometry=debrep_6.Faces)  # -> Area, Centroid
pdecon_11 = Deconstruct(Point=area_36.Centroid)  # -> XComponent, YComponent, ZComponent
sort_15 = SortList(Keys=pdecon_11.ZComponent, ValuesA=debrep_6.Faces)  # -> Keys, reverse(ValuesA)
item_46 = ListItem(List=sort_15.ValuesA, Index=0, Wrap=True)
area_37 = Area(Geometry=item_46)  # -> Area, Centroid
xy_6 = XYPlane(Origin=area_37.Centroid)  # -> flatten(Plane)

pln_16 = Plane(xy_6)

cso_12 = CreateSpeckleObject(
    FrameBase=pln_16,
    Geo=filter_7,
    OffsetPositive=number_slider_5,
    OffsetNegative=number_slider_5,
    Name="Brim Flange",
    Type="Planar",
    selectedKitName="Objects")

split_36 = SplitTree(Data=sdiff_6, Masks=flatten("{1;*}"))  # -> Positive, Negative
cluster_8 = Cluster_29(A=split_36.Positive, L=cso_2)
so = SpeckleObject(cluster_8)
tstat_23 = TreeStatistics(Tree=sdiff_6)  # -> Paths, Length, Count
tstat_24 = TreeStatistics(Tree=so)  # -> Paths, Length, Count
split_37 = SplitTree(Data=sdiff_6, Masks=flatten(tstat_24.Paths))  # -> Positive, Negative
sdiff_7 = SolidDifference(BrepsA=split_37.Positive, BrepsB=geo_19)
merge_34 = Merge(Data1=sdiff_7, Data2=split_37.Negative)

clash_3 = Clash(FirstSet=merge_34, SecondSet=filter_7, Distance=0, L=100)  # -> ClashCount, ClashPoints, ClashRadii, FirstIndex, SecondIndex
item_47 = ListItem(List=filter_7, Index=clash_3.SecondIndex, Wrap=True)
clean_21 = CleanTree(RemoveNulls=True, RemoveInvalid=True, RemoveEmpty=True, Tree=item_47)  # -> simplify(Tree)
tstat_25 = TreeStatistics(Tree=clean_21)  # -> Paths, Length, Count
split_38 = SplitTree(Data=merge_34, Masks=flatten(tstat_25.Paths))  # -> Positive, Negative
split_39 = SplitTree(Data=simplify(item_47), Masks=flatten(tstat_25.Paths))  # -> Positive, Negative
sdiff_8 = SolidDifference(BrepsA=split_38.Positive, BrepsB=split_39.Positive)
merge_35 = Merge(Data1=sdiff_8, Data2=split_38.Negative)

clash_4 = Clash(FirstSet=merge_35, SecondSet=flatten(geo_42), Distance=0, L=100)  # -> ClashCount, ClashPoints, ClashRadii, FirstIndex, SecondIndex
item_48 = ListItem(List=flatten(geo_42), Index=clash_4.SecondIndex, Wrap=True)
clean_22 = CleanTree(RemoveNulls=True, RemoveInvalid=True, RemoveEmpty=True, Tree=item_48)  # -> simplify(Tree)
tstat_26 = TreeStatistics(Tree=clean_22)  # -> Paths, Length, Count
split_40 = SplitTree(Data=merge_35, Masks=flatten(tstat_26.Paths))  # -> Positive, Negative
split_41 = SplitTree(Data=simplify(item_48), Masks=flatten(tstat_26.Paths))  # -> Positive, Negative
sdiff_9 = SolidDifference(BrepsA=split_40.Positive, BrepsB=split_41.Positive)
merge_36 = Merge(Data1=sdiff_9, Data2=split_40.Negative)

cluster_9 = Cluster_29(A=merge_34, L=cso)
so_2 = SpeckleObject(cluster_9)
cluster_10 = Cluster_29(A=merge_34, L=merge_26)
cluster_11 = Cluster_29(A=merge_34, L=cso_6)
cluster_12 = Cluster_29(A=merge_34, L=cso_12)

area_38 = Area(Geometry=merge_36)  # -> Area, Centroid
sort_16 = SortList(Keys=area_38.Area, ValuesA=merge_36)  # -> Keys, reverse(ValuesA)
item_49 = ListItem(List=sort_16.ValuesA, Index=0, Wrap=True)
tstat_27 = TreeStatistics(Tree=item_49)  # -> Paths, Length, Count
split_42 = SplitTree(Data=simplify(geo_49), Masks=flatten(tstat_27.Paths))  # -> Positive, Negative
merge_37 = Merge(Data1=item_49, Data2=split_42.Negative)

so_3 = SpeckleObject(cluster_10)
so_4 = SpeckleObject(cluster_11)
so_5 = SpeckleObject(cluster_12)
cluster_13 = Cluster_29(A=merge_34, L=cso_3)

split_43 = SplitTree(Data=simplify(merge_37), Masks=flatten("{0,8;*}"))  # -> Positive, Negative
merge_38 = Merge(Data1=split_43.Positive, Data2=geo_23)
sunion_2 = SolidUnion(Breps=merge_38)
fmerge_5 = MergeFaces(Brep=sunion_2)  # -> Breps, Before, After
merge_39 = Merge(Data1=fmerge_5.Breps, Data2=split_43.Negative)

so_6 = SpeckleObject(cluster_13)
tree_8 = CreateTree(Data=so, Path=tstat_24.Paths, Ensure=tstat_23.Paths)

split_44 = SplitTree(Data=simplify(merge_39), Masks=flatten(tstat_21.Paths))  # -> Positive, Negative
sdiff_10 = SolidDifference(BrepsA=split_44.Positive, BrepsB=merge_27)
merge_40 = Merge(Data1=simplify(split_44.Negative), Data2=simplify(sdiff_10))

clean_23 = CleanTree(RemoveNulls=True, RemoveInvalid=True, RemoveEmpty=True, Tree=sdiff_10)
tstat_28 = TreeStatistics(Tree=clean_23)  # -> Paths, Length, Count

area_39 = Area(Geometry=merge_40)  # -> Area, Centroid
sort_17 = SortList(Keys=area_39.Area, ValuesA=merge_40)  # -> Keys, reverse(ValuesA)
split_45 = SplitList(List=sort_17.ValuesA, Index=1)  # -> ListA, ListB
item_50 = ListItem(List=sort_17.ValuesA, Index=0, Wrap=True)
geo_50 = Geometry(split_45.ListB)

move_29 = Move(Geometry=geo_50, Motion=vec_2.Vector)  # -> Geometry, Transform
move_30 = Move(Geometry=item_50, Motion=vec_2.Vector)  # -> Geometry, Transform

preview_6 = CustomPreview(Geometry=move_30.Geometry, Material=ColourSwatch(SwatchColor=RGBA(255, 255, 255, 15)))

preview_7 = CustomPreview(Geometry=move_29.Geometry, Material=ColourSwatch(SwatchColor=RGBA(255, 0, 0, 249)))

split_46 = SplitTree(Data=geo_49, Masks=flatten("{6;*}"))  # -> Positive, Negative
clash_5 = Clash(FirstSet=split_46.Positive, SecondSet=move_23.Geometry, Distance=0, L=100)  # -> ClashCount, ClashPoints, ClashRadii, FirstIndex, SecondIndex
item_51 = ListItem(List=move_23.Geometry, Index=clash_5.SecondIndex, Wrap=True)  # -> simplify(Item)
clean_24 = CleanTree(RemoveNulls=True, RemoveInvalid=True, RemoveEmpty=True, Tree=item_51)
tstat_29 = TreeStatistics(Tree=clean_24)  # -> Paths, Length, Count
split_47 = SplitTree(Data=simplify(split_31.Positive), Masks=flatten(tstat_29.Paths))  # -> Positive, Negative
lng_4 = ListLength(List=clean_24)
dup_2 = DuplicateData(Data=split_47.Positive, Number=lng_4, Order=True)  # -> simplify(Data)

clash_6 = Clash(FirstSet=move_30.Geometry, SecondSet=merge_11, Distance=0, L=100)  # -> ClashCount, ClashPoints, ClashRadii, FirstIndex, SecondIndex
item_52 = ListItem(List=cap_3, Index=clash_6.SecondIndex, Wrap=True)

pln_17 = Plane(xy_6)

clean_25 = CleanTree(RemoveNulls=True, RemoveInvalid=True, RemoveEmpty=True, Tree=simplify(item_52))
tstat_30 = TreeStatistics(Tree=clean_25)  # -> Paths, Length, Count
split_48 = SplitTree(Data=move_30.Geometry, Masks=flatten(tstat_30.Paths))  # -> Positive, Negative
sdiff_11 = SolidDifference(BrepsA=split_48.Positive, BrepsB=clean_25)

clean_26 = CleanTree(RemoveNulls=True, RemoveInvalid=True, RemoveEmpty=True, Tree=sdiff_11)  # -> simplify(Tree)
tstat_31 = TreeStatistics(Tree=clean_26)  # -> Paths, Length, Count
split_49 = SplitTree(Data=simplify(move_30.Geometry), Masks=flatten(tstat_31.Paths))  # -> Positive, Negative
merge_41 = Merge(Data1=clean_26, Data2=split_49.Negative)
clean_27 = CleanTree(RemoveNulls=True, RemoveInvalid=True, RemoveEmpty=False, Tree=merge_41)  # -> simplify(Tree)

pln_18 = Plane(dup_2)
geo_51 = Geometry(geo_49)

cso_13 = CreateSpeckleObject(
    FrameBase=pln_18,
    Geo=clean_24,
    OffsetPositive=number_slider_8,
    OffsetNegative=neg_5,
    Name="Core Vents",
    Type="Hole",
    selectedKitName="Objects")  # -> flatten(SpeckleObject)

cluster_14 = Cluster_29(A=geo_51, L=cso_11)
cluster_15 = Cluster_29(A=geo_51, L=cso_10)
cluster_16 = Cluster_29(A=geo_51, L=cso_13)
so_7 = SpeckleObject(cluster_14)
so_8 = SpeckleObject(cluster_15)
so_9 = SpeckleObject(cluster_16)
merge_42 = Merge(Data1=so_7, Data2=so_8, Data3=so_9)

filter_8 = StreamFilter(Gate=Toggle(True), Stream0=move_30.Geometry, Stream1=clean_27)

geo_52 = Geometry(filter_8)

filter_9 = StreamFilter(Gate=finger_joints, Stream1=geo_52)
split_50 = SplitTree(Data=filter_9, Masks=flatten("{0,8;*}"))  # -> Positive, Negative

cluster_17 = Cluster_20(
    crv_2=branch,
    crv=filter_3,
    num_2=tfj,
    int=shell,
    num_5=end_clearence,
    vec=filter_5,
    num=efj,
    num_3=bottom_offset,
    num_4=segment_thickness,
    geo=filter_9,
    geo_2=filter_2)  # -> s_0, D, T
cluster_18 = Cluster_23(
    crv_2=branch_2,
    crv=filter_3,
    num_2=tfj,
    int=shell_2,
    num_5=end_clearence,
    vec=filter_5,
    num=efj,
    num_3=bottom_offset,
    num_4=segment_thickness,
    geo=filter_9,
    geo_2=filter_2)  # -> s_0, D, T
cluster_19 = Cluster_23(
    crv_2=branch_3,
    crv=filter_3,
    num_2=tfj,
    int=shell_3,
    num_5=end_clearence,
    vec=filter_5,
    num=efj,
    num_3=bottom_offset,
    num_4=segment_thickness,
    geo=filter_9,
    geo_2=filter_2)  # -> s_0, D, T
cluster_20 = Cluster_23(
    crv_2=branch_4,
    crv=filter_3,
    num_2=tfj,
    int=shell_4,
    num_5=end_clearence,
    vec=filter_5,
    num=efj,
    num_3=bottom_offset,
    num_4=segment_thickness,
    geo=filter_9,
    geo_2=filter_2)  # -> s_0, D, T
cluster_21 = Cluster_23(
    crv_2=branch_5,
    crv=filter_3,
    num_2=tfj,
    int=shell_5,
    num_5=end_clearence,
    vec=filter_5,
    num=efj,
    num_3=bottom_offset,
    num_4=segment_thickness,
    geo=filter_9,
    geo_2=filter_2)  # -> s_0, D, T
cluster_22 = Cluster_23(
    crv_2=branch_6,
    crv=filter_3,
    num_2=tfj,
    int=shell_6,
    num_5=end_clearence,
    vec=filter_5,
    num=efj,
    num_3=bottom_offset,
    num_4=segment_thickness,
    geo=filter_9,
    geo_2=filter_2)  # -> s_0, D, T
cluster_23 = Cluster_24(
    crv_2=branch_7,
    crv=filter_3,
    num_2=tfj,
    int=shell_7,
    num_5=end_clearence,
    vec=filter_5,
    num=efj,
    num_3=bottom_offset,
    num_4=segment_thickness,
    geo=filter_9,
    geo_2=filter_2)  # -> s_1, D, T
preview_8 = CustomPreview(Geometry=cluster_17.s_0, Material=cluster_17.D)
preview_9 = CustomPreview(Geometry=cluster_18.s_0, Material=cluster_18.D)
preview_10 = CustomPreview(Geometry=cluster_19.s_0, Material=cluster_19.D)
preview_11 = CustomPreview(Geometry=cluster_20.s_0, Material=cluster_20.D)
preview_12 = CustomPreview(Geometry=cluster_21.s_0, Material=cluster_21.D)
preview_13 = CustomPreview(Geometry=cluster_22.s_0, Material=cluster_22.D)
preview_14 = CustomPreview(Geometry=cluster_23.s_1, Material=cluster_23.D)
so_10 = SpeckleObject(cluster_17.T)
so_11 = SpeckleObject(cluster_18.T)
so_12 = SpeckleObject(cluster_19.T)
so_13 = SpeckleObject(cluster_20.T)
so_14 = SpeckleObject(cluster_21.T)
so_15 = SpeckleObject(cluster_22.T)
so_16 = SpeckleObject(cluster_23.T)
merge_43 = Merge(
    Data1=split_50.Positive,
    Data2=cluster_17.s_0,
    Data3=cluster_18.s_0,
    Data4=cluster_19.s_0,
    Data5=cluster_20.s_0,
    Data6=cluster_21.s_0,
    Data7=cluster_22.s_0,
    Data8=cluster_23.s_1)
merge_44 = Merge(Data1=so_10, Data2=so_11, Data3=so_12, Data4=so_13, Data5=so_14, Data6=so_15, Data7=so_16)

clean_28 = CleanTree(RemoveNulls=True, RemoveInvalid=True, RemoveEmpty=True, Tree=merge_44)
lng_5 = ListLength(List=clean_28)
tstat_32 = TreeStatistics(Tree=merge_43)  # -> Paths, Length, Count
tstat_33 = TreeStatistics(Tree=clean_28)  # -> Paths, Length, Count
dup_3 = DuplicateData(Data=graft(tstat_33.Paths), Number=lng_5, Order=True)  # -> flatten(Data)
tree_9 = CreateTree(Data=flatten(clean_28), Path=dup_3, Ensure=tstat_32.Paths)

filter_10 = StreamFilter(Gate=finger_joints, Stream0=geo_52, Stream1=merge_43)
filter_11 = StreamFilter(Gate=finger_joints, Stream1=tree_9)

geo_53 = Geometry(filter_10)
c_script_19 = CSharpScript(x=geo_53)  # -> out, A; inputs x: Brep
# ---------- c_script_19: C# ----------
    A = x.ToJSON(new Rhino.FileIO.SerializationOptions());
# ---------- end c_script_19 ----------
c_script_20 = CSharpScript(x=geo_53)  # -> out, A; inputs x: tree of Brep
# ---------- c_script_20: C# ----------
    List<object> data = new List<object>();
    for (int i = 0; i < x.BranchCount; i++)
    {
      for (int j = 0; j < x.Branch(i).Count; j++)
      {
        Brep brp = x.Branch(i)[j];
        if(!brp.IsValid)
          data.Add(brp);
      }
    }

    A = data;
# ---------- end c_script_20 ----------
panel_50 = Panel(c_script_20.A)
area_40 = Area(Geometry=geo_53)  # -> Area, Centroid

sunion_3 = SolidUnion(Breps=geo_12)  # -> flatten(Result)
pt_3 = Point(Point(0, 48, 0))
xz_4 = XZPlane(Origin="0,47,0")
plntrimsrf = PlaneTrimSurface(Surface=sunion_3, Plane=xz_4, Flip=False)  # -> flatten(Trimmed), Intersected
cap_5 = CapHoles(Brep=plntrimsrf.Trimmed)
move_31 = Move(Geometry=sunion_3, Motion=vec_2.Vector)  # -> Geometry, Transform
clash_7 = Clash(FirstSet=geo_53, SecondSet=cap_5, Distance=0, L=100)  # -> ClashCount, ClashPoints, ClashRadii, FirstIndex, SecondIndex
clean_29 = CleanTree(RemoveNulls=True, RemoveInvalid=True, RemoveEmpty=True, Tree=clash_7.FirstIndex)  # -> simplify(Tree)
split_51 = SplitTree(Data=clean_29, Masks=flatten("{!0,8;*}"))  # -> Positive, Negative
tstat_34 = TreeStatistics(Tree=split_51.Positive)  # -> Paths, Length, Count
split_52 = SplitTree(Data=geo_53, Masks=flatten(tstat_34.Paths))  # -> Positive, Negative; disabled

merge_45 = Merge(Data1=merge_42, Data2=cso_9, Data3=so_2, Data4=so_3, Data5=so_4, Data6=so_5, Data7=so_6, Data8=tree_8)
tstat_35 = TreeStatistics(Tree=geo_49)  # -> Paths, Length, Count

c_script_21 = CSharpScript(
    iSolidOperator_Speckle=merge_45,
    moveVector=vec_2.Vector,
    Reference=["C:\USERS\LASATHS\DESKTOP\LIBRARIES\ABXM.PLATESTRUCTURES\LCRL.dll", "C:\Users\lasaths\AppData\Roaming\Grasshopper\Libraries\ABxM.PlateStructures\ElementBase.dll", "C:\Users\lasaths\AppData\Roaming\Grasshopper\Libraries\FabFramework\Fab.Core.dll", "C:\Users\lasaths\AppData\Roaming\McNeel\Rhinoceros\7.0\Plug-ins\SpeckleRhino2 (8dd5f30b-a13d-4a24-abdc-3e05c8c87143)\SpeckleCore2.dll", "C:\Windows\Microsoft.NET\assembly\GAC_MSIL\netstandard\v4.0_2.0.0.0__cc7b13ffcd2ddd51\netstandard.dll", "C:\Users\lasaths\AppData\Roaming\McNeel\Rhinoceros\7.0\Plug-ins\SpeckleRhino2 (8dd5f30b-a13d-4a24-abdc-3e05c8c87143)\SpeckleConnectorGrasshopper.gha", "C:\Users\lasaths\AppData\Roaming\Speckle\Kits\Objects\Objects.Converter.Grasshopper7.dll", "C:\Users\lasaths\AppData\Roaming\Speckle\Kits\Objects\Objects.dll"])  # -> out, A; inputs moveVector: Vector3d
# ---------- c_script_21: C# usings ----------
using Fab.Core.FabCollection;
using Fab.Core.DesignElement;
using System.Linq;
using Grasshopper.Kernel.Components;
using System.Net.NetworkInformation;
using ABxM.PlateStructures.Development;
using Speckle.Core.Models;
using Objects.Converter.RhinoGh;
using Objects.Geometry;
using Speckle.Core.Kits;
using System.Reflection;

// Aliases for clarity
using SpecklePoint = Objects.Geometry.Point;
using SpecklePlane = Objects.Geometry.Plane;
using SpeckleBrep = Objects.Geometry.Brep;
using SpeckleLine = Objects.Geometry.Line;
# ---------- c_script_21: C# ----------
    // Cast the input to a Speckle Base object.
    Base speckleObj = iSolidOperator_Speckle as Base;
    if (speckleObj == null)
    {
      Print("Input is not a valid Speckle object.");
      return;
    }

    // Create a new Speckle object.
    Base newSpeckle = new Base();
    
    // Optionally, copy core properties if desired.
    if (speckleObj["@Name"] != null)
      newSpeckle["@Name"] = speckleObj["@Name"];
    if (speckleObj["@Type"] != null)
      newSpeckle["@Type"] = speckleObj["@Type"];

    // Set up the converter.
    ConverterRhinoGh converter = new ConverterRhinoGh();
    converter.SetContextDocument(RhinoDoc.ActiveDoc);

    // Retrieve dynamic properties from the original object.
    IDictionary<string, object> members = speckleObj.GetMembers(DynamicBaseMemberType.Dynamic);
    
    // Loop through each property and process it.
    foreach (string key in members.Keys)
    {
      object value = speckleObj[key];
      Print("Processing key: " + key + " of type: " + (value != null ? value.GetType().ToString() : "null"));
      object movedValue = MoveSpeckleValue(value, moveVector, converter);
      newSpeckle[key] = movedValue;
    }

    // Output the new Speckle object.
    A = newSpeckle;
# ---------- c_script_21: C# additional code ----------
  /// <summary>
  /// Moves a Speckle geometry value (or a list of such values) by a given vector.
  /// If the value is not a recognized geometry type, it is returned unchanged.
  /// </summary>
  private object MoveSpeckleValue(object value, Vector3d moveVector, ConverterRhinoGh converter)
  {
    if (value == null)
      return null;

    // If the value is a list, process each element recursively.
    IList list = value as IList;
    if (list != null)
    {
      List<object> newList = new List<object>();
      for (int i = 0; i < list.Count; i++)
      {
        newList.Add(MoveSpeckleValue(list[i], moveVector, converter));
      }
      return newList;
    }

    try
    {
      // Process Speckle Point.
      SpecklePoint sp = value as SpecklePoint;
      if (sp != null)
      {
        Rhino.Geometry.Point rhPt = converter.PointToNative(sp);
        // Create a new point instance with the moved location.
        Rhino.Geometry.Point newPt = new Rhino.Geometry.Point(rhPt.Location + moveVector);
        Print("Moved point from " + rhPt.Location.ToString() + " to " + newPt.Location.ToString());
        return converter.PointToSpeckle(newPt);
      }

      // Process Speckle Plane.
      SpecklePlane spl = value as SpecklePlane;
      if (spl != null)
      {
        Rhino.Geometry.Plane rhPlane = converter.PlaneToNative(spl);
        // Create a new plane instance; move the origin.
        Rhino.Geometry.Plane newPlane = new Rhino.Geometry.Plane(rhPlane);
        newPlane.Origin = rhPlane.Origin + moveVector;
        Print("Moved plane from " + rhPlane.Origin.ToString() + " to " + newPlane.Origin.ToString());
        return converter.PlaneToSpeckle(newPlane);
      }

      // Process Speckle Brep.
      SpeckleBrep sb = value as SpeckleBrep;
      if (sb != null)
      {
        List<string> notes;
        Rhino.Geometry.Brep rhBrep = converter.BrepToNative(sb, out notes);
        if (rhBrep != null)
        {
          // Duplicate the brep before transforming.
          Rhino.Geometry.Brep newBrep = rhBrep.DuplicateBrep();
          newBrep.Transform(Transform.Translation(moveVector));
          Print("Moved brep.");
          return converter.BrepToSpeckle(newBrep);
        }
      }

      // Process Speckle Line.
      SpeckleLine sl = value as SpeckleLine;
      if (sl != null)
      {
        var lineResult = converter.LineToNative(sl); // Assuming it returns an object with a Line property.
        Rhino.Geometry.Line rhLine = lineResult.Line;
        // Create a new line instance with moved endpoints.
        Rhino.Geometry.Line newLine = new Rhino.Geometry.Line(rhLine.From + moveVector, rhLine.To + moveVector);
        Print("Moved line from " + rhLine.From.ToString() + " - " + rhLine.To.ToString() +
          " to " + newLine.From.ToString() + " - " + newLine.To.ToString());
        return converter.LineToSpeckle(newLine);
      }
    }
    catch (Exception ex)
    {
      Rhino.RhinoApp.WriteLine("Error moving property: " + ex.Message);
    }

    // If not a recognized type, return the original value.
    return value;
  }
# ---------- end c_script_21 ----------

tstat_36 = TreeStatistics(Tree=c_script_21.A)  # -> Paths, Length, Count
lng_6 = ListLength(List=c_script_21.A)
dup_4 = DuplicateData(Data=graft(tstat_36.Paths), Number=lng_6, Order=True)
tree_10 = CreateTree(Data=flatten(c_script_21.A), Path=flatten(dup_4), Ensure=tstat_35.Paths)

data_21 = Data(geo_53)

split_53 = SplitTree(Data=simplify(merge_23), Masks=flatten(tstat_31.Paths))  # -> Positive, Negative

c_script_22 = CSharpScript(x=split_53.Positive, y="_pipe")  # -> out, A; inputs x: String, y: String; same code as c_script_15

merge_46 = Merge(Data1=c_script_22.A, Data2=split_53.Negative)

sort_val_2 = SortDuplicateValues(ValueList=flatten(tstat_33.Paths))  # -> UniqueValues, Indices
split_54 = SplitTree(Data=simplify(merge_46), Masks=flatten(sort_val_2.UniqueValues))  # -> Positive, Negative
c_script_23 = CSharpScript(x=split_54.Positive, y="_fingerJoint")  # -> out, A; inputs x: String, y: String; same code as c_script_15
merge_47 = Merge(Data1=c_script_23.A, Data2=split_54.Negative)

filter_12 = StreamFilter(Gate=finger_joints, Stream0=merge_46, Stream1=merge_47)

sort_val_3 = SortDuplicateValues(ValueList=flatten(tstat_3.Paths))  # -> UniqueValues, Indices
split_55 = SplitTree(Data=simplify(filter_12), Masks=flatten(sort_val_3.UniqueValues))  # -> Positive, Negative
c_script_24 = CSharpScript(x=split_55.Positive, y="_crown")  # -> out, A; inputs x: String, y: String; same code as c_script_15
merge_48 = Merge(Data1=c_script_24.A, Data2=split_55.Negative)

split_56 = SplitTree(Data=simplify(merge_48), Masks=flatten(data_6))  # -> Positive, Negative
c_script_25 = CSharpScript(x=split_56.Positive, y="_onSite")  # -> out, A; inputs x: String, y: String; same code as c_script_15
merge_49 = Merge(Data1=c_script_25.A, Data2=split_56.Negative)

data_22 = Data(tstat_28.Paths)
split_57 = SplitTree(Data=simplify(merge_49), Masks=flatten(data_22))  # -> Positive, Negative
c_script_26 = CSharpScript(x=split_57.Positive, y="_fins")  # -> out, A; inputs x: String, y: String; same code as c_script_15
merge_50 = Merge(Data1=c_script_26.A, Data2=split_57.Negative)

c_script_27 = CSharpScript(x=merge_50)  # -> out, A; inputs x: String
# ---------- c_script_27: C# ----------
    A = ReorderPropertiesAlphabetically(x, 2);
# ---------- c_script_27: C# additional code ----------
  public static string ReorderPropertiesAlphabetically(string input, int frontLength)
  {
    // Split the string by '_'
    var parts = input.Split('_');

    // Check if the string has enough parts (at least type and location)
    if (parts.Length <= frontLength) return input;

    // Extract type and location (first two parts)
    string type = parts[0];
    string location = parts[1];

    // Extract properties (remaining parts)
    string[] properties = new string[parts.Length - 2];
    Array.Copy(parts, 2, properties, 0, parts.Length - 2);

    // Sort properties
    Array.Sort(properties);

    // Reassemble the string
    return type + "_" + location + "_" + string.Join("_", properties);
  }
# ---------- end c_script_27 ----------

move_32 = Move(Geometry=data_4, Motion=vec_2.Vector)  # -> Geometry, Transform

clt_offset_4 = Slider(0.02, range=0..0.1)
item_53 = ListItem(List=buildup.BuildupValue, Index=[0, -1], Wrap=True)

# ----
# Beams
move_33 = Move(Geometry=crv_7, Motion=vec_2.Vector)  # -> Geometry, Transform

# ----
# Beams
move_34 = Move(Geometry=crv_6, Motion=vec_2.Vector)  # -> Geometry, Transform
toggle_2 = BooleanToggle(True)

toggle_3 = BooleanToggle(True)

# ---- group: A1, A2, B1, B2
txt_3 = Text(clean_16)
split_58 = SplitTree(Data=c_script_27.A, Masks=flatten(txt_3))  # -> Positive, Negative
c_script_28 = CSharpScript(x=split_58.Negative)  # -> out, A; inputs x: String
# ---------- c_script_28: C# ----------
    string type = x;

    if (x.Contains("brim"))
    {
      type = type.Replace("solid", "solid_A1");
    }
    else if (!x.Contains("fins"))
    {
      type = type.Replace("solid", "solid_A1");
    }
    else
    {
      type = type.Replace("solid", "solid_A2");
    }

    if (x.Contains("hollow"))
    {
      type = type.Replace("hollow", "hollow_B1");
    }

    A = type;
# ---------- end c_script_28 ----------
c_script_29 = CSharpScript(x=split_58.Positive)  # -> out, A; inputs x: String
# ---------- c_script_29: C# ----------
    string type = x;

    if (x.Contains("hollow"))
    {
      type = type.Replace("hollow", "hollow_B2");
    }

    A = type;
# ---------- end c_script_29 ----------

# ----
split_59 = SplitTree(Data=split_58.Negative, Masks=flatten(tstat_34.Paths))  # -> Positive, Negative
c_script_30 = CSharpScript(x=split_59.Positive)  # -> out, A; inputs x: String
# ---------- c_script_30: C# ----------
    string type = x;

    if (x.Contains("solid"))
    {
      type = type.Replace("solid", "solid_A1");
    }

    if (x.Contains("hollow"))
    {
      type = type.Replace("hollow", "hollow_B1");
    }

    A = type;
# ---------- end c_script_30 ----------
c_script_31 = CSharpScript(x=split_59.Negative)  # -> out, A; inputs x: String
# ---------- c_script_31: C# ----------
    string type = x;

    if (x.Contains("solid"))
    {
      type = type.Replace("solid", "solid_A2");
    }

    if (x.Contains("hollow"))
    {
      type = type.Replace("hollow", "hollow_B1");
    }

    A = type;
# ---------- end c_script_31 ----------
merge_51 = Merge(Data1=c_script_30.A, Data2=c_script_31.A)

filter_13 = StreamFilter(Gate=off_ibb_drawing_t130, Stream0=c_script_28.A, Stream1=merge_51)

# ---- group: A1, A2, B1, B2 (continued)
merge_52 = Merge(Data1=filter_13, Data2=c_script_29.A)

# ----
sort_val_4 = SortDuplicateValues(ValueList=flatten(merge_52))  # -> UniqueValues, Indices
lng_7 = ListLength(List=sort_val_4.UniqueValues)

txt_4 = Text(merge_52)

data_23 = Data(txt_4)

string_filter_3 = StringFilter(Text=data_23, Object=data_21, Key="hollow")  # -> Text, Object
clean_30 = CleanTree(RemoveNulls=True, RemoveInvalid=True, RemoveEmpty=True, Tree=string_filter_3.Text)
tstat_37 = TreeStatistics(Tree=clean_30)  # -> Paths, Length, Count
split_60 = SplitTree(Data=data_21, Masks=flatten(tstat_37.Paths))  # -> Positive, Negative
txt_5 = Text(tstat_37.Paths)

c_script_32 = CSharpScript(x=tstat_37.Paths, y=clean_16, z=data_11, u=buildup_3.BuildupValue)  # -> out, A; inputs x: list, y: list of String, z: list of Double, u: list of Double
# ---------- c_script_32: C# ----------
    DataTree<double> buildup = new DataTree<double>();

    for (int i = 0; i < x.Count; i++)
    {
      GH_Path path = x[i] as GH_Path;
      if(y.Contains(x[i].ToString())) buildup.AddRange(u, path);
      else buildup.AddRange(z, path);
    }

    A = buildup;
# ---------- end c_script_32 ----------
split_61 = SplitTree(Data=data_23, Masks=flatten(tstat_37.Paths))  # -> Positive, Negative

string_filter_4 = StringFilter(Text=data_23, Object=data_21, Key="solid")  # -> Text, Object
clean_31 = CleanTree(RemoveNulls=True, RemoveInvalid=True, RemoveEmpty=True, Tree=string_filter_4.Text)
split_62 = SplitTree(Data=clean_31, Masks=flatten("{!0,8;*}"))  # -> Positive, Negative
tstat_38 = TreeStatistics(Tree=split_62.Positive)  # -> Paths, Length, Count
cluster_24 = Cluster_3(P=move_34.Geometry, M=tstat_38.Paths, D=Toggle(False))  # -> geo_4, geo_5, geo_6, M_2
geo_54 = Geometry(cluster_24.geo_4)
geo_55 = Geometry(cluster_24.geo_5)
geo_56 = Geometry(cluster_24.geo_6)
generate_raw_plate = GenerateRawPlate(
    BaseOutline=simplify(geo_54),
    BasePlane=geo_55,
    MitrePlanes=geo_56,
    FabricationOffsets=clt_offset_4,
    Buildup=item_53,
    PlateType=Slider(3, range=0..10))  # -> RawPlate, RawBoundingBox, EdgeOffsets, OffsetPolyline

tstat_39 = TreeStatistics(Tree=simplify(geo_54))  # -> Paths, Length, Count
split_63 = SplitTree(Data=simplify(pln_6), Masks=flatten(tstat_39.Paths))  # -> Positive, Negative
bbox_7 = BoundingBox(Content=generate_raw_plate.RawPlate, Plane=split_63.Positive)  # -> Box, Box_2

cluster_25 = Cluster_3(P=move_34.Geometry, M=txt_5, D=Toggle(False))  # -> geo_4, geo_5, geo_6, M_2

number_slider_20 = Slider(1, range=0..1)
dom = ConstructDomain(DomainStart=0, DomainEnd=255)
series = Series(Start=Slider(100, range=0..100), Step=Slider(20, range=0..100), Count=lng_7)
remap = RemapNumbers(Value=series, Source=dom, Target=Domain(0, 1))  # -> Mapped, Clipped
hsv = ColourHSV(Alpha=0.4, Hue=remap.Mapped, Saturation=number_slider_20, Value=number_slider_20)
merge_53 = Merge(
    Data1=ColourSwatch(SwatchColor=RGBA(255, 0, 0, 100)),
    Data2=ColourSwatch(SwatchColor=RGBA(255, 85, 0, 100)),
    Data3=flatten(hsv))

filter_14 = StreamFilter(Gate=thicker_bottom_plate, Stream0=data_11, Stream1=c_script_32.A)

series_2 = Series(Start=0, Step=1, Count=3)
generate_raw_plate_2 = GenerateRawPlate(
    BaseOutline=simplify(cluster_25.geo_4),
    BasePlane=cluster_25.geo_5,
    MitrePlanes=cluster_25.geo_6,
    FabricationOffsets=merge_8,
    Buildup=filter_14,
    PlateType=series_2)  # -> RawPlate, RawBoundingBox, EdgeOffsets, OffsetPolyline

sort_val_5 = SortDuplicateValues(ValueList=flatten(txt_4))  # -> UniqueValues, Indices
item_54 = ListItem(List=sort_val_5.UniqueValues, Index=Slider(17, range=0..100), Wrap=True)
c_script_33 = CSharpScript(x=item_54, y=txt_4, z=geo_53)  # -> out, A; inputs x: String, y: String, z: Brep
# ---------- c_script_33: C# ----------
    if( x == y) A = z;
# ---------- end c_script_33 ----------
panel_51 = Panel(sort_val_5.UniqueValues)
string_filter_5 = StringFilter(Text=txt_4, Object=geo_53, Key="B2")  # -> Text, Object

# ----
# Top and Bottom Plates
deplane_7 = DeconstructPlane(Plane=cluster_25.geo_6)  # -> Origin, XAxis, YAxis, ZAxis
cluster_26 = Cluster(P=cluster_25.geo_4, V=deplane_7.YAxis, O=item_42.Item3, O_2=item_42.Item2)  # -> T_2, T, T_3
cluster_27 = Cluster_2(G=thicker_bottom_plate, P=cluster_25.geo_4, V=deplane_7.YAxis, M=clean_16, L=data_11, L_2=buildup_3.BuildupValue)  # -> T, T_2, s_1

c_script_34 = CSharpScript(x=txt_4, z=sort_val_5.UniqueValues, y=merge_53)  # -> out, A; inputs x: String, z: list of String, y: list of Color
# ---------- c_script_34: C# ----------
    if(x.Contains("column"))
    {
      System.Drawing.Color newCol = System.Drawing.Color.FromArgb(
        100,
        System.Drawing.Color.DarkSlateGray.R,
        System.Drawing.Color.DarkSlateGray.G,
        System.Drawing.Color.DarkSlateGray.B
        );
        A = newCol;
    }
    else
      A = y[z.IndexOf(x)];
# ---------- end c_script_34 ----------
preview_15 = CustomPreview(Geometry=geo_53, Material=c_script_34.A)

textdot = DefineTextDot(Text=txt_4, Location=area_40.Centroid, Font="Arial", Size=14)

item_55 = ListItem(List=generate_raw_plate_2.RawPlate, Index=2, Wrap=True)
tstat_40 = TreeStatistics(Tree=item_55)  # -> Paths, Length, Count
split_64 = SplitTree(Data=move_11.Geometry, Masks=flatten(tstat_40.Paths))  # -> Positive, Negative
clean_32 = CleanTree(RemoveNulls=True, RemoveInvalid=True, RemoveEmpty=False, Tree=split_64.Positive)

preview_16 = CustomPreview(Geometry=textdot, Material=c_script_34.A)

split_65 = SplitTree(Data=simplify(pln_7), Masks=flatten(tstat_40.Paths))  # -> Positive, Negative
bbox_8 = BoundingBox(Content=item_55, Plane=split_65.Positive)  # -> Box, Box_2
debox_4 = DeconstructBox(Box=bbox_8.Box)  # -> Plane, X, Y, Z
num_6 = Number(debox_4.Y)
addition_7 = Addition(A=num_6, B=0.025)
sort_18 = SortList(Keys=flatten(addition_7))  # -> reverse(Keys), ValuesA

panel_52 = Panel(item_54)
geo_57 = Geometry(clean_32)
clean_33 = CleanTree(RemoveNulls=True, RemoveInvalid=True, RemoveEmpty=False, Tree=string_filter_5.Object)

tstat_41 = TreeStatistics(Tree=txt_4)  # -> graft(Paths), Length, Count
match_7 = MatchTree(Tree=tstat_41.Paths, Guide=txt_4)

preview_17 = CustomPreview(Geometry=clean_33, Material=ColourSwatch(SwatchColor=RGBA(255, 255, 255, 26)))

number_slider_21 = Slider(0.01, range=0..0.01)
number_slider_22 = Slider(0.3, range=0..1)
pln_19 = Plane(geo_57)
polyoffset_5 = PolylineOffset(Polylines=geo_57, Distance=number_slider_21, Plane=pln_19, Tolerance=0.0001, ClosedFillet=1, OpenFillet=1, Miter=2)  # -> Contour, Holes
polyoffset_6 = PolylineOffset(
    Polylines=geo_57,
    Distance=expr("x/2", number_slider_21),
    Plane=pln_19,
    Tolerance=0.0001,
    ClosedFillet=1,
    OpenFillet=1,
    Miter=2)  # -> Contour, Holes
explode_6 = Explode(Curve=polyoffset_5.Holes, Recursive=True)  # -> Segments, Vertices
crv_21 = Curve(polyoffset_6.Holes)
boundary_21 = BoundarySurfaces(Edges=polyoffset_5.Holes)
line_2 = Line(explode_6.Segments)
division_15 = Division(A=number_slider_22, B=2)
clean_34 = CleanTree(RemoveNulls=True, RemoveInvalid=True, RemoveEmpty=False, Tree=line_2)
neg_10 = Negative(Value=division_15)
ext = ExtendCurve(Curve=clean_34, Type=0, Start=neg_10, End=neg_10)
clean_35 = CleanTree(RemoveNulls=True, RemoveInvalid=True, RemoveEmpty=False, Tree=ext)
len_10 = Length(Curve=clean_35)
division_16 = Division(A=len_10, B=number_slider_22)
round = Round(Number=division_16)  # -> Nearest, Floor, Ceiling
pframes = PerpFrames(Curve=clean_35, Count=round.Nearest, Align=True)  # -> Frames, Parameters
trim_14 = TrimTree(Tree=pframes.Frames, Depth=1)  # -> simplify(Tree)
pcx = CurvePlane(Curve=geo_57, Plane=trim_14)  # -> Points, ParamsC, ParamsP
dist_2 = Distance(PointA=simplify(graft(trim_14)), PointB=pcx.Points)
sort_19 = SortList(Keys=dist_2, ValuesA=pcx.Points)  # -> Keys, ValuesA
item_56 = ListItem(List=sort_19.ValuesA, Index=0, Wrap=True)
ln_4 = Line(StartPoint=simplify(graft(trim_14)), EndPoint=item_56)
deplane_8 = DeconstructPlane(Plane=graft(trim_14))  # -> Origin, XAxis, YAxis, ZAxis
ext_2 = ExtendCurve(Curve=ln_4, Type=0, Start=0.01, End=0)
amp = Amplitude(Vector=deplane_8.ZAxis, Amplitude=Slider(0.01, range=0..0.1))
end_2 = EndPoints(Curve=ext_2)  # -> Start, End
neg_11 = Negative(Value=amp)
move_35 = Move(Geometry=end_2.Start, Motion=neg_11)  # -> Geometry, Transform
move_36 = Move(Geometry=end_2.Start, Motion=amp)  # -> Geometry, Transform
rec_3pt = Rectangle3Pt(PointA=move_36.Geometry, PointB=move_35.Geometry, PointC=end_2.End)  # -> Rectangle, Length
trim_15 = TrimTree(Tree=simplify(rec_3pt.Rectangle), Depth=1)
merge_54 = Merge(Data1=trim_15, Data2=simplify(polyoffset_5.Holes))
runion_2 = RegionUnion(Curves=merge_54)

tstat_42 = TreeStatistics(Tree=match_7)  # -> Paths, Length, Count
dpath = DeconstructPath(Branch=tstat_42.Paths)
match_8 = MatchTree(Tree=dpath, Guide=txt_4)
merge_55 = Merge(Data1=match_8, Data2=txt_4)

split_66 = SplitTree(Data=simplify(filter_11), Masks=flatten(tstat_37.Paths))  # -> Positive, Negative
clean_36 = CleanTree(RemoveNulls=True, RemoveInvalid=True, RemoveEmpty=False, Tree=split_66.Negative)

split_67 = SplitTree(Data=simplify(move_29.Geometry), Masks=flatten(tstat_37.Paths))  # -> Positive, Negative
clean_37 = CleanTree(RemoveNulls=True, RemoveInvalid=True, RemoveEmpty=False, Tree=split_67.Negative)

split_68 = SplitTree(Data=simplify(data_18), Masks=flatten(tstat_37.Paths))  # -> Positive, Negative

split_69 = SplitTree(Data=split_60.Negative, Masks=flatten("{0,8;*}"))  # -> Positive, Negative
split_70 = SplitTree(Data=split_61.Negative, Masks=flatten("{0,8;*}"))  # -> Positive, Negative
string_filter_6 = StringFilter(Text=split_70.Negative, Object=split_69.Negative, Key="ridge_column")  # -> Text, Object
clean_38 = CleanTree(RemoveNulls=True, RemoveInvalid=True, RemoveEmpty=True, Tree=string_filter_6.Object)
tstat_43 = TreeStatistics(Tree=clean_38)  # -> Paths, Length, Count
split_71 = SplitTree(Data=simplify(geo_29), Masks=flatten(tstat_43.Paths))  # -> Positive, Negative
move_37 = Move(Geometry=split_71.Positive, Motion=data_13)  # -> Geometry, Transform
dup_5 = DuplicateData(Data=clean_38, Number=2, Order=True)

pl_offset_3 = PlaneOffset(BasePlane=move_37.Geometry, Offset=number_slider_11)

planesrf_3 = PlaneSurface(Plane=pl_offset_3, XSize=Domain(-10, 10), YSize=Domain(-10, 10))
offsrf_14 = OffsetSurface(Surface=planesrf_3, Distance=[1, -1], BothSides=0, CreateSolid=True)
sdiff_12 = SolidDifference(BrepsA=graft(dup_5), BrepsB=offsrf_14)
trim_16 = TrimTree(Tree=sdiff_12, Depth=1)  # -> simplify(Tree)

tstat_44 = TreeStatistics(Tree=trim_16)  # -> Paths, Length, Count
split_72 = SplitTree(Data=simplify(split_60.Negative), Masks=flatten(tstat_44.Paths))  # -> Positive, Negative
merge_56 = Merge(Data1=trim_16, Data2=split_72.Negative)
geo_58 = Geometry(merge_56)

cluster_28 = Cluster_3(P=move_34.Geometry, M=txt_5, D=toggle_3)  # -> geo_4, geo_5, geo_6, M_2

tstat_45 = TreeStatistics(Tree=cluster_28.geo_4)  # -> Paths, Length, Count
split_73 = SplitTree(Data=simplify(data_3), Masks=flatten(tstat_45.Paths))  # -> Positive, Negative
split_74 = SplitTree(Data=simplify(move_32.Geometry), Masks=flatten(tstat_45.Paths))  # -> Positive, Negative
num_7 = Number(split_73.Positive)
division_17 = Division(A=num_7, B=100)
cp_5 = ClosestPoint(Point=cluster_28.geo_6, Cloud=split_74.Positive)  # -> ClosestPoint, CPIndex, Distance
item_57 = ListItem(List=division_17, Index=cp_5.CPIndex, Wrap=True)

data_24 = Data(item_57)

extremums_4 = MinMax(Number=flatten(data_24))  # -> Minimum, Maximum
gradient_2 = Gradient(
    LowerLimit=extremums_4.Minimum,
    UpperLimit=extremums_4.Maximum,
    Parameter=data_24,
    stops=[0.15: RGBA(134, 105, 191, 80), 0.85: RGB(0, 255, 111)])

tag_5 = TextTag(Location=split_74.Positive, Text=division_17)
tag_6 = TextTag(Location=cp_5.ClosestPoint, Text=data_24, Colour=gradient_2)

split_75 = SplitTree(Data=simplify(data_24), Masks=flatten(tstat_37.Paths))  # -> Positive, Negative

split_76 = SplitTree(Data=simplify(data_24), Masks=flatten(tstat_37.Paths))  # -> Positive, Negative

cluster_29 = Cluster_3(P=move_33.Geometry, M=txt_5, D=toggle_3)  # -> geo_4, geo_5, geo_6, M_2
generate_beam = GenerateBeam(
    EdgePlanes=cluster_29.geo_6,
    Polyline=cluster_29.geo_4,
    BasePlane=cluster_29.geo_5,
    TopPlateOffset=item_44.Item2,
    BottomPlateOffset=item_44.Item1,
    BeamWidths=split_75.Positive,
    BeamWidthMinimum=toggle_2,
    BeamMinLength=number_slider_10,
    FabricationTolerance=number_slider_9,
    FlipBeams=False)  # -> Beams, BeamPlanes, BoundingBox, InteriorPlanes, simplify(EndPlanes), ExteriorLengths, InteriorLengths

brec_10 = BoundingRectangle(Geometry=flatten(dso_40.Polyline), Plane=PlaneXY(0, 0, 0), Axis=0, Slide=0, Union=True)  # -> Bounding, DimensionX, DimensionY
project_11 = Project(Geometry=brec_10.Bounding, Plane=xy_4)  # -> Geometry, Transform
polyoffset_7 = PolylineOffset(
    Polylines=project_11.Geometry,
    Distance=Slider(1, range=0..1),
    Plane=xy_4,
    Tolerance=0.0001,
    ClosedFillet=1,
    OpenFillet=1,
    Miter=2)  # -> Contour, Holes
rdiff_3 = RegionDifference(CurvesA=polyoffset_7.Contour, CurvesB=project_11.Geometry)
boundary_22 = BoundarySurfaces(Edges=rdiff_3)
Z_10 = UnitZ(Factor=number_slider_17)
move_38 = Move(Geometry=boundary_22, Motion=expr("-x", Z_10))  # -> Geometry, Transform
extr_6 = Extrude(Base=move_38.Geometry, Direction=expr("2*x", Z_10))
move_39 = Move(Geometry=extr_6, Motion=vec_2.Vector)  # -> Geometry, Transform

brec_11 = BoundingRectangle(Geometry=flatten(dso_40.Polyline), Plane=PlaneXY(0, 0, 0), Axis=0, Slide=0, Union=True)  # -> Bounding, DimensionX, DimensionY
project_12 = Project(Geometry=brec_11.Bounding, Plane=xy_4)  # -> Geometry, Transform
polyoffset_8 = PolylineOffset(
    Polylines=project_12.Geometry,
    Distance=Slider(1, range=0..1),
    Plane=xy_4,
    Tolerance=0.0001,
    ClosedFillet=1,
    OpenFillet=1,
    Miter=2)  # -> Contour, Holes
rdiff_4 = RegionDifference(CurvesA=polyoffset_8.Contour, CurvesB=project_12.Geometry)
boundary_23 = BoundarySurfaces(Edges=rdiff_4)
Z_11 = UnitZ(Factor=number_slider_17)
move_40 = Move(Geometry=boundary_23, Motion=expr("-x", Z_11))  # -> Geometry, Transform
extr_7 = Extrude(Base=move_40.Geometry, Direction=expr("2*x", Z_11))
move_41 = Move(Geometry=extr_7, Motion=vec_2.Vector)  # -> Geometry, Transform

generate_beam_2 = GenerateBeam(
    EdgePlanes=cluster_28.geo_6,
    Polyline=cluster_28.geo_4,
    BasePlane=cluster_28.geo_5,
    TopPlateOffset=item_42.Item2,
    BottomPlateOffset=item_42.Item1,
    BeamWidths=split_76.Positive,
    BeamWidthMinimum=toggle_2,
    BeamMinLength=number_slider_10,
    FabricationTolerance=number_slider_9,
    FlipBeams=False)  # -> Beams, BeamPlanes, BoundingBox, InteriorPlanes, simplify(EndPlanes), ExteriorLengths, InteriorLengths

geo_59 = Geometry(generate_beam_2.EndPlanes)
trim_17 = TrimTree(Tree=geo_59, Depth=1)
shift = ShiftList(List=trim_17, Shift=1, Wrap=False)
partition = PartitionList(List=shift, Size=2)
item_58 = ListItem(List=partition, Index=0, Wrap=True)
pt_4 = Point(partition)
avr_3 = Average(Input=pt_4)
pl_origin_6 = PlaneOrigin(Base=item_58, Origin=avr_3)
trim_18 = TrimTree(Tree=pl_origin_6, Depth=1)  # -> simplify(Tree)
shift_2 = ShiftList(List=trim_18, Shift=-1, Wrap=False)
geo_60 = Geometry(reverse(shift_2))
move_42 = Move(Geometry=geo_60, Motion=expr("-x", vec_2.Vector))  # -> Geometry, Transform
match_9 = MatchTree(Tree=move_42.Geometry, Guide=cluster_28.geo_4)
split_77 = SplitTree(Data=simplify(match_9), Masks=flatten(tstat_15.Paths))  # -> Positive, Negative

geo_61 = Geometry(reverse(generate_beam_2.InteriorPlanes))
move_43 = Move(Geometry=geo_61, Motion=expr("-x", vec_2.Vector))  # -> Geometry, Transform
match_10 = MatchTree(Tree=move_43.Geometry, Guide=cluster_28.geo_4)
split_78 = SplitTree(Data=simplify(match_10), Masks=flatten(tstat_15.Paths))  # -> Positive, Negative

pl_offset_4 = PlaneOffset(BasePlane=split_78.Positive, Offset=offset_from_beams)

ppx = PlanePlane(PlaneA=planar_2.Plane, PlaneB=pl_offset_4)
cluster_30 = Cluster_31(A=planar_2.Plane, _0=pl_offset_4, _1=split_77.Positive)  # -> simplify(pl)

shift_3 = ShiftList(List=ppx, Shift=1, Wrap=True)  # -> simplify(List)
llx = LineLine(Line1=ppx, Line2=shift_3)  # -> ParamA, ParamB, PointA, PointB
pline = PolyLine(Vertices=llx.PointA, Closed=True)

polyline_interior_angles = PolylineInteriorAngles(Polyline=cluster_30)  # -> Angles, Points
deg = Degrees(Radians=polyline_interior_angles.Angles)
smaller_3 = SmallerThan(FirstNumber=deg, SecondNumber=5)  # -> SmallerThan, OrEqualTo
cull_6 = CullPattern(List=polyline_interior_angles.Points, CullPattern=invert(smaller_3.OrEqualTo))
cull_7 = CullPattern(List=polyline_interior_angles.Points, CullPattern=smaller_3.OrEqualTo)
pline_2 = PolyLine(Vertices=cull_6, Closed=True)

cx = CurveSelf(Curve=cluster_30)  # -> Points, Params
shatter = Shatter(Curve=cluster_30, Parameters=cx.Params)
len_11 = Length(Curve=shatter)
sort_20 = SortList(Keys=len_11, ValuesA=shatter)  # -> Keys, ValuesA
item_59 = ListItem(List=reverse(sort_20.ValuesA), Index=0, Wrap=True)  # -> simplify(Item)
clean_39 = CleanTree(RemoveNulls=True, RemoveInvalid=True, RemoveEmpty=True, Tree=item_59)
tstat_46 = TreeStatistics(Tree=simplify(clean_39))  # -> Paths, Length, Count

c_script_35 = CSharpScript(x=tstat_46.Paths)  # -> out, A; inputs x: list
# ---------- c_script_35: C# ----------
    if( x == null) A = "{!*}";
    else A = x;
# ---------- end c_script_35 ----------

split_79 = SplitTree(Data=cluster_30, Masks=flatten(c_script_35.A))  # -> Positive, Negative
merge_57 = Merge(Data1=split_79.Negative, Data2=clean_39)

boundary_24 = BoundarySurfaces(Edges=merge_57)
flip_4 = Flip(Surface=boundary_24, Guide=xy_3)  # -> Surface, Result
crv_cp = CurveClosestPoint(Point=midpt_4, Curve=merge_57)  # -> Point, Parameter, Distance
offsrf_15 = OffsetSurface(Surface=flip_4.Surface, Distance=acoustic_top, BothSides=acoustic_bottom, CreateSolid=True)  # -> simplify(Offset)

move_44 = Move(Geometry=offsrf_15, Motion=vec_2.Vector)  # -> Geometry, Transform

match_11 = MatchTree(Tree=offsrf_15, Guide=planar_2.Plane)

ln_5 = Line(StartPoint=midpt_4, EndPoint=crv_cp.Point)  # -> simplify(Line)
plx = LinePlane(Line=ln_5, Plane=split_78.Positive)  # -> Point, ParamL, ParamP
addition_8 = Addition(A=crv_cp.Distance, B=neg_7)
dist_3 = Distance(PointA=crv_cp.Point, PointB=plx.Point)
extremums_5 = MinMax(Number=flatten(dist_3))  # -> Minimum, Maximum

trim_19 = TrimTree(Tree=match_11, Depth=1)
avr_4 = Average(Input=flatten(dist_3))
geo_62 = Geometry(move_44.Geometry)

area_41 = Area(Geometry=trim_19)  # -> Area, Centroid
cp_6 = ClosestPoint(Point=area_41.Centroid, Cloud=flatten(area_23.Centroid))  # -> ClosestPoint, CPIndex, Distance
item_60 = ListItem(List=tstat_18.Paths, Index=cp_6.CPIndex, Wrap=True)  # -> flatten(Item)
tree_11 = CreateTree(Data=flatten(trim_19), Path=item_60, Ensure=tstat_18.Paths)  # -> simplify(Data)
move_45 = Move(Geometry=tree_11, Motion=vec_2.Vector)  # -> Geometry, Transform

panel_53 = Panel([extremums_5.Maximum, extremums_5.Minimum, avr_4])

geo_63 = Geometry(move_45.Geometry)

debrep_7 = DeconstructBrep(Brep=geo_63)  # -> Faces, Edges, Vertices
join_12 = BrepJoin(Breps=debrep_7.Faces)  # -> Breps, Closed

geo_64 = Geometry(join_12.Breps)
clash_8 = Clash(FirstSet=geo_64, SecondSet=merge_11, Distance=0, L=100)  # -> ClashCount, ClashPoints, ClashRadii, FirstIndex, SecondIndex
item_61 = ListItem(List=cap_4, Index=clash_8.SecondIndex, Wrap=True)
sdiff_13 = SolidDifference(BrepsA=geo_64, BrepsB=item_61)

clean_40 = CleanTree(RemoveNulls=True, RemoveInvalid=True, RemoveEmpty=True, Tree=simplify(sdiff_13))
tstat_47 = TreeStatistics(Tree=clean_40)  # -> Paths, Length, Count
split_80 = SplitTree(Data=simplify(geo_64), Masks=flatten(tstat_47.Paths))  # -> Positive, Negative
merge_58 = Merge(Data1=clean_40, Data2=split_80.Negative)
clean_41 = CleanTree(RemoveNulls=True, RemoveInvalid=True, RemoveEmpty=False, Tree=merge_58)  # -> simplify(Tree)

data_25 = Data(item_61)

tstat_48 = TreeStatistics(Tree=cluster_26.T_2)  # -> Paths, Length, Count
clean_42 = CleanTree(RemoveNulls=True, RemoveInvalid=True, RemoveEmpty=True, Tree=simplify(data_25))
split_81 = SplitTree(Data=clean_42, Masks=flatten(tstat_48.Paths))  # -> Positive, Negative
tstat_49 = TreeStatistics(Tree=split_81.Positive)  # -> Paths, Length, Count
split_82 = SplitTree(Data=simplify(cluster_26.T_2), Masks=flatten(tstat_49.Paths))  # -> Positive, Negative
sdiff_14 = SolidDifference(BrepsA=split_82.Positive, BrepsB=split_81.Positive)
merge_59 = Merge(Data1=sdiff_14, Data2=split_82.Negative)

clean_43 = CleanTree(RemoveNulls=True, RemoveInvalid=True, RemoveEmpty=True, Tree=merge_58)  # -> simplify(Tree)
eso = ExtendSpeckleObject(SpeckleObject=clean_43, Type="Acoustic", selectedKitName="Objects")

debrep_8 = DeconstructBrep(Brep=clean_43)  # -> Faces, Edges, Vertices
area_42 = Area(Geometry=debrep_8.Faces)  # -> Area, Centroid
sort_21 = SortList(Keys=area_42.Area, ValuesA=debrep_8.Faces)  # -> Keys, reverse(ValuesA)

pl_offset_5 = PlaneOffset(BasePlane=geo_33, Offset=Slider(0.03, range=0..0.1))
clean_44 = CleanTree(RemoveNulls=True, RemoveInvalid=True, RemoveEmpty=True, Tree=pl_offset_5)
deplane_9 = DeconstructPlane(Plane=clean_44)  # -> Origin, XAxis, YAxis, ZAxis
tstat_50 = TreeStatistics(Tree=clean_44)  # -> Paths, Length, Count
split_83 = SplitTree(Data=generate_raw_plate.RawPlate, Masks=flatten(tstat_50.Paths))  # -> Positive, Negative
split_84 = SplitTree(Data=geo_55, Masks=flatten(tstat_50.Paths))  # -> Positive, Negative
deplane_10 = DeconstructPlane(Plane=split_84.Positive)  # -> Origin, XAxis, YAxis, ZAxis
pl_7 = ConstructPlane(Origin=deplane_9.Origin, XAxis=deplane_10.ZAxis, YAxis=deplane_9.YAxis)
c_script_36 = CSharpScript(x=pl_7, y=clean_44)  # -> out, A; inputs x: Plane, y: Plane
# ---------- c_script_36: C# ----------
    Plane pln = new Plane(x);
    if(pln.ZAxis.IsParallelTo(y.ZAxis, Math.PI / 3) != 1) pln = new Plane(pln.Origin, -1 * pln.ZAxis);
    A = pln;
# ---------- end c_script_36 ----------
filter_15 = StreamFilter(Gate=Toggle(True), Stream0=clean_44, Stream1=c_script_36.A)
pln_20 = Plane(filter_15)
deplane_11 = DeconstructPlane(Plane=pln_20)  # -> Origin, XAxis, YAxis, ZAxis
rectangle = Rectangle(Plane=pln_20, XSize=Domain(-10, 10), YSize=Domain(-10, 10), Radius=0)  # -> Rectangle, Length
boundary_25 = BoundarySurfaces(Edges=rectangle.Rectangle)
amp_2 = Amplitude(Vector=deplane_11.ZAxis, Amplitude=10)
extr_8 = Extrude(Base=boundary_25, Direction=amp_2)
area_43 = Area(Geometry=extr_8)  # -> Area, Centroid
splitmul = SplitBrepMultiple(Brep=split_83.Positive, Cutters=extr_8)
pt_5 = Point(Tree({1;0}: [Point(13.94306664, 49.39825059, 10.66570026), Point(13.95412015, 47.64501814, 10.72318285)], {1;1}: [Point(13.95407326, 20.02015211, 10.72209201), Point(13.94347529, 17.67669301, 10.71355134)], {1;4}: [Point(13.94306665, 48.36308513, 10.76611146)], {1;5}: [Point(13.94347809, 18.71670993, 10.71804063)], {1;6}: [Point(13.9540713, 18.98022503, 10.70361575)], {1;9}: [Point(13.95940248, 45.12987263, 10.6722738)]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))
dist_4 = Distance(PointA=pt_5, PointB=area_43.Centroid)
capex = CapHolesEx(Brep=splitmul)  # -> Brep, Caps, Solid
area_44 = Area(Geometry=capex.Brep)  # -> Area, Centroid
sort_22 = SortList(Keys=area_44.Area, ValuesA=capex.Brep)  # -> Keys, reverse(ValuesA)
item_62 = ListItem(List=sort_22.ValuesA, Index=0, Wrap=True)  # -> simplify(Item)
number_slider_23 = Slider(0, range=0..100)
trigger = Trigger(Interval=-100, TimerInterval=100, Target=c_script_37)

volume = Volume(Geometry=split_83.Positive)  # -> Volume, Centroid
volume_2 = Volume(Geometry=item_62)  # -> Volume, Centroid
division_18 = Division(A=volume_2.Volume, B=volume.Volume)
abs = Absolute(Value=division_18)
smaller_4 = SmallerThan(FirstNumber=abs, SecondNumber=0.97)  # -> SmallerThan, OrEqualTo

geo_65 = Geometry(item_62)

p_n_c = PickNChoose(Pattern=smaller_4.SmallerThan, Stream0=geo_65, Stream1=split_83.Positive)
merge_60 = Merge(Data1=p_n_c, Data2=split_83.Negative)

account_for_4_valent_edge = BooleanToggle(True)
filter_16 = StreamFilter(Gate=account_for_4_valent_edge, Stream0=generate_raw_plate.RawPlate, Stream1=merge_60)
cluster_31 = Cluster_45(C=planesrf_3, D=filter_16, M=tstat_43.Paths)
cluster_32 = Cluster_45(C=planesrf_3, D=generate_raw_plate.RawBoundingBox, M=tstat_43.Paths)
cluster_33 = Cluster_45(C=planesrf_3, D=bbox_7.Box, M=tstat_43.Paths)
cso_14 = CreateSpeckleObject(
    Offsets=generate_raw_plate.EdgeOffsets,
    Raw=filter_16,
    RawBoundingBox=cluster_32,
    RawFibreAlignedBB=simplify(cluster_33),
    OffsetPolyline=generate_raw_plate.OffsetPolyline,
    selectedKitName="Objects")

cull_8 = CullPattern(List=geo_65, CullPattern=invert(smaller_4.SmallerThan))
panel_54 = Panel(abs)

# ---- group: On-site Pockets
data_26 = Data(tstat.Paths)
split_85 = SplitTree(Data=simplify(geo_58), Masks=flatten(data_26))  # -> Positive, Negative

# ----
tstat_51 = TreeStatistics(Tree=split_85.Positive)  # -> Paths, Length, Count
split_86 = SplitTree(Data=item, Masks=flatten(tstat_51.Paths))  # -> Positive, Negative

# ---- group: On-site Pockets (continued)
sdiff_15 = SolidDifference(BrepsA=split_85.Positive, BrepsB=split_86.Positive)
# RAW
merge_61 = Merge(Data1=sdiff_15, Data2=split_85.Negative)

# ----
geo_66 = Geometry(merge_61)

lng_8 = ListLength(List=flatten(geo_65))
c_script_37 = CSharpScript(x=Button(), y=lng_8)  # -> out, A; inputs x: Boolean, y: Int32
# ---------- c_script_37: C# ----------
    if(x) counter = -1;
    else
    {
      if(counter != y)
        counter++;
    }
    A = counter;
# ---------- c_script_37: C# additional code ----------
  public int counter = 0;
# ---------- end c_script_37 ----------
tstat_52 = TreeStatistics(Tree=simplify(geo_65))  # -> Paths, Length, Count
item_63 = ListItem(List=flatten(tstat_52.Paths), Index=c_script_37.A, Wrap=True)
item_64 = ListItem(List=flatten(geo_65), Index=c_script_37.A, Wrap=True)
panel_55 = Panel(c_script_37.A)
item_65 = ListItem(List=flatten(split_83.Positive), Index=c_script_37.A, Wrap=True)
item_66 = ListItem(List=flatten(split_84.Positive), Index=c_script_37.A, Wrap=True)
split_87 = SplitTree(Data=simplify(geo_66), Masks=flatten(item_63))  # -> Positive, Negative
orient = Orient(Geometry=item_64, Source=item_66, Target=PlaneXY(0, 0, 0))  # -> Geometry, Transform
orient_2 = Orient(Geometry=item_65, Source=item_66, Target=PlaneXY(0, 0, 0))  # -> Geometry, Transform
orient_3 = Orient(Geometry=split_87.Positive, Source=item_66, Target=PlaneXY(0, 0, 0))  # -> Geometry, Transform
preview_18 = CustomPreview(Geometry=orient_3.Geometry, Material=ColourSwatch(SwatchColor=RGBA(255, 61, 61, 75)))
preview_19 = CustomPreview(Geometry=orient.Geometry, Material=ColourSwatch(SwatchColor=RGBA(46, 171, 255, 75)))
preview_20 = CustomPreview(Geometry=orient_2.Geometry, Material=ColourSwatch(SwatchColor=RGBA(79, 108, 255, 25)))

eso_2 = ExtendSpeckleObject(SpeckleObject=merge_61, Type="Solid", selectedKitName="Objects")

group = Group(Objects=generate_beam.EndPlanes)
trim_20 = TrimTree(Tree=group, Depth=1)  # -> reverse(Tree)
geo_67 = Geometry(reverse(cluster_29.geo_6))
match_12 = MatchTree(Tree=geo_67, Guide=generate_beam.Beams)

group_2 = Group(Objects=generate_beam_2.EndPlanes)
trim_21 = TrimTree(Tree=group_2, Depth=1)  # -> reverse(Tree)
geo_68 = Geometry(reverse(cluster_28.geo_6))
match_13 = MatchTree(Tree=geo_68, Guide=generate_beam_2.Beams)

# ---- group: Scales the beam to steps of 2cm with a min of 2cm
split_88 = SplitTree(Data=simplify(generate_raw_plate_2.EdgeOffsets), Masks=flatten("{*;1}"))  # -> Positive, Negative
item_67 = ListItem(List=generate_raw_plate_2.RawPlate, Index=0, Wrap=True)

# ----
cluster_34 = Cluster_4(
    pln=generate_beam.EndPlanes,
    num=split_88.Positive,
    geo=cluster_29.geo_6,
    geo_2=generate_beam.Beams,
    geo_3=generate_beam.BeamPlanes,
    num_2=generate_beam.InteriorLengths,
    geo_4=cluster_29.geo_4,
    geo_5=generate_beam.EndPlanes,
    D_2=generate_beam.BoundingBox)  # -> O, R_2, R, R_3, P, T

cluster_35 = Cluster_4(
    pln=generate_beam_2.EndPlanes,
    num=split_88.Positive,
    geo=cluster_28.geo_6,
    geo_2=generate_beam_2.Beams,
    geo_3=generate_beam_2.BeamPlanes,
    num_2=generate_beam_2.InteriorLengths,
    geo_4=cluster_28.geo_4,
    geo_5=generate_beam_2.EndPlanes,
    D_2=generate_beam_2.BoundingBox)  # -> O, R_2, R, R_3, P, T

# ---- group: Needs to be reversed
group_3 = Group(Objects=cluster_34.O)
geo_69 = Geometry(reverse(cluster_34.R))
geo_70 = Geometry(reverse(cluster_34.R_3))
num_8 = Number(reverse(cluster_34.R_2))
trim_22 = TrimTree(Tree=group_3, Depth=1)  # -> reverse(Tree)

group_4 = Group(Objects=cluster_35.O)
num_9 = Number(reverse(cluster_35.R_2))
geo_71 = Geometry(reverse(cluster_35.R))
geo_72 = Geometry(reverse(cluster_35.R_3))
trim_23 = TrimTree(Tree=group_4, Depth=1)  # -> reverse(Tree)

# ----
sdiff_16 = SolidDifference(BrepsA=geo_69, BrepsB=move_39.Geometry)  # -> simplify(Result)

sdiff_17 = SolidDifference(BrepsA=geo_71, BrepsB=move_41.Geometry)  # -> simplify(Result)

filter_17 = StreamFilter(Gate=Toggle(False), Stream0=geo_69, Stream1=sdiff_16)

filter_18 = StreamFilter(Gate=Toggle(False), Stream0=geo_71, Stream1=sdiff_17)

cluster_36 = Cluster_25(I=cluster_34.T, D=trim_20, M=cluster_34.P)
cluster_37 = Cluster_25(I=cluster_34.T, D=generate_beam.BeamPlanes, M=cluster_34.P)
cluster_38 = Cluster_25(I=cluster_34.T, D=generate_beam.InteriorPlanes, M=cluster_34.P)
match_14 = MatchTree(Tree=cluster_38, Guide=cluster_29.geo_4)
match_15 = MatchTree(Tree=cluster_36, Guide=cluster_29.geo_4)
cluster_39 = Cluster_25(I=cluster_34.T, D=match_12, M=cluster_34.P)
match_16 = MatchTree(Tree=cluster_37, Guide=cluster_29.geo_4)
ungroup = Ungroup(Group=match_15)
item_68 = ListItem(List=ungroup, Index=0, Wrap=True)  # -> Item, Item1
match_17 = MatchTree(Tree=cluster_39, Guide=cluster_29.geo_4)
match_18 = MatchTree(Tree=geo_69, Guide=cluster_29.geo_4)
trim_24 = TrimTree(Tree=item_68.Item, Depth=1)
trim_25 = TrimTree(Tree=item_68.Item1, Depth=1)
geo_73 = Geometry(reverse(match_16))
geo_74 = Geometry(reverse(match_14))
geo_75 = Geometry(match_18)

cluster_40 = Cluster_25(I=cluster_35.T, D=trim_21, M=cluster_35.P)
cluster_41 = Cluster_25(I=cluster_35.T, D=generate_beam_2.BeamPlanes, M=cluster_35.P)
cluster_42 = Cluster_25(I=cluster_35.T, D=generate_beam_2.InteriorPlanes, M=cluster_35.P)
match_19 = MatchTree(Tree=cluster_42, Guide=cluster_28.geo_4)
match_20 = MatchTree(Tree=cluster_40, Guide=cluster_28.geo_4)
cluster_43 = Cluster_25(I=cluster_35.T, D=match_13, M=cluster_35.P)
match_21 = MatchTree(Tree=cluster_41, Guide=cluster_28.geo_4)
ungroup_2 = Ungroup(Group=match_20)
item_69 = ListItem(List=ungroup_2, Index=0, Wrap=True)  # -> Item, Item1
match_22 = MatchTree(Tree=cluster_43, Guide=cluster_28.geo_4)
match_23 = MatchTree(Tree=filter_18, Guide=cluster_28.geo_4)
trim_26 = TrimTree(Tree=item_69.Item, Depth=1)
geo_76 = Geometry(reverse(match_21))
trim_27 = TrimTree(Tree=item_69.Item1, Depth=1)
geo_77 = Geometry(reverse(match_19))
geo_78 = Geometry(match_23)

geo_79 = Geometry(match_17)
geo_80 = Geometry(match_22)

split_89 = SplitTree(Data=geo_78, Masks=flatten(clean_16))  # -> Positive, Negative
split_90 = SplitTree(Data=geo_75, Masks=flatten(clean_16))  # -> Positive, Negative
merge_62 = Merge(Data1=split_90.Positive, Data2=split_89.Negative)
filter_19 = StreamFilter(Gate=thicker_bottom_plate, Stream0=geo_78, Stream1=merge_62)

match_24 = MatchTree(Tree=geo_72, Guide=cluster_28.geo_4)
match_25 = MatchTree(Tree=geo_70, Guide=cluster_28.geo_4)
cluster_44 = Cluster_27(data_2=match_24, G=thicker_bottom_plate, D=match_25, data=data_20)

match_26 = MatchTree(Tree=trim_27, Guide=cluster_28.geo_4)
match_27 = MatchTree(Tree=trim_25, Guide=cluster_28.geo_4)
cluster_45 = Cluster_27(data_2=match_26, G=thicker_bottom_plate, D=match_27, data=data_20)

match_28 = MatchTree(Tree=geo_80, Guide=cluster_28.geo_4)
match_29 = MatchTree(Tree=geo_79, Guide=cluster_28.geo_4)
cluster_46 = Cluster_27(data_2=match_28, G=thicker_bottom_plate, D=match_29, data=data_20)

match_30 = MatchTree(Tree=trim_26, Guide=cluster_28.geo_4)
match_31 = MatchTree(Tree=trim_24, Guide=cluster_28.geo_4)
cluster_47 = Cluster_27(data_2=match_30, G=thicker_bottom_plate, D=match_31, data=data_20)

match_32 = MatchTree(Tree=trim_23, Guide=cluster_28.geo_4)
match_33 = MatchTree(Tree=trim_22, Guide=cluster_28.geo_4)
cluster_48 = Cluster_27(data_2=match_32, G=thicker_bottom_plate, D=match_33, data=data_20)

match_34 = MatchTree(Tree=geo_76, Guide=cluster_28.geo_4)
match_35 = MatchTree(Tree=geo_73, Guide=cluster_28.geo_4)
cluster_49 = Cluster_27(data_2=match_34, G=thicker_bottom_plate, D=match_35, data=data_20)

match_36 = MatchTree(Tree=geo_77, Guide=cluster_28.geo_4)
match_37 = MatchTree(Tree=geo_74, Guide=cluster_28.geo_4)
cluster_50 = Cluster_27(data_2=match_36, G=thicker_bottom_plate, D=match_37, data=data_20)

match_38 = MatchTree(Tree=num_9, Guide=cluster_28.geo_4)
match_39 = MatchTree(Tree=num_8, Guide=cluster_28.geo_4)
cluster_51 = Cluster_27(data_2=match_38, G=thicker_bottom_plate, D=match_39, data=data_20)

# ---- group: Scales the beam to steps of 2cm with a min of 2cm (continued)
match_40 = MatchTree(Tree=cluster_44, Guide=cluster_25.geo_4)
match_41 = MatchTree(Tree=cluster_51, Guide=match_40)
c_script_38 = CSharpScript(x=match_40, y=simplify(match_41), z=raw_beam_offset)  # -> out, A, B, C; inputs y: Double, z: Double
# ---------- c_script_38: C# ----------
    Box box = (Box) x;

    double boxY = box.Y.Length;
    double totalWidth = boxY + y;
    double factor = 0.02;
    double roundWidth = Math.Ceiling(totalWidth / factor) * factor;
    double offset = roundWidth - boxY;
    Vector3d dir = box.Plane.YAxis;
    dir.Unitize();
    dir *= offset;
    box.Inflate(z, 0, 0);
    List<Point3d> pts = box.GetCorners().ToList();
    pts[0] -= dir;
    pts[1] -= dir;
    pts[4] -= dir;
    pts[5] -= dir;

    Box output = new Box(box.Plane, pts);
    A = output;
    B = output.Y.Length;
    C = output.X.Length;
# ---------- end c_script_38 ----------

# ----
match_42 = MatchTree(Tree=cluster_48, Guide=c_script_38.A)
ungroup_3 = Ungroup(Group=match_42)
planesrf_4 = PlaneSurface(Plane=ungroup_3, XSize=Domain(-1, 1), YSize=Domain(-1, 1))
splitmul_2 = SplitBrepMultiple(Brep=graft(c_script_38.A), Cutters=planesrf_4)
area_45 = Area(Geometry=splitmul_2)  # -> Area, Centroid
brepinc_3 = PointInBrep(Brep=graft(filter_19), Point=area_45.Centroid, Strict=True)
cull_9 = CullPattern(List=splitmul_2, CullPattern=brepinc_3)
capex_2 = CapHolesEx(Brep=cull_9)  # -> Brep, Caps, Solid
trim_28 = TrimTree(Tree=simplify(capex_2.Brep), Depth=1)

sort_val_6 = SortDuplicateValues(ValueList=flatten(c_script_38.B))  # -> UniqueValues, Indices
lng_9 = ListLength(List=sort_val_6.Indices)
concat_5 = Concatenate(
    FragmentF="Final Width",
    FragmentC="Raw Width = ",
    FragmentA=sort_val_6.UniqueValues,
    FragmentB="m : Count =  ",
    FragmentD=flatten(lng_9))
panel_56 = Panel(concat_5)

# ----
# Construct Speckle Objects
cso_15 = CreateSpeckleObject(BoundingBox=match_40, Raw=trim_28, RawBoundingBox=c_script_38.A, RawWidth=c_script_38.B, selectedKitName="Objects")

eso_3 = ExtendSpeckleObject(SpeckleObject=filter_19, Type="Beam", selectedKitName="Objects")
split_91 = SplitTree(Data=filter_19, Masks=flatten(clean_16))  # -> Positive, Negative
split_92 = SplitTree(Data=filter_19, Masks=flatten(clean_16))  # -> Positive, Negative
split_93 = SplitTree(Data=trim_28, Masks=flatten(clean_16))  # -> Positive, Negative
preview_21 = CustomPreview(Geometry=split_92.Positive, Material=ColourSwatch(SwatchColor=RGB(191, 63, 63)))
preview_22 = CustomPreview(Geometry=split_92.Negative, Material=ColourSwatch(SwatchColor=RGB(191, 136, 63)))
preview_23 = CustomPreview(Geometry=split_93.Negative, Material=ColourSwatch(SwatchColor=RGBA(191, 183, 63, 14)))
preview_24 = CustomPreview(Geometry=split_91.Negative, Material=ColourSwatch(SwatchColor=RGBA(102, 21, 232, 80)))

geo_81 = Geometry(cluster_44)
pln_21 = Plane(cluster_46)

brep_2 = Brep(geo_81)

division_19 = Division(A=data_15, B=2)

multiplication_2 = Multiplication(A=spacing_d, B=diameter)
division_20 = Division(A=multiplication_2, B=1000)

# ---- group: On-site Pockets
split_94 = SplitTree(Data=simplify(merge_59), Masks=flatten(data_17))  # -> Positive, Negative

# ----
split_95 = SplitTree(Data=split_94.Positive, Masks=flatten(tstat_37.Paths))  # -> Positive, Negative
tstat_53 = TreeStatistics(Tree=split_94.Positive)  # -> Paths, Length, Count
tstat_54 = TreeStatistics(Tree=split_95.Positive)  # -> Paths, Length, Count
split_96 = SplitTree(Data=data_16, Masks=flatten(tstat_53.Paths))  # -> Positive, Negative

# ---- group: On-site Pockets (continued)
sdiff_18 = SolidDifference(BrepsA=split_94.Positive, BrepsB=split_96.Positive)
merge_63 = Merge(Data1=sdiff_18, Data2=split_94.Negative)

# ----
geo_82 = Geometry(merge_63)
eso_4 = ExtendSpeckleObject(SpeckleObject=geo_82, Type="TopPlate", selectedKitName="Objects")

# ---- group: TP
cso_16 = CreateSpeckleObject(
    Geometry=eso_4,
    GeometryPreCut=merge_59,
    Raw=item_67,
    Material=dso_44.TopPlateMaterial,
    OutlineUpper=cluster_26.T,
    OutlineLower=cluster_26.T_3,
    selectedKitName="Objects")

# ----
cluster_52 = Cluster_30(T=cso_16)
panel_57 = Panel(cluster_52)
split_97 = SplitTree(Data=txt_4, Masks=flatten(tstat_54.Paths))  # -> Positive, Negative
split_98 = SplitTree(Data=split_97.Negative, Masks=flatten("{0,1;*}"))  # -> Positive, Negative

tstat_55 = TreeStatistics(Tree=simplify(cso_14))  # -> Paths, Length, Count
c_script_39 = CSharpScript(x=merge_61)  # -> out, A; inputs x: Brep; same code as c_script_19
tstat_56 = TreeStatistics(Tree=c_script_39.A)  # -> Paths, Length, Count

lng_10 = ListLength(List=cso_14)
dup_6 = DuplicateData(Data=graft(tstat_55.Paths), Number=lng_10, Order=True)  # -> flatten(Data)

tree_12 = CreateTree(Data=flatten(cso_14), Path=dup_6, Ensure=tstat_56.Paths)

# ---- group: Solid
cso_17 = CreateSpeckleObject(
    FingerJoint=clean_36,
    Extra=clean_37,
    Geometry=eso_2,
    GeometryJSON=c_script_39.A,
    Material=dso_44.SolidSegment,
    Raw=tree_12,
    IsOutsourced=split_68.Negative,
    selectedKitName="Objects")

# ----
cluster_53 = Cluster_30(T=cso_17)
panel_58 = Panel(cluster_53)

data_27 = Data(simplify(dso_40.Id))

sso = RenderMaterial(
    Opacity=1,
    Metalness=0,
    Roughness=1,
    Diffuse=c_script_34.A,
    SelectedConstructorName="Objects.Other.RenderMaterial.ctor(System.Double,System.Double,System.Double,System.Nullable`1[System.Drawing.Color],System.Nullable`1[System.Drawing.Color])",
    SelectedTypeName="Objects.Other.RenderMaterial",
    UseSchemaTag=False,
    UserSetSchemaTag=False,
    seed="555265bba8c7cba49671")
panel_59 = Panel("https://app.speckle.systems/projects/fa2b5c68c0/models/c325a9a9dc")

cso_18 = CreateSpeckleObject(
    Id=dso_40.Id,
    ShellPreCut=cso_5,
    ShellJSON=c_script_19.A,
    ShellExtraPeices=move_29.Geometry,
    Shell=geo_53,
    Acoustic=simplify(clean_41),
    Type=txt_4,
    IsOutsourced=data_7,
    selectedKitName="Objects")
sso_2 = RenderMaterial(
    Opacity=0.5,
    Metalness=0,
    Roughness=1,
    Diffuse=c_script_34.A,
    SelectedConstructorName="Objects.Other.RenderMaterial.ctor(System.Double,System.Double,System.Double,System.Nullable`1[System.Drawing.Color],System.Nullable`1[System.Drawing.Color])",
    SelectedTypeName="Objects.Other.RenderMaterial",
    UseSchemaTag=False,
    UserSetSchemaTag=False,
    seed="e32e69875568463a5275")
panel_60 = Panel("[LPH5 Rev_7]DataDrop - DD17 WIP - Updated Brim, Updated OnSite Pockets")
panel_61 = Panel("https://speckle.xyz/streams/fa2b5c68c0/branches/02-development/3-simple_model")

eso_5 = ExtendSpeckleObject(SpeckleObject=cso_18, RenderMaterial=sso_2, selectedKitName="Objects")

trim_29 = TrimTree(Tree=simplify(eso_5), Depth=1)
cso_19 = CreateSpeckleObject(Simple_Solids=trim_29, Parent=concat_4, ReleaseNotes=note, selectedKitName="Objects")  # -> flatten(SpeckleObject)
send = Send(
    Stream=panel_61,
    Message=panel_60,
    Data=cso_19,
    AutoSend=False,
    BaseId="0f886424140577a38ba005ed456b4b29",
    CurrentComponentState="up_to_date",
    KitName="Objects",
    OutputWrappers="https://app.speckle.systems\tfa2b5c68c0\tc18d5ccaa6",
    UseDefaultCache=True,
    selectedKitName="Objects")

panel_62 = Panel(panel_60)
panel_63 = Panel(send)
dso_45 = DeconstructSpeckleObject(SpeckleObject=cso_18, selectedKitName="Objects")  # -> Acoustic, Id, IsOutsourced, Shell, ShellExtraPeices, ShellJSON, ShellPreCut, Type; disabled
string_filter_7 = StringFilter(Text=dso_45.Type, Object=dso_45.ShellPreCut, Key=panel_23)  # -> Text, Object; disabled
string_filter_8 = StringFilter(Text=dso_45.Type, Object=dso_40.Polyline, Key=panel_24)  # -> Text, Object; disabled
clean_45 = CleanTree(RemoveNulls=True, RemoveInvalid=True, RemoveEmpty=True, Tree=string_filter_7.Object)  # disabled
string_filter_9 = StringFilter(Text=dso_45.Type, Object=dso_40.Polyline, Key=panel_25)  # -> Text, Object; disabled
move_46 = Move(Geometry=string_filter_8.Object, Motion=vec_2.Vector)  # -> Geometry, Transform; disabled
clean_46 = CleanTree(RemoveNulls=True, RemoveInvalid=True, RemoveEmpty=True, Tree=move_46.Geometry)  # disabled
move_47 = Move(Geometry=string_filter_9.Object, Motion=vec_2.Vector)  # -> Geometry, Transform; disabled
dso_46 = DeconstructSpeckleObject(SpeckleObject=clean_45, selectedKitName="Objects")  # -> BottomContour, BottomHoles, FourValentEdgePlanes, MitrePlanes, Segment, TopContour; disabled
clean_47 = CleanTree(RemoveNulls=True, RemoveInvalid=True, RemoveEmpty=True, Tree=move_47.Geometry)  # disabled
area_46 = Area(Geometry=clean_46)  # -> Area, Centroid; disabled
boundary_26 = BoundarySurfaces(Edges=clean_46)  # disabled
boundary_27 = BoundarySurfaces(Edges=clean_47)  # disabled
area_47 = Area(Geometry=clean_47)  # -> Area, Centroid; disabled
boundary_28 = BoundarySurfaces(Edges=dso_46.TopContour)  # disabled
ma_4 = MassAddition(Input=flatten(area_46.Area))  # -> Result, PartialResults; disabled
crv_22 = Curve(dso_46.TopContour)  # disabled
ma_5 = MassAddition(Input=flatten(area_47.Area))  # -> Result, PartialResults; disabled
area_48 = Area(Geometry=dso_46.BottomContour)  # -> Area, Centroid; disabled
area_49 = Area(Geometry=dso_46.TopContour)  # -> Area, Centroid; disabled
panel_64 = Panel(ma_4.Result)  # disabled
max = Maximum(A=area_48.Area, B=area_49.Area)  # disabled
panel_65 = Panel(ma_5.Result)  # disabled
ma_6 = MassAddition(Input=flatten(max))  # -> Result, PartialResults; disabled
panel_66 = Panel(ma_6.Result)  # disabled
split_99 = SplitTree(Data=sso_2, Masks=flatten(tstat_54.Paths))  # -> Positive, Negative
split_100 = SplitTree(Data=split_99.Negative, Masks=flatten("{0,1;*}"))  # -> Positive, Negative

layers = CreateModifyLayers(LayerName=panel_51, LayerColor=flatten(c_script_34.A), DeleteLayer=False, enableFullPath=False)  # -> LayerNames, LayerFullPath
createatts = CreateAttributes(Name=match_7, LayerName=txt_4, Color=c_script_34.A, UserDataKeys=panel_22, UserDataValues=merge_55, enableFullPath=True)
createatts_2 = CreateAttributes(
    Name=match_7,
    LayerName=txt_4,
    Color=ColourSwatch(SwatchColor=RGB(240, 240, 240)),
    UserDataKeys=panel_22,
    UserDataValues=merge_55,
    enableFullPath=True)

filter_20 = StreamFilter(Gate=monotone, Stream0=createatts, Stream1=createatts_2)

bake = BakeGeometry(Bake=Button(), Geometry=geo_53, Attributes=filter_20, DeleteOldBakes=False, PreserveTrees=False)

pln_22 = Plane(cluster_27.T)
pln_23 = Plane(cluster_27.s_1)
merge_64 = Merge(Data1=pln_23, Data2=pln_22)
avrpln = AveragePlane(Planes=merge_64)

# ----
# Beams Wood Nails
nail_spacing = Slider(0.4, range=0..1)
c_script_40 = CSharpScript(x=cluster_44, y=nail_spacing, z=num_4)  # -> out, A; inputs x: Box, y: Double, z: Double
# ---------- c_script_40: C# ----------
    List<Plane> output = new List<Plane>();

    List<Point3d> corners = x.GetCorners().ToList();
    Line edge = new Line(corners[4], corners[5]);

    int count = (int) (edge.Length / y);
    double distance = y;
    double mod = edge.Length % y;
    double factor = 0.8;

    if(count < 2)
    {
      count = 2;
      distance = (factor * edge.Length) / 2;
      mod = edge.Length * (1 - factor);
    }

    mod /= -2;
    edge.Extend(mod, mod);

    for (int i = 0; i < count; i++)
    {

      Point3d pt = edge.PointAtLength(i * distance);
      Vector3d dirZ = x.Plane.ZAxis;
      dirZ.Reverse();
      dirZ.Unitize();
      pt += dirZ * x.Z.Length / 4;
      Plane gripperPlane = new Plane(pt, x.Plane.XAxis, x.Plane.ZAxis);
      gripperPlane.Rotate(-3 * Math.PI / 4, gripperPlane.XAxis);
      output.Add(gripperPlane);

      Vector3d dirY = x.Plane.YAxis;
      dirY.Unitize();
      pt += dirZ * (x.Z.Length / 2 + z);
      pt += dirY * x.Y.Length / 2;
      output.Add(new Plane(pt, x.Plane.XAxis, x.Plane.YAxis));
    }

    A = output;
# ---------- end c_script_40 ----------
number_slider_24 = Slider(0.09, range=0..0.1)
number_slider_25 = Slider(0.0053, range=0..0.01)
deplane_12 = DeconstructPlane(Plane=c_script_40.A)  # -> Origin, XAxis, YAxis, ZAxis

pln_24 = Plane(c_script_40.A)
cso_20 = CreateSpeckleObject(
    FrameBase=graft(pln_21),
    Geo=graft(brep_2),
    Nails=pln_24,
    OffsetPositive=number_slider_24,
    OffsetNegative=Slider(0, range=0..100),
    Name="Wood Nails",
    Type="Pilot",
    selectedKitName="Objects")
trim_30 = TrimTree(Tree=cso_20, Depth=1)

merge_65 = Merge(Data1=tree_10, Data2=trim_5, Data3=trim_30)

c_script_41 = CSharpScript(
    iSolidOperator_Speckle=merge_65,
    Reference=["C:\USERS\LASATHS\DESKTOP\LIBRARIES\ABXM.PLATESTRUCTURES\LCRL.dll", "C:\Users\lasaths\AppData\Roaming\Grasshopper\Libraries\ABxM.PlateStructures\ElementBase.dll", "C:\Users\lasaths\AppData\Roaming\Grasshopper\Libraries\FabFramework\Fab.Core.dll", "C:\Users\lasaths\AppData\Roaming\McNeel\Rhinoceros\7.0\Plug-ins\SpeckleRhino2 (8dd5f30b-a13d-4a24-abdc-3e05c8c87143)\SpeckleCore2.dll", "C:\Windows\Microsoft.NET\assembly\GAC_MSIL\netstandard\v4.0_2.0.0.0__cc7b13ffcd2ddd51\netstandard.dll", "C:\Users\lasaths\AppData\Roaming\McNeel\Rhinoceros\7.0\Plug-ins\SpeckleRhino2 (8dd5f30b-a13d-4a24-abdc-3e05c8c87143)\SpeckleConnectorGrasshopper.gha", "C:\Users\lasaths\AppData\Roaming\Speckle\Kits\Objects\Objects.Converter.Grasshopper7.dll", "C:\Users\lasaths\AppData\Roaming\Speckle\Kits\Objects\Objects.dll"])  # -> out, A; disabled
# ---------- c_script_41: C# usings ----------
using Fab.Core.FabCollection;
using Fab.Core.DesignElement;
using System.Linq;
using Grasshopper.Kernel.Components;
using System.Net.NetworkInformation;
using ABxM.PlateStructures.Development;
using Speckle.Core.Models;
using Objects.Converter.RhinoGh;
using Objects.Geometry;
using Speckle.Core.Kits;
using System.Reflection;

// Alias definitions for convenience.
using RhinoPlane = Rhino.Geometry.Plane;
using RhinoLine = Rhino.Geometry.Line;
using RhinoBrep = Rhino.Geometry.Brep;
using RhinoBox = Rhino.Geometry.BoundingBox;
using RhinoPoint = Rhino.Geometry.Point;
using RhinoVector3d = Rhino.Geometry.Vector3d;
using SpecklePlane = Objects.Geometry.Plane;
using SpeckleLine = Objects.Geometry.Line;
using SpeckleBrep = Objects.Geometry.Brep;
using SpeckleBox = Objects.Geometry.Box;
using SpecklePoint = Objects.Geometry.Point;
using SpeckleVector = Objects.Geometry.Vector;
# ---------- c_script_41: C# ----------
    // Cast the input to a Speckle Base object.
    Base speckleObj = iSolidOperator_Speckle as Base;
    if (speckleObj == null)
    {
      Print("Input is not a valid Speckle object.");
      return;
    }
    A = ConverterHelper.PopulateSolidOperator(speckleObj);
# ---------- c_script_41: C# additional code ----------
  public static class ConverterHelper
  {
    public static SolidOperator PopulateSolidOperator(Base speckleObj)
    {
      // Retrieve required properties.
      string name = speckleObj["@Name"] as string;
      string typeStr = speckleObj["@Type"] as string;
      if (string.IsNullOrEmpty(name))
        throw new ArgumentException("The Speckle object is missing the '@Name' property.");
      if (string.IsNullOrEmpty(typeStr))
        throw new ArgumentException("The Speckle object is missing the '@Type' property.");

      // Convert the type string to the SolidOperatorType enum.
      SolidOperatorType opType;
      if (!Enum.TryParse(typeStr, true, out opType))
        throw new ArgumentException("Invalid SolidOperatorType: " + typeStr);

      // Create a converter instance and set the active Rhino document.
      ConverterRhinoGh converter = new ConverterRhinoGh();
      converter.SetContextDocument(RhinoDoc.ActiveDoc);

      // Retrieve dynamic members from the Speckle object.
      IDictionary<string, object> dynamicMembers = speckleObj.GetMembers(DynamicBaseMemberType.Dynamic);

      // Retrieve the plane (FrameBase/Plane) for the operator.
      object planeObj = null;
      if (dynamicMembers.ContainsKey("FrameBase"))
        planeObj = dynamicMembers["FrameBase"];
      else if (dynamicMembers.ContainsKey("@FrameBase"))
        planeObj = dynamicMembers["@FrameBase"];
      else if (dynamicMembers.ContainsKey("@Plane"))
        planeObj = dynamicMembers["@Plane"];
      if (planeObj == null)
        throw new ArgumentException("The Speckle object does not contain a valid plane definition.");

      RhinoPlane frameBase;
      SpecklePlane sp = planeObj as SpecklePlane;
      if (sp != null)
      {
        frameBase = converter.PlaneToNative(sp);
      }
      else
      {
        throw new Exception("Plane conversion failed: unrecognized type.");
      }

      // Process known optional properties.
      Rhino.Geometry.Curve path = null;
      if (dynamicMembers.ContainsKey("@Path"))
      {
        object pathObj = dynamicMembers["@Path"];
        SpeckleLine sLine = pathObj as SpeckleLine;
        if (sLine != null)
        {
          RhinoLine nativeLine = converter.LineToNative(sLine).Line;
          path = new LineCurve(nativeLine);
        }
      }
      double offsetPositive = 0.0;
      double offsetNegative = 0.0;
      if (dynamicMembers.ContainsKey("@OffsetPositive"))
        offsetPositive = Convert.ToDouble(dynamicMembers["@OffsetPositive"]);
      if (dynamicMembers.ContainsKey("@OffsetNegative"))
        offsetNegative = Convert.ToDouble(dynamicMembers["@OffsetNegative"]);

      // Create the SolidOperator instance using the appropriate constructor.
      SolidOperator solidOp;
      if (path != null)
        solidOp = new SolidOperator(name, opType, frameBase, path, offsetPositive, offsetNegative);
      else
        solidOp = new SolidOperator(name, opType, frameBase);

      solidOp.Name = name;
      
      // Prepare a set of keys that have been explicitly processed.
      HashSet<string> processedKeys = new HashSet<string>
        {
          "@Name", "@Type", "FrameBase", "@FrameBase", "Plane", "Path", "OffsetPositive", "OffsetNegative"
          };

      // Special handling: if the Speckle object contains the "Geo" key,
      // convert and assign its value to the Geometry property using a classic cast.

      if (dynamicMembers.ContainsKey("@Geo"))
      {
        RhinoApp.WriteLine("Starting GEO");

        object geoObj = dynamicMembers["@Geo"];
        // Use classic casting instead of inline pattern matching.
        var sGeo = geoObj as Objects.Geometry.Brep;
        if (sGeo != null)
        {
          List<string> notes = new List<string>();
          solidOp.Geometry = converter.BrepToNative(sGeo, out notes);
        }
        else
        {
          throw new Exception("Geo conversion failed: unrecognized type.");
        }
        processedKeys.Add("Geo");
      }

      // Use reflection to process any additional dynamic properties.
      Type solidOpType = solidOp.GetType();
      foreach (string key in dynamicMembers.Keys)
      {
        if (processedKeys.Contains(key))
          continue;

        // Remove any "@" prefix.
        string dictKey = key.StartsWith("@") ? key.Substring(1) : key;
        if (dictKey == "Geo") continue;
        object value = dynamicMembers[key];
        if (value == null)
          continue;

        // Check if a settable property exists on SolidOperator.
        PropertyInfo prop = solidOpType.GetProperty(dictKey, BindingFlags.IgnoreCase | BindingFlags.Public | BindingFlags.Instance);
        if (prop != null && prop.CanWrite)
        {
          try
          {
            object converted = ConvertPropertyValue(prop.PropertyType, value, converter);
            if (converted == null)
              throw new Exception("Conversion returned null.");
            prop.SetValue(solidOp, converted, null);
          }
          catch (Exception ex)
          {
            RhinoApp.WriteLine("Failed to assign property " + dictKey + ": " + ex.Message);
          }
          continue;
        }

        // Fallback: add unrecognized members to the CustomData dictionary.
        if (solidOp.CustomData == null)
          solidOp.CustomData = new Dictionary<string, object>();
        if (!solidOp.CustomData.ContainsKey(dictKey))
          solidOp.CustomData[dictKey] = value;
      }

      return solidOp;
    }

    public static object ConvertPropertyValue(Type targetType, object value, ConverterRhinoGh converter)
    {
      if (targetType == typeof(string))
        return value.ToString();
      if (targetType == typeof(int))
        return Convert.ToInt32(value);
      if (targetType == typeof(double))
        return Convert.ToDouble(value);
      if (targetType == typeof(bool))
        return Convert.ToBoolean(value);
      if (targetType == typeof(RhinoPlane))
      {
        SpecklePlane sp = value as SpecklePlane;
        if (sp != null)
          return converter.PlaneToNative(sp);
      }
      if (targetType == typeof(RhinoBrep))
      {
        if (value is SpeckleBrep)
        {
          SpeckleBrep sb = value as SpeckleBrep;
          List<string> notes;
          RhinoBrep brep = converter.BrepToNative(sb, out notes);
          if (brep == null)
            throw new Exception("Brep conversion returned null. Notes: " + string.Join(", ", notes));
          return brep;
        }
        else if (value is SpeckleBox)
        {
          SpeckleBox sbox = value as SpeckleBox;
          RhinoBox box = converter.BoxToNative(sbox).BoundingBox;
          RhinoBrep brep = box.ToBrep();
          return brep;
        }
      }
      if (targetType == typeof(RhinoBox))
      {
        SpeckleBox sbox = value as SpeckleBox;
        if (sbox != null)
          return converter.BoxToNative(sbox);
      }
      if (targetType == typeof(Point3d))
      {
        SpecklePoint spt = value as SpecklePoint;
        if (spt != null)
        {
          RhinoPoint pt = converter.PointToNative(spt);
          return pt.Location;
        }
      }
      if (targetType == typeof(RhinoVector3d))
      {
        SpeckleVector sv = value as SpeckleVector;
        if (sv != null)
          return converter.VectorToNative(sv);
      }
      if (targetType == typeof(RhinoLine))
      {
        SpeckleLine sl = value as SpeckleLine;
        if (sl != null)
          return converter.LineToNative(sl).Line;
      }
      return value;
    }
  }
# ---------- end c_script_41 ----------
c_script_42 = CSharpScript(
    iSolidOperator_Speckle=merge_65,
    Reference=["C:\USERS\LASATHS\DESKTOP\LIBRARIES\ABXM.PLATESTRUCTURES\LCRL.dll", "C:\Users\lasaths\AppData\Roaming\Grasshopper\Libraries\ABxM.PlateStructures\ElementBase.dll", "C:\Users\lasaths\AppData\Roaming\Grasshopper\Libraries\FabFramework\Fab.Core.dll", "C:\Users\lasaths\AppData\Roaming\McNeel\Rhinoceros\7.0\Plug-ins\SpeckleRhino2 (8dd5f30b-a13d-4a24-abdc-3e05c8c87143)\SpeckleCore2.dll", "C:\Windows\Microsoft.NET\assembly\GAC_MSIL\netstandard\v4.0_2.0.0.0__cc7b13ffcd2ddd51\netstandard.dll", "C:\Users\lasaths\AppData\Roaming\McNeel\Rhinoceros\7.0\Plug-ins\SpeckleRhino2 (8dd5f30b-a13d-4a24-abdc-3e05c8c87143)\SpeckleConnectorGrasshopper.gha", "C:\Users\lasaths\AppData\Roaming\Speckle\Kits\Objects\Objects.Converter.Grasshopper7.dll", "C:\Users\lasaths\AppData\Roaming\Speckle\Kits\Objects\Objects.dll"])  # -> out, A; disabled
# ---------- c_script_42: C# ----------
    // Cast the input to a Speckle Base object.
    Base speckleObj = iSolidOperator_Speckle as Base;
    if (speckleObj == null)
    {
      Print("Input is not a valid Speckle object.");
      return;
    }
    A = ConverterHelper.PopulateSolidOperator(speckleObj);
# ---------- c_script_42: C# additional code ----------
  public static class ConverterHelper
  {
    public static SolidOperator PopulateSolidOperator(Base speckleObj)
    {
      // Retrieve required properties.
      string name = speckleObj["@Name"] as string;
      string typeStr = speckleObj["@Type"] as string;
      if (string.IsNullOrEmpty(name))
        throw new ArgumentException("The Speckle object is missing the '@Name' property.");
      if (string.IsNullOrEmpty(typeStr))
        throw new ArgumentException("The Speckle object is missing the '@Type' property.");

      // Convert the type string to the SolidOperatorType enum.
      SolidOperatorType opType;
      if (!Enum.TryParse(typeStr, true, out opType))
        throw new ArgumentException("Invalid SolidOperatorType: " + typeStr);

      // Create a converter instance and set the active Rhino document.
      ConverterRhinoGh converter = new ConverterRhinoGh();
      converter.SetContextDocument(RhinoDoc.ActiveDoc);

      // Retrieve dynamic members from the Speckle object.
      IDictionary<string, object> dynamicMembers = speckleObj.GetMembers(DynamicBaseMemberType.Dynamic);

      // Retrieve the plane (FrameBase/Plane) for the operator.
      object planeObj = null;
      if (dynamicMembers.ContainsKey("FrameBase"))
        planeObj = dynamicMembers["FrameBase"];
      else if (dynamicMembers.ContainsKey("@FrameBase"))
        planeObj = dynamicMembers["@FrameBase"];
      else if (dynamicMembers.ContainsKey("@Plane"))
        planeObj = dynamicMembers["@Plane"];
      if (planeObj == null)
        throw new ArgumentException("The Speckle object does not contain a valid plane definition.");

      RhinoPlane frameBase;
      SpecklePlane sp = planeObj as SpecklePlane;
      if (sp != null)
      {
        frameBase = converter.PlaneToNative(sp);
      }
      else
      {
        throw new Exception("Plane conversion failed: unrecognized type.");
      }

      // Process known optional properties.
      Rhino.Geometry.Curve path = null;
      if (dynamicMembers.ContainsKey("@Path"))
      {
        object pathObj = dynamicMembers["@Path"];
        SpeckleLine sLine = pathObj as SpeckleLine;
        if (sLine != null)
        {
          RhinoLine nativeLine = converter.LineToNative(sLine).Line;
          path = new LineCurve(nativeLine);
        }
      }
      double offsetPositive = 0.0;
      double offsetNegative = 0.0;
      if (dynamicMembers.ContainsKey("@OffsetPositive"))
        offsetPositive = Convert.ToDouble(dynamicMembers["@OffsetPositive"]);
      if (dynamicMembers.ContainsKey("@OffsetNegative"))
        offsetNegative = Convert.ToDouble(dynamicMembers["@OffsetNegative"]);

      // Create the SolidOperator instance using the appropriate constructor.
      SolidOperator solidOp;
      if (path != null)
        solidOp = new SolidOperator(name, opType, frameBase, path, offsetPositive, offsetNegative);
      else
        solidOp = new SolidOperator(name, opType, frameBase);

      solidOp.Name = name;

      // Prepare a set of keys that have been explicitly processed.
      HashSet<string> processedKeys = new HashSet<string>
        {
          "@Name", "@Type", "FrameBase", "@FrameBase", "Plane", "Path", "OffsetPositive", "OffsetNegative"
          };

      // Special handling: if the Speckle object contains the "Geo" key,
      // convert and assign its value to the Geometry property using a classic cast.
      if (dynamicMembers.ContainsKey("@Geo"))
      {

        object geoObj = dynamicMembers["@Geo"];
        var sGeo = geoObj as Objects.Geometry.Brep;
        if (sGeo != null)
        {
          List<string> notes = new List<string>();
          solidOp.Geometry = converter.BrepToNative(sGeo, out notes);
        }
        else
        {
          throw new Exception("Geo conversion failed: unrecognized type.");
        }
        processedKeys.Add("Geo");
      }

      // Use reflection to process any additional dynamic properties.
      Type solidOpType = solidOp.GetType();
      foreach (string key in dynamicMembers.Keys)
      {
        if (processedKeys.Contains(key))
          continue;

        // Remove any "@" prefix.
        string dictKey = key.StartsWith("@") ? key.Substring(1) : key;
        if (dictKey == "Geo") continue;
        object value = dynamicMembers[key];
        if (value == null)
          continue;

        // Check if a settable property exists on SolidOperator.
        PropertyInfo prop = solidOpType.GetProperty(dictKey, BindingFlags.IgnoreCase | BindingFlags.Public | BindingFlags.Instance);
        if (prop != null && prop.CanWrite)
        {
          try
          {
            object converted = ConvertPropertyValue(prop.PropertyType, value, converter);
            if (converted == null)
              throw new Exception("Conversion returned null.");
            prop.SetValue(solidOp, converted, null);
          }
          catch (Exception ex)
          {
            RhinoApp.WriteLine("Failed to assign property " + dictKey + ": " + ex.Message);
          }
          continue;
        }

        // Fallback: add unrecognized members to the CustomData dictionary,
        // converting them to native Rhino types if possible.
        if (solidOp.CustomData == null)
          solidOp.CustomData = new Dictionary<string, object>();

        object nativeValue = ConvertCustomData(value, converter);
        if (!solidOp.CustomData.ContainsKey(dictKey))
          solidOp.CustomData[dictKey] = nativeValue;
      }

      return solidOp;
    }

    public static object ConvertPropertyValue(Type targetType, object value, ConverterRhinoGh converter)
    {
      if (targetType == typeof(string))
        return value.ToString();
      if (targetType == typeof(int))
        return Convert.ToInt32(value);
      if (targetType == typeof(double))
        return Convert.ToDouble(value);
      if (targetType == typeof(bool))
        return Convert.ToBoolean(value);
      if (targetType == typeof(RhinoPlane))
      {
        SpecklePlane sp = value as SpecklePlane;
        if (sp != null)
          return converter.PlaneToNative(sp);
      }
      if (targetType == typeof(RhinoBrep))
      {
        if (value is SpeckleBrep)
        {
          SpeckleBrep sb = value as SpeckleBrep;
          List<string> notes;
          RhinoBrep brep = converter.BrepToNative(sb, out notes);
          if (brep == null)
            throw new Exception("Brep conversion returned null. Notes: " + string.Join(", ", notes));
          return brep;
        }
        else if (value is SpeckleBox)
        {
          SpeckleBox sbox = value as SpeckleBox;
          RhinoBox box = converter.BoxToNative(sbox).BoundingBox;
          RhinoBrep brep = box.ToBrep();
          return brep;
        }
      }
      if (targetType == typeof(RhinoBox))
      {
        SpeckleBox sbox = value as SpeckleBox;
        if (sbox != null)
          return converter.BoxToNative(sbox);
      }
      if (targetType == typeof(Point3d))
      {
        SpecklePoint spt = value as SpecklePoint;
        if (spt != null)
        {
          RhinoPoint pt = converter.PointToNative(spt);
          return pt.Location;
        }
      }
      if (targetType == typeof(RhinoVector3d))
      {
        SpeckleVector sv = value as SpeckleVector;
        if (sv != null)
          return converter.VectorToNative(sv);
      }
      if (targetType == typeof(RhinoLine))
      {
        SpeckleLine sl = value as SpeckleLine;
        if (sl != null)
          return converter.LineToNative(sl).Line;
      }
      return value;
    }

    // Helper method to convert custom dynamic data to native Rhino types when possible.
    public static object ConvertCustomData(object value, ConverterRhinoGh converter)
    {
      SpecklePlane sp = value as SpecklePlane;
      if (sp != null)
      {
        return converter.PlaneToNative(sp);
      }

      SpeckleLine sl = value as SpeckleLine;
      if (sl != null)
      {
        return converter.LineToNative(sl).Line;
      }

      SpeckleBrep sb = value as SpeckleBrep;
      if (sb != null)
      {
        List<string> notes;
        RhinoBrep brep = converter.BrepToNative(sb, out notes);
        return brep;
      }

      SpeckleBox sbox = value as SpeckleBox;
      if (sbox != null)
      {
        return converter.BoxToNative(sbox);
      }

      SpecklePoint spt = value as SpecklePoint;
      if (spt != null)
      {
        return converter.PointToNative(spt);
      }

      SpeckleVector sv = value as SpeckleVector;
      if (sv != null)
      {
        return converter.VectorToNative(sv);
      }

      // If the value is not a recognized Speckle geometry type, return it as is.
      return value;
    }
  }
# ---------- end c_script_42 ----------

c_script_43 = CSharpScript(
    iSolidOperator_Speckle=merge_65,
    Reference=["C:\USERS\LASATHS\DESKTOP\LIBRARIES\ABXM.PLATESTRUCTURES\LCRL.dll", "C:\Users\lasaths\AppData\Roaming\Grasshopper\Libraries\ABxM.PlateStructures\ElementBase.dll", "C:\Users\lasaths\AppData\Roaming\Grasshopper\Libraries\FabFramework\Fab.Core.dll", "C:\Users\lasaths\AppData\Roaming\McNeel\Rhinoceros\7.0\Plug-ins\SpeckleRhino2 (8dd5f30b-a13d-4a24-abdc-3e05c8c87143)\SpeckleCore2.dll", "C:\Windows\Microsoft.NET\assembly\GAC_MSIL\netstandard\v4.0_2.0.0.0__cc7b13ffcd2ddd51\netstandard.dll", "C:\Users\lasaths\AppData\Roaming\McNeel\Rhinoceros\7.0\Plug-ins\SpeckleRhino2 (8dd5f30b-a13d-4a24-abdc-3e05c8c87143)\SpeckleConnectorGrasshopper.gha", "C:\Users\lasaths\AppData\Roaming\Speckle\Kits\Objects\Objects.Converter.Grasshopper7.dll", "C:\Users\lasaths\AppData\Roaming\Speckle\Kits\Objects\Objects.dll"])  # -> out, A
# ---------- c_script_43: C# usings ----------
using Fab.Core.FabCollection;
using Fab.Core.DesignElement;
using System.Linq;
using Grasshopper.Kernel.Components;
using System.Net.NetworkInformation;
using ABxM.PlateStructures.Development;
using Speckle.Core.Models;
using Objects.Converter.RhinoGh;
using Objects.Geometry;
using Speckle.Core.Kits;
using System.Reflection;

// Alias definitions for convenience.
using RhinoPlane = Rhino.Geometry.Plane;
using RhinoLine = Rhino.Geometry.Line;
using RhinoBrep = Rhino.Geometry.Brep;
using RhinoBox = Rhino.Geometry.BoundingBox;
using RhinoPoint = Rhino.Geometry.Point;
using RhinoVector3d = Rhino.Geometry.Vector3d;
using SpecklePlane = Objects.Geometry.Plane;
using SpeckleLine = Objects.Geometry.Line;
using SpeckleBrep = Objects.Geometry.Brep;
using SpeckleBox = Objects.Geometry.Box;
using SpecklePoint = Objects.Geometry.Point;
using SpeckleVector = Objects.Geometry.Vector;
// Aliases to disambiguate Polyline, Mesh, ICurve, and PolylineCurve.
using RhinoPolyline = Rhino.Geometry.Polyline;
using SpecklePolyline = Objects.Geometry.Polyline;
using RhinoMesh = Rhino.Geometry.Mesh;
using SpeckleMesh = Objects.Geometry.Mesh;
using SpeckleICurve = Objects.ICurve;
using RhinoPolylineCurve = Rhino.Geometry.PolylineCurve;  // Explicit alias
# ---------- c_script_43: C# ----------
    // Cast the input to a Speckle Base object.
    Base speckleObj = iSolidOperator_Speckle as Base;
    if (speckleObj == null)
    {
      Print("Input is not a valid Speckle object.");
      return;
    }
    A = ConverterHelper.PopulateSolidOperator(speckleObj);
# ---------- c_script_43: C# additional code ----------
  public static class ConverterHelper
  {
    public static SolidOperator PopulateSolidOperator(Base speckleObj)
    {
      // Retrieve required properties.
      string name = speckleObj["@Name"] as string;
      string typeStr = speckleObj["@Type"] as string;
      if (string.IsNullOrEmpty(name))
      {
        throw new ArgumentException("The Speckle object is missing the '@Name' property.");
      }
      if (string.IsNullOrEmpty(typeStr))
      {
        throw new ArgumentException("The Speckle object is missing the '@Type' property.");
      }

      // Convert the type string to the SolidOperatorType enum.
      SolidOperatorType opType;
      if (!Enum.TryParse(typeStr, true, out opType))
      {
        throw new ArgumentException("Invalid SolidOperatorType: " + typeStr);
      }

      // Create a converter instance and set the active Rhino document.
      ConverterRhinoGh converter = new ConverterRhinoGh();
      converter.SetContextDocument(RhinoDoc.ActiveDoc);

      // Retrieve dynamic members from the Speckle object.
      IDictionary<string, object> dynamicMembers = speckleObj.GetMembers(DynamicBaseMemberType.Dynamic);

      // Retrieve the plane (FrameBase/Plane) for the operator.
      object planeObj = null;
      if (dynamicMembers.ContainsKey("FrameBase"))
      {
        planeObj = dynamicMembers["FrameBase"];
      }
      else if (dynamicMembers.ContainsKey("@FrameBase"))
      {
        planeObj = dynamicMembers["@FrameBase"];
      }
      else if (dynamicMembers.ContainsKey("@Plane"))
      {
        planeObj = dynamicMembers["@Plane"];
      }
      if (planeObj == null)
      {
        throw new ArgumentException("The Speckle object does not contain a valid plane definition.");
      }

      RhinoPlane frameBase;
      SpecklePlane sp = planeObj as SpecklePlane;
      if (sp != null)
      {
        frameBase = converter.PlaneToNative(sp);
      }
      else
      {
        throw new Exception("Plane conversion failed: unrecognized type.");
      }

      // Process known optional properties.
      Rhino.Geometry.Curve path = null;
      if (dynamicMembers.ContainsKey("@Path"))
      {
        object pathObj = dynamicMembers["@Path"];
        SpeckleLine sLine = pathObj as SpeckleLine;
        if (sLine != null)
        {
          RhinoLine nativeLine = converter.LineToNative(sLine).Line;
          path = new LineCurve(nativeLine);
        }
      }
      double offsetPositive = 0.0;
      double offsetNegative = 0.0;
      if (dynamicMembers.ContainsKey("@OffsetPositive"))
      {
        offsetPositive = Convert.ToDouble(dynamicMembers["@OffsetPositive"]);
      }
      if (dynamicMembers.ContainsKey("@OffsetNegative"))
      {
        offsetNegative = Convert.ToDouble(dynamicMembers["@OffsetNegative"]);
      }

      // Create the SolidOperator instance using the appropriate constructor.
      SolidOperator solidOp;
      if (path != null)
      {
        solidOp = new SolidOperator(name, opType, frameBase, path, offsetPositive, offsetNegative);
      }
      else
      {
        solidOp = new SolidOperator(name, opType, frameBase);
      }

      solidOp.Name = name;

      // Prepare a set of keys that have been explicitly processed.
      HashSet<string> processedKeys = new HashSet<string>
        {
          "@Name", "@Type", "FrameBase", "@FrameBase", "Plane", "Path", "OffsetPositive", "OffsetNegative"
          };

      // Special handling: if the Speckle object contains the "Geo" key,
      // convert and assign its value to the Geometry property.
      if (dynamicMembers.ContainsKey("@Geo"))
      {
        object geoObj = dynamicMembers["@Geo"];
        Objects.Geometry.Brep sGeo = geoObj as Objects.Geometry.Brep;
        if (sGeo != null)
        {
          List<string> notes = new List<string>();
          solidOp.Geometry = converter.BrepToNative(sGeo, out notes);
        }
        else
        {
          throw new Exception("Geo conversion failed: unrecognized type.");
        }
        processedKeys.Add("Geo");
      }

      // Use reflection to process any additional dynamic properties.
      Type solidOpType = solidOp.GetType();
      foreach (string key in dynamicMembers.Keys)
      {
        if (processedKeys.Contains(key))
        {
          continue;
        }

        // Remove any "@" prefix.
        string dictKey = key.StartsWith("@") ? key.Substring(1) : key;
        if (dictKey == "Geo")
        {
          continue;
        }
        object value = dynamicMembers[key];
        if (value == null)
        {
          continue;
        }

        // Check if a settable property exists on SolidOperator.
        PropertyInfo prop = solidOpType.GetProperty(dictKey, BindingFlags.IgnoreCase | BindingFlags.Public | BindingFlags.Instance);
        if (prop != null && prop.CanWrite)
        {
          try
          {
            object converted = ConvertPropertyValue(prop.PropertyType, value, converter);
            if (converted == null)
            {
              throw new Exception("Conversion returned null.");
            }
            prop.SetValue(solidOp, converted, null);
          }
          catch (Exception ex)
          {
            RhinoApp.WriteLine("Failed to assign property " + dictKey + ": " + ex.Message);
          }
          continue;
        }

        // Fallback: add unrecognized members to the CustomData dictionary.
        if (solidOp.CustomData == null)
        {
          solidOp.CustomData = new Dictionary<string, object>();
        }
        object nativeValue = ConvertCustomData(value, converter);
        if (!solidOp.CustomData.ContainsKey(dictKey))
        {
          solidOp.CustomData[dictKey] = nativeValue;
        }
      }

      return solidOp;
    }

    public static object ConvertPropertyValue(Type targetType, object value, ConverterRhinoGh converter)
    {
      if (targetType == typeof(string))
      {
        return value.ToString();
      }
      if (targetType == typeof(int))
      {
        return Convert.ToInt32(value);
      }
      if (targetType == typeof(double))
      {
        return Convert.ToDouble(value);
      }
      if (targetType == typeof(bool))
      {
        return Convert.ToBoolean(value);
      }
      if (targetType == typeof(RhinoPlane))
      {
        SpecklePlane sp = value as SpecklePlane;
        if (sp != null)
        {
          return converter.PlaneToNative(sp);
        }
      }
      if (targetType == typeof(RhinoBrep))
      {
        SpeckleBrep sb = value as SpeckleBrep;
        if (sb != null)
        {
          List<string> notes;
          RhinoBrep brep = converter.BrepToNative(sb, out notes);
          if (brep == null)
          {
            throw new Exception("Brep conversion returned null. Notes: " + string.Join(", ", notes));
          }
          return brep;
        }
        else
        {
          SpeckleBox sbox = value as SpeckleBox;
          if (sbox != null)
          {
            RhinoBox box = converter.BoxToNative(sbox).BoundingBox;
            RhinoBrep brep = box.ToBrep();
            return brep;
          }
        }
      }
      if (targetType == typeof(RhinoBox))
      {
        SpeckleBox sbox = value as SpeckleBox;
        if (sbox != null)
        {
          return converter.BoxToNative(sbox);
        }
      }
      if (targetType == typeof(Point3d))
      {
        SpecklePoint spt = value as SpecklePoint;
        if (spt != null)
        {
          RhinoPoint pt = converter.PointToNative(spt);
          return pt.Location;
        }
      }
      if (targetType == typeof(RhinoVector3d))
      {
        SpeckleVector sv = value as SpeckleVector;
        if (sv != null)
        {
          return converter.VectorToNative(sv);
        }
      }
      if (targetType == typeof(RhinoLine))
      {
        SpeckleLine sl = value as SpeckleLine;
        if (sl != null)
        {
          return converter.LineToNative(sl).Line;
        }
      }
      if (targetType == typeof(RhinoPolyline))
      {
        SpecklePolyline spPolyline = value as SpecklePolyline;
        if (spPolyline != null)
        {
          return converter.PolylineToNative(spPolyline);
        }
        else if (value is RhinoPolyline)
        {
          return (RhinoPolyline) value;
        }
      }
      if (targetType == typeof(RhinoPolylineCurve))
      {
        SpecklePolyline spPolyline = value as SpecklePolyline;
        if (spPolyline != null)
        {
          return new RhinoPolylineCurve(converter.PolylineToNative(spPolyline));
        }
        else if (value is RhinoPolylineCurve)
        {
          return (RhinoPolylineCurve) value;
        }
      }
      if (targetType == typeof(RhinoMesh))
      {
        SpeckleMesh spMesh = value as SpeckleMesh;
        if (spMesh != null)
        {
          return converter.MeshToNative(spMesh);
        }
      }
      if (targetType == typeof(Rhino.Geometry.Curve))
      {
        SpeckleICurve spCurve = value as SpeckleICurve;
        if (spCurve != null)
        {
          return converter.CurveToNative(spCurve);
        }
      }
      if (targetType == typeof(Rhino.Geometry.Surface))
      {
        Objects.Geometry.Surface spSurface = value as Objects.Geometry.Surface;
        if (spSurface != null)
        {
          return converter.SurfaceToNative(spSurface);
        }
      }
      // Removed Nurbs conversions due to missing implementations.
      return value;
    }

    public static object ConvertCustomData(object value, ConverterRhinoGh converter)
    {
      SpecklePlane sp = value as SpecklePlane;
      if (sp != null)
      {
        return converter.PlaneToNative(sp);
      }
      SpeckleLine sl = value as SpeckleLine;
      if (sl != null)
      {
        return converter.LineToNative(sl).Line;
      }
      SpeckleBrep sb = value as SpeckleBrep;
      if (sb != null)
      {
        List<string> notes;
        RhinoBrep brep = converter.BrepToNative(sb, out notes);
        return brep;
      }
      SpeckleBox sbox = value as SpeckleBox;
      if (sbox != null)
      {
        return converter.BoxToNative(sbox);
      }
      SpecklePoint spt = value as SpecklePoint;
      if (spt != null)
      {
        return converter.PointToNative(spt);
      }
      SpeckleVector sv = value as SpeckleVector;
      if (sv != null)
      {
        return converter.VectorToNative(sv);
      }
      SpecklePolyline spPolyline = value as SpecklePolyline;
      if (spPolyline != null)
      {
        return converter.PolylineToNative(spPolyline);
      }
      else if (value is RhinoPolyline)
      {
        return (RhinoPolyline) value;
      }
      if (value is RhinoPolylineCurve)
      {
        return (RhinoPolylineCurve) value;
      }
      SpeckleMesh spMesh = value as SpeckleMesh;
      if (spMesh != null)
      {
        return converter.MeshToNative(spMesh);
      }
      SpeckleICurve spCurve = value as SpeckleICurve;
      if (spCurve != null)
      {
        return converter.CurveToNative(spCurve);
      }
      Objects.Geometry.Surface spSurface = value as Objects.Geometry.Surface;
      if (spSurface != null)
      {
        return converter.SurfaceToNative(spSurface);
      }
      // If the value is not a recognized Speckle geometry type, return it as is.
      return value;
    }
  }
# ---------- end c_script_43 ----------
to_json = ToJSON(Elements=c_script_43.A)

amp_3 = Amplitude(Vector=deplane_12.ZAxis, Amplitude=number_slider_24)
amp_4 = Amplitude(Vector=deplane_12.XAxis, Amplitude=expr("x/2", number_slider_25))
move_48 = Move(Geometry=deplane_12.Origin, Motion=amp_3)  # -> Geometry, Transform
move_49 = Move(Geometry=deplane_12.Origin, Motion=amp_4)  # -> Geometry, Transform
merge_66 = Merge(Data1=graft(deplane_12.Origin), Data2=graft(move_48.Geometry), Data3=graft(move_49.Geometry))
conmesh = ConstructMesh(Vertices=merge_66, Faces={A=0, B=1, C=2, D=2})
trim_31 = TrimTree(Tree=simplify(conmesh), Depth=1)

cso_21 = CreateSpeckleObject(
    Plane=c_script_40.A,
    Length=number_slider_24,
    Diameter=number_slider_25,
    Mesh=trim_31,
    Name="LIGNOLOC 5.3 Plastic Sheel Coil Wood Nails",
    selectedKitName="Objects")
trim_32 = TrimTree(Tree=cso_21, Depth=1)

cso_22 = CreateSpeckleObject(Id=dso_40.Id, SolidOperators=merge_65, JSON=to_json, selectedKitName="Objects")
eso_6 = ExtendSpeckleObject(SpeckleObject=cso_22, RenderMaterial=sso, selectedKitName="Objects")

tstat_57 = TreeStatistics(Tree=simplify(eso_6))  # -> Paths, Length, Count
panel_67 = Panel(tstat_57.Paths)

cso_23 = CreateSpeckleObject(FabricationDesignData=flatten(eso_6), GH_Path=panel_67, Parent=concat_4, ReleaseNotes=note, selectedKitName="Objects")  # -> flatten(SpeckleObject)
send_2 = Send(
    Stream=panel_59,
    Message=panel_62,
    Data=cso_23,
    AutoSend=False,
    BaseId="b1ef20eaa264cb50f2883e3c382b5ac6",
    CurrentComponentState="up_to_date",
    KitName="Objects",
    OutputWrappers="https://app.speckle.systems\tfa2b5c68c0\t7a777bae62",
    UseDefaultCache=True,
    selectedKitName="Objects")
panel_68 = Panel(send_2)

cluster_54 = Cluster_32(L=cluster_46, B=filter_19, geo=cluster_28.geo_5)  # -> i, item_1

trim_33 = TrimTree(Tree=simplify(cluster_54.i), Depth=1)
trim_34 = TrimTree(Tree=simplify(cluster_54.item_1), Depth=1)

crv_23 = Curve(trim_33)
crv_24 = Curve(trim_34)

clean_48 = CleanTree(RemoveNulls=True, RemoveInvalid=True, RemoveEmpty=True, Tree=data_12)

move_50 = Move(Geometry=clean_48, Motion=vec_2.Vector)  # -> Geometry, Transform

boundary_29 = BoundarySurfaces(Edges=move_50.Geometry)  # -> simplify(Surfaces)
flip_5 = Flip(Surface=boundary_29, Guide=planesrf_2)  # -> Surface, Result
offsrf_16 = OffsetSurface(Surface=flip_5.Surface, Distance=2, BothSides=-1, CreateSolid=True)  # -> simplify(Offset)
tstat_58 = TreeStatistics(Tree=offsrf_16)  # -> Paths, Length, Count
split_101 = SplitTree(Data=simplify(cluster_27.T_2), Masks=flatten(tstat_58.Paths))  # -> Positive, Negative
sdiff_19 = SolidDifference(BrepsA=split_101.Positive, BrepsB=offsrf_16)
merge_67 = Merge(Data1=split_101.Negative, Data2=sdiff_19)

pln_25 = Plane(boundary_29)
tstat_59 = TreeStatistics(Tree=pln_25)  # -> Paths, Length, Count
split_102 = SplitTree(Data=avrpln, Masks=flatten(tstat_59.Paths))  # -> Positive, Negative
split_103 = SplitTree(Data=pln_25, Masks=flatten(tstat_59.Paths))  # -> Positive, Negative
c_script_44 = CSharpScript(x=split_102.Positive, y=split_103.Positive)  # -> out, A; inputs x: Plane, y: Plane
# ---------- c_script_44: C# ----------
    A = GetDistanceBetweenPlanes(x, y);
# ---------- c_script_44: C# additional code ----------
  public static double GetDistanceBetweenPlanes(Plane planeA, Plane planeB)
  {
    double tolerance = RhinoDoc.ActiveDoc.ModelAbsoluteTolerance;
    // Check if planes are parallel by verifying that their normals are parallel.
    // For parallel planes, the cross product of their normals is near zero.
    Vector3d cross = Vector3d.CrossProduct(planeA.Normal, planeB.Normal);
    if (cross.Length == 0)
    {
      // The planes are not parallel, so they intersect. Distance is zero.
      return 0.0;
    }

    // Calculate the difference between the origins.
    Vector3d diff = planeB.Origin - planeA.Origin;

    // The distance is the absolute value of the projection of the difference onto the normal.
    double distance = Math.Abs(Vector3d.Multiply(diff, planeA.Normal));
    return distance;
  }
# ---------- end c_script_44 ----------
roundd = RoundToDecimalPlace(NumberX=c_script_44.A, DecimalPlace=4, RoundType=0)  # -> Rounded, Difference
offset_2 = OffsetSurface(Surface=boundary_29, Distance=expr("-x", roundd.Rounded), Retrim=True)
split_104 = SplitTree(Data=offset_2, Masks=flatten(clean_16))  # -> Positive, Negative
offsrf_17 = OffsetSurface(
    Surface=split_104.Negative,
    Distance=expr("x/2", dso_41.Bottom_layer),
    BothSides=expr("-x/2", dso_41.Bottom_layer),
    CreateSolid=True)  # -> simplify(Offset)
panel_69 = Panel(roundd.Rounded)
offsrf_18 = OffsetSurface(
    Surface=split_104.Positive,
    Distance=expr("x/2", number_slider_19),
    BothSides=expr("-x/2", number_slider_19),
    CreateSolid=True)  # -> simplify(Offset)
merge_68 = Merge(Data1=offsrf_17, Data2=offsrf_18)

tstat_60 = TreeStatistics(Tree=clean_43)  # -> Paths, Length, Count
tstat_61 = TreeStatistics(Tree=merge_67)  # -> Paths, Length, Count
tree_13 = CreateTree(Data=flatten(clean_43), Path=tstat_60.Paths, Ensure=tstat_61.Paths)

cluster_55 = Cluster_26(pln=dso_40.Rect, L=sort_21.ValuesA, M=tstat_60.Paths)  # -> P, B, Y, T
c_script_45 = CSharpScript(x=cluster_55.Y, y=data_14)  # -> out, A; inputs x: Double, y: Double
# ---------- c_script_45: C# ----------
    if(x / y < 3) A = x / 3;
    else A = y;
# ---------- end c_script_45 ----------
generate_acoustic_battens = GenerateAcousticBattens(
    Outline=cluster_55.P,
    BoundingRectangle=cluster_55.B,
    Spacing=c_script_45.A,
    BattenWidth=dso_43.Width,
    BattenThickness=data_15,
    EdgeOffset=Slider(0.05, range=0..0.1),
    OffsetOutlinePlane=division_19,
    OffsetTolerance=Slider(0, range=0..1),
    MinBattenLength=number_slider_12,
    ContourOption=Slider(0, range=0..100))  # -> simplify(Battens), Centrelines, OffsetPlanes
tstat_62 = TreeStatistics(Tree=cluster_55.T)  # -> Paths, Length, Count

lng_11 = ListLength(List=generate_acoustic_battens.Centrelines)  # -> simplify(Length)
tstat_63 = TreeStatistics(Tree=lng_11)  # -> Paths, Length, Count
split_105 = SplitTree(Data=data_27, Masks=flatten(tstat_63.Paths))  # -> Positive, Negative
dup_7 = DuplicateData(Data=split_105.Positive, Number=lng_11, Order=True)  # -> simplify(graft(Data))

brep_3 = Brep(cluster_55.T)

split_106 = SplitTree(Data=generate_acoustic_battens.Battens, Masks=flatten(tstat_62.Paths))  # -> Positive, Negative
sdiff_20 = SolidDifference(BrepsA=graft(split_106.Positive), BrepsB=flatten(cluster_55.T))
trim_35 = TrimTree(Tree=sdiff_20, Depth=1)
merge_69 = Merge(Data1=trim_35, Data2=split_106.Negative)
group_5 = Group(Objects=merge_69)
tstat_64 = TreeStatistics(Tree=merge_69)  # -> Paths, Length, Count
tree_14 = CreateTree(Data=flatten(group_5), Path=tstat_64.Paths, Ensure=tstat_61.Paths)
ungroup_4 = Ungroup(Group=tree_14)  # -> simplify(Objects)
tstat_65 = TreeStatistics(Tree=ungroup_4)  # -> Paths, Length, Count
tree_15 = CreateTree(Data=tstat_65.Paths, Path=tstat_65.Paths)  # -> simplify(Data)
cluster_56 = Cluster_5(
    brep=brep_3,
    crv=generate_acoustic_battens.Centrelines,
    ispacing=division_20,
    iedgeoffsetfactor=Slider(3, range=0..10),
    pln=generate_acoustic_battens.OffsetPlanes,
    A=diameter,
    B=offset_from_top_of_top_plate,
    L=screw_length,
    min_batten_width=number_slider_12,
    beam_depth=data_15,
    top_plate_thickness=dso_41.Top_layer)  # -> geo_5, geo_6, geo_7, S

c_script_46 = CSharpScript(
    x=cluster_56.S,
    y=dup_7,
    Reference=["C:\USERS\LASATHS\DESKTOP\LIBRARIES\ABXM.PLATESTRUCTURES\LCRL.dll", "C:\USERS\LASATHS\APPDATA\ROAMING\GRASSHOPPER\LIBRARIES\ABXM.PLATESTRUCTURES\ElementBase.dll", "C:\Users\lasaths\AppData\Roaming\Grasshopper\Libraries\ABxM.PlateStructures\ABxM.PlateStructuresCore.dll"])  # -> out, A; inputs y: String
# ---------- c_script_46: C# ----------
    Screw screw = x as Screw;
    Screw newScrew = screw.ShallowCopy() as Screw;
    newScrew.Project = "LCRL";
    newScrew.Version = "LPH5";
    newScrew.Parent = y;
    newScrew.Type = "BattenScrew";
    newScrew.Name = Utilities.GenerateElementNameId(newScrew);
    A = newScrew;
# ---------- end c_script_46 ----------

to_json_2 = ToJSON(Elements=c_script_46.A)
tstat_66 = TreeStatistics(Tree=cluster_56.S)  # -> Paths, Length, Count
panel_70 = Panel(tstat_66.Paths)
cso_24 = CreateSpeckleObject(JSON=flatten(to_json_2), GH_Path=panel_70, selectedKitName="Objects")

group_6 = Group(Objects=cluster_56.geo_5)
trim_36 = TrimTree(Tree=group_6, Depth=1)
group_7 = Group(Objects=trim_36)
tstat_67 = TreeStatistics(Tree=group_7)  # -> Paths, Length, Count
tree_16 = CreateTree(Data=flatten(group_7), Path=tstat_67.Paths, Ensure=tstat_65.Paths)  # -> simplify(Data)
ungroup_5 = Ungroup(Group=tree_16)
ungroup_6 = Ungroup(Group=ungroup_5)

clean_49 = CleanTree(RemoveNulls=True, RemoveInvalid=True, RemoveEmpty=True, Tree=ungroup_4)  # -> simplify(Tree)
eso_7 = ExtendSpeckleObject(SpeckleObject=clean_49, Type="Battens", selectedKitName="Objects")
tstat_68 = TreeStatistics(Tree=clean_49)  # -> Paths, Length, Count
lng_12 = ListLength(List=eso_7)
match_43 = MatchTree(Tree=graft(tstat_68.Paths), Guide=clean_49)
tstat_69 = TreeStatistics(Tree=ungroup_4)  # -> Paths, Length, Count
dup_8 = DuplicateData(Data=match_43, Number=lng_12, Order=True)
tree_17 = CreateTree(Data=flatten(clean_49), Path=dup_8, Ensure=tstat_69.Paths)

tstat_70 = TreeStatistics(Tree=clean_43)  # -> Paths, Length, Count
tstat_71 = TreeStatistics(Tree=merge_67)  # -> Paths, Length, Count
tree_18 = CreateTree(Data=flatten(eso), Path=tstat_70.Paths, Ensure=tstat_71.Paths)

tstat_72 = TreeStatistics(Tree=merge_67)  # -> Paths, Length, Count
clean_50 = CleanTree(RemoveNulls=True, RemoveInvalid=True, RemoveEmpty=True, Tree=merge_68)
tstat_73 = TreeStatistics(Tree=clean_50)  # -> Paths, Length, Count
tree_19 = CreateTree(Data=flatten(clean_50), Path=tstat_73.Paths, Ensure=tstat_72.Paths)

split_107 = SplitTree(Data=simplify(filter_19), Masks=flatten(tstat_58.Paths))  # -> Positive, Negative
clash_9 = Clash(FirstSet=split_107.Positive, SecondSet=offsrf_16, Distance=0, L=100)  # -> ClashCount, ClashPoints, ClashRadii, FirstIndex, SecondIndex
textdot_2 = DefineTextDot(Text="CLASH!", Location=clash_9.ClashPoints, Font="Arial", Size=14)

clean_51 = CleanTree(RemoveNulls=True, RemoveInvalid=True, RemoveEmpty=True, Tree=data_19)  # -> simplify(flatten(Tree))
tstat_74 = TreeStatistics(Tree=merge_67)  # -> Paths, Length, Count
c_script_47 = CSharpScript(x=tstat_74.Paths, y=clean_51)  # -> out, A; inputs x: String, y: list of String
# ---------- c_script_47: C# ----------
    if(y.Contains(x)) A = true;
    else A = false;
# ---------- end c_script_47 ----------
tree_20 = CreateTree(Data=c_script_47.A, Path=tstat_74.Paths)
cull_10 = CullPattern(List=flatten(merge_67), CullPattern=c_script_47.A)
c_script_48 = CSharpScript(x=tree_20, z=dso_44.BottomPlateMaterial)  # -> out, A; inputs x: Boolean
# ---------- c_script_48: C# ----------
    if(x) A = z+"_50mm"; else A = z+"_27mm";
# ---------- end c_script_48 ----------

area_50 = Area(Geometry=tree_13)  # -> Area, Centroid

area_51 = Area(Geometry=flip_5.Surface)  # -> Area, Centroid
tstat_75 = TreeStatistics(Tree=flip_5.Surface)  # -> Paths, Length, Count

c_script_49 = CSharpScript(x=tree_20, z=dso_44.BeamMaterial)  # -> out, A; inputs x: Boolean
# ---------- c_script_49: C# ----------
    if(x) A = z + " - Final Thickness = 105mm"; else A = z + " - Final Thickness = 128mm";
# ---------- end c_script_49 ----------
eso_8 = ExtendSpeckleObject(SpeckleObject=merge_67, Type="BottomPlate", selectedKitName="Objects")

# ---- group: BP
cso_25 = CreateSpeckleObject(
    Geometry=eso_8,
    Raw=item_55,
    Material=c_script_48.A,
    BottomHole=geo_57,
    OutlineUpper=cluster_27.T,
    OutlineLower=cluster_27.s_1,
    BottomHoleCutout=tree_19,
    BottomHoleCutoutWithTabs=runion_2,
    selectedKitName="Objects")

# ---- group: Beams
cso_26 = CreateSpeckleObject(
    Geometry=eso_3,
    Raw=cso_15,
    Material=c_script_49.A,
    OutlineUpper=crv_24,
    OutlineLower=crv_23,
    StartPlane=cluster_47,
    EndPlane=cluster_45,
    BasePlane=cluster_49,
    InteriorPlane=cluster_50,
    MitrePlane=cluster_46,
    WoodNails=trim_32,
    selectedKitName="Objects")

# ----
cluster_57 = Cluster_30(T=cso_25)
cluster_58 = Cluster_30(T=cso_26)
cluster_59 = Cluster_30(T=cso_25)
panel_71 = Panel(cluster_58)
panel_72 = Panel(cluster_57)
panel_73 = Panel(cluster_59)
merge_70 = Merge(Data1=geo_82, Data2=merge_67, Data3=tree_13, Data4=merge_61, Data5=filter_19)

preview_25 = CustomPreview(Geometry=split_93.Positive, Material=ColourSwatch(SwatchColor=RGBA(191, 106, 63, 136)))
preview_26 = CustomPreview(Geometry=merge_70, Material=c_script_34.A)
preview_27 = CustomPreview(Geometry=split_91.Positive, Material=ColourSwatch(SwatchColor=RGBA(89, 63, 191, 80)))
preview_28 = CustomPreview(Geometry=textdot_2, Material=ColourSwatch(SwatchColor=RGB(255, 0, 0)))
tag_7 = TextTag(Location=flatten(area_51.Centroid), Text=tstat_75.Paths)

dso_47 = DeconstructSpeckleObject(SpeckleObject=cso_26, selectedKitName="Objects")  # -> BasePlane, EndPlane, simplify(Geometry), InteriorPlane, Material, MitrePlane, OutlineLower, OutlineUpper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
cluster_60 = Cluster_30(T=dso_47.StartPlane)
panel_74 = Panel(cluster_60)
trim_37 = TrimTree(Tree=simplify(dso_47.Geometry), Depth=1)
panel_75 = Panel(dso_47.OutlineUpper)
cluster_61 = Cluster_28(geo=trim_37, geo_2=cluster_25.M_2)  # -> C, unique, i, i_2
preview_29 = CustomPreview(Geometry=cluster_61.i, Material=cluster_61.C)
tag_8 = TextTag(Location=cluster_61.i_2, Text=graft(cluster_61.unique))
panel_76 = Panel(cluster_61.unique)

geo_83 = Geometry(c_script_13.A)
geo_84 = Geometry(pl_offset_2)

tstat_76 = TreeStatistics(Tree=simplify(geo_83))  # -> Paths, Length, Count

tree_21 = CreateTree(Data=flatten(geo_83), Path=tstat_76.Paths, Ensure=tstat_61.Paths)  # -> simplify(Data)
tree_22 = CreateTree(Data=flatten(geo_84), Path=tstat_76.Paths, Ensure=tstat_61.Paths)  # -> simplify(Data)
move_51 = Move(Geometry=tree_21, Motion=vec_2.Vector)  # -> Geometry, Transform
move_52 = Move(Geometry=tree_22, Motion=vec_2.Vector)  # -> Geometry, Transform
clean_52 = CleanTree(RemoveNulls=True, RemoveInvalid=True, RemoveEmpty=False, Tree=move_52.Geometry)
clean_53 = CleanTree(RemoveNulls=True, RemoveInvalid=True, RemoveEmpty=False, Tree=move_51.Geometry)

area_52 = Area(Geometry=clean_53)  # -> Area, Centroid
pl_origin_7 = PlaneOrigin(Base=clean_52, Origin=area_52.Centroid)
ln_6 = Line(StartPoint=clean_52, EndPoint=area_50.Centroid)

# ---- group: Acoustic
dso_48 = DeconstructSpeckleObject(SpeckleObject=dso_44.Acoustic, selectedKitName="Objects")  # -> Battens, Padding, Panel
cso_27 = CreateSpeckleObject(Geometry=tree_18, Material=dso_48.Panel, Outline=clean_53, FrameBase=clean_52, selectedKitName="Objects")  # -> simplify(SpeckleObject)

# ----
cluster_62 = Cluster_30(T=cso_27)
panel_77 = Panel(cluster_62)

cso_28 = CreateSpeckleObject(Solid=cso_17, selectedKitName="Objects")  # -> simplify(SpeckleObject)
sso_3 = RenderMaterial(
    Opacity=1,
    Metalness=0,
    Roughness=1,
    Diffuse=c_script_34.A,
    SelectedConstructorName="Objects.Other.RenderMaterial.ctor(System.Double,System.Double,System.Double,System.Nullable`1[System.Drawing.Color],System.Nullable`1[System.Drawing.Color])",
    SelectedTypeName="Objects.Other.RenderMaterial",
    UseSchemaTag=False,
    UserSetSchemaTag=False,
    seed="2441410a84a7694f9160")
panel_78 = Panel("https://speckle.xyz/streams/fa2b5c68c0/branches/02-development/4-detail_model")

filter_21 = StreamFilter(Gate=manual, Stream0=note_2)
c_script_50 = CSharpScript(x=panel_60)  # -> out, A
# ---------- c_script_50: C# ----------
    if (y == null || y == "") A = x;
    else A = x + " & " + y;
# ---------- end c_script_50 ----------

cso_29 = CreateSpeckleObject(Line=ungroup_6, Diameter=diameter, selectedKitName="Objects")
trim_38 = TrimTree(Tree=simplify(cso_29), Depth=1)
tstat_77 = TreeStatistics(Tree=trim_38)  # -> Paths, Length, Count
panel_79 = Panel(tstat_77.Paths)
cso_30 = CreateSpeckleObject(GH_Path=panel_79, BattenScrews=flatten(cso_29), ObjectJSON=flatten(cso_24), selectedKitName="Objects")
cso_31 = CreateSpeckleObject(GH_Path=panel_79, BattenScrews=flatten(cso_29), selectedKitName="Objects")
send_3 = Send(
    Stream=panel_28,
    Message=c_script_50.A,
    Data=cso_30,
    AutoSend=False,
    BaseId="21cba8b492f1651a1fdf90a0cd6bf768",
    CurrentComponentState="up_to_date",
    KitName="Objects",
    OutputWrappers="https://app.speckle.systems\tfa2b5c68c0\tf1c95385e7",
    UseDefaultCache=True,
    selectedKitName="Objects")
panel_80 = Panel(send_3)

# ---- group: Acoustic (continued)
cso_32 = CreateSpeckleObject(GH_Path=tree_15, Geometry=tree_17, Screw=panel_80, Material=dso_48.Battens, selectedKitName="Objects")  # -> simplify(SpeckleObject)

# ----
cluster_63 = Cluster_30(T=cso_32)
panel_81 = Panel(cluster_63)
filter_22 = StreamFilter(Gate=manual, Stream0=c_script_50.A)

cso_33 = CreateSpeckleObject(Beams=cso_26, TopPlate=cso_16, BottomPlate=cso_25, Acoustic=cso_27, AcousticBattens=cso_32, selectedKitName="Objects")  # -> simplify(SpeckleObject)
merge_71 = Merge(Data1=cso_28, Data2=cso_33)
cso_34 = CreateSpeckleObject(Segments=merge_71, Id=txt, Type=txt_4, BasePlane=move_5.Geometry, selectedKitName="Objects")  # -> simplify(SpeckleObject)
eso_9 = ExtendSpeckleObject(SpeckleObject=cso_34, RenderMaterial=sso_3, selectedKitName="Objects")
trim_39 = TrimTree(Tree=eso_9, Depth=1)
cso_35 = CreateSpeckleObject(DetailModel=trim_39, Parent=concat_4, ReleaseNotes=filter_21, selectedKitName="Objects")  # -> flatten(SpeckleObject)
panel_82 = Panel(filter_22)
send_4 = Send(
    Stream=panel_78,
    Message=filter_22,
    Data=cso_35,
    AutoSend=False,
    BaseId="506851ba65cb55fcc5c4dafd7e1426e7",
    CurrentComponentState="expired",
    KitName="Objects",
    OutputWrappers="https://app.speckle.systems\tfa2b5c68c0\tbc007777cc",
    UseDefaultCache=True,
    selectedKitName="Objects")
panel_83 = Panel(send_4)

dso_49 = DeconstructSpeckleObject(SpeckleObject=cso_34, selectedKitName="Objects")  # -> BasePlane, Id, Segments, Type; disabled
string_filter_10 = StringFilter(Text=dso_45.Type, Object=dso_49.Segments, Key=panel_26)  # -> Text, Object; disabled
clean_54 = CleanTree(RemoveNulls=True, RemoveInvalid=True, RemoveEmpty=True, Tree=string_filter_10.Object)  # disabled
dso_50 = DeconstructSpeckleObject(SpeckleObject=clean_54, selectedKitName="Objects")  # -> Acoustic, AcousticBattens, Beams, BottomPlate, TopPlate; disabled
string_filter_11 = StringFilter(Text=dso_45.Type, Object=dso_49.Segments, Key=panel_27)  # -> Text, Object; disabled
dso_51 = DeconstructSpeckleObject(SpeckleObject=dso_50.BottomPlate, selectedKitName="Objects")  # -> BottomHole, BottomHoleCutout, BottomHoleCutoutWithTabs, Geometry, Material, OutlineLower, OutlineUpper, Raw; disabled
dso_52 = DeconstructSpeckleObject(SpeckleObject=dso_50.TopPlate, selectedKitName="Objects")  # -> Geometry, GeometryPreCut, Material, OutlineLower, OutlineUpper, Raw; disabled
clean_55 = CleanTree(RemoveNulls=True, RemoveInvalid=True, RemoveEmpty=True, Tree=string_filter_11.Object)  # disabled
debrep_9 = DeconstructBrep(Brep=dso_52.Raw)  # -> Faces, Edges, Vertices; disabled
dso_53 = DeconstructSpeckleObject(SpeckleObject=clean_55, selectedKitName="Objects")  # -> Acoustic, AcousticBattens, Beams, BottomPlate, TopPlate; disabled
area_53 = Area(Geometry=debrep_9.Faces)  # -> Area, Centroid; disabled
debrep_10 = DeconstructBrep(Brep=dso_51.Raw)  # -> Faces, Edges, Vertices; disabled
sort_23 = SortList(Keys=area_53.Area, ValuesA=debrep_9.Faces)  # -> Keys, reverse(ValuesA); disabled
area_54 = Area(Geometry=debrep_10.Faces)  # -> Area, Centroid; disabled
dso_54 = DeconstructSpeckleObject(SpeckleObject=dso_53.BottomPlate, selectedKitName="Objects")  # -> BottomHole, BottomHoleCutout, BottomHoleCutoutWithTabs, Geometry, Material, OutlineLower, OutlineUpper, Raw; disabled
dso_55 = DeconstructSpeckleObject(SpeckleObject=dso_53.TopPlate, selectedKitName="Objects")  # -> Geometry, GeometryPreCut, Material, OutlineLower, OutlineUpper, Raw; disabled
sort_24 = SortList(Keys=area_54.Area, ValuesA=debrep_10.Faces)  # -> Keys, reverse(ValuesA); disabled
item_70 = ListItem(List=sort_23.ValuesA, Index=0, Wrap=True)  # disabled
debrep_11 = DeconstructBrep(Brep=dso_55.Raw)  # -> Faces, Edges, Vertices; disabled
item_71 = ListItem(List=sort_24.ValuesA, Index=0, Wrap=True)  # disabled
debrep_12 = DeconstructBrep(Brep=dso_54.Raw)  # -> Faces, Edges, Vertices; disabled
area_55 = Area(Geometry=debrep_11.Faces)  # -> Area, Centroid; disabled
sort_25 = SortList(Keys=area_55.Area, ValuesA=debrep_11.Faces)  # -> Keys, reverse(ValuesA); disabled
area_56 = Area(Geometry=debrep_12.Faces)  # -> Area, Centroid; disabled
area_57 = Area(Geometry=item_70)  # -> Area, Centroid; disabled
ma_7 = MassAddition(Input=flatten(area_57.Area))  # -> Result, PartialResults; disabled
area_58 = Area(Geometry=item_71)  # -> Area, Centroid; disabled
ma_8 = MassAddition(Input=flatten(area_58.Area))  # -> Result, PartialResults; disabled
sort_26 = SortList(Keys=area_56.Area, ValuesA=debrep_12.Faces)  # -> Keys, reverse(ValuesA); disabled
item_72 = ListItem(List=sort_25.ValuesA, Index=0, Wrap=True)  # disabled
item_73 = ListItem(List=sort_26.ValuesA, Index=0, Wrap=True)  # disabled
panel_84 = Panel(ma_8.Result)  # disabled
panel_85 = Panel(ma_7.Result)  # disabled
area_59 = Area(Geometry=item_73)  # -> Area, Centroid; disabled
area_60 = Area(Geometry=item_72)  # -> Area, Centroid; disabled
ma_9 = MassAddition(Input=flatten(area_60.Area))  # -> Result, PartialResults; disabled
ma_10 = MassAddition(Input=flatten(area_59.Area))  # -> Result, PartialResults; disabled
panel_86 = Panel(ma_9.Result)  # disabled
panel_87 = Panel(ma_10.Result)  # disabled
merge_72 = Merge(Data1=panel_84, Data2=panel_85, Data3=panel_87, Data4=panel_86)  # disabled
panel_88 = Panel(merge_72)  # disabled

string_filter_12 = StringFilter(Text=txt_4, Object=merge_71, Key="B1")  # -> Text, Object
dso_56 = DeconstructSpeckleObject(SpeckleObject=string_filter_12.Object, selectedKitName="Objects")  # -> Acoustic, AcousticBattens, Beams, BottomPlate, TopPlate
dso_57 = DeconstructSpeckleObject(SpeckleObject=dso_56.BottomPlate, selectedKitName="Objects")  # -> BottomHole, BottomHoleCutout, BottomHoleCutoutWithTabs, Geometry, Material, OutlineLower, OutlineUpper, Raw
dso_58 = DeconstructSpeckleObject(SpeckleObject=dso_56.Beams, selectedKitName="Objects")  # -> BasePlane, EndPlane, Geometry, InteriorPlane, Material, MitrePlane, OutlineLower, OutlineUpper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
dso_59 = DeconstructSpeckleObject(SpeckleObject=dso_56.TopPlate, selectedKitName="Objects")  # -> Geometry, GeometryPreCut, Material, OutlineLower, OutlineUpper, Raw
dso_60 = DeconstructSpeckleObject(SpeckleObject=dso_58.Raw, selectedKitName="Objects")  # -> BoundingBox, simplify(Raw), RawBoundingBox, RawWidth
pln_26 = Plane(dso_59.OutlineUpper)
pln_27 = Plane(dso_57.OutlineUpper)
bbox_9 = BoundingBox(Content=simplify(dso_59.Geometry), Plane=pln_26)  # -> Box, Box_2
bbox_10 = BoundingBox(Content=simplify(dso_57.Geometry), Plane=pln_27)  # -> Box, Box_2
bbox_11 = BoundingBox(Content=simplify(dso_59.Raw), Plane=pln_26)  # -> Box, Box_2
bbox_12 = BoundingBox(Content=simplify(dso_57.Raw), Plane=pln_27)  # -> Box, Box_2
bbox_13 = BoundingBox(Content=simplify(dso_58.Geometry), Plane=dso_58.BasePlane)  # -> Box, Box_2
debox_5 = DeconstructBox(Box=bbox_9.Box)  # -> Plane, X, Y, Z
debox_6 = DeconstructBox(Box=bbox_10.Box)  # -> Plane, X, Y, Z
debox_7 = DeconstructBox(Box=bbox_11.Box)  # -> Plane, X, Y, Z
debox_8 = DeconstructBox(Box=bbox_12.Box)  # -> Plane, X, Y, Z
bbox_14 = BoundingBox(Content=simplify(dso_60.Raw), Plane=dso_58.BasePlane)  # -> Box, Box_2
panel_89 = Panel(txt)
debox_9 = DeconstructBox(Box=bbox_13.Box)  # -> Plane, X, Y, Z
debox_10 = DeconstructBox(Box=bbox_14.Box)  # -> Plane, X, Y, Z
num_10 = Number([debox_5.Z, debox_7.Z])
num_11 = Number([debox_6.Z, debox_8.Z])
avr_5 = Average(Input=flatten(num_10))
avr_6 = Average(Input=flatten(num_11))
num_12 = Number([debox_9.Z, debox_10.Z])
avr_7 = Average(Input=flatten(num_12))
roundd_2 = RoundToDecimalPlace(NumberX=avr_5, DecimalPlace=4, RoundType=0)  # -> Rounded, Difference
roundd_3 = RoundToDecimalPlace(NumberX=avr_6, DecimalPlace=4, RoundType=0)  # -> Rounded, Difference
roundd_4 = RoundToDecimalPlace(NumberX=avr_7, DecimalPlace=4, RoundType=0)  # -> Rounded, Difference
panel_90 = Panel(roundd_2.Rounded)
panel_91 = Panel(roundd_3.Rounded)
panel_92 = Panel(roundd_4.Rounded)

# ----
# Onsite Assembly Data
split_108 = SplitTree(Data=geo_53, Masks=flatten(tstat.Paths))  # -> Positive, Negative
geo_85 = Geometry(item)
sdiff_21 = SolidDifference(BrepsA=split_108.Positive, BrepsB=geo_85)
split_109 = SplitTree(Data=merge_71, Masks=flatten(tstat_54.Paths))  # -> Positive, Negative
split_110 = SplitTree(Data=move_12.Geometry, Masks=flatten(tstat_54.Paths))  # -> Positive, Negative
split_111 = SplitTree(Data=generate_mitre_planes_between_segments.Neighbours, Masks=flatten(tstat_54.Paths))  # -> Positive, Negative
split_112 = SplitTree(Data=cluster_28.geo_5, Masks=flatten(tstat_54.Paths))  # -> Positive, Negative
dso_61 = DeconstructSpeckleObject(SpeckleObject=split_109.Positive, selectedKitName="Objects")  # -> Acoustic, AcousticBattens, Beams, BottomPlate, TopPlate
dso_62 = DeconstructSpeckleObject(SpeckleObject=dso_61.BottomPlate, selectedKitName="Objects")  # -> BottomHole, BottomHoleCutout, BottomHoleCutoutWithTabs, Geometry, Material, OutlineLower, OutlineUpper, Raw
split_113 = SplitTree(Data=split_108.Negative, Masks=flatten("{0,1;*}"))  # -> Positive, Negative
dso_63 = DeconstructSpeckleObject(SpeckleObject=dso_61.Beams, selectedKitName="Objects")  # -> BasePlane, EndPlane, Geometry, InteriorPlane, Material, MitrePlane, OutlineLower, OutlineUpper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
dso_64 = DeconstructSpeckleObject(SpeckleObject=dso_61.TopPlate, selectedKitName="Objects")  # -> Geometry, GeometryPreCut, Material, OutlineLower, OutlineUpper, Raw
dso_65 = DeconstructSpeckleObject(SpeckleObject=dso_61.Acoustic, selectedKitName="Objects")  # -> FrameBase, Geometry, Material, Outline
dso_66 = DeconstructSpeckleObject(SpeckleObject=dso_61.AcousticBattens, selectedKitName="Objects")  # -> Geometry, GH_Path, Material, Screw
_3s_plate_3 = _3SPlate(ActiveMaterialIndex=0)
python_4 = GhPythonScript(x=_3s_plate)  # -> out, a
# ---------- python_4: Python ----------
a = x.Density
# ---------- end python_4 ----------
python_5 = GhPythonScript(x=_3s_plate_2)  # -> out, a; same code as python_4
python_6 = GhPythonScript(x=_3s_plate_3)  # -> out, a; same code as python_4
division_21 = Division(A=Slider(2800, range=0..10000), B=1000)
tstat_78 = TreeStatistics(Tree=split_113.Positive)  # -> Paths, Length, Count
match_44 = MatchTree(Tree=graft(tstat_78.Paths), Guide=split_113.Positive)
panel_93 = Panel(match_44)

cluster_64 = Cluster_43(x=division_21, G=dso_65.Geometry)
cluster_65 = Cluster_43(x=Slider(350, range=0..1000), G=dso_66.Geometry)
cluster_66 = Cluster_43(x=python_4.a, G=dso_63.Geometry)
cluster_67 = Cluster_43(x=python_6.a, G=dso_62.Geometry)
cluster_68 = Cluster_43(x=python_5.a, G=dso_64.Geometry)
trim_40 = TrimTree(Tree=cluster_66, Depth=1)
dpath_2 = DeconstructPath(Branch=match_44)
item_74 = ListItem(List=dpath_2, Index=1, Wrap=True)  # -> simplify(Item)
panel_94 = Panel(item_74)

merge_73 = Merge(Data1=cluster_64, Data2=cluster_65, Data3=trim_40, Data4=cluster_67, Data5=cluster_68)
ma_11 = MassAddition(Input=merge_73)  # -> Result, PartialResults
match_45 = MatchTree(Tree=ma_11.Result, Guide=split_109.Positive)
tstat_79 = TreeStatistics(Tree=match_45)  # -> Paths, Length, Count
match_46 = MatchTree(Tree=graft(tstat_79.Paths), Guide=split_109.Positive)
panel_95 = Panel(match_46)
cso_36 = CreateSpeckleObject(Id=item_74, Name=panel_93, Geometry=split_113.Positive, Type=split_98.Positive, selectedKitName="Objects")

tstat_80 = TreeStatistics(Tree=simplify(match_45))  # -> Paths, Length, Count
match_47 = MatchTree(Tree=graft(tstat_80.Paths), Guide=split_109.Positive)
eso_10 = ExtendSpeckleObject(SpeckleObject=sdiff_21, Weight=match_45, selectedKitName="Objects")
eso_11 = ExtendSpeckleObject(SpeckleObject=cso_36, RenderMaterial=split_100.Positive, selectedKitName="Objects")

dpath_3 = DeconstructPath(Branch=match_47)
match_48 = MatchTree(Tree=dpath_3, Guide=split_109.Positive)
cso_37 = CreateSpeckleObject(
    Name=panel_95,
    Id=match_48,
    Geometry=eso_10,
    MitrePlanes=split_110.Positive,
    ApproxWeight=match_45,
    CentrePlane=split_112.Positive,
    Neighbours=split_111.Positive,
    Type=split_97.Positive,
    selectedKitName="Objects")

eso_12 = ExtendSpeckleObject(SpeckleObject=cso_37, RenderMaterial=split_99.Positive, selectedKitName="Objects")

cso_38 = CreateSpeckleObject(ContextSegments=flatten(eso_11), OnsiteSegments=flatten(eso_12), selectedKitName="Objects")

panel_96 = Panel(panel_60)
send_5 = Send(
    Stream="https://speckle.xyz/projects/fa2b5c68c0/models/6b0d00be57",
    Message=panel_96,
    Data=flatten(cso_38),
    AutoSend=False,
    BaseId="fe2aa7c25d6be930ab1450bb3d3b907f",
    CurrentComponentState="up_to_date",
    KitName="Objects",
    OutputWrappers="https://app.speckle.systems\tfa2b5c68c0\tf11bc4b2cc",
    UseDefaultCache=True,
    selectedKitName="Objects")

panel_97 = Panel(send_5)

# ==== cluster Cluster
V = ClusterInput()
P = ClusterInput()
O = ClusterInput()
O_2 = ClusterInput()
generate_offset_polylines = GenerateOffsetPolylines(
    Polyline=P,
    Offset=O,
    OptionalEdgeVectorOverride=V,
    AngleTolerance=degrees(1),
    OffsetMethod=2,
    nonPlanar=False,
    virtual4Valent=False)  # -> OffsetPolylines, FourValenceNodes
generate_offset_polylines_2 = GenerateOffsetPolylines(
    Polyline=P,
    Offset=O_2,
    OptionalEdgeVectorOverride=V,
    AngleTolerance=degrees(1),
    OffsetMethod=2,
    nonPlanar=False,
    virtual4Valent=False)  # -> OffsetPolylines, FourValenceNodes
boundary = BoundarySurfaces(Edges=graft(generate_offset_polylines.OffsetPolylines))
boundary_2 = BoundarySurfaces(Edges=graft(generate_offset_polylines_2.OffsetPolylines))
merge = Merge(Data1=simplify(graft(boundary)), Data2=simplify(graft(boundary_2)))
loft = Loft(Curves=merge, Options={Adjust=False, Closed=False, LoftEnds=0, LoftSimp=0, LoftType=0, Rebuild=10, Refit=0.01})
match = MatchTree(Tree=generate_offset_polylines.OffsetPolylines, Guide=P)
cap = CapHoles(Brep=loft)
match_2 = MatchTree(Tree=generate_offset_polylines_2.OffsetPolylines, Guide=P)
match_3 = MatchTree(Tree=cap, Guide=P)
T = ClusterOutput(match)
T_2 = ClusterOutput(match_3)
T_3 = ClusterOutput(match_2)

# ==== cluster Cluster_2
G = ClusterInput()
P = ClusterInput()
V = ClusterInput()
M = ClusterInput()
L = ClusterInput()
L_2 = ClusterInput()
item = ListItem(List=L, Index=0, Wrap=True)  # -> Item, Item1, Item2, Item3
item_2 = ListItem(List=L_2, Index=0, Wrap=True)  # -> Item, Item1, Item2, Item3
generate_offset_polylines = GenerateOffsetPolylines(
    Polyline=P,
    Offset=item.Item,
    OptionalEdgeVectorOverride=V,
    AngleTolerance=degrees(1),
    OffsetMethod=2,
    nonPlanar=False,
    virtual4Valent=False)  # -> OffsetPolylines, FourValenceNodes
generate_offset_polylines_2 = GenerateOffsetPolylines(
    Polyline=P,
    Offset=item.Item1,
    OptionalEdgeVectorOverride=V,
    AngleTolerance=degrees(1),
    OffsetMethod=2,
    nonPlanar=False,
    virtual4Valent=False)  # -> OffsetPolylines, FourValenceNodes
generate_offset_polylines_3 = GenerateOffsetPolylines(
    Polyline=P,
    Offset=item_2.Item1,
    OptionalEdgeVectorOverride=V,
    AngleTolerance=degrees(1),
    OffsetMethod=2,
    nonPlanar=False,
    virtual4Valent=False)  # -> OffsetPolylines, FourValenceNodes
match = MatchTree(Tree=generate_offset_polylines_2.OffsetPolylines, Guide=P)
match_2 = MatchTree(Tree=generate_offset_polylines_3.OffsetPolylines, Guide=P)
split = SplitTree(Data=simplify(match), Masks=flatten(M))  # -> Positive, Negative
split_2 = SplitTree(Data=simplify(match_2), Masks=flatten(M))  # -> Positive, Negative
merge = Merge(Data1=split_2.Positive, Data2=split.Negative)
filter = StreamFilter(Gate=G, Stream0=match, Stream1=merge)
boundary = BoundarySurfaces(Edges=generate_offset_polylines.OffsetPolylines)
boundary_2 = BoundarySurfaces(Edges=filter)
merge_2 = Merge(Data1=simplify(graft(boundary)), Data2=simplify(graft(boundary_2)))
match_3 = MatchTree(Tree=generate_offset_polylines.OffsetPolylines, Guide=P)
loft = Loft(Curves=merge_2, Options={Adjust=False, Closed=False, LoftEnds=0, LoftSimp=0, LoftType=0, Rebuild=10, Refit=0.01})
cap = CapHoles(Brep=loft)
match_4 = MatchTree(Tree=cap, Guide=P)
T = ClusterOutput(match_3)
T_2 = ClusterOutput(match_4)
s_1 = ClusterOutput(filter)

# ==== cluster Cluster_3
Z = UnitZ(Factor=1)
P = ClusterInput()
D = ClusterInput()
unify_polylines = UnifyPolylines(Polylines=P, Direction=D)  # -> simplify(Polylines)
trim = TrimTree(Tree=unify_polylines, Depth=1)  # -> simplify(Tree)
generate_mitre_planes_between_segments = GenerateMitrePlanesBetweenSegments(Polyline=simplify(trim), NakedEdgeGuideVector=Z)  # -> MitrePlanes, Neighbours, PolylinePlanes, BoundingRectangle
M = ClusterInput()
split = SplitTree(Data=simplify(graft(generate_mitre_planes_between_segments.PolylinePlanes)), Masks=flatten(M))  # -> Positive, Negative
split_2 = SplitTree(Data=simplify(unify_polylines), Masks=flatten(M))  # -> Positive, Negative
split_3 = SplitTree(Data=simplify(generate_mitre_planes_between_segments.MitrePlanes), Masks=flatten(M))  # -> Positive, Negative

geo = Geometry(split_2.Positive)
geo_2 = Geometry(split.Positive)
geo_3 = Geometry(split_3.Positive)

geo_4 = ClusterOutput(geo)
geo_5 = ClusterOutput(geo_2)
geo_6 = ClusterOutput(geo_3)
M_2 = ClusterOutput(generate_mitre_planes_between_segments.MitrePlanes)

# ==== cluster Cluster_4
pln = ClusterInput()
num = ClusterInput()
geo = ClusterInput()
geo_2 = ClusterInput()
geo_3 = ClusterInput()
num_2 = ClusterInput()
geo_4 = ClusterInput()
geo_5 = ClusterInput()
D = ClusterInput()
D_2 = ClusterInput()
num_3 = Number(num)
pln_2 = Plane(pln)
geo_6 = Geometry(geo)
geo_7 = Geometry(geo_2)
geo_8 = Geometry(geo_3)
num_4 = Number(num_2)
geo_9 = Geometry(geo_4)
geo_10 = Geometry(geo_5)
group = Group(Objects=pln_2)
split = SplitTree(Data=num_3, Masks=flatten("{*;*;1}"))  # -> Positive, Negative

c_script = CSharpScript(x=num_4, y=geo_7)  # -> out, A, B, C, D; inputs x: list of Double, y: list
# ---------- c_script: C# ----------
    List<bool> output = new List<bool>();
    List<object> prevs = new List<object>();
    List<object> nexts = new List<object>();
    List<int> indices = new List<int>();

    for (int i = 0; i < x.Count; i++)
    {
      int next = i == x.Count - 1 ? 0 : i + 1;
      int prev = i == 0 ? x.Count - 1 : i - 1;

      if(Math.Round(x[i], 2) == 0)
      {
        prevs.Add(y[prev]);
        nexts.Add(y[next]);
        indices.Add(i);
        output.Add(true);
      }
      else
      {
        output.Add(false);
      }
    }

    A = output;
    B = prevs;
    C = nexts;
    D = indices;
# ---------- end c_script ----------
polyline_interior_angles = PolylineInteriorAngles(Polyline=geo_9)  # -> Angles, Points
c_script_2 = CSharpScript(check=c_script.A, angle=polyline_interior_angles.Angles, point=polyline_interior_angles.Points)  # -> out, A, B, C; inputs check: list of Boolean, angle: list of Double, point: list of Point3d
# ---------- c_script_2: C# ----------
    if(check.Count != angle.Count) this.Component.AddRuntimeMessage(GH_RuntimeMessageLevel.Error, "WTF");

    List<int> outputCheck = new List<int>();
    List<int> outputCheck2 = new List<int>();

    List<Point3d> outputPt = new List<Point3d>();

    for (int i = 0; i < check.Count; i++)
    {
      if(check[i])
      {
        int next = i == check.Count - 1 ? 0 : i + 1;
        int prev = i == 0 ? check.Count - 1 : i - 1;
        int index = angle[i] < angle[next] ? 0 : 1;
        int index2 = angle[i] < angle[next] ? next : prev;
        outputCheck.Add(index);
        outputCheck2.Add(index2);
        if(index == 0) outputPt.Add(point[i]);
        else outputPt.Add(point[next]);
      }
    }

    A = outputCheck;
    B = outputPt;
    C = outputCheck2;
# ---------- end c_script_2 ----------

trim = TrimTree(Tree=group, Depth=1)
trim_2 = TrimTree(Tree=split.Positive, Depth=1)

cull = CullPattern(List=graft(geo_7), CullPattern=graft(c_script.A))
clean = CleanTree(RemoveNulls=True, RemoveInvalid=True, RemoveEmpty=True, Tree=simplify(cull))
tstat = TreeStatistics(Tree=clean)  # -> Paths, Length, Count

rev = ReverseList(List=trim_2)

merge = Merge(Data1=c_script.B, Data2=c_script.C)
item = ListItem(List=merge, Index=c_script_2.A, Wrap=True)  # -> Item, Item1

split_2 = SplitTree(Data=geo_10, Masks=flatten(tstat.Paths))  # -> Positive, Negative
trim_3 = TrimTree(Tree=split_2.Positive, Depth=1)

clean_2 = CleanTree(RemoveNulls=True, RemoveInvalid=True, RemoveEmpty=True, Tree=simplify(item.Item1))
debrep = DeconstructBrep(Brep=clean_2)  # -> Faces, Edges, Vertices

cull_2 = CullPattern(List=geo_10, CullPattern=graft(c_script.A))
clean_3 = CleanTree(RemoveNulls=True, RemoveInvalid=True, RemoveEmpty=True, Tree=simplify(cull_2))

clean_4 = CleanTree(RemoveNulls=True, RemoveInvalid=True, RemoveEmpty=True, Tree=simplify(c_script_2.A))
item_2 = ListItem(List=trim_3, Index=clean_4, Wrap=True)

area = Area(Geometry=debrep.Faces)  # -> Area, Centroid
cp = ClosestPoint(Point=item_2, Cloud=area.Centroid)  # -> ClosestPoint, CPIndex, Distance
cull_i = CullIndex(List=debrep.Faces, Indices=cp.CPIndex, Wrap=True)
item_3 = ListItem(List=debrep.Faces, Index=cp.CPIndex, Wrap=True)

item_4 = ListItem(List=clean_3, Index=cp.CPIndex, Wrap=True)
trim_4 = TrimTree(Tree=item_4, Depth=1)
clean_5 = CleanTree(RemoveNulls=True, RemoveInvalid=True, RemoveEmpty=True, Tree=simplify(trim_4))

geo_11 = Geometry(geo_8)
tstat_2 = TreeStatistics(Tree=trim_3)  # -> Paths, Length, Count
clean_6 = CleanTree(RemoveNulls=True, RemoveInvalid=True, RemoveEmpty=True, Tree=simplify(c_script_2.C))
split_3 = SplitTree(Data=geo_11, Masks=flatten(tstat_2.Paths))  # -> Positive, Negative
item_5 = ListItem(List=split_3.Positive, Index=clean_6, Wrap=True)
deplane = DeconstructPlane(Plane=item_5)  # -> Origin, XAxis, YAxis, ZAxis

c_script_3 = CSharpScript(x=deplane.XAxis, y=clean_4)  # -> out, A; inputs x: Vector3d, y: Int32
# ---------- c_script_3: C# ----------
    if(y == 1) A = x;
    else
    {
      x.Reverse();
      A = x;
    }
# ---------- end c_script_3 ----------
amp = Amplitude(Vector=c_script_3.A, Amplitude=Slider(5, range=0..10))
move = Move(Geometry=item_3, Motion=amp)  # -> Geometry, Transform
merge_2 = Merge(Data1=item_3, Data2=move.Geometry)
crv = Curve(merge_2)
loft = Loft(Curves=crv, Options={Adjust=False, Closed=False, LoftEnds=0, LoftSimp=0, LoftType=0, Rebuild=10, Refit=0.01})

merge_3 = Merge(Data1=simplify(loft), Data2=simplify(move.Geometry), Data3=simplify(cull_i))
join = BrepJoin(Breps=merge_3)  # -> Breps, Closed
fmerge = MergeFaces(Brep=join.Breps)  # -> Breps, Before, After

match = MatchTree(Tree=geo_6, Guide=c_script.A)  # -> graft(Tree)
split_4 = SplitTree(Data=match, Masks=flatten(tstat.Paths))  # -> Positive, Negative

sec = BrepPlane(Brep=fmerge.Breps, Plane=clean_5)  # -> Curves, Points
split_5 = SplitBrep(Brep=fmerge.Breps, Cutter=sec.Curves)
area_2 = Area(Geometry=split_5)  # -> Area, Centroid
sort = SortList(Keys=area_2.Area, ValuesA=split_5)  # -> Keys, ValuesA
item_6 = ListItem(List=sort.ValuesA, Index=0, Wrap=True)
cap = CapHoles(Brep=item_6)

sec_2 = BrepPlane(Brep=cap, Plane=split_4.Positive)  # -> Curves, Points
split_6 = SplitBrep(Brep=cap, Cutter=sec_2.Curves)
area_3 = Area(Geometry=split_6)  # -> Area, Centroid
sort_2 = SortList(Keys=area_3.Area, ValuesA=split_6)  # -> Keys, reverse(ValuesA)
item_7 = ListItem(List=sort_2.ValuesA, Index=0, Wrap=True)
cap_2 = CapHoles(Brep=item_7)  # -> simplify(Brep)

bbox = BoundingBox(Content=cap_2, Plane=item_5)  # -> Box, Box_2
split_7 = SplitTree(Data=D_2, Masks=flatten(tstat_2.Paths))  # -> Positive, Negative

clean_7 = CleanTree(RemoveNulls=True, RemoveInvalid=True, RemoveEmpty=True, Tree=simplify(c_script.D))
split_8 = SplitTree(Data=geo_7, Masks=flatten(tstat_2.Paths))  # -> Positive, Negative
replace = ReplaceItems(List=split_8.Positive, Item=cap_2, Indices=clean_6, Wrap=False)
cull_i_2 = CullIndex(List=replace, Indices=clean_7, Wrap=True)  # -> simplify(List)
merge_4 = Merge(Data1=cull_i_2, Data2=split_8.Negative)

match_2 = MatchTree(Tree=rev, Guide=merge_4)
split_9 = SplitTree(Data=simplify(match_2), Masks=flatten(tstat_2.Paths))  # -> Positive, Negative
cull_i_3 = CullIndex(List=split_9.Positive, Indices=clean_7, Wrap=True)  # -> simplify(List)
merge_5 = Merge(Data1=cull_i_3, Data2=split_9.Negative)

replace_2 = ReplaceItems(List=split_7.Positive, Item=bbox.Box, Indices=clean_6, Wrap=False)
cull_i_4 = CullIndex(List=replace_2, Indices=clean_7, Wrap=True)  # -> simplify(List)
merge_6 = Merge(Data1=cull_i_4, Data2=split_7.Negative)
R = ClusterOutput(merge_4)
R_2 = ClusterOutput(merge_5)
R_3 = ClusterOutput(merge_6)
P = ClusterOutput(tstat_2.Paths)
T = ClusterOutput(clean_7)

match_3 = MatchTree(Tree=trim, Guide=merge_4)
split_10 = SplitTree(Data=simplify(match_3), Masks=flatten(tstat_2.Paths))  # -> Positive, Negative

item_8 = ListItem(List=split_10.Positive, Index=clean_6, Wrap=True)
ungroup = Ungroup(Group=item_8)
geo_12 = Geometry(clean_5)
cp_2 = ClosestPoint(Point=geo_12, Cloud=ungroup)  # -> ClosestPoint, CPIndex, Distance
replace_3 = ReplaceItems(List=ungroup, Item=geo_12, Indices=cp_2.CPIndex, Wrap=False)
group_2 = Group(Objects=replace_3)  # -> simplify(Group)
replace_4 = ReplaceItems(List=split_10.Positive, Item=group_2, Indices=clean_6, Wrap=False)
cull_i_5 = CullIndex(List=replace_4, Indices=clean_7, Wrap=True)  # -> simplify(List)

merge_7 = Merge(Data1=cull_i_5, Data2=split_10.Negative)

ungroup_2 = Ungroup(Group=merge_7)
O = ClusterOutput(ungroup_2)

# ==== cluster Cluster_5
crv = ClusterInput()
pln = ClusterInput()
min_batten_width = ClusterInput()
crv_2 = Curve(crv)
pln_2 = Plane(pln)
deplane = DeconstructPlane(Plane=pln_2)  # -> Origin, XAxis, YAxis, ZAxis
pl = ConstructPlane(Origin=deplane.Origin, XAxis=deplane.XAxis, YAxis=deplane.ZAxis)
min_batten_width_2 = Number(min_batten_width)
project = Project(Geometry=crv_2, Plane=pl)  # -> Geometry, Transform
top_plate_thickness = ClusterInput()
brep = ClusterInput()
beam_depth = ClusterInput()
brep_2 = Brep(brep)
top_plate_thickness_2 = Number(top_plate_thickness)
beam_depth_2 = Number(beam_depth)
len = Length(Curve=project.Geometry)
smaller = SmallerThan(FirstNumber=len, SecondNumber=min_batten_width_2)  # -> SmallerThan, OrEqualTo
cull = CullPattern(List=project.Geometry, CullPattern=invert(smaller.SmallerThan))
cull_2 = CullPattern(List=pln_2, CullPattern=invert(smaller.SmallerThan))  # -> graft(List)
A = ClusterInput()
iedgeoffsetfactor = ClusterInput()
ispacing = ClusterInput()
deplane_2 = DeconstructPlane(Plane=cull_2)  # -> Origin, XAxis, YAxis, ZAxis
line = Line(cull)
division = Division(A=A, B=1000)
rot3d = Rotate3D(Geometry=cull_2, Angle=1.570796327, Center=deplane_2.Origin, Axis=deplane_2.XAxis)  # -> Geometry, Transform
multiplication = Multiplication(A=iedgeoffsetfactor, B=division)

c_script = CSharpScript(brep=brep_2, distance=multiplication, solid=Toggle(False), extend=Toggle(True))  # -> out, A; inputs brep: Brep, distance: Double, solid: Boolean, extend: Boolean
# ---------- c_script: C# ----------
    if (null != brep)
    {
      //double tol = RhinoDoc.ActiveDoc.ModelAbsoluteTolerance;
      Brep[] out_blends = null;
      Brep[] out_walls = null;
      Brep[] out_breps = Brep.CreateOffsetBrep(brep, distance, solid, extend, RhinoDoc.ActiveDoc.ModelAbsoluteTolerance, out out_blends, out out_walls);
      if (null != out_breps)
        A = out_breps;
      else
        this.Component.AddRuntimeMessage(GH_RuntimeMessageLevel.Error, "Failed");
    }
    else
      this.Component.AddRuntimeMessage(GH_RuntimeMessageLevel.Error, "Brep Null");
# ---------- end c_script ----------

c_script_2 = CSharpScript(iLine=graft(line), iSpacing=ispacing, iEdgeOffsetFactor=iedgeoffsetfactor, iDiameter=division)  # -> out, A, B; inputs iLine: Line, iSpacing: Double, iEdgeOffsetFactor: Double, iDiameter: Double
# ---------- c_script_2: C# ----------
    double count = Math.Floor(iLine.Length / iSpacing);
    double buffer = iDiameter * iEdgeOffsetFactor;
    double offsetDistance = iLine.Length - (count * iSpacing) - (buffer * 2);
    if(offsetDistance < 0)
    {
      count -= 1;
      offsetDistance = iLine.Length - (count * iSpacing) - (buffer * 2);
    }
    offsetDistance /= 2;
    Line newLine = new Line(iLine.PointAtLength(offsetDistance), iLine.PointAtLength(iLine.Length - offsetDistance));

    List<Point3d> pts = new List<Point3d>();
    for (int i = 0; i < count + 1; i++)
    {
      pts.Add(newLine.PointAtLength(i * iSpacing + buffer));
    }
    A = newLine;
    B = pts;
# ---------- end c_script_2 ----------
pl_2 = ConstructPlane(Origin=c_script_2.B, XAxis=deplane_2.XAxis, YAxis=deplane_2.ZAxis)
pl_origin = PlaneOrigin(Base=simplify(rot3d.Geometry), Origin=simplify(c_script_2.B))
B = ClusterInput()
addition = Addition(A=top_plate_thickness_2, B=beam_depth_2)
division_2 = Division(A=beam_depth_2, B=2)
L = ClusterInput()
lng = ListLength(List=line)
flippln = FlipPlane(Plane=pl_origin, FlipX=False, FlipY=False, FlipZ=True)  # -> Flipped, R
division_3 = Division(A=L, B=2)
subtraction = Subtraction(A=addition, B=B)  # -> simplify(Result)
division_4 = Division(A=L, B=2)
brepsinc = PointInBreps(Brep=flatten(c_script.A), Point=flippln.Flipped, Strict=True)  # -> Inside, Index
listdexs = ListIndices(List=flippln.Flipped)
dup = DuplicateData(Data=subtraction, Number=lng, Order=True)  # -> simplify(graft(Data))
dup_2 = DuplicateData(Data=division_2, Number=lng, Order=True)  # -> simplify(graft(Data))
cull_3 = CullPattern(List=flippln.Flipped, CullPattern=invert(brepsinc.Inside))
cull_4 = CullPattern(List=listdexs, CullPattern=invert(brepsinc.Inside))
pl_offset = PlaneOffset(BasePlane=cull_3, Offset=division_4)
cs = CreateScrews(BasePlane=pl_offset, ScrewIndex=cull_4, ScrewDiameter=division, ScrewLength=L, TopOffset=dup_2)
c_script_3 = CSharpScript(
    x=cs,
    Reference=["C:\USERS\LASATHS\DESKTOP\Libraries\ABxM.PlateStructures\LCRL.dll", "C:\Users\lasaths\AppData\Roaming\Grasshopper\Libraries\ABxM.PlateStructures\ElementBase.dll"])  # -> out, A, B, C, D
# ---------- c_script_3: C# usings ----------
using ABxM.PlateStructures.Development;
# ---------- c_script_3: C# ----------
    if(x != null)
    {
      Screw screw = x as Screw;
      Line ln = screw.PreviewLine;
      A = ln;
      B = screw.FrameBase;
      C = screw.ConnectedSegmentHeadPlane;
      D = screw.Centerline;
    }
# ---------- end c_script_3 ----------
geo = Geometry(c_script_3.D)
geo_2 = Geometry(c_script_3.B)
geo_3 = Geometry(c_script_3.A)
geo_4 = Geometry(c_script_3.C)
geo_5 = ClusterOutput(geo)
geo_6 = ClusterOutput(geo_2)
geo_7 = ClusterOutput(geo_4)
S = ClusterOutput(cs)

# ==== cluster Cluster_6
D = ClusterInput()
D_2 = ClusterInput()
lng = ListLength(List=D_2)
dup = DuplicateData(Data=D, Number=lng, Order=True)
tree = CreateTree(Data=flatten(D_2), Path=flatten(dup))
D_3 = ClusterOutput(tree)

# ==== cluster Cluster_14

offset_distance = Slider(0.003, range=0..0.01)
offset_shadow_gap = GetNumber(
    offset_distance,
    {"0.003"}, selected=[],
    AtLeast=1,
    AtMost=1,
    Maximum=1.797693135e+308,
    Minimum=-1.797693135e+308,
    Prompt="Shadaw Gap through offset of Plate",
    TreeAccess=False)

factor = Slider(1, range=0..1)
min_area_of_hole = Slider(0.1, range=0..1)
min_area_of_hole_2 = GetNumber(
    min_area_of_hole,
    AtLeast=1,
    AtMost=1,
    Maximum=1.797693135e+308,
    Minimum=-1.797693135e+308,
    Prompt="Cull areas small than",
    TreeAccess=False)
weight_of_holes = GetNumber(
    factor,
    AtLeast=1,
    AtMost=1,
    Maximum=1.797693135e+308,
    Minimum=-1.797693135e+308,
    Prompt="Weight of Hole Size (0 is none, 1 is full)",
    TreeAccess=False)

list = ValueList({"Z Height": 0, "Normal Angle": 1}, selected="Z Height")
hole_gradient_method = GetInteger(
    list,
    {"0"}, selected=[],
    AtLeast=1,
    AtMost=1,
    Maximum=2147483647,
    Minimum=-2147483648,
    Prompt="Z Height  = 0, Normal Angle = 1",
    TreeAccess=False)

clear_height = Slider(0, range=0..10)
offset_north_south_edge = GetNumber(
    Slider(3, range=0..100),
    AtLeast=1,
    AtMost=1,
    Maximum=1.797693135e+308,
    Minimum=-1.797693135e+308,
    Prompt="Offset from the Roof Edge",
    TreeAccess=False)
offset_clear_height = GetNumber(
    clear_height,
    AtLeast=1,
    AtMost=1,
    Maximum=1.797693135e+308,
    Minimum=-1.797693135e+308,
    Prompt="Height above ridge to be clear of holes",
    TreeAccess=False)

height_based_gradient_max_offset = GetNumber(
    Slider(0.6, range=0..1),
    AtLeast=1,
    AtMost=1,
    Maximum=1.797693135e+308,
    Minimum=-1.797693135e+308,
    Prompt="Max Offset from Boundary",
    TreeAccess=False)
height_based_gradient_min_offset = GetNumber(
    Slider(0.3, range=0..1),
    AtLeast=1,
    AtMost=1,
    Maximum=1.797693135e+308,
    Minimum=-1.797693135e+308,
    Prompt="Min Offset from Boundary",
    TreeAccess=False)

normal_angle_max_angle = GetInteger(
    Slider(45, range=0..100),
    AtLeast=1,
    AtMost=1,
    Maximum=2147483647,
    Minimum=-2147483648,
    Prompt="Remaps angles based on Max Angle",
    TreeAccess=False)

list_2 = ValueList({"Interpolate Hole": 0, "Filleted Hex": 1}, selected="Filleted Hex")
hex_fillet = Slider(0.15, range=0..1)
hole_type = GetInteger(
    list_2,
    AtLeast=1,
    AtMost=1,
    Maximum=2147483647,
    Minimum=-2147483648,
    Prompt="Interpolate Hole = 0, Filleted Hex     = 1",
    TreeAccess=False)
hex_fillet_2 = GetNumber(hex_fillet, AtLeast=1, AtMost=1, Maximum=1.797693135e+308, Minimum=-1.797693135e+308, TreeAccess=False)

beam_width = ClusterInput()

list_3 = ValueList({"Gradient": 0, "Constant": 1, "Structural": 2, "Struct/Grad": 3}, selected="Struct/Grad")
hole_gradient_method_2 = GetInteger(
    beam_width,
    {"0"}, selected=[],
    AtLeast=1,
    AtMost=1,
    Maximum=2147483647,
    Minimum=-2147483648,
    Prompt="Z Height  = 0, Normal Angle = 1",
    TreeAccess=False)
constant_offset = GetNumber(
    Slider(0.24, range=0..1),
    AtLeast=1,
    AtMost=1,
    Maximum=1.797693135e+308,
    Minimum=-1.797693135e+308,
    Prompt="Max Offset from Boundary",
    TreeAccess=False)

number_slider = Slider(0.0045, range=0.001..0.01)

number_slider_2 = Slider(0.0029, range=0.001..0.01)

# ----
# - Bottom Plate Holes -
crv = ClusterInput()
structural_offset = ClusterInput()
split = SplitTree(Data=structural_offset, Masks=flatten("{6,7;*}"))  # -> Positive, Negative
subtraction = Subtraction(A=split.Negative, B=number_slider_2)
subtraction_2 = Subtraction(A=split.Positive, B=number_slider)
crv_2 = Curve(Tree({0;0;0;0}: [], {0;0;1;0}: [], {0;0;2;0}: [], {0;1;0;0}: [], {0;1;1;0}: [], {0;1;2;0}: []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))
beam_width_2 = ClusterInput()

crv_3 = Curve(simplify(crv))

fabrication_offset = ClusterInput()
merge = Merge(Data1=simplify(subtraction_2), Data2=simplify(subtraction))
addition = Addition(A=beam_width_2, B=fabrication_offset)
num = Number(simplify(merge))
area = Area(Geometry=crv_3)  # -> Area, Centroid
tstat = TreeStatistics(Tree=crv_3)  # -> Paths, Length, Count
Z = UnitZ(Factor=-0.1)

tstat_2 = TreeStatistics(Tree=simplify(crv_3))  # -> Paths, Length, Count
tstat_3 = TreeStatistics(Tree=addition)  # -> Paths, Length, Count
tree = CreateTree(Data=flatten(addition), Path=tstat_3.Paths, Ensure=tstat_2.Paths)

area_2 = Area(Geometry=crv_2)  # -> Area, Centroid

tstat_4 = TreeStatistics(Tree=simplify(crv_3))  # -> Paths, Length, Count
tstat_5 = TreeStatistics(Tree=num)  # -> Paths, Length, Count
tree_2 = CreateTree(Data=flatten(num), Path=tstat_5.Paths, Ensure=tstat_4.Paths)

move = Move(Geometry=area.Centroid, Motion=Z)  # -> Geometry, Transform
clean = CleanTree(RemoveNulls=True, RemoveInvalid=True, RemoveEmpty=True, Tree=area_2.Area)
split_2 = SplitTree(Data=simplify(clean), Masks=flatten("{6,7;*}"))  # -> Positive, Negative
tag = TextTag(Location=flatten(move.Geometry), Text=tstat.Paths)

tstat_6 = TreeStatistics(Tree=crv_3)  # -> Paths, Length, Count
lng = ListLength(List=tstat_6.Paths)
larger = LargerThan(FirstNumber=lng, SecondNumber=1)  # -> LargerThan, OrEqualTo

ma = MassAddition(Input=flatten(split_2.Positive))  # -> Result, PartialResults
ma_2 = MassAddition(Input=flatten(split_2.Negative))  # -> Result, PartialResults
previewlw = CustomPreviewLineweights(Geometry=crv_2, Shader=ColourSwatch(SwatchColor=RGB(98, 255, 0)), Absolute=False)
panel = Panel(ma.Result)
panel_2 = Panel(ma_2.Result)
boundary = BoundarySurfaces(Edges=crv_3)

# ---- group: Shadow Gap of Bottom Plate
planar = Planar(Curve=crv_3)  # -> Planar, Plane, Deviation
polyoffset = PolylineOffset(
    Polylines=graft(crv_3),
    Distance=offset_shadow_gap,
    Plane=simplify(graft(planar.Plane)),
    Tolerance=0.001,
    ClosedFillet=1,
    OpenFillet=2,
    Miter=2)  # -> Contour, Holes
match = MatchTree(Tree=polyoffset.Holes, Guide=graft(crv_3))

# ----
cluster = Cluster_7(G=larger.LargerThan, _1=match)
area_3 = Area(Geometry=cluster)  # -> Area, Centroid
pdecon = Deconstruct(Point=area_3.Centroid)  # -> XComponent, YComponent, ZComponent
cluster_2 = Cluster_10(G=larger.LargerThan, _0=simplify(pdecon.ZComponent))
c_script = CSharpScript(x=cluster_2)  # -> Min, Max; inputs x: list of Double
# ---------- c_script: C# usings ----------
using System.Linq;
# ---------- c_script: C# ----------
    Max = x.Max();
    Min = x.Min();
# ---------- end c_script ----------
dom = ConstructDomain(DomainStart=c_script.Min, DomainEnd=c_script.Max)
cluster_3 = Cluster_11(G=larger.LargerThan, _0=simplify(dom), L=cluster_2)
remap = RemapNumbers(Value=pdecon.ZComponent, Source=cluster_3, Target=Domain(0, 1))  # -> Mapped, Clipped
cluster_4 = Cluster_10(G=larger.LargerThan, _0=simplify(remap.Mapped))
c_script_2 = CSharpScript(x=remap.Mapped)  # -> out, A; inputs x: Double
# ---------- c_script_2: C# ----------
    if(x == 0)
      A = 0;
    else A = 1 - x;
# ---------- end c_script_2 ----------
c_script_3 = CSharpScript(x=cluster_4)  # -> Min, Max; inputs x: list of Double; same code as c_script
dom_2 = ConstructDomain(DomainStart=height_based_gradient_min_offset, DomainEnd=height_based_gradient_max_offset)
dom_3 = ConstructDomain(DomainStart=c_script_3.Min, DomainEnd=c_script_3.Max)
remap_2 = RemapNumbers(Value=c_script_2.A, Source=dom_3, Target=dom_2)  # -> simplify(Mapped), Clipped

cluster_5 = Cluster_8(G=larger.LargerThan, _0=boundary)
brep_cp = BrepClosestPoint(Point=area_3.Centroid, Brep=cluster_5)  # -> Point, Normal, Distance
Z_2 = UnitZ(Factor=1)
dprod = DotProduct(VectorA=brep_cp.Normal, VectorB=Z_2, Unitize=False)
smaller = SmallerThan(FirstNumber=dprod, SecondNumber=0)  # -> SmallerThan, OrEqualTo
c_script_4 = CSharpScript(x=brep_cp.Normal, y=smaller.SmallerThan)  # -> out, A; inputs x: Vector3d, y: Boolean
# ---------- c_script_4: C# ----------
    if(y)
    {
      x.Reverse();
      double angle = Vector3d.VectorAngle(x, Vector3d.ZAxis);
      if(angle < 0) angle = 0;
      A = angle;
    }
    else
    {
      double angle = Vector3d.VectorAngle(x, Vector3d.ZAxis);
      if(angle < 0) angle = 0;
      A = angle;
    }
# ---------- end c_script_4 ----------
deg = Degrees(Radians=c_script_4.A)
c_script_5 = CSharpScript(x=deg, y=normal_angle_max_angle)  # -> out, A; inputs x: Double, y: Double
# ---------- c_script_5: C# ----------
    if(x > y) A = y;
    else A = x;
# ---------- end c_script_5 ----------
cluster_6 = Cluster_10(G=larger.LargerThan, _0=c_script_5.A)
c_script_6 = CSharpScript(x=cluster_6)  # -> Min, Max; inputs x: list of Double; same code as c_script
dom_4 = ConstructDomain(DomainStart=c_script_6.Min, DomainEnd=c_script_6.Max)
remap_3 = RemapNumbers(Value=c_script_5.A, Source=dom_4, Target=dom_2)  # -> Mapped, Clipped

pt = ConstructPoint(XCoordinate=0, YCoordinate=0, ZCoordinate=0)
boundary_2 = BoundarySurfaces(Edges=match)
evalsrf = EvaluateSurface(Surface=boundary_2, Point=pt)  # -> Point, Normal, UDirection, VDirection, Frame
pl = PlaneNormal(Origin=evalsrf.Point, ZAxis=evalsrf.Normal)

polyoffset_2 = PolylineOffset(
    Polylines=simplify(graft(match)),
    Distance=graft(tree_2),
    Plane=simplify(graft(pl)),
    Tolerance=0.001,
    ClosedFillet=2,
    OpenFillet=1,
    Miter=2)  # -> Contour, simplify(Holes)

join = BrepJoin(Breps=flatten(boundary))  # -> Breps, Closed
edges = BrepEdges(Brep=join.Breps)  # -> Naked, Interior, NonManifold
join_2 = JoinCurves(Curves=edges.Naked, Preserve=False)
len = Length(Curve=join_2)
sort = SortList(Keys=len, ValuesA=join_2)  # -> Keys, reverse(ValuesA)
item = ListItem(List=sort.ValuesA, Index=0, Wrap=True)
disc = Discontinuity(Curve=item, Level=1)  # -> Points, Parameters
c_script_7 = CSharpScript(x=disc.Points, y=offset_north_south_edge, z=offset_clear_height)  # -> yMin, yMax, zMin; inputs x: list of Point3d, y: Double, z: Double
# ---------- c_script_7: C# ----------
    List<double> yVal = x.Select(o => o.Y).ToList();
    List<double> zVal = x.Select(o => o.Z).ToList();
    yMax = yVal.Max() - y;
    yMin = yVal.Min() + y;
    zMin = zVal.Min() + z;
# ---------- end c_script_7 ----------

filter = StreamFilter(Gate=hole_gradient_method, Stream0=remap_2.Mapped, Stream1=remap_3.Mapped)
multiplication = Multiplication(A=filter, B=weight_of_holes)
c_script_8 = CSharpScript(u=multiplication, x=area_3.Centroid, yMin=c_script_7.yMin, yMax=c_script_7.yMax, zMin=c_script_7.zMin)  # -> out, simplify(A); inputs x: Point3d, yMin: Double, yMax: Double, zMin: Double
# ---------- c_script_8: C# ----------
    if(x.Z > zMin && x.Y < yMax && x.Y > yMin) A = u;
    else A = 0;
# ---------- end c_script_8 ----------

md_slider = MDSlider(
    SliderMode=0,
    slider_value=Point(0.4847358452, 0.5509033203, 0.5),
    x_domain=Domain(0, 1),
    y_domain=Domain(0, 1),
    z_domain=Domain(0, 1))
number_slider_3 = Slider(0.6694, range=0.1..0.8)
number_slider_4 = Slider(0.3035, range=0.3..0.7)
number_slider_5 = Slider(0.6159, range=0.4..0.7)
number_slider_6 = Slider(0.401, range=0.4..0.7)
md_slider_2 = MDSlider(
    SliderMode=0,
    slider_value=Point(0.5482513092, 0.6442990187, 0.5),
    x_domain=Domain(0, 1),
    y_domain=Domain(0, 1),
    z_domain=Domain(0, 1))

area_4 = Area(Geometry=match)  # -> Area, Centroid
match_2 = MatchTree(Tree=c_script_8.A, Guide=multiplication)
cp = ClosestPoint(Point=area_4.Centroid, Cloud=area_3.Centroid)  # -> ClosestPoint, CPIndex, Distance
item_2 = ListItem(List=match_2, Index=cp.CPIndex, Wrap=True)

pt_2 = ConstructPoint(XCoordinate=number_slider_5, YCoordinate=number_slider_3, ZCoordinate=0)
pt_3 = ConstructPoint(XCoordinate=number_slider_6, YCoordinate=number_slider_4, ZCoordinate=0)
filter_2 = StreamFilter(Gate=Toggle(False), Stream0=pt_2, Stream1=md_slider_2)
filter_3 = StreamFilter(Gate=Toggle(False), Stream0=pt_3, Stream1=md_slider)
pdecon_2 = Deconstruct(Point=filter_2)  # -> XComponent, YComponent, ZComponent
pdecon_3 = Deconstruct(Point=filter_3)  # -> XComponent, YComponent, ZComponent
number_slider_7 = Slider(0.1, range=0..0.1)
c_script_9 = CSharpScript(x=item_2, y=constant_offset)  # -> out, A; inputs x: Double, y: Double
# ---------- c_script_9: C# ----------
    if(x == 0) A = x;
    else A = y;
# ---------- end c_script_9 ----------
graph = GraphMapper(
    c_script_9.A,
    x0=0,
    x1=1,
    y0=0,
    y1=1,
    container_name="Bezier",
    cpx=[0, 0.3851548433, 0.75, 1],
    cpy=[0, 0.09435856342, 0.75, 1])
graph_2 = GraphMapper(item_2, x0=0, x1=1, y0=0, y1=1, container_name="Bezier", cpx=[0, 0.3851548433, 0.75, 1], cpy=[0, 0.09435856342, 0.75, 1])
c_script_10 = CSharpScript(x=graph_2, y=tree)  # -> out, A; inputs x: Double, y: Double
# ---------- c_script_10: C# ----------
    if(x> 0  && y > 0)
    {
      if( y > x) A = y;
      else A = x;
    }
# ---------- end c_script_10 ----------
split_3 = SplitTree(Data=c_script_10.A, Masks=flatten("{6,7;*}"))  # -> Positive, Negative
cluster_7 = Cluster_12(X=pdecon_2.XComponent, Y=pdecon_2.YComponent, X_2=split_3.Negative)
cluster_8 = Cluster_12(X=pdecon_3.XComponent, Y=pdecon_3.YComponent, X_2=split_3.Positive)
panel_3 = Panel(cluster_8)
genes = GenePool(
    Decimals=4,
    Maximum=0.8,
    Minimum=0.4,
    Value=[0.665742, 0.65892, 0.663244, 0.659726, 0.658435, 0.663277, 0.663978, 0.539541, 0.660237, 0.665176, 0.539847, 0.53595, 0.545603, 0.538125])
trim = TrimTree(Tree=split_3.Positive, Depth=1)
trim_2 = TrimTree(Tree=split_3.Negative, Depth=1)
graph_3 = GraphMapper(trim, x0=0, x1=1, y0=0, y1=1, Cx=0.5044915676, Cy=0.4825386405, container_name="Conic")
graph_4 = GraphMapper(trim_2, x0=0, x1=1, y0=0, y1=1, Cx=0.4831001759, Cy=0.6187028885, container_name="Conic")
merge_2 = Merge(Data1=cluster_8, Data2=simplify(cluster_7))
graft = GraftTree(Tree=graph_4, IncludeEmptyLists=True, IncludeNullItems=True)
graft_2 = GraftTree(Tree=graph_3, IncludeEmptyLists=True, IncludeNullItems=True)
match_3 = MatchTree(Tree=graft_2, Guide=split_3.Positive)
match_4 = MatchTree(Tree=graft, Guide=split_3.Negative)
cluster_9 = Cluster_13(L=genes, D=c_script_10.A)
merge_3 = Merge(Data1=match_3, Data2=match_4)
clean_2 = CleanTree(RemoveNulls=True, RemoveInvalid=True, RemoveEmpty=False, Tree=merge_3)
filter_4 = StreamFilter(Gate=Toggle(True), Stream0=clean_2, Stream1=merge_2)
match_5 = MatchTree(Tree=filter_4, Guide=c_script_10.A)
movopossum_3_0_0 = Opossum(
    OpossumData_OptimizationType=2,
    OpossumData_ResultSerializationStatus=0,
    OpossumData_objective=num_4,
    OpossumData_variable=[genes, number_slider])
c_script_11 = CSharpScript(x=match_5, y=tree)  # -> out, A; inputs x: Double, y: Double; same code as c_script_10

hall_acoustic_area_min = Slider(590, range=0..1000)
office_acoustic_area_min = Slider(188, range=0..1000)

filter_5 = StreamFilter(Gate=hole_gradient_method_2, Stream0=graph_2, Stream1=graph, Stream2=tree, Stream3=c_script_11.A)

tstat_7 = TreeStatistics(Tree=num)  # -> Paths, Length, Count
split_4 = SplitTree(Data=filter_5, Masks=flatten(tstat_7.Paths))  # -> Positive, Negative
split_5 = SplitTree(Data=num, Masks=flatten(tstat_7.Paths))  # -> Positive, Negative
max = Maximum(A=split_4.Positive, B=split_5.Positive)
merge_4 = Merge(Data1=max, Data2=split_4.Negative)

movopossum_3_0_0_2 = Opossum(
    OpossumData_OptimizationType=2,
    OpossumData_ResultSerializationStatus=0,
    OpossumData_objective=num_2,
    OpossumData_variable=[number_slider_4, number_slider_6, number_slider_8])
movopossum_3_0_0_3 = Opossum(
    OpossumData_OptimizationType=0,
    OpossumData_ResultSerializationStatus=0,
    OpossumData_objective=num_3,
    OpossumData_variable=[number_slider_3, number_slider_5, number_slider_2])
shell_7_swap = ClusterInput()
filter_6 = StreamFilter(Gate=shell_7_swap, Stream0="{*}", Stream1="{1;15,16,17,18,19}")
split_6 = SplitTree(Data=c_script_10.A, Masks=flatten(filter_6))  # -> Positive, Negative
split_7 = SplitTree(Data=merge_4, Masks=flatten(filter_6))  # -> Positive, Negative
merge_5 = Merge(Data1=split_6.Positive, Data2=split_7.Positive)
avr = Average(Input=merge_5)
merge_6 = Merge(Data1=avr, Data2=split_7.Negative)

M = ClusterInput()
split_8 = SplitTree(Data=merge_6, Masks=flatten(M))  # -> Positive, Negative
c_script_12 = CSharpScript(x=split_8.Positive, y=constant_offset)  # -> out, A
# ---------- c_script_12: C# ----------
    A = y;
# ---------- end c_script_12 ----------
merge_7 = Merge(Data1=c_script_12.A, Data2=split_8.Negative)

split_9 = SplitTree(Data=tree, Masks=flatten(M))  # -> Positive, Negative
c_script_13 = CSharpScript(x=split_9.Positive, y=constant_offset)  # -> out, A; same code as c_script_12
merge_8 = Merge(Data1=c_script_13.A, Data2=split_9.Negative)
polyoffset_3 = PolylineOffset(
    Polylines=simplify(graft(match)),
    Distance=graft(merge_8),
    Plane=simplify(graft(pl)),
    Tolerance=0.001,
    ClosedFillet=2,
    OpenFillet=1,
    Miter=2)  # -> Contour, simplify(Holes); disabled
filter_7 = StreamFilter(Gate=Toggle(True), Stream0=polyoffset_3.Holes, Stream1=polyoffset_2.Holes)
crv_4 = Curve(filter_7)  # disabled
area_5 = Area(Geometry=polyoffset_3.Holes)  # -> Area, Centroid

number_slider_8 = Slider(-0.0142, range=-0.015..0.005)
office_extra_acoustic_area = ClusterInput()  # Office Extra Acoustic Area
split_10 = SplitTree(Data=simplify(merge_7), Masks=flatten(office_extra_acoustic_area))  # -> Positive, Negative
addition_2 = Addition(A=split_10.Positive, B=number_slider_8)
merge_9 = Merge(Data1=simplify(split_10.Negative), Data2=addition_2)

polyoffset_4 = PolylineOffset(
    Polylines=simplify(graft(match)),
    Distance=graft(merge_9),
    Plane=simplify(graft(pl)),
    Tolerance=0.001,
    ClosedFillet=2,
    OpenFillet=1,
    Miter=2)  # -> Contour, simplify(Holes)
crv_5 = Curve(polyoffset_4.Holes)
area_6 = Area(Geometry=crv_5)  # -> Area, Centroid
smaller_2 = SmallerThan(FirstNumber=area_5.Area, SecondNumber=area_6.Area)  # -> SmallerThan, OrEqualTo
c_script_14 = CSharpScript(
    x=smaller_2.SmallerThan,
    y=ColourSwatch(SwatchColor=RGBA(25, 97, 207, 43)),
    z=ColourSwatch(SwatchColor=RGBA(235, 19, 19, 90)))  # -> out, A; inputs x: Boolean
# ---------- c_script_14: C# ----------
    if(!x) A = y;
    else A = z;
# ---------- end c_script_14 ----------
x = ClusterInput()
M_2 = ClusterInput()
crvprox = CurveProximity()  # -> PointA, PointB, Distance

smoothpline = SmoothPolyline(Polyline=crv_4, Strength=0.25, Times=1)  # disabled
disc_2 = Discontinuity(Curve=crv_4, Level=1)  # -> simplify(Points), Parameters; disabled
cluster_10 = Cluster_9(I=disc_2.Points)  # -> B, B_2; disabled
pline = PolyLine(Vertices=cluster_10.B, Closed=True)  # disabled
intcrv = Interpolate(Vertices=cluster_10.B, Degree=3, Periodic=True, KnotStyle=2)  # -> Curve, Length, Domain; disabled

disc_3 = Discontinuity(Curve=pline, Level=1)  # -> Points, Parameters
cullpt = CullDuplicates(Points=disc_3.Points, Tolerance=Slider(0.05, range=0..0.1), CullMode=3)  # -> Points, Indices, Valence
pline_2 = PolyLine(Vertices=cullpt.Points, Closed=True)  # disabled

fillet = FilletDistance(Curve=pline_2, Distance=hex_fillet_2)  # disabled

filter_8 = StreamFilter(Gate=hole_type, Stream0=intcrv.Curve, Stream1=fillet)  # disabled
merge_10 = Merge(Data1=simplify(filter_8), Data2=simplify(cluster_10.B_2))  # -> simplify(Result); disabled
area_7 = Area(Geometry=merge_10)  # -> Area, Centroid; disabled
smaller_3 = SmallerThan(FirstNumber=area_7.Area, SecondNumber=min_area_of_hole_2)  # -> SmallerThan, OrEqualTo; disabled
cull = CullPattern(List=merge_10, CullPattern=invert(smaller_3.SmallerThan))  # disabled
clean_3 = CleanTree(RemoveNulls=True, RemoveInvalid=True, RemoveEmpty=False, Tree=cull)  # disabled

merge_11 = Merge(Data1=simplify(clean_3), Data2=simplify(crv_2))  # -> simplify(Result)
clean_4 = CleanTree(RemoveNulls=True, RemoveInvalid=True, RemoveEmpty=True, Tree=merge_11)
alicrvseams = AlignCurveSeams(Curves=clean_4, Snap=False, Iterative=True)  # -> Aligned, Points, R
loft = Loft(
    Curves=alicrvseams.Aligned,
    Options={Adjust=False, Closed=False, LoftEnds=0, LoftSimp=0, LoftType=0, Rebuild=10, Refit=0.01})  # -> flatten(Loft); disabled
preview = CustomPreview(Geometry=loft, Material=ColourSwatch(SwatchColor=RGB(255, 0, 0)))
boundary_3 = BoundarySurfaces(Edges=clean_3)
preview_2 = CustomPreview(Geometry=boundary_3, Material=c_script_14.A)

area_8 = Area(Geometry=match)  # -> Area, Centroid
Z_3 = UnitZ(Factor=0.1)
move_2 = Move(Geometry=area_8.Centroid, Motion=expr("2*x", Z_3))  # -> Geometry, Transform
move_3 = Move(Geometry=area_8.Centroid, Motion=Z_3)  # -> Geometry, Transform
tag_2 = TextTag(Location=area_8.Centroid, Text=addition, Colour=RGB(157, 0, 255))
tag_3 = TextTag(Location=move_3.Geometry, Text=merge_4, Colour=RGB(22, 72, 222))

smoothpline_2 = SmoothPolyline(Polyline=crv_5, Strength=0.25, Times=1)
disc_4 = Discontinuity(Curve=crv_5, Level=1)  # -> simplify(Points), Parameters
cluster_11 = Cluster_9(I=disc_4.Points)  # -> B, B_2
pline_3 = PolyLine(Vertices=cluster_11.B, Closed=True)
intcrv_2 = Interpolate(Vertices=cluster_11.B, Degree=3, Periodic=True, KnotStyle=2)  # -> Curve, Length, Domain

disc_5 = Discontinuity(Curve=pline_3, Level=1)  # -> Points, Parameters
cullpt_2 = CullDuplicates(Points=disc_5.Points, Tolerance=Slider(0.05, range=0..0.1), CullMode=3)  # -> Points, Indices, Valence
pline_4 = PolyLine(Vertices=cullpt_2.Points, Closed=True)

fillet_2 = FilletDistance(Curve=pline_4, Distance=hex_fillet_2)

filter_9 = StreamFilter(Gate=hole_type, Stream0=intcrv_2.Curve, Stream1=fillet_2)
merge_12 = Merge(Data1=simplify(filter_9), Data2=simplify(cluster_11.B_2))  # -> simplify(Result)
area_9 = Area(Geometry=merge_12)  # -> Area, Centroid
smaller_4 = SmallerThan(FirstNumber=area_9.Area, SecondNumber=min_area_of_hole_2)  # -> SmallerThan, OrEqualTo
cull_2 = CullPattern(List=merge_12, CullPattern=invert(smaller_4.SmallerThan))
clean_5 = CleanTree(RemoveNulls=True, RemoveInvalid=True, RemoveEmpty=False, Tree=cull_2)

split_11 = SplitTree(Data=clean_5, Masks=flatten(M_2))  # -> Positive, Negative
c_script_15 = CSharpScript(X=split_11.Positive)  # -> Out, A
merge_13 = Merge(Data1=c_script_15.A, Data2=split_11.Negative)
clean_6 = CleanTree(RemoveNulls=True, RemoveInvalid=True, RemoveEmpty=False, Tree=merge_13)

c_script_16 = CSharpScript(x=clean_6, y=clean_5)  # -> out, A; inputs x: tree, y: tree
# ---------- c_script_16: C# ----------
    if(x.DataCount == 0) A = y;
    else A = x;
# ---------- end c_script_16 ----------

c_script_17 = CSharpScript(x=simplify(x))  # -> out, A; inputs x: String
# ---------- c_script_17: C# ----------
    if(x != null || x != "")
    {
      if(x.Contains("solid")) A = true;
      else A = false;
    }
    else A = false;
# ---------- end c_script_17 ----------
cull_3 = CullPattern(List=c_script_16.A, CullPattern=invert(graft(c_script_17.A)))  # -> simplify(List)

# ---- group: RH_OUT:Holes
crv_6 = Curve(cull_3)

# ----
split_12 = SplitTree(Data=crv_6, Masks=flatten("{6,7;*}"))  # -> Positive, Negative
area_10 = Area(Geometry=split_12.Positive)  # -> flatten(Area), Centroid
area_11 = Area(Geometry=split_12.Negative)  # -> flatten(Area), Centroid
ma_3 = MassAddition(Input=area_10.Area)  # -> Result, PartialResults
panel_4 = Panel(ma_3.Result)
subtraction_3 = Subtraction(A=office_acoustic_area_min, B=panel_4)
c_script_18 = CSharpScript(x=subtraction_3)  # -> out, A; inputs x: Double
# ---------- c_script_18: C# ----------
    if(x < 0) A = x * 2;
    else A = x;
# ---------- end c_script_18 ----------
abs = Absolute(Value=subtraction_3)
num_2 = Number(abs)
ma_4 = MassAddition(Input=area_11.Area)  # -> Result, PartialResults
panel_5 = Panel(ma_4.Result)
subtraction_4 = Subtraction(A=hall_acoustic_area_min, B=panel_5)
c_script_19 = CSharpScript(x=subtraction_4)  # -> out, A; inputs x: Double
# ---------- c_script_19: C# ----------
    if(x > 0) A = x * 2;
    else A = x;
# ---------- end c_script_19 ----------
abs_2 = Absolute(Value=c_script_19.A)
num_3 = Number(abs_2)
addition_3 = Addition(A=num_3, B=num_2)
num_4 = Number(addition_3)

swatch = ColourSwatch(SwatchColor=RGB(0, 255, 13))
previewlw_2 = CustomPreviewLineweights(Geometry=crv_6, Shader=swatch, Absolute=False)

tag_4 = TextTag(Location=move_2.Geometry, Text=merge_9, Colour=swatch)

pframe = PerpFrame(Curve=crv_6, Parameter=0.5)
L = ClusterOutput(cull_3)
crv_cp = CurveClosestPoint(Point=pframe, Curve=crv_3)  # -> Point, Parameter, Distance
ln = Line(StartPoint=crv_cp.Point, EndPoint=pframe)
polyboolean = PolylineBoolean(
    A=simplify(graft(match)),
    B=cull_3,
    BooleanType=2,
    Plane=simplify(Plane(origin=(0, 0, 0), x=(0, 0, 0), y=(0, 0, 0))),
    Tolerance=0.001,
    EvenOdd=True)  # -> simplify(Result); disabled
c_script_20 = CSharpScript(x=x, y=cull_3)  # -> out, simplify(A); inputs x: String
# ---------- c_script_20: C# ----------
    if(x.Contains("hollow"))
    {
      if(y == null)
      {
        if(!x.Contains("closed"))
        {
          if(!x.Contains("open"))
            A = x.Replace("hollow", "hollow_closed");
          else
            A = x.Replace("hollow_open", "hollow_closed");
        }
        else
          A = x;
      }
      else
      {

        if(!x.Contains("open"))
        {
          if(!x.Contains("closed"))
            A = x.Replace("hollow", "hollow_open");
          else
            A = x.Replace("hollow_closed", "hollow_open");
        }
        else
          A = x;
      }
    }
    else
    {
      A = x;
    }
# ---------- end c_script_20 ----------
boundary_4 = BoundarySurfaces(Edges=polyboolean)  # disabled
A = ClusterOutput(c_script_20.A)
linedim = LineDimension(Line=ln, Text="{0:0.00}", Size=0.3)
sort_val = SortDuplicateValues(ValueList=flatten(c_script_20.A))  # -> UniqueValues, Indices
R = ClusterOutput(polyboolean)  # disabled
panel_6 = Panel(cull_3)

# ==== cluster Cluster_20
num = ClusterInput()
crv = ClusterInput()
num_2 = ClusterInput()
num_3 = ClusterInput()
vec = ClusterInput()
num_4 = ClusterInput()
int = ClusterInput()
num_5 = ClusterInput()
crv_2 = ClusterInput()
geo = ClusterInput()
geo_2 = ClusterInput()

crv_3 = Curve(simplify(crv))
int_2 = Integer(int)
num_6 = Number(num_5)
crv_4 = Curve(crv_2)
geo_3 = Geometry(geo_2)

num_7 = Number(num)
num_8 = Number(num_2)
num_9 = Number(num_3)
vec_2 = Vector(vec)
num_10 = Number(num_4)

geo_4 = Geometry(geo)

division = Division(A=num_10, B=2)

move = Move(Geometry=crv_4, Motion=vec_2)  # -> Geometry, Transform
previewlw = CustomPreviewLineweights(
    Geometry=move.Geometry,
    Shader=ColourSwatch(SwatchColor=RGB(255, 255, 255)),
    Thickness=Slider(20, range=0..100),
    Absolute=False)

trim = TrimTree(Tree=crv_3, Depth=1)
path = ConstructPath(Indices=int_2)
split = SplitTree(Data=trim, Masks=flatten(path))  # -> Positive, Negative

poly_topo_edge = PolygonTopologyEdge(ListOfPolylines=split.Positive, Tolerance=0.001)  # -> ListOfEdges, LoopEdgeStructure, EdgeLoopStructure

midpt = CurveMiddle(Curve=poly_topo_edge.ListOfEdges)
midpt_2 = CurveMiddle(Curve=crv_4)
cp = ClosestPoint(Point=midpt_2, Cloud=midpt)  # -> ClosestPoint, CPIndex, Distance

Z = UnitZ(Factor=1)
generate_mitre_planes_between_segments = GenerateMitrePlanesBetweenSegments(Polyline=split.Positive, NakedEdgeGuideVector=Z)  # -> MitrePlanes, Neighbours, PolylinePlanes, BoundingRectangle
flip_data_edge_to_loop = FlipDataEdgeToLoop(
    LoopEdgeStructure=poly_topo_edge.LoopEdgeStructure,
    EdgeLoopStructure=poly_topo_edge.EdgeLoopStructure,
    ObjectsInLoopStructure=generate_mitre_planes_between_segments.MitrePlanes)  # -> EdgeLoopStructure, ObjectsInEdgeStructure

midpt_3 = CurveMiddle(Curve=poly_topo_edge.ListOfEdges)
panel = Panel(cp.CPIndex)
points = PointList(Points=midpt_3, Size=0.1)

sort = SortList(Keys=panel)  # -> Keys, ValuesA

path_2 = ConstructPath(Indices=graft(sort.Keys))
item = ListItem(List=poly_topo_edge.EdgeLoopStructure, Index=0, Wrap=True)
split_2 = SplitTree(Data=simplify(item), Masks=flatten(path_2))  # -> Positive, Negative
item_2 = ListItem(List=split.Positive, Index=split_2.Positive, Wrap=True)

lng = ListLength(List=panel)
larger = LargerThan(FirstNumber=lng, SecondNumber=1)  # -> LargerThan, OrEqualTo

neg = Negative(Value=division)
addition = Addition(A=neg, B=num_9)
merge = Merge(Data1=division, Data2=addition)
merge_2 = Merge(Data1=num_10, Data2=addition)

explode = Explode(Curve=split.Positive, Recursive=True)  # -> simplify(graft(Segments)), Vertices
tstat = TreeStatistics(Tree=explode.Segments)  # -> Paths, Length, Count
cluster = Cluster_16(B=tstat.Paths, I=int_2)

concat = Concatenate(FragmentA="{", FragmentB=int_2, FragmentC=";*}")
split_3 = SplitTree(Data=simplify(geo_4), Masks=flatten(concat))  # -> Positive, Negative

poly_topo_edge_filter = PolygonTopologyEdgeFilter(EdgeList=poly_topo_edge.ListOfEdges, EdgeLoopStructure=poly_topo_edge.EdgeLoopStructure, ValencyFilter=1)  # -> ListOfEdgeIDs, ListOfEdges
join = JoinCurves(Curves=poly_topo_edge_filter.ListOfEdges, Preserve=False)
len = Length(Curve=join)
sort_2 = SortList(Keys=len, ValuesA=join)  # -> Keys, reverse(ValuesA)
pt = Point(Point(0, 0, -10))
item_3 = ListItem(List=sort_2.ValuesA, Index=0, Wrap=True)
number_slider = Slider(0.1, range=0..1)
project = Project(Geometry=item_3, Plane=pt)  # -> Geometry, Transform
simplify = SimplifyCurve(Curve=project.Geometry)  # -> Curve, Simplified
offcrv = OffsetCurve(
    Curve=simplify.Curve,
    Plane=PlaneXY(0, 0, 0),
    Distance=number_slider,
    BothSides=expr("-x", number_slider),
    Kinks=0,
    CapType=1)

polyoffset = PolylineOffset(
    Polylines=simplify.Curve,
    Distance=Slider(0.1, range=0..1),
    Plane=pt,
    Tolerance=0.0001,
    ClosedFillet=1,
    OpenFillet=1,
    Miter=2)  # -> Contour, Holes
polyoffset_2 = PolylineOffset(
    Polylines=simplify.Curve,
    Distance=Slider(1, range=0..1),
    Plane=pt,
    Tolerance=0.0001,
    ClosedFillet=1,
    OpenFillet=1,
    Miter=2)  # -> Contour, Holes
rdiff = RegionDifference(CurvesA=polyoffset_2.Contour, CurvesB=polyoffset.Holes, Plane=pt)

boundary = BoundarySurfaces(Edges=rdiff)
offsrf = OffsetSurface(Surface=boundary, Distance=20, BothSides=-5, CreateSolid=True)

merge_3 = Merge(Data1=offsrf, Data2=geo_3)  # -> flatten(Result)

item_4 = ListItem(List=flatten(poly_topo_edge.ListOfEdges), Index=flatten(sort.Keys), Wrap=True)  # -> simplify(graft(Item))
explode_2 = Explode(Curve=item_2, Recursive=True)  # -> Segments, Vertices
midpt_4 = CurveMiddle(Curve=explode_2.Segments)
midpt_5 = CurveMiddle(Curve=item_4)
cp_2 = ClosestPoint(Point=midpt_5, Cloud=midpt_4)  # -> ClosestPoint, CPIndex, Distance
item_5 = ListItem(List=explode_2.Segments, Index=cp_2.CPIndex, Wrap=True)
trim_2 = TrimWithBreps(Curve=item_5, Brep=merge_3)  # -> Inside, Outside
ext = ExtendCurve(Curve=trim_2.Outside, Type=0, Start=expr("-x", num_6), End=expr("-x", num_6))  # -> simplify(Curve)
clean = CleanTree(RemoveNulls=True, RemoveInvalid=True, RemoveEmpty=True, Tree=ext)

len_2 = Length(Curve=clean)
mod = Modulus(A=len_2, B=num_7)
division_2 = Division(A=mod, B=2)
ext_2 = ExtendCurve(Curve=clean, Type=0, Start=expr("-x", division_2), End=expr("-x", division_2))
clean_2 = CleanTree(RemoveNulls=True, RemoveInvalid=True, RemoveEmpty=True, Tree=ext_2)
len_3 = Length(Curve=clean_2)
sort_3 = SortList(Keys=len_3, ValuesA=clean_2)  # -> Keys, reverse(ValuesA)
item_6 = ListItem(List=sort_3.ValuesA, Index=0, Wrap=True)

tstat_2 = TreeStatistics(Tree=item_6)  # -> Paths, Length, Count

dpath = DeconstructPath(Branch=tstat_2.Paths)  # -> flatten(Indices)
item_7 = ListItem(List=sort.Keys, Index=dpath, Wrap=True)

filter = StreamFilter(Gate=larger.LargerThan, Stream0=sort.Keys, Stream1=item_7)

path_3 = ConstructPath(Indices=graft(filter))  # -> flatten(Branch)
split_4 = SplitTree(Data=split_2.Positive, Masks=flatten(path_3))  # -> Positive, Negative

item_8 = ListItem(List=flip_data_edge_to_loop.ObjectsInEdgeStructure, Index=0, Wrap=True)
item_9 = ListItem(List=flatten(item_8), Index=filter, Wrap=True)  # -> graft(Item)
deplane = DeconstructPlane(Plane=item_9)  # -> Origin, XAxis, YAxis, ZAxis

graft = GraftTree(Tree=flatten(item_6), IncludeEmptyLists=True, IncludeNullItems=True)  # -> simplify(Tree)
cluster_2 = Cluster_19(data=simplify(item_5), G=larger.LargerThan, M=tstat_2.Paths)
cluster_3 = Cluster_19(data=cp_2.CPIndex, G=larger.LargerThan, M=tstat_2.Paths)
cluster_4 = Cluster_18(data=clean, G=larger.LargerThan, M=tstat_2.Paths)

divlength = DivideLength(Curve=graft, Length=num_7)  # -> Points, Tangents, Parameters
shatter = Shatter(Curve=graft, Parameters=divlength.Parameters)

division_3 = Division(A=num_8, B=2)
c_script = CSharpScript(z=shatter, x=deplane.ZAxis, y=division_3)  # -> out, A; inputs z: list, x: Vector3d, y: Double
# ---------- c_script: C# ----------
    List<Vector3d> output = new List<Vector3d>();

    Vector3d dir = x;
    dir.Unitize();

    for (int i = 0; i < z.Count; i++)
    {
      if(i % 2 == 0) output.Add(dir * y);
      else output.Add(dir * -1 * y);
    }

    A = output;
# ---------- end c_script ----------
move_2 = Move(Geometry=shatter, Motion=expr("-1.05*x", c_script.A))  # -> Geometry, Transform
move_3 = Move(Geometry=shatter, Motion=c_script.A)  # -> Geometry, Transform

merge_4 = Merge(Data1=simplify(graft(move_3.Geometry)), Data2=simplify(graft(move_2.Geometry)))
lng_2 = ListLength(List=move_3.Geometry)
dup = DuplicateData(Data=item_9, Number=lng_2, Order=True)
midpt_6 = CurveMiddle(Curve=merge_4)
pl_origin = PlaneOrigin(Base=graft(dup), Origin=midpt_6)  # -> simplify(Plane)

path_4 = ConstructPath(Indices=graft(filter))
split_5 = SplitTree(Data=simplify(poly_topo_edge.EdgeLoopStructure), Masks=flatten(path_4))  # -> simplify(Positive), Negative
item_10 = ListItem(List=generate_mitre_planes_between_segments.PolylinePlanes, Index=split_5.Positive, Wrap=True)  # -> simplify(Item)
group = Group(Objects=item_10)
dup_2 = DuplicateData(Data=group, Number=lng_2, Order=True)  # -> simplify(Data)
ungroup = Ungroup(Group=dup_2)
item_11 = ListItem(List=ungroup, Index=0, Wrap=True)  # -> Item, Item1

int_3 = Integer(split_5.Positive)

sort_val = SortDuplicateValues(ValueList=flatten(int_3))  # -> UniqueValues, Indices
path_5 = ConstructPath(Indices=graft(sort_val.UniqueValues))  # -> flatten(Branch)
split_6 = SplitTree(Data=simplify(poly_topo_edge.LoopEdgeStructure), Masks=flatten(path_5))  # -> Positive, Negative

tree = CreateTree(Data=flatten(cluster_2), Path=filter)

pframe = PerpFrame(Curve=reparameterize(graft(move_3.Geometry)), Parameter=[0, 1])  # -> simplify(Frame)
trim_3 = TrimTree(Tree=pframe, Depth=1)  # -> simplify(Tree)
end = EndPoints(Curve=cluster_2)  # -> Start, End
end_2 = EndPoints(Curve=cluster_4)  # -> Start, End

match = MatchTree(Tree=trim_3, Guide=end.Start)
filter_2 = StreamFilter(Gate=larger.LargerThan, Stream0=pframe, Stream1=match)

align = AlignPlane(Plane=filter_2, Direction=deplane.ZAxis)  # -> Plane, Angle
partition = PartitionList(List=align.Plane, Size=2)  # -> simplify(Chunks)

pline = PolyLine(Vertices=filter_2, Closed=False)
merge_5 = Merge(
    Data1=simplify(flatten(end.Start)),
    Data2=simplify(flatten(end_2.Start)),
    Data3=simplify(flatten(filter_2)),
    Data4=simplify(flatten(end_2.End)),
    Data5=simplify(flatten(end.End)))

merge_6 = Merge(
    Data1=simplify(end.Start),
    Data2=simplify(end_2.Start),
    Data3=simplify(filter_2),
    Data4=simplify(end_2.End),
    Data5=simplify(end.End))

weave = Weave(Pattern=[0, 1], Stream0=partition, Stream1=pl_origin, NullGaps=False)
filter_3 = StreamFilter(Gate=larger.LargerThan, Stream0=merge_5, Stream1=merge_6)

pl_offset = PlaneOffset(BasePlane=graft(ungroup), Offset=merge)
trim_4 = TrimTree(Tree=pl_offset, Depth=1)
cluster_5 = Cluster_17(A=simplify(weave), L=simplify(trim_4))  # -> simplify(B)

pl_offset_2 = PlaneOffset(BasePlane=item_11.Item1, Offset=merge_2)
cluster_6 = Cluster_15(A=weave, L=pl_offset_2)  # -> simplify(B)

pline_2 = PolyLine(Vertices=filter_3, Closed=False)
explode_3 = Explode(Curve=pline_2, Recursive=True)  # -> Segments, Vertices
vec_3 = Vector(explode_3.Segments)
midpt_7 = CurveMiddle(Curve=explode_3.Segments)
amp = Amplitude(Vector=deplane.YAxis, Amplitude=Slider(0.2, range=0..1))
pl = ConstructPlane(Origin=midpt_7, XAxis=vec_3, YAxis=deplane.YAxis)  # -> simplify(Plane)
move_4 = Move(Geometry=pline_2, Motion=expr("-x", amp))  # -> Geometry, Transform
move_5 = Move(Geometry=pline_2, Motion=amp)  # -> Geometry, Transform
group_2 = Group(Objects=pl)
merge_7 = Merge(Data1=move_5.Geometry, Data2=move_4.Geometry)

flatten = FlattenTree(Tree=cluster_5, Path="{0}")
flatten_2 = FlattenTree(Tree=cluster_6, Path="{0}")

match_2 = MatchTree(Tree=group_2, Guide=split_4.Positive)
match_3 = MatchTree(Tree=cluster_3, Guide=match_2)

loft = Loft(Curves=merge_7, Options={Adjust=False, Closed=False, LoftEnds=0, LoftSimp=0, LoftType=0, Rebuild=10, Refit=0.01})
match_4 = MatchTree(Tree=loft, Guide=match_2)

c_script_2 = CSharpScript(x=split_6.Positive, y=match_3, u=int_3)  # -> out, graft(A); inputs x: tree of Int32, y: tree, u: tree of Int32
# ---------- c_script_2: C# ----------
    List<int> edgePaths = y.Paths.Select(p => p[0]).ToList();
    DataTree<Object> output = new DataTree<Object>();
    for (int s = 0; s < x.BranchCount; s++)
    {
      int segmentIndex = x.Paths[s][0];
      if(x.Branch(s).Intersect(edgePaths).Any())
      {
        List<int> intersect = x.Branch(s).Intersect(edgePaths).ToList();
        if(intersect.Count > 0)
        {
          for (int j = 0; j < intersect.Count; j++)
          {
            GH_Path path = new GH_Path(segmentIndex);
            GH_Path edgePath = new GH_Path(intersect[j]);
            output.AddRange(y.Branch(edgePath), path);
          }
        }
      }
    }


    A = output;
# ---------- end c_script_2 ----------
c_script_3 = CSharpScript(x=split_6.Positive, y=match_4, u=int_3)  # -> out, graft(A); inputs x: tree of Int32, y: tree, u: tree of Int32; same code as c_script_2
c_script_4 = CSharpScript(x=split_6.Positive, y=match_2, u=int_3)  # -> out, A; inputs x: tree of Int32, y: tree, u: tree of Int32; same code as c_script_2

python = GhPythonScript(x=c_script_4.A)  # -> out, a
# ---------- python: Python ----------
__author__ = "Lasat"
__version__ = "2024.05.13"

import rhinoscriptsyntax as rs

a = x;
# ---------- end python ----------
move_6 = Move(Geometry=python.a, Motion=expr("x", vec_2))  # -> Geometry, Transform

move_7 = Move(Geometry=c_script_3.A, Motion=expr("x", vec_2))  # -> Geometry, Transform
data = Data(c_script_2.A)

tstat_3 = TreeStatistics(Tree=data)  # -> Paths, Length, Count
cluster_7 = Cluster_16(B=tstat_3.Paths, I=int_2)  # -> flatten(B_2)

group_3 = Group(Objects=weave)
trim_5 = TrimTree(Tree=simplify(group_3), Depth=1)

flatten_3 = FlattenTree(Tree=group_3, Path="{0}")
filter_4 = StreamFilter(Gate=larger.LargerThan, Stream0=flatten_3, Stream1=trim_5)

dispatch = Dispatch(List=filter_4, DispatchPattern=[True, False])  # -> ListA, ListB

match_5 = MatchTree(Tree=dispatch.ListA, Guide=tree)
match_6 = MatchTree(Tree=dispatch.ListB, Guide=tree)

c_script_5 = CSharpScript(x=split_6.Positive, y=match_5, z=match_6, u=int_3)  # -> out, A, B, C, D; inputs x: tree of Int32, y: tree, z: tree, u: tree of Int32
# ---------- c_script_5: C# ----------
    List<int> edgePaths = y.Paths.Select(p => p[0]).ToList();
    DataTree<Object> output = new DataTree<Object>();
    DataTree<int> outputEdges = new DataTree<int>();
    DataTree<int> neighbour = new DataTree<int>();
    DataTree<int> neighbour2 = new DataTree<int>();

    for (int s = 0; s < x.BranchCount; s++)
    {
      int segmentIndex = x.Paths[s][0];
      if(x.Branch(s).Intersect(edgePaths).Any())
      {
        List<int> intersect = x.Branch(s).Intersect(edgePaths).ToList();
        if(intersect.Count > 0)
        {
          for (int j = 0; j < intersect.Count; j++)
          {
            GH_Path path = new GH_Path(segmentIndex);
            GH_Path edgePath = new GH_Path(intersect[j]);
            Print(intersect[j].ToString());
            int index = u.Branch(edgePath).IndexOf(segmentIndex);
            if(index == 0)
            {
              output.AddRange(y.Branch(edgePath), path);
              neighbour.AddRange(y.Branch(edgePath).Select(f => u.Branch(edgePath)[1]).ToList(), path);
              neighbour2.Add(u.Branch(edgePath)[1], path);
              outputEdges.AddRange(y.Branch(edgePath).Select(f => intersect[j]).ToList(), path);

            }
            else
            {
              output.AddRange(z.Branch(edgePath), path);
              neighbour.AddRange(z.Branch(edgePath).Select(f => u.Branch(edgePath)[0]).ToList(), path);
              neighbour2.Add(u.Branch(edgePath)[0], path);
              outputEdges.AddRange(z.Branch(edgePath).Select(f => intersect[j]).ToList(), path);


            }
          }
        }
      }
    }


    A = output;
    B = outputEdges;
    C = neighbour;
    D = neighbour2;
# ---------- end c_script_5 ----------
item_12 = ListItem(List=generate_mitre_planes_between_segments.PolylinePlanes, Index=c_script_5.D, Wrap=True)  # -> graft(Item)

tstat_4 = TreeStatistics(Tree=c_script_5.A)  # -> Paths, Length, Count
split_7 = SplitTree(Data=simplify(graft(generate_mitre_planes_between_segments.PolylinePlanes)), Masks=flatten(tstat_4.Paths))  # -> Positive, Negative
lng_3 = ListLength(List=c_script_5.A)
group_4 = Group(Objects=split_7.Positive)
dup_3 = DuplicateData(Data=group_4, Number=lng_3, Order=True)  # -> simplify(Data)
ungroup_2 = Ungroup(Group=dup_3)
pl_offset_3 = PlaneOffset(BasePlane=ungroup_2, Offset=merge)

move_8 = Move(Geometry=item_12, Motion=expr("x", vec_2))  # -> Geometry, Transform
pl_offset_4 = PlaneOffset(BasePlane=move_8.Geometry, Offset=merge)
cso = CreateSpeckleObject(
    Planes=move_6.Geometry,
    EdgeIndex=data,
    GuideSurface=move_7.Geometry,
    Neighbour=graft(c_script_5.D),
    NeighbourPlane=move_8.Geometry,
    TopBottomPlanes=pl_offset_4,
    Offsets=merge,
    selectedKitName="Objects")

tree_2 = CreateTree(Data=flatten(cso), Path=cluster_7, Ensure=flatten(cluster))
trim_6 = TrimTree(Tree=tree_2, Depth=1)

trim_7 = TrimTree(Tree=simplify(cluster_5), Depth=1)

filter_5 = StreamFilter(Gate=larger.LargerThan, Stream0=flatten, Stream1=trim_7)

dispatch_2 = Dispatch(List=filter_5, DispatchPattern=[True, False])  # -> ListA, ListB

match_7 = MatchTree(Tree=dispatch_2.ListA, Guide=tree)
match_8 = MatchTree(Tree=dispatch_2.ListB, Guide=tree)

trim_8 = TrimTree(Tree=simplify(cluster_6), Depth=1)

filter_6 = StreamFilter(Gate=larger.LargerThan, Stream0=flatten_2, Stream1=trim_8)

dispatch_3 = Dispatch(List=simplify(filter_6), DispatchPattern=[True, False])  # -> ListA, ListB

match_9 = MatchTree(Tree=dispatch_3.ListA, Guide=tree)
match_10 = MatchTree(Tree=dispatch_3.ListB, Guide=tree)

c_script_6 = CSharpScript(x=split_6.Positive, y=match_10, z=match_9, u=int_3)  # -> out, A; inputs x: tree of Int32, y: tree of Brep, z: tree of Brep, u: tree of Int32
# ---------- c_script_6: C# ----------
    List<int> edgePaths = y.Paths.Select(p => p[0]).ToList();
    DataTree<Brep> output = new DataTree<Brep>();
    for (int s = 0; s < x.BranchCount; s++)
    {
      int segmentIndex = x.Paths[s][0];
      if(x.Branch(s).Intersect(edgePaths).Any())
      {
        List<int> intersect = x.Branch(s).Intersect(edgePaths).ToList();
        if(intersect.Count > 0)
        {
          for (int j = 0; j < intersect.Count; j++)
          {
            GH_Path path = new GH_Path(segmentIndex);
            GH_Path edgePath = new GH_Path(intersect[j]);
            Print(intersect[j].ToString());
            int index = u.Branch(edgePath).IndexOf(segmentIndex);
            if(index == 0)
              output.AddRange(y.Branch(edgePath), path);
            else
              output.AddRange(z.Branch(edgePath), path);
          }
        }
      }
    }


    A = output;
# ---------- end c_script_6 ----------

trim_9 = TrimTree(Tree=geo_4, Depth=1)
split_8 = SplitTree(Data=simplify(trim_9), Masks=flatten(path))  # -> Positive, Negative
move_9 = Move(Geometry=split_8.Positive, Motion=expr("-x", vec_2))  # -> Geometry, Transform
tstat_5 = TreeStatistics(Tree=c_script_6.A)  # -> Paths, Length, Count
split_9 = SplitTree(Data=simplify(graft(move_9.Geometry)), Masks=flatten(tstat_5.Paths))  # -> Positive, Negative

python_2 = GhPythonScript(x=c_script_5.A)  # -> out, a; same code as python
cluster_8 = Cluster_15(A=python_2.a, L=pl_offset_3)  # -> simplify(B)
sdiff = SolidDifference(BrepsA=split_9.Positive, BrepsB=c_script_6.A)

item_13 = ListItem(List=generate_mitre_planes_between_segments.PolylinePlanes, Index=c_script_5.C, Wrap=True)
pl_offset_5 = PlaneOffset(BasePlane=item_13, Offset=division)
planesrf = PlaneSurface(Plane=pl_offset_5, XSize=Domain(-10, 10), YSize=Domain(-10, 10))
offsrf_2 = OffsetSurface(Surface=planesrf, Distance=1, BothSides=0, CreateSolid=True)
sdiff_2 = SolidDifference(BrepsA=cluster_8, BrepsB=offsrf_2)

trim_10 = TrimTree(Tree=sdiff_2, Depth=1)
merge_8 = Merge(Data1=trim_10, Data2=sdiff)
sunion = SolidUnion(Breps=merge_8)

fmerge = MergeFaces(Brep=sunion)  # -> Breps, Before, After
merge_9 = Merge(Data1=fmerge.Breps, Data2=split_9.Negative)  # -> flatten(Result)

tstat_6 = TreeStatistics(Tree=fmerge.Breps)  # -> Paths, Length, Count
dpath_2 = DeconstructPath(Branch=tstat_6.Paths)  # -> flatten(Indices)

c_script_7 = CSharpScript(x=merge_9, y=dpath_2)  # -> out, A; inputs x: list of Int32, y: list of Int32
# ---------- c_script_7: C# ----------
    
    if(x.Count == 0 && y.Count == 0)

      A = "0,0,230";
    else
    {   
      List < string > output = new List<string>();
    for (int i = 0; i < x.Count; i++)
    {
      if(y.Contains(i))output.Add("230,0,0");
      else output.Add("0,0,230");
    }
    A = output;
  }
# ---------- end c_script_7 ----------
concat_2 = Concatenate(FragmentA=c_script_7.A, FragmentC=",", FragmentB=Slider(95, range=0..255))

move_10 = Move(Geometry=merge_9, Motion=expr("x", vec_2))  # -> simplify(Geometry), Transform
listdexs = ListIndices(List=move_10.Geometry)
concat_3 = Concatenate(FragmentA="{", FragmentB=int_2, FragmentE=";", FragmentC=listdexs, FragmentD="}")
tree_3 = CreateTree(Data=move_10.Geometry, Path=concat_3)

tree_4 = CreateTree(Data=concat_2, Path=concat_3)

lng_4 = ListLength(List=flatten(tree_3))
equals = Equality(FirstNumber=lng_4, SecondNumber=1)  # -> Equality, Inequality

filter_7 = StreamFilter(Gate=equals.Equality, Stream0=tree_3, Stream1=split_3.Positive)

preview = CustomPreview(Geometry=filter_7, Material=tree_4)

s_0 = ClusterOutput(filter_7)
T = ClusterOutput(trim_6)
D = ClusterOutput(tree_4)

# ==== cluster Cluster_23
num = ClusterInput()
crv = ClusterInput()
num_2 = ClusterInput()
num_3 = ClusterInput()
vec = ClusterInput()
num_4 = ClusterInput()
int = ClusterInput()
num_5 = ClusterInput()
crv_2 = ClusterInput()
geo = ClusterInput()
geo_2 = ClusterInput()

crv_3 = Curve(simplify(crv))
int_2 = Integer(int)
num_6 = Number(num_5)
crv_4 = Curve(crv_2)
geo_3 = Geometry(geo_2)

num_7 = Number(num)
num_8 = Number(num_2)
num_9 = Number(num_3)
vec_2 = Vector(vec)
num_10 = Number(num_4)

geo_4 = Geometry(geo)

division = Division(A=num_10, B=2)

move = Move(Geometry=crv_4, Motion=vec_2)  # -> Geometry, Transform
previewlw = CustomPreviewLineweights(
    Geometry=move.Geometry,
    Shader=ColourSwatch(SwatchColor=RGB(255, 255, 255)),
    Thickness=Slider(20, range=0..100),
    Absolute=False)

trim = TrimTree(Tree=crv_3, Depth=1)
path = ConstructPath(Indices=int_2)
split = SplitTree(Data=trim, Masks=flatten(path))  # -> Positive, Negative

poly_topo_edge = PolygonTopologyEdge(ListOfPolylines=split.Positive, Tolerance=0.001)  # -> ListOfEdges, LoopEdgeStructure, EdgeLoopStructure

midpt = CurveMiddle(Curve=poly_topo_edge.ListOfEdges)
midpt_2 = CurveMiddle(Curve=crv_4)
cp = ClosestPoint(Point=midpt_2, Cloud=midpt)  # -> ClosestPoint, CPIndex, Distance

Z = UnitZ(Factor=1)
generate_mitre_planes_between_segments = GenerateMitrePlanesBetweenSegments(Polyline=split.Positive, NakedEdgeGuideVector=Z)  # -> MitrePlanes, Neighbours, PolylinePlanes, BoundingRectangle
flip_data_edge_to_loop = FlipDataEdgeToLoop(
    LoopEdgeStructure=poly_topo_edge.LoopEdgeStructure,
    EdgeLoopStructure=poly_topo_edge.EdgeLoopStructure,
    ObjectsInLoopStructure=generate_mitre_planes_between_segments.MitrePlanes)  # -> EdgeLoopStructure, ObjectsInEdgeStructure

midpt_3 = CurveMiddle(Curve=poly_topo_edge.ListOfEdges)
panel = Panel(cp.CPIndex)
points = PointList(Points=midpt_3, Size=0.1)

sort = SortList(Keys=panel)  # -> Keys, ValuesA

path_2 = ConstructPath(Indices=graft(sort.Keys))
item = ListItem(List=poly_topo_edge.EdgeLoopStructure, Index=0, Wrap=True)
split_2 = SplitTree(Data=simplify(item), Masks=flatten(path_2))  # -> Positive, Negative
item_2 = ListItem(List=split.Positive, Index=split_2.Positive, Wrap=True)

lng = ListLength(List=panel)
larger = LargerThan(FirstNumber=lng, SecondNumber=1)  # -> LargerThan, OrEqualTo

neg = Negative(Value=division)
addition = Addition(A=neg, B=num_9)
merge = Merge(Data1=division, Data2=addition)
merge_2 = Merge(Data1=num_10, Data2=addition)

explode = Explode(Curve=split.Positive, Recursive=True)  # -> simplify(graft(Segments)), Vertices
tstat = TreeStatistics(Tree=explode.Segments)  # -> Paths, Length, Count
cluster = Cluster_16(B=tstat.Paths, I=int_2)

concat = Concatenate(FragmentA="{", FragmentB=int_2, FragmentC=";*}")
split_3 = SplitTree(Data=simplify(geo_4), Masks=flatten(concat))  # -> Positive, Negative

poly_topo_edge_filter = PolygonTopologyEdgeFilter(EdgeList=poly_topo_edge.ListOfEdges, EdgeLoopStructure=poly_topo_edge.EdgeLoopStructure, ValencyFilter=1)  # -> ListOfEdgeIDs, ListOfEdges
join = JoinCurves(Curves=poly_topo_edge_filter.ListOfEdges, Preserve=False)
len = Length(Curve=join)
sort_2 = SortList(Keys=len, ValuesA=join)  # -> Keys, reverse(ValuesA)
pt = Point(Point(0, 0, -10))
item_3 = ListItem(List=sort_2.ValuesA, Index=0, Wrap=True)
number_slider = Slider(0.1, range=0..1)
project = Project(Geometry=item_3, Plane=pt)  # -> Geometry, Transform
simplify = SimplifyCurve(Curve=project.Geometry)  # -> Curve, Simplified
offcrv = OffsetCurve(
    Curve=simplify.Curve,
    Plane=PlaneXY(0, 0, 0),
    Distance=number_slider,
    BothSides=expr("-x", number_slider),
    Kinks=0,
    CapType=1)

polyoffset = PolylineOffset(
    Polylines=simplify.Curve,
    Distance=Slider(0.1, range=0..1),
    Plane=pt,
    Tolerance=0.0001,
    ClosedFillet=1,
    OpenFillet=1,
    Miter=2)  # -> Contour, Holes
polyoffset_2 = PolylineOffset(
    Polylines=simplify.Curve,
    Distance=Slider(1, range=0..1),
    Plane=pt,
    Tolerance=0.0001,
    ClosedFillet=1,
    OpenFillet=1,
    Miter=2)  # -> Contour, Holes
rdiff = RegionDifference(CurvesA=polyoffset_2.Contour, CurvesB=polyoffset.Holes, Plane=pt)

boundary = BoundarySurfaces(Edges=rdiff)
offsrf = OffsetSurface(Surface=boundary, Distance=20, BothSides=-5, CreateSolid=True)

merge_3 = Merge(Data1=offsrf, Data2=geo_3)  # -> flatten(Result)

item_4 = ListItem(List=flatten(poly_topo_edge.ListOfEdges), Index=flatten(sort.Keys), Wrap=True)  # -> simplify(graft(Item))
explode_2 = Explode(Curve=item_2, Recursive=True)  # -> Segments, Vertices
midpt_4 = CurveMiddle(Curve=explode_2.Segments)
midpt_5 = CurveMiddle(Curve=item_4)
cp_2 = ClosestPoint(Point=midpt_5, Cloud=midpt_4)  # -> ClosestPoint, CPIndex, Distance
item_5 = ListItem(List=explode_2.Segments, Index=cp_2.CPIndex, Wrap=True)
trim_2 = TrimWithBreps(Curve=item_5, Brep=merge_3)  # -> Inside, Outside
ext = ExtendCurve(Curve=trim_2.Outside, Type=0, Start=expr("-x", num_6), End=expr("-x", num_6))  # -> simplify(Curve)
clean = CleanTree(RemoveNulls=True, RemoveInvalid=True, RemoveEmpty=True, Tree=ext)

len_2 = Length(Curve=clean)
mod = Modulus(A=len_2, B=num_7)
division_2 = Division(A=mod, B=2)
ext_2 = ExtendCurve(Curve=clean, Type=0, Start=expr("-x", division_2), End=expr("-x", division_2))
clean_2 = CleanTree(RemoveNulls=True, RemoveInvalid=True, RemoveEmpty=True, Tree=ext_2)
len_3 = Length(Curve=clean_2)
sort_3 = SortList(Keys=len_3, ValuesA=clean_2)  # -> Keys, reverse(ValuesA)
item_6 = ListItem(List=sort_3.ValuesA, Index=0, Wrap=True)

tstat_2 = TreeStatistics(Tree=item_6)  # -> Paths, Length, Count

dpath = DeconstructPath(Branch=tstat_2.Paths)  # -> flatten(Indices)
item_7 = ListItem(List=sort.Keys, Index=dpath, Wrap=True)

filter = StreamFilter(Gate=larger.LargerThan, Stream0=sort.Keys, Stream1=item_7)

path_3 = ConstructPath(Indices=graft(filter))  # -> flatten(Branch)
split_4 = SplitTree(Data=split_2.Positive, Masks=flatten(path_3))  # -> Positive, Negative

item_8 = ListItem(List=flip_data_edge_to_loop.ObjectsInEdgeStructure, Index=0, Wrap=True)
item_9 = ListItem(List=flatten(item_8), Index=filter, Wrap=True)  # -> graft(Item)
deplane = DeconstructPlane(Plane=item_9)  # -> Origin, XAxis, YAxis, ZAxis

graft = GraftTree(Tree=flatten(item_6), IncludeEmptyLists=True, IncludeNullItems=True)  # -> simplify(Tree)
cluster_2 = Cluster_22(data=simplify(item_5), G=larger.LargerThan, M=tstat_2.Paths)
cluster_3 = Cluster_22(data=cp_2.CPIndex, G=larger.LargerThan, M=tstat_2.Paths)
cluster_4 = Cluster_21(data=clean, G=larger.LargerThan, M=tstat_2.Paths)

divlength = DivideLength(Curve=graft, Length=num_7)  # -> Points, Tangents, Parameters
shatter = Shatter(Curve=graft, Parameters=divlength.Parameters)

division_3 = Division(A=num_8, B=2)
c_script = CSharpScript(z=shatter, x=deplane.ZAxis, y=division_3)  # -> out, A; inputs z: list, x: Vector3d, y: Double; same code as c_script
move_2 = Move(Geometry=shatter, Motion=expr("-1.05*x", c_script.A))  # -> Geometry, Transform
move_3 = Move(Geometry=shatter, Motion=c_script.A)  # -> Geometry, Transform

merge_4 = Merge(Data1=simplify(graft(move_3.Geometry)), Data2=simplify(graft(move_2.Geometry)))
lng_2 = ListLength(List=move_3.Geometry)
dup = DuplicateData(Data=item_9, Number=lng_2, Order=True)
midpt_6 = CurveMiddle(Curve=merge_4)
pl_origin = PlaneOrigin(Base=graft(dup), Origin=midpt_6)  # -> simplify(Plane)

path_4 = ConstructPath(Indices=graft(filter))
split_5 = SplitTree(Data=simplify(poly_topo_edge.EdgeLoopStructure), Masks=flatten(path_4))  # -> simplify(Positive), Negative
item_10 = ListItem(List=generate_mitre_planes_between_segments.PolylinePlanes, Index=split_5.Positive, Wrap=True)  # -> simplify(Item)
group = Group(Objects=item_10)
dup_2 = DuplicateData(Data=group, Number=lng_2, Order=True)  # -> simplify(Data)
ungroup = Ungroup(Group=dup_2)
item_11 = ListItem(List=ungroup, Index=0, Wrap=True)  # -> Item, Item1

int_3 = Integer(split_5.Positive)

sort_val = SortDuplicateValues(ValueList=flatten(int_3))  # -> UniqueValues, Indices
path_5 = ConstructPath(Indices=graft(sort_val.UniqueValues))  # -> flatten(Branch)
split_6 = SplitTree(Data=simplify(poly_topo_edge.LoopEdgeStructure), Masks=flatten(path_5))  # -> Positive, Negative

tree = CreateTree(Data=flatten(cluster_2), Path=filter)

pframe = PerpFrame(Curve=reparameterize(graft(move_3.Geometry)), Parameter=[0, 1])  # -> simplify(Frame)
trim_3 = TrimTree(Tree=pframe, Depth=1)  # -> simplify(Tree)
end = EndPoints(Curve=cluster_2)  # -> Start, End
end_2 = EndPoints(Curve=cluster_4)  # -> Start, End

match = MatchTree(Tree=trim_3, Guide=end.Start)
filter_2 = StreamFilter(Gate=larger.LargerThan, Stream0=pframe, Stream1=match)

align = AlignPlane(Plane=filter_2, Direction=deplane.ZAxis)  # -> Plane, Angle
partition = PartitionList(List=align.Plane, Size=2)  # -> simplify(Chunks)

pline = PolyLine(Vertices=filter_2, Closed=False)
merge_5 = Merge(
    Data1=simplify(flatten(end.Start)),
    Data2=simplify(flatten(end_2.Start)),
    Data3=simplify(flatten(filter_2)),
    Data4=simplify(flatten(end_2.End)),
    Data5=simplify(flatten(end.End)))

merge_6 = Merge(
    Data1=simplify(end.Start),
    Data2=simplify(end_2.Start),
    Data3=simplify(filter_2),
    Data4=simplify(end_2.End),
    Data5=simplify(end.End))

weave = Weave(Pattern=[0, 1], Stream0=partition, Stream1=pl_origin, NullGaps=False)
filter_3 = StreamFilter(Gate=larger.LargerThan, Stream0=merge_5, Stream1=merge_6)

pl_offset = PlaneOffset(BasePlane=graft(ungroup), Offset=merge)
trim_4 = TrimTree(Tree=pl_offset, Depth=1)
cluster_5 = Cluster_17(A=simplify(weave), L=simplify(trim_4))  # -> simplify(B)

pl_offset_2 = PlaneOffset(BasePlane=item_11.Item1, Offset=merge_2)
cluster_6 = Cluster_15(A=weave, L=pl_offset_2)  # -> simplify(B)

pline_2 = PolyLine(Vertices=filter_3, Closed=False)
explode_3 = Explode(Curve=pline_2, Recursive=True)  # -> Segments, Vertices
vec_3 = Vector(explode_3.Segments)
midpt_7 = CurveMiddle(Curve=explode_3.Segments)
amp = Amplitude(Vector=deplane.YAxis, Amplitude=Slider(0.2, range=0..1))
pl = ConstructPlane(Origin=midpt_7, XAxis=vec_3, YAxis=deplane.YAxis)  # -> simplify(Plane)
move_4 = Move(Geometry=pline_2, Motion=expr("-x", amp))  # -> Geometry, Transform
move_5 = Move(Geometry=pline_2, Motion=amp)  # -> Geometry, Transform
group_2 = Group(Objects=pl)
merge_7 = Merge(Data1=move_5.Geometry, Data2=move_4.Geometry)

flatten = FlattenTree(Tree=cluster_5, Path="{0}")
flatten_2 = FlattenTree(Tree=cluster_6, Path="{0}")

match_2 = MatchTree(Tree=group_2, Guide=split_4.Positive)
match_3 = MatchTree(Tree=cluster_3, Guide=match_2)

loft = Loft(Curves=merge_7, Options={Adjust=False, Closed=False, LoftEnds=0, LoftSimp=0, LoftType=0, Rebuild=10, Refit=0.01})
match_4 = MatchTree(Tree=loft, Guide=match_2)

c_script_2 = CSharpScript(x=split_6.Positive, y=match_3, u=int_3)  # -> out, graft(A); inputs x: tree of Int32, y: tree, u: tree of Int32; same code as c_script_2
c_script_3 = CSharpScript(x=split_6.Positive, y=match_4, u=int_3)  # -> out, graft(A); inputs x: tree of Int32, y: tree, u: tree of Int32; same code as c_script_2
c_script_4 = CSharpScript(x=split_6.Positive, y=match_2, u=int_3)  # -> out, A; inputs x: tree of Int32, y: tree, u: tree of Int32; same code as c_script_2

python = GhPythonScript(x=c_script_4.A)  # -> out, a; same code as python
move_6 = Move(Geometry=python.a, Motion=expr("x", vec_2))  # -> Geometry, Transform

move_7 = Move(Geometry=c_script_3.A, Motion=expr("x", vec_2))  # -> Geometry, Transform
data = Data(c_script_2.A)

tstat_3 = TreeStatistics(Tree=data)  # -> Paths, Length, Count
cluster_7 = Cluster_16(B=tstat_3.Paths, I=int_2)  # -> flatten(B_2)

group_3 = Group(Objects=weave)
trim_5 = TrimTree(Tree=simplify(group_3), Depth=1)

flatten_3 = FlattenTree(Tree=group_3, Path="{0}")
filter_4 = StreamFilter(Gate=larger.LargerThan, Stream0=flatten_3, Stream1=trim_5)

dispatch = Dispatch(List=filter_4, DispatchPattern=[True, False])  # -> ListA, ListB

match_5 = MatchTree(Tree=dispatch.ListA, Guide=tree)
match_6 = MatchTree(Tree=dispatch.ListB, Guide=tree)

c_script_5 = CSharpScript(x=split_6.Positive, y=match_5, z=match_6, u=int_3)  # -> out, A, B, C, D; inputs x: tree of Int32, y: tree, z: tree, u: tree of Int32; same code as c_script_5
item_12 = ListItem(List=generate_mitre_planes_between_segments.PolylinePlanes, Index=c_script_5.D, Wrap=True)  # -> graft(Item)

tstat_4 = TreeStatistics(Tree=c_script_5.A)  # -> Paths, Length, Count
split_7 = SplitTree(Data=simplify(graft(generate_mitre_planes_between_segments.PolylinePlanes)), Masks=flatten(tstat_4.Paths))  # -> Positive, Negative
lng_3 = ListLength(List=c_script_5.A)
group_4 = Group(Objects=split_7.Positive)
dup_3 = DuplicateData(Data=group_4, Number=lng_3, Order=True)  # -> simplify(Data)
ungroup_2 = Ungroup(Group=dup_3)
pl_offset_3 = PlaneOffset(BasePlane=ungroup_2, Offset=merge)

move_8 = Move(Geometry=item_12, Motion=expr("x", vec_2))  # -> Geometry, Transform
pl_offset_4 = PlaneOffset(BasePlane=move_8.Geometry, Offset=merge)
cso = CreateSpeckleObject(
    Planes=move_6.Geometry,
    EdgeIndex=data,
    GuideSurface=move_7.Geometry,
    Neighbour=graft(c_script_5.D),
    NeighbourPlane=move_8.Geometry,
    TopBottomPlanes=pl_offset_4,
    Offsets=merge,
    selectedKitName="Objects")

tree_2 = CreateTree(Data=flatten(cso), Path=cluster_7, Ensure=flatten(cluster))
trim_6 = TrimTree(Tree=tree_2, Depth=1)

trim_7 = TrimTree(Tree=simplify(cluster_5), Depth=1)

filter_5 = StreamFilter(Gate=larger.LargerThan, Stream0=flatten, Stream1=trim_7)

dispatch_2 = Dispatch(List=filter_5, DispatchPattern=[True, False])  # -> ListA, ListB

match_7 = MatchTree(Tree=dispatch_2.ListA, Guide=tree)
match_8 = MatchTree(Tree=dispatch_2.ListB, Guide=tree)

trim_8 = TrimTree(Tree=simplify(cluster_6), Depth=1)

filter_6 = StreamFilter(Gate=larger.LargerThan, Stream0=flatten_2, Stream1=trim_8)

dispatch_3 = Dispatch(List=simplify(filter_6), DispatchPattern=[True, False])  # -> ListA, ListB

match_9 = MatchTree(Tree=dispatch_3.ListA, Guide=tree)
match_10 = MatchTree(Tree=dispatch_3.ListB, Guide=tree)

c_script_6 = CSharpScript(x=split_6.Positive, y=match_10, z=match_9, u=int_3)  # -> out, A; inputs x: tree of Int32, y: tree of Brep, z: tree of Brep, u: tree of Int32; same code as c_script_6

trim_9 = TrimTree(Tree=geo_4, Depth=1)
split_8 = SplitTree(Data=simplify(trim_9), Masks=flatten(path))  # -> Positive, Negative
move_9 = Move(Geometry=split_8.Positive, Motion=expr("-x", vec_2))  # -> Geometry, Transform
tstat_5 = TreeStatistics(Tree=c_script_6.A)  # -> Paths, Length, Count
split_9 = SplitTree(Data=simplify(graft(move_9.Geometry)), Masks=flatten(tstat_5.Paths))  # -> Positive, Negative

python_2 = GhPythonScript(x=c_script_5.A)  # -> out, a; same code as python
cluster_8 = Cluster_15(A=python_2.a, L=pl_offset_3)  # -> simplify(B)
sdiff = SolidDifference(BrepsA=split_9.Positive, BrepsB=c_script_6.A)

item_13 = ListItem(List=generate_mitre_planes_between_segments.PolylinePlanes, Index=c_script_5.C, Wrap=True)
pl_offset_5 = PlaneOffset(BasePlane=item_13, Offset=division)
planesrf = PlaneSurface(Plane=pl_offset_5, XSize=Domain(-10, 10), YSize=Domain(-10, 10))
offsrf_2 = OffsetSurface(Surface=planesrf, Distance=1, BothSides=0, CreateSolid=True)
sdiff_2 = SolidDifference(BrepsA=cluster_8, BrepsB=offsrf_2)

trim_10 = TrimTree(Tree=sdiff_2, Depth=1)
merge_8 = Merge(Data1=trim_10, Data2=sdiff)
sunion = SolidUnion(Breps=merge_8)

fmerge = MergeFaces(Brep=sunion)  # -> Breps, Before, After
merge_9 = Merge(Data1=fmerge.Breps, Data2=split_9.Negative)  # -> flatten(Result)

tstat_6 = TreeStatistics(Tree=fmerge.Breps)  # -> Paths, Length, Count
dpath_2 = DeconstructPath(Branch=tstat_6.Paths)  # -> flatten(Indices)

c_script_7 = CSharpScript(x=merge_9, y=dpath_2)  # -> out, A; inputs x: list of Int32, y: list of Int32; same code as c_script_7
concat_2 = Concatenate(FragmentA=c_script_7.A, FragmentC=",", FragmentB=Slider(95, range=0..255))

move_10 = Move(Geometry=merge_9, Motion=expr("x", vec_2))  # -> simplify(Geometry), Transform
listdexs = ListIndices(List=move_10.Geometry)
concat_3 = Concatenate(FragmentA="{", FragmentB=int_2, FragmentE=";", FragmentC=listdexs, FragmentD="}")
tree_3 = CreateTree(Data=move_10.Geometry, Path=concat_3)

tree_4 = CreateTree(Data=concat_2, Path=concat_3)

lng_4 = ListLength(List=flatten(tree_3))
equals = Equality(FirstNumber=lng_4, SecondNumber=1)  # -> Equality, Inequality

filter_7 = StreamFilter(Gate=equals.Equality, Stream0=tree_3, Stream1=split_3.Positive)

preview = CustomPreview(Geometry=filter_7, Material=tree_4)

s_0 = ClusterOutput(filter_7)
T = ClusterOutput(trim_6)
D = ClusterOutput(tree_4)

# ==== cluster Cluster_24
num = ClusterInput()
crv = ClusterInput()
num_2 = ClusterInput()
num_3 = ClusterInput()
vec = ClusterInput()
num_4 = ClusterInput()
int = ClusterInput()
num_5 = ClusterInput()
crv_2 = ClusterInput()
geo = ClusterInput()
geo_2 = ClusterInput()

crv_3 = Curve(simplify(crv))
int_2 = Integer(int)
num_6 = Number(num_5)
crv_4 = Curve(crv_2)
geo_3 = Geometry(geo_2)

num_7 = Number(num)
num_8 = Number(num_2)
num_9 = Number(num_3)
vec_2 = Vector(vec)
num_10 = Number(num_4)

geo_4 = Geometry(geo)

division = Division(A=num_10, B=2)

move = Move(Geometry=crv_4, Motion=vec_2)  # -> Geometry, Transform
previewlw = CustomPreviewLineweights(
    Geometry=move.Geometry,
    Shader=ColourSwatch(SwatchColor=RGB(255, 255, 255)),
    Thickness=Slider(20, range=0..100),
    Absolute=False)

trim = TrimTree(Tree=crv_3, Depth=1)
path = ConstructPath(Indices=int_2)
split = SplitTree(Data=trim, Masks=flatten(path))  # -> Positive, Negative

poly_topo_edge = PolygonTopologyEdge(ListOfPolylines=split.Positive, Tolerance=0.001)  # -> ListOfEdges, LoopEdgeStructure, EdgeLoopStructure

midpt = CurveMiddle(Curve=poly_topo_edge.ListOfEdges)
midpt_2 = CurveMiddle(Curve=crv_4)
cp = ClosestPoint(Point=midpt_2, Cloud=midpt)  # -> ClosestPoint, CPIndex, Distance

Z = UnitZ(Factor=1)
generate_mitre_planes_between_segments = GenerateMitrePlanesBetweenSegments(Polyline=split.Positive, NakedEdgeGuideVector=Z)  # -> MitrePlanes, Neighbours, PolylinePlanes, BoundingRectangle
flip_data_edge_to_loop = FlipDataEdgeToLoop(
    LoopEdgeStructure=poly_topo_edge.LoopEdgeStructure,
    EdgeLoopStructure=poly_topo_edge.EdgeLoopStructure,
    ObjectsInLoopStructure=generate_mitre_planes_between_segments.MitrePlanes)  # -> EdgeLoopStructure, ObjectsInEdgeStructure

midpt_3 = CurveMiddle(Curve=poly_topo_edge.ListOfEdges)
panel = Panel(cp.CPIndex)
points = PointList(Points=midpt_3, Size=0.1)

sort = SortList(Keys=panel)  # -> Keys, ValuesA

path_2 = ConstructPath(Indices=graft(sort.Keys))
item = ListItem(List=poly_topo_edge.EdgeLoopStructure, Index=0, Wrap=True)
split_2 = SplitTree(Data=simplify(item), Masks=flatten(path_2))  # -> Positive, Negative
item_2 = ListItem(List=split.Positive, Index=split_2.Positive, Wrap=True)

lng = ListLength(List=panel)
larger = LargerThan(FirstNumber=lng, SecondNumber=1)  # -> LargerThan, OrEqualTo

neg = Negative(Value=division)
addition = Addition(A=neg, B=num_9)
merge = Merge(Data1=division, Data2=addition)
merge_2 = Merge(Data1=num_10, Data2=addition)

explode = Explode(Curve=split.Positive, Recursive=True)  # -> simplify(graft(Segments)), Vertices
tstat = TreeStatistics(Tree=explode.Segments)  # -> Paths, Length, Count
cluster = Cluster_16(B=tstat.Paths, I=int_2)

concat = Concatenate(FragmentA="{", FragmentB=int_2, FragmentC=";*}")
split_3 = SplitTree(Data=simplify(geo_4), Masks=flatten(concat))  # -> Positive, Negative

poly_topo_edge_filter = PolygonTopologyEdgeFilter(EdgeList=poly_topo_edge.ListOfEdges, EdgeLoopStructure=poly_topo_edge.EdgeLoopStructure, ValencyFilter=1)  # -> ListOfEdgeIDs, ListOfEdges
join = JoinCurves(Curves=poly_topo_edge_filter.ListOfEdges, Preserve=False)
len = Length(Curve=join)
sort_2 = SortList(Keys=len, ValuesA=join)  # -> Keys, reverse(ValuesA)
pt = Point(Point(0, 0, -10))
item_3 = ListItem(List=sort_2.ValuesA, Index=0, Wrap=True)
number_slider = Slider(0.1, range=0..1)
project = Project(Geometry=item_3, Plane=pt)  # -> Geometry, Transform
simplify = SimplifyCurve(Curve=project.Geometry)  # -> Curve, Simplified
offcrv = OffsetCurve(
    Curve=simplify.Curve,
    Plane=PlaneXY(0, 0, 0),
    Distance=number_slider,
    BothSides=expr("-x", number_slider),
    Kinks=0,
    CapType=1)

polyoffset = PolylineOffset(
    Polylines=simplify.Curve,
    Distance=Slider(0.1, range=0..1),
    Plane=pt,
    Tolerance=0.0001,
    ClosedFillet=1,
    OpenFillet=1,
    Miter=2)  # -> Contour, Holes
polyoffset_2 = PolylineOffset(
    Polylines=simplify.Curve,
    Distance=Slider(1, range=0..1),
    Plane=pt,
    Tolerance=0.0001,
    ClosedFillet=1,
    OpenFillet=1,
    Miter=2)  # -> Contour, Holes
rdiff = RegionDifference(CurvesA=polyoffset_2.Contour, CurvesB=polyoffset.Holes, Plane=pt)

boundary = BoundarySurfaces(Edges=rdiff)
offsrf = OffsetSurface(Surface=boundary, Distance=20, BothSides=-5, CreateSolid=True)

merge_3 = Merge(Data1=offsrf, Data2=geo_3)  # -> flatten(Result)

item_4 = ListItem(List=flatten(poly_topo_edge.ListOfEdges), Index=flatten(sort.Keys), Wrap=True)  # -> simplify(graft(Item))
explode_2 = Explode(Curve=item_2, Recursive=True)  # -> Segments, Vertices
midpt_4 = CurveMiddle(Curve=explode_2.Segments)
midpt_5 = CurveMiddle(Curve=item_4)
cp_2 = ClosestPoint(Point=midpt_5, Cloud=midpt_4)  # -> ClosestPoint, CPIndex, Distance
item_5 = ListItem(List=explode_2.Segments, Index=cp_2.CPIndex, Wrap=True)
trim_2 = TrimWithBreps(Curve=item_5, Brep=merge_3)  # -> Inside, Outside
ext = ExtendCurve(Curve=trim_2.Outside, Type=0, Start=expr("-x", num_6), End=expr("-x", num_6))  # -> simplify(Curve)
clean = CleanTree(RemoveNulls=True, RemoveInvalid=True, RemoveEmpty=True, Tree=ext)

len_2 = Length(Curve=clean)
mod = Modulus(A=len_2, B=num_7)
division_2 = Division(A=mod, B=2)
ext_2 = ExtendCurve(Curve=clean, Type=0, Start=expr("-x", division_2), End=expr("-x", division_2))
clean_2 = CleanTree(RemoveNulls=True, RemoveInvalid=True, RemoveEmpty=True, Tree=ext_2)
len_3 = Length(Curve=clean_2)
sort_3 = SortList(Keys=len_3, ValuesA=clean_2)  # -> Keys, reverse(ValuesA)
item_6 = ListItem(List=sort_3.ValuesA, Index=0, Wrap=True)

tstat_2 = TreeStatistics(Tree=item_6)  # -> Paths, Length, Count

dpath = DeconstructPath(Branch=tstat_2.Paths)  # -> flatten(Indices)
item_7 = ListItem(List=sort.Keys, Index=dpath, Wrap=True)

filter = StreamFilter(Gate=larger.LargerThan, Stream0=sort.Keys, Stream1=item_7)

path_3 = ConstructPath(Indices=graft(filter))  # -> flatten(Branch)
split_4 = SplitTree(Data=split_2.Positive, Masks=flatten(path_3))  # -> Positive, Negative

item_8 = ListItem(List=flip_data_edge_to_loop.ObjectsInEdgeStructure, Index=0, Wrap=True)
item_9 = ListItem(List=flatten(item_8), Index=filter, Wrap=True)  # -> graft(Item)
deplane = DeconstructPlane(Plane=item_9)  # -> Origin, XAxis, YAxis, ZAxis

graft = GraftTree(Tree=flatten(item_6), IncludeEmptyLists=True, IncludeNullItems=True)  # -> simplify(Tree)
cluster_2 = Cluster_19(data=simplify(item_5), G=larger.LargerThan, M=tstat_2.Paths)
cluster_3 = Cluster_19(data=cp_2.CPIndex, G=larger.LargerThan, M=tstat_2.Paths)
cluster_4 = Cluster_18(data=clean, G=larger.LargerThan, M=tstat_2.Paths)

divlength = DivideLength(Curve=graft, Length=num_7)  # -> Points, Tangents, Parameters
shatter = Shatter(Curve=graft, Parameters=divlength.Parameters)

division_3 = Division(A=num_8, B=2)
c_script = CSharpScript(z=shatter, x=deplane.ZAxis, y=division_3)  # -> out, A; inputs z: list, x: Vector3d, y: Double; same code as c_script
move_2 = Move(Geometry=shatter, Motion=expr("-1.05*x", c_script.A))  # -> Geometry, Transform
move_3 = Move(Geometry=shatter, Motion=c_script.A)  # -> Geometry, Transform

merge_4 = Merge(Data1=simplify(graft(move_3.Geometry)), Data2=simplify(graft(move_2.Geometry)))
lng_2 = ListLength(List=move_3.Geometry)
dup = DuplicateData(Data=item_9, Number=lng_2, Order=True)
midpt_6 = CurveMiddle(Curve=merge_4)
pl_origin = PlaneOrigin(Base=graft(dup), Origin=midpt_6)  # -> simplify(Plane)

path_4 = ConstructPath(Indices=graft(filter))
split_5 = SplitTree(Data=simplify(poly_topo_edge.EdgeLoopStructure), Masks=flatten(path_4))  # -> simplify(Positive), Negative
item_10 = ListItem(List=generate_mitre_planes_between_segments.PolylinePlanes, Index=split_5.Positive, Wrap=True)  # -> simplify(Item)
group = Group(Objects=item_10)
dup_2 = DuplicateData(Data=group, Number=lng_2, Order=True)  # -> simplify(Data)
ungroup = Ungroup(Group=dup_2)
item_11 = ListItem(List=ungroup, Index=0, Wrap=True)  # -> Item, Item1

int_3 = Integer(split_5.Positive)

sort_val = SortDuplicateValues(ValueList=flatten(int_3))  # -> UniqueValues, Indices
path_5 = ConstructPath(Indices=graft(sort_val.UniqueValues))  # -> flatten(Branch)
split_6 = SplitTree(Data=simplify(poly_topo_edge.LoopEdgeStructure), Masks=flatten(path_5))  # -> Positive, Negative

tree = CreateTree(Data=flatten(cluster_2), Path=filter)

pframe = PerpFrame(Curve=reparameterize(graft(move_3.Geometry)), Parameter=[0, 1])  # -> simplify(Frame)
trim_3 = TrimTree(Tree=pframe, Depth=1)  # -> simplify(Tree)
end = EndPoints(Curve=cluster_2)  # -> Start, End
end_2 = EndPoints(Curve=cluster_4)  # -> Start, End

match = MatchTree(Tree=trim_3, Guide=end.Start)
filter_2 = StreamFilter(Gate=larger.LargerThan, Stream0=pframe, Stream1=match)

align = AlignPlane(Plane=filter_2, Direction=deplane.ZAxis)  # -> Plane, Angle
partition = PartitionList(List=align.Plane, Size=2)  # -> simplify(Chunks)

pline = PolyLine(Vertices=filter_2, Closed=False)
merge_5 = Merge(
    Data1=simplify(flatten(end.Start)),
    Data2=simplify(flatten(end_2.Start)),
    Data3=simplify(flatten(filter_2)),
    Data4=simplify(flatten(end_2.End)),
    Data5=simplify(flatten(end.End)))

merge_6 = Merge(
    Data1=simplify(end.Start),
    Data2=simplify(end_2.Start),
    Data3=simplify(filter_2),
    Data4=simplify(end_2.End),
    Data5=simplify(end.End))

weave = Weave(Pattern=[0, 1], Stream0=partition, Stream1=pl_origin, NullGaps=False)
filter_3 = StreamFilter(Gate=larger.LargerThan, Stream0=merge_5, Stream1=merge_6)

pl_offset = PlaneOffset(BasePlane=graft(ungroup), Offset=merge)
trim_4 = TrimTree(Tree=pl_offset, Depth=1)
cluster_5 = Cluster_17(A=simplify(weave), L=simplify(trim_4))  # -> simplify(B)

pl_offset_2 = PlaneOffset(BasePlane=item_11.Item1, Offset=merge_2)
cluster_6 = Cluster_15(A=weave, L=pl_offset_2)  # -> simplify(B)

pline_2 = PolyLine(Vertices=filter_3, Closed=False)
explode_3 = Explode(Curve=pline_2, Recursive=True)  # -> Segments, Vertices
vec_3 = Vector(explode_3.Segments)
midpt_7 = CurveMiddle(Curve=explode_3.Segments)
amp = Amplitude(Vector=deplane.YAxis, Amplitude=Slider(0.2, range=0..1))
pl = ConstructPlane(Origin=midpt_7, XAxis=vec_3, YAxis=deplane.YAxis)  # -> simplify(Plane)
move_4 = Move(Geometry=pline_2, Motion=expr("-x", amp))  # -> Geometry, Transform
move_5 = Move(Geometry=pline_2, Motion=amp)  # -> Geometry, Transform
group_2 = Group(Objects=pl)
merge_7 = Merge(Data1=move_5.Geometry, Data2=move_4.Geometry)

flatten = FlattenTree(Tree=cluster_5, Path="{0}")
flatten_2 = FlattenTree(Tree=cluster_6, Path="{0}")

match_2 = MatchTree(Tree=group_2, Guide=split_4.Positive)
match_3 = MatchTree(Tree=cluster_3, Guide=match_2)

loft = Loft(Curves=merge_7, Options={Adjust=False, Closed=False, LoftEnds=0, LoftSimp=0, LoftType=0, Rebuild=10, Refit=0.01})
match_4 = MatchTree(Tree=loft, Guide=match_2)

c_script_2 = CSharpScript(x=split_6.Positive, y=match_3, u=int_3)  # -> out, graft(A); inputs x: tree of Int32, y: tree, u: tree of Int32; same code as c_script_2
c_script_3 = CSharpScript(x=split_6.Positive, y=match_4, u=int_3)  # -> out, graft(A); inputs x: tree of Int32, y: tree, u: tree of Int32; same code as c_script_2
c_script_4 = CSharpScript(x=split_6.Positive, y=match_2, u=int_3)  # -> out, A; inputs x: tree of Int32, y: tree, u: tree of Int32; same code as c_script_2

python = GhPythonScript(x=c_script_4.A)  # -> out, a; same code as python
move_6 = Move(Geometry=python.a, Motion=expr("x", vec_2))  # -> Geometry, Transform

move_7 = Move(Geometry=c_script_3.A, Motion=expr("x", vec_2))  # -> Geometry, Transform
data = Data(c_script_2.A)

tstat_3 = TreeStatistics(Tree=data)  # -> Paths, Length, Count
cluster_7 = Cluster_16(B=tstat_3.Paths, I=int_2)  # -> flatten(B_2)

group_3 = Group(Objects=weave)
trim_5 = TrimTree(Tree=simplify(group_3), Depth=1)

flatten_3 = FlattenTree(Tree=group_3, Path="{0}")
filter_4 = StreamFilter(Gate=larger.LargerThan, Stream0=flatten_3, Stream1=trim_5)

dispatch = Dispatch(List=filter_4, DispatchPattern=[True, False])  # -> ListA, ListB

match_5 = MatchTree(Tree=dispatch.ListA, Guide=tree)
match_6 = MatchTree(Tree=dispatch.ListB, Guide=tree)

c_script_5 = CSharpScript(x=split_6.Positive, y=match_5, z=match_6, u=int_3)  # -> out, A, B, C, D; inputs x: tree of Int32, y: tree, z: tree, u: tree of Int32; same code as c_script_5
item_12 = ListItem(List=generate_mitre_planes_between_segments.PolylinePlanes, Index=c_script_5.D, Wrap=True)  # -> graft(Item)

tstat_4 = TreeStatistics(Tree=c_script_5.A)  # -> Paths, Length, Count
split_7 = SplitTree(Data=simplify(graft(generate_mitre_planes_between_segments.PolylinePlanes)), Masks=flatten(tstat_4.Paths))  # -> Positive, Negative
lng_3 = ListLength(List=c_script_5.A)
group_4 = Group(Objects=split_7.Positive)
dup_3 = DuplicateData(Data=group_4, Number=lng_3, Order=True)  # -> simplify(Data)
ungroup_2 = Ungroup(Group=dup_3)
pl_offset_3 = PlaneOffset(BasePlane=ungroup_2, Offset=merge)

move_8 = Move(Geometry=item_12, Motion=expr("x", vec_2))  # -> Geometry, Transform
pl_offset_4 = PlaneOffset(BasePlane=move_8.Geometry, Offset=merge)
cso = CreateSpeckleObject(
    Planes=move_6.Geometry,
    EdgeIndex=data,
    GuideSurface=move_7.Geometry,
    Neighbour=graft(c_script_5.D),
    NeighbourPlane=move_8.Geometry,
    TopBottomPlanes=pl_offset_4,
    Offsets=merge,
    selectedKitName="Objects")

tree_2 = CreateTree(Data=flatten(cso), Path=cluster_7, Ensure=flatten(cluster))
trim_6 = TrimTree(Tree=tree_2, Depth=1)

trim_7 = TrimTree(Tree=simplify(cluster_5), Depth=1)

filter_5 = StreamFilter(Gate=larger.LargerThan, Stream0=flatten, Stream1=trim_7)

dispatch_2 = Dispatch(List=filter_5, DispatchPattern=[True, False])  # -> ListA, ListB

match_7 = MatchTree(Tree=dispatch_2.ListA, Guide=tree)
match_8 = MatchTree(Tree=dispatch_2.ListB, Guide=tree)

trim_8 = TrimTree(Tree=simplify(cluster_6), Depth=1)

filter_6 = StreamFilter(Gate=larger.LargerThan, Stream0=flatten_2, Stream1=trim_8)

dispatch_3 = Dispatch(List=simplify(filter_6), DispatchPattern=[True, False])  # -> ListA, ListB

match_9 = MatchTree(Tree=dispatch_3.ListA, Guide=tree)
match_10 = MatchTree(Tree=dispatch_3.ListB, Guide=tree)

c_script_6 = CSharpScript(x=split_6.Positive, y=match_10, z=match_9, u=int_3)  # -> out, A; inputs x: tree of Int32, y: tree of Brep, z: tree of Brep, u: tree of Int32; same code as c_script_6

trim_9 = TrimTree(Tree=geo_4, Depth=1)
split_8 = SplitTree(Data=simplify(trim_9), Masks=flatten(path))  # -> Positive, Negative
move_9 = Move(Geometry=split_8.Positive, Motion=expr("-x", vec_2))  # -> Geometry, Transform
tstat_5 = TreeStatistics(Tree=c_script_6.A)  # -> Paths, Length, Count
split_9 = SplitTree(Data=simplify(graft(move_9.Geometry)), Masks=flatten(tstat_5.Paths))  # -> Positive, Negative

python_2 = GhPythonScript(x=c_script_5.A)  # -> out, a; same code as python
cluster_8 = Cluster_15(A=python_2.a, L=pl_offset_3)  # -> simplify(B)
sdiff = SolidDifference(BrepsA=split_9.Positive, BrepsB=c_script_6.A)

item_13 = ListItem(List=generate_mitre_planes_between_segments.PolylinePlanes, Index=c_script_5.C, Wrap=True)
pl_offset_5 = PlaneOffset(BasePlane=item_13, Offset=division)
planesrf = PlaneSurface(Plane=pl_offset_5, XSize=Domain(-10, 10), YSize=Domain(-10, 10))
offsrf_2 = OffsetSurface(Surface=planesrf, Distance=1, BothSides=0, CreateSolid=True)
sdiff_2 = SolidDifference(BrepsA=cluster_8, BrepsB=offsrf_2)

trim_10 = TrimTree(Tree=sdiff_2, Depth=1)
merge_8 = Merge(Data1=trim_10, Data2=sdiff)
sunion = SolidUnion(Breps=merge_8)

fmerge = MergeFaces(Brep=sunion)  # -> Breps, Before, After
merge_9 = Merge(Data1=fmerge.Breps, Data2=split_9.Negative)  # -> flatten(Result)

tstat_6 = TreeStatistics(Tree=fmerge.Breps)  # -> Paths, Length, Count
dpath_2 = DeconstructPath(Branch=tstat_6.Paths)  # -> flatten(Indices)

c_script_7 = CSharpScript(x=merge_9, y=dpath_2)  # -> out, A; inputs x: list of Int32, y: list of Int32; same code as c_script_7
concat_2 = Concatenate(FragmentA=c_script_7.A, FragmentC=",", FragmentB=Slider(95, range=0..255))

move_10 = Move(Geometry=merge_9, Motion=expr("x", vec_2))  # -> simplify(Geometry), Transform
listdexs = ListIndices(List=move_10.Geometry)
concat_3 = Concatenate(FragmentA="{", FragmentB=int_2, FragmentE=";", FragmentC=listdexs, FragmentD="}")
tree_3 = CreateTree(Data=move_10.Geometry, Path=concat_3)

tree_4 = CreateTree(Data=concat_2, Path=concat_3)

lng_4 = ListLength(List=flatten(tree_3))
equals = Equality(FirstNumber=lng_4, SecondNumber=1)  # -> Equality, Inequality

filter_7 = StreamFilter(Gate=equals.Equality, Stream0=tree_3, Stream1=split_3.Positive)

preview = CustomPreview(Geometry=filter_7, Material=tree_4)

s_1 = ClusterOutput(filter_7)
T = ClusterOutput(trim_6)
D = ClusterOutput(tree_4)

# ==== cluster Cluster_25
D = ClusterInput()
M = ClusterInput()
I = ClusterInput()
split = SplitTree(Data=D, Masks=flatten(M))  # -> Positive, Negative
cull_i = CullIndex(List=split.Positive, Indices=I, Wrap=True)
merge = Merge(Data1=cull_i, Data2=split.Negative)
R = ClusterOutput(merge)

# ==== cluster Cluster_26
L = ClusterInput()
split = SplitList(List=L, Index=2)  # -> ListA, ListB
area = Area(Geometry=split.ListA)  # -> Area, Centroid
pdecon = Deconstruct(Point=area.Centroid)  # -> XComponent, YComponent, ZComponent
sort = SortList(Keys=pdecon.ZComponent, ValuesA=split.ListA)  # -> Keys, reverse(ValuesA)
item = ListItem(List=sort.ValuesA, Index=0, Wrap=True)
edges = BrepEdges(Brep=item)  # -> Naked, Interior, NonManifold
crv = Curve(edges.Naked)
join = JoinCurves(Curves=crv, Preserve=False)  # -> simplify(Curves)
area_2 = Area(Geometry=join)  # -> Area, Centroid
pln = ClusterInput()
sort_2 = SortList(Keys=area_2.Area, ValuesA=join)  # -> Keys, reverse(ValuesA)
M = ClusterInput()
pln_2 = Plane(pln)
split_2 = SplitTree(Data=simplify(pln_2), Masks=flatten(M))  # -> Positive, Negative
item_2 = ListItem(List=sort_2.ValuesA, Index=0, Wrap=True)
area_3 = Area(Geometry=item_2)  # -> Area, Centroid
unify_polylines = UnifyPolylines(Polylines=item_2, Direction=True)
split_3 = SplitList(List=sort_2.ValuesA, Index=1)  # -> ListA, ListB
pl_origin = PlaneOrigin(Base=split_2.Positive, Origin=area_3.Centroid)
boundary = BoundarySurfaces(Edges=split_3.ListB)
P = ClusterOutput(unify_polylines)
c_script = CSharpScript(x=pl_origin)  # -> out, A; inputs x: Plane
# ---------- c_script: C# ----------
    if(Vector3d.Multiply(x.ZAxis,Vector3d.ZAxis) < 0)
      A = new Plane(x.Origin, x.XAxis, -1*x.YAxis);
    else 
      A = x;
# ---------- end c_script ----------
offsrf = OffsetSurface(Surface=boundary, Distance=1, BothSides=-1, CreateSolid=True)  # -> simplify(Offset)
rotate = Rotate(Geometry=c_script.A, Angle=1.570796327, Plane=c_script.A)  # -> Geometry, Transform
brec = BoundingRectangle(Geometry=unify_polylines, Plane=rotate.Geometry, Axis=0, Slide=0, Union=True)  # -> Bounding, DimensionX, DimensionY
clean = CleanTree(RemoveNulls=True, RemoveInvalid=True, RemoveEmpty=True, Tree=offsrf)
trim = TrimTree(Tree=clean, Depth=1)
B = ClusterOutput(brec.Bounding)
Y = ClusterOutput(brec.DimensionY)
T = ClusterOutput(trim)

# ==== cluster Cluster_27
data = ClusterInput()
data_2 = ClusterInput()
D = ClusterInput()
data_3 = Data(data)
data_4 = Data(data_2)
panel = Panel(data_4)
split = SplitTree(Data=D, Masks=flatten(data_3))  # -> Positive, Negative
split_2 = SplitTree(Data=data_4, Masks=flatten(data_3))  # -> Positive, Negative
merge = Merge(Data1=split.Positive, Data2=split_2.Negative)
G = ClusterInput()
filter = StreamFilter(Gate=G, Stream0=data_4, Stream1=merge)
s_1 = ClusterOutput(filter)

# ==== cluster Cluster_28
geo = ClusterInput()
geo_2 = ClusterInput()
geo_3 = Geometry(geo)
geo_4 = Geometry(geo_2)
clean = CleanTree(RemoveNulls=True, RemoveInvalid=True, RemoveEmpty=False, Tree=geo_3)  # -> simplify(Tree)
tstat = TreeStatistics(Tree=clean)  # -> Paths, Length, Count
split = SplitTree(Data=simplify(geo_4), Masks=flatten(tstat.Paths))  # -> Positive, Negative
pt = Point(split.Positive)
avr = Average(Input=pt)
plfit = PlaneFit(Points=pt)  # -> Plane, Deviation
geo_5 = Geometry(clean)
pl_origin = PlaneOrigin(Base=plfit.Plane, Origin=avr)
area = Area(Geometry=geo_5)  # -> Area, Centroid
bbox = BoundingBox(Content=geo_5, Plane=pl_origin)  # -> Box, Box_2
debox = DeconstructBox(Box=bbox.Box_2)  # -> Plane, X, Y, Z
num = Number(debox.Z)
roundd = RoundToDecimalPlace(NumberX=num, DecimalPlace=4, RoundType=0)  # -> Rounded, Difference
sort_val = SortDuplicateValues(ValueList=flatten(roundd.Rounded))  # -> UniqueValues, Indices
item = ListItem(List=flatten(geo_5), Index=sort_val.Indices, Wrap=True)
item_2 = ListItem(List=flatten(area.Centroid), Index=sort_val.Indices, Wrap=True)
unique = ClusterOutput(sort_val.UniqueValues)
randcol = RandomColor(Data=sort_val.UniqueValues, Seed=2, FastMode=False)  # -> graft(Colors)
i = ClusterOutput(item)
i_2 = ClusterOutput(item_2)
C = ClusterOutput(randcol)

# ==== cluster Cluster_29
L = ClusterInput()
A = ClusterInput()

dso = DeconstructSpeckleObject(SpeckleObject=L, selectedKitName="Objects")  # -> FrameBase, Geo, Name, OffsetNegative, OffsetPositive, Type
geo = Geometry(flatten(dso.Geo))
clash = Clash(FirstSet=A, SecondSet=geo, Distance=0, L=100)  # -> ClashCount, ClashPoints, ClashRadii, FirstIndex, simplify(SecondIndex)
item = ListItem(List=L, Index=clash.SecondIndex, Wrap=True)

match = MatchTree(Tree=item, Guide=A)

clean = CleanTree(RemoveNulls=True, RemoveInvalid=True, RemoveEmpty=True, Tree=match)
tstat = TreeStatistics(Tree=clean)  # -> Paths, Length, Count
split = SplitTree(Data=match, Masks=flatten(tstat.Paths))  # -> Positive, Negative

P = ClusterOutput(split.Positive)

# ==== cluster Cluster_30
T = ClusterInput()
lng = ListLength(List=flatten(T))
clean = CleanTree(RemoveNulls=True, RemoveInvalid=True, RemoveEmpty=False, Tree=T)
lng_2 = ListLength(List=flatten(clean))
c_script = CSharpScript(x=lng_2, y=lng)  # -> out, A; inputs x: Int32, y: Int32
# ---------- c_script: C# ----------
    if(Math.Abs((x - y)) != 0)  {A = "ERROR";this.Component.AddRuntimeMessage(GH_RuntimeMessageLevel.Error, "ERROR");}
    else A = "PASS";
# ---------- end c_script ----------
A = ClusterOutput(c_script.A)

# ==== cluster Cluster_31
_0 = ClusterInput()
_1 = ClusterInput()
weave = Weave(Pattern=[0, 1], Stream0=_0, Stream1=_1, NullGaps=False)
A = ClusterInput()
ppx = PlanePlane(PlaneA=A, PlaneB=weave)
midpt = CurveMiddle(Curve=ppx)  # disabled
shift = ShiftList(List=ppx, Shift=1, Wrap=True)  # -> simplify(List)
llx = LineLine(Line1=ppx, Line2=shift)  # -> ParamA, ParamB, PointA, PointB
points = PointList(Points=midpt, Size=0.2)  # disabled
pline = PolyLine(Vertices=llx.PointA, Closed=True)
explode = Explode(Curve=pline, Recursive=True)  # -> Segments, Vertices
len = Length(Curve=explode.Segments)
smaller = SmallerThan(FirstNumber=len, SecondNumber=0.1)  # -> SmallerThan, OrEqualTo
cull = CullPattern(List=explode.Segments, CullPattern=invert(smaller.SmallerThan))
shift_2 = ShiftList(List=cull, Shift=1, Wrap=True)  # -> simplify(List)
llx_2 = LineLine(Line1=cull, Line2=shift_2)  # -> ParamA, ParamB, PointA, PointB
pline_2 = PolyLine(Vertices=llx_2.PointA, Closed=True)
pl = ClusterOutput(pline_2)

# ==== cluster Cluster_32
B = ClusterInput()
L = ClusterInput()
geo = ClusterInput()
debrep = DeconstructBrep(Brep=B)  # -> Faces, Edges, Vertices
lng = ListLength(List=B)
item = ListItem(List=L, Index=0, Wrap=True)
geo_2 = Geometry(geo)
area = Area(Geometry=debrep.Faces)  # -> Area, Centroid
dup = DuplicateData(Data=geo_2, Number=lng, Order=True)  # -> simplify(graft(Data))
cp = PlaneClosestPoint(Point=area.Centroid, Plane=dup)  # -> Point, UVPoint, Distance
sort = SortList(Keys=cp.Distance, ValuesA=debrep.Faces)  # -> Keys, reverse(ValuesA)
item_2 = ListItem(List=sort.ValuesA, Index=[0, -1], Wrap=True)
area_2 = Area(Geometry=item_2)  # -> Area, Centroid
pdecon = Deconstruct(Point=area_2.Centroid)  # -> XComponent, YComponent, ZComponent
sort_2 = SortList(Keys=pdecon.ZComponent, ValuesA=item_2)  # -> Keys, ValuesA
alicrvseams = AlignCurveSeams(Curves=sort_2.ValuesA, Guide=item, Snap=False, Iterative=True)  # -> Aligned, Points, R
item_3 = ListItem(List=alicrvseams.Aligned, Index=0, Wrap=True)  # -> Item, Item1
i = ClusterOutput(item_3.Item)
item_1 = ClusterOutput(item_3.Item1)

# ==== cluster Cluster_33
D = ClusterInput()
d1 = ClusterInput()
d2 = ClusterInput()
D_2 = ClusterInput()

split = SplitTree(Data=D, Masks=flatten("{6;*}"))  # -> Positive, Negative
merge = Merge(Data1=simplify(d1), Data2=simplify(d2))
clean = CleanTree(RemoveNulls=True, RemoveInvalid=True, RemoveEmpty=True, Tree=merge)
cullpt = CullDuplicates(Points=clean, Tolerance=0.001, CullMode=1)  # -> simplify(Points), Indices, Valence
tstat = TreeStatistics(Tree=cullpt.Points)  # -> Paths, Length, Count
split_2 = SplitTree(Data=simplify(graft(D_2)), Masks=flatten(tstat.Paths))  # -> Positive, Negative

N = ClusterOutput(split.Negative)

debrep = DeconstructBrep(Brep=split_2.Positive)  # -> Faces, Edges, Vertices
area = Area(Geometry=debrep.Faces)  # -> Area, Centroid
cp = ClosestPoint(Point=simplify(cullpt.Points), Cloud=simplify(area.Centroid))  # -> ClosestPoint, CPIndex, Distance

larger = LargerThan(FirstNumber=cp.Distance, SecondNumber=0.2)  # -> LargerThan, OrEqualTo
cull = CullPattern(List=cp.CPIndex, CullPattern=invert(larger.LargerThan))
item = ListItem(List=area.Centroid, Index=cull, Wrap=True)

brep_cp = BrepClosestPoint(Point=item, Brep=split_2.Positive)  # -> Point, Normal, Distance
pl = PlaneNormal(Origin=brep_cp.Point, ZAxis=brep_cp.Normal)  # -> simplify(Plane)

tstat_2 = TreeStatistics(Tree=D)  # -> Paths, Length, Count
tstat_3 = TreeStatistics(Tree=pl)  # -> Paths, Length, Count
lng = ListLength(List=pl)
dup = DuplicateData(Data=graft(tstat_3.Paths), Number=lng, Order=True)  # -> flatten(Data)
tree = CreateTree(Data=flatten(pl), Path=dup, Ensure=tstat_2.Paths)

D_3 = ClusterOutput(tree)

# ==== cluster Cluster_42
L = ClusterInput()
crv = ClusterInput()
poly_topo_edge = PolygonTopologyEdge(ListOfPolylines=crv, Tolerance=0.001)  # -> ListOfEdges, LoopEdgeStructure, EdgeLoopStructure
O = ClusterInput()

item = ListItem(List=flatten(L), Index=6, Wrap=True)
cluster = Cluster_35(L=item, crv=crv, G=Toggle(False))  # -> A, flatten(s_0), pln_6, L_2, B
generate_offset_polylines = GenerateOffsetPolylines(
    Polyline=cluster.s_0,
    Offset=expr("-x", O),
    OptionalMitrePlane=cluster.A,
    AngleTolerance=degrees(1),
    OffsetMethod=2,
    nonPlanar=False,
    virtual4Valent=False)  # -> OffsetPolylines, simplify(FourValenceNodes)
generate_offset_polylines_2 = GenerateOffsetPolylines(
    Polyline=cluster.s_0,
    Offset=O,
    OptionalMitrePlane=cluster.A,
    AngleTolerance=degrees(1),
    OffsetMethod=2,
    nonPlanar=False,
    virtual4Valent=False)  # -> OffsetPolylines, simplify(FourValenceNodes)

geo = Geometry(generate_offset_polylines.FourValenceNodes)
poly_topo_edge_filter = PolygonTopologyEdgeFilter(EdgeList=poly_topo_edge.ListOfEdges, EdgeLoopStructure=poly_topo_edge.EdgeLoopStructure, ValencyFilter=1)  # -> ListOfEdgeIDs, ListOfEdges
join = JoinCurves(Curves=poly_topo_edge_filter.ListOfEdges, Preserve=False)
tstat = TreeStatistics(Tree=geo)  # -> Paths, Length, Count
len = Length(Curve=join)
sort = SortList(Keys=len, ValuesA=join)  # -> Keys, reverse(flatten(ValuesA))
cullpt = CullDuplicates(Points=geo, Tolerance=0.01, CullMode=1)  # -> Points, Indices, Valence
cluster_2 = Cluster_37(pln=cluster.A, int=poly_topo_edge.EdgeLoopStructure, crv=generate_offset_polylines.OffsetPolylines, pln_2=cluster.pln_6)
crv_2 = Curve(cluster_2)
split = SplitTree(Data=simplify(graft(crv_2)), Masks=flatten(tstat.Paths))  # -> Positive, Negative
cluster_3 = Cluster_37(
    pln=cluster.A,
    int=poly_topo_edge.EdgeLoopStructure,
    crv=generate_offset_polylines_2.OffsetPolylines,
    pln_2=cluster.pln_6)
item_2 = ListItem(List=sort.ValuesA, Index=0, Wrap=True)

simplify = SimplifyCurve(Curve=item_2)  # -> Curve, Simplified
project = Project(Geometry=simplify.Curve, Plane=PlaneXY(0, 0, 0))  # -> Geometry, Transform
disc = Discontinuity(Curve=simplify.Curve, Level=1)  # -> Points, Parameters
shatter = Shatter(Curve=simplify.Curve, Parameters=disc.Parameters)
end = EndPoints(Curve=shatter)  # -> Start, End
vec2pt = Vector2Pt(PointA=end.Start, PointB=end.End, Unitize=False)  # -> Vector, Length
c_script = CSharpScript(x=vec2pt.Vector)  # -> out, A; inputs x: Vector3d
# ---------- c_script: C# ----------
    if(x.IsParallelTo(Vector3d.XAxis, Math.PI / 4) == 0) A = true;
    else A = false;
# ---------- end c_script ----------
cull = CullPattern(List=shatter, CullPattern=c_script.A)
ext = ExtendCurve(Curve=cull, Type=0, Start=4, End=4)
connect = ConnectCurves(Curves=ext, Continuity=2, Close=True, Bulge=0)

crv_cp = CurveClosestPoint(Point=cullpt.Points, Curve=split.Positive)  # -> Point, Parameter, Distance
merge = Merge(Data1=simplify(graft(cullpt.Points)), Data2=simplify(graft(crv_cp.Point)))
avr = Average(Input=merge)
cluster_4 = Cluster_38(top=graft(cluster_3), bottom=graft(cluster_2))

number_slider = Slider(0.04, range=0..1)
geo_2 = Geometry(flatten(cluster.L_2))
box = CenterBox(Base=geo_2, X=number_slider, Y=number_slider, Z=Slider(0.12, range=0..1))
clash = Clash(FirstSet=cluster_4, SecondSet=box, Distance=0, L=100)  # -> ClashCount, ClashPoints, ClashRadii, FirstIndex, SecondIndex
larger = LargerThan(FirstNumber=clash.ClashCount, SecondNumber=0)  # -> LargerThan, OrEqualTo

trim = TrimTree(Tree=avr, Depth=1)

cull_2 = CullPattern(List=cluster_4, CullPattern=larger.LargerThan)
clean = CleanTree(RemoveNulls=True, RemoveInvalid=True, RemoveEmpty=True, Tree=cull_2)
sdiff = SolidDifference(BrepsA=clean, BrepsB=cluster.B)  # -> simplify(Result)
tstat_2 = TreeStatistics(Tree=sdiff)  # -> Paths, Length, Count
split_2 = SplitTree(Data=cluster_4, Masks=flatten(tstat_2.Paths))  # -> Positive, Negative
merge_2 = Merge(Data1=split_2.Negative, Data2=sdiff)

debrep = DeconstructBrep(Brep=sdiff)  # -> Faces, Edges, Vertices
area = Area(Geometry=debrep.Faces)  # -> Area, Centroid
sort_2 = SortList(Keys=area.Area, ValuesA=debrep.Faces)  # -> Keys, reverse(ValuesA)
split_3 = SplitList(List=sort_2.ValuesA, Index=2)  # -> ListA, ListB
crv_3 = Curve(split_3.ListA)
area_2 = Area(Geometry=crv_3)  # -> Area, Centroid
pdecon = Deconstruct(Point=area_2.Centroid)  # -> XComponent, YComponent, ZComponent
sort_3 = SortList(Keys=pdecon.ZComponent, ValuesA=crv_3)  # -> Keys, ValuesA
item_3 = ListItem(List=sort_3.ValuesA, Index=0, Wrap=True)  # -> simplify(Item), Item1
tstat_3 = TreeStatistics(Tree=simplify(item_3.Item))  # -> Paths, Length, Count
dpath = DeconstructPath(Branch=tstat_3.Paths)  # -> flatten(Indices)
cluster_5 = Cluster_39(I=item_3.Item1, i=dpath, crv=generate_offset_polylines_2.OffsetPolylines)
cluster_6 = Cluster_39(I=item_3.Item, i=dpath, crv=generate_offset_polylines.OffsetPolylines)

cluster_7 = Cluster_36(S=crv, geo=merge_2, T=generate_offset_polylines_2.FourValenceNodes)  # -> min, max, R
R = ClusterOutput(cluster_7.R)
L_2 = ClusterOutput(cluster_5)
L_3 = ClusterOutput(cluster_6)
R_2 = ClusterOutput(cluster.A)

geo_3 = Geometry(cluster_7.R)
split_4 = SplitTree(Data=simplify(graft(geo_3)), Masks=flatten(tstat.Paths))  # -> Positive, Negative
debrep_2 = DeconstructBrep(Brep=split_4.Positive)  # -> Faces, Edges, Vertices
area_3 = Area(Geometry=debrep_2.Faces)  # -> Area, Centroid
cp = ClosestPoint(Point=simplify(trim), Cloud=simplify(area_3.Centroid))  # -> ClosestPoint, CPIndex, Distance
brep_cp = BrepClosestPoint(Point=cp.ClosestPoint, Brep=split_4.Positive)  # -> Point, Normal, Distance
amp = Amplitude(Vector=brep_cp.Normal, Amplitude=Slider(0.4, range=0..1))
unit = UnitVector(Vector=brep_cp.Normal)
pl = PlaneNormal(Origin=brep_cp.Point, ZAxis=brep_cp.Normal)
move = Move(Geometry=brep_cp.Point, Motion=amp)  # -> Geometry, Transform
crv_cp_2 = CurveClosestPoint(Point=move.Geometry, Curve=connect)  # -> Point, Parameter, Distance
larger_2 = LargerThan(FirstNumber=crv_cp_2.Distance, SecondNumber=Slider(0.2, range=0..1))  # -> LargerThan, OrEqualTo
cull_3 = CullPattern(List=pl, CullPattern=invert(larger_2.LargerThan))
randcol = RandomColor(Data=flatten(geo_3), Seed=2, FastMode=False)  # -> simplify(graft(Colors))
clean_2 = CleanTree(RemoveNulls=True, RemoveInvalid=True, RemoveEmpty=True, Tree=cull_3)  # -> simplify(Tree)
tstat_4 = TreeStatistics(Tree=clean_2)  # -> Paths, Length, Count
split_5 = SplitTree(Data=simplify(graft(randcol)), Masks=flatten(tstat_4.Paths))  # -> Positive, Negative
concat = Concatenate(FragmentA=split_5.Positive, FragmentB=",10")
T = ClusterOutput(clean_2)
split_6 = SplitTree(Data=simplify(graft(geo_3)), Masks=flatten(tstat_4.Paths))  # -> Positive, Negative
split_7 = SplitTree(Data=randcol, Masks=flatten(tstat_4.Paths))  # -> Positive, Negative
deplane = DeconstructPlane(Plane=clean_2)  # -> Origin, XAxis, YAxis, ZAxis
vdisex = VectorDisplayEx(Point=deplane.Origin, Vector=deplane.ZAxis, Colour=split_7.Positive, Width=2)
preview = CustomPreview(Geometry=flatten(split_6.Positive), Material=flatten(concat))
cluster_8 = Cluster_41(C=cluster_5, C_2=cluster_6, A=cluster_7.min, B=cluster_7.max, x=cluster_7.R)
R_3 = ClusterOutput(cluster_8)

# ==== cluster Cluster_43
G = ClusterInput()
x = ClusterInput()
volume = Volume(Geometry=G)  # -> Volume, Centroid
c_script = CSharpScript(x=x, y=volume.Volume)  # -> out, A; inputs x: Double, y: list of Double
# ---------- c_script: C# usings ----------
using System.Linq;
# ---------- c_script: C# ----------
    if(y.Count == 0) A = 0;
    else A = y.Sum(f => f * x);
# ---------- end c_script ----------
ma = MassAddition(Input=c_script.A)  # -> simplify(Result), PartialResults
R = ClusterOutput(ma.Result)

# ==== cluster Cluster_44
D = ClusterInput()
split = SplitTree(Data=D, Masks=flatten("{0,8;*}"))  # -> Positive, Negative
boundary = BoundarySurfaces(Edges=split.Positive)
y = ClusterInput()
explode = Explode(Curve=boundary, Recursive=True)  # -> Segments, Vertices
pln = Plane(boundary)
align = AlignPlanes(Planes=pln)
c_script = CSharpScript(x=align, y=y)  # -> out, A; inputs x: Plane, y: Double; disabled
# ---------- c_script: C# ----------
    Vector3d axis;
    if(x.ZAxis.IsParallelTo(Vector3d.ZAxis, Math.PI / 2) != 1)
    {
      axis = x.ZAxis;
      axis.Reverse();

    }
    else
      axis = x.ZAxis;
    
    double angle = Vector3d.VectorAngle(axis, Vector3d.ZAxis);
    A = y / Math.Cos(angle);
# ---------- end c_script ----------
c_script_2 = CSharpScript(x=align, y=y)  # -> out, A; inputs x: Plane, y: Double; same code as c_script_12
len = Length(Curve=explode.Segments)
panel = Panel(c_script_2.A)
sort = SortList(Keys=len, ValuesA=explode.Segments)  # -> Keys, reverse(ValuesA)
deplane = DeconstructPlane(Plane=align)  # -> Origin, XAxis, YAxis, ZAxis
bang = ExplodeTree(Data=c_script_2.A)  # -> Branch0, Branch1
item = ListItem(List=sort.ValuesA, Index=0, Wrap=True)
neg = Negative(Value=bang.Branch0)
crv_cp = CurveClosestPoint(Point=explode.Vertices, Curve=item)  # -> Point, Parameter, Distance; disabled
listdexs = ListIndices(List=crv_cp.Point)  # disabled
sort_2 = SortList(Keys=crv_cp.Distance, ValuesA=listdexs)  # -> Keys, ValuesA; disabled
merge = Merge(Data1=neg, Data2=bang.Branch1)
X = UnitX(Factor=merge)
split_2 = SplitList(List=sort_2.ValuesA, Index=2)  # -> ListA, ListB; disabled
trim = TrimTree(Tree=simplify(item), Depth=1)
amp = Amplitude(Vector=deplane.XAxis, Amplitude=merge)
midpt = CurveMiddle(Curve=trim)
move = Move(Geometry=trim, Motion=X)  # -> Geometry, Transform
move_2 = Move(Geometry=trim, Motion=amp)  # -> Geometry, Transform
num = ClusterInput()
midpt_2 = CurveMiddle(Curve=move_2.Geometry)
midpt_3 = CurveMiddle(Curve=move.Geometry)
yz = YZPlane(Origin=midpt)
merge_2 = Merge(Data1=simplify(item), Data2=simplify(graft(move.Geometry)))
C = ClusterInput()
num_2 = Number(num)
dist = Distance(PointA=midpt_2, PointB=midpt_3)
merge_3 = Merge(Data1=simplify(item), Data2=simplify(graft(move_2.Geometry)))
subtraction = Subtraction(A=num_2, B=dist, C=C)
end = EndPoints(Curve=graft(move_2.Geometry))  # -> Start, End; disabled
Z = UnitZ(Factor=expr("-x", subtraction))
item_2 = ListItem(List=explode.Vertices, Index=split_2.ListA, Wrap=True)  # disabled
loft = Loft(Curves=merge_3, Options={Adjust=False, Closed=False, LoftEnds=0, LoftSimp=0, LoftType=0, Rebuild=10, Refit=0.01})
neg_2 = Negative(Value=num_2)
loft_2 = Loft(Curves=merge_2, Options={Adjust=False, Closed=False, LoftEnds=0, LoftSimp=0, LoftType=0, Rebuild=10, Refit=0.01})
Z_2 = UnitZ(Factor=1)
merge_4 = Merge(Data1=end.Start, Data2=end.End)  # disabled
move_3 = Move(Geometry=loft_2, Motion=graft(Z))  # -> Geometry, Transform
cp = ClosestPoint(Point=item_2, Cloud=merge_4)  # -> ClosestPoint, CPIndex, Distance; disabled
generate_offset_polylines = GenerateOffsetPolylines(
    Polyline=loft,
    Offset=neg_2,
    OptionalEdgeVectorOverride=Z_2,
    AngleTolerance=0.1,
    OffsetMethod=2,
    nonPlanar=False,
    virtual4Valent=False)  # -> simplify(OffsetPolylines), FourValenceNodes
item_3 = ListItem(List=merge_4, Index=cp.CPIndex, Wrap=True)  # disabled
panel_2 = Panel(subtraction)
merge_5 = Merge(Data1=generate_offset_polylines.OffsetPolylines, Data2=move_3.Geometry)
replace = ReplaceItems(List=explode.Vertices, Item=item_3, Indices=split_2.ListA, Wrap=False)  # disabled
loft_3 = Loft(Curves=merge_5, Options={Adjust=False, Closed=False, LoftEnds=0, LoftSimp=0, LoftType=0, Rebuild=10, Refit=0.01})
pline = PolyLine(Vertices=replace, Closed=True)  # disabled
cap = CapHoles(Brep=loft_3)
trim_2 = TrimTree(Tree=pline, Depth=1)  # disabled
B = ClusterOutput(cap)
merge_6 = Merge(Data1=trim_2, Data2=split.Negative)  # disabled
geo = Geometry(merge_6)

# ==== cluster Cluster_45
D = ClusterInput()
M = ClusterInput()
split = SplitTree(Data=simplify(D), Masks=flatten(M))  # -> Positive, Negative
C = ClusterInput()
split_2 = SplitBrep(Brep=split.Positive, Cutter=C)
cap = CapHoles(Brep=split_2)
merge = Merge(Data1=simplify(cap), Data2=split.Negative)
R = ClusterOutput(merge)

# ==== cluster Cluster_7
_1 = ClusterInput()
trim = TrimTree(Tree=_1, Depth=1)
G = ClusterInput()
filter = StreamFilter(Gate=G, Stream0=trim, Stream1=_1)  # -> simplify(Stream)
s_1 = ClusterOutput(filter)

# ==== cluster Cluster_8
_0 = ClusterInput()
graft = GraftTree(Tree=_0, IncludeEmptyLists=True, IncludeNullItems=True)
G = ClusterInput()
filter = StreamFilter(Gate=G, Stream0=_0, Stream1=graft)  # -> simplify(Stream)
s_1 = ClusterOutput(filter)

# ==== cluster Cluster_9
I = ClusterInput()
tstat = TreeStatistics(Tree=I)  # -> Paths, Length, Count
null = NullItem(Item=I)  # -> NullFlags, InvalidFlags, Description
item = ListItem(List=null.NullFlags, Index=0, Wrap=True)
dispatch = Dispatch(List=tstat.Paths, DispatchPattern=flatten(item))  # -> ListA, ListB
branch = TreeBranch(Tree=simplify(I), Path=dispatch.ListB, MaintainPaths=True)
branch_2 = TreeBranch(Tree=I, Path=dispatch.ListA, MaintainPaths=True)
B = ClusterOutput(branch)
B_2 = ClusterOutput(branch_2)

# ==== cluster Cluster_10
_0 = ClusterInput()
trim = TrimTree(Tree=_0, Depth=1)
G = ClusterInput()
filter = StreamFilter(Gate=G, Stream0=_0, Stream1=trim)  # -> simplify(Stream)
s_1 = ClusterOutput(filter)

# ==== cluster Cluster_11
L = ClusterInput()
_0 = ClusterInput()
lng = ListLength(List=L)
dup = DuplicateData(Data=_0, Number=lng, Order=True)  # -> graft(Data)
G = ClusterInput()
filter = StreamFilter(Gate=G, Stream0=_0, Stream1=dup)  # -> simplify(Stream)
s_1 = ClusterOutput(filter)

# ==== cluster Cluster_12
X = ClusterInput()
Y = ClusterInput()
X_2 = ClusterInput()
pt = ConstructPoint(XCoordinate=X, YCoordinate=Y, ZCoordinate=0)
merge = Merge(Data1="0,0,0", Data2=pt, Data3="1,1,0")
pt_2 = ConstructPoint(XCoordinate=X_2, YCoordinate=0, ZCoordinate=0)
intcrv = Interpolate(Vertices=merge, Degree=3, Periodic=False, KnotStyle=1)  # -> Curve, Length, Domain
yz = YZPlane(Origin=pt_2)
pcx = CurvePlane(Curve=intcrv.Curve, Plane=yz)  # -> Points, ParamsC, ParamsP
pdecon = Deconstruct(Point=pcx.Points)  # -> XComponent, YComponent, ZComponent
Y_2 = ClusterOutput(pdecon.YComponent)

# ==== cluster Cluster_13
L = ClusterInput()
dispatch = Dispatch(List=L, DispatchPattern=[True, False])  # -> ListA, ListB
D = ClusterInput()
pt = ConstructPoint(XCoordinate=graft(dispatch.ListA), YCoordinate=graft(dispatch.ListB), ZCoordinate=0)
clean = CleanTree(RemoveNulls=True, RemoveInvalid=True, RemoveEmpty=True, Tree=D)
lng = ListLength(List=dispatch.ListA)
tstat = TreeStatistics(Tree=clean)  # -> Paths, Length, Count
dup = DuplicateData(Data="0,0,0", Number=lng, Order=True)
split = SplitTree(Data=D, Masks=flatten(tstat.Paths))  # -> Positive, Negative
dup_2 = DuplicateData(Data="1,1,0", Number=lng, Order=True)
merge = Merge(Data1=simplify(graft(dup)), Data2=simplify(pt), Data3=simplify(graft(dup_2)))
pt_2 = ConstructPoint(XCoordinate=split.Positive, YCoordinate=0, ZCoordinate=0)
trim = TrimTree(Tree=pt_2, Depth=1)
match = MatchTree(Tree=merge, Guide=trim)
intcrv = Interpolate(Vertices=match, Degree=3, Periodic=False, KnotStyle=1)  # -> Curve, Length, Domain
yz = YZPlane(Origin=trim)
pcx = CurvePlane(Curve=intcrv.Curve, Plane=yz)  # -> Points, ParamsC, ParamsP
pdecon = Deconstruct(Point=pcx.Points)  # -> XComponent, YComponent, ZComponent
match_2 = MatchTree(Tree=pdecon.YComponent, Guide=pt_2)
merge_2 = Merge(Data1=match_2, Data2=split.Negative)
subtraction = Subtraction(A=split.Positive, B=match_2)
R = ClusterOutput(merge_2)

# ==== cluster Cluster_15
L = ClusterInput()
item = ListItem(List=L, Index=0, Wrap=True)  # -> Item, Item1
A = ClusterInput()
ppx = PlanePlane(PlaneA=A, PlaneB=item.Item1)
ppx_2 = PlanePlane(PlaneA=A, PlaneB=item.Item)
shift = ShiftList(List=ppx_2, Shift=1, Wrap=True)
shift_2 = ShiftList(List=ppx, Shift=1, Wrap=True)
llx = LineLine(Line1=ppx_2, Line2=shift)  # -> ParamA, ParamB, PointA, PointB
llx_2 = LineLine(Line1=ppx, Line2=shift_2)  # -> ParamA, ParamB, PointA, PointB
pline = PolyLine(Vertices=llx.PointA, Closed=True)
pline_2 = PolyLine(Vertices=llx_2.PointA, Closed=True)
merge = Merge(Data1=pline, Data2=pline_2)
loft = Loft(Curves=merge, Options={Adjust=False, Closed=False, LoftEnds=0, LoftSimp=0, LoftType=0, Rebuild=10, Refit=0.01})
cap = CapHoles(Brep=loft)
B = ClusterOutput(cap)

# ==== cluster Cluster_16
B = ClusterInput()
dpath = DeconstructPath(Branch=B)
I = ClusterInput()
ins = InsertItems(List=dpath, Item=I, Indices=0, Wrap=True)
path = ConstructPath(Indices=ins)
B_2 = ClusterOutput(path)

# ==== cluster Cluster_17
L = ClusterInput()
item = ListItem(List=L, Index=0, Wrap=True)  # -> Item, Item1, Item2, Item3
A = ClusterInput()
dispatch = Dispatch(List=L, DispatchPattern=[True, False])  # -> ListA, ListB
c_script = CSharpScript(x=dispatch.ListA)  # -> out, A; inputs x: tree
# ---------- c_script: C# ----------
    DataTree<object> output = new DataTree<object>(x);

    for (int i = 0; i < x.BranchCount; i++)
    {
      if(i % 2 == 0) output.Branch(i).RemoveAt(0);
      else output.Branch(i).RemoveAt(1);
    }

    A = output;
# ---------- end c_script ----------
c_script_2 = CSharpScript(x=dispatch.ListB)  # -> out, A; inputs x: tree; same code as c_script
c_script_3 = CSharpScript(platePlanes=L, fingerPlanes=simplify(A))  # -> out, A; inputs platePlanes: tree of Plane, fingerPlanes: tree of Plane; disabled
# ---------- c_script_3: C# ----------
    A = CreateGeometry(fingerPlanes, platePlanes);
# ---------- c_script_3: C# additional code ----------
  public DataTree<Plane> CullFirstLast(DataTree<Plane> list)
  {
    DataTree<Plane> output = new DataTree<Plane>();

    for (int i = 0; i < list.BranchCount; i++)
    {
      List<Plane> branch = list.Branch(i).ToList();
      if (branch.Count > 0)
      {
        if (i % 2 == 0 && branch.Count > 0)
          branch.RemoveAt(0); // Remove the first element
        else if (branch.Count > 1)
          branch.RemoveAt(branch.Count - 1); // Remove the last element

        output.AddRange(branch, list.Path(i));
      }
    }

    return output;
  }

  public Polyline CreatePoly(List<Plane> fingerPlanes, Plane intersectPlane)
  {
    List<Line> intersections = new List<Line>();

    foreach (var fingerPlane in fingerPlanes)
    {
      Line intersection;
      if (!Rhino.Geometry.Intersect.Intersection.PlanePlane(fingerPlane, intersectPlane, out intersection) || intersection.Length == 0)
      {
        // Add a runtime message or handle the error as necessary
        throw new InvalidOperationException("Plane intersection failed or no valid intersection.");
      }
      intersections.Add(intersection);
      RhinoApp.WriteLine(intersection.ToString());
    }

    List<Point3d> polylinePoints = new List<Point3d>();

    for (int i = 0; i < intersections.Count; i++)
    {

      Line lineA = intersections[i];
      Line lineB = i == intersections.Count - 1 ? intersections[0] : intersections[i + 1];

      double a, b;
      if (!Rhino.Geometry.Intersect.Intersection.LineLine(lineA, lineB, out a, out b))
      {
        //throw new InvalidOperationException("Line intersection failed.");
      }
      Point3d pointA = lineA.PointAt(a);
      RhinoApp.WriteLine(i.ToString() + " ___ " + pointA.ToString());
      polylinePoints.Add(pointA);
    }

    if (!polylinePoints.First().EpsilonEquals(polylinePoints.Last(), Rhino.RhinoMath.ZeroTolerance))
    {
      polylinePoints.Add(polylinePoints[0]); // Close the polyline if not already closed
    }

    return new Polyline(polylinePoints);
  }


  public DataTree<Brep> CreateGeometry(DataTree<Plane> fingers, DataTree<Plane> plates)
  {
    DataTree<Brep> result = new DataTree<Brep>();

    // Separate top and bottom planes
    DataTree<Plane> topPlanesTree = new DataTree<Plane>();
    DataTree<Plane> bottomPlanesTree = new DataTree<Plane>();

    for (int i = 0; i < plates.BranchCount; i++)
    {
      var branch = plates.Branch(i);
      var topPlanes = branch.Where((p, index) => index % 2 == 0).ToList();
      var bottomPlanes = branch.Where((p, index) => index % 2 != 0).ToList();

      topPlanesTree.AddRange(topPlanes, plates.Path(i));
      bottomPlanesTree.AddRange(bottomPlanes, plates.Path(i));
    }

    // Modify top and bottom planes
    DataTree<Plane> modTopPlanesTree = CullFirstLast(topPlanesTree);
    DataTree<Plane> modBottomPlanesTree = CullFirstLast(bottomPlanesTree);

    DataTree<Polyline> polys = new DataTree<Polyline>();

    // Create polylines for each finger and plane combination
    for (int i = 0; i < fingers.BranchCount; i++)
    {

      if ( modTopPlanesTree.Branch(i).Count != 1)
      {
        throw new InvalidOperationException("Invalid top plane for branch" + i.ToString());
      }
      if (modBottomPlanesTree.Branch(i).Count != 1)
      {
        throw new InvalidOperationException("Invalid bottom plane for branch" + i.ToString());
      }

      polys.Add(CreatePoly(fingers.Branch(i), modTopPlanesTree.Branch(i)[0]), fingers.Path(i));
      polys.Add(CreatePoly(fingers.Branch(i), modBottomPlanesTree.Branch(i)[0]), fingers.Path(i));
    }

    // Create geometry from polylines
    for (int i = 0; i < polys.BranchCount; i++)
    {
      List<Curve> curves = polys.Branch(i).Select(f => (Curve) f.ToNurbsCurve()).ToList();

      // Create loft from curves
      Brep[] lofts = Brep.CreateFromLoft(curves, Point3d.Unset, Point3d.Unset, LoftType.Normal, false);
      if (lofts == null || lofts.Length == 0)
      {
        throw new InvalidOperationException("Loft creation failed for branch " + i.ToString());
      }

      // Cap holes to create a solid
      Brep cappedBrep = lofts[0].CapPlanarHoles(0.01);
      if (cappedBrep == null)
      {
        throw new InvalidOperationException("Capping holes failed for branch " + i.ToString());
      }

      result.Add(cappedBrep, polys.Path(i));
    }

    return result;
  }
# ---------- end c_script_3 ----------
ppx = PlanePlane(PlaneA=A, PlaneB=c_script_2.A)
ppx_2 = PlanePlane(PlaneA=A, PlaneB=c_script.A)
shift = ShiftList(List=ppx_2, Shift=1, Wrap=True)
shift_2 = ShiftList(List=ppx, Shift=1, Wrap=True)
llx = LineLine(Line1=ppx_2, Line2=shift)  # -> ParamA, ParamB, PointA, PointB
llx_2 = LineLine(Line1=ppx, Line2=shift_2)  # -> ParamA, ParamB, PointA, PointB
pline = PolyLine(Vertices=llx.PointA, Closed=True)
pline_2 = PolyLine(Vertices=llx_2.PointA, Closed=True)
merge = Merge(Data1=pline, Data2=pline_2)
loft = Loft(Curves=merge, Options={Adjust=False, Closed=False, LoftEnds=0, LoftSimp=0, LoftType=0, Rebuild=10, Refit=0.01})
cap = CapHoles(Brep=loft)  # -> simplify(Brep)
B = ClusterOutput(cap)

# ==== cluster Cluster_18
data = ClusterInput()
M = ClusterInput()
data_2 = Data(data)
tstat = TreeStatistics(Tree=data_2)  # -> Paths, Length, Count
lng = ListLength(List=M)
lng_2 = ListLength(List=tstat.Paths)
split = SplitTree(Data=data_2, Masks=flatten(M))  # -> Positive, Negative
equals = Equality(FirstNumber=lng, SecondNumber=lng_2)  # -> Equality, Inequality
graft = GraftTree(Tree=flatten(split.Positive), IncludeEmptyLists=True, IncludeNullItems=True)  # -> simplify(Tree)
G = ClusterInput()
filter = StreamFilter(Gate=equals.Equality, Stream0=graft, Stream1=split.Positive)
filter_2 = StreamFilter(Gate=G, Stream0=data_2, Stream1=filter)
s_0 = ClusterOutput(filter_2)

# ==== cluster Cluster_19
data = ClusterInput()
M = ClusterInput()
data_2 = Data(data)
split = SplitTree(Data=data_2, Masks=flatten(M))  # -> Positive, Negative
graft = GraftTree(Tree=flatten(split.Positive), IncludeEmptyLists=True, IncludeNullItems=True)  # -> simplify(Tree)
G = ClusterInput()
filter = StreamFilter(Gate=G, Stream0=data_2, Stream1=split.Positive)
s_0 = ClusterOutput(filter)

# ==== cluster Cluster_21
data = ClusterInput()
M = ClusterInput()
data_2 = Data(data)
tstat = TreeStatistics(Tree=data_2)  # -> Paths, Length, Count
lng = ListLength(List=M)
lng_2 = ListLength(List=tstat.Paths)
split = SplitTree(Data=data_2, Masks=flatten(M))  # -> Positive, Negative
equals = Equality(FirstNumber=lng, SecondNumber=lng_2)  # -> Equality, Inequality
graft = GraftTree(Tree=flatten(split.Positive), IncludeEmptyLists=True, IncludeNullItems=True)  # -> simplify(Tree)
G = ClusterInput()
filter = StreamFilter(Gate=equals.Equality, Stream0=graft, Stream1=split.Positive)
filter_2 = StreamFilter(Gate=G, Stream0=data_2, Stream1=filter)
s_1 = ClusterOutput(filter_2)

# ==== cluster Cluster_22
data = ClusterInput()
M = ClusterInput()
data_2 = Data(data)
split = SplitTree(Data=data_2, Masks=flatten(M))  # -> Positive, Negative
graft = GraftTree(Tree=flatten(split.Positive), IncludeEmptyLists=True, IncludeNullItems=True)  # -> simplify(Tree)
G = ClusterInput()
filter = StreamFilter(Gate=G, Stream0=data_2, Stream1=split.Positive)
s_1 = ClusterOutput(filter)

# ==== cluster Cluster_35
receive = Receive(
    AutoReceive=False,
    CurrentComponentState="expired",
    ExpandOutput=True,
    LastInfoMessage="Lasath @ 02/22/2024 09:01:18: Updated Acoustics based on A610 V DD12 (id:2c90bcf47d)",
    ReceiveOnOpen=True,
    ReceivedCommitId="2c90bcf47d",
    StreamWrapper="https://speckle.xyz/projects/fa2b5c68c0/models/globals",
    selectedKitName="Objects")  # -> Info, ArchicadMiddleTopOfGrid1, Cassette, Material, Steel
crv = ClusterInput()
crv_2 = Curve(crv)
L = ClusterInput()

# ---- group: Get Skylight Plane
item = ListItem(List=flatten(L), Index=6, Wrap=True)
edges = BrepEdges(Brep=item)  # -> Naked, Interior, NonManifold
join = JoinCurves(Curves=edges.Naked, Preserve=False)
item_2 = ListItem(List=join, Index=1, Wrap=True)
explode = Explode(Curve=item_2, Recursive=True)  # -> Segments, Vertices
boundary = BoundarySurfaces(Edges=item_2)
len = Length(Curve=explode.Segments)
disc = Discontinuity(Curve=boundary, Level=1)  # -> Points, Parameters
c_script = CSharpScript(x=boundary)  # -> out, A, B, C, D; inputs x: Brep
# ---------- c_script: C# ----------
    var amp = AreaMassProperties.Compute(x);
    Point3d center = amp.Centroid;

    Point3d pt;
    double s,t;
    ComponentIndex ci;
    Vector3d normal;
    x.ClosestPoint(center, out pt, out ci, out s, out t, 1, out normal);
    if(Vector3d.Multiply(normal, Vector3d.ZAxis) < 0)
      normal.Reverse();
    A = normal;
    B = pt;
    C = Vector3d.VectorAngle(normal, Vector3d.ZAxis);
    D = new Plane(center, normal);
# ---------- end c_script ----------
sort = SortList(Keys=len, ValuesA=explode.Segments)  # -> Keys, ValuesA
item_3 = ListItem(List=sort.ValuesA, Index=0, Wrap=True)
vec = Vector(item_3)
rev = Reverse(Vector=vec)
align = AlignPlane(Plane=c_script.D, Direction=rev)  # -> Plane, Angle

# ----
Z = UnitZ(Factor=1)
generate_mitre_planes_between_segments = GenerateMitrePlanesBetweenSegments(Polyline=crv_2, NakedEdgeGuideVector=Z)  # -> MitrePlanes, Neighbours, PolylinePlanes, BoundingRectangle

poly_topo_edge = PolygonTopologyEdge(ListOfPolylines=crv_2, Tolerance=0.001)  # -> ListOfEdges, LoopEdgeStructure, EdgeLoopStructure
flip_data_edge_to_loop = FlipDataEdgeToLoop(
    LoopEdgeStructure=simplify(poly_topo_edge.LoopEdgeStructure),
    EdgeLoopStructure=simplify(poly_topo_edge.EdgeLoopStructure),
    ObjectsInLoopStructure=simplify(generate_mitre_planes_between_segments.MitrePlanes))  # -> EdgeLoopStructure, ObjectsInEdgeStructure

poly_topo_edge_filter = PolygonTopologyEdgeFilter(EdgeList=poly_topo_edge.ListOfEdges, EdgeLoopStructure=poly_topo_edge.EdgeLoopStructure, ValencyFilter=1)  # -> ListOfEdgeIDs, ListOfEdges
join_2 = JoinCurves(Curves=poly_topo_edge_filter.ListOfEdges, Preserve=False)
len_2 = Length(Curve=join_2)
sort_2 = SortList(Keys=len_2, ValuesA=join_2)  # -> Keys, ValuesA
item_4 = ListItem(List=sort_2.ValuesA, Index=0, Wrap=True)
ccx = CurveCurve(CurveA=item_4, CurveB=poly_topo_edge_filter.ListOfEdges)  # -> Points, ParamsA, ParamsB
lng = ListLength(List=ccx.Points)
cull = CullPattern(List=poly_topo_edge_filter.ListOfEdgeIDs, CullPattern=flatten(lng))
path = ConstructPath(Indices=graft(cull))  # -> flatten(Branch)

line_topo = LineTopology(ListOfLines=poly_topo_edge.ListOfEdges, Tolerance=0.001)  # -> ListOfPoints, LinePointStructure, PointPointStructure, PointLineStructure, PointLineStructureIndex
explode_2 = Explode(Curve=item_4, Recursive=True)  # -> Segments, Vertices
c_script_2 = CSharpScript(x=explode_2.Segments)  # -> out, A, B; inputs x: list of Line
# ---------- c_script_2: C# ----------
    List<Line> output = new List<Line>();
    List<Point3d> output2 = new List<Point3d>();

    for (int i = 0; i < x.Count; i++)
    {
      if(x[i].Length < 0.5)
      {
        output.Add(x[i]);
        if(x[i].PointAt(0).Z > x[i].PointAt(1).Z)
          output2.Add(x[i].PointAt(1));
        else
          output2.Add(x[i].PointAt(0));

      }

    }

    A = output;
    B = output2;
# ---------- end c_script_2 ----------
midpt = CurveMiddle(Curve=poly_topo_edge.ListOfEdges)
midpt_2 = CurveMiddle(Curve=c_script_2.A)
cp = ClosestPoint(Point=c_script_2.B, Cloud=line_topo.ListOfPoints)  # -> ClosestPoint, CPIndex, Distance
cp_2 = ClosestPoint(Point=midpt_2, Cloud=midpt)  # -> ClosestPoint, CPIndex, Distance
c_script_3 = CSharpScript(P=cp.CPIndex, L=cp_2.CPIndex, PL=line_topo.PointLineStructureIndex)  # -> out, A; inputs P: Int32, L: list of Int32, PL: tree of Int32
# ---------- c_script_3: C# ----------
    var edges = PL.Branch(P);
    edges = edges.Except(L).ToList();
    A = edges;
# ---------- end c_script_3 ----------

pln = Plane(align.Plane)
deplane = DeconstructPlane(Plane=pln)  # -> Origin, XAxis, YAxis, ZAxis
vdis = VectorDisplay(Anchor=deplane.Origin, Vector=deplane.ZAxis)

number_slider = Slider(0.21, range=0..1)
G = ClusterInput()

item_5 = ListItem(List=flatten(generate_mitre_planes_between_segments.PolylinePlanes), Index=poly_topo_edge.EdgeLoopStructure, Wrap=True)  # -> simplify(Item)
lng_2 = ListLength(List=item_5)
tstat = TreeStatistics(Tree=item_5)  # -> Paths, Length, Count
equals = Equality(FirstNumber=lng_2, SecondNumber="2")  # -> Equality, Inequality
c_script_4 = CSharpScript(y=cull, z=flatten(equals.Equality))  # -> out, A; inputs y: list of Int32, z: list of Boolean
# ---------- c_script_4: C# ----------
    List<bool> outputList = new List<bool>();


    List<int> checkList = new List<int>(y);
    checkList.Distinct();

    for (int i = 0; i < z.Count; i++)
    {
      if(checkList.Contains(i))
      {
        outputList.Add(!z[i]);

      }
      else outputList.Add(z[i]);
    }

    A = outputList;
# ---------- end c_script_4 ----------

cull_2 = CullPattern(List=tstat.Paths, CullPattern=c_script_4.A)

split = SplitTree(Data=flip_data_edge_to_loop.ObjectsInEdgeStructure, Masks=flatten(cull_2))  # -> Positive, Negative

split_2 = SplitTree(Data=split.Positive, Masks=flatten(path))  # -> Positive, Negative
deplane_2 = DeconstructPlane(Plane=split_2.Positive)  # -> Origin, XAxis, YAxis, ZAxis
pl = ConstructPlane(Origin=deplane_2.Origin, XAxis=deplane_2.XAxis, YAxis=deplane.ZAxis)
merge = Merge(Data1=simplify(pl), Data2=split_2.Negative)

pln_2 = Plane(merge)

path_2 = ConstructPath(Indices=graft(c_script_3.A))
split_3 = SplitTree(Data=pln_2, Masks=flatten(path_2))  # -> Positive, Negative

c_script_5 = CSharpScript(x=c_script_3.A, y=split_3.Positive)  # -> out, simplify(A); inputs x: list of Int32, y: tree of Plane
# ---------- c_script_5: C# ----------
    if(x.Count == 2)
    {
      Plane plnA = y.Branch(new GH_Path(x[0]))[0];
      Plane plnB = y.Branch(new GH_Path(x[1]))[0];
      Line ln;
      Rhino.Geometry.Intersect.Intersection.PlanePlane(plnA, plnB, out ln);
      A = ln;

    }
# ---------- end c_script_5 ----------
vec_2 = Vector(c_script_5.A)

item_6 = ListItem(List=line_topo.ListOfPoints, Index=cp.CPIndex, Wrap=True)
pl_2 = PlaneNormal(Origin=graft(item_6), ZAxis=vec_2)

path_3 = ConstructPath(Indices=graft(cp_2.CPIndex))
split_4 = SplitTree(Data=simplify(merge), Masks=flatten(path_3))  # -> Positive, Negative

split_5 = SplitTree(Data=simplify(graft(poly_topo_edge.ListOfEdges)), Masks=flatten(path_3))  # -> Positive, Negative
vec_3 = Vector(split_5.Positive)
align_2 = AlignPlane(Plane=pl_2, Direction=vec_3)  # -> Plane, Angle
deplane_3 = DeconstructPlane(Plane=align_2.Plane)  # -> Origin, XAxis, YAxis, ZAxis
pl_3 = ConstructPlane(Origin=deplane_3.Origin, XAxis=deplane_3.XAxis, YAxis=deplane_3.ZAxis)  # -> simplify(flatten(Plane))
tree = CreateTree(Data=pl_3, Path=cp_2.CPIndex)

merge_2 = Merge(Data1=split_4.Negative, Data2=tree, Data3=split.Negative)

explode_3 = Explode(Curve=item_4, Recursive=True)  # -> Segments, Vertices
cp_3 = PlaneClosestPoint(Point=explode_3.Vertices, Plane=item_2)  # -> Point, UVPoint, Distance
smaller = SmallerThan(FirstNumber=cp_3.Distance, SecondNumber=0.01)  # -> SmallerThan, OrEqualTo
cull_3 = CullPattern(List=explode_3.Vertices, CullPattern=smaller.SmallerThan)
midpt_3 = CurveMiddle(Curve=explode_3.Segments)
pline = PolyLine(Vertices=cull_3, Closed=False)

smaller_2 = SmallerThan(FirstNumber=cp_3.Distance, SecondNumber=0.01)  # -> SmallerThan, OrEqualTo
cull_4 = CullPattern(List=explode_3.Vertices, CullPattern=invert(smaller_2.SmallerThan))

cp_4 = ClosestPoint(Point=cull_4, Cloud=midpt_3)  # -> ClosestPoint, CPIndex, Distance
cull_i = CullIndex(List=midpt_3, Indices=cp_4.CPIndex, Wrap=True)

cp_5 = ClosestPoint(Point=graft(merge_2), Cloud=cull_i)  # -> ClosestPoint, CPIndex, Distance
smaller_3 = SmallerThan(FirstNumber=cp_5.Distance, SecondNumber=0.01)  # -> SmallerThan, OrEqualTo
cull_5 = CullPattern(List=graft(merge_2), CullPattern=smaller_3.SmallerThan)
clean = CleanTree(RemoveNulls=True, RemoveInvalid=True, RemoveEmpty=True, Tree=cull_5)  # -> simplify(Tree)
pl_offset = PlaneOffset(BasePlane=clean, Offset=0.1)

pdecon = Deconstruct(Point=clean)  # -> XComponent, YComponent, ZComponent
roundd = RoundToDecimalPlace(NumberX=pdecon.ZComponent, DecimalPlace=1, RoundType=0)  # -> Rounded, Difference
extremums = MinMax(Number=flatten(roundd.Rounded))  # -> Minimum, Maximum
larger = LargerThan(FirstNumber=extremums.Minimum, SecondNumber=roundd.Rounded)  # -> LargerThan, OrEqualTo
cull_6 = CullPattern(List=clean, CullPattern=invert(larger.OrEqualTo))
clean_2 = CleanTree(RemoveNulls=True, RemoveInvalid=True, RemoveEmpty=True, Tree=cull_6)  # -> simplify(Tree)
sort_pt = SortPoints(Points=flatten(clean_2))  # -> Points, Indices
item_7 = ListItem(List=sort_pt.Indices, Index=[0, -1], Wrap=True)
tstat_2 = TreeStatistics(Tree=clean_2)  # -> Paths, Length, Count
item_8 = ListItem(List=tstat_2.Paths, Index=item_7, Wrap=True)
split_6 = SplitTree(Data=clean_2, Masks=flatten(item_8))  # -> Positive, Negative
int = Integer(poly_topo_edge.EdgeLoopStructure)
pln_3 = Plane(split_6.Negative)
crv_3 = Curve(crv_2)
pl_offset_2 = PlaneOffset(BasePlane=pln_3, Offset=0.1)
tstat_3 = TreeStatistics(Tree=pln_3)  # -> Paths, Length, Count
split_7 = SplitTree(Data=simplify(int), Masks=flatten(tstat_3.Paths))  # -> Positive, Negative
path_4 = ConstructPath(Indices=split_7.Positive)
split_8 = SplitTree(Data=simplify(graft(crv_3)), Masks=flatten(path_4))  # -> Positive, Negative
boundary_2 = BoundarySurfaces(Edges=split_8.Positive)
pln_4 = Plane(boundary_2)

tstat_4 = TreeStatistics(Tree=pln_3)  # -> Paths, Length, Count
split_9 = SplitTree(Data=merge_2, Masks=flatten(tstat_4.Paths))  # -> Positive, Negative
merge_3 = Merge(Data1=split_9.Negative, Data2=pl_offset_2)

filter = StreamFilter(Gate=G, Stream0=merge_2, Stream1=merge_3)
c_script_6 = CSharpScript(iEL=simplify(poly_topo_edge.EdgeLoopStructure), iLE=simplify(poly_topo_edge.LoopEdgeStructure), x=simplify(filter))  # -> out, A; inputs iEL: tree of Int32, iLE: tree of Int32, x: tree of Plane
# ---------- c_script_6: C# ----------
    DataTree<object> sortedData = new DataTree<object>();

    for (int i = 0; i < iLE.BranchCount; i++)
    {
      for (int j = 0; j < iLE.Branch(i).Count; j++)
      {
        int index = iEL.Branch(iLE.Branch(i)[j]).IndexOf(i);
        sortedData.Add(x.Branch(iLE.Branch(i)[j])[index], iLE.Paths[i]);
      }
    }
    A = sortedData;
# ---------- end c_script_6 ----------

pln_5 = Plane(c_script_6.A)
split_10 = SplitTree(Data=simplify(pln_5), Masks=flatten(path_4))  # -> Positive, Negative
cp_6 = ClosestPoint(Point=split_10.Positive, Cloud=flatten(pln_3))  # -> ClosestPoint, CPIndex, Distance
cp_7 = ClosestPoint(Point=flatten(pln_3), Cloud=split_10.Positive)  # -> ClosestPoint, CPIndex, Distance
smaller_4 = SmallerThan(FirstNumber=cp_6.Distance, SecondNumber=0.01)  # -> SmallerThan, OrEqualTo
smaller_5 = SmallerThan(FirstNumber=cp_7.Distance, SecondNumber=0.01)  # -> SmallerThan, OrEqualTo
cull_7 = CullPattern(List=cp_6.CPIndex, CullPattern=smaller_4.SmallerThan)
cull_8 = CullPattern(List=cp_7.CPIndex, CullPattern=smaller_5.SmallerThan)
item_9 = ListItem(List=flatten(pl_offset_2), Index=cull_7, Wrap=True)
replace = ReplaceItems(List=split_10.Positive, Item=item_9, Indices=cull_8, Wrap=False)
ppx = PlanePlane(PlaneA=replace, PlaneB=pln_4)
shift = ShiftList(List=ppx, Shift=1, Wrap=True)
llx = LineLine(Line1=ppx, Line2=shift)  # -> ParamA, ParamB, PointA, PointB
pline_2 = PolyLine(Vertices=llx.PointA, Closed=True)  # -> simplify(Polyline)
merge_4 = Merge(Data1=split_8.Negative, Data2=pline_2)

cp_8 = ClosestPoint(Point=midpt_3, Cloud=flatten(pln_5))  # -> ClosestPoint, CPIndex, Distance
item_10 = ListItem(List=flatten(pln_5), Index=cp_8.CPIndex, Wrap=True)
crv_cp = CurveClosestPoint(Point=item_10, Curve=item_4)  # -> Point, Parameter, Distance
sort_3 = SortList(Keys=crv_cp.Parameter, ValuesA=item_10)  # -> Keys, ValuesA
cluster = Cluster_34(A=sort_3.ValuesA, P=align.Plane, O=expr("-x", number_slider))
cluster_2 = Cluster_34(A=sort_3.ValuesA, P=align.Plane, O=number_slider)
crv_4 = Curve(cluster_2)
disc_2 = Discontinuity(Curve=crv_4, Level=1)  # -> Points, Parameters
crv_5 = Curve(cluster)
item_11 = ListItem(List=disc_2.Points, Index=Slider(8, range=0..10), Wrap=True)
points = PointList(Points=disc_2.Points)
explode_4 = Explode(Curve=crv_4, Recursive=True)  # -> Segments, Vertices
merge_5 = Merge(Data1=crv_4, Data2=crv_5)
explode_5 = Explode(Curve=crv_5, Recursive=True)  # -> Segments, Vertices
alicrvseams = AlignCurveSeams(Curves=merge_5, Guide=item_11, Seam=0.5, Snap=False, Iterative=True)  # -> Aligned, Points, R
item_12 = ListItem(List=alicrvseams.Aligned, Index=0, Wrap=True)  # -> Item, Item1
flip = FlipCurve(Curve=item_12.Item, Guide=item_12.Item1)  # -> Curve, Flag
merge_6 = Merge(Data1=simplify(flip.Curve), Data2=simplify(item_12.Item1))
item_13 = ListItem(List=merge_6, Index=0, Wrap=True)  # -> Item, Item1
loft = Loft(Curves=merge_6, Options={Adjust=False, Closed=False, LoftEnds=0, LoftSimp=0, LoftType=3, Rebuild=10, Refit=0.01})
A = ClusterOutput(c_script_6.A)
cap = CapHoles(Brep=loft)
B = ClusterOutput(cap)
filter_2 = StreamFilter(Gate=G, Stream0=crv_2, Stream1=flatten(merge_4))
s_0 = ClusterOutput(filter_2)
pln_6 = ClusterOutput(pln_3)
L_2 = ClusterOutput(cull_6)

# ==== cluster Cluster_36
geo = ClusterInput()
geo_2 = Geometry(geo)
T = ClusterInput()
fmerge = MergeFaces(Brep=geo_2)  # -> Breps, Before, After
clean = CleanTree(RemoveNulls=True, RemoveInvalid=True, RemoveEmpty=True, Tree=T)
tstat = TreeStatistics(Tree=clean)  # -> Paths, Length, Count
split = SplitTree(Data=fmerge.Breps, Masks=flatten(tstat.Paths))  # -> Positive, Negative

debrep = DeconstructBrep(Brep=split.Positive)  # -> Faces, Edges, Vertices
area = Area(Geometry=debrep.Faces)  # -> Area, Centroid
cp = ClosestPoint(Point=clean, Cloud=area.Centroid)  # -> ClosestPoint, CPIndex, Distance

cull_i = CullIndex(List=debrep.Faces, Indices=cp.CPIndex, Wrap=True)
item = ListItem(List=debrep.Faces, Index=cp.CPIndex, Wrap=True)
explode = Explode(Curve=item, Recursive=True)  # -> simplify(Segments), Vertices
c_script = CSharpScript(x=explode.Segments, y=graft(clean))  # -> out, A; inputs x: Line, y: Point3d
# ---------- c_script: C# ----------
    Polyline poly = new Polyline();
    poly.Add(x.From);
    poly.Add(x.To);
    poly.Add(y);
    poly.Add(x.From);
    A = poly;
# ---------- end c_script ----------
boundary = BoundarySurfaces(Edges=c_script.A)
join = BrepJoin(Breps=boundary)  # -> simplify(Breps), Closed
trim = TrimTree(Tree=join.Breps, Depth=1)
merge = Merge(Data1=simplify(trim), Data2=simplify(cull_i))
join_2 = BrepJoin(Breps=merge)  # -> Breps, Closed
cap = CapHoles(Brep=join_2.Breps)
fmerge_2 = MergeFaces(Brep=cap)  # -> Breps, Before, After
S = ClusterInput()
clean_2 = CleanTree(RemoveNulls=True, RemoveInvalid=True, RemoveEmpty=True, Tree=fmerge_2.Breps)
planar = IsPlanar(Surface=S, Interior=True)  # -> Planar, Plane
tstat_2 = TreeStatistics(Tree=clean_2)  # -> Paths, Length, Count
split_2 = SplitTree(Data=fmerge.Breps, Masks=flatten(tstat_2.Paths))  # -> Positive, Negative
merge_2 = Merge(Data1=simplify(split_2.Negative), Data2=simplify(clean_2))  # -> flatten(Result)
bbox = BoundingBox(Content=graft(merge_2), Plane=graft(planar.Plane))  # -> Box, Box_2
debox = DeconstructBox(Box=bbox.Box_2)  # -> Plane, X, Y, Z
R = ClusterOutput(merge_2)
dedomain = DeconstructDomain(Domain=debox.Z)  # -> Start, End
subtraction = Subtraction(A=dedomain.End, B=dedomain.Start)
extremums = MinMax(Number=flatten(subtraction))  # -> Minimum, Maximum
equals = Equality(FirstNumber=flatten(subtraction), SecondNumber=extremums.Minimum)  # -> Equality, Inequality
min = ClusterOutput(extremums.Minimum)
max = ClusterOutput(extremums.Maximum)

# ==== cluster Cluster_37
pln = ClusterInput()
int = ClusterInput()
crv = ClusterInput()
pln_2 = ClusterInput()
pln_3 = Plane(pln)
int_2 = Integer(int)
crv_2 = Curve(crv)
pln_4 = Plane(pln_2)
pl_offset = PlaneOffset(BasePlane=pln_4, Offset=0.1)
tstat = TreeStatistics(Tree=pln_4)  # -> Paths, Length, Count
split = SplitTree(Data=simplify(int_2), Masks=flatten(tstat.Paths))  # -> Positive, Negative
path = ConstructPath(Indices=split.Positive)
split_2 = SplitTree(Data=simplify(graft(crv_2)), Masks=flatten(path))  # -> Positive, Negative
split_3 = SplitTree(Data=simplify(pln_3), Masks=flatten(path))  # -> Positive, Negative
boundary = BoundarySurfaces(Edges=split_2.Positive)
cp = ClosestPoint(Point=split_3.Positive, Cloud=flatten(pln_4))  # -> ClosestPoint, CPIndex, Distance
cp_2 = ClosestPoint(Point=flatten(pln_4), Cloud=split_3.Positive)  # -> ClosestPoint, CPIndex, Distance
smaller = SmallerThan(FirstNumber=cp.Distance, SecondNumber=0.01)  # -> SmallerThan, OrEqualTo
smaller_2 = SmallerThan(FirstNumber=cp_2.Distance, SecondNumber=0.01)  # -> SmallerThan, OrEqualTo
cull = CullPattern(List=cp.CPIndex, CullPattern=smaller.SmallerThan)
cull_2 = CullPattern(List=cp_2.CPIndex, CullPattern=smaller_2.SmallerThan)
item = ListItem(List=flatten(pl_offset), Index=cull, Wrap=True)
pln_5 = Plane(boundary)
replace = ReplaceItems(List=split_3.Positive, Item=item, Indices=cull_2, Wrap=False)
ppx = PlanePlane(PlaneA=replace, PlaneB=pln_5)
shift = ShiftList(List=ppx, Shift=1, Wrap=True)
llx = LineLine(Line1=ppx, Line2=shift)  # -> ParamA, ParamB, PointA, PointB
pline = PolyLine(Vertices=llx.PointA, Closed=True)  # -> simplify(Polyline)
merge = Merge(Data1=split_2.Negative, Data2=pline)
R = ClusterOutput(merge)

# ==== cluster Cluster_38
pi = Pi(Factor=1)
top = ClusterInput()  # Top
polyline_interior_angles = PolylineInteriorAngles(Polyline=top)  # -> Angles, Points
subtraction = Subtraction(A=polyline_interior_angles.Angles, B=pi)
bottom = ClusterInput()  # Bottom
abs = Absolute(Value=subtraction)
sort = SortList(Keys=abs, ValuesA=polyline_interior_angles.Points)  # -> Keys, ValuesA
merge = Merge(Data1=simplify(bottom), Data2=simplify(top))
item = ListItem(List=sort.ValuesA, Index=0, Wrap=True)
flip = FlipCurve(Curve=merge, Guide=bottom)  # -> Curve, Flag
path = ConstructPath(Indices=Slider(163, range=0..1000))
alicrvseams = AlignCurveSeams(Curves=flip.Curve, Guide=item, Snap=True, Iterative=True)  # -> Aligned, Points, R
len = Length(Curve=alicrvseams.Aligned)
larger = LargerThan(FirstNumber=len, SecondNumber=Slider(0, range=0..100))  # -> LargerThan, OrEqualTo
cull = CullPattern(List=alicrvseams.Aligned, CullPattern=larger.LargerThan)
python = GhPythonScript(iCurve=cull)  # -> out, simplify(a); inputs iCurve: Curve
# ---------- python: Python ----------
import Rhino.Geometry as rg



if not iCurve.IsClosed:
    iCurve.MakeClosed(0.0001)

a = iCurve
# ---------- end python ----------
loft = Loft(Curves=python.a, Options={Adjust=False, Closed=False, LoftEnds=0, LoftSimp=0, LoftType=0, Rebuild=10, Refit=0.01})
clean = CleanTree(RemoveNulls=True, RemoveInvalid=True, RemoveEmpty=False, Tree=loft)
cap = CapHoles(Brep=clean)
python_2 = GhPythonScript(x=cap)  # -> out, a; inputs x: Brep
# ---------- python_2: Python ----------
a = x.IsSolid
# ---------- end python_2 ----------
dispatch = Dispatch(List=cap, DispatchPattern=python_2.a)  # -> ListA, ListB
dispatch_2 = Dispatch(List=python.a, DispatchPattern=python_2.a)  # -> ListA, ListB
area = Area(Geometry=dispatch_2.ListB)  # -> Area, Centroid
smaller = SmallerThan(FirstNumber=area.Area, SecondNumber=0.1)  # -> SmallerThan, OrEqualTo
cull_2 = CullPattern(List=dispatch_2.ListB, CullPattern=smaller.SmallerThan)
dispatch_3 = Dispatch(List=dispatch_2.ListB, DispatchPattern=smaller.SmallerThan)  # -> ListA, ListB
disc = Discontinuity(Curve=dispatch_3.ListA, Level=1)  # -> Points, Parameters
duppt = RemoveDuplicatePts(Points=disc.Points, Tolerance=0.001)
plfit = PlaneFit(Points=disc.Points)  # -> Plane, Deviation
c_script = CSharpScript(x=duppt)  # -> out, A; inputs x: list of Point3d
# ---------- c_script: C# ----------
    A = ArePointsCollinear(x);
# ---------- c_script: C# additional code ----------
  public bool ArePointsCollinear(List<Point3d> points)
  {
    // You need at least three points to check for collinearity
    if (points.Count < 3)
      return true;

    for (int i = 0; i < points.Count - 2; i++)
    {
      Point3d p1 = points[i];
      Point3d p2 = points[i + 1];
      Point3d p3 = points[i + 2];

      // Create vectors
      Vector3d v1 = p2 - p1;
      Vector3d v2 = p3 - p1;

      // The cross product of two vectors is a vector that's perpendicular to the two original vectors.
      // If the two original vectors are parallel (and thus the points are collinear), the cross product will be a zero vector.
      Vector3d crossProduct = Vector3d.CrossProduct(v1, v2);

      // If the cross product is not approximately zero, the points are not collinear
      if (crossProduct.Length > 1e-4) // 1e-10 is a small tolerance value
        return false;
    }

    return true;
  }
# ---------- end c_script ----------
brec = BoundingRectangle(Geometry=cull_2, Plane=plfit.Plane, Axis=0, Slide=0, Union=True)  # -> Bounding, DimensionX, DimensionY
dispatch_4 = Dispatch(List=duppt, DispatchPattern=c_script.A)  # -> ListA, ListB
sort_pt = SortPoints(Points=dispatch_4.ListA)  # -> Points, Indices
del = DelaunayMesh(Points=dispatch_4.ListB, Plane=plfit.Plane)
clean_2 = CleanTree(RemoveNulls=True, RemoveInvalid=True, RemoveEmpty=False, Tree=del)
geo = Geometry(dispatch_4.ListA)
duppt_2 = RemoveDuplicatePts(Points=sort_pt.Points, Tolerance=0.001)
medges = MeshEdges(Mesh=del)  # -> NakedEdges, InteriorEdges, NonManifoldEdges
pline = PolyLine(Vertices=duppt_2, Closed=False)
join = JoinCurves(Curves=medges.NakedEdges, Preserve=False)
merge_2 = Merge(Data1=simplify(pline), Data2=simplify(join))
clean_3 = CleanTree(RemoveNulls=True, RemoveInvalid=True, RemoveEmpty=False, Tree=merge_2)
merge_3 = Merge(Data1=simplify(clean_3), Data2=simplify(dispatch_3.ListB))
item_2 = ListItem(List=merge_3, Index=0, Wrap=True)  # -> Item, Item1
c_script_2 = CSharpScript(x=merge_3)  # -> out, A, B; inputs x: list of Polyline; disabled
# ---------- c_script_2: C# ----------
    if(x.Count > 0)
      if(x[0].IsClosed && x[1].IsClosed )
        A = LoftPolylines(x);
      else
        B = x;
# ---------- c_script_2: C# additional code ----------
  public List<Line> LoftPolylines(List<Polyline> polylines)
  {
    // Check if the polylines are not null
    if (polylines == null || polylines.Count == 0)
      throw new Exception("The list of polylines must be defined and cannot be empty.");

    // Determine the polyline with the most points
    int maxIndex = 0;
    int minIndex = 0;
    for (int i = 1; i < polylines.Count; i++)
    {
      if (polylines[i].Count > polylines[maxIndex].Count)
      {
        maxIndex = i;
      }
    }
    if(maxIndex == 0) minIndex = 1;

    Polyline maxPolyline = polylines[maxIndex];
    Polyline minPolyline = polylines[minIndex];

    Plane fitPlane;
    Plane.FitPlaneToPoints(maxPolyline.ToList(), out fitPlane);

    // Create a list to hold the loft surfaces
    List<Line> lines = new List<Line>();

    // Cycle through the points of the polyline with the most points
    for (int i = 0; i < maxPolyline.Count; i++)
    {
      Point3d pt1 = maxPolyline[i];
      List<Point3d> points = minPolyline.ToList();
      List<Point3d> projectedPoints = points.Select(x => fitPlane.ClosestPoint(x)).ToList();
      int index;
      Point3d pt2 = ComputeClosestPoint(projectedPoints, pt1, out index);
      pt2 = points[index];
      // Create a line between the two points and convert it to a curve
      Line line = new Line(pt1, pt2);

      lines.Add(line);



    }
    return lines;
  }

  private Point3d ComputeClosestPoint(List<Point3d> points, Point3d testPoint, out int index)
  {
    int outputIndex = -1;
    // Initialize RTree
    RTree rTree = new RTree();
    for (int i = 0; i < points.Count; i++)
    {
      rTree.Insert(points[i], i);
    }

    Point3d closestPoint = new Point3d();
    double closestDistance = Double.MaxValue;
    EventHandler<RTreeEventArgs> closestPointCallback =
      (object sender, RTreeEventArgs args) =>
      {
      double distance = points[args.Id].DistanceTo(testPoint);
      if (distance < closestDistance)
      {
        closestDistance = distance;
        closestPoint = points[args.Id];
        outputIndex = args.Id;
      }
      };

    rTree.Search(new Sphere(testPoint, closestDistance), closestPointCallback);

    if (outputIndex == -1)
      RhinoApp.WriteLine("Help");

    index = outputIndex;
    return closestPoint;
  }
# ---------- end c_script_2 ----------
explode = Explode(Curve=item_2.Item1, Recursive=True)  # -> Segments, Vertices
disc_2 = Discontinuity(Curve=item_2.Item, Level=1)  # -> Points, Parameters
boundary = BoundarySurfaces(Edges=item_2.Item1)
cull_i = CullIndex(List=explode.Vertices, Indices=-1, Wrap=True)
duppt_3 = RemoveDuplicatePts(Points=disc_2.Points, Tolerance=0.01)
plfit_2 = PlaneFit(Points=cull_i)  # -> Plane, Deviation
project = Project(Geometry=duppt_3, Plane=plfit_2.Plane)  # -> Geometry, Transform
cp = ClosestPoint(Point=cull_i, Cloud=project.Geometry)  # -> ClosestPoint, CPIndex, Distance
item_3 = ListItem(List=duppt_3, Index=cp.CPIndex, Wrap=True)
ln = Line(StartPoint=item_3, EndPoint=cull_i)  # -> simplify(Line)
shift = ShiftList(List=ln, Shift=1, Wrap=True)
c_script_3 = CSharpScript(x=ln, y=shift)  # -> out, simplify(A); inputs x: Line, y: Line
# ---------- c_script_3: C# ----------
    if(x.PointAt(0).DistanceTo(y.PointAt(1)) > y.PointAt(0).DistanceTo(x.PointAt(1)))
    {
      Polyline polyA = new Polyline{x.PointAt(0),x.PointAt(1),y.PointAt(0),x.PointAt(0)};
      Polyline polyB = new Polyline{y.PointAt(0),y.PointAt(1),x.PointAt(1),y.PointAt(0)};
      A = new List<Polyline>{polyA,polyB};
    }
    else
    {
      Polyline polyA = new Polyline{x.PointAt(0),x.PointAt(1),y.PointAt(1),x.PointAt(0)};
      Polyline polyB = new Polyline{y.PointAt(0),y.PointAt(1),x.PointAt(0),y.PointAt(0)};
      A = new List<Polyline>{polyA,polyB};

    }
# ---------- end c_script_3 ----------
boundary_2 = BoundarySurfaces(Edges=c_script_3.A)
trim = TrimTree(Tree=boundary_2, Depth=1)
merge_4 = Merge(Data1=simplify(trim), Data2=simplify(boundary))  # -> simplify(Result)
clean_4 = CleanTree(RemoveNulls=True, RemoveInvalid=True, RemoveEmpty=True, Tree=merge_4)
poly_topo_point = PolygonTopologyPoint(ListOfPolylines=clean_4, Tolerance=0.001)  # -> ListOfPoints, LoopPointStructure, PointLoopStructure
trim_2 = TrimTree(Tree=poly_topo_point.LoopPointStructure, Depth=1)
lng = ListLength(List=poly_topo_point.LoopPointStructure)
item_4 = ListItem(List=poly_topo_point.ListOfPoints, Index=trim_2, Wrap=True)
trim_3 = TrimTree(Tree=lng, Depth=1)
partition = PartitionList(List=item_4, Size=trim_3)
pline_2 = PolyLine(Vertices=partition, Closed=False)
boundary_3 = BoundarySurfaces(Edges=pline_2)
trim_4 = TrimTree(Tree=boundary_3, Depth=1)
join_2 = BrepJoin(Breps=trim_4)  # -> Breps, Closed
cap_2 = CapHoles(Brep=join_2.Breps)
match = MatchTree(Tree=cap_2, Guide=clean_4)
fmerge = MergeFaces(Brep=match)  # -> Breps, Before, After
merge_5 = Merge(Data1=dispatch.ListA, Data2=fmerge.Breps)

alicrvseams_2 = AlignCurveSeams(Curves=flip.Curve, Snap=True, Iterative=True)  # -> Aligned, Points, R

tstat = TreeStatistics(Tree=alicrvseams_2.Aligned)  # -> Paths, Length, Count
area_2 = Area(Geometry=alicrvseams_2.Aligned)  # -> Area, Centroid
item_5 = ListItem(List=area_2.Centroid, Index=0, Wrap=True)
c_script_4 = CSharpScript(x=alicrvseams_2.Aligned)  # -> out, A; inputs x: list of Polyline
# ---------- c_script_4: C# ----------
    A = LoftPolylines(x);
# ---------- c_script_4: C# additional code ----------
  public List<Line> LoftPolylines(List<Polyline> polylines)
  {
    if (polylines == null || polylines.Count == 0)
      return new List<Line>();  // Return an empty list instead of throwing an exception

    int maxIndex = 0;
    for (int i = 1; i < polylines.Count; i++)
    {
      if (polylines[i].Count > polylines[maxIndex].Count)
      {
        maxIndex = i;
      }
    }

    Polyline maxPolyline = polylines[maxIndex];

    Plane fitPlane;
    Plane.FitPlaneToPoints(maxPolyline.ToList(), out fitPlane);

    List<Line> lines = new List<Line>();
    foreach (var pt1 in maxPolyline)
    {
      double t;
      Curve crv = new PolylineCurve(maxPolyline);
      crv.ClosestPoint(pt1, out t);

      Point3d pt2 = ComputeClosestPointOnOtherPolylines(pt1, polylines, maxIndex);
      lines.Add(new Line(pt1, pt2));
    }
    return lines;
  }
  private Point3d ComputeClosestPointOnOtherPolylines(Point3d point, List<Polyline> polylines, int excludeIndex)
  {
    Point3d closestPoint = new Point3d();
    double closestDistance = double.MaxValue;

    for (int i = 0; i < polylines.Count; i++)
    {
      if (i == excludeIndex) continue; // Skip the polyline at excludeIndex

      var polyline = polylines[i];
      foreach (var pt in polyline)
      {
        double distance = point.DistanceTo(pt);
        if (distance < closestDistance)
        {
          closestDistance = distance;
          closestPoint = pt;
        }
      }
    }

    if (closestDistance == double.MaxValue)
    {
      throw new InvalidOperationException("No closest point found on other polylines.");
    }

    return closestPoint;
  }
  
  private Point3d ComputeClosestPoint(List<Point3d> points, Point3d testPoint, out int outputIndex)
  {
    // Initialize RTree
    RTree rTree = new RTree();
    int index = -1;
    for (int i = 0; i < points.Count; i++)
    {
      rTree.Insert(points[i], i);
    }

    Point3d closestPoint = new Point3d();
    double closestDistance = Double.MaxValue;
    EventHandler<RTreeEventArgs> closestPointCallback =
      (object sender, RTreeEventArgs args) =>
      {
      double distance = points[args.Id].DistanceTo(testPoint);
      if (distance < closestDistance)
      {
        closestDistance = distance;
        closestPoint = points[args.Id];
        index = args.Id;
      }
      };

    rTree.Search(new Sphere(testPoint, closestDistance), closestPointCallback);
    outputIndex = index;

    return closestPoint;
  }

  public static Point3d GetClosestEndPoint(Point3d point, List<Line> lines, List<Line> lines2)
  {
    if (lines == null || lines.Count == 0)
    {
      throw new ArgumentException("The list of lines must be defined and cannot be empty.");
    }

    int closestLineIndex = -1;
    double closestDistance = double.MaxValue;

    for (int i = 0; i < lines.Count; i++)
    {
      double t;
      double distance = point.DistanceTo(lines[i].ClosestPoint(point, true));
      if (distance < closestDistance)
      {
        closestDistance = distance;
        closestLineIndex = i;
      }
    }

    if (closestLineIndex != -1)
    {
      Point3d closestEndPoint;
      double distanceToStart = point.DistanceTo(lines[closestLineIndex].From);
      double distanceToEnd = point.DistanceTo(lines[closestLineIndex].To);

      if (distanceToStart < distanceToEnd)
      {
        closestEndPoint = lines2[closestLineIndex].From;
      }
      else
      {
        closestEndPoint = lines2[closestLineIndex].To;
      }

      return closestEndPoint;
    }

    throw new InvalidOperationException("No closest line found.");
  }
# ---------- end c_script_4 ----------
tag = TextTag(Location=flatten(item_5), Text=tstat.Paths)
dupln = RemoveDuplicateLines(Lines=c_script_4.A, Tolerance=0.01)  # -> simplify(UniqueLines)
line_topo = LineTopology(ListOfLines=dupln, Tolerance=0.001)  # -> ListOfPoints, LinePointStructure, PointPointStructure, PointLineStructure, PointLineStructureIndex
split = SplitTree(Data=simplify(dupln), Masks=flatten(path))  # -> Positive, Negative
c_script_5 = CSharpScript(x=dupln, y=line_topo.LinePointStructure, z=line_topo.ListOfPoints)  # -> out, A; inputs x: tree of Line, y: tree of Int32, z: tree of Point3d
# ---------- c_script_5: C# ----------
    DataTree<Polyline> output = new DataTree<Polyline>();

    for (int i = 0; i < x.BranchCount; i++)
    {
      for (int j = 0; j < x.Branch(i).Count; j++)
      {
        List<int> ptsList = new List<int>();
        int currentIndex = j;
        int nextIndex = currentIndex + 1 >= x.Branch(i).Count ? 0 : currentIndex + 1;

        if (y.Branch(new GH_Path(i, currentIndex)).Intersect(y.Branch(new GH_Path(i, nextIndex))).Any())
          ptsList = y.Branch(new GH_Path(i, currentIndex)).Union(y.Branch(new GH_Path(i, nextIndex))).ToList();
        else
        {
          List<int> nextBranch = y.Branch(new GH_Path(i, nextIndex));
          nextBranch.Reverse();
          ptsList = y.Branch(new GH_Path(i, currentIndex)).Concat(nextBranch).ToList();
        }

        List<Point3d> pts = new List<Point3d>();

        for (int k = 0; k < ptsList.Count; k++)
        {
          pts.Add(z.Branch(i)[ptsList[k]]);
        }
        pts.Add(pts[0]);
        if(pts.Count == 5)
        {
          Line lineA = new Line(pts[1], pts[2]);
          Line lineB = new Line(pts[0], pts[3]);
          double a,b;
          if(Rhino.Geometry.Intersect.Intersection.LineLine(lineA, lineB, out a, out b))
            pts = new List<Point3d>{pts[0],pts[1],pts[3],pts[2],pts[0]};

        }
        output.Add(new Polyline(pts), new GH_Path(i));
      }
    }

    A = output;
# ---------- end c_script_5 ----------

loft_2 = Loft(Curves=dupln, Options={Adjust=False, Closed=True, LoftEnds=0, LoftSimp=0, LoftType=3, Rebuild=10, Refit=0.01})  # -> simplify(Loft)

boundary_4 = BoundarySurfaces(Edges=simplify(graft(c_script_5.A)))
trim_5 = TrimTree(Tree=boundary_4, Depth=1)
join_3 = BrepJoin(Breps=trim_5)  # -> Breps, Closed
cap_3 = CapHoles(Brep=join_3.Breps)
clean_5 = CleanTree(RemoveNulls=True, RemoveInvalid=True, RemoveEmpty=False, Tree=cap_3)
c_script_6 = CSharpScript(x=clean_5, y=merge_5)  # -> out, A
# ---------- c_script_6: C# ----------
    if( x == null) A = y;
    else A = x;
# ---------- end c_script_6 ----------
A = ClusterOutput(c_script_6.A)

# ==== cluster Cluster_39
crv = ClusterInput()
crv_2 = Curve(flatten(crv))
I = ClusterInput()
item = ListItem(List=crv_2, Index=I, Wrap=True)
explode = Explode(Curve=item, Recursive=True)  # -> Segments, Vertices
item_2 = ListItem(List=explode.Vertices, Index=0, Wrap=True)
crv_cp = CurveClosestPoint(Point=item_2, Curve=I)  # -> Point, Parameter, Distance
seam = Seam(Curve=I, Seam=crv_cp.Parameter)  # -> flatten(Curve)
i = ClusterInput()
replace = ReplaceItems(List=crv_2, Item=flatten(I), Indices=i, Wrap=False)
L = ClusterOutput(replace)

# ==== cluster Cluster_41
C = ClusterInput()
C_2 = ClusterInput()
cluster = Cluster_40(C=C)  # -> min, max
cluster_2 = Cluster_40(C=C_2)  # -> min, max
x = ClusterInput()
A = ClusterInput()
B = ClusterInput()

c_script = CSharpScript(x=x)  # -> out, A; inputs x: Brep
# ---------- c_script: C# ----------
    A = x.IsSolid;
# ---------- end c_script ----------
ma = MassAddition(Input=c_script.A)  # -> Result, PartialResults
lng = ListLength(List=c_script.A)
subtraction = Subtraction(A=lng, B=ma.Result)
equals = Equality(FirstNumber=subtraction, SecondNumber=0)  # -> Equality, Inequality

concat = Concatenate(FragmentD="Bottom Poly Planarity: Min = ", FragmentA=cluster_2.min, FragmentC=", Max = ", FragmentB=cluster_2.max)
concat_2 = Concatenate(FragmentD="Top Poly Planarity: Min = ", FragmentA=cluster.min, FragmentC=", Max = ", FragmentB=cluster.max)
concat_3 = Concatenate(FragmentD="Thickness: Min = ", FragmentA=A, FragmentC=", Max = ", FragmentB=B)
concat_4 = Concatenate(FragmentD="Open Breps = ", FragmentA=equals.Inequality)
merge = Merge(Data1=concat_3, Data2=concat_2, Data3=concat, Data4=concat_4)
R = ClusterOutput(merge)

# ==== cluster Cluster_34
P = ClusterInput()
O = ClusterInput()
A = ClusterInput()
pl_offset = PlaneOffset(BasePlane=P, Offset=O)
pln = Plane(A)
ppx = PlanePlane(PlaneA=A, PlaneB=pl_offset)
shift = ShiftList(List=ppx, Shift=1, Wrap=True)
midpt = CurveMiddle(Curve=shift)
llx = LineLine(Line1=ppx, Line2=shift)  # -> ParamA, ParamB, PointA, PointB
c_script = CSharpScript(x=llx.PointA, y=midpt)  # -> out, A
# ---------- c_script: C# ----------
    if(x == null) A = y;
    else A = x;
# ---------- end c_script ----------
pline = PolyLine(Vertices=c_script.A, Closed=True)
simplify = Simplify(Curve=pline)
explode = Explode(Curve=simplify, Recursive=True)  # -> Segments, Vertices
cullpt = CullDuplicates(Points=explode.Vertices, Tolerance=0.1, CullMode=1)  # -> Points, Indices, Valence
pline_2 = PolyLine(Vertices=explode.Vertices, Closed=True)
P_2 = ClusterOutput(simplify)

# ==== cluster Cluster_40
C = ClusterInput()
explode = Explode(Curve=C, Recursive=True)  # -> Segments, Vertices
plfit = PlaneFit(Points=explode.Vertices)  # -> Plane, flatten(Deviation)
extremums = MinMax(Number=plfit.Deviation)  # -> Minimum, Maximum
min = ClusterOutput(extremums.Minimum)
max = ClusterOutput(extremums.Maximum)
