# Grasshopper definition DataDrop 17.gh (Grasshopper 1.0.7)
# plug-ins: Speckle 2, Pufferfish, ClipperComponents, LunchBox, LCRL.Grasshopper, Human, eleFront, Mensa, Sandbox Topology, Heteroptera, NGon, MetaHopper

# Key
# Inputs
# Outputs
# Bake Items
# Parameters
c_script = CSharpScript()
# ---------- c_script: C# ----------
    doc.AdjustModelUnitSystem(UnitSystem.Meters, false);
    Rhino.RhinoDoc.ActiveDoc.ModelAbsoluteTolerance = 0.001;
# ---------- end c_script ----------

panel = Panel("https://app.speckle.systems/projects/fa2b5c68c0/models/1a387dc852")
receive = Receive(
    Stream=panel,
    AutoReceive=False,
    CurrentComponentState="up_to_date",
    ExpandOutput=True,
    LastInfoMessage="Lasath Siriwardena @ 06/10/2024 15:38:48: [Rev 7] Updated according to DD15+ IBB T130V01 (id:ceb9de41df)",
    ReceiveOnOpen=True,
    ReceivedCommitId="ceb9de41df",
    StreamWrapper="https://app.speckle.systems/projects/fa2b5c68c0/models/01-design/1-base_surface",
    selectedKitName="Objects")  # -> Info, Data
dso = DeconstructSpeckleObject(SpeckleObject=receive.Data, selectedKitName="Objects")  # -> Base_Surfaces, Brims, ChangeLog, Columns, Facade, Grid, Parent, Skylight_Shell

# ----
# Evaluation
# Speckle
panel_2 = Panel("fa2b5c68c0")
number_slider = Slider(0, range=0..100)
number_slider_2 = Slider(8, range=0..10)
merge = Merge(Data1=number_slider, Data2=number_slider_2)
brim_branches = Panel("{0,8;*}")
concat = Concatenate(FragmentA="{", FragmentB=number_slider, FragmentC=",", FragmentD=number_slider_2, FragmentE=";", FragmentF="*}")

dso_2 = DeconstructSpeckleObject(SpeckleObject=receive.Data, selectedKitName="Objects")  # -> Base_Surfaces, Brims, ChangeLog, Columns, Facade, Grid, Parent, Skylight_Shell
dso_3 = DeconstructSpeckleObject(SpeckleObject=dso_2.Columns, selectedKitName="Objects")  # -> Centerlines, Profile, Type
dso_4 = DeconstructSpeckleObject(SpeckleObject=dso.Facade, selectedKitName="Objects")  # -> IFC, Mesh, Outline

dso_5 = DeconstructSpeckleObject(SpeckleObject=dso.Facade, selectedKitName="Objects")  # -> IFC, Mesh, Outline

flatten = FlattenTree(Tree=dso.Base_Surfaces, Path="{0}")  # disabled
c_script_2 = CSharpScript(x=simplify(graft(flatten)), y=flatten(dso.Brims))  # -> out, A; inputs x: tree, y: list; disabled
# ---------- c_script_2: C# ----------
    DataTree<object> tree = x;
    foreach (var item in y)
    {
      int len = tree.BranchCount;
      tree.Add(item, new GH_Path(len));
    }
    A = tree;
# ---------- end c_script_2 ----------

geo = Geometry(dso_5.Outline)

panel_3 = Panel("https://app.speckle.systems/projects/fa2b5c68c0/models/6f0c5e029f")
receive_2 = Receive(
    Stream=panel_3,
    AutoReceive=False,
    CurrentComponentState="up_to_date",
    ExpandOutput=True,
    LastInfoMessage="Lasath Siriwardena @ 08/06/2024 09:01:54: Updated Data from Felix - 240712_250_cassettes.3dm (id:ac9615ec9e)",
    ReceiveOnOpen=True,
    ReceivedCommitId="ac9615ec9e",
    StreamWrapper="https://app.speckle.systems/projects/fa2b5c68c0/models/03-fabrication/02-outsourcing",
    selectedKitName="Objects")  # -> Info, Data
dso_6 = DeconstructSpeckleObject(SpeckleObject=receive_2.Data, selectedKitName="Objects")  # -> Geometry, GH_Path, IsOutsourced, Type

panel_4 = Panel("https://app.speckle.systems/projects/fa2b5c68c0/models/a8081a08c3")
receive_3 = Receive(
    Stream=panel_4,
    AutoReceive=False,
    CurrentComponentState="up_to_date",
    ExpandOutput=True,
    LastInfoMessage="Lasath Siriwardena @ 08/26/2025 11:07:31: DD16 IBB Update T601 V06 250811  (id:230766f548)",
    ReceiveOnOpen=True,
    ReceivedCommitId="230766f548",
    StreamWrapper="https://app.speckle.systems/projects/fa2b5c68c0/models/10-structural/04-connections",
    selectedKitName="Objects")  # -> Info, Data
dso_7 = DeconstructSpeckleObject(SpeckleObject=receive_3.Data, selectedKitName="Objects")  # -> Parent, Roof
dso_8 = DeconstructSpeckleObject(SpeckleObject=dso_7.Roof, selectedKitName="Objects")  # -> BeamWidthsSegmentDT, BottomPlateKerto, CrossScrewSpecialCase5d, FingerJointEdgeType, FingerJointEdges, ScrewsEdgeDT
dso_9 = DeconstructSpeckleObject(SpeckleObject=dso_8.BottomPlateKerto, selectedKitName="Objects")  # -> GH_Path, IsBottmPlateKerto, Paths

panel_5 = Panel("https://app.speckle.systems/projects/fa2b5c68c0/models/afb4a95b2b")
receive_4 = Receive(
    Stream=panel_5,
    AutoReceive=False,
    CurrentComponentState="up_to_date",
    ExpandOutput=True,
    LastInfoMessage="Lasath Siriwardena @ 07/28/2025 12:27:22: Fixed Missing Fabrication Data (id:ecb96cefa4)",
    ReceiveOnOpen=True,
    ReceivedCommitId="ecb96cefa4",
    StreamWrapper="https://app.speckle.systems/projects/fa2b5c68c0/models/04-onsite/01-pockets",
    selectedKitName="Objects")  # -> Info, Data
dso_10 = DeconstructSpeckleObject(SpeckleObject=receive_4.Data, selectedKitName="Objects")  # -> FabricationData, Geometry, GH_Path

panel_6 = Panel("https://app.speckle.systems/projects/fa2b5c68c0/models/bdd416d68b")
receive_5 = Receive(
    Stream=panel_6,
    AutoReceive=False,
    CurrentComponentState="up_to_date",
    ExpandOutput=True,
    LastInfoMessage="Lasath Siriwardena @ 10/18/2024 15:11:36: LPH5 Update Screw Pairs DD15+++ (id:206591aa4c)",
    ReceiveOnOpen=True,
    ReceivedCommitId="206591aa4c",
    StreamWrapper="https://app.speckle.systems/projects/fa2b5c68c0/models/10-structural/02-development",
    selectedKitName="Objects")  # -> Info, Data

dso_11 = DeconstructSpeckleObject(SpeckleObject=receive_5.Data, selectedKitName="Objects")  # -> Parent, Roof
panel_7 = Panel(receive_5.Info)
dso_12 = DeconstructSpeckleObject(SpeckleObject=dso_11.Roof, selectedKitName="Objects")  # -> BeamWidths, BeamPoints, BottomHoleAdjusted, GH_Path
cluster = Cluster_6(D_2=dso_12.BottomHoleAdjusted, D=dso_12.GH_Path)
cluster_2 = Cluster_6(D_2=dso_12.BeamWidths, D=dso_12.GH_Path)
cluster_3 = Cluster_6(D_2=dso_12.BeamPoints, D=dso_12.GH_Path)

panel_8 = Panel(dso_6.IsOutsourced)
tree = CreateTree(Data=dso_10.Geometry, Path=dso_10.GH_Path)
tree_2 = CreateTree(Data=dso_10.FabricationData, Path=dso_10.GH_Path)

area = Area(Geometry=tree)  # -> Area, Centroid
cullpt = CullDuplicates(Points=area.Centroid, Tolerance=0.0001, CullMode=1)  # -> Points, Indices, Valence
item = ListItem(List=tree, Index=cullpt.Indices, Wrap=True)

panel_9 = Panel("https://app.speckle.systems/projects/fa2b5c68c0/models/bec8474d8d")
receive_6 = Receive(
    Stream=panel_9,
    AutoReceive=False,
    CurrentComponentState="up_to_date",
    ExpandOutput=True,
    LastInfoMessage="Tobias Schwinn @ 06/10/2024 08:24:32: Add missing cutouts at brim column heads (id:f56576bac1)",
    ReceiveOnOpen=True,
    ReceivedCommitId="f56576bac1",
    StreamWrapper="https://app.speckle.systems/projects/fa2b5c68c0/models/12-fhz",
    selectedKitName="Objects")  # -> Info, Data
panel_10 = Panel(receive_6.Info)
dso_13 = DeconstructSpeckleObject(SpeckleObject=receive_6.Data, selectedKitName="Objects")  # -> Brim_cutout, Downpipes, Elevator_vent, Pin_cutout, Pipes, PVDucts, Ventilation_duct

beam_tolerance = Slider(0.01, range=0..1)
acoustic_offset = Slider(0.03, range=0..1)

# ---- group: Beam Widths
clean = CleanTree(RemoveNulls=True, RemoveInvalid=True, RemoveEmpty=True, Tree=cluster_2)  # -> simplify(Tree)
num = Number(clean)
division = Division(A=num, B=100)

# ----
tstat = TreeStatistics(Tree=item)  # -> Paths, Length, Count

geo_2 = Geometry(cluster)
edges = BrepEdges(Brep=geo_2)  # -> Naked, Interior, NonManifold
join = JoinCurves(Curves=edges.Naked, Preserve=False)  # -> simplify(Curves)
len = Length(Curve=join)
sort = SortList(Keys=len, ValuesA=join)  # -> Keys, ValuesA
c_script_3 = CSharpScript(x=sort.ValuesA)  # -> out, A; inputs x: list
# ---------- c_script_3: C# ----------
    if(x.Count == 2)
      A = x;
# ---------- end c_script_3 ----------
clean_2 = CleanTree(RemoveNulls=True, RemoveInvalid=True, RemoveEmpty=True, Tree=c_script_3.A)  # -> simplify(Tree)
item_2 = ListItem(List=clean_2, Index=0, Wrap=True)  # -> Item, Item1
c_script_4 = CSharpScript(x=sort.ValuesA)  # -> out, A; inputs x: list
# ---------- c_script_4: C# ----------
    if(x.Count == 2)
      A = x[0];
# ---------- end c_script_4 ----------
crvprox = CurveProximity(CurveA=item_2.Item, CurveB=item_2.Item1)  # -> PointA, PointB, Distance

swatch = ColourSwatch(SwatchColor=RGB(250, 0, 0))  # disabled
swatch_2 = ColourSwatch(SwatchColor=RGB(0, 0, 0))  # disabled
swatch_3 = ColourSwatch(SwatchColor=RGB(250, 0, 0))  # disabled
swatch_4 = ColourSwatch(SwatchColor=RGB(0, 0, 0))  # disabled
concat_2 = Concatenate(FragmentA="{", FragmentB=Slider(2, range=0..10), FragmentE=";", FragmentC="*", FragmentD="}")  # disabled
panel_11 = Panel("""{3;52}
{3;151}
{5;52}
{5;151}""")
swatch_5 = ColourSwatch(SwatchColor=RGB(250, 0, 0))  # disabled
swatch_6 = ColourSwatch(SwatchColor=RGB(0, 0, 0))  # disabled
data = Data(dso_9.Paths)

drain_width = Slider(0.18, range=0..1)
end_height = Slider(0.06, range=0..0.1)

panel_12 = Panel("https://app.speckle.systems/projects/fa2b5c68c0/models/a207298a91")
receive_7 = Receive(
    Stream=panel_12,
    AutoReceive=False,
    CurrentComponentState="up_to_date",
    ExpandOutput=True,
    LastInfoMessage="Lasath Siriwardena @ 11/23/2025 21:30:15: LPH5 Rev 7 - DD 17 - Removed old Column Head Plate from T612 Location (West) (id:1c27a4f8fd)",
    ReceiveOnOpen=False,
    ReceivedCommitId="1c27a4f8fd",
    StreamWrapper="https://app.speckle.systems/projects/fa2b5c68c0/models/02-development/5-solid_steel",
    selectedKitName="Objects")  # -> Info, Data
dso_14 = DeconstructSpeckleObject(SpeckleObject=receive_7.Data, selectedKitName="Objects")  # -> Parent, ReleaseNotes, Solids
dso_15 = DeconstructSpeckleObject(SpeckleObject=dso_14.Solids, selectedKitName="Objects")  # -> Field, Ridge, UPE
dso_16 = DeconstructSpeckleObject(SpeckleObject=dso_15.Ridge, selectedKitName="Objects")  # -> Column_heads, Column_heads_brim, Dowel_plugs, Flanschblech, Flanschblech_solidOperator, Ridge_plates, Tension_elements, Winkelverbinder
dso_17 = DeconstructSpeckleObject(SpeckleObject=dso_16.Column_heads, selectedKitName="Objects")  # -> Bolt_centerlines, Bolts, Crown_plates, Dowel_plugs, Head_plates, Stiffener_centerlines, Stiffener_solidOperator, Stiffeners

panel_13 = Panel(receive_7.Info)

dso_18 = DeconstructSpeckleObject(SpeckleObject=dso_15.Field, selectedKitName="Objects")  # -> Bolt, Column_heads, GH_Path, Top_plate
dso_19 = DeconstructSpeckleObject(SpeckleObject=dso_17.Crown_plates, selectedKitName="Objects")  # -> Geometry, JSON, PreCut
dso_20 = DeconstructSpeckleObject(SpeckleObject=dso_18.Column_heads, selectedKitName="Objects")  # -> Geometry, JSON
dso_21 = DeconstructSpeckleObject(SpeckleObject=dso_18.Top_plate, selectedKitName="Objects")  # -> Geometry, JSON; disabled
dso_22 = DeconstructSpeckleObject(SpeckleObject=dso_16.Winkelverbinder, selectedKitName="Objects")  # -> Geometry, GeometryJSON, PreCut, Screws; disabled
dso_23 = DeconstructSpeckleObject(SpeckleObject=dso_16.Ridge_plates, selectedKitName="Objects")  # -> Geometry, JSON, PreCut
c_script_5 = CSharpScript(x=dso_21.JSON)  # -> out, A; inputs x: String; disabled
# ---------- c_script_5: C# ----------
    A = Brep.FromJSON(x);
# ---------- end c_script_5 ----------
c_script_6 = CSharpScript(x=dso_19.JSON)  # -> out, A; inputs x: String; disabled; same code as c_script_5
c_script_7 = CSharpScript(x=dso_23.JSON)  # -> out, A; inputs x: String; disabled; same code as c_script_5
c_script_8 = CSharpScript(x=dso_22.GeometryJSON)  # -> out, A; inputs x: String; disabled
# ---------- c_script_8: C# ----------
    if(x!=null) A = Brep.FromJSON(x);
# ---------- end c_script_8 ----------

dso_24 = DeconstructSpeckleObject(SpeckleObject=receive_6.Data, selectedKitName="Objects")  # -> Brim_cutout, Downpipes, Elevator_vent, Pin_cutout, Pipes, PVDucts, Ventilation_duct

area_2 = Area(Geometry=dso_24.Downpipes)  # -> Area, Centroid
scale_nu = ScaleNU(Geometry=dso_24.Downpipes, Plane=area_2.Centroid, ScaleX=1, ScaleY=1, ScaleZ=2)  # -> Geometry, Transform
debrep = DeconstructBrep(Brep=scale_nu.Geometry)  # -> Faces, Edges, Vertices
shrinktrimsrf = ShrinkTrimmedSurface(Surface=debrep.Faces)  # -> Shrunken, Underlying, R
join_2 = BrepJoin(Breps=shrinktrimsrf.Shrunken)  # -> flatten(Breps), Closed

geo_3 = Geometry(dso_20.Geometry)
geo_4 = Geometry([c_script_5.A, dso_20.Geometry])
geo_5 = Geometry(dso_22.PreCut)
geo_6 = Geometry(dso_17.Head_plates)
geo_7 = Geometry(dso_16.Flanschblech)
geo_8 = Geometry(dso_19.PreCut)
geo_9 = Geometry(dso_16.Column_heads_brim)
geo_10 = Geometry(dso_16.Tension_elements)
geo_11 = Geometry(c_script_7.A)
geo_12 = Geometry(dso_17.Stiffeners)

geo_13 = Geometry(dso_23.PreCut)

tension_band_bottom_cut = Slider(0.02, range=0..1)
addtop_and_bottom_tol = BooleanToggle(False)
tension_band_top_and_bttom_tolerance = Slider(0.05, range=0..1)
fin_tolerance = Slider(0.01, range=0..0.01)

# ----
# On-site Pockets
dso_25 = DeconstructSpeckleObject(SpeckleObject=tree_2, selectedKitName="Objects")  # -> BottomPlane, ReferencePoint, ToolPath, TopPlate
dist = Distance(PointA=dso_25.BottomPlane, PointB=dso_25.TopPlate)
pln = Plane(dso_25.BottomPlane)
geo_14 = Geometry(item)
data_2 = Data(dso_25.ToolPath)
data_3 = Data(dist)

number_slider_3 = Slider(0, range=0..100)

cso = CreateSpeckleObject(
    FrameBase=pln,
    Geo=graft(geo_14),
    ToolPath=data_2,
    OffsetPositive=data_3,
    OffsetNegative=Slider(0, range=0..100),
    Name="Onsite Pockets",
    Type="Pocket",
    selectedKitName="Objects")
trim = TrimTree(Tree=cso, Depth=1)

number_slider_4 = Slider(0.1, range=0..0.1)
data_4 = Data(tstat.Paths)
off_ibb_drawing_t130 = BooleanToggle(True)

note = Panel("""[LPH5 Rev_7] 
- DD17 WIP""")

monotone = BooleanToggle(False)
panel_14 = Panel("""Shell
Shell_Index
Type""")

panel_15 = Panel("""{3;48}
{3;155}
{5;48}
{5;155}
{6;51}
{6;64}""")

panel_16 = Panel("""{1;49}
{1;86}
{3;50}
{3;153}
{5;50}
{5;153}
{7;49}
{7;86}""")

panel_17 = Panel("""{1;62}
{2;42}
{2;61}
{2;74}
{2;75}
{2;84}
{2;103}
{3;73}
{3;83}
{3;120}
{3;130}
{4;42}
{4;61}
{4;74}
{4;75}
{4;84}
{4;103}
{5;73}
{5;83}
{5;120}
{5;130}
{6;94}
{7;62}""")

clt_offset = Slider(0.03, range=0..0.1)
clt_offset_2 = Slider(0.02, range=0..0.1)
clt_offset_3 = Slider(0.02, range=0..0.1)
merge_2 = Merge(Data1=clt_offset, Data2=clt_offset_2, Data3=clt_offset_3)

number_slider_5 = Slider(0.015, range=0..0.1)
number_slider_6 = Slider(0.1, range=0..1)

offset_from_top_of_top_plate = Slider(0.01, range=0..0.01)
number_slider_7 = Slider(0.3, range=0..1)
screw_length = Slider(0.1, range=0..0.1)
spacing_d = Slider(5, range=0..10)
diameter = Slider(6, range=0..10)

# ---- group: Scales the beam to steps of 2cm with a min of 2cm
# For MB it should be zero
raw_beam_offset = Slider(0, range=0..0.1)

# ---- group: Offset of Split (90mm To, 110mm Bottom
number_slider_8 = Slider(0, range=0..0.01)

# ----
note_2 = Panel(note)

panel_18 = Panel("https://speckle.xyz/streams/fa2b5c68c0/branches/02-development%2F6-connections_battens")
_3s_plate = _3SPlate(ActiveMaterialIndex=2)
_3s_plate_2 = _3SPlate(ActiveMaterialIndex=4)

# ---- group: Planar Poly
# - LCRL LPH5 Development Model  -
panel_19 = Panel("https://app.speckle.systems/projects/fa2b5c68c0/models/443f7f142a")

# ----
receive_8 = Receive(
    Stream=panel_19,
    AutoReceive=False,
    CurrentComponentState="up_to_date",
    ExpandOutput=True,
    LastInfoMessage="Lasath Siriwardena @ 11/23/2025 17:46:36: [Rev_7] Brim Update to 1.78m Plan Width for Drain (id:c3b3abdd6a)",
    ReceiveOnOpen=False,
    ReceivedCommitId="c3b3abdd6a",
    StreamWrapper="https://app.speckle.systems/projects/fa2b5c68c0/models/01-design/4-planarization",
    selectedKitName="Objects")  # -> Info, Data
panel_20 = Panel(receive_8.Info)

# ---- group: Planar Poly (continued)
dso_26 = DeconstructSpeckleObject(SpeckleObject=receive_8.Data, selectedKitName="Objects")  # -> Parent, Roof
dso_27 = DeconstructSpeckleObject(SpeckleObject=dso_26.Roof, selectedKitName="Objects")  # -> Base_Surface, Segments
dso_28 = DeconstructSpeckleObject(SpeckleObject=dso_27.Segments, selectedKitName="Objects")  # -> Fibre_dir, HasColumn, HasVent, Id, Polyline, Rect, Type, Vent

# ---- group: Bottom Plate is Source
data_5 = Data(dso_28.Type)

# ----
edges_2 = BrepEdges(Brep=dso_27.Base_Surface)  # -> Naked, Interior, NonManifold
join_3 = JoinCurves(Curves=edges_2.Naked, Preserve=False)
len_2 = Length(Curve=join_3)
sort_2 = SortList(Keys=len_2, ValuesA=join_3)  # -> Keys, reverse(ValuesA)
item_3 = ListItem(List=sort_2.ValuesA, Index=0, Wrap=True)

c_script_9 = CSharpScript(x=data_5, y=ColourSwatch(SwatchColor=RGBA(255, 0, 77, 30)), z=ColourSwatch(SwatchColor=RGBA(0, 255, 60, 19)))  # -> out, A; inputs x: String
# ---------- c_script_9: C# ----------
    if(x.Contains("solid")) A = y;
    else A = z;
# ---------- end c_script_9 ----------
boundary = BoundarySurfaces(Edges=dso_28.Polyline)

crv = Curve(dso_28.Vent)

area_3 = Area(Geometry=dso_28.Polyline)  # -> Area, Centroid
item_4 = ListItem(List=dso_4.Outline, Index=0, Wrap=True)
project = Project(Geometry=area_3.Centroid, Plane=PlaneXY(0, 0, 0))  # -> Geometry, Transform
brec = BoundingRectangle(Geometry=item_4, Plane=PlaneXY(0, 0, 0), Axis=0, Slide=0, Union=True)  # -> Bounding, DimensionX, DimensionY
project_2 = Project(Geometry=brec.Bounding, Plane=PlaneXY(0, 0, 0))  # -> Geometry, Transform
incurve = PointInCurve(Point=project.Geometry, Curve=project_2.Geometry)  # -> Relationship, Point
equals = Equality(FirstNumber=incurve.Relationship, SecondNumber=2)  # -> Equality, Inequality
cull = CullPattern(List=project.Geometry, CullPattern=equals.Equality)  # -> simplify(List)
clean_3 = CleanTree(RemoveNulls=True, RemoveInvalid=True, RemoveEmpty=True, Tree=cull)
tstat_2 = TreeStatistics(Tree=clean_3)  # -> Paths, Length, Count
tag = TextTag(Location=flatten(clean_3), Text=tstat_2.Paths)

trim_2 = TrimTree(Tree=simplify(dso_28.Polyline), Depth=1)
python = GhPythonScript(x="0_020", y=dso_28.Id)  # -> out, a
# ---------- python: Python ----------
if x == y : a = True;
else : a = False;
# ---------- end python ----------

area_4 = Area(Geometry=dso_28.Polyline)  # -> Area, Centroid
pln_2 = Plane(dso_28.Rect)
pl_origin = PlaneOrigin(Base=pln_2, Origin=area_4.Centroid)

cull_2 = CullPattern(List=dso_28.Polyline, CullPattern=python.a)

preview = CustomPreview(Geometry=boundary, Material=c_script_9.A)
previewlw = CustomPreviewLineweights(Geometry=crv, Shader=ColourSwatch(SwatchColor=RGB(255, 255, 255)), Thickness=Slider(3, range=0..10), Absolute=False)

tstat_3 = TreeStatistics(Tree=simplify(area_4.Centroid))  # -> Paths, Length, Count
clean_4 = CleanTree(RemoveNulls=True, RemoveInvalid=True, RemoveEmpty=True, Tree=simplify(cull_2))  # -> simplify(Tree)
tstat_4 = TreeStatistics(Tree=clean_4)  # -> Paths, Length, Count
panel_21 = Panel(tstat_4.Paths)

tstat_5 = TreeStatistics(Tree=simplify(dso_28.Polyline))  # -> Paths, Length, Count
tree_3 = CreateTree(Data=panel_8, Path=tstat_5.Paths)

trim_3 = TrimTree(Tree=simplify(dso_28.Polyline), Depth=1)

panel_22 = Panel("https://app.speckle.systems/projects/fa2b5c68c0/models/b1504d0473")
receive_9 = Receive(
    Stream=panel_22,
    AutoReceive=False,
    CurrentComponentState="up_to_date",
    ExpandOutput=True,
    LastInfoMessage="Lasath Siriwardena @ 11/21/2025 22:56:51: LPH5 DD17 Full DataTree Fix (id:5329e2dbf7)",
    ReceiveOnOpen=False,
    ReceivedCommitId="5329e2dbf7",
    StreamWrapper="https://app.speckle.systems/projects/fa2b5c68c0/models/02-development/1-bottom_holes",
    selectedKitName="Objects")  # -> Info, Data
dso_29 = DeconstructSpeckleObject(SpeckleObject=receive_9.Data, selectedKitName="Objects")  # -> BottomHoles, Parent
tstat_6 = TreeStatistics(Tree=simplify(graft(trim_3)))  # -> Paths, Length, Count
dso_30 = DeconstructSpeckleObject(SpeckleObject=dso_29.BottomHoles, selectedKitName="Objects")  # -> GH_Path, Outline, Type
tree_4 = CreateTree(Data=dso_30.Type, Path=dso_30.GH_Path, Ensure=tstat_6.Paths)
tree_5 = CreateTree(Data=dso_30.Outline, Path=dso_30.GH_Path, Ensure=tstat_6.Paths)
clean_5 = CleanTree(RemoveNulls=True, RemoveInvalid=True, RemoveEmpty=False, Tree=tree_5)
clean_6 = CleanTree(RemoveNulls=True, RemoveInvalid=True, RemoveEmpty=False, Tree=tree_4)

extremums = MinMax(Number=division)  # -> Minimum, Maximum
split = SplitTree(Data=simplify(extremums.Maximum), Masks=flatten(tstat_2.Paths))  # -> Positive, Negative

data_6 = Data(clean_5)
data_7 = Data(clean_6)

trim_4 = TrimTree(Tree=data_6, Depth=1)  # disabled
tstat_7 = TreeStatistics(Tree=split.Positive)  # -> Paths, Length, Count; disabled
split_2 = SplitTree(Data=trim_4, Masks=flatten("{!6,7;*}"))  # -> Positive, Negative; disabled
split_3 = SplitTree(Data=data_6, Masks=flatten(tstat_7.Paths))  # -> Positive, Negative; disabled
area_5 = Area(Geometry=split_3.Positive)  # -> Area, Centroid; disabled
area_6 = Area(Geometry=split_2.Positive)  # -> Area, Centroid; disabled
area_7 = Area(Geometry=split_2.Negative)  # -> Area, Centroid; disabled
ma = MassAddition(Input=flatten(area_6.Area))  # -> Result, PartialResults; disabled
ma_2 = MassAddition(Input=flatten(area_7.Area))  # -> Result, PartialResults; disabled

# ----
# Bottom Hole Area Check
extremums_2 = MinMax(Number=flatten(division))  # -> Minimum, Maximum; disabled
gradient = Gradient(
    LowerLimit=extremums_2.Minimum,
    UpperLimit=extremums_2.Maximum,
    Parameter=split.Positive,
    stops=[0: RGB(0, 128, 0), 0.5: RGB(255, 255, 0), 1: RGB(255, 0, 0)])  # disabled
tag_2 = TextTag(Location=area_5.Centroid, Text=split.Positive, Colour=gradient)
panel_23 = Panel(ma_2.Result)
panel_24 = Panel(ma.Result)

area_8 = Area(Geometry=data_6)  # -> Area, Centroid; disabled
area_9 = Area(Geometry=data_6)  # -> Area, Centroid; disabled
smaller = SmallerThan(FirstNumber=area_9.Area, SecondNumber=area_8.Area)  # -> SmallerThan, OrEqualTo; disabled
c_script_10 = CSharpScript(x=smaller.SmallerThan)  # -> out, A; inputs x: Boolean; disabled
# ---------- c_script_10: C# ----------
    if(x) A = "red";
    else A = "green";
# ---------- end c_script_10 ----------
previewlw_2 = CustomPreviewLineweights(Geometry=data_6, Shader=c_script_10.A, Absolute=False)  # disabled

split_4 = SplitTree(Data=simplify(data_6), Masks=flatten(panel_11))  # -> Positive, Negative

clean_7 = CleanTree(RemoveNulls=True, RemoveInvalid=True, RemoveEmpty=True, Tree=data_6)
boundary_2 = BoundarySurfaces(Edges=clean_7)  # -> simplify(Surfaces)

planesrf = PlaneSurface(Plane=PlaneXY(0, 0, 0), XSize=Domain(-10, 10), YSize=Domain(-10, 10))
flip = Flip(Surface=boundary_2, Guide=planesrf)  # -> Surface, Result

poly_topo_edge = PolygonTopologyEdge(ListOfPolylines=trim_2, Tolerance=0.001)  # -> ListOfEdges, LoopEdgeStructure, EdgeLoopStructure
poly_topo_edge_filter = PolygonTopologyEdgeFilter(EdgeList=poly_topo_edge.ListOfEdges, EdgeLoopStructure=poly_topo_edge.EdgeLoopStructure, ValencyFilter=1)  # -> ListOfEdgeIDs, ListOfEdges
join_4 = JoinCurves(Curves=poly_topo_edge_filter.ListOfEdges, Preserve=False)
len_3 = Length(Curve=join_4)
sort_3 = SortList(Keys=len_3, ValuesA=join_4)  # -> Keys, reverse(ValuesA)
item_5 = ListItem(List=sort_3.ValuesA, Index=0, Wrap=True)

crv_2 = Curve(dso_28.Polyline)
c_script_11 = CSharpScript(x=crv_2)  # -> out, simplify(A); inputs x: Polyline
# ---------- c_script_11: C# ----------
    A = CalculateInteriorAngles(x);
# ---------- c_script_11: C# additional code ----------
  // Standalone method to calculate interior angles (including reflex angles > 180°)
  private List<double> CalculateInteriorAngles(Polyline polyline)
  {
    List<double> interiorAngles = new List<double>();
  
    if (polyline == null || !polyline.IsValid)
    {
      return interiorAngles;
    }
  
    // Get the plane of the polyline using fit plane to determine the correct normal vector
    List<Point3d> pts = new List<Point3d>();
    int pointCount = polyline.IsClosed ? polyline.Count - 1 : polyline.Count;
    for (int i = 0; i < pointCount; i++)
    {
      pts.Add(polyline[i]);
    }
  
    Plane polylinePlane;
    double maxDeviation;
    Plane.FitPlaneToPoints(pts, out polylinePlane, out maxDeviation);
  
    Vector3d planeNormal = polylinePlane.Normal;
    planeNormal.Unitize();
  
    // Determine if the polyline is oriented clockwise or counterclockwise
    bool isClockwise = polyline.ToPolylineCurve().ClosedCurveOrientation(polylinePlane) == CurveOrientation.Clockwise;
  
    // Iterate through the vertices of the polyline
    int vertexCount = polyline.IsClosed ? polyline.Count - 1 : polyline.Count - 1;
    for (int i = 0; i < vertexCount; i++)
    {
      // Get the adjacent points
      Point3d prev = i == 0 ? polyline[polyline.Count - 2] : polyline[i - 1];
      Point3d curr = polyline[i];
      Point3d next = i == polyline.Count - 2 ? polyline[0] : polyline[i + 1];
    
      // Create vectors from vertex to neighbors
      Vector3d vecToPrev = prev - curr;  // Vector from current to previous
      Vector3d vecToNext = next - curr;  // Vector from current to next
    
      // Normalize vectors
      vecToPrev.Unitize();
      vecToNext.Unitize();
    
      // Calculate the unsigned angle between the vectors (0 to π)
      double angle = Vector3d.VectorAngle(vecToPrev, vecToNext);
    
      // Determine if vertex is concave using cross product
      // Cross product of vecToPrev × vecToNext gives direction
      Vector3d crossProduct = Vector3d.CrossProduct(vecToPrev, vecToNext);
      crossProduct.Unitize();
      double dotProduct = crossProduct * planeNormal;
    
      // Determine concavity based on polygon orientation
      // For counterclockwise: if cross product points same as normal, vertex is concave
      // For clockwise: if cross product points opposite to normal, vertex is concave
      bool isConcave;
      if (isClockwise)
      {
        isConcave = dotProduct < 0;
      }
      else
      {
        isConcave = dotProduct > 0;
      }
    
      // Calculate interior angle
      // For convex: interior angle = angle (0 to π)
      // For concave: interior angle = 2π - angle (π to 2π)
      double interiorAngle = isConcave ? (2 * Math.PI - angle) : angle;
    
      // Add the interior angle
      interiorAngles.Add(interiorAngle);
    }
  
    return interiorAngles;
  }
# ---------- end c_script_11 ----------
polyline_interior_angles = PolylineInteriorAngles(Polyline=crv_2)  # -> Angles, Points
avr = Average(Input=polyline_interior_angles.Points)
vec2pt = Vector2Pt(PointA=polyline_interior_angles.Points, PointB=avr, Unitize=False)  # -> Vector, Length
deg = Degrees(Radians=c_script_11.A)
amp = Amplitude(Vector=vec2pt.Vector, Amplitude=Slider(0.2, range=0..1))
move = Move(Geometry=polyline_interior_angles.Points, Motion=amp)  # -> Geometry, Transform
extremums_3 = MinMax(Number=deg)  # -> Minimum, Maximum
roundd = RoundToDecimalPlace(NumberX=deg, DecimalPlace=1, RoundType=0)  # -> Rounded, Difference
larger = LargerThan(FirstNumber=extremums_3.Maximum, SecondNumber=Slider(180, range=0..1000))  # -> LargerThan, OrEqualTo
cull_3 = CullPattern(List=crv_2, CullPattern=invert(larger.LargerThan))
c_script_12 = CSharpScript(x=larger.LargerThan)  # -> out, A; inputs x: Boolean
# ---------- c_script_12: C# ----------
    if (x) A = "red";
    else A = "blue";
# ---------- end c_script_12 ----------
clean_8 = CleanTree(RemoveNulls=True, RemoveInvalid=True, RemoveEmpty=True, Tree=cull_3)  # -> simplify(Tree)
boundary_3 = BoundarySurfaces(Edges=crv_2)  # disabled
tag_3 = TextTag(Location=move.Geometry, Text=roundd.Rounded, Colour=c_script_12.A)
tstat_8 = TreeStatistics(Tree=clean_8)  # -> Paths, Length, Count
preview_2 = CustomPreview(Geometry=boundary_3, Material=c_script_12.A)  # disabled

data_8 = Data(tree_3)

panel_25 = Panel("https://app.speckle.systems/projects/fa2b5c68c0/models/73d1db8d95")

receive_10 = Receive(
    Stream=panel_25,
    AutoReceive=False,
    CurrentComponentState="up_to_date",
    ExpandOutput=True,
    LastInfoMessage="Lasath Siriwardena @ 02/22/2024 09:01:18: Updated Acoustics based on A610 V DD12 (id:2c90bcf47d)",
    ReceiveOnOpen=True,
    ReceivedCommitId="2c90bcf47d",
    StreamWrapper="https://app.speckle.systems/projects/fa2b5c68c0/models/globals",
    selectedKitName="Objects")  # -> Info, ArchicadMiddleTopOfGrid1, Cassette, Material, Steel

dso_31 = DeconstructSpeckleObject(SpeckleObject=receive_10.Cassette, selectedKitName="Objects")  # -> AcousticBatten, AcousticThickness, Beam_layer, Beam_Width, Bottom_layer, InsulationThickness, Top_layer
dso_32 = DeconstructSpeckleObject(SpeckleObject=receive_10.ArchicadMiddleTopOfGrid1, selectedKitName="Objects")  # -> X, Y, Z
vec = VectorXYZ(XComponent=dso_32.X, YComponent=dso_32.Y, ZComponent=dso_32.Z)  # -> Vector, Length

vec_2 = Vector(vec.Vector)
move_2 = Move(Geometry=geo, Motion=vec_2)  # -> Geometry, Transform
move_3 = Move(Geometry=pl_origin, Motion=vec_2)  # -> Geometry, Transform
move_4 = Move(Geometry=pl_origin, Motion=vec_2)  # -> Geometry, Transform
addition = Addition(A=dso_31.Bottom_layer, B=dso_31.Beam_layer, C=dso_31.Top_layer)
tag_4 = TextTag(Location=flatten(move_4.Geometry), Text=tstat_3.Paths)
division_2 = Division(A=addition, B=2)
buildup = DefineCassetteBuildup(LayerThickness=dso_31.Bottom_layer, Beam_layer=dso_31.Beam_layer, Top_layer=dso_31.Top_layer, includeCenterValues=False)  # -> BuildupKey, BuildupValue

# ----
# Globals
layer_thickness = Panel(dso_31.AcousticThickness)
layer_thickness_2 = Panel(dso_31.Bottom_layer)
layer_thickness_3 = Panel(dso_31.InsulationThickness)
layer_thickness_4 = Panel(dso_31.Beam_layer)
layer_thickness_5 = Panel(dso_31.Top_layer)
panel_26 = Panel(buildup.BuildupValue)

buildup_2 = DefineCassetteBuildup(LayerThickness=dso_31.Bottom_layer, Beam_layer=dso_31.Beam_layer, Top_layer=dso_31.Top_layer, includeCenterValues=True)  # -> BuildupKey, BuildupValue
addition_2 = Addition(A=dso_31.Top_layer, B=dso_31.Bottom_layer, C=dso_31.Beam_layer)
panel_27 = Panel(addition_2)
panel_28 = Panel(buildup.BuildupKey)
panel_29 = Panel(buildup_2.BuildupKey)
panel_30 = Panel(buildup_2.BuildupValue)
item_6 = ListItem(List=buildup.BuildupValue, Index=Slider(2, range=0..10), Wrap=True)
item_7 = ListItem(List=buildup.BuildupValue, Index=Slider(1, range=0..10), Wrap=True)
panel_31 = Panel(item_6)
panel_32 = Panel(item_7)

merge_3 = Merge(Data1=dso_13.Elevator_vent, Data2=dso_13.Pipes, Data3=dso_13.Ventilation_duct)  # -> flatten(Result)
boundary_4 = BoundarySurfaces(Edges=dso_28.Polyline)
move_5 = Move(Geometry=boundary_4, Motion=vec_2)  # -> Geometry, Transform
clash = Clash(FirstSet=move_5.Geometry, SecondSet=merge_3, Distance=0, L=100)  # -> ClashCount, ClashPoints, ClashRadii, simplify(FirstIndex), SecondIndex
clean_9 = CleanTree(RemoveNulls=True, RemoveInvalid=True, RemoveEmpty=True, Tree=clash.FirstIndex)

tstat_9 = TreeStatistics(Tree=clean_9)  # -> Paths, Length, Count

crv_3 = Curve(trim_3)
num_2 = Number(division_2)
geo_15 = Geometry(dso_27.Base_Surface)
vec_3 = Vector(vec_2)

list = ValueList({"Gradient": 0, "Constant": 1, "Structural": 2, "Struct/Grad": 3}, selected="Struct/Grad")
data_9 = Data(tstat_9.Paths)
data_10 = Data(data_5)
data_11 = Data(dso_28.Polyline)

boundary_5 = BoundarySurfaces(Edges=item_2.Item)
offsrf = OffsetSurface(Surface=boundary_5, Distance=1, BothSides=-1, CreateSolid=True)
tstat_10 = TreeStatistics(Tree=boundary_5)  # -> Paths, Length, Count
split_5 = SplitTree(Data=simplify(data_11), Masks=flatten(tstat_10.Paths))  # -> Positive, Negative
boundary_6 = BoundarySurfaces(Edges=split_5.Positive)
bbx = BrepBrep(BrepA=boundary_6, BrepB=simplify(offsrf))  # -> Curves, Points

area_10 = Area(Geometry=bbx.Curves)  # -> Area, Centroid
tstat_11 = TreeStatistics(Tree=bbx.Curves)  # -> Paths, Length, Count
tag_5 = TextTag(Location=flatten(area_10.Centroid), Text=tstat_11.Paths)

panel_33 = Panel("""{6;108}
{6;79}
{6;118}
{6;94}
{6;64}
{7;76}
{6;92}""")
panel_34 = Panel("""{3;52}
{3;151}
{5;52}
{5;151}""")
tstat_12 = TreeStatistics(Tree=simplify(bbx.Curves))  # -> Paths, Length, Count
split_6 = SplitTree(Data=simplify(data_10), Masks=flatten(tstat_12.Paths))  # -> Positive, Negative
tstat_13 = TreeStatistics(Tree=simplify(split_6.Negative))  # -> Paths, Length, Count
merge_4 = Merge(Data1=panel_34, Data2=tstat_13.Paths)

number_slider_9 = Slider(3, range=0..10)  # disabled
move_6 = Move(Geometry=data_6, Motion=vec_2)  # -> Geometry, Transform; disabled
swatch_7 = ColourSwatch(SwatchColor=RGB(255, 255, 255))  # disabled
previewlw_3 = CustomPreviewLineweights(Geometry=move_6.Geometry, Shader=swatch_7, Thickness=number_slider_9, Absolute=False)  # disabled

item_8 = ListItem(List=buildup.BuildupValue, Index=2, Wrap=True)
offsrf_2 = OffsetSurface(Surface=flip.Surface, Distance=item_8, BothSides=-1, CreateSolid=True)  # -> simplify(Offset)

match = MatchTree(Tree=offsrf_2, Guide=clean_7)
tstat_14 = TreeStatistics(Tree=match)  # -> Paths, Length, Count

split_7 = SplitTree(Data=division, Masks=flatten(tstat_14.Paths))  # -> Positive, Negative
crv_4 = Curve(dso_28.Polyline)
split_8 = SplitTree(Data=simplify(crv_4), Masks=flatten(tstat_14.Paths))  # -> Positive, Negative
planar = IsPlanar(Surface=split_8.Positive, Interior=True)  # -> Planar, Plane
neg = Negative(Value=split_7.Positive)
c_script_13 = CSharpScript(x=split_8.Positive, y=neg, z=planar.Plane)  # -> out, A; inputs x: Polyline, y: list of Double, z: Plane
# ---------- c_script_13: C# ----------
    A = OffsetPolylineVariable(x, y, z);
# ---------- c_script_13: C# additional code ----------
  public Polyline OffsetPolylineVariable(Polyline polyline, List<double> distances, Plane plane)
  {
    // Check if polyline is valid
    if (!polyline.IsValid)
      throw new ArgumentException("Provided polyline is not valid.");

    // Check if the distances count is the same as the segment count
    if (polyline.SegmentCount != distances.Count)
    {
      throw new ArgumentException("Number of distances does not match the number of polyline segments.");
    }

    //List<Point3d> newVertices = new List<Point3d>();
    List<Line> shiftedLines = new List<Line>();
    for (int i = 0; i < polyline.SegmentCount; i++)
    {
      Line segment = polyline.SegmentAt(i);

      Vector3d offsetDirection = Vector3d.CrossProduct(segment.Direction, plane.Normal);
      offsetDirection.Unitize();
      offsetDirection *= distances[i]; // scale by the distance

      Point3d start = segment.From + offsetDirection;
      Point3d end = segment.To + offsetDirection;
      shiftedLines.Add(new Line(start, end));
    }
    List<int> failedEdges = new List<int>();
    return IntersectionLinesToPolyline(shiftedLines, out failedEdges);
  }

  public Polyline IntersectionLinesToPolyline(List<Line> segments, out List<int> failedEdges)
  {
    failedEdges = new List<int>();
    Polyline offsetPolyline = new Polyline();
    for (int i = 0; i < segments.Count; i++)
    {
      int nextIndex = i == segments.Count - 1 ? 0 : i + 1;
      double a,b;
      if (Rhino.Geometry.Intersect.Intersection.LineLine(segments[i], segments[nextIndex], out  a, out  b))
      {
        double angle = Vector3d.VectorAngle(segments[i].Direction, segments[nextIndex].Direction);
        double angleDeg = RhinoMath.ToDegrees(angle);
        if (angle > Math.PI) angle = 2 * Math.PI - angle;
        if (angle < RhinoMath.ToRadians(1))
        {
          offsetPolyline.Add(segments[nextIndex].PointAt(0));
          failedEdges.Add(i);
        }
        else
        {
          Point3d pt = segments[i].PointAt(a);
          offsetPolyline.Add(pt);
        }
      }
      else
      {
        failedEdges.Add(i);
        offsetPolyline.Add(segments[nextIndex].PointAt(0));
      }
    }

    ShiftRightWrap(offsetPolyline, 01);
    offsetPolyline.Add(offsetPolyline[0]);

    return offsetPolyline;
  }

  public void ShiftRightWrap(Polyline polyline, int positions)
  {
    if (polyline == null || !polyline.IsValid)
      return;

    positions = positions % polyline.Count;

    if (positions == 0)
      return;

    var shifted = polyline.Skip(polyline.Count - positions).Concat(polyline.Take(polyline.Count - positions)).ToList();

    polyline.Clear();
    foreach (var pt in shifted)
    {
      polyline.Add(pt);
    }
  }
# ---------- end c_script_13 ----------

boundary_7 = BoundarySurfaces(Edges=c_script_13.A)
xy = XYPlane(Origin=Point(0, 0, 0))
flip_2 = Flip(Surface=boundary_7, Guide=xy)  # -> Surface, Result
offsrf_3 = OffsetSurface(Surface=flip_2.Surface, Distance=panel_31, BothSides=panel_32, CreateSolid=True)  # -> flatten(Offset)

# ----
# Brim Drain Extension
cluster_4 = Cluster_36(D=trim_3, A=drain_width, A_2=num_2, B=end_height)
geo_16 = Geometry(cluster_4)

# ----
# Brim Flange Band Solid Operator
clean_10 = CleanTree(RemoveNulls=True, RemoveInvalid=True, RemoveEmpty=True, Tree=dso_16.Flanschblech)
item_9 = ListItem(List=clean_10, Index=0, Wrap=True)
geo_17 = Geometry(flatten(item_9))
debrep_2 = DeconstructBrep(Brep=geo_17)  # -> Faces, Edges, Vertices
sort_pt = SortPoints(Points=debrep_2.Vertices)  # -> reverse(Points), Indices
item_10 = ListItem(List=sort_pt.Points, Index=0, Wrap=True)
scale_nu_2 = ScaleNU(Geometry=geo_17, Plane=flatten(item_10), ScaleX=1, ScaleY=1, ScaleZ=5)  # -> Geometry, Transform
area_11 = Area(Geometry=scale_nu_2.Geometry)  # -> Area, Centroid
scale_nu_3 = ScaleNU(Geometry=scale_nu_2.Geometry, Plane=flatten(area_11.Centroid), ScaleX=4, ScaleY=400, ScaleZ=1)  # -> Geometry, Transform
move_7 = Move(Geometry=scale_nu_3.Geometry, Motion=expr("-x", vec_2))  # -> Geometry, Transform

dso_33 = DeconstructSpeckleObject(SpeckleObject=receive_10.Material, selectedKitName="Objects")  # -> Acoustic, BeamMaterial, BottomPlateMaterial, SolidSegment, TopPlateMaterial

# ---- group: Top Layer Thickness
num_3 = Number(dso_31.Top_layer)

# ----
dual = Panel("https://speckle.xyz/streams/")
panel_35 = Panel(panel_20)
panel_36 = Panel(receive_10.Info)
panel_37 = Panel(receive.Info)

concat_3 = Concatenate(FragmentA=dual, FragmentB=panel_2, FragmentC="/commits/")

# ----
# Bottom Hole
crvprox_2 = CurveProximity(CurveA=bbx.Curves, CurveB=boundary_6)  # -> PointA, PointB, Distance

# ---- group: Modification requestion Simon 250207
split_9 = SplitTree(Data=simplify(crvprox_2.Distance), Masks=flatten("{6;25}"))  # -> Positive, Negative
addition_3 = Addition(A=split_9.Positive, B=0.1)
merge_5 = Merge(Data1=addition_3, Data2=split_9.Negative)

# ----
cluster_5 = Cluster_14(
    shell_7_swap=Toggle(True),
    M=data_9,
    x=data_10,
    crv=data_11,
    office_extra_acoustic_area=panel_33,
    M_2=merge_4,
    beam_width=list,
    beam_width_2=split.Positive,
    fabrication_offset=Slider(0.02, range=0..0.1),
    structural_offset=merge_5)  # -> L, A, R; disabled

# ---- group: Missing a Hole
wires = BrepWireframe(Brep=cluster, Density=-1)
join_5 = JoinCurves(Curves=wires, Preserve=False)
len_4 = Length(Curve=join_5)
c_script_14 = CSharpScript(x=len_4, y=join_5)  # -> out, simplify(A); inputs x: list of Double, y: list of Curve
# ---------- c_script_14: C# ----------
  if(x.Count == 1)
      A = new List<Curve>();
    else
    {
      if(x[0] > x[1]) A = y[1];
      else A = y[0];
    }
# ---------- end c_script_14 ----------
crv_5 = Curve(data_6)
split_10 = SplitTree(Data=simplify(c_script_14.A), Masks=flatten(dso_30.GH_Path))  # -> Positive, Negative
crv_6 = Curve(split_10.Negative)
area_12 = Area(Geometry=data_6)  # -> Area, Centroid
area_13 = Area(Geometry=c_script_14.A)  # -> Area, Centroid
python_2 = GhPythonScript(x=clean_6, y=cluster_5.A)  # -> out, a
# ---------- python_2: Python ----------
if x == y:
    a = 0
else:
    a = 1
# ---------- end python_2 ----------
subtraction = Subtraction(A=area_12.Area, B=area_13.Area)
dist_2 = Distance(PointA=area_12.Centroid, PointB=area_13.Centroid)
equals_2 = Equality(FirstNumber=python_2.a, SecondNumber=1)  # -> Equality, Inequality
roundd_2 = RoundToDecimalPlace(NumberX=subtraction, DecimalPlace=6, RoundType=0)  # -> Rounded, Difference
roundd_3 = RoundToDecimalPlace(NumberX=dist_2, DecimalPlace=6, RoundType=0)  # -> Rounded, Difference
cull_4 = CullPattern(List=clean_6, CullPattern=equals_2.Equality)  # -> flatten(List)
cull_5 = CullPattern(List=cluster_5.A, CullPattern=equals_2.Equality)  # -> flatten(List)
cull_6 = CullPattern(List=data_6, CullPattern=equals_2.Equality)  # -> flatten(List)
cull_7 = CullPattern(List=graft(crv_3), CullPattern=equals_2.Equality)  # -> flatten(List)
cull_8 = CullPattern(List=data_6, CullPattern=equals_2.Equality)  # -> flatten(List)
ma_3 = MassAddition(Input=flatten(roundd_2.Rounded))  # -> Result, PartialResults
ma_4 = MassAddition(Input=flatten(roundd_3.Rounded))  # -> Result, PartialResults
ma_5 = MassAddition(Input=flatten(python_2.a))  # -> Result, PartialResults
panel_38 = Panel(cull_5)
panel_39 = Panel(cull_4)
merge_6 = Merge(Data1=ma_3.Result, Data2=ma_4.Result, Data3=ma_5.Result)
panel_40 = Panel(merge_6)
ma_6 = MassAddition(Input=merge_6)  # -> Result, PartialResults
panel_41 = Panel(ma_6.Result)

# ----
split_11 = SplitTree(Data=crv_3, Masks=flatten("{0,8}"))  # -> Positive, Negative
split_12 = SplitTree(Data=split_11.Negative, Masks=flatten("{6}"))  # -> Positive, Negative
graft = GraftTree(Tree=split_12.Positive, IncludeEmptyLists=True, IncludeNullItems=True)
Z = UnitZ(Factor=1)
generate_mitre_planes_between_segments = GenerateMitrePlanesBetweenSegments(Polyline=crv_3, NakedEdgeGuideVector=Z)  # -> MitrePlanes, Neighbours, PolylinePlanes, BoundingRectangle

poly_topo_point = PolygonTopologyPoint(ListOfPolylines=split_11.Positive, Tolerance=0.001)  # -> ListOfPoints, LoopPointStructure, PointLoopStructure
c_script_15 = CSharpScript(x=poly_topo_point.ListOfPoints, y=poly_topo_point.LoopPointStructure)  # -> out, A; inputs x: tree of Point3d, y: tree of Int32
# ---------- c_script_15: C# ----------
        DataTree<Polyline> output = new DataTree<Polyline>();
    for (int i = 0; i < y.BranchCount; i++)
    {
      int mainIndex = y.Path(i)[0];
            Polyline poly = new Polyline();
            for (int j = 0; j < y.Branch(i).Count; j++)
            {
              poly.Add(x.Branch(mainIndex)[y.Branch(i)[j]]);
            }
            poly.Add(poly[0]);
            output.Add(poly, new GH_Path(mainIndex));
    }
    A = output;
# ---------- end c_script_15 ----------
boundary_8 = BoundarySurfaces(Edges=graft(c_script_15.A))
trim_5 = TrimTree(Tree=boundary_8, Depth=1)
match_2 = MatchTree(Tree=trim_5, Guide=split_11.Positive)

cluster_6 = Cluster_32(crv=split_12.Positive, O=num_2, L=dso_27.Base_Surface)  # -> R_3, R, L_2, L_3, R_2, T
geo_18 = Geometry(flatten(cluster_6.L_3))
geo_19 = Geometry(flatten(cluster_6.L_2))
geo_20 = Geometry(cluster_6.R)
geo_21 = Geometry(cluster_6.R_2)
match_3 = MatchTree(Tree=geo_20, Guide=split_12.Positive)  # -> graft(Tree)
match_4 = MatchTree(Tree=geo_21, Guide=graft)
match_5 = MatchTree(Tree=geo_18, Guide=split_12.Positive)  # -> graft(Tree)
match_6 = MatchTree(Tree=geo_19, Guide=split_12.Positive)  # -> graft(Tree)

poly_topo_edge_2 = PolygonTopologyEdge(ListOfPolylines=flatten(geo_19), Tolerance=0.001)  # -> ListOfEdges, LoopEdgeStructure, EdgeLoopStructure; disabled
poly_topo_edge_filter_2 = PolygonTopologyEdgeFilter(EdgeList=poly_topo_edge_2.ListOfEdges, EdgeLoopStructure=poly_topo_edge_2.EdgeLoopStructure, ValencyFilter=1)  # -> ListOfEdgeIDs, ListOfEdges; disabled
previewlw_4 = CustomPreviewLineweights(Geometry=poly_topo_edge_filter_2.ListOfEdges, Shader=swatch_2, Thickness=10, Absolute=False)  # disabled

poly_topo_edge_3 = PolygonTopologyEdge(ListOfPolylines=flatten(geo_18), Tolerance=0.001)  # -> ListOfEdges, LoopEdgeStructure, EdgeLoopStructure; disabled
poly_topo_edge_filter_3 = PolygonTopologyEdgeFilter(EdgeList=poly_topo_edge_3.ListOfEdges, EdgeLoopStructure=poly_topo_edge_3.EdgeLoopStructure, ValencyFilter=1)  # -> ListOfEdgeIDs, ListOfEdges; disabled
previewlw_5 = CustomPreviewLineweights(Geometry=poly_topo_edge_filter_3.ListOfEdges, Shader=swatch, Thickness=10, Absolute=False)  # disabled

merge_7 = Merge(Data1=match_2, Data2=split_12.Negative)
crv_7 = Curve(merge_7)

generate_offset_polylines = GenerateOffsetPolylines(
    Polyline=crv_7,
    Offset=num_2,
    OptionalEdgeVectorOverride=Z,
    AngleTolerance=degrees(1),
    OffsetMethod=2,
    nonPlanar=False,
    virtual4Valent=False)  # -> OffsetPolylines, FourValenceNodes
generate_offset_polylines_2 = GenerateOffsetPolylines(
    Polyline=crv_7,
    Offset=expr("-x", num_2),
    OptionalEdgeVectorOverride=Z,
    AngleTolerance=degrees(1),
    OffsetMethod=2,
    nonPlanar=False,
    virtual4Valent=True)  # -> OffsetPolylines, FourValenceNodes
simplify = Simplify(Curve=generate_offset_polylines.OffsetPolylines)
simplify_2 = Simplify(Curve=generate_offset_polylines_2.OffsetPolylines)
merge_8 = Merge(Data1=simplify(graft(simplify)), Data2=simplify(graft(crv_7)), Data3=simplify(graft(simplify_2)))
loft_polylines = LoftPolylines(Polylines=merge_8)  # -> LoftedPlate, Report, Debug
trim_6 = TrimTree(Tree=loft_polylines.LoftedPlate, Depth=1)

cluster_7 = Cluster_23(
    d1=generate_offset_polylines.FourValenceNodes,
    D_2=trim_6,
    d2=generate_offset_polylines_2.FourValenceNodes,
    D=generate_mitre_planes_between_segments.MitrePlanes)  # -> D_3, N

poly_topo_edge_4 = PolygonTopologyEdge(ListOfPolylines=flatten(simplify), Tolerance=0.001)  # -> ListOfEdges, LoopEdgeStructure, EdgeLoopStructure; disabled
poly_topo_edge_filter_4 = PolygonTopologyEdgeFilter(EdgeList=poly_topo_edge_4.ListOfEdges, EdgeLoopStructure=poly_topo_edge_4.EdgeLoopStructure, ValencyFilter=1)  # -> ListOfEdgeIDs, ListOfEdges; disabled
previewlw_6 = CustomPreviewLineweights(Geometry=poly_topo_edge_filter_4.ListOfEdges, Shader=swatch_4, Thickness=10, Absolute=False)  # disabled

poly_topo_edge_5 = PolygonTopologyEdge(ListOfPolylines=flatten(simplify_2), Tolerance=0.001)  # -> ListOfEdges, LoopEdgeStructure, EdgeLoopStructure; disabled
poly_topo_edge_filter_5 = PolygonTopologyEdgeFilter(EdgeList=poly_topo_edge_5.ListOfEdges, EdgeLoopStructure=poly_topo_edge_5.EdgeLoopStructure, ValencyFilter=1)  # -> ListOfEdgeIDs, ListOfEdges; disabled
previewlw_7 = CustomPreviewLineweights(Geometry=poly_topo_edge_filter_5.ListOfEdges, Shader=swatch_3, Thickness=10, Absolute=False)  # disabled

merge_9 = Merge(Data1=match_3, Data2=graft(trim_6))
merge_10 = Merge(Data1=match_5, Data2=simplify(simplify_2))
merge_11 = Merge(Data1=match_6, Data2=simplify)
merge_12 = Merge(Data1=match_4, Data2=cluster_7.N)

cluster_8 = Cluster_35(d2=merge_10, data=crv_3)
cluster_9 = Cluster_35(d2=merge_11, data=crv_3)

crv_8 = Curve(simplify(cluster_9))
crv_9 = Curve(simplify(cluster_8))
geo_22 = Geometry(simplify(cluster_7.D_3))
geo_23 = Geometry(merge_12)
geo_24 = Geometry(merge_9)

split_13 = SplitTree(Data=geo_24, Masks=flatten(concat_2))  # -> Positive, Negative; disabled

move_8 = Move(Geometry=crv_9, Motion=vec_3)  # -> Geometry, Transform
move_9 = Move(Geometry=geo_23, Motion=vec_3)  # -> Geometry, Transform
move_10 = Move(Geometry=crv_8, Motion=vec_3)  # -> Geometry, Transform
move_11 = Move(Geometry=geo_24, Motion=vec_3)  # -> Geometry, Transform
move_12 = Move(Geometry=data_6, Motion=vec_3)  # -> Geometry, Transform
move_13 = Move(Geometry=geo_22, Motion=vec_3)  # -> Geometry, Transform

clean_11 = CleanTree(RemoveNulls=True, RemoveInvalid=True, RemoveEmpty=False, Tree=move_12.Geometry)

clean_12 = CleanTree(RemoveNulls=True, RemoveInvalid=True, RemoveEmpty=False, Tree=move_13.Geometry)
cso_2 = CreateSpeckleObject(
    MitrePlanes=move_9.Geometry,
    BottomContour=move_8.Geometry,
    TopContour=move_10.Geometry,
    Segment=move_11.Geometry,
    BottomHoles=clean_11,
    FourValentEdgePlanes=clean_12,
    selectedKitName="Objects")

number_slider_10 = Slider(0.0001, range=0..0.0001)  # disabled
number_slider_11 = Slider(1e-05, range=0..1e-05)  # disabled
number_slider_12 = Slider(0.0001, range=0..0.0001)  # disabled
number_slider_13 = Slider(1e-05, range=0..1e-05)  # disabled
poly_topo_point_2 = PolygonTopologyPoint(ListOfPolylines=flatten(crv_8), Tolerance=number_slider_10)  # -> ListOfPoints, LoopPointStructure, PointLoopStructure; disabled
poly_topo_point_3 = PolygonTopologyPoint(ListOfPolylines=flatten(crv_8), Tolerance=number_slider_11)  # -> ListOfPoints, LoopPointStructure, PointLoopStructure; disabled
poly_topo_point_4 = PolygonTopologyPoint(ListOfPolylines=flatten(crv_9), Tolerance=number_slider_12)  # -> ListOfPoints, LoopPointStructure, PointLoopStructure; disabled
poly_topo_point_5 = PolygonTopologyPoint(ListOfPolylines=flatten(crv_9), Tolerance=number_slider_13)  # -> ListOfPoints, LoopPointStructure, PointLoopStructure; disabled
cp = ClosestPoint(Point=poly_topo_point_3.ListOfPoints, Cloud=poly_topo_point_2.ListOfPoints)  # -> ClosestPoint, CPIndex, Distance; disabled
cp_2 = ClosestPoint(Point=poly_topo_point_5.ListOfPoints, Cloud=poly_topo_point_4.ListOfPoints)  # -> ClosestPoint, CPIndex, Distance; disabled
item_11 = ListItem(List=poly_topo_point_2.ListOfPoints, Index=cp.CPIndex, Wrap=True)  # disabled
item_12 = ListItem(List=poly_topo_point_4.ListOfPoints, Index=cp_2.CPIndex, Wrap=True)  # disabled
ln = Line(StartPoint=poly_topo_point_3.ListOfPoints, EndPoint=item_11)  # disabled
ln_2 = Line(StartPoint=poly_topo_point_5.ListOfPoints, EndPoint=item_12)  # disabled
clean_13 = CleanTree(RemoveNulls=True, RemoveInvalid=True, RemoveEmpty=False, Tree=ln)  # disabled
clean_14 = CleanTree(RemoveNulls=True, RemoveInvalid=True, RemoveEmpty=False, Tree=ln_2)  # disabled
len_5 = Length(Curve=clean_13)  # disabled
len_6 = Length(Curve=clean_14)  # disabled
sort_4 = SortList(Keys=len_5)  # -> reverse(Keys), ValuesA; disabled
sort_5 = SortList(Keys=len_6)  # -> reverse(Keys), ValuesA; disabled

poly_topo_edge_6 = PolygonTopologyEdge(ListOfPolylines=flatten(crv_8), Tolerance=0.001)  # -> ListOfEdges, LoopEdgeStructure, EdgeLoopStructure; disabled
poly_topo_edge_filter_6 = PolygonTopologyEdgeFilter(EdgeList=poly_topo_edge_6.ListOfEdges, EdgeLoopStructure=poly_topo_edge_6.EdgeLoopStructure, ValencyFilter=1)  # -> ListOfEdgeIDs, ListOfEdges; disabled
previewlw_8 = CustomPreviewLineweights(Geometry=poly_topo_edge_filter_6.ListOfEdges, Shader=swatch_6, Thickness=10, Absolute=False)  # disabled

poly_topo_edge_7 = PolygonTopologyEdge(ListOfPolylines=flatten(crv_9), Tolerance=0.001)  # -> ListOfEdges, LoopEdgeStructure, EdgeLoopStructure; disabled
poly_topo_edge_filter_7 = PolygonTopologyEdgeFilter(EdgeList=poly_topo_edge_7.ListOfEdges, EdgeLoopStructure=poly_topo_edge_7.EdgeLoopStructure, ValencyFilter=1)  # -> ListOfEdgeIDs, ListOfEdges; disabled
previewlw_9 = CustomPreviewLineweights(Geometry=poly_topo_edge_filter_7.ListOfEdges, Shader=swatch_5, Thickness=10, Absolute=False)  # disabled

midpt = CurveMiddle(Curve=clean_13)  # disabled
midpt_2 = CurveMiddle(Curve=clean_14)  # disabled
panel_42 = Panel(sort_4.Keys)  # disabled
panel_43 = Panel(sort_5.Keys)  # disabled

# ----
# Acoustic Panel
offset_from_beams = Slider(0.02, range=0..0.1)

geo_25 = Geometry(geo_24)
crv_10 = Curve(simplify(dso_28.Polyline))
area_14 = Area(Geometry=flatten(crv_10))  # -> Area, Centroid
number_slider_14 = Slider(20, range=0..100)

tstat_15 = TreeStatistics(Tree=clean_7)  # -> Paths, Length, Count
split_14 = SplitTree(Data=simplify(dso_28.Polyline), Masks=flatten(tstat_15.Paths))  # -> Positive, Negative
planar_2 = IsPlanar(Surface=split_14.Positive, Interior=True)  # -> Planar, Plane
xy_2 = XYPlane(Origin=Point(0, 0, 0))

split_15 = SplitTree(Data=flip_2.Surface, Masks=flatten(data))  # -> Positive, Negative
offsrf_4 = OffsetSurface(Surface=split_15.Negative, Distance=panel_31, BothSides=panel_32, CreateSolid=True)

clean_15 = CleanTree(RemoveNulls=True, RemoveInvalid=True, RemoveEmpty=True, Tree=dso_28.Vent)  # -> simplify(Tree)
tstat_16 = TreeStatistics(Tree=crv_10)  # -> Paths, Length, Count
boundary_9 = BoundarySurfaces(Edges=clean_15)

split_16 = SplitTree(Data=division, Masks=flatten(tstat_15.Paths))  # -> Positive, Negative
addition_4 = Addition(A=offset_from_beams, B=split_16.Positive)

area_15 = Area(Geometry=flatten(clean_15))  # -> Area, Centroid
cp_3 = ClosestPoint(Point=area_15.Centroid, Cloud=area_14.Centroid)  # -> ClosestPoint, CPIndex, Distance
item_13 = ListItem(List=tstat_16.Paths, Index=cp_3.CPIndex, Wrap=True)
clean_16 = CleanTree(RemoveNulls=True, RemoveInvalid=True, RemoveEmpty=False, Tree=boundary_9)

neg_2 = Negative(Value=addition_4)
c_script_16 = CSharpScript(x=split_14.Positive, y=neg_2, z=planar_2.Plane)  # -> out, A; inputs x: Polyline, y: list of Double, z: Plane; same code as c_script_13
boundary_10 = BoundarySurfaces(Edges=c_script_16.A)
flip_3 = Flip(Surface=boundary_10, Guide=xy_2)  # -> Surface, Result

explode = Explode(Curve=split_14.Positive, Recursive=True)  # -> Segments, Vertices
midpt_3 = CurveMiddle(Curve=explode.Segments)

xy_3 = XYPlane(Origin=Point(0, 0, 0))
project_3 = Project(Geometry=item_5, Plane=xy_3)  # -> Geometry, Transform
Z_2 = UnitZ(Factor=Slider(20, range=0..100))

area_16 = Area(Geometry=project_3.Geometry)  # -> Area, Centroid
scale_nu_4 = ScaleNU(Geometry=project_3.Geometry, Plane=area_16.Centroid, ScaleX=2, ScaleY=1, ScaleZ=1)  # -> Geometry, Transform

offsrf_5 = OffsetSurface(Surface=clean_16, Distance=2, BothSides=-2, CreateSolid=True)

project_4 = Project(Geometry=scale_nu_4.Geometry, Plane=xy_3)  # -> Geometry, Transform

split_17 = SplitTree(Data=geo_25, Masks=flatten(tstat_14.Paths))  # -> Positive, Negative

split_18 = SplitTree(Data=split_17.Negative, Masks=flatten(item_13))  # -> Positive, Negative
sdiff = SolidDifference(BrepsA=split_18.Positive, BrepsB=flatten(offsrf_5))
merge_13 = Merge(Data1=split_18.Negative, Data2=sdiff)

polyoffset = PolylineOffset(
    Polylines=project_4.Geometry,
    Distance=Slider(1, range=0..1),
    Plane=xy_3,
    Tolerance=0.0001,
    ClosedFillet=1,
    OpenFillet=1,
    Miter=2)  # -> Contour, Holes
rdiff = RegionDifference(CurvesA=polyoffset.Contour, CurvesB=project_4.Geometry)
boundary_11 = BoundarySurfaces(Edges=rdiff)
move_14 = Move(Geometry=boundary_11, Motion=expr("-x", Z_2))  # -> Geometry, Transform
extr = Extrude(Base=move_14.Geometry, Direction=expr("2*x", Z_2))  # -> simplify(Extrusion)

crv_11 = Curve(dso_28.Polyline)
area_17 = Area(Geometry=crv_11)  # -> Area, Centroid
tstat_17 = TreeStatistics(Tree=area_17.Centroid)  # -> Paths, Length, Count

panel_44 = Panel("https://app.speckle.systems/projects/fa2b5c68c0/models/8b61bd92e6")

receive_11 = Receive(
    Stream=panel_44,
    AutoReceive=False,
    CurrentComponentState="up_to_date",
    ExpandOutput=True,
    LastInfoMessage="Lasath Siriwardena @ 11/23/2025 21:00:51: Removed old Column Head Plate from T612 Location (West) (id:685450b583)",
    ReceiveOnOpen=False,
    ReceivedCommitId="685450b583",
    StreamWrapper="https://app.speckle.systems/projects/fa2b5c68c0/models/01-design/6-steel",
    selectedKitName="Objects")  # -> Info, Data

panel_45 = Panel(receive_11.Info)
dso_34 = DeconstructSpeckleObject(SpeckleObject=receive_11.Data, selectedKitName="Objects")  # -> Field, Ridge, UPE
dso_35 = DeconstructSpeckleObject(SpeckleObject=dso_34.Ridge, selectedKitName="Objects")  # -> Brim_column_heads, Brim_column_profile, Column_heads, Dowel_plug, Flanschbleche, Ridge_bolts, Ridge_fin_column, Ridge_fins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
dso_36 = DeconstructSpeckleObject(SpeckleObject=dso_35.Column_heads, selectedKitName="Objects")  # -> Crown_bolts, Crown_plates, Crown_plates_path, Dowel_plug, Head_plates, Konstruktionsbolzen, Stahl_duebel, Stiffeners, Wood_screw_column_head

merge_14 = Merge(Data1=panel_35, Data2=panel_37, Data3=panel_36, Data4=panel_45, Data5=panel_10, Data6=receive.Info, Data7=panel_13)
python_3 = GhPythonScript(x=merge_14)  # -> out, a
# ---------- python_3: Python ----------
arr = x.split(":")
id = arr[-1]
id = id[:-1]

a = id
# ---------- end python_3 ----------
concat_4 = Concatenate(FragmentA=concat_3, FragmentB=python_3.a)
url_of_commit = Panel(concat_4)

dso_37 = DeconstructSpeckleObject(SpeckleObject=dso_34.Field, selectedKitName="Objects")  # -> Column_head, Gh_path
dso_38 = DeconstructSpeckleObject(SpeckleObject=dso_37.Column_head, selectedKitName="Objects")  # -> Head_plates, Hollow_tube, Pin_srf, Top_plate, Top_plate_screw, Wood_screws

geo_26 = Geometry(dso_38.Hollow_tube)
edges_3 = BrepEdges(Brep=geo_26)  # -> Naked, Interior, NonManifold
join_6 = JoinCurves(Curves=edges_3.Naked, Preserve=False)
area_18 = Area(Geometry=join_6)  # -> Area, Centroid
item_14 = ListItem(List=area_18.Centroid, Index=0, Wrap=True)  # -> Item, Item1
avr_2 = Average(Input=area_18.Centroid)
vec2pt_2 = Vector2Pt(PointA=item_14.Item, PointB=item_14.Item1, Unitize=False)  # -> Vector, Length
pl = PlaneNormal(Origin=avr_2, ZAxis=vec2pt_2.Vector)
scale_nu_5 = ScaleNU(Geometry=geo_26, Plane=pl, ScaleX=1, ScaleY=1, ScaleZ=5)  # -> Geometry, Transform
cap = CapHoles(Brep=scale_nu_5.Geometry)  # -> flatten(Brep)
move_15 = Move(Geometry=cap, Motion=vec_2)  # -> Geometry, Transform

dso_39 = DeconstructSpeckleObject(SpeckleObject=dso_35.Ridge_fins, selectedKitName="Objects")  # -> Ridge_fins, Thickness
tree_6 = CreateTree(Data=flatten(dso_39.Ridge_fins), Path=flatten(dso_35.Ridge_fins_path))
join_7 = BrepJoin(Breps=tree_6)  # -> Breps, Closed
fmerge = MergeFaces(Brep=join_7.Breps)  # -> Breps, Before, After

dso_40 = DeconstructSpeckleObject(SpeckleObject=dso_35.Tension_elements, selectedKitName="Objects")  # -> Tension_elements, Thickness
trim_7 = TrimTree(Tree=simplify(dso_40.Tension_elements), Depth=1)
join_8 = BrepJoin(Breps=trim_7)  # -> Breps, Closed
trim_8 = TrimTree(Tree=simplify(dso_40.Thickness), Depth=1)
fmerge_2 = MergeFaces(Brep=join_8.Breps)  # -> Breps, Before, After

dso_41 = DeconstructSpeckleObject(SpeckleObject=dso_36.Crown_plates, selectedKitName="Objects")  # -> Column_crowns, Precut_outlines, Thickness
boundary_12 = BoundarySurfaces(Edges=dso_41.Precut_outlines)
item_15 = ListItem(List=flatten(dso_41.Thickness), Index=0, Wrap=True)
tree_7 = CreateTree(Data=flatten(boundary_12), Path=flatten(dso_36.Crown_plates_path))
division_3 = Division(A=item_15, B=1000)

item_16 = ListItem(List=flatten(dso_39.Thickness), Index=0, Wrap=True)
division_4 = Division(A=item_16, B=1000)
panel_46 = Panel(division_4)

merge_15 = Merge(
    Data1=join_2.Breps,
    Data2=dso_24.Elevator_vent,
    Data3=dso_24.Pipes,
    Data4=dso_24.PVDucts,
    Data5=dso_24.Ventilation_duct,
    Data6=move_15.Geometry,
    Data7=dso_24.Brim_cutout)  # -> flatten(Result)

geo_27 = Geometry(dso_3.Centerlines)
pt = Point(Point(0, 0, -10))
geo_28 = Geometry(tree_7)
geo_29 = Geometry(fmerge.Breps)

geo_30 = Geometry(fmerge_2.Breps)
disc = Discontinuity(Curve=geo_30, Level=1)  # -> Points, Parameters
sort_pt_2 = SortPoints(Points=disc.Points)  # -> Points, Indices
item_17 = ListItem(List=reverse(sort_pt_2.Points), Index=0, Wrap=True)
scale_nu_6 = ScaleNU(Geometry=geo_30, Plane=item_17, ScaleX=1, ScaleY=1, ScaleZ=expr("3", 1))  # -> Geometry, Transform

division_5 = Division(A=trim_8, B=2000)
item_18 = ListItem(List=division_5, Index=0, Wrap=True)
neg_3 = Negative(Value=item_18)

crv_12 = Curve(geo_29)
area_19 = Area(Geometry=geo_29)  # -> Area, Centroid
disc_2 = Discontinuity(Curve=crv_12, Level=1)  # -> Points, Parameters
plfit = PlaneFit(Points=disc_2.Points)  # -> Plane, Deviation
pl_origin_2 = PlaneOrigin(Base=plfit.Plane, Origin=area_19.Centroid)

item_19 = ListItem(List=geo_29, Index=0, Wrap=True)
merge_16 = Merge(Data1=simplify(geo_28), Data2=simplify(item_19))
brec_2 = BoundingRectangle(Geometry=flatten(merge_16), Plane=PlaneXY(0, 0, 0), Axis=0, Slide=0, Union=True)  # -> Bounding, DimensionX, DimensionY

explode_2 = Explode(Curve=crv_12, Recursive=True)  # -> Segments, Vertices
len_7 = Length(Curve=explode_2.Segments)
sort_6 = SortList(Keys=len_7, ValuesA=explode_2.Segments)  # -> Keys, reverse(ValuesA)
item_20 = ListItem(List=sort_6.ValuesA, Index=0, Wrap=True)
vec_4 = Vector(item_20)

drec = DeconstuctRectangle(Rectangle=geo_30)  # -> BasePlane, XInterval, YInterval
deplane = DeconstructPlane(Plane=drec.BasePlane)  # -> Origin, XAxis, YAxis, ZAxis
pl_2 = ConstructPlane(Origin=deplane.Origin, XAxis=deplane.XAxis, YAxis=Vector(0, 1, 0))

pdecon = Deconstruct(Point=disc.Points)  # -> XComponent, YComponent, ZComponent
sort_7 = SortList(Keys=pdecon.ZComponent, ValuesA=disc.Points)  # -> Keys, ValuesA
item_21 = ListItem(List=reverse(sort_7.ValuesA), Index=[0, 1], Wrap=True)
avr_3 = Average(Input=item_21)

offsrf_6 = OffsetSurface(Surface=fmerge_2.Breps, Distance=item_18, BothSides=neg_3, CreateSolid=True)
area_20 = Area(Geometry=offsrf_6)  # -> Area, Centroid
item_22 = ListItem(List=flatten(area_20.Centroid), Index=0, Wrap=True)
xy_4 = XYPlane(Origin=item_22)
pdecon_2 = Deconstruct(Point=item_22)  # -> XComponent, YComponent, ZComponent

panel_47 = Panel("""5
1
1
1
1
1
1
5""")
area_21 = Area(Geometry=scale_nu_6.Geometry)  # -> Area, Centroid
scale_nu_7 = ScaleNU(Geometry=scale_nu_6.Geometry, Plane=area_21.Centroid, ScaleX=1, ScaleY=1, ScaleZ=graft(panel_47))  # -> Geometry, Transform

align = AlignPlane(Plane=pl_origin_2, Direction=vec_4)  # -> Plane, Angle
brec_3 = BoundingRectangle(Geometry=geo_29, Plane=align.Plane, Axis=0, Slide=0, Union=True)  # -> Bounding, DimensionX, DimensionY
scale_nu_8 = ScaleNU(Geometry=brec_3.Bounding, Plane=brec_3.Bounding, ScaleX=2, ScaleY=1, ScaleZ=1)  # -> Geometry, Transform

project_5 = Project(Geometry=brec_2.Bounding, Plane=pt)  # -> Geometry, Transform
Z_3 = UnitZ(Factor=20)
extr_2 = Extrude(Base=project_5.Geometry, Direction=Z_3)
cap_2 = CapHoles(Brep=extr_2)
split_19 = SplitWithBrep(Curve=scale_nu_8.Geometry, Brep=cap_2)  # -> Curve, Points
clscrv = CloseCurve(Curve=split_19.Curve, CloseType=0, Bulge=0.5, Tolerance=0)  # -> Closed, R
area_22 = Area(Geometry=clscrv.Closed)  # -> Area, Centroid
brepinc = PointInBrep(Brep=cap_2, Point=area_22.Centroid, Strict=False)
cull_9 = CullPattern(List=clscrv.Closed, CullPattern=brepinc)  # -> simplify(List)
clean_17 = CleanTree(RemoveNulls=True, RemoveInvalid=True, RemoveEmpty=True, Tree=cull_9)

brec_4 = BoundingRectangle(Geometry=flatten(geo_27), Plane=PlaneXY(0, 0, 0), Axis=0, Slide=0, Union=True)  # -> Bounding, DimensionX, DimensionY
area_23 = Area(Geometry=brec_4.Bounding)  # -> Area, Centroid
scale_nu_9 = ScaleNU(Geometry=brec_4.Bounding, Plane=area_23.Centroid, ScaleX=1.5, ScaleY=1, ScaleZ=1)  # -> Geometry, Transform
project_6 = Project(Geometry=scale_nu_9.Geometry, Plane=pt)  # -> Geometry, Transform
offset = OffsetCurve(Curve=project_6.Geometry, Distance=10, Corners=1)
rdiff_2 = RegionDifference(CurvesA=offset, CurvesB=project_6.Geometry)
boundary_13 = BoundarySurfaces(Edges=rdiff_2)
extr_3 = Extrude(Base=boundary_13, Direction=Z_3)

bbox = BoundingBox(Content=offsrf_6, Plane=PlaneXY(0, 0, 0))  # -> Box, Box_2
debox = DeconstructBox(Box=bbox.Box_2)  # -> Plane, X, Y, Z
num_4 = Number(debox.Z)
item_23 = ListItem(List=flatten(num_4), Index=0, Wrap=True)

division_6 = Division(A=item_23, B=2)
addition_5 = Addition(A=division_6, B=tension_band_bottom_cut)
Z_4 = UnitZ(Factor=expr("-x", addition_5))

tstat_18 = TreeStatistics(Tree=clean_17)  # -> Paths, Length, Count
split_20 = SplitTree(Data=simplify(scale_nu_8.Geometry), Masks=flatten(tstat_18.Paths))  # -> Positive, Negative
merge_17 = Merge(Data1=clean_17, Data2=split_20.Negative)

move_16 = Move(Geometry=xy_4, Motion=Z_4)  # -> Geometry, Transform
planesrf_2 = PlaneSurface(Plane=move_16.Geometry, XSize=Domain(-100, 100), YSize=Domain(-100, 100))
offsrf_7 = OffsetSurface(Surface=planesrf_2, Distance=expr("-X", Slider(1, range=0..1)), BothSides=0, CreateSolid=True)

# ----
# Tension Band Bottom Cut Solid Operator
panel_48 = Panel(pdecon_2.ZComponent)
pln_3 = Plane(move_16.Geometry)
geo_31 = Geometry(planesrf_2)

project_7 = Project(Geometry=merge_17, Plane=pl_origin_2)  # -> Geometry, Transform
trim_9 = TrimWithBrep(Curve=project_7.Geometry, Brep=extr_3)  # -> Inside, Outside
clscrv_2 = CloseCurve(Curve=trim_9.Outside, CloseType=0, Bulge=0.5, Tolerance=0)  # -> Closed, R
crv_13 = Curve(clscrv_2.Closed)

crv_14 = Curve(geo_28)
disc_3 = Discontinuity(Curve=crv_14, Level=1)  # -> Points, Parameters
join_9 = JoinCurves(Curves=crv_14, Preserve=False)  # -> simplify(Curves)
plfit_2 = PlaneFit(Points=disc_3.Points)  # -> Plane, Deviation
polyoffset_2 = PolylineOffset(
    Polylines=graft(join_9),
    Distance=fin_tolerance,
    Plane=graft(plfit_2.Plane),
    Tolerance=0.001,
    ClosedFillet=2,
    OpenFillet=1,
    Miter=2)  # -> simplify(Contour), Holes
panel_49 = Panel(division_3)
boundary_14 = BoundarySurfaces(Edges=polyoffset_2.Contour)
crv_15 = Curve(polyoffset_2.Holes)
offsrf_8 = OffsetSurface(Surface=boundary_14, Distance=expr("x/2", panel_49), BothSides=expr("-x/2", panel_49), CreateSolid=True)  # -> simplify(Offset)

pln_4 = Plane(boundary_14)
tstat_19 = TreeStatistics(Tree=offsrf_8)  # -> Paths, Length, Count

pln_5 = Plane(pln_4)
geo_32 = Geometry(offsrf_8)
num_5 = Number(division_3)

# ----
# Ridge Fins & Column Head Solid Operator
geo_33 = Geometry(polyoffset_2.Contour)

number_slider_15 = Slider(0, range=0..100)
cso_3 = CreateSpeckleObject(
    FrameBase=pln_3,
    Geo=geo_31,
    OffsetPositive=number_slider_15,
    OffsetNegative=number_slider_15,
    Name="Tension Band Bottom Cut",
    Type="Planar",
    selectedKitName="Objects")

cso_4 = CreateSpeckleObject(
    FrameBase=pln_5,
    Geo=geo_32,
    Outline=geo_33,
    OffsetPositive=num_5,
    OffsetNegative=num_5,
    Name="Column Crown",
    Type="Pocket",
    selectedKitName="Objects")  # -> simplify(SpeckleObject)

toggle = GroupToggle(ToggleActive=True, ToggleVisible=False)  # disabled
txt = Text(data_7)

string_filter = StringFilter(Text=txt, Object=dso_28.Polyline, Key="ridge")  # -> Text, Object

boundary_15 = BoundarySurfaces(Edges=crv_13)
clean_18 = CleanTree(RemoveNulls=True, RemoveInvalid=True, RemoveEmpty=True, Tree=string_filter.Object)  # -> simplify(Tree)
area_24 = Area(Geometry=boundary_15)  # -> Area, Centroid
boundary_16 = BoundarySurfaces(Edges=clean_18)
msphere = MeshSphere(Base=area_24.Centroid, Radius=0.05, UCount=3, VCount=3)
clash_2 = Clash(FirstSet=boundary_16, SecondSet=flatten(msphere), Distance=0, L=100)  # -> ClashCount, ClashPoints, ClashRadii, FirstIndex, SecondIndex
item_24 = ListItem(List=flatten(crv_13), Index=clash_2.SecondIndex, Wrap=True)
clean_19 = CleanTree(RemoveNulls=True, RemoveInvalid=True, RemoveEmpty=True, Tree=item_24)

boundary_17 = BoundarySurfaces(Edges=clean_19)
join_10 = BrepJoin(Breps=boundary_17)  # -> Breps, Closed
fmerge_3 = MergeFaces(Brep=join_10.Breps)  # -> Breps, Before, After
edges_4 = BrepEdges(Brep=fmerge_3.Breps)  # -> Naked, Interior, NonManifold
trim_10 = TrimTree(Tree=simplify(edges_4.Naked), Depth=1)

pln_6 = Plane(simplify(pl_origin))
tstat_20 = TreeStatistics(Tree=simplify(clean_19))  # -> Paths, Length, Count
split_21 = SplitTree(Data=pln_6, Masks=flatten(tstat_20.Paths))  # -> Positive, Negative
runion = RegionUnion(Curves=clean_19, Plane=split_21.Positive)

disc_4 = Discontinuity(Curve=runion, Level=1)  # -> Points, Parameters
plfit_3 = PlaneFit(Points=disc_4.Points)  # -> Plane, Deviation
polyoffset_3 = PolylineOffset(
    Polylines=graft(runion),
    Distance=fin_tolerance,
    Plane=graft(plfit_3.Plane),
    Tolerance=0.001,
    ClosedFillet=2,
    OpenFillet=1,
    Miter=2)  # -> simplify(Contour), Holes
boundary_18 = BoundarySurfaces(Edges=polyoffset_3.Contour)
offsrf_9 = OffsetSurface(Surface=boundary_18, Distance=expr("x/2", panel_46), BothSides=expr("-x/2", panel_46), CreateSolid=True)  # -> simplify(Offset)

explode_3 = Explode(Curve=runion, Recursive=True)  # -> Segments, Vertices
len_8 = Length(Curve=explode_3.Segments)
sort_8 = SortList(Keys=len_8, ValuesA=explode_3.Segments)  # -> Keys, reverse(ValuesA)
item_25 = ListItem(List=sort_8.ValuesA, Index=0, Wrap=True)

area_25 = Area(Geometry=runion)  # -> Area, Centroid
c_script_17 = CSharpScript(x=item_25)  # -> out, A; inputs x: Vector3d
# ---------- c_script_17: C# ----------
    Vector3d dir = new Vector3d(x);
    if(x.IsParallelTo(Vector3d.YAxis, Math.PI / 2) < 0) dir.Reverse();
    A = dir;
# ---------- end c_script_17 ----------
pl_origin_3 = PlaneOrigin(Base=plfit_3.Plane, Origin=area_25.Centroid)
align_2 = AlignPlane(Plane=pl_origin_3, Direction=c_script_17.A)  # -> Plane, Angle
division_7 = Division(A=panel_46, B=2)
bbox_2 = BoundingBox(Content=offsrf_9, Plane=align_2.Plane)  # -> Box, Box_2

tstat_21 = TreeStatistics(Tree=simplify(plfit_3.Plane))  # -> Paths, Length, Count
geo_34 = Geometry(align_2.Plane)
split_22 = SplitTree(Data=simplify(clean_18), Masks=flatten(tstat_21.Paths))  # -> Positive, Negative
deplane_2 = DeconstructPlane(Plane=geo_34)  # -> Origin, XAxis, YAxis, ZAxis
box_corners = BoxCorners(Box=bbox_2.Box)  # -> CornerA, CornerB, CornerC, CornerD, CornerE, CornerF, CornerG, CornerH
line = LineSDL(Start=deplane_2.Origin, Direction=deplane_2.XAxis, Length=1)
brec_5 = BoundingRectangle(Geometry=split_22.Positive, Plane=geo_34, Axis=0, Slide=0, Union=True)  # -> Bounding, DimensionX, DimensionY
brec_6 = BoundingRectangle(Geometry=bbox_2.Box, Plane=geo_34, Axis=0, Slide=0, Union=True)  # -> Bounding, DimensionX, DimensionY
pl_3pt = Plane3Pt(PointA=box_corners.CornerC, PointB=box_corners.CornerD, PointC=box_corners.CornerG)
clx = CurveLine(Curve=simplify(brec_5.Bounding), Line=simplify(line))  # -> Points, Params, Count
item_26 = ListItem(List=clx.Points, Index=0, Wrap=True)  # -> Item, Item1
ln_3 = Line(StartPoint=item_26.Item, EndPoint=item_26.Item1)
midpt_4 = CurveMiddle(Curve=ln_3)
pl_origin_4 = PlaneOrigin(Base=geo_34, Origin=midpt_4)

debrep_3 = DeconstructBrep(Brep=bbox_2.Box)  # -> Faces, Edges, Vertices
area_26 = Area(Geometry=debrep_3.Faces)  # -> Area, Centroid
pdecon_3 = Deconstruct(Point=area_26.Centroid)  # -> XComponent, YComponent, ZComponent
sort_9 = SortList(Keys=pdecon_3.ZComponent, ValuesA=area_26.Centroid)  # -> Keys, reverse(ValuesA)
item_27 = ListItem(List=sort_9.ValuesA, Index=0, Wrap=True)
deplane_3 = DeconstructPlane(Plane=align_2.Plane)  # -> Origin, XAxis, YAxis, ZAxis
pl_3 = ConstructPlane(Origin=simplify(item_27), XAxis=deplane_3.XAxis, YAxis=deplane_3.ZAxis)

pln_7 = Plane(pl_origin_4)
pln_8 = Plane(pl_3)
geo_35 = Geometry(ln_3)
brep = Brep(bbox_2.Box)
num_6 = Number(division_7)

cso_5 = CreateSpeckleObject(
    FrameBase=pln_7,
    FrameEnd=pln_8,
    Line=geo_35,
    Geo=brep,
    OffsetPositive=num_6,
    OffsetNegative=num_6,
    Name="Slits",
    Type="Planar",
    selectedKitName="Objects")  # -> simplify(SpeckleObject)

sort_val = SortDuplicateValues(ValueList=flatten(dso_36.Crown_plates_path))  # -> UniqueValues, Indices
split_23 = SplitTree(Data=simplify(txt), Masks=flatten(sort_val.UniqueValues))  # -> Positive, Negative
c_script_18 = CSharpScript(x=split_23.Positive, y="_column")  # -> out, A; inputs x: String, y: String
# ---------- c_script_18: C# ----------
    if(!x.Contains(y))
      A = x + y;
    else
      A = x;
# ---------- end c_script_18 ----------
merge_18 = Merge(Data1=c_script_18.A, Data2=split_23.Negative)

split_24 = SplitTree(Data=simplify(merge_18), Masks=flatten("{0,8;*}"))  # -> Positive, Negative
c_script_19 = CSharpScript(x=split_24.Positive, y="_brim")  # -> out, A; inputs x: String, y: String; same code as c_script_18
merge_19 = Merge(Data1=c_script_19.A, Data2=split_24.Negative)

# ----
# Head Plate Solid Operator
head_plate_tolerance = Slider(0.015, range=0..1)
dso_42 = DeconstructSpeckleObject(SpeckleObject=dso_36.Head_plates, selectedKitName="Objects")  # -> Drill_holes, Head_plates, Thickness
geo_36 = Geometry(dso_42.Head_plates)
trim_11 = TrimTree(Tree=simplify(geo_36), Depth=1)
split_25 = SplitTree(Data=trim_11, Masks=flatten("{1}"))  # -> Positive, Negative
explode_4 = Explode(Curve=split_25.Positive, Recursive=True)  # -> Segments, Vertices
len_9 = Length(Curve=explode_4.Segments)
sort_10 = SortList(Keys=len_9)  # -> reverse(Keys), ValuesA
item_28 = ListItem(List=flatten(sort_10.Keys), Index=0, Wrap=True)  # -> Item, Item1
neg_4 = Negative(Value=item_28.Item)
merge_20 = Merge(Data1=item_28.Item, Data2=neg_4)
Y = UnitY(Factor=merge_20)
move_17 = Move(Geometry=split_25.Positive, Motion=Y)  # -> Geometry, Transform
area_27 = Area(Geometry=move_17.Geometry)  # -> Area, Centroid
area_28 = Area(Geometry=flatten(geo_36))  # -> Area, Centroid
pln_9 = Plane(move_17.Geometry)
item_29 = ListItem(List=pln_9, Index=0, Wrap=True)
cp_4 = ClosestPoint(Point=area_27.Centroid, Cloud=flatten(area_28.Centroid))  # -> ClosestPoint, CPIndex, Distance
item_30 = ListItem(List=flatten(geo_36), Index=cp_4.CPIndex, Wrap=True)
merge_21 = Merge(Data1=simplify(graft(item_30)), Data2=simplify(graft(move_17.Geometry)))
brec_7 = BoundingRectangle(Geometry=merge_21, Plane=graft(pln_9), Axis=0, Slide=0, Union=True)  # -> flatten(Bounding), DimensionX, DimensionY
area_29 = Area(Geometry=brec_7.Bounding)  # -> Area, Centroid
scale_nu_10 = ScaleNU(Geometry=brec_7.Bounding, Plane=area_29.Centroid, ScaleX=Slider(800, range=0..1000), ScaleY=1, ScaleZ=1)  # -> Geometry, Transform
disc_5 = Discontinuity(Curve=scale_nu_10.Geometry, Level=1)  # -> Points, Parameters
panel_50 = Panel("""0
-1""")
sort_pt_3 = SortPoints(Points=disc_5.Points)  # -> Points, Indices
item_31 = ListItem(List=sort_pt_3.Points, Index=graft(panel_50), Wrap=True)
scale_nu_11 = ScaleNU(Geometry=scale_nu_10.Geometry, Plane=flatten(item_31), ScaleX=1, ScaleY=Slider(10, range=0..1000), ScaleZ=1)  # -> Geometry, Transform
Z_5 = UnitZ(Factor=head_plate_tolerance)
move_18 = Move(Geometry=scale_nu_11.Geometry, Motion=Z_5)  # -> Geometry, Transform
Z_6 = UnitZ(Factor=-5)
boundary_19 = BoundarySurfaces(Edges=move_18.Geometry)
extr_4 = Extrude(Base=boundary_19, Direction=Z_6)  # -> flatten(Extrusion)
pln_10 = Plane(pln_9)
geo_37 = Geometry(extr_4)

area_30 = Area(Geometry=geo_36)  # -> Area, Centroid
xz = XZPlane(Origin=item_31)

item_32 = ListItem(List=flatten(xz), Index=0, Wrap=True)  # -> Item, Item1
flippln = FlipPlane(Plane=item_32.Item1, FlipX=False, FlipY=False, FlipZ=True)  # -> Flipped, R
merge_22 = Merge(Data1=item_32.Item, Data2=flippln.Flipped)
deplane_4 = DeconstructPlane(Plane=merge_22)  # -> Origin, XAxis, YAxis, ZAxis
vdis = VectorDisplay(Anchor=deplane_4.Origin, Vector=deplane_4.ZAxis)

geo_38 = Geometry(merge_22)

number_slider_16 = Slider(0, range=0..100)
cso_6 = CreateSpeckleObject(
    FrameBase=pln_10,
    FrameEnd=geo_38,
    Geo=geo_37,
    OffsetPositive=number_slider_16,
    OffsetNegative=number_slider_16,
    Name="Head Plate",
    Type="Planar",
    selectedKitName="Objects")

# ----
# Stiffener Solid Operator
dso_43 = DeconstructSpeckleObject(SpeckleObject=dso_36.Stiffeners, selectedKitName="Objects")  # -> Surfaces, Thickness
geo_39 = Geometry(dso_17.Stiffener_solidOperator)
num_7 = Number(dso_43.Thickness)

split_26 = SplitTree(Data=simplify(geo_39), Masks=flatten("{0,7;*}"))  # -> Positive, Negative
area_31 = Area(Geometry=split_26.Positive)  # -> Area, Centroid
pdecon_4 = Deconstruct(Point=area_31.Centroid)  # -> XComponent, YComponent, ZComponent
sort_11 = SortList(Keys=pdecon_4.ZComponent, ValuesA=split_26.Positive)  # -> Keys, ValuesA
split_27 = SplitList(List=sort_11.ValuesA, Index=4)  # -> simplify(ListA), ListB
merge_23 = Merge(Data1=split_26.Negative, Data2=split_27.ListA)

xz_2 = XZPlane(Origin=Point(0, 0, 0))
brec_8 = BoundingRectangle(Geometry=dso_43.Surfaces, Plane=xz_2, Axis=0, Slide=0, Union=True)  # -> Bounding, DimensionX, DimensionY
disc_6 = Discontinuity(Curve=brec_8.Bounding, Level=1)  # -> Points, Parameters
pdecon_5 = Deconstruct(Point=disc_6.Points)  # -> XComponent, YComponent, ZComponent
extremums_4 = MinMax(Number=flatten(pdecon_5.ZComponent))  # -> Minimum, Maximum

move_19 = Move(Geometry=merge_23, Motion=expr("-x", vec_2))  # -> Geometry, Transform
area_32 = Area(Geometry=move_19.Geometry)  # -> Area, Centroid
pdecon_6 = Deconstruct(Point=area_32.Centroid)  # -> XComponent, YComponent, ZComponent
pt_2 = ConstructPoint(XCoordinate=pdecon_6.XComponent, YCoordinate=pdecon_6.YComponent, ZCoordinate=extremums_4.Minimum)
xz_3 = XZPlane(Origin=pt_2)

debrep_4 = DeconstructBrep(Brep=move_19.Geometry)  # -> Faces, Edges, Vertices
area_33 = Area(Geometry=debrep_4.Faces)  # -> Area, Centroid
smaller_2 = SmallerThan(FirstNumber=area_33.Area, SecondNumber=0.001)  # -> SmallerThan, OrEqualTo
cull_10 = CullPattern(List=debrep_4.Faces, CullPattern=invert(smaller_2.SmallerThan))
area_34 = Area(Geometry=cull_10)  # -> Area, Centroid
pdecon_7 = Deconstruct(Point=area_34.Centroid)  # -> XComponent, YComponent, ZComponent
sort_12 = SortList(Keys=pdecon_7.ZComponent, ValuesA=cull_10, ValuesB=area_34.Centroid)  # -> Keys, reverse(ValuesA), reverse(ValuesB)
item_33 = ListItem(List=sort_12.ValuesB, Index=0, Wrap=True)
item_34 = ListItem(List=sort_12.ValuesA, Index=0, Wrap=True)
explode_5 = Explode(Curve=item_34, Recursive=True)  # -> simplify(Segments), Vertices
len_10 = Length(Curve=explode_5.Segments)
sort_13 = SortList(Keys=len_10, ValuesA=explode_5.Segments)  # -> Keys, reverse(ValuesA)
item_35 = ListItem(List=sort_13.ValuesA, Index=0, Wrap=True)  # -> simplify(Item)
end = EndPoints(Curve=item_35)  # -> Start, End
merge_24 = Merge(Data1=end.Start, Data2=end.End)
sort_pt_4 = SortPoints(Points=merge_24)  # -> Points, Indices
item_36 = ListItem(List=sort_pt_4.Points, Index=0, Wrap=True)  # -> Item, Item1
vec2pt_3 = Vector2Pt(PointA=item_36.Item, PointB=item_36.Item1, Unitize=False)  # -> Vector, Length
pl_4 = ConstructPlane(Origin=item_33, XAxis=vec2pt_3.Vector, YAxis=Vector(0, 1, 0))

pln_11 = Plane(xz_3)
pln_12 = Plane(pl_4)
geo_40 = Geometry(move_19.Geometry)

division_8 = Division(A=num_7, B=2000)
cso_7 = CreateSpeckleObject(
    FrameBase=pln_11,
    FrameEnd=pln_12,
    Geo=geo_40,
    OffsetPositive=division_8,
    OffsetNegative=division_8,
    Name="Stiffener",
    Type="Planar",
    selectedKitName="Objects")  # -> flatten(SpeckleObject)

panel_51 = Panel(division_8)

# ----
# West Column Plate
tolerance = Slider(0, range=0..50)
dso_44 = DeconstructSpeckleObject(SpeckleObject=flatten(dso_35.Ridge_fin_column), selectedKitName="Objects")  # -> flatten(Ridge_fins), flatten(Thickness)
pln_13 = Plane(dso_44.Ridge_fins)
scale_nu_12 = ScaleNU(Geometry=dso_44.Ridge_fins, Plane=pln_13, ScaleX=2, ScaleY=1, ScaleZ=1)  # -> Geometry, Transform

addition_6 = Addition(A=dso_44.Thickness, B=tolerance)

deplane_5 = DeconstructPlane(Plane=pln_13)  # -> Origin, XAxis, YAxis, ZAxis
pl_5 = ConstructPlane(Origin=deplane_5.Origin, XAxis=deplane_5.ZAxis, YAxis=deplane_5.YAxis)

division_9 = Division(A=addition_6, B=2000)
offsrf_10 = OffsetSurface(Surface=scale_nu_12.Geometry, Distance=division_9, BothSides=expr("-x", division_9), CreateSolid=True)
vdis_2 = VectorDisplay(Anchor=deplane_5.Origin, Vector=deplane_5.ZAxis)
geo_41 = Geometry(offsrf_10)

geo_42 = Geometry(geo_41)
geo_43 = Geometry(pl_5)
geo_44 = Geometry(pln_13)
data_12 = Data(division_9)

cso_8 = CreateSpeckleObject(
    FrameBase=geo_44,
    FrameEnd=geo_43,
    Geo=geo_41,
    OffsetPositive=data_12,
    OffsetNegative=data_12,
    Name="Column Fin Plate",
    Type="Planar",
    selectedKitName="Objects")

# ----
# Pentrations - Brim
geo_45 = Geometry(dso_24.Brim_cutout)

move_20 = Move(Geometry=geo_45, Motion=expr("-x", vec_2))  # -> Geometry, Transform

bbox_3 = BoundingBox(Content=move_20.Geometry, Plane=PlaneXY(0, 0, 0))  # -> Box, Box_2
area_35 = Area(Geometry=move_20.Geometry)  # -> Area, Centroid
debox_2 = DeconstructBox(Box=bbox_3.Box)  # -> Plane, X, Y, Z
num_8 = Number(debox_2.Z)
xy_5 = XYPlane(Origin=area_35.Centroid)
division_10 = Division(A=num_8, B=2)
pln_14 = Plane(xy_5)
geo_46 = Geometry(move_20.Geometry)
num_9 = Number(division_10)

cso_9 = CreateSpeckleObject(
    FrameBase=pln_14,
    Geo=geo_46,
    OffsetPositive=num_9,
    OffsetNegative=num_9,
    Name="Brim Cutouts",
    Type="Hole",
    selectedKitName="Objects")

# ----
# Pentrations - Core Vents
geo_47 = Geometry(dso_24.Pipes)
geo_48 = Geometry(dso_24.Ventilation_duct)
geo_49 = Geometry(dso_24.Elevator_vent)
merge_25 = Merge(Data1=geo_48, Data2=geo_47, Data3=geo_49)
split_28 = SplitTree(Data=simplify(pl_origin), Masks=flatten("{6;*}"))  # -> Positive, Negative

move_21 = Move(Geometry=merge_25, Motion=expr("-x", vec_2))  # -> Geometry, Transform

# ----
# Pentrations - Pipes
merge_26 = Merge(Data1=join_2.Breps, Data2=dso_24.PVDucts, Data3=move_15.Geometry)  # -> flatten(Result)

move_22 = Move(Geometry=merge_26, Motion=expr("-x", vec_2))  # -> Geometry, Transform

debrep_5 = DeconstructBrep(Brep=move_22.Geometry)  # -> Faces, Edges, Vertices
area_36 = Area(Geometry=debrep_5.Faces)  # -> Area, Centroid
pdecon_8 = Deconstruct(Point=area_36.Centroid)  # -> XComponent, YComponent, ZComponent
sort_14 = SortList(Keys=pdecon_8.ZComponent, ValuesA=debrep_5.Faces)  # -> Keys, ValuesA
item_37 = ListItem(List=sort_14.ValuesA, Index=0, Wrap=True)
c_script_20 = CSharpScript(x=item_37)  # -> out, flatten(A); inputs x: Plane
# ---------- c_script_20: C# ----------
    if(Vector3d.Multiply(x.ZAxis, Vector3d.ZAxis) < 0) x.Flip();
    A = x;
# ---------- end c_script_20 ----------
pln_15 = Plane(c_script_20.A)
geo_50 = Geometry(move_22.Geometry)

cso_10 = CreateSpeckleObject(
    FrameBase=pln_15,
    Geo=geo_50,
    OffsetPositive=number_slider_3,
    OffsetNegative=number_slider_3,
    Name="Pipes",
    Type="Hole",
    selectedKitName="Objects")

# ----
# Solid Operators
geo_51 = Geometry(offsrf_7)
geo_52 = Geometry(extr_4)

# ----
# Brim Zugband Cut - A612
bbox_4 = BoundingBox(Content=scale_nu_3.Geometry, Plane=PlaneXY(0, 0, 0), UnionBox=True)  # -> Box, Box_2
box_corners_2 = BoxCorners(Box=bbox_4.Box)  # -> CornerA, CornerB, CornerC, CornerD, CornerE, CornerF, CornerG, CornerH
item_38 = ListItem(List=flatten(box_corners_2.CornerE), Index=0, Wrap=True)
pdecon_9 = Deconstruct(Point=item_38)  # -> XComponent, YComponent, ZComponent

bbox_5 = BoundingBox(Content=geo_30, Plane=pl_2)  # -> Box, Box_2
area_37 = Area(Geometry=geo_30)  # -> Area, Centroid
debox_3 = DeconstructBox(Box=bbox_5.Box)  # -> Plane, X, Y, Z
dedomain = DeconstructDomain(Domain=debox_3.Z)  # -> Start, End
subtraction_2 = Subtraction(A=dedomain.End, B=dedomain.Start)
item_39 = ListItem(List=flatten(trim_8), Index=0, Wrap=True)
division_11 = Division(A=item_39, B=1000)

# ----
# Tension Band Solid Operator
number_slider_17 = Slider(2, range=0..10)
area_38 = Area(Geometry=geo_30)  # -> Area, Centroid

multiplication = Multiplication(A=number_slider_17, B=tension_band_top_and_bttom_tolerance)
addition_7 = Addition(A=subtraction_2, B=multiplication)
division_12 = Division(A=addition_7, B=subtraction_2)
scale_nu_13 = ScaleNU(Geometry=geo_30, Plane=area_37.Centroid, ScaleX=1, ScaleY=1, ScaleZ=division_12)  # -> Geometry, Transform
filter = StreamFilter(Gate=addtop_and_bottom_tol, Stream0=scale_nu_7.Geometry, Stream1=scale_nu_13.Geometry)
offsrf_11 = OffsetSurface(Surface=filter, Distance=expr("x/2", division_11), BothSides=expr("-x/2", division_11), CreateSolid=True)

item_40 = ListItem(List=trim_8, Index=0, Wrap=True)
division_13 = Division(A=item_40, B=2000)
split_29 = SplitTree(Data=simplify(division_13), Masks=flatten("{!0,7}"))  # -> Positive, Negative

pl_origin_5 = PlaneOrigin(Base=filter, Origin=area_38.Centroid)
split_30 = SplitTree(Data=simplify(pl_origin_5), Masks=flatten("{!0,7}"))  # -> Positive, Negative
split_31 = SplitTree(Data=simplify(offsrf_11), Masks=flatten("{!0,7}"))  # -> Positive, Negative
pln_16 = Plane(split_30.Positive)
geo_53 = Geometry(split_31.Positive)
num_10 = Number(split_29.Positive)
pln_17 = Plane(split_30.Negative)
geo_54 = Geometry(split_31.Negative)
num_11 = Number(split_29.Negative)

merge_27 = Merge(Data1=geo_53, Data2=geo_54)

# ---- group: Top Notch
split_32 = SplitTree(Data=simplify(avr_3), Masks=flatten("{!0,7}"))  # -> Positive, Negative
Z_7 = UnitZ(Factor=1)
pl_6 = PlaneNormal(Origin=split_32.Positive, ZAxis=Z_7)
deplane_6 = DeconstructPlane(Plane=split_30.Positive)  # -> Origin, XAxis, YAxis, ZAxis
align_3 = AlignPlane(Plane=pl_6, Direction=deplane_6.XAxis)  # -> Plane, Angle

# ----
pln_18 = Plane(align_3.Plane)

cso_11 = CreateSpeckleObject(
    FrameBase=pln_17,
    Geo=geo_54,
    OffsetPositive=num_11,
    OffsetNegative=num_11,
    Name="Tension Band Brims",
    Type="Planar",
    selectedKitName="Objects")

cso_12 = CreateSpeckleObject(
    FrameBase=pln_16,
    FrameEnd=pln_18,
    Geo=geo_53,
    OffsetPositive=num_10,
    OffsetNegative=num_10,
    Name="Tension Band",
    Type="Planar",
    selectedKitName="Objects")

geo_55 = Geometry(merge_27)

geo_56 = Geometry(move_19.Geometry)

merge_28 = Merge(Data1=simplify(brep), Data2=geo_32)
tstat_22 = TreeStatistics(Tree=merge_28)  # -> Paths, Length, Count

number_slider_18 = Slider(0, range=0..100)

# ---- group: Penetrations
cap_3 = CapHoles(Brep=merge_15)

# ----
merge_29 = Merge(Data1=cso_12, Data2=cso_11)  # -> flatten(Result)

sort_val_2 = SortDuplicateValues(ValueList=flatten(tstat_19.Paths))  # -> UniqueValues, Indices

sunion = SolidUnion(Breps=geo_10)  # -> flatten(Result)
pt_3 = Point(Point(0, 48, 0))
xz_4 = XZPlane(Origin="0,47,0")
plntrimsrf = PlaneTrimSurface(Surface=sunion, Plane=xz_4, Flip=False)  # -> flatten(Trimmed), Intersected
cap_4 = CapHoles(Brep=plntrimsrf.Trimmed)
move_23 = Move(Geometry=sunion, Motion=vec_2)  # -> Geometry, Transform

data_13 = Data(tstat_8.Paths)

# ---- group: A1, A2, B1, B2
clean_20 = CleanTree(RemoveNulls=True, RemoveInvalid=True, RemoveEmpty=True, Tree=dso_9.Paths)  # -> simplify(flatten(Tree))
txt_2 = Text(clean_20)

# ----
data_14 = Data(merge_15)
cap_5 = CapHoles(Brep=data_14)

number_slider_19 = Slider(1, range=0..1)
dom = ConstructDomain(DomainStart=0, DomainEnd=255)

panel_52 = Panel("[LPH5 Rev_7]DataDrop - DD17 WIP - Updated Types")
panel_53 = Panel("https://speckle.xyz/streams/fa2b5c68c0/branches/02-development/3-simple_model")

panel_54 = Panel(panel_52)

panel_55 = Panel("https://app.speckle.systems/projects/fa2b5c68c0/models/c325a9a9dc")

# ----
# Acoustic Battens + Screws
merge_30 = Merge(Data1=panel_15, Data2=panel_16, Data3=panel_17)

split_33 = SplitTree(Data=simplify(c_script_16.A), Masks=flatten(merge_30))  # -> Positive, Negative
tstat_23 = TreeStatistics(Tree=simplify(split_33.Negative))  # -> Paths, Length, Count
panel_56 = Panel(tstat_23.Paths)

entwine = Entwine(Branch00=panel_56, Branch01=panel_15, Branch02=panel_16, Branch03=panel_17, FlattenInputs=True)
entwine_2 = Entwine(
    Branch00=Slider(625, range=0..1000),
    Branch01=Slider(400, range=0..1000),
    Branch02=Slider(625, range=0..1000),
    Branch03=Slider(400, range=0..1000),
    FlattenInputs=True)
entwine_3 = Entwine(
    Branch00=Slider(60, range=0..100),
    Branch01=Slider(60, range=0..100),
    Branch02=Slider(60, range=0..100),
    Branch03=Slider(60, range=0..100),
    FlattenInputs=True)

c_script_21 = CSharpScript(path=entwine, spacing=entwine_2, height=entwine_3)  # -> out, A, B; inputs path: list of String, spacing: Double, height: Double
# ---------- c_script_21: C# ----------
    DataTree<double> spacings = new DataTree<double>();
    DataTree<double> heights = new DataTree<double>();

    for (int i = 0; i < path.Count; i++)
    {
      spacings.Add(spacing / 1000, new GH_Path(ConvertStringToIntArray(path[i])));
      heights.Add(height / 1000, new GH_Path(ConvertStringToIntArray(path[i])));

    }

    A = spacings;
    B = heights;
# ---------- c_script_21: C# additional code ----------
  public static int[] ConvertStringToIntArray(string input)
  {
    if (string.IsNullOrWhiteSpace(input))
      return new int[0];

    input = input.Trim('{', '}');
    string[] parts = input.Split(';');
    int[] intArray = new int[parts.Length];

    for (int i = 0; i < parts.Length; i++)
    {
      if (!int.TryParse(parts[i], out intArray[i]))
      {
        throw new FormatException("Input string contains invalid numbers.");
      }
    }

    return intArray;
  }
# ---------- end c_script_21 ----------

subtraction_3 = Subtraction(A=panel_31, B=c_script_21.B)
subtraction_4 = Subtraction(A=subtraction_3, B=dso_31.AcousticThickness)
acoustic_top = Panel(subtraction_3)
acoustic_bottom = Panel(subtraction_4)
pl_offset = PlaneOffset(BasePlane=planar_2.Plane, Offset=acoustic_bottom)

offsrf_12 = OffsetSurface(Surface=flip_3.Surface, Distance=1, BothSides=acoustic_bottom, CreateSolid=True)  # -> simplify(Offset)

thicker_bottom_plate = BooleanToggle(True)
geo_57 = Geometry(graft(generate_mitre_planes_between_segments.PolylinePlanes))
crv_16 = Curve(dso_28.Polyline)
data_15 = Data(dso_9.Paths)
clean_21 = CleanTree(RemoveNulls=True, RemoveInvalid=True, RemoveEmpty=True, Tree=data_15)  # -> simplify(flatten(Tree))
data_16 = Data(dso_33.SolidSegment)
geo_58 = Geometry(move_16.Geometry)
data_17 = Data(vec_3)
data_18 = Data(item)
data_19 = Data(tstat.Paths)
data_20 = Data(tree_3)
data_21 = Data(cluster_2)
data_22 = Data(cluster_3)
data_23 = Data(data_6)
vec_5 = Vector(vec.Vector)
crv_17 = Curve(dso_28.Polyline)
data_24 = Data(c_script_21.A)
data_25 = Data(c_script_21.B)
data_26 = Data(dso_33.BeamMaterial)
data_27 = Data(dso_33.BottomPlateMaterial)
_4_valent = Geometry(move_13.Geometry)
crv_18 = Curve(dso_28.Fibre_dir)
data_28 = Data(dso_33.TopPlateMaterial)
data_29 = Data(dso_33.Acoustic)

data_30 = Data(clean_21)

move_24 = Move(Geometry=data_22, Motion=vec_5)  # -> Geometry, Transform

# ----
# Build up
botttom_plate_alt = Slider(0.049, range=0..0.1)
data_31 = Data(buildup.BuildupValue)
subtraction_5 = Subtraction(A=panel_27, B=dso_31.Top_layer, C=botttom_plate_alt)
buildup_3 = DefineCassetteBuildup(LayerThickness=botttom_plate_alt, Layer1=subtraction_5, Top_layer=dso_31.Top_layer, includeCenterValues=False)  # -> BuildupKey, BuildupValue
item_41 = ListItem(List=data_31, Index=0, Wrap=True)  # -> Item, Item1, Item2, Item3

item_42 = ListItem(List=buildup_3.BuildupValue, Index=0, Wrap=True)  # -> Item, Item1, Item2, Item3
offsrf_13 = OffsetSurface(Surface=split_15.Positive, Distance=item_42.Item2, BothSides=item_42.Item1, CreateSolid=True)
merge_31 = Merge(Data1=simplify(offsrf_4), Data2=simplify(offsrf_13))  # -> flatten(Result)

filter_2 = StreamFilter(Gate=thicker_bottom_plate, Stream0=offsrf_3, Stream1=merge_31)

tree_8 = CreateTree(Data=filter_2, Path=tstat_14.Paths)
merge_32 = Merge(Data1=match, Data2=tree_8)
sunion_2 = SolidUnion(Breps=merge_32)
sdiff_2 = SolidDifference(BrepsA=split_17.Positive, BrepsB=sunion_2)

merge_33 = Merge(Data1=merge_13, Data2=sdiff_2)

tstat_24 = TreeStatistics(Tree=merge_33)  # -> Paths, Length, Count
trim_12 = TrimTree(Tree=merge_33, Depth=1)
python_4 = GhPythonScript(x=merge_33)  # -> out, a; inputs x: Brep
# ---------- python_4: Python ----------
a = x.Vertices;
# ---------- end python_4 ----------
lng = ListLength(List=trim_12)

dup = DuplicateData(Data=extr, Number=lng, Order=True)  # -> simplify(graft(Data))

brepinc_2 = PointInBrep(Brep=dup, Point=python_4.a, Strict=True)
ma_7 = MassAddition(Input=brepinc_2)  # -> Result, PartialResults
larger_2 = LargerThan(FirstNumber=ma_7.Result, SecondNumber=0)  # -> LargerThan, OrEqualTo
cull_11 = CullPattern(List=tstat_24.Paths, CullPattern=flatten(larger_2.LargerThan))

split_34 = SplitTree(Data=dup, Masks=flatten(cull_11))  # -> Positive, Negative
split_35 = SplitTree(Data=merge_33, Masks=flatten(cull_11))  # -> Positive, Negative
sdiff_3 = SolidDifference(BrepsA=split_35.Positive, BrepsB=split_34.Positive)
clean_22 = CleanTree(RemoveNulls=True, RemoveInvalid=True, RemoveEmpty=False, Tree=sdiff_3)
merge_34 = Merge(Data1=clean_22, Data2=split_35.Negative)

geo_59 = Geometry(merge_34)

preview_3 = CustomPreview(Geometry=merge_34, Material=ColourSwatch(SwatchColor=RGBA(89, 94, 153, 61)))

# ----
# Solid Operators - Brim
split_36 = SplitTree(Data=simplify(geo_59), Masks=flatten("{0,8;*}"))  # -> Positive, Negative
sdiff_4 = SolidDifference(BrepsA=split_36.Positive, BrepsB=geo_16)
fmerge_4 = MergeFaces(Brep=sdiff_4)  # -> simplify(Breps), Before, After
merge_35 = Merge(Data1=fmerge_4.Breps, Data2=split_36.Negative)

clean_23 = CleanTree(RemoveNulls=True, RemoveInvalid=True, RemoveEmpty=True, Tree=flatten(merge_35))
lng_2 = ListLength(List=clean_23)
panel_57 = Panel(lng_2)

geo_60 = Geometry(merge_35)

dispatch = Dispatch(List=flatten(geo_60), DispatchPattern=dso_6.IsOutsourced)  # -> ListA, ListB
preview_4 = CustomPreview(
    Geometry=dispatch.ListA,
    Material={diffuse=RGB(221, 160, 221), emission=RGB(66, 48, 66), shine=0.5, specular=RGB(255, 255, 255), transparency=0})
preview_5 = CustomPreview(Geometry=dispatch.ListB, Material=ColourSwatch(SwatchColor=RGBA(255, 255, 255, 64)))

string_filter_2 = StringFilter(Text=txt, Object=geo_60, Key="ridge")  # -> Text, Object
clean_24 = CleanTree(RemoveNulls=True, RemoveInvalid=True, RemoveEmpty=True, Tree=string_filter_2.Object)  # -> simplify(Tree)

split_37 = SplitTree(Data=clean_24, Masks=flatten("{0,8;*}"))  # -> Positive, Negative
move_25 = Move(Geometry=split_37.Positive, Motion=vec_2)  # -> Geometry, Transform
trim_13 = TrimTree(Tree=move_25.Geometry, Depth=1)
bbox_6 = BoundingBox(Content=trim_13, Plane=PlaneXY(0, 0, 0), UnionBox=True)  # -> Box, Box_2
box_corners_3 = BoxCorners(Box=bbox_6.Box)  # -> CornerA, CornerB, CornerC, CornerD, CornerE, CornerF, CornerG, CornerH
item_43 = ListItem(List=flatten(box_corners_3.CornerB), Index=0, Wrap=True)
pdecon_10 = Deconstruct(Point=item_43)  # -> XComponent, YComponent, ZComponent
subtraction_6 = Subtraction(A=pdecon_10.ZComponent, B=pdecon_9.ZComponent)
Z_8 = UnitZ(Factor=subtraction_6)
move_26 = Move(Geometry=move_7.Geometry, Motion=Z_8)  # -> Geometry, Transform

split_38 = SplitTree(Data=geo_60, Masks=flatten("{6;*}"))  # -> Positive, Negative
clash_3 = Clash(FirstSet=split_38.Positive, SecondSet=move_21.Geometry, Distance=0, L=100)  # -> ClashCount, ClashPoints, ClashRadii, FirstIndex, SecondIndex
item_44 = ListItem(List=move_21.Geometry, Index=clash_3.SecondIndex, Wrap=True)  # -> simplify(Item)
clean_25 = CleanTree(RemoveNulls=True, RemoveInvalid=True, RemoveEmpty=True, Tree=item_44)
tstat_25 = TreeStatistics(Tree=clean_25)  # -> Paths, Length, Count
split_39 = SplitTree(Data=simplify(split_28.Positive), Masks=flatten(tstat_25.Paths))  # -> Positive, Negative
lng_3 = ListLength(List=clean_25)
dup_2 = DuplicateData(Data=split_39.Positive, Number=lng_3, Order=True)  # -> simplify(Data)
pln_19 = Plane(flatten(dup_2))
geo_61 = Geometry(flatten(clean_25))

sdiff_5 = SolidDifference(BrepsA=clean_24, BrepsB=geo_51)
sdiff_6 = SolidDifference(BrepsA=sdiff_5, BrepsB=geo_52)
sdiff_7 = SolidDifference(BrepsA=sdiff_6, BrepsB=flatten(geo_55))

# ---- group: Match A612
filter_3 = StreamFilter(Gate=Toggle(True), Stream0=move_7.Geometry, Stream1=move_26.Geometry)

# ----
debrep_6 = DeconstructBrep(Brep=filter_3)  # -> Faces, Edges, Vertices
area_39 = Area(Geometry=debrep_6.Faces)  # -> Area, Centroid
pdecon_11 = Deconstruct(Point=area_39.Centroid)  # -> XComponent, YComponent, ZComponent
sort_15 = SortList(Keys=pdecon_11.ZComponent, ValuesA=debrep_6.Faces)  # -> Keys, reverse(ValuesA)
item_45 = ListItem(List=sort_15.ValuesA, Index=0, Wrap=True)
area_40 = Area(Geometry=item_45)  # -> Area, Centroid
xy_6 = XYPlane(Origin=area_40.Centroid)  # -> flatten(Plane)

move_27 = Move(Geometry=scale_nu_3.Geometry, Motion=Z_8)  # -> Geometry, Transform
pln_20 = Plane(xy_6)
geo_62 = Geometry(filter_3)

cso_13 = CreateSpeckleObject(
    FrameBase=pln_19,
    Geo=geo_61,
    OffsetPositive=number_slider_4,
    OffsetNegative=number_slider_4,
    Name="Core Vents",
    Type="Hole",
    selectedKitName="Objects")  # -> flatten(SpeckleObject)

cso_14 = CreateSpeckleObject(
    FrameBase=pln_20,
    Geo=geo_62,
    OffsetPositive=number_slider_18,
    OffsetNegative=number_slider_18,
    Name="Brim Flange",
    Type="Planar",
    selectedKitName="Objects")

geo_63 = Geometry(geo_60)

# ---- group: Data Tree Reorder
geo_64 = Geometry(sdiff_7)
split_40 = SplitTree(Data=geo_64, Masks=flatten("{1;*}"))  # -> Positive, Negative
clash_4 = Cluster_19(A=split_40.Positive, L=cso_8)
so = SpeckleObject(clash_4)
tstat_26 = TreeStatistics(Tree=geo_64)  # -> Paths, Length, Count
tstat_27 = TreeStatistics(Tree=so)  # -> Paths, Length, Count
tree_9 = CreateTree(Data=so, Path=tstat_27.Paths, Ensure=tstat_26.Paths)

# ----
split_41 = SplitTree(Data=sdiff_7, Masks=flatten(tstat_27.Paths))  # -> Positive, Negative
sdiff_8 = SolidDifference(BrepsA=split_41.Positive, BrepsB=geo_42)
merge_36 = Merge(Data1=sdiff_8, Data2=split_41.Negative)

clash_5 = Clash(FirstSet=merge_36, SecondSet=filter_3, Distance=0, L=100)  # -> ClashCount, ClashPoints, ClashRadii, FirstIndex, SecondIndex
item_46 = ListItem(List=filter_3, Index=clash_5.SecondIndex, Wrap=True)
clean_26 = CleanTree(RemoveNulls=True, RemoveInvalid=True, RemoveEmpty=True, Tree=item_46)  # -> simplify(Tree)
tstat_28 = TreeStatistics(Tree=clean_26)  # -> Paths, Length, Count
split_42 = SplitTree(Data=merge_36, Masks=flatten(tstat_28.Paths))  # -> Positive, Negative
split_43 = SplitTree(Data=simplify(item_46), Masks=flatten(tstat_28.Paths))  # -> Positive, Negative
sdiff_9 = SolidDifference(BrepsA=split_42.Positive, BrepsB=split_43.Positive)
merge_37 = Merge(Data1=sdiff_9, Data2=split_42.Negative)

clash_6 = Clash(FirstSet=merge_37, SecondSet=flatten(geo_56), Distance=0, L=100)  # -> ClashCount, ClashPoints, ClashRadii, FirstIndex, SecondIndex
item_47 = ListItem(List=flatten(geo_56), Index=clash_6.SecondIndex, Wrap=True)
clean_27 = CleanTree(RemoveNulls=True, RemoveInvalid=True, RemoveEmpty=True, Tree=item_47)  # -> simplify(Tree)
tstat_29 = TreeStatistics(Tree=clean_27)  # -> Paths, Length, Count
split_44 = SplitTree(Data=merge_37, Masks=flatten(tstat_29.Paths))  # -> Positive, Negative
split_45 = SplitTree(Data=simplify(item_47), Masks=flatten(tstat_29.Paths))  # -> Positive, Negative
sdiff_10 = SolidDifference(BrepsA=split_44.Positive, BrepsB=split_45.Positive)
merge_38 = Merge(Data1=sdiff_10, Data2=split_44.Negative)

area_41 = Area(Geometry=merge_38)  # -> Area, Centroid
sort_16 = SortList(Keys=area_41.Area, ValuesA=merge_38)  # -> Keys, reverse(ValuesA)
item_48 = ListItem(List=sort_16.ValuesA, Index=0, Wrap=True)
tstat_30 = TreeStatistics(Tree=item_48)  # -> Paths, Length, Count
split_46 = SplitTree(Data=simplify(geo_60), Masks=flatten(tstat_30.Paths))  # -> Positive, Negative
merge_39 = Merge(Data1=item_48, Data2=split_46.Negative)

split_47 = SplitTree(Data=simplify(merge_39), Masks=flatten(tstat_22.Paths))  # -> Positive, Negative
sdiff_11 = SolidDifference(BrepsA=split_47.Positive, BrepsB=merge_28)
merge_40 = Merge(Data1=simplify(split_47.Negative), Data2=simplify(sdiff_11))

clean_28 = CleanTree(RemoveNulls=True, RemoveInvalid=True, RemoveEmpty=True, Tree=sdiff_11)
tstat_31 = TreeStatistics(Tree=clean_28)  # -> Paths, Length, Count

area_42 = Area(Geometry=merge_40)  # -> Area, Centroid
sort_17 = SortList(Keys=area_42.Area, ValuesA=merge_40)  # -> Keys, reverse(ValuesA)
split_48 = SplitList(List=sort_17.ValuesA, Index=1)  # -> ListA, ListB
item_49 = ListItem(List=sort_17.ValuesA, Index=0, Wrap=True)
geo_65 = Geometry(split_48.ListB)

move_28 = Move(Geometry=geo_65, Motion=vec_2)  # -> Geometry, Transform
move_29 = Move(Geometry=item_49, Motion=vec_2)  # -> Geometry, Transform

clean_29 = CleanTree(RemoveNulls=True, RemoveInvalid=True, RemoveEmpty=True, Tree=move_28.Geometry)

preview_6 = CustomPreview(Geometry=flatten(clean_29), Material=ColourSwatch(SwatchColor=RGBA(255, 0, 0, 249)))

preview_7 = CustomPreview(Geometry=move_29.Geometry, Material=ColourSwatch(SwatchColor=RGBA(255, 255, 255, 15)))

# ---- group: Penetrations (continued)
clash_7 = Clash(FirstSet=move_29.Geometry, SecondSet=merge_15, Distance=0, L=100)  # -> ClashCount, ClashPoints, ClashRadii, FirstIndex, SecondIndex
item_50 = ListItem(List=cap_3, Index=clash_7.SecondIndex, Wrap=True)

clean_30 = CleanTree(RemoveNulls=True, RemoveInvalid=True, RemoveEmpty=True, Tree=simplify(item_50))
tstat_32 = TreeStatistics(Tree=clean_30)  # -> Paths, Length, Count
split_49 = SplitTree(Data=move_29.Geometry, Masks=flatten(tstat_32.Paths))  # -> Positive, Negative
sdiff_12 = SolidDifference(BrepsA=split_49.Positive, BrepsB=clean_30)

# ----
cluster_10 = Cluster_19(A=merge_36, L=cso_7)
so_2 = SpeckleObject(cluster_10)

cluster_11 = Cluster_19(A=merge_36, L=cso_14)
so_3 = SpeckleObject(cluster_11)

cluster_12 = Cluster_19(A=merge_36, L=cso_6)
so_4 = SpeckleObject(cluster_12)

cluster_13 = Cluster_19(A=geo_63, L=cso_10)
so_5 = SpeckleObject(cluster_13)

cluster_14 = Cluster_19(A=geo_63, L=cso_9)
so_6 = SpeckleObject(cluster_14)

cluster_15 = Cluster_19(A=geo_63, L=cso_13)
so_7 = SpeckleObject(cluster_15)

cluster_16 = Cluster_19(A=merge_36, L=cso_3)
so_8 = SpeckleObject(cluster_16)

cluster_17 = Cluster_19(A=merge_36, L=merge_29)
so_9 = SpeckleObject(cluster_17)

# ---- group: Penetrations
clean_31 = CleanTree(RemoveNulls=True, RemoveInvalid=True, RemoveEmpty=True, Tree=sdiff_12)  # -> simplify(Tree)
tstat_33 = TreeStatistics(Tree=clean_31)  # -> Paths, Length, Count
split_50 = SplitTree(Data=simplify(move_29.Geometry), Masks=flatten(tstat_33.Paths))  # -> Positive, Negative
merge_41 = Merge(Data1=clean_31, Data2=split_50.Negative)
clean_32 = CleanTree(RemoveNulls=True, RemoveInvalid=True, RemoveEmpty=False, Tree=merge_41)  # -> simplify(Tree)

# ----
merge_42 = Merge(Data1=so_5, Data2=so_6, Data3=so_7)

filter_4 = StreamFilter(Gate=Toggle(True), Stream0=move_29.Geometry, Stream1=clean_32)

geo_66 = Geometry(filter_4)

geo_67 = Geometry(move_28.Geometry)

geo_68 = Geometry(geo_66)
c_script_22 = CSharpScript(x=geo_68)  # -> out, A; inputs x: Brep
# ---------- c_script_22: C# ----------
    A = x.ToJSON(new Rhino.FileIO.SerializationOptions());
# ---------- end c_script_22 ----------

clash_8 = Clash(FirstSet=geo_68, SecondSet=cap_4, Distance=0, L=100)  # -> ClashCount, ClashPoints, ClashRadii, FirstIndex, SecondIndex
clean_33 = CleanTree(RemoveNulls=True, RemoveInvalid=True, RemoveEmpty=True, Tree=clash_8.FirstIndex)  # -> simplify(Tree)
split_51 = SplitTree(Data=clean_33, Masks=flatten("{!0,8;*}"))  # -> Positive, Negative
tstat_34 = TreeStatistics(Tree=split_51.Positive)  # -> Paths, Length, Count

c_script_23 = CSharpScript(x=geo_68)  # -> out, A; inputs x: tree of Brep
# ---------- c_script_23: C# ----------
    List<object> data = new List<object>();
    for (int i = 0; i < x.BranchCount; i++)
    {
      for (int j = 0; j < x.Branch(i).Count; j++)
      {
        Brep brp = x.Branch(i)[j];
        if(!brp.IsValid)
          data.Add(brp);
      }
    }

    A = data;
# ---------- end c_script_23 ----------
panel_58 = Panel(c_script_23.A)
area_43 = Area(Geometry=geo_68)  # -> Area, Centroid

merge_43 = Merge(Data1=merge_42, Data2=cso_5, Data3=so_8, Data4=so_9, Data5=so_2, Data6=so_3, Data7=so_4, Data8=tree_9, Data9=cso_4)
tstat_35 = TreeStatistics(Tree=geo_60)  # -> Paths, Length, Count

c_script_24 = CSharpScript(
    iSolidOperator_Speckle=merge_43,
    moveVector=vec_2,
    Reference=["C:\Users\Lasat\AppData\Roaming\Grasshopper\Libraries\ABxM.PlateStructures\LCRL.Core.dll", "C:\USERS\LASAT\APPDATA\ROAMING\GRASSHOPPER\LIBRARIES\ABXM.PLATESTRUCTURES\ElementBase.dll", "C:\USERS\LASAT\APPDATA\ROAMING\GRASSHOPPER\LIBRARIES\FABFRAMEWORK\Fab.Core.dll", "C:\Users\Lasat\AppData\Roaming\McNeel\Rhinoceros\7.0\Plug-ins\SpeckleRhino2 (8dd5f30b-a13d-4a24-abdc-3e05c8c87143)\SpeckleCore2.dll", "C:\Windows\Microsoft.NET\assembly\GAC_MSIL\netstandard\v4.0_2.0.0.0__cc7b13ffcd2ddd51\netstandard.dll", "C:\Users\Lasat\AppData\Roaming\McNeel\Rhinoceros\7.0\Plug-ins\SpeckleRhino2 (8dd5f30b-a13d-4a24-abdc-3e05c8c87143)\SpeckleConnectorGrasshopper.gha", "C:\Users\Lasat\AppData\Roaming\Speckle\Kits\Objects\Objects.Converter.Grasshopper7.dll", "C:\Users\Lasat\AppData\Roaming\Speckle\Kits\Objects\Objects.dll"])  # -> out, A; inputs moveVector: Vector3d
# ---------- c_script_24: C# usings ----------
using Fab.Core.FabCollection;
using Fab.Core.DesignElement;
using System.Linq;
using Grasshopper.Kernel.Components;
using System.Net.NetworkInformation;
using ABxM.PlateStructures.Development;
using Speckle.Core.Models;
using Objects.Converter.RhinoGh;
using Objects.Geometry;
using Speckle.Core.Kits;
using System.Reflection;

// Aliases for clarity
using SpecklePoint = Objects.Geometry.Point;
using SpecklePlane = Objects.Geometry.Plane;
using SpeckleBrep = Objects.Geometry.Brep;
using SpeckleLine = Objects.Geometry.Line;
# ---------- c_script_24: C# ----------
    // Cast the input to a Speckle Base object.
    Base speckleObj = iSolidOperator_Speckle as Base;
    if (speckleObj == null)
    {
      Print("Input is not a valid Speckle object.");
      return;
    }

    // Create a new Speckle object.
    Base newSpeckle = new Base();
    
    // Optionally, copy core properties if desired.
    if (speckleObj["@Name"] != null)
      newSpeckle["@Name"] = speckleObj["@Name"];
    if (speckleObj["@Type"] != null)
      newSpeckle["@Type"] = speckleObj["@Type"];

    // Set up the converter.
    ConverterRhinoGh converter = new ConverterRhinoGh();
    converter.SetContextDocument(RhinoDoc.ActiveDoc);

    // Retrieve dynamic properties from the original object.
    IDictionary<string, object> members = speckleObj.GetMembers(DynamicBaseMemberType.Dynamic);
    
    // Loop through each property and process it.
    foreach (string key in members.Keys)
    {
      object value = speckleObj[key];
      Print("Processing key: " + key + " of type: " + (value != null ? value.GetType().ToString() : "null"));
      object movedValue = MoveSpeckleValue(value, moveVector, converter);
      newSpeckle[key] = movedValue;
    }

    // Output the new Speckle object.
    A = newSpeckle;
# ---------- c_script_24: C# additional code ----------
  /// <summary>
  /// Moves a Speckle geometry value (or a list of such values) by a given vector.
  /// If the value is not a recognized geometry type, it is returned unchanged.
  /// </summary>
  private object MoveSpeckleValue(object value, Vector3d moveVector, ConverterRhinoGh converter)
  {
    if (value == null)
      return null;

    // If the value is a list, process each element recursively.
    IList list = value as IList;
    if (list != null)
    {
      List<object> newList = new List<object>();
      for (int i = 0; i < list.Count; i++)
      {
        newList.Add(MoveSpeckleValue(list[i], moveVector, converter));
      }
      return newList;
    }

    try
    {
      // Process Speckle Point.
      SpecklePoint sp = value as SpecklePoint;
      if (sp != null)
      {
        Rhino.Geometry.Point rhPt = converter.PointToNative(sp);
        // Create a new point instance with the moved location.
        Rhino.Geometry.Point newPt = new Rhino.Geometry.Point(rhPt.Location + moveVector);
        Print("Moved point from " + rhPt.Location.ToString() + " to " + newPt.Location.ToString());
        return converter.PointToSpeckle(newPt);
      }

      // Process Speckle Plane.
      SpecklePlane spl = value as SpecklePlane;
      if (spl != null)
      {
        Rhino.Geometry.Plane rhPlane = converter.PlaneToNative(spl);
        // Create a new plane instance; move the origin.
        Rhino.Geometry.Plane newPlane = new Rhino.Geometry.Plane(rhPlane);
        newPlane.Origin = rhPlane.Origin + moveVector;
        Print("Moved plane from " + rhPlane.Origin.ToString() + " to " + newPlane.Origin.ToString());
        return converter.PlaneToSpeckle(newPlane);
      }

      // Process Speckle Brep.
      SpeckleBrep sb = value as SpeckleBrep;
      if (sb != null)
      {
        List<string> notes;
        Rhino.Geometry.Brep rhBrep = converter.BrepToNative(sb, out notes);
        if (rhBrep != null)
        {
          // Duplicate the brep before transforming.
          Rhino.Geometry.Brep newBrep = rhBrep.DuplicateBrep();
          newBrep.Transform(Transform.Translation(moveVector));
          Print("Moved brep.");
          return converter.BrepToSpeckle(newBrep);
        }
      }

      // Process Speckle Line.
      SpeckleLine sl = value as SpeckleLine;
      if (sl != null)
      {
        var lineResult = converter.LineToNative(sl); // Assuming it returns an object with a Line property.
        Rhino.Geometry.Line rhLine = lineResult.Line;
        // Create a new line instance with moved endpoints.
        Rhino.Geometry.Line newLine = new Rhino.Geometry.Line(rhLine.From + moveVector, rhLine.To + moveVector);
        Print("Moved line from " + rhLine.From.ToString() + " - " + rhLine.To.ToString() +
          " to " + newLine.From.ToString() + " - " + newLine.To.ToString());
        return converter.LineToSpeckle(newLine);
      }
    }
    catch (Exception ex)
    {
      Rhino.RhinoApp.WriteLine("Error moving property: " + ex.Message);
    }

    // If not a recognized type, return the original value.
    return value;
  }
# ---------- end c_script_24 ----------

tstat_36 = TreeStatistics(Tree=c_script_24.A)  # -> Paths, Length, Count
lng_4 = ListLength(List=c_script_24.A)
dup_3 = DuplicateData(Data=graft(tstat_36.Paths), Number=lng_4, Order=True)
tree_10 = CreateTree(Data=flatten(c_script_24.A), Path=flatten(dup_3), Ensure=tstat_35.Paths)

split_52 = SplitTree(Data=simplify(merge_19), Masks=flatten(tstat_33.Paths))  # -> Positive, Negative

c_script_25 = CSharpScript(x=split_52.Positive, y="_pipe")  # -> out, A; inputs x: String, y: String; same code as c_script_18

merge_44 = Merge(Data1=c_script_25.A, Data2=split_52.Negative)

split_53 = SplitTree(Data=simplify(merge_44), Masks=flatten(sort_val_2.UniqueValues))  # -> Positive, Negative
c_script_26 = CSharpScript(x=split_53.Positive, y="_crown")  # -> out, A; inputs x: String, y: String; same code as c_script_18
merge_45 = Merge(Data1=c_script_26.A, Data2=split_53.Negative)

split_54 = SplitTree(Data=simplify(merge_45), Masks=flatten(data_4))  # -> Positive, Negative
c_script_27 = CSharpScript(x=split_54.Positive, y="_onSite")  # -> out, A; inputs x: String, y: String; same code as c_script_18
merge_46 = Merge(Data1=c_script_27.A, Data2=split_54.Negative)

split_55 = SplitTree(Data=simplify(merge_46), Masks=flatten(data_13))  # -> Positive, Negative
c_script_28 = CSharpScript(x=split_55.Positive, y="_synclastic")  # -> out, A; inputs x: String, y: String; same code as c_script_18
c_script_29 = CSharpScript(x=split_55.Negative, y="_anticlastic")  # -> out, A; inputs x: String, y: String; same code as c_script_18
merge_47 = Merge(Data1=c_script_28.A, Data2=c_script_29.A)

data_32 = Data(tstat_31.Paths)
split_56 = SplitTree(Data=simplify(merge_47), Masks=flatten(data_32))  # -> Positive, Negative
c_script_30 = CSharpScript(x=split_56.Positive, y="_fins")  # -> out, A; inputs x: String, y: String; same code as c_script_18
merge_48 = Merge(Data1=c_script_30.A, Data2=split_56.Negative)
c_script_31 = CSharpScript(x=merge_48)  # -> out, A; inputs x: String
# ---------- c_script_31: C# ----------
    A = ReorderPropertiesAlphabetically(x, 2);
# ---------- c_script_31: C# additional code ----------
  public static string ReorderPropertiesAlphabetically(string input, int frontLength)
  {
    // Split the string by '_'
    var parts = input.Split('_');

    // Check if the string has enough parts (at least type and location)
    if (parts.Length <= frontLength) return input;

    // Extract type and location (first two parts)
    string type = parts[0];
    string location = parts[1];

    // Extract properties (remaining parts)
    string[] properties = new string[parts.Length - 2];
    Array.Copy(parts, 2, properties, 0, parts.Length - 2);

    // Sort properties
    Array.Sort(properties);

    // Reassemble the string
    return type + "_" + location + "_" + string.Join("_", properties);
  }
# ---------- end c_script_31 ----------

# ---- group: A1, A2, B1, B2 (continued)
split_57 = SplitTree(Data=c_script_31.A, Masks=flatten(txt_2))  # -> Positive, Negative
c_script_32 = CSharpScript(x=split_57.Negative)  # -> out, A; inputs x: String
# ---------- c_script_32: C# ----------
    string type = x;

    if (x.Contains("brim"))
    {
      type = type.Replace("solid", "solid_A1");
    }
    else if (!x.Contains("fins"))
    {
      type = type.Replace("solid", "solid_A1");
    }
    else
    {
      type = type.Replace("solid", "solid_A2");
    }

    if (x.Contains("hollow"))
    {
      type = type.Replace("hollow", "hollow_B1");
    }

    A = type;
# ---------- end c_script_32 ----------
c_script_33 = CSharpScript(x=split_57.Positive)  # -> out, A; inputs x: String
# ---------- c_script_33: C# ----------
    string type = x;

    if (x.Contains("hollow"))
    {
      type = type.Replace("hollow", "hollow_B2");
    }

    A = type;
# ---------- end c_script_33 ----------

# ----
split_58 = SplitTree(Data=split_57.Negative, Masks=flatten(tstat_34.Paths))  # -> Positive, Negative
c_script_34 = CSharpScript(x=split_58.Positive)  # -> out, A; inputs x: String
# ---------- c_script_34: C# ----------
    string type = x;

    if (x.Contains("solid"))
    {
      type = type.Replace("solid", "solid_A1");
    }

    if (x.Contains("hollow"))
    {
      type = type.Replace("hollow", "hollow_B1");
    }

    A = type;
# ---------- end c_script_34 ----------
c_script_35 = CSharpScript(x=split_58.Negative)  # -> out, A; inputs x: String
# ---------- c_script_35: C# ----------
    string type = x;

    if (x.Contains("solid"))
    {
      type = type.Replace("solid", "solid_A2");
    }

    if (x.Contains("hollow"))
    {
      type = type.Replace("hollow", "hollow_B1");
    }

    A = type;
# ---------- end c_script_35 ----------
merge_49 = Merge(Data1=c_script_34.A, Data2=c_script_35.A)

filter_5 = StreamFilter(Gate=off_ibb_drawing_t130, Stream0=c_script_32.A, Stream1=merge_49)

# ---- group: A1, A2, B1, B2 (continued)
merge_50 = Merge(Data1=filter_5, Data2=c_script_33.A)

# ----
txt_3 = Text(merge_50)

sort_val_3 = SortDuplicateValues(ValueList=flatten(txt_3))  # -> UniqueValues, Indices
lng_5 = ListLength(List=sort_val_3.UniqueValues)

series = Series(Start=Slider(100, range=0..100), Step=Slider(20, range=0..100), Count=lng_5)
remap = RemapNumbers(Value=series, Source=dom, Target=Domain(0, 1))  # -> Mapped, Clipped
hsv = ColourHSV(Alpha=0.4, Hue=remap.Mapped, Saturation=number_slider_19, Value=number_slider_19)
merge_51 = Merge(
    Data1=ColourSwatch(SwatchColor=RGBA(255, 0, 0, 100)),
    Data2=ColourSwatch(SwatchColor=RGBA(255, 85, 0, 100)),
    Data3=flatten(hsv))

sort_val_4 = SortDuplicateValues(ValueList=flatten(txt_3))  # -> UniqueValues, Indices
item_51 = ListItem(List=sort_val_4.UniqueValues, Index=Slider(17, range=0..100), Wrap=True)
c_script_36 = CSharpScript(x=item_51, y=txt_3, z=geo_68)  # -> out, A; inputs x: String, y: String, z: Brep
# ---------- c_script_36: C# ----------
    if( x == y) A = z;
# ---------- end c_script_36 ----------
panel_59 = Panel(sort_val_4.UniqueValues)
string_filter_3 = StringFilter(Text=txt_3, Object=geo_68, Key="anticlastic")  # -> Text, Object

c_script_37 = CSharpScript(x=txt_3, z=sort_val_4.UniqueValues, y=merge_51)  # -> out, A; inputs x: String, z: list of String, y: list of Color
# ---------- c_script_37: C# ----------
    if(x.Contains("column"))
    {
      System.Drawing.Color newCol = System.Drawing.Color.FromArgb(
        100,
        System.Drawing.Color.DarkSlateGray.R,
        System.Drawing.Color.DarkSlateGray.G,
        System.Drawing.Color.DarkSlateGray.B
        );
        A = newCol;
    }
    else
      A = y[z.IndexOf(x)];
# ---------- end c_script_37 ----------
tag_6 = TextTag3D(Location=area_43.Centroid, Text=txt_3, Size=0.1, Colour=ColourSwatch(SwatchColor=RGB(0, 0, 0)), Justification=5)
preview_8 = CustomPreview(Geometry=geo_68, Material=c_script_37.A)

panel_60 = Panel(item_51)
clean_34 = CleanTree(RemoveNulls=True, RemoveInvalid=True, RemoveEmpty=True, Tree=string_filter_3.Object)
tstat_37 = TreeStatistics(Tree=clean_34)  # -> Paths, Length, Count
split_59 = SplitTree(Data=simplify(geo_68), Masks=flatten(tstat_37.Paths))  # -> Positive, Negative

tstat_38 = TreeStatistics(Tree=txt_3)  # -> graft(Paths), Length, Count
match_7 = MatchTree(Tree=tstat_38.Paths, Guide=txt_3)

preview_9 = CustomPreview(Geometry=clean_34, Material=ColourSwatch(SwatchColor=RGBA(106, 14, 227, 26)))
preview_10 = CustomPreview(Geometry=split_59.Negative, Material=ColourSwatch(SwatchColor=RGBA(227, 227, 227, 0)))
tstat_39 = TreeStatistics(Tree=match_7)  # -> Paths, Length, Count
dpath = DeconstructPath(Branch=tstat_39.Paths)
match_8 = MatchTree(Tree=dpath, Guide=txt_3)
merge_52 = Merge(Data1=match_8, Data2=txt_3)

sso = RenderMaterial(
    Opacity=1,
    Metalness=0,
    Roughness=1,
    Diffuse=c_script_37.A,
    SelectedConstructorName="Objects.Other.RenderMaterial.ctor(System.Double,System.Double,System.Double,System.Nullable`1[System.Drawing.Color],System.Nullable`1[System.Drawing.Color])",
    SelectedTypeName="Objects.Other.RenderMaterial",
    UseSchemaTag=False,
    UserSetSchemaTag=False,
    seed="555265bba8c7cba49671")

sso_2 = RenderMaterial(
    Opacity=0.5,
    Metalness=0,
    Roughness=1,
    Diffuse=c_script_37.A,
    SelectedConstructorName="Objects.Other.RenderMaterial.ctor(System.Double,System.Double,System.Double,System.Nullable`1[System.Drawing.Color],System.Nullable`1[System.Drawing.Color])",
    SelectedTypeName="Objects.Other.RenderMaterial",
    UseSchemaTag=False,
    UserSetSchemaTag=False,
    seed="e32e69875568463a5275")

layers = CreateModifyLayers(LayerName=panel_59, LayerColor=flatten(c_script_37.A), DeleteLayer=False, enableFullPath=False)  # -> LayerNames, LayerFullPath
createatts = CreateAttributes(Name=match_7, LayerName=txt_3, Color=c_script_37.A, UserDataKeys=panel_14, UserDataValues=merge_52, enableFullPath=True)
createatts_2 = CreateAttributes(
    Name=match_7,
    LayerName=txt_3,
    Color=ColourSwatch(SwatchColor=RGB(240, 240, 240)),
    UserDataKeys=panel_14,
    UserDataValues=merge_52,
    enableFullPath=True)

filter_6 = StreamFilter(Gate=monotone, Stream0=createatts, Stream1=createatts_2)

bake = BakeGeometry(Bake=Button(), Geometry=geo_68, Attributes=filter_6, DeleteOldBakes=False, PreserveTrees=False)

data_33 = Data(txt_3)
data_34 = Data(geo_68)

# ----
# Solid
panel_61 = Panel("hollow")
string_filter_4 = StringFilter(Text=data_33, Object=data_34, Key=panel_61)  # -> Text, Object
clean_35 = CleanTree(RemoveNulls=True, RemoveInvalid=True, RemoveEmpty=True, Tree=string_filter_4.Text)
tstat_40 = TreeStatistics(Tree=clean_35)  # -> Paths, Length, Count
split_60 = SplitTree(Data=data_33, Masks=flatten(tstat_40.Paths))  # -> Positive, Negative
split_61 = SplitTree(Data=data_34, Masks=flatten(tstat_40.Paths))  # -> Positive, Negative
txt_4 = Text(tstat_40.Paths)

c_script_38 = CSharpScript(x=tstat_40.Paths, y=clean_21, z=data_31, u=buildup_3.BuildupValue)  # -> out, A; inputs x: list, y: list of String, z: list of Double, u: list of Double
# ---------- c_script_38: C# ----------
    DataTree<double> buildup = new DataTree<double>();

    for (int i = 0; i < x.Count; i++)
    {
      GH_Path path = x[i] as GH_Path;
      if(y.Contains(x[i].ToString())) buildup.AddRange(u, path);
      else buildup.AddRange(z, path);
    }

    A = buildup;
# ---------- end c_script_38 ----------

# ----
# RAW – Hollow
filter_7 = StreamFilter(Gate=thicker_bottom_plate, Stream0=data_31, Stream1=c_script_38.A)

split_62 = SplitTree(Data=split_61.Negative, Masks=flatten("{0,8;*}"))  # -> Positive, Negative
split_63 = SplitTree(Data=split_60.Negative, Masks=flatten("{0,8;*}"))  # -> Positive, Negative
string_filter_5 = StringFilter(Text=split_63.Negative, Object=split_62.Negative, Key="ridge_column")  # -> Text, Object
clean_36 = CleanTree(RemoveNulls=True, RemoveInvalid=True, RemoveEmpty=True, Tree=string_filter_5.Object)
tstat_41 = TreeStatistics(Tree=clean_36)  # -> Paths, Length, Count
split_64 = SplitTree(Data=simplify(geo_57), Masks=flatten(tstat_41.Paths))  # -> Positive, Negative
move_30 = Move(Geometry=split_64.Positive, Motion=data_17)  # -> Geometry, Transform
pl_offset_2 = PlaneOffset(BasePlane=move_30.Geometry, Offset=number_slider_8)
planesrf_3 = PlaneSurface(Plane=pl_offset_2, XSize=Domain(-10, 10), YSize=Domain(-10, 10))
dup_4 = DuplicateData(Data=clean_36, Number=2, Order=True)
offsrf_14 = OffsetSurface(Surface=planesrf_3, Distance=[1, -1], BothSides=0, CreateSolid=True)
sdiff_13 = SolidDifference(BrepsA=graft(dup_4), BrepsB=offsrf_14)
trim_14 = TrimTree(Tree=sdiff_13, Depth=1)  # -> simplify(Tree)

tstat_42 = TreeStatistics(Tree=trim_14)  # -> Paths, Length, Count
split_65 = SplitTree(Data=simplify(split_61.Negative), Masks=flatten(tstat_42.Paths))  # -> Positive, Negative
merge_53 = Merge(Data1=trim_14, Data2=split_65.Negative)
geo_69 = Geometry(merge_53)

# ---- group: On-site Pockets
data_35 = Data(tstat.Paths)
split_66 = SplitTree(Data=simplify(geo_69), Masks=flatten(data_35))  # -> Positive, Negative
tstat_43 = TreeStatistics(Tree=split_66.Positive)  # -> Paths, Length, Count
split_67 = SplitTree(Data=data_18, Masks=flatten(tstat_43.Paths))  # -> Positive, Negative
sdiff_14 = SolidDifference(BrepsA=split_66.Positive, BrepsB=split_67.Positive)
merge_54 = Merge(Data1=sdiff_14, Data2=split_66.Negative)

# ----
split_68 = SplitTree(Data=simplify(move_28.Geometry), Masks=flatten(tstat_40.Paths))  # -> Positive, Negative
clean_37 = CleanTree(RemoveNulls=True, RemoveInvalid=True, RemoveEmpty=False, Tree=split_68.Negative)

split_69 = SplitTree(Data=simplify(data_20), Masks=flatten(tstat_40.Paths))  # -> Positive, Negative
eso = ExtendSpeckleObject(SpeckleObject=merge_54, Type="Solid", selectedKitName="Objects")

# ----
# Beams
move_31 = Move(Geometry=crv_17, Motion=vec_5)  # -> Geometry, Transform
toggle_2 = BooleanToggle(True)

# ----
# Top Plates
cluster_18 = Cluster_3(P=move_31.Geometry, M=txt_4, D=Toggle(False))  # -> geo_4, geo_5, geo_6, M_2

# ----
# RAW - Solid
panel_62 = Panel("solid")
string_filter_6 = StringFilter(Text=data_33, Object=data_34, Key=panel_62)  # -> Text, Object
clean_38 = CleanTree(RemoveNulls=True, RemoveInvalid=True, RemoveEmpty=True, Tree=string_filter_6.Text)
split_70 = SplitTree(Data=clean_38, Masks=flatten("{!0,8;*}"))  # -> Positive, Negative
clt_offset_4 = Slider(0.02, range=0..0.1)
tstat_44 = TreeStatistics(Tree=split_70.Positive)  # -> Paths, Length, Count
cluster_19 = Cluster_3(P=move_31.Geometry, M=tstat_44.Paths, D=Toggle(False))  # -> geo_4, geo_5, geo_6, M_2
item_52 = ListItem(List=buildup.BuildupValue, Index=[0, -1], Wrap=True)
geo_70 = Geometry(cluster_19.geo_4)
geo_71 = Geometry(cluster_19.geo_5)
geo_72 = Geometry(cluster_19.geo_6)
generate_raw_plate = GenerateRawPlate(
    BaseOutline=simplify(geo_70),
    BasePlane=geo_71,
    MitrePlanes=geo_72,
    FabricationOffsets=clt_offset_4,
    Buildup=item_52,
    PlateType=Slider(3, range=0..10))  # -> RawPlate, RawBoundingBox, EdgeOffsets, OffsetPolyline

deplane_7 = DeconstructPlane(Plane=cluster_18.geo_6)  # -> Origin, XAxis, YAxis, ZAxis
cluster_20 = Cluster(P=cluster_18.geo_4, V=deplane_7.YAxis, O=item_41.Item3, O_2=item_41.Item2)  # -> T_2, T, T_3
cluster_21 = Cluster_2(G=thicker_bottom_plate, P=cluster_18.geo_4, V=deplane_7.YAxis, M=clean_21, L=data_31, L_2=buildup_3.BuildupValue)  # -> T, T_2, s_1

series_2 = Series(Start=0, Step=1, Count=3)
generate_raw_plate_2 = GenerateRawPlate(
    BaseOutline=simplify(cluster_18.geo_4),
    BasePlane=cluster_18.geo_5,
    MitrePlanes=cluster_18.geo_6,
    FabricationOffsets=merge_2,
    Buildup=filter_7,
    PlateType=series_2)  # -> RawPlate, RawBoundingBox, EdgeOffsets, OffsetPolyline

# ---- group: Trim Ridge Segments
geo_73 = Geometry(generate_raw_plate.RawPlate)
move_32 = Move(Geometry=geo_58, Motion=vec_5)  # -> Geometry, Transform
plntrimsrf_2 = PlaneTrimSurface(Surface=geo_73, Plane=move_32.Geometry, Flip=False)  # -> Trimmed, Intersected
cap_6 = CapHoles(Brep=plntrimsrf_2.Trimmed)  # -> simplify(Brep)
c_script_39 = CSharpScript(x=generate_raw_plate.OffsetPolyline, y=cap_6, z=plntrimsrf_2.Intersected)  # -> out, A, B; inputs x: Polyline, y: Brep, z: Boolean
# ---------- c_script_39: C# ----------
    Plane plane;
    Plane.FitPlaneToPoints(x, out plane);

    if(z)
    {

      Polyline poly;
      A = PlateSolidOffsetExtrude_net48(y, plane, out poly);
      B = poly;
    }
    else
    {
      A = y;
      B = x;
    }
# ---------- c_script_39: C# additional code ----------
  private Brep PlateSolidOffsetExtrude_net48(Brep B, Plane Pl, out Polyline outline)
  {
    outline = new Polyline();
    if (B == null || !B.IsValid) return null;

    double tol = RhinoDoc.ActiveDoc != null ? RhinoDoc.ActiveDoc.ModelAbsoluteTolerance : 1e-3;
    double angTol = RhinoMath.ToRadians(1.0);

    // Project any curve orthogonally to a plane (drop Z in that plane's frame)
    Func<Curve, Plane, Curve> ProjectToPlane = (c, pln) =>
      {
      if (c == null) return null;
      Transform toPl = Transform.PlaneToPlane(Plane.WorldXY, pln);
      Transform fromPl = Transform.PlaneToPlane(pln, Plane.WorldXY);

      Curve crv = c.DuplicateCurve();
      crv.Transform(fromPl); // now 'pln' acts like WorldXY

      NurbsCurve n = crv.ToNurbsCurve();
      if (n == null) return null;
      for (int i = 0; i < n.Points.Count; i++)
      {
        Point3d p = n.Points[i].Location;
        n.Points.SetPoint(i, new Point3d(p.X, p.Y, 0.0)); // orthogonal drop
      }
      n.Transform(toPl);
      return n;
      };

    // Find the two planar faces parallel to Pl.Normal and measure signed distances
    bool haveTop = false, haveBot = false;
    int topIndex = -1, botIndex = -1;
    double topSigned = 0.0, botSigned = 0.0, topArea = 0.0, botArea = 0.0;
    Plane topPlane = Plane.Unset, botPlane = Plane.Unset;

    for (int i = 0; i < B.Faces.Count; i++)
    {
      BrepFace f = B.Faces[i];
      if (!f.IsPlanar(tol)) continue;

      Plane fp; if (!f.TryGetPlane(out fp)) continue;

      double ang = Vector3d.VectorAngle(fp.ZAxis, Pl.Normal);
      ang = Math.Min(ang, Math.Abs(Math.PI - ang)); // treat ± parallel
      if (ang > angTol) continue;

      double signed = Pl.DistanceTo(fp.Origin); // >0 above Pl, <0 below Pl

      AreaMassProperties amp = AreaMassProperties.Compute(f);
      double area = amp != null ? amp.Area : 0.0;

      if (!haveTop || signed > topSigned) { haveTop = true; topSigned = signed; topIndex = i; topArea = area; topPlane = fp; }
      if (!haveBot || signed < botSigned) { haveBot = true; botSigned = signed; botIndex = i; botArea = area; botPlane = fp; }
    }
    if (!haveTop || !haveBot) return null;

    // Use the larger of the two faces to harvest the outline
    int biggestIndex; Plane biggestPlane;
    if (topArea >= botArea) { biggestIndex = topIndex; biggestPlane = topPlane; }
    else { biggestIndex = botIndex; biggestPlane = botPlane; }

    BrepFace bigFace = B.Faces[biggestIndex];

    // Pick the largest closed loop on that face (by projected area)
    Curve largest = null; double maxA = double.NegativeInfinity;
    foreach (BrepLoop loop in bigFace.Loops)
    {
      Curve c3 = loop.To3dCurve(); if (c3 == null) continue;
      Curve flat = ProjectToPlane(c3, biggestPlane);
      if (flat == null || !flat.IsClosed) continue;

      AreaMassProperties a = AreaMassProperties.Compute(flat);
      if (a != null && a.Area > maxA) { maxA = a.Area; largest = c3; }
    }
    if (largest == null) return null;

    // Project that boundary to the mid-plane (Pl) and make a clean, closed polyline
    Curve onPl = ProjectToPlane(largest, Pl);
    if (onPl == null) return null;

    onPl = onPl.Simplify(CurveSimplifyOptions.All, tol, tol) ?? onPl;

    Polyline poly;
    if (!onPl.TryGetPolyline(out poly))
    {
      PolylineCurve plc = onPl.ToPolyline(tol, tol, 0.0, 0.0);
      if (plc != null && plc.TryGetPolyline(out poly) && poly.Count > 2) { }
      else
      {
        onPl = onPl.ToNurbsCurve(); if (onPl == null) return null;
        double len = onPl.GetLength();
        int div = Math.Max(64, (int) (len / Math.Max(1e-9, tol * 10.0)));
        Point3d[] pts;
        var ok = onPl.DivideByCount(div, true, out pts);
        if (ok.Length < 1 || pts == null || pts.Length < 3) return null;
        poly = new Polyline(pts);
      }
    }
    if (!poly.IsClosed)
    {
      if (poly.Count > 1 && poly[0].DistanceTo(poly[poly.Count - 1]) > tol) poly.Add(poly[0]);
    }
    if (!poly.IsValid || poly.Count < 4) return null;

    // expose the outline on the mid-plane
    outline = poly;

    // === Offset-in-two-directions via mid-plane extrusion ===
    double thickness = topSigned - botSigned; // total thickness
    if (thickness <= tol) return null;

    // Outline on the mid-plane stays as-is:
    PolylineCurve baseMid = poly.ToPolylineCurve();

    // 1) Duplicate the outline and move it onto the bottom plane (at botSigned)
    PolylineCurve baseBottom = baseMid.DuplicateCurve() as PolylineCurve;
    if (baseBottom == null) return null;

    Vector3d bottomShift = Pl.Normal;
    bottomShift.Unitize();
    bottomShift *= botSigned; // move from mid-plane to bottom plane
    Transform toBottom = Transform.Translation(bottomShift);
    baseBottom.Transform(toBottom);

    // 2) Extrude explicitly along Pl.Normal by 'thickness'
    Vector3d extrudeDir = Pl.Normal;
    extrudeDir.Unitize();
    extrudeDir *= thickness;

    // Make extrusion surface
    Surface srf = Surface.CreateExtrusion(baseBottom, extrudeDir);
    if (srf == null) return null;

    // Convert extrusion surface to Brep
    Brep solid = srf.ToBrep();
    if (solid == null) return null;

    // Try to cap it
    solid = solid.CapPlanarHoles(tol);
    if (!solid.IsSolid) return null;

    // Optional cleanup
    solid.MergeCoplanarFaces(tol, RhinoMath.ToRadians(1.0));

    return solid;


  }
# ---------- end c_script_39 ----------

# ----
move_33 = Move(Geometry=crv_18, Motion=vec_5)  # -> Geometry, Transform
move_34 = Move(Geometry=geo_57, Motion=vec_5)  # -> Geometry, Transform
end_2 = EndPoints(Curve=move_33.Geometry)  # -> Start, End
move2pt = MoveToPoint(Geometry=move_33.Geometry, PointA=end_2.Start, PointB=move_34.Geometry)  # -> Moved, Vector, Transform
align_4 = AlignPlane(Plane=move_34.Geometry, Direction=move2pt.Moved)  # -> Plane, Angle
tstat_45 = TreeStatistics(Tree=simplify(geo_70))  # -> Paths, Length, Count
split_71 = SplitTree(Data=simplify(align_4.Plane), Masks=flatten(tstat_45.Paths))  # -> Positive, Negative
bbox_7 = BoundingBox(Content=c_script_39.A, Plane=split_71.Positive)  # -> Box, Box_2

# ----
# 4 VALENT
number_slider_20 = Slider(0.03, range=0..0.1)
pl_offset_3 = PlaneOffset(BasePlane=_4_valent, Offset=number_slider_20)
clean_39 = CleanTree(RemoveNulls=True, RemoveInvalid=True, RemoveEmpty=True, Tree=pl_offset_3)
tstat_46 = TreeStatistics(Tree=clean_39)  # -> Paths, Length, Count
split_72 = SplitTree(Data=geo_71, Masks=flatten(tstat_46.Paths))  # -> Positive, Negative
deplane_8 = DeconstructPlane(Plane=clean_39)  # -> Origin, XAxis, YAxis, ZAxis
deplane_9 = DeconstructPlane(Plane=split_72.Positive)  # -> Origin, XAxis, YAxis, ZAxis
pl_7 = ConstructPlane(Origin=deplane_8.Origin, XAxis=deplane_9.ZAxis, YAxis=deplane_8.YAxis)
c_script_40 = CSharpScript(x=pl_7, y=clean_39)  # -> out, A; inputs x: Plane, y: Plane
# ---------- c_script_40: C# ----------
    Plane pln = new Plane(x);
    if(pln.ZAxis.IsParallelTo(y.ZAxis, Math.PI / 3) != 1) pln = new Plane(pln.Origin, -1 * pln.ZAxis);
    A = pln;
# ---------- end c_script_40 ----------
filter_8 = StreamFilter(Gate=Toggle(True), Stream0=clean_39, Stream1=c_script_40.A)
pln_21 = Plane(filter_8)
deplane_10 = DeconstructPlane(Plane=pln_21)  # -> Origin, XAxis, YAxis, ZAxis
rectangle = Rectangle(Plane=pln_21, XSize=Domain(-10, 10), YSize=Domain(-10, 10), Radius=0)  # -> Rectangle, Length
boundary_20 = BoundarySurfaces(Edges=rectangle.Rectangle)
amp_2 = Amplitude(Vector=deplane_10.ZAxis, Amplitude=10)
extr_5 = Extrude(Base=boundary_20, Direction=amp_2)
split_73 = SplitTree(Data=c_script_39.A, Masks=flatten(tstat_46.Paths))  # -> Positive, Negative
splitmul = SplitBrepMultiple(Brep=split_73.Positive, Cutters=extr_5)
capex = CapHolesEx(Brep=splitmul)  # -> Brep, Caps, Solid
area_44 = Area(Geometry=capex.Brep)  # -> Area, Centroid
sort_18 = SortList(Keys=area_44.Area, ValuesA=capex.Brep)  # -> Keys, reverse(ValuesA)
item_53 = ListItem(List=sort_18.ValuesA, Index=0, Wrap=True)  # -> simplify(Item)
volume = Volume(Geometry=item_53)  # -> Volume, Centroid
volume_2 = Volume(Geometry=split_73.Positive)  # -> Volume, Centroid
geo_74 = Geometry(item_53)
division_14 = Division(A=volume.Volume, B=volume_2.Volume)
abs = Absolute(Value=division_14)
smaller_3 = SmallerThan(FirstNumber=abs, SecondNumber=0.8)  # -> SmallerThan, OrEqualTo
p_n_c = PickNChoose(Pattern=smaller_3.SmallerThan, Stream0=geo_74, Stream1=split_73.Positive)

tstat_47 = TreeStatistics(Tree=simplify(p_n_c))  # -> Paths, Length, Count
geo_75 = Geometry(merge_54)
split_74 = SplitTree(Data=simplify(geo_75), Masks=flatten(tstat_47.Paths))  # -> Positive, Negative

number_slider_21 = Slider(0.998, range=0..1)
move_35 = Move(Geometry=geo_57, Motion=data_17)  # -> Geometry, Transform
split_75 = SplitTree(Data=simplify(move_35.Geometry), Masks=flatten(tstat_47.Paths))  # -> Positive, Negative
area_45 = Area(Geometry=split_74.Positive)  # -> Area, Centroid
scale_nu_14 = ScaleNU(
    Geometry=split_74.Positive,
    Plane=split_75.Positive,
    ScaleX=number_slider_21,
    ScaleY=number_slider_21,
    ScaleZ=Slider(0.98, range=0..1))  # -> Geometry, Transform
shapein = ShapeInBrep(Brep=p_n_c, Shape=scale_nu_14.Geometry)
larger_3 = LargerThan(FirstNumber=shapein, SecondNumber=0)  # -> LargerThan, OrEqualTo
c_script_41 = CSharpScript(x=larger_3.LargerThan)  # -> out, simplify(A); inputs x: list of Boolean
# ---------- c_script_41: C# ----------
    if(x.Count == 2)
    {
      if(x[0] || x[1])
        A = true;
      else
        A = false;
    }
    else
      A = x[0];
# ---------- end c_script_41 ----------

p_n_c_2 = PickNChoose(Pattern=c_script_41.A, Stream0=p_n_c, Stream1=split_73.Positive)

merge_55 = Merge(Data1=p_n_c_2, Data2=split_73.Negative)

sec = BrepPlane(Brep=merge_55, Plane=geo_71)  # -> Curves, Points
explode_6 = Explode(Curve=sec.Curves, Recursive=True)  # -> Segments, Vertices
explode_7 = Explode(Curve=geo_70, Recursive=True)  # -> Segments, Vertices
pline = PolyLine(Vertices=explode_6.Vertices, Closed=True)
item_54 = ListItem(List=explode_7.Vertices, Index=0, Wrap=True)
merge_56 = Merge(Data1=simplify(pline), Data2=simplify(geo_70))
alicrvseams = AlignCurveSeams(Curves=merge_56, Guide=item_54, Snap=True, Iterative=True)  # -> Aligned, Points, R
item_55 = ListItem(List=alicrvseams.Aligned, Index=0, Wrap=True)

trigger = Trigger(Interval=-200, TimerInterval=200, Target=c_script_42)  # disabled
tstat_48 = TreeStatistics(Tree=simplify(p_n_c_2))  # -> Paths, Length, Count
geo_76 = Geometry(geo_75)
lng_6 = ListLength(List=flatten(p_n_c_2))
c_script_42 = CSharpScript(x=Button(), y=lng_6, z=Toggle(True))  # -> out, A; inputs x: Boolean, y: Int32, z: Boolean
# ---------- c_script_42: C# ----------
    if(x) counter = -1;
    else
    {
      if(counter != y)
      {
       if(!z) 
        counter++;
       else
          counter--;
      }
    }
    A = counter;
# ---------- c_script_42: C# additional code ----------
  public int counter = 0;
# ---------- end c_script_42 ----------
item_56 = ListItem(List=flatten(tstat_48.Paths), Index=c_script_42.A, Wrap=True)
item_57 = ListItem(List=flatten(p_n_c_2), Index=c_script_42.A, Wrap=True)
item_58 = ListItem(List=flatten(split_73.Positive), Index=c_script_42.A, Wrap=True)
item_59 = ListItem(List=flatten(split_72.Positive), Index=c_script_42.A, Wrap=True)
split_76 = SplitTree(Data=simplify(geo_76), Masks=flatten(item_56))  # -> Positive, Negative
orient = Orient(Geometry=item_57, Source=item_59, Target=PlaneXY(0, 0, 0))  # -> Geometry, Transform
panel_63 = Panel(c_script_42.A)
orient_2 = Orient(Geometry=split_76.Positive, Source=item_59, Target=PlaneXY(0, 0, 0))  # -> Geometry, Transform
orient_3 = Orient(Geometry=item_58, Source=item_59, Target=PlaneXY(0, 0, 0))  # -> Geometry, Transform
panel_64 = Panel(item_56)
preview_11 = CustomPreview(Geometry=orient_2.Geometry, Material=ColourSwatch(SwatchColor=RGBA(255, 61, 61, 75)))
preview_12 = CustomPreview(Geometry=orient.Geometry, Material=ColourSwatch(SwatchColor=RGBA(46, 171, 255, 75)))
preview_13 = CustomPreview(Geometry=orient_3.Geometry, Material=ColourSwatch(SwatchColor=RGBA(79, 108, 255, 25)))
split_77 = SplitTree(Data=merge_55, Masks=flatten(panel_64))  # -> Positive, Negative

split_78 = SplitTree(Data=geo_76, Masks=flatten(panel_64))  # -> Positive, Negative

pln_22 = Plane(cluster_21.s_1)
pln_23 = Plane(cluster_21.T)
merge_57 = Merge(Data1=pln_22, Data2=pln_23)
avrpln = AveragePlane(Planes=merge_57)

# ----
# Beams
item_60 = ListItem(List=buildup_3.BuildupValue, Index=0, Wrap=True)  # -> Item, Item1, Item2, Item3
move_36 = Move(Geometry=crv_17, Motion=vec_5)  # -> Geometry, Transform

# ----
# Acoustic Battens + Screws
dso_45 = DeconstructSpeckleObject(SpeckleObject=dso_31.AcousticBatten, selectedKitName="Objects")  # -> PadddingBehindAcousticPanel, PaddingThickness, Spacing, Thickness, Width

clean_40 = CleanTree(RemoveNulls=True, RemoveInvalid=True, RemoveEmpty=True, Tree=data_6)

# ----
# Bottom Plates
move_37 = Move(Geometry=clean_40, Motion=vec_5)  # -> Geometry, Transform

boundary_21 = BoundarySurfaces(Edges=move_37.Geometry)  # -> simplify(Surfaces)
flip_4 = Flip(Surface=boundary_21, Guide=planesrf)  # -> Surface, Result
offsrf_15 = OffsetSurface(Surface=flip_4.Surface, Distance=2, BothSides=-1, CreateSolid=True)  # -> simplify(Offset)
tstat_49 = TreeStatistics(Tree=offsrf_15)  # -> Paths, Length, Count
split_79 = SplitTree(Data=simplify(cluster_21.T_2), Masks=flatten(tstat_49.Paths))  # -> Positive, Negative
sdiff_15 = SolidDifference(BrepsA=split_79.Positive, BrepsB=offsrf_15)
merge_58 = Merge(Data1=split_79.Negative, Data2=sdiff_15)

pln_24 = Plane(boundary_21)
tstat_50 = TreeStatistics(Tree=pln_24)  # -> Paths, Length, Count
split_80 = SplitTree(Data=avrpln, Masks=flatten(tstat_50.Paths))  # -> Positive, Negative
split_81 = SplitTree(Data=pln_24, Masks=flatten(tstat_50.Paths))  # -> Positive, Negative
c_script_43 = CSharpScript(x=split_80.Positive, y=split_81.Positive)  # -> out, A; inputs x: Plane, y: Plane
# ---------- c_script_43: C# ----------
    A = GetDistanceBetweenPlanes(x, y);
# ---------- c_script_43: C# additional code ----------
  public static double GetDistanceBetweenPlanes(Plane planeA, Plane planeB)
  {
    double tolerance = RhinoDoc.ActiveDoc.ModelAbsoluteTolerance;
    // Check if planes are parallel by verifying that their normals are parallel.
    // For parallel planes, the cross product of their normals is near zero.
    Vector3d cross = Vector3d.CrossProduct(planeA.Normal, planeB.Normal);
    if (cross.Length == 0)
    {
      // The planes are not parallel, so they intersect. Distance is zero.
      return 0.0;
    }

    // Calculate the difference between the origins.
    Vector3d diff = planeB.Origin - planeA.Origin;

    // The distance is the absolute value of the projection of the difference onto the normal.
    double distance = Math.Abs(Vector3d.Multiply(diff, planeA.Normal));
    return distance;
  }
# ---------- end c_script_43 ----------
roundd_4 = RoundToDecimalPlace(NumberX=c_script_43.A, DecimalPlace=4, RoundType=0)  # -> Rounded, Difference
offset_2 = OffsetSurface(Surface=boundary_21, Distance=expr("-x", roundd_4.Rounded), Retrim=True)
split_82 = SplitTree(Data=offset_2, Masks=flatten(clean_21))  # -> Positive, Negative
offsrf_16 = OffsetSurface(
    Surface=split_82.Negative,
    Distance=expr("x/2", dso_31.Bottom_layer),
    BothSides=expr("-x/2", dso_31.Bottom_layer),
    CreateSolid=True)  # -> simplify(Offset)
panel_65 = Panel(roundd_4.Rounded)
offsrf_17 = OffsetSurface(
    Surface=split_82.Positive,
    Distance=expr("x/2", botttom_plate_alt),
    BothSides=expr("-x/2", botttom_plate_alt),
    CreateSolid=True)  # -> simplify(Offset)
merge_59 = Merge(Data1=offsrf_16, Data2=offsrf_17)

clean_41 = CleanTree(RemoveNulls=True, RemoveInvalid=True, RemoveEmpty=True, Tree=merge_59)
tstat_51 = TreeStatistics(Tree=clean_41)  # -> Paths, Length, Count
tstat_52 = TreeStatistics(Tree=merge_58)  # -> Paths, Length, Count
tree_11 = CreateTree(Data=flatten(clean_41), Path=tstat_51.Paths, Ensure=tstat_52.Paths)

clean_42 = CleanTree(RemoveNulls=True, RemoveInvalid=True, RemoveEmpty=True, Tree=data_15)  # -> simplify(flatten(Tree))
tstat_53 = TreeStatistics(Tree=merge_58)  # -> Paths, Length, Count
c_script_44 = CSharpScript(x=tstat_53.Paths, y=clean_42)  # -> out, A; inputs x: String, y: list of String
# ---------- c_script_44: C# ----------
    if(y.Contains(x)) A = true;
    else A = false;
# ---------- end c_script_44 ----------
tree_12 = CreateTree(Data=c_script_44.A, Path=tstat_53.Paths)
cull_12 = CullPattern(List=flatten(merge_58), CullPattern=c_script_44.A)
c_script_45 = CSharpScript(x=tree_12, z=data_27)  # -> out, A; inputs x: Boolean
# ---------- c_script_45: C# ----------
    if(x) A = z+"_50mm"; else A = z+"_27mm";
# ---------- end c_script_45 ----------
c_script_46 = CSharpScript(x=tree_12, z=data_26)  # -> out, A; inputs x: Boolean
# ---------- c_script_46: C# ----------
    if(x) A = z + " - Final Thickness = 105mm"; else A = z + " - Final Thickness = 128mm";
# ---------- end c_script_46 ----------

area_46 = Area(Geometry=flip_4.Surface)  # -> Area, Centroid
tstat_54 = TreeStatistics(Tree=flip_4.Surface)  # -> Paths, Length, Count

toggle_3 = BooleanToggle(True)
cluster_22 = Cluster_3(P=move_31.Geometry, M=txt_4, D=toggle_3)  # -> geo_4, geo_5, geo_6, M_2

# ----
# Beam WidtHs
tstat_55 = TreeStatistics(Tree=cluster_22.geo_4)  # -> Paths, Length, Count
split_83 = SplitTree(Data=simplify(data_21), Masks=flatten(tstat_55.Paths))  # -> Positive, Negative
split_84 = SplitTree(Data=simplify(move_24.Geometry), Masks=flatten(tstat_55.Paths))  # -> Positive, Negative
num_12 = Number(split_83.Positive)
division_15 = Division(A=num_12, B=100)
cp_5 = ClosestPoint(Point=cluster_22.geo_6, Cloud=split_84.Positive)  # -> ClosestPoint, CPIndex, Distance
item_61 = ListItem(List=division_15, Index=cp_5.CPIndex, Wrap=True)

data_36 = Data(item_61)

extremums_5 = MinMax(Number=flatten(data_36))  # -> Minimum, Maximum
gradient_2 = Gradient(
    LowerLimit=extremums_5.Minimum,
    UpperLimit=extremums_5.Maximum,
    Parameter=data_36,
    stops=[0.15: RGBA(134, 105, 191, 80), 0.85: RGB(0, 255, 111)])

tag_7 = TextTag(Location=split_84.Positive, Text=division_15)
tag_8 = TextTag(Location=cp_5.ClosestPoint, Text=data_36, Colour=gradient_2)

split_85 = SplitTree(Data=simplify(data_36), Masks=flatten(tstat_40.Paths))  # -> Positive, Negative

split_86 = SplitTree(Data=simplify(data_36), Masks=flatten(tstat_40.Paths))  # -> Positive, Negative

cluster_23 = Cluster_3(P=move_36.Geometry, M=txt_4, D=toggle_3)  # -> geo_4, geo_5, geo_6, M_2
generate_beam = GenerateBeam(
    EdgePlanes=cluster_23.geo_6,
    Polyline=cluster_23.geo_4,
    BasePlane=cluster_23.geo_5,
    TopPlateOffset=item_60.Item2,
    BottomPlateOffset=item_60.Item1,
    BeamWidths=split_86.Positive,
    BeamWidthMinimum=toggle_2,
    BeamMinLength=number_slider_6,
    FabricationTolerance=number_slider_5,
    FlipBeams=False)  # -> Beams, BeamPlanes, BoundingBox, InteriorPlanes, simplify(EndPlanes), ExteriorLengths, InteriorLengths

brec_9 = BoundingRectangle(Geometry=flatten(dso_28.Polyline), Plane=PlaneXY(0, 0, 0), Axis=0, Slide=0, Union=True)  # -> Bounding, DimensionX, DimensionY
project_8 = Project(Geometry=brec_9.Bounding, Plane=xy_3)  # -> Geometry, Transform
polyoffset_4 = PolylineOffset(
    Polylines=project_8.Geometry,
    Distance=Slider(1, range=0..1),
    Plane=xy_3,
    Tolerance=0.0001,
    ClosedFillet=1,
    OpenFillet=1,
    Miter=2)  # -> Contour, Holes
rdiff_3 = RegionDifference(CurvesA=polyoffset_4.Contour, CurvesB=project_8.Geometry)
boundary_22 = BoundarySurfaces(Edges=rdiff_3)
Z_9 = UnitZ(Factor=number_slider_14)
move_38 = Move(Geometry=boundary_22, Motion=expr("-x", Z_9))  # -> Geometry, Transform
extr_6 = Extrude(Base=move_38.Geometry, Direction=expr("2*x", Z_9))
move_39 = Move(Geometry=extr_6, Motion=vec_5)  # -> Geometry, Transform

brec_10 = BoundingRectangle(Geometry=flatten(dso_28.Polyline), Plane=PlaneXY(0, 0, 0), Axis=0, Slide=0, Union=True)  # -> Bounding, DimensionX, DimensionY
project_9 = Project(Geometry=brec_10.Bounding, Plane=xy_3)  # -> Geometry, Transform
polyoffset_5 = PolylineOffset(
    Polylines=project_9.Geometry,
    Distance=Slider(1, range=0..1),
    Plane=xy_3,
    Tolerance=0.0001,
    ClosedFillet=1,
    OpenFillet=1,
    Miter=2)  # -> Contour, Holes
rdiff_4 = RegionDifference(CurvesA=polyoffset_5.Contour, CurvesB=project_9.Geometry)
boundary_23 = BoundarySurfaces(Edges=rdiff_4)
Z_10 = UnitZ(Factor=number_slider_14)
move_40 = Move(Geometry=boundary_23, Motion=expr("-x", Z_10))  # -> Geometry, Transform
extr_7 = Extrude(Base=move_40.Geometry, Direction=expr("2*x", Z_10))
move_41 = Move(Geometry=extr_7, Motion=vec_5)  # -> Geometry, Transform

generate_beam_2 = GenerateBeam(
    EdgePlanes=cluster_22.geo_6,
    Polyline=cluster_22.geo_4,
    BasePlane=cluster_22.geo_5,
    TopPlateOffset=item_41.Item2,
    BottomPlateOffset=item_41.Item1,
    BeamWidths=split_85.Positive,
    BeamWidthMinimum=toggle_2,
    BeamMinLength=number_slider_6,
    FabricationTolerance=number_slider_5,
    FlipBeams=False)  # -> Beams, BeamPlanes, BoundingBox, InteriorPlanes, simplify(EndPlanes), ExteriorLengths, InteriorLengths

geo_77 = Geometry(generate_beam_2.EndPlanes)
trim_15 = TrimTree(Tree=geo_77, Depth=1)
shift = ShiftList(List=trim_15, Shift=1, Wrap=False)
partition = PartitionList(List=shift, Size=2)
item_62 = ListItem(List=partition, Index=0, Wrap=True)
pt_4 = Point(partition)
avr_4 = Average(Input=pt_4)
pl_origin_6 = PlaneOrigin(Base=item_62, Origin=avr_4)
trim_16 = TrimTree(Tree=pl_origin_6, Depth=1)  # -> simplify(Tree)
shift_2 = ShiftList(List=trim_16, Shift=-1, Wrap=False)
geo_78 = Geometry(reverse(shift_2))
move_42 = Move(Geometry=geo_78, Motion=expr("-x", vec_2))  # -> Geometry, Transform
match_9 = MatchTree(Tree=move_42.Geometry, Guide=cluster_22.geo_4)
split_87 = SplitTree(Data=simplify(match_9), Masks=flatten(tstat_15.Paths))  # -> Positive, Negative

geo_79 = Geometry(reverse(generate_beam_2.InteriorPlanes))
move_43 = Move(Geometry=geo_79, Motion=expr("-x", vec_2))  # -> Geometry, Transform
match_10 = MatchTree(Tree=move_43.Geometry, Guide=cluster_22.geo_4)
split_88 = SplitTree(Data=simplify(match_10), Masks=flatten(tstat_15.Paths))  # -> Positive, Negative

pl_offset_4 = PlaneOffset(BasePlane=split_88.Positive, Offset=offset_from_beams)

ppx = PlanePlane(PlaneA=planar_2.Plane, PlaneB=pl_offset_4)
cluster_24 = Cluster_21(A=planar_2.Plane, _0=pl_offset_4, _1=split_87.Positive)  # -> simplify(pl)

shift_3 = ShiftList(List=ppx, Shift=1, Wrap=True)  # -> simplify(List)
llx = LineLine(Line1=ppx, Line2=shift_3)  # -> ParamA, ParamB, PointA, PointB
pline_2 = PolyLine(Vertices=llx.PointA, Closed=True)

polyline_interior_angles_2 = PolylineInteriorAngles(Polyline=cluster_24)  # -> Angles, Points
deg_2 = Degrees(Radians=polyline_interior_angles_2.Angles)
smaller_4 = SmallerThan(FirstNumber=deg_2, SecondNumber=5)  # -> SmallerThan, OrEqualTo
cull_13 = CullPattern(List=polyline_interior_angles_2.Points, CullPattern=invert(smaller_4.OrEqualTo))
cull_14 = CullPattern(List=polyline_interior_angles_2.Points, CullPattern=smaller_4.OrEqualTo)
pline_3 = PolyLine(Vertices=cull_13, Closed=True)

cx = CurveSelf(Curve=cluster_24)  # -> Points, Params
shatter = Shatter(Curve=cluster_24, Parameters=cx.Params)
len_11 = Length(Curve=shatter)
sort_19 = SortList(Keys=len_11, ValuesA=shatter)  # -> Keys, ValuesA
item_63 = ListItem(List=reverse(sort_19.ValuesA), Index=0, Wrap=True)  # -> simplify(Item)
clean_43 = CleanTree(RemoveNulls=True, RemoveInvalid=True, RemoveEmpty=True, Tree=item_63)
tstat_56 = TreeStatistics(Tree=simplify(clean_43))  # -> Paths, Length, Count

c_script_47 = CSharpScript(x=tstat_56.Paths)  # -> out, A; inputs x: list
# ---------- c_script_47: C# ----------
    if( x == null) A = "{!*}";
    else A = x;
# ---------- end c_script_47 ----------

split_89 = SplitTree(Data=cluster_24, Masks=flatten(c_script_47.A))  # -> Positive, Negative
merge_60 = Merge(Data1=split_89.Negative, Data2=clean_43)

boundary_24 = BoundarySurfaces(Edges=merge_60)
flip_5 = Flip(Surface=boundary_24, Guide=xy_2)  # -> Surface, Result
crv_cp = CurveClosestPoint(Point=midpt_3, Curve=merge_60)  # -> Point, Parameter, Distance
offsrf_18 = OffsetSurface(Surface=flip_5.Surface, Distance=acoustic_top, BothSides=acoustic_bottom, CreateSolid=True)  # -> simplify(Offset)

move_44 = Move(Geometry=offsrf_18, Motion=vec_2)  # -> Geometry, Transform

match_11 = MatchTree(Tree=offsrf_18, Guide=planar_2.Plane)

ln_4 = Line(StartPoint=midpt_3, EndPoint=crv_cp.Point)  # -> simplify(Line)
plx = LinePlane(Line=ln_4, Plane=split_88.Positive)  # -> Point, ParamL, ParamP
addition_8 = Addition(A=crv_cp.Distance, B=neg_2)
dist_3 = Distance(PointA=crv_cp.Point, PointB=plx.Point)
extremums_6 = MinMax(Number=flatten(dist_3))  # -> Minimum, Maximum

trim_17 = TrimTree(Tree=match_11, Depth=1)
avr_5 = Average(Input=flatten(dist_3))
geo_80 = Geometry(move_44.Geometry)

area_47 = Area(Geometry=trim_17)  # -> Area, Centroid
cp_6 = ClosestPoint(Point=area_47.Centroid, Cloud=flatten(area_17.Centroid))  # -> ClosestPoint, CPIndex, Distance
item_64 = ListItem(List=tstat_17.Paths, Index=cp_6.CPIndex, Wrap=True)  # -> flatten(Item)
tree_13 = CreateTree(Data=flatten(trim_17), Path=item_64, Ensure=tstat_17.Paths)  # -> simplify(Data)
move_45 = Move(Geometry=tree_13, Motion=vec_2)  # -> Geometry, Transform

panel_66 = Panel([extremums_6.Maximum, extremums_6.Minimum, avr_5])

geo_81 = Geometry(move_45.Geometry)

debrep_7 = DeconstructBrep(Brep=geo_81)  # -> Faces, Edges, Vertices
join_11 = BrepJoin(Breps=debrep_7.Faces)  # -> Breps, Closed

geo_82 = Geometry(join_11.Breps)
clash_9 = Clash(FirstSet=geo_82, SecondSet=data_14, Distance=0, L=100)  # -> ClashCount, ClashPoints, ClashRadii, FirstIndex, SecondIndex
item_65 = ListItem(List=cap_5, Index=clash_9.SecondIndex, Wrap=True)
sdiff_16 = SolidDifference(BrepsA=geo_82, BrepsB=item_65)

clean_44 = CleanTree(RemoveNulls=True, RemoveInvalid=True, RemoveEmpty=True, Tree=simplify(sdiff_16))
tstat_57 = TreeStatistics(Tree=clean_44)  # -> Paths, Length, Count
split_90 = SplitTree(Data=simplify(geo_82), Masks=flatten(tstat_57.Paths))  # -> Positive, Negative
merge_61 = Merge(Data1=clean_44, Data2=split_90.Negative)
clean_45 = CleanTree(RemoveNulls=True, RemoveInvalid=True, RemoveEmpty=False, Tree=merge_61)  # -> simplify(Tree)

data_37 = Data(item_65)

tstat_58 = TreeStatistics(Tree=cluster_20.T_2)  # -> Paths, Length, Count
clean_46 = CleanTree(RemoveNulls=True, RemoveInvalid=True, RemoveEmpty=True, Tree=simplify(data_37))
split_91 = SplitTree(Data=clean_46, Masks=flatten(tstat_58.Paths))  # -> Positive, Negative
tstat_59 = TreeStatistics(Tree=split_91.Positive)  # -> Paths, Length, Count
split_92 = SplitTree(Data=simplify(cluster_20.T_2), Masks=flatten(tstat_59.Paths))  # -> Positive, Negative
sdiff_17 = SolidDifference(BrepsA=split_92.Positive, BrepsB=split_91.Positive)
merge_62 = Merge(Data1=sdiff_17, Data2=split_92.Negative)

# ---- group: On-site Pockets
split_93 = SplitTree(Data=simplify(merge_62), Masks=flatten(data_19))  # -> Positive, Negative
tstat_60 = TreeStatistics(Tree=split_93.Positive)  # -> Paths, Length, Count
split_94 = SplitTree(Data=data_18, Masks=flatten(tstat_60.Paths))  # -> Positive, Negative
sdiff_18 = SolidDifference(BrepsA=split_93.Positive, BrepsB=split_94.Positive)
split_95 = SplitTree(Data=split_93.Positive, Masks=flatten(tstat_40.Paths))  # -> Positive, Negative
merge_63 = Merge(Data1=sdiff_18, Data2=split_93.Negative)
tstat_61 = TreeStatistics(Tree=split_95.Positive)  # -> Paths, Length, Count
geo_83 = Geometry(merge_63)

# ----
eso_2 = ExtendSpeckleObject(SpeckleObject=geo_83, Type="TopPlate", selectedKitName="Objects")
split_96 = SplitTree(Data=sso_2, Masks=flatten(tstat_61.Paths))  # -> Positive, Negative
split_97 = SplitTree(Data=txt_3, Masks=flatten(tstat_61.Paths))  # -> Positive, Negative
split_98 = SplitTree(Data=split_96.Negative, Masks=flatten("{0,1;*}"))  # -> Positive, Negative
split_99 = SplitTree(Data=split_97.Negative, Masks=flatten("{0,1;*}"))  # -> Positive, Negative

cso_15 = CreateSpeckleObject(
    Id=dso_28.Id,
    ShellPreCut=cso_2,
    ShellJSON=c_script_22.A,
    ShellExtraPeices=geo_67,
    Shell=geo_68,
    Acoustic=simplify(clean_45),
    Type=txt_3,
    IsOutsourced=data_8,
    selectedKitName="Objects")

eso_3 = ExtendSpeckleObject(SpeckleObject=cso_15, RenderMaterial=sso_2, selectedKitName="Objects")

trim_18 = TrimTree(Tree=simplify(eso_3), Depth=1)
cso_16 = CreateSpeckleObject(Simple_Solids=trim_18, Parent=concat_4, ReleaseNotes=note, selectedKitName="Objects")  # -> flatten(SpeckleObject)
send = Send(
    Stream=panel_53,
    Message=panel_52,
    Data=cso_16,
    AutoSend=False,
    BaseId="821b6ad52858323aad5cb6be6689e7b9",
    CurrentComponentState="up_to_date",
    KitName="Objects",
    OutputWrappers="https://app.speckle.systems\tfa2b5c68c0\tddfe656760",
    UseDefaultCache=True,
    selectedKitName="Objects")

panel_67 = Panel(send)

division_16 = Division(A=data_25, B=2)

multiplication_2 = Multiplication(A=spacing_d, B=diameter)
division_17 = Division(A=multiplication_2, B=1000)

data_38 = Data(simplify(dso_28.Id))

# ----
# Acoustic
panel_68 = Panel("Acoustic")
clean_47 = CleanTree(RemoveNulls=True, RemoveInvalid=True, RemoveEmpty=True, Tree=merge_61)  # -> simplify(Tree)
eso_4 = ExtendSpeckleObject(SpeckleObject=clean_47, Type=panel_68, selectedKitName="Objects")

debrep_8 = DeconstructBrep(Brep=clean_47)  # -> Faces, Edges, Vertices
area_48 = Area(Geometry=debrep_8.Faces)  # -> Area, Centroid
sort_20 = SortList(Keys=area_48.Area, ValuesA=debrep_8.Faces)  # -> Keys, reverse(ValuesA)

tstat_62 = TreeStatistics(Tree=clean_47)  # -> Paths, Length, Count
tstat_63 = TreeStatistics(Tree=merge_58)  # -> Paths, Length, Count
tree_14 = CreateTree(Data=flatten(clean_47), Path=tstat_62.Paths, Ensure=tstat_63.Paths)

cluster_25 = Cluster_16(pln=dso_28.Rect, L=sort_20.ValuesA, M=tstat_62.Paths)  # -> P, B, Y, T
c_script_48 = CSharpScript(x=cluster_25.Y, y=data_24)  # -> out, A; inputs x: Double, y: Double
# ---------- c_script_48: C# ----------
    if(x / y < 3) A = x / 3;
    else A = y;
# ---------- end c_script_48 ----------
generate_acoustic_battens = GenerateAcousticBattens(
    Outline=cluster_25.P,
    BoundingRectangle=cluster_25.B,
    Spacing=c_script_48.A,
    BattenWidth=dso_45.Width,
    BattenThickness=data_25,
    EdgeOffset=Slider(0.05, range=0..0.1),
    OffsetOutlinePlane=division_16,
    OffsetTolerance=Slider(0, range=0..1),
    MinBattenLength=number_slider_7,
    ContourOption=Slider(0, range=0..100))  # -> simplify(Battens), Centrelines, OffsetPlanes
tstat_64 = TreeStatistics(Tree=cluster_25.T)  # -> Paths, Length, Count

lng_7 = ListLength(List=generate_acoustic_battens.Centrelines)  # -> simplify(Length)
tstat_65 = TreeStatistics(Tree=lng_7)  # -> Paths, Length, Count
split_100 = SplitTree(Data=data_38, Masks=flatten(tstat_65.Paths))  # -> Positive, Negative
dup_5 = DuplicateData(Data=split_100.Positive, Number=lng_7, Order=True)  # -> simplify(graft(Data))

brep_2 = Brep(cluster_25.T)

split_101 = SplitTree(Data=generate_acoustic_battens.Battens, Masks=flatten(tstat_64.Paths))  # -> Positive, Negative
sdiff_19 = SolidDifference(BrepsA=graft(split_101.Positive), BrepsB=flatten(cluster_25.T))
trim_19 = TrimTree(Tree=sdiff_19, Depth=1)
merge_64 = Merge(Data1=trim_19, Data2=split_101.Negative)
group = Group(Objects=merge_64)
tstat_66 = TreeStatistics(Tree=merge_64)  # -> Paths, Length, Count
tree_15 = CreateTree(Data=flatten(group), Path=tstat_66.Paths, Ensure=tstat_63.Paths)
ungroup = Ungroup(Group=tree_15)  # -> simplify(Objects)
tstat_67 = TreeStatistics(Tree=ungroup)  # -> Paths, Length, Count
tree_16 = CreateTree(Data=tstat_67.Paths, Path=tstat_67.Paths)  # -> simplify(Data)

cluster_26 = Cluster_5(
    brep=brep_2,
    crv=generate_acoustic_battens.Centrelines,
    ispacing=division_17,
    iedgeoffsetfactor=Slider(3, range=0..10),
    pln=generate_acoustic_battens.OffsetPlanes,
    A=diameter,
    B=offset_from_top_of_top_plate,
    L=screw_length,
    min_batten_width=number_slider_7,
    beam_depth=data_25,
    top_plate_thickness=dso_31.Top_layer)  # -> geo_5, geo_6, geo_7, A_2

c_script_49 = CSharpScript(
    x=cluster_26.A_2,
    y=dup_5,
    Reference=["C:\Users\Lasat\AppData\Roaming\Grasshopper\Libraries\ABxM.PlateStructures\LCRL.Core.dll", "C:\USERS\LASAT\APPDATA\ROAMING\GRASSHOPPER\LIBRARIES\ABXM.PLATESTRUCTURES\ElementBase.dll", "C:\Users\Lasat\AppData\Roaming\Grasshopper\Libraries\ABxM.PlateStructures\PlateStructuresCore.dll"])  # -> out, A; inputs y: String
# ---------- c_script_49: C# ----------
    Screw screw = x as Screw;
    Screw newScrew = screw.ShallowCopy() as Screw;
    newScrew.Project = "LCRL";
    newScrew.Version = "LPH5";
    newScrew.Parent = y;
    newScrew.Type = "BattenScrew";
    newScrew.Name = Utilities.GenerateElementNameId(newScrew);
    A = newScrew;
# ---------- end c_script_49 ----------

tstat_68 = TreeStatistics(Tree=clean_47)  # -> Paths, Length, Count
tstat_69 = TreeStatistics(Tree=merge_58)  # -> Paths, Length, Count
tree_17 = CreateTree(Data=flatten(eso_4), Path=tstat_68.Paths, Ensure=tstat_69.Paths)

to_json = ToJSON(Elements=c_script_49.A)
tstat_70 = TreeStatistics(Tree=cluster_26.A_2)  # -> Paths, Length, Count
panel_69 = Panel(tstat_70.Paths)
cso_17 = CreateSpeckleObject(JSON=flatten(to_json), GH_Path=panel_69, selectedKitName="Objects")

group_2 = Group(Objects=cluster_26.geo_5)
trim_20 = TrimTree(Tree=group_2, Depth=1)
group_3 = Group(Objects=trim_20)
tstat_71 = TreeStatistics(Tree=group_3)  # -> Paths, Length, Count
tree_18 = CreateTree(Data=flatten(group_3), Path=tstat_71.Paths, Ensure=tstat_67.Paths)  # -> simplify(Data)
ungroup_2 = Ungroup(Group=tree_18)
ungroup_3 = Ungroup(Group=ungroup_2)

clean_48 = CleanTree(RemoveNulls=True, RemoveInvalid=True, RemoveEmpty=True, Tree=ungroup)  # -> simplify(Tree)
eso_5 = ExtendSpeckleObject(SpeckleObject=clean_48, Type="Battens", selectedKitName="Objects")
tstat_72 = TreeStatistics(Tree=clean_48)  # -> Paths, Length, Count
lng_8 = ListLength(List=eso_5)
match_12 = MatchTree(Tree=graft(tstat_72.Paths), Guide=clean_48)
tstat_73 = TreeStatistics(Tree=ungroup)  # -> Paths, Length, Count
dup_6 = DuplicateData(Data=match_12, Number=lng_8, Order=True)
tree_19 = CreateTree(Data=flatten(clean_48), Path=dup_6, Ensure=tstat_73.Paths)

# ---- group: Scales the beam to steps of 2cm with a min of 2cm
split_102 = SplitTree(Data=simplify(generate_raw_plate_2.EdgeOffsets), Masks=flatten("{*;1}"))  # -> Positive, Negative
item_66 = ListItem(List=generate_raw_plate_2.RawPlate, Index=0, Wrap=True)

# ----
cluster_27 = Cluster_4(
    pln=generate_beam.EndPlanes,
    num=split_102.Positive,
    geo=cluster_23.geo_6,
    geo_2=generate_beam.Beams,
    geo_3=generate_beam.BeamPlanes,
    num_2=generate_beam.InteriorLengths,
    geo_4=cluster_23.geo_4,
    geo_5=generate_beam.EndPlanes,
    D_2=generate_beam.BoundingBox)  # -> O, R_2, R, R_3, P, T

cluster_28 = Cluster_4(
    pln=generate_beam_2.EndPlanes,
    num=split_102.Positive,
    geo=cluster_22.geo_6,
    geo_2=generate_beam_2.Beams,
    geo_3=generate_beam_2.BeamPlanes,
    num_2=generate_beam_2.InteriorLengths,
    geo_4=cluster_22.geo_4,
    geo_5=generate_beam_2.EndPlanes,
    D_2=generate_beam_2.BoundingBox)  # -> O, R_2, R, R_3, P, T

# ---- group: Needs to be reversed
group_4 = Group(Objects=cluster_27.O)
geo_84 = Geometry(reverse(cluster_27.R))
geo_85 = Geometry(reverse(cluster_27.R_3))
num_13 = Number(reverse(cluster_27.R_2))
trim_21 = TrimTree(Tree=group_4, Depth=1)  # -> reverse(Tree)

group_5 = Group(Objects=cluster_28.O)
num_14 = Number(reverse(cluster_28.R_2))
geo_86 = Geometry(reverse(cluster_28.R))
geo_87 = Geometry(reverse(cluster_28.R_3))
trim_22 = TrimTree(Tree=group_5, Depth=1)  # -> reverse(Tree)

# ----
sdiff_20 = SolidDifference(BrepsA=geo_84, BrepsB=move_39.Geometry)  # -> simplify(Result)

sdiff_21 = SolidDifference(BrepsA=geo_86, BrepsB=move_41.Geometry)  # -> simplify(Result)

group_6 = Group(Objects=generate_beam.EndPlanes)
trim_23 = TrimTree(Tree=group_6, Depth=1)  # -> reverse(Tree)
geo_88 = Geometry(reverse(cluster_23.geo_6))
cluster_29 = Cluster_15(I=cluster_27.T, D=trim_23, M=cluster_27.P)
cluster_30 = Cluster_15(I=cluster_27.T, D=generate_beam.BeamPlanes, M=cluster_27.P)
cluster_31 = Cluster_15(I=cluster_27.T, D=generate_beam.InteriorPlanes, M=cluster_27.P)
match_13 = MatchTree(Tree=geo_88, Guide=generate_beam.Beams)
match_14 = MatchTree(Tree=cluster_31, Guide=cluster_23.geo_4)
match_15 = MatchTree(Tree=cluster_29, Guide=cluster_23.geo_4)
cluster_32 = Cluster_15(I=cluster_27.T, D=match_13, M=cluster_27.P)
match_16 = MatchTree(Tree=cluster_30, Guide=cluster_23.geo_4)
ungroup_4 = Ungroup(Group=match_15)
item_67 = ListItem(List=ungroup_4, Index=0, Wrap=True)  # -> Item, Item1
match_17 = MatchTree(Tree=cluster_32, Guide=cluster_23.geo_4)
match_18 = MatchTree(Tree=geo_84, Guide=cluster_23.geo_4)
trim_24 = TrimTree(Tree=item_67.Item, Depth=1)
trim_25 = TrimTree(Tree=item_67.Item1, Depth=1)
geo_89 = Geometry(reverse(match_16))
geo_90 = Geometry(reverse(match_14))
geo_91 = Geometry(match_18)

filter_9 = StreamFilter(Gate=Toggle(False), Stream0=geo_84, Stream1=sdiff_20)

filter_10 = StreamFilter(Gate=Toggle(False), Stream0=geo_86, Stream1=sdiff_21)

group_7 = Group(Objects=generate_beam_2.EndPlanes)
trim_26 = TrimTree(Tree=group_7, Depth=1)  # -> reverse(Tree)
geo_92 = Geometry(reverse(cluster_22.geo_6))
cluster_33 = Cluster_15(I=cluster_28.T, D=trim_26, M=cluster_28.P)
cluster_34 = Cluster_15(I=cluster_28.T, D=generate_beam_2.BeamPlanes, M=cluster_28.P)
cluster_35 = Cluster_15(I=cluster_28.T, D=generate_beam_2.InteriorPlanes, M=cluster_28.P)
match_19 = MatchTree(Tree=geo_92, Guide=generate_beam_2.Beams)
match_20 = MatchTree(Tree=cluster_35, Guide=cluster_22.geo_4)
match_21 = MatchTree(Tree=cluster_33, Guide=cluster_22.geo_4)
cluster_36 = Cluster_15(I=cluster_28.T, D=match_19, M=cluster_28.P)
match_22 = MatchTree(Tree=cluster_34, Guide=cluster_22.geo_4)
ungroup_5 = Ungroup(Group=match_21)
item_68 = ListItem(List=ungroup_5, Index=0, Wrap=True)  # -> Item, Item1
match_23 = MatchTree(Tree=cluster_36, Guide=cluster_22.geo_4)
match_24 = MatchTree(Tree=filter_10, Guide=cluster_22.geo_4)
trim_27 = TrimTree(Tree=item_68.Item, Depth=1)
trim_28 = TrimTree(Tree=item_68.Item1, Depth=1)
geo_93 = Geometry(reverse(match_22))
geo_94 = Geometry(reverse(match_20))
geo_95 = Geometry(match_24)

geo_96 = Geometry(match_17)
geo_97 = Geometry(match_23)

split_103 = SplitTree(Data=geo_95, Masks=flatten(clean_21))  # -> Positive, Negative
split_104 = SplitTree(Data=geo_91, Masks=flatten(clean_21))  # -> Positive, Negative
merge_65 = Merge(Data1=split_104.Positive, Data2=split_103.Negative)
filter_11 = StreamFilter(Gate=thicker_bottom_plate, Stream0=geo_95, Stream1=merge_65)

match_25 = MatchTree(Tree=geo_87, Guide=cluster_22.geo_4)
match_26 = MatchTree(Tree=geo_85, Guide=cluster_22.geo_4)
cluster_37 = Cluster_17(data_2=match_25, G=thicker_bottom_plate, D=match_26, data=data_30)

match_27 = MatchTree(Tree=trim_28, Guide=cluster_22.geo_4)
match_28 = MatchTree(Tree=trim_25, Guide=cluster_22.geo_4)
cluster_38 = Cluster_17(data_2=match_27, G=thicker_bottom_plate, D=match_28, data=data_30)

match_29 = MatchTree(Tree=geo_97, Guide=cluster_22.geo_4)
match_30 = MatchTree(Tree=geo_96, Guide=cluster_22.geo_4)
cluster_39 = Cluster_17(data_2=match_29, G=thicker_bottom_plate, D=match_30, data=data_30)

match_31 = MatchTree(Tree=trim_27, Guide=cluster_22.geo_4)
match_32 = MatchTree(Tree=trim_24, Guide=cluster_22.geo_4)
cluster_40 = Cluster_17(data_2=match_31, G=thicker_bottom_plate, D=match_32, data=data_30)

match_33 = MatchTree(Tree=trim_22, Guide=cluster_22.geo_4)
match_34 = MatchTree(Tree=trim_21, Guide=cluster_22.geo_4)
cluster_41 = Cluster_17(data_2=match_33, G=thicker_bottom_plate, D=match_34, data=data_30)

match_35 = MatchTree(Tree=geo_93, Guide=cluster_22.geo_4)
match_36 = MatchTree(Tree=geo_89, Guide=cluster_22.geo_4)
cluster_42 = Cluster_17(data_2=match_35, G=thicker_bottom_plate, D=match_36, data=data_30)

match_37 = MatchTree(Tree=geo_94, Guide=cluster_22.geo_4)
match_38 = MatchTree(Tree=geo_90, Guide=cluster_22.geo_4)
cluster_43 = Cluster_17(data_2=match_37, G=thicker_bottom_plate, D=match_38, data=data_30)

match_39 = MatchTree(Tree=num_14, Guide=cluster_22.geo_4)
match_40 = MatchTree(Tree=num_13, Guide=cluster_22.geo_4)
cluster_44 = Cluster_17(data_2=match_39, G=thicker_bottom_plate, D=match_40, data=data_30)

# ---- group: Scales the beam to steps of 2cm with a min of 2cm (continued)
match_41 = MatchTree(Tree=cluster_37, Guide=cluster_18.geo_4)
match_42 = MatchTree(Tree=cluster_44, Guide=match_41)
c_script_50 = CSharpScript(x=match_41, y=simplify(match_42), z=raw_beam_offset)  # -> out, A, B, C; inputs y: Double, z: Double
# ---------- c_script_50: C# ----------
    Box box = (Box) x;

    double boxY = box.Y.Length;
    double totalWidth = boxY + y;
    double factor = 0.02;
    double roundWidth = Math.Ceiling(totalWidth / factor) * factor;
    double offset = roundWidth - boxY;
    Vector3d dir = box.Plane.YAxis;
    dir.Unitize();
    dir *= offset;
    box.Inflate(z, 0, 0);
    List<Point3d> pts = box.GetCorners().ToList();
    pts[0] -= dir;
    pts[1] -= dir;
    pts[4] -= dir;
    pts[5] -= dir;

    Box output = new Box(box.Plane, pts);
    A = output;
    B = output.Y.Length;
    C = output.X.Length;
# ---------- end c_script_50 ----------

# ----
match_43 = MatchTree(Tree=cluster_41, Guide=c_script_50.A)
ungroup_6 = Ungroup(Group=match_43)
planesrf_4 = PlaneSurface(Plane=ungroup_6, XSize=Domain(-1, 1), YSize=Domain(-1, 1))
splitmul_2 = SplitBrepMultiple(Brep=graft(c_script_50.A), Cutters=planesrf_4)
area_49 = Area(Geometry=splitmul_2)  # -> Area, Centroid
brepinc_3 = PointInBrep(Brep=graft(filter_11), Point=area_49.Centroid, Strict=True)
cull_15 = CullPattern(List=splitmul_2, CullPattern=brepinc_3)
capex_2 = CapHolesEx(Brep=cull_15)  # -> Brep, Caps, Solid
trim_29 = TrimTree(Tree=simplify(capex_2.Brep), Depth=1)

sort_val_5 = SortDuplicateValues(ValueList=flatten(c_script_50.B))  # -> UniqueValues, Indices
lng_9 = ListLength(List=sort_val_5.Indices)
concat_5 = Concatenate(
    FragmentF="Final Width",
    FragmentC="Raw Width = ",
    FragmentA=sort_val_5.UniqueValues,
    FragmentB="m : Count =  ",
    FragmentD=flatten(lng_9))
panel_70 = Panel(concat_5)

top_layer_thickness = Slider(0.045, range=0..0.1)
nail_spacing = Slider(0.4, range=0..1)
nail_diameter = Slider(0.0053, range=0..0.01)
nail_length = Slider(0.09, range=0..0.1)
geo_98 = Geometry(cluster_37)

cluster_45 = Cluster_22(L=cluster_39, B=filter_11, geo=cluster_22.geo_5)  # -> i, item_1
trim_30 = TrimTree(Tree=simplify(cluster_45.i), Depth=1)
trim_31 = TrimTree(Tree=simplify(cluster_45.item_1), Depth=1)
crv_19 = Curve(trim_30)
tstat_74 = TreeStatistics(Tree=crv_19)  # -> Paths, Length, Count
split_105 = SplitTree(Data=simplify(move_31.Geometry), Masks=flatten(tstat_74.Paths))  # -> Positive, Negative
crv_20 = Curve(trim_31)
boundary_25 = BoundarySurfaces(Edges=crv_20)
explode_8 = Explode(Curve=split_105.Positive, Recursive=True)  # -> Segments, Vertices
midpt_5 = CurveMiddle(Curve=explode_8.Segments)
area_50 = Area(Geometry=boundary_25)  # -> Area, Centroid
ln_5 = Line(StartPoint=midpt_5, EndPoint=area_50.Centroid)

split_106 = SplitTree(Data=simplify(filter_11), Masks=flatten(tstat_49.Paths))  # -> Positive, Negative
clash_10 = Clash(FirstSet=split_106.Positive, SecondSet=offsrf_15, Distance=0, L=100)  # -> ClashCount, ClashPoints, ClashRadii, FirstIndex, SecondIndex
textdot = DefineTextDot(Text="CLASH!", Location=clash_10.ClashPoints, Font="Arial", Size=14)

# ----
# Construct Speckle Objects
panel_71 = Panel("BottomPlate")
eso_6 = ExtendSpeckleObject(SpeckleObject=merge_58, Type=panel_71, selectedKitName="Objects")
cso_18 = CreateSpeckleObject(BoundingBox=match_41, Raw=trim_29, RawBoundingBox=c_script_50.A, RawWidth=c_script_50.B, selectedKitName="Objects")

eso_7 = ExtendSpeckleObject(SpeckleObject=filter_11, Type="Beam", selectedKitName="Objects")

# ---- group: TP
cso_19 = CreateSpeckleObject(
    Geometry=eso_2,
    GeometryPreCut=merge_62,
    Raw=item_66,
    Material=data_28,
    OutlineUpper=cluster_20.T,
    OutlineLower=cluster_20.T_3,
    selectedKitName="Objects")

# ----
cluster_46 = Cluster_20(T=cso_19)
panel_72 = Panel(cluster_46)
tstat_75 = TreeStatistics(Tree=cso_19)  # -> Paths, Length, Count
merge_66 = Merge(Data1=geo_83, Data2=merge_58, Data3=tree_14, Data4=merge_54, Data5=filter_11)
split_107 = SplitTree(Data=filter_11, Masks=flatten(clean_21))  # -> Positive, Negative
split_108 = SplitTree(Data=filter_11, Masks=flatten(clean_21))  # -> Positive, Negative
split_109 = SplitTree(Data=trim_29, Masks=flatten(clean_21))  # -> Positive, Negative

preview_14 = CustomPreview(Geometry=split_109.Positive, Material=ColourSwatch(SwatchColor=RGBA(191, 106, 63, 136)))
preview_15 = CustomPreview(Geometry=merge_66, Material=c_script_37.A)
preview_16 = CustomPreview(Geometry=split_107.Positive, Material=ColourSwatch(SwatchColor=RGBA(89, 63, 191, 80)))
tag_9 = TextTag(Location=flatten(area_46.Centroid), Text=tstat_54.Paths)
preview_17 = CustomPreview(Geometry=textdot, Material=ColourSwatch(SwatchColor=RGB(255, 0, 0)))

preview_18 = CustomPreview(Geometry=split_108.Positive, Material=ColourSwatch(SwatchColor=RGB(191, 63, 63)))
preview_19 = CustomPreview(Geometry=split_108.Negative, Material=ColourSwatch(SwatchColor=RGB(191, 136, 63)))
preview_20 = CustomPreview(Geometry=split_109.Negative, Material=ColourSwatch(SwatchColor=RGBA(191, 183, 63, 14)))
preview_21 = CustomPreview(Geometry=split_107.Negative, Material=ColourSwatch(SwatchColor=RGBA(102, 21, 232, 80)))

pln_25 = Plane(cluster_39)

geo_99 = Geometry(c_script_16.A)
geo_100 = Geometry(pl_offset)

tstat_76 = TreeStatistics(Tree=simplify(geo_99))  # -> Paths, Length, Count
area_51 = Area(Geometry=tree_14)  # -> Area, Centroid

tree_20 = CreateTree(Data=flatten(geo_99), Path=tstat_76.Paths, Ensure=tstat_63.Paths)  # -> simplify(Data)
tree_21 = CreateTree(Data=flatten(geo_100), Path=tstat_76.Paths, Ensure=tstat_63.Paths)  # -> simplify(Data)
move_46 = Move(Geometry=tree_20, Motion=vec_5)  # -> Geometry, Transform
move_47 = Move(Geometry=tree_21, Motion=vec_5)  # -> Geometry, Transform
clean_49 = CleanTree(RemoveNulls=True, RemoveInvalid=True, RemoveEmpty=False, Tree=move_47.Geometry)
clean_50 = CleanTree(RemoveNulls=True, RemoveInvalid=True, RemoveEmpty=False, Tree=move_46.Geometry)

area_52 = Area(Geometry=clean_50)  # -> Area, Centroid
pl_origin_7 = PlaneOrigin(Base=clean_49, Origin=area_52.Centroid)
ln_6 = Line(StartPoint=clean_49, EndPoint=area_51.Centroid)

account_for_4_valent_edge = BooleanToggle(True)
filter_12 = StreamFilter(Gate=account_for_4_valent_edge, Stream0=c_script_39.A, Stream1=merge_55)
cluster_47 = Cluster_34(C=planesrf_3, D=generate_raw_plate.RawBoundingBox, M=tstat_41.Paths)
cluster_48 = Cluster_34(C=planesrf_3, D=bbox_7.Box, M=tstat_41.Paths)
cluster_49 = Cluster_34(C=planesrf_3, D=filter_12, M=tstat_41.Paths)

filter_13 = StreamFilter(Gate=account_for_4_valent_edge, Stream0=c_script_39.B, Stream1=item_55)  # -> simplify(Stream)

cso_20 = CreateSpeckleObject(
    Offsets=generate_raw_plate.EdgeOffsets,
    Raw=filter_12,
    RawBoundingBox=cluster_47,
    RawFibreAlignedBB=simplify(cluster_48),
    OffsetPolyline=filter_13,
    selectedKitName="Objects")

# ----
# Bottom Plate - Tabs
move_48 = Move(Geometry=data_23, Motion=expr("x", vec_5))  # -> Geometry, Transform
number_slider_22 = Slider(0.3, range=0..1)
division_18 = Division(A=number_slider_22, B=2)
neg_5 = Negative(Value=division_18)

item_69 = ListItem(List=generate_raw_plate_2.RawPlate, Index=2, Wrap=True)
tstat_77 = TreeStatistics(Tree=item_69)  # -> Paths, Length, Count
split_110 = SplitTree(Data=move_48.Geometry, Masks=flatten(tstat_77.Paths))  # -> Positive, Negative
clean_51 = CleanTree(RemoveNulls=True, RemoveInvalid=True, RemoveEmpty=False, Tree=split_110.Positive)

geo_101 = Geometry(clean_51)
pln_26 = Plane(geo_101)
polyoffset_6 = PolylineOffset(
    Polylines=geo_101,
    Distance=Slider(0.01, range=0..0.01),
    Plane=pln_26,
    Tolerance=0.0001,
    ClosedFillet=1,
    OpenFillet=1,
    Miter=2)  # -> Contour, Holes
explode_9 = Explode(Curve=polyoffset_6.Holes, Recursive=True)  # -> Segments, Vertices
line_2 = Line(explode_9.Segments)
clean_52 = CleanTree(RemoveNulls=True, RemoveInvalid=True, RemoveEmpty=False, Tree=line_2)
ext = ExtendCurve(Curve=clean_52, Type=0, Start=neg_5, End=neg_5)
clean_53 = CleanTree(RemoveNulls=True, RemoveInvalid=True, RemoveEmpty=False, Tree=ext)
len_12 = Length(Curve=clean_53)
division_19 = Division(A=len_12, B=number_slider_22)
round = Round(Number=division_19)  # -> Nearest, Floor, Ceiling
pframes = PerpFrames(Curve=clean_53, Count=round.Nearest, Align=True)  # -> Frames, Parameters
trim_32 = TrimTree(Tree=pframes.Frames, Depth=1)  # -> simplify(Tree)
pcx = CurvePlane(Curve=geo_101, Plane=trim_32)  # -> Points, ParamsC, ParamsP
dist_4 = Distance(PointA=simplify(graft(trim_32)), PointB=pcx.Points)
sort_21 = SortList(Keys=dist_4, ValuesA=pcx.Points)  # -> Keys, ValuesA
item_70 = ListItem(List=sort_21.ValuesA, Index=0, Wrap=True)
ln_7 = Line(StartPoint=simplify(graft(trim_32)), EndPoint=item_70)
deplane_11 = DeconstructPlane(Plane=graft(trim_32))  # -> Origin, XAxis, YAxis, ZAxis
ext_2 = ExtendCurve(Curve=ln_7, Type=0, Start=0.01, End=0)
amp_3 = Amplitude(Vector=deplane_11.ZAxis, Amplitude=Slider(0.01, range=0..0.1))
end_3 = EndPoints(Curve=ext_2)  # -> Start, End
neg_6 = Negative(Value=amp_3)
move_49 = Move(Geometry=end_3.Start, Motion=neg_6)  # -> Geometry, Transform
move_50 = Move(Geometry=end_3.Start, Motion=amp_3)  # -> Geometry, Transform
rec_3pt = Rectangle3Pt(PointA=move_50.Geometry, PointB=move_49.Geometry, PointC=end_3.End)  # -> Rectangle, Length
trim_33 = TrimTree(Tree=simplify(rec_3pt.Rectangle), Depth=1)
merge_67 = Merge(Data1=trim_33, Data2=simplify(polyoffset_6.Holes))
runion_2 = RegionUnion(Curves=merge_67)

# ---- group: BP
cso_21 = CreateSpeckleObject(
    Geometry=eso_6,
    Raw=item_69,
    Material=c_script_45.A,
    BottomHole=geo_101,
    OutlineUpper=cluster_21.T,
    OutlineLower=cluster_21.s_1,
    BottomHoleCutout=tree_11,
    BottomHoleCutoutWithTabs=runion_2,
    selectedKitName="Objects")

# ----
cluster_50 = Cluster_20(T=cso_21)
cluster_51 = Cluster_20(T=cso_21)
panel_73 = Panel(cluster_50)
panel_74 = Panel(cluster_51)

tstat_78 = TreeStatistics(Tree=simplify(cso_20))  # -> Paths, Length, Count
c_script_51 = CSharpScript(x=merge_54)  # -> out, A; inputs x: Brep; same code as c_script_22
tstat_79 = TreeStatistics(Tree=c_script_51.A)  # -> Paths, Length, Count

lng_10 = ListLength(List=cso_20)
dup_7 = DuplicateData(Data=graft(tstat_78.Paths), Number=lng_10, Order=True)  # -> flatten(Data)

tree_22 = CreateTree(Data=flatten(cso_20), Path=dup_7, Ensure=tstat_79.Paths)

# ---- group: Solid
cso_22 = CreateSpeckleObject(
    Extra=clean_37,
    Geometry=eso,
    GeometryJSON=c_script_51.A,
    Material=data_16,
    Raw=tree_22,
    IsOutsourced=split_69.Negative,
    selectedKitName="Objects")

# ----
cluster_52 = Cluster_20(T=cso_22)
panel_75 = Panel(cluster_52)

# ----
# Beams Wood Nails
toggle_4 = BooleanToggle(True)
c_script_52 = CSharpScript(
    iBox=geo_98,
    iNailSpacing=nail_spacing,
    iTopLayerThickness=num_3,
    iSymmetric=toggle_4,
    iNailDiameter=nail_diameter,
    iNailLength=nail_length)  # -> out, A, B, C, D, E, F, G; inputs iBox: Box, iNailSpacing: Double, iTopLayerThickness: Double, iSymmetric: Boolean, iNailDiameter: Double, iNailLength: Double
# ---------- c_script_52: C# ----------
 List<Plane> beamPlanes = new List<Plane>();
    List<Plane> topPlatePlanes = new List<Plane>();

    // --- ORIGINAL EDGE SELECTION ---
    List<Point3d> corners = iBox.GetCorners().ToList();
    Line edge = new Line(corners[4], corners[5]);
    double L = edge.Length;

    if (L <= 0.0)
    {
      A = beamPlanes;
      B = topPlatePlanes;
      C = 0;
      D = 0.0;
      return;
    }

    // --- PYTHON LOGIC: PARAMETERS ---
    double minBeamLength    = 260.0;
    double shortBeamLength  = 700.0;
    double mediumBeamLength = 1500.0;
    double longBeamLength   = 2400.0;

    double nailDistance = iNailSpacing;
    if (nailDistance <= 0.0)
      nailDistance = 400.0; // fallback

    // --- PYTHON LOGIC: logical nails_per_beam (0–4) ---
    int logicalNails;
    if (L <= minBeamLength)
      logicalNails = 0;
    else if (L <= shortBeamLength)
      logicalNails = 2;
    else if (L <= mediumBeamLength)
      logicalNails = 2;
    else if (L <= longBeamLength)
      logicalNails = 3;
    else
      logicalNails = 4;
    // logicalNails is not used for geometry, but you can expose it if needed.

    // --- PYTHON LOGIC: nailgun_amount + nailgun_spacing ---
    int nailgunAmount;
    double nailgunSpacing;

    if (L <= 0.0)
    {
      nailgunAmount = 0;
      nailgunSpacing = 0.0;
    }
    else
    {
      nailgunAmount = (int) Math.Ceiling(L / nailDistance);
      nailgunSpacing = L / nailgunAmount;
      nailgunSpacing = Math.Round(nailgunSpacing, 2);
    }

    if (nailgunAmount <= 0)
    {
      A = beamPlanes;
      B = topPlatePlanes;
      C = nailgunAmount;
      D = nailgunSpacing;
      return;
    }

    // --- GEOMETRY: USE nailgunAmount & nailgunSpacing TO PLACE PLANES ---
    // iSymmetric = false -> original style (start at edge 0)
    // iSymmetric = true  -> centered along edge, same spacing & count as Python

    double startDist;
    if (!iSymmetric)
    {
      // Old-style: first nail at 0, then + spacing
      startDist = 0.0;
    }
    else
    {
      // Symmetric: first nail at half a spacing from the start,
      // last nail at half a spacing from the end.
      // With spacing = L / n, this becomes start = L / (2n).
      startDist = L / (2.0 * nailgunAmount);
    }

    for (int i = 0; i < nailgunAmount; i++)
    {
      double dist = startDist + i * nailgunSpacing;

      // Clamp to [0, L] just in case of rounding noise
      if (dist < 0.0) dist = 0.0;
      if (dist > L)   dist = L;

      Point3d pt = edge.PointAtLength(dist);

      // === ORIGINAL PLANE MANIPULATION STARTS HERE ===

      // Beam / gripper plane
      Vector3d dirZ = iBox.Plane.ZAxis;
      dirZ.Reverse();
      dirZ.Unitize();

      Point3d ptBeam = pt + dirZ * iBox.Z.Length / 4.0;
      Plane gripperPlane = new Plane(ptBeam, iBox.Plane.XAxis, iBox.Plane.ZAxis);
      gripperPlane.Rotate(-3 * Math.PI / 4.0, gripperPlane.XAxis);
      beamPlanes.Add(gripperPlane);

      // Top plate plane
      Vector3d dirY = iBox.Plane.YAxis;
      dirY.Unitize();

      Point3d ptTop = ptBeam;
      ptTop += dirZ * (iBox.Z.Length / 2.0 + iTopLayerThickness);
      ptTop += dirY * iBox.Y.Length / 2.0;

      Plane topPlane = new Plane(ptTop, iBox.Plane.XAxis, iBox.Plane.YAxis);
      topPlatePlanes.Add(topPlane);

      // === ORIGINAL PLANE MANIPULATION ENDS HERE ===
    }

    // --- OUTPUTS ---
    A = beamPlanes;         // beam / gripper nail planes
    B = topPlatePlanes;     // top-plate nail planes
    C = nailgunAmount;      // from Python: ceil(L / nailDistance)
    D = nailgunSpacing;     // from Python: L / nailgunAmount
    E = edge;


    F = beamPlanes.Select(b=> CreateNailTriangleMesh(b,iNailDiameter,iNailLength)).ToList();
    G = topPlatePlanes.Select(tp=> CreateNailTriangleMesh(tp,iNailDiameter,iNailLength)).ToList();
# ---------- c_script_52: C# additional code ----------
// Creates a single-triangle mesh for a wood nail
Mesh CreateNailTriangleMesh(Plane nailPlane, double diameter, double length)
{
  Mesh m = new Mesh();

  // Base width = diameter, centered on plane origin along X
  Point3d p0 = nailPlane.Origin;  // base right
  Point3d p1 = p0 + nailPlane.XAxis * (diameter / 2.0);  // base left

  // Tip along Z axis (length of nail)
  Point3d p2 = nailPlane.Origin + nailPlane.ZAxis * length;            // tip

  int i0 = m.Vertices.Add(p0);
  int i1 = m.Vertices.Add(p1);
  int i2 = m.Vertices.Add(p2);

  m.Faces.AddFace(i0, i1, i2);

  m.Normals.ComputeNormals();
  m.Compact();
  return m;
}
# ---------- end c_script_52 ----------
area_53 = Area(Geometry=geo_98)  # -> Area, graft(Centroid)
geo_102 = Geometry(c_script_52.B)
geo_103 = Geometry(c_script_52.A)
swatch_8 = ColourSwatch(SwatchColor=RGB(255, 254, 255))
previewlw_10 = CustomPreviewLineweights(Geometry=c_script_52.E, Shader=swatch_8, Absolute=False)

merge_68 = Merge(Data1=c_script_52.F, Data2=c_script_52.G)
merge_69 = Merge(Data1=geo_103, Data2=geo_102)
merge_70 = Merge(Data1=merge_69, Data2=merge_68)

geo_104 = Geometry(merge_68)
pln_27 = Plane(merge_69)
cso_23 = CreateSpeckleObject(
    FrameBase=graft(pln_25),
    Geo=geo_104,
    Nails=pln_27,
    OffsetPositive=nail_length,
    OffsetNegative=Slider(0, range=0..100),
    Name="Wood Nails",
    Type="Pilot",
    selectedKitName="Objects")
trim_34 = TrimTree(Tree=cso_23, Depth=1)

merge_71 = Merge(Data1=tree_10, Data2=trim, Data3=trim_34)

c_script_53 = CSharpScript(
    iSolidOperator_Speckle=merge_71,
    Reference=["C:\Users\Lasat\AppData\Roaming\Grasshopper\Libraries\ABxM.PlateStructures\LCRL.Core.dll", "C:\USERS\LASAT\APPDATA\ROAMING\GRASSHOPPER\LIBRARIES\ABXM.PLATESTRUCTURES\ElementBase.dll", "C:\USERS\LASAT\APPDATA\ROAMING\GRASSHOPPER\LIBRARIES\FABFRAMEWORK\Fab.Core.dll", "C:\USERS\LASAT\APPDATA\ROAMING\MCNEEL\RHINOCEROS\7.0\PLUG-INS\SPECKLERHINO2 (8DD5F30B-A13D-4A24-ABDC-3E05C8C87143)\SpeckleCore2.dll", "C:\Windows\Microsoft.NET\assembly\GAC_MSIL\netstandard\v4.0_2.0.0.0__cc7b13ffcd2ddd51\netstandard.dll", "C:\USERS\LASAT\APPDATA\ROAMING\MCNEEL\RHINOCEROS\7.0\PLUG-INS\SPECKLERHINO2 (8DD5F30B-A13D-4A24-ABDC-3E05C8C87143)\SpeckleConnectorGrasshopper.gha", "C:\USERS\LASAT\APPDATA\ROAMING\SPECKLE\KITS\OBJECTS\Objects.Converter.Grasshopper7.dll", "C:\USERS\LASAT\APPDATA\ROAMING\SPECKLE\KITS\OBJECTS\Objects.dll"])  # -> out, A; disabled
# ---------- c_script_53: C# usings ----------
using Fab.Core.FabCollection;
using Fab.Core.DesignElement;
using System.Linq;
using Grasshopper.Kernel.Components;
using System.Net.NetworkInformation;
using ABxM.PlateStructures.Development;
using Speckle.Core.Models;
using Objects.Converter.RhinoGh;
using Objects.Geometry;
using Speckle.Core.Kits;
using System.Reflection;

// Alias definitions for convenience.
using RhinoPlane = Rhino.Geometry.Plane;
using RhinoLine = Rhino.Geometry.Line;
using RhinoBrep = Rhino.Geometry.Brep;
using RhinoBox = Rhino.Geometry.BoundingBox;
using RhinoPoint = Rhino.Geometry.Point;
using RhinoVector3d = Rhino.Geometry.Vector3d;
using SpecklePlane = Objects.Geometry.Plane;
using SpeckleLine = Objects.Geometry.Line;
using SpeckleBrep = Objects.Geometry.Brep;
using SpeckleBox = Objects.Geometry.Box;
using SpecklePoint = Objects.Geometry.Point;
using SpeckleVector = Objects.Geometry.Vector;
# ---------- c_script_53: C# ----------
    // Cast the input to a Speckle Base object.
    Base speckleObj = iSolidOperator_Speckle as Base;
    if (speckleObj == null)
    {
      Print("Input is not a valid Speckle object.");
      return;
    }
    A = ConverterHelper.PopulateSolidOperator(speckleObj);
# ---------- c_script_53: C# additional code ----------
  public static class ConverterHelper
  {
    public static SolidOperator PopulateSolidOperator(Base speckleObj)
    {
      // Retrieve required properties.
      string name = speckleObj["@Name"] as string;
      string typeStr = speckleObj["@Type"] as string;
      if (string.IsNullOrEmpty(name))
        throw new ArgumentException("The Speckle object is missing the '@Name' property.");
      if (string.IsNullOrEmpty(typeStr))
        throw new ArgumentException("The Speckle object is missing the '@Type' property.");

      // Convert the type string to the SolidOperatorType enum.
      SolidOperatorType opType;
      if (!Enum.TryParse(typeStr, true, out opType))
        throw new ArgumentException("Invalid SolidOperatorType: " + typeStr);

      // Create a converter instance and set the active Rhino document.
      ConverterRhinoGh converter = new ConverterRhinoGh();
      converter.SetContextDocument(RhinoDoc.ActiveDoc);

      // Retrieve dynamic members from the Speckle object.
      IDictionary<string, object> dynamicMembers = speckleObj.GetMembers(DynamicBaseMemberType.Dynamic);

      // Retrieve the plane (FrameBase/Plane) for the operator.
      object planeObj = null;
      if (dynamicMembers.ContainsKey("FrameBase"))
        planeObj = dynamicMembers["FrameBase"];
      else if (dynamicMembers.ContainsKey("@FrameBase"))
        planeObj = dynamicMembers["@FrameBase"];
      else if (dynamicMembers.ContainsKey("@Plane"))
        planeObj = dynamicMembers["@Plane"];
      if (planeObj == null)
        throw new ArgumentException("The Speckle object does not contain a valid plane definition.");

      RhinoPlane frameBase;
      SpecklePlane sp = planeObj as SpecklePlane;
      if (sp != null)
      {
        frameBase = converter.PlaneToNative(sp);
      }
      else
      {
        throw new Exception("Plane conversion failed: unrecognized type.");
      }

      // Process known optional properties.
      Rhino.Geometry.Curve path = null;
      if (dynamicMembers.ContainsKey("@Path"))
      {
        object pathObj = dynamicMembers["@Path"];
        SpeckleLine sLine = pathObj as SpeckleLine;
        if (sLine != null)
        {
          RhinoLine nativeLine = converter.LineToNative(sLine).Line;
          path = new LineCurve(nativeLine);
        }
      }
      double offsetPositive = 0.0;
      double offsetNegative = 0.0;
      if (dynamicMembers.ContainsKey("@OffsetPositive"))
        offsetPositive = Convert.ToDouble(dynamicMembers["@OffsetPositive"]);
      if (dynamicMembers.ContainsKey("@OffsetNegative"))
        offsetNegative = Convert.ToDouble(dynamicMembers["@OffsetNegative"]);

      // Create the SolidOperator instance using the appropriate constructor.
      SolidOperator solidOp;
      if (path != null)
        solidOp = new SolidOperator(name, opType, frameBase, path, offsetPositive, offsetNegative);
      else
        solidOp = new SolidOperator(name, opType, frameBase);

      solidOp.Name = name;
      
      // Prepare a set of keys that have been explicitly processed.
      HashSet<string> processedKeys = new HashSet<string>
        {
          "@Name", "@Type", "FrameBase", "@FrameBase", "Plane", "Path", "OffsetPositive", "OffsetNegative"
          };

      // Special handling: if the Speckle object contains the "Geo" key,
      // convert and assign its value to the Geometry property using a classic cast.

      if (dynamicMembers.ContainsKey("@Geo"))
      {
        RhinoApp.WriteLine("Starting GEO");

        object geoObj = dynamicMembers["@Geo"];
        // Use classic casting instead of inline pattern matching.
        var sGeo = geoObj as Objects.Geometry.Brep;
        if (sGeo != null)
        {
          List<string> notes = new List<string>();
          solidOp.Geometry = converter.BrepToNative(sGeo, out notes);
        }
        else
        {
          throw new Exception("Geo conversion failed: unrecognized type.");
        }
        processedKeys.Add("Geo");
      }

      // Use reflection to process any additional dynamic properties.
      Type solidOpType = solidOp.GetType();
      foreach (string key in dynamicMembers.Keys)
      {
        if (processedKeys.Contains(key))
          continue;

        // Remove any "@" prefix.
        string dictKey = key.StartsWith("@") ? key.Substring(1) : key;
        if (dictKey == "Geo") continue;
        object value = dynamicMembers[key];
        if (value == null)
          continue;

        // Check if a settable property exists on SolidOperator.
        PropertyInfo prop = solidOpType.GetProperty(dictKey, BindingFlags.IgnoreCase | BindingFlags.Public | BindingFlags.Instance);
        if (prop != null && prop.CanWrite)
        {
          try
          {
            object converted = ConvertPropertyValue(prop.PropertyType, value, converter);
            if (converted == null)
              throw new Exception("Conversion returned null.");
            prop.SetValue(solidOp, converted, null);
          }
          catch (Exception ex)
          {
            RhinoApp.WriteLine("Failed to assign property " + dictKey + ": " + ex.Message);
          }
          continue;
        }

        // Fallback: add unrecognized members to the CustomData dictionary.
        if (solidOp.CustomData == null)
          solidOp.CustomData = new Dictionary<string, object>();
        if (!solidOp.CustomData.ContainsKey(dictKey))
          solidOp.CustomData[dictKey] = value;
      }

      return solidOp;
    }

    public static object ConvertPropertyValue(Type targetType, object value, ConverterRhinoGh converter)
    {
      if (targetType == typeof(string))
        return value.ToString();
      if (targetType == typeof(int))
        return Convert.ToInt32(value);
      if (targetType == typeof(double))
        return Convert.ToDouble(value);
      if (targetType == typeof(bool))
        return Convert.ToBoolean(value);
      if (targetType == typeof(RhinoPlane))
      {
        SpecklePlane sp = value as SpecklePlane;
        if (sp != null)
          return converter.PlaneToNative(sp);
      }
      if (targetType == typeof(RhinoBrep))
      {
        if (value is SpeckleBrep)
        {
          SpeckleBrep sb = value as SpeckleBrep;
          List<string> notes;
          RhinoBrep brep = converter.BrepToNative(sb, out notes);
          if (brep == null)
            throw new Exception("Brep conversion returned null. Notes: " + string.Join(", ", notes));
          return brep;
        }
        else if (value is SpeckleBox)
        {
          SpeckleBox sbox = value as SpeckleBox;
          RhinoBox box = converter.BoxToNative(sbox).BoundingBox;
          RhinoBrep brep = box.ToBrep();
          return brep;
        }
      }
      if (targetType == typeof(RhinoBox))
      {
        SpeckleBox sbox = value as SpeckleBox;
        if (sbox != null)
          return converter.BoxToNative(sbox);
      }
      if (targetType == typeof(Point3d))
      {
        SpecklePoint spt = value as SpecklePoint;
        if (spt != null)
        {
          RhinoPoint pt = converter.PointToNative(spt);
          return pt.Location;
        }
      }
      if (targetType == typeof(RhinoVector3d))
      {
        SpeckleVector sv = value as SpeckleVector;
        if (sv != null)
          return converter.VectorToNative(sv);
      }
      if (targetType == typeof(RhinoLine))
      {
        SpeckleLine sl = value as SpeckleLine;
        if (sl != null)
          return converter.LineToNative(sl).Line;
      }
      return value;
    }
  }
# ---------- end c_script_53 ----------
c_script_54 = CSharpScript(
    iSolidOperator_Speckle=merge_71,
    Reference=["C:\Users\Lasat\AppData\Roaming\Grasshopper\Libraries\ABxM.PlateStructures\LCRL.Core.dll", "C:\USERS\LASAT\APPDATA\ROAMING\GRASSHOPPER\LIBRARIES\ABXM.PLATESTRUCTURES\ElementBase.dll", "C:\USERS\LASAT\APPDATA\ROAMING\GRASSHOPPER\LIBRARIES\FABFRAMEWORK\Fab.Core.dll", "C:\USERS\LASAT\APPDATA\ROAMING\MCNEEL\RHINOCEROS\7.0\PLUG-INS\SPECKLERHINO2 (8DD5F30B-A13D-4A24-ABDC-3E05C8C87143)\SpeckleCore2.dll", "C:\Windows\Microsoft.NET\assembly\GAC_MSIL\netstandard\v4.0_2.0.0.0__cc7b13ffcd2ddd51\netstandard.dll", "C:\USERS\LASAT\APPDATA\ROAMING\MCNEEL\RHINOCEROS\7.0\PLUG-INS\SPECKLERHINO2 (8DD5F30B-A13D-4A24-ABDC-3E05C8C87143)\SpeckleConnectorGrasshopper.gha", "C:\USERS\LASAT\APPDATA\ROAMING\SPECKLE\KITS\OBJECTS\Objects.Converter.Grasshopper7.dll", "C:\USERS\LASAT\APPDATA\ROAMING\SPECKLE\KITS\OBJECTS\Objects.dll"])  # -> out, A; disabled
# ---------- c_script_54: C# ----------
    // Cast the input to a Speckle Base object.
    Base speckleObj = iSolidOperator_Speckle as Base;
    if (speckleObj == null)
    {
      Print("Input is not a valid Speckle object.");
      return;
    }
    A = ConverterHelper.PopulateSolidOperator(speckleObj);
# ---------- c_script_54: C# additional code ----------
  public static class ConverterHelper
  {
    public static SolidOperator PopulateSolidOperator(Base speckleObj)
    {
      // Retrieve required properties.
      string name = speckleObj["@Name"] as string;
      string typeStr = speckleObj["@Type"] as string;
      if (string.IsNullOrEmpty(name))
        throw new ArgumentException("The Speckle object is missing the '@Name' property.");
      if (string.IsNullOrEmpty(typeStr))
        throw new ArgumentException("The Speckle object is missing the '@Type' property.");

      // Convert the type string to the SolidOperatorType enum.
      SolidOperatorType opType;
      if (!Enum.TryParse(typeStr, true, out opType))
        throw new ArgumentException("Invalid SolidOperatorType: " + typeStr);

      // Create a converter instance and set the active Rhino document.
      ConverterRhinoGh converter = new ConverterRhinoGh();
      converter.SetContextDocument(RhinoDoc.ActiveDoc);

      // Retrieve dynamic members from the Speckle object.
      IDictionary<string, object> dynamicMembers = speckleObj.GetMembers(DynamicBaseMemberType.Dynamic);

      // Retrieve the plane (FrameBase/Plane) for the operator.
      object planeObj = null;
      if (dynamicMembers.ContainsKey("FrameBase"))
        planeObj = dynamicMembers["FrameBase"];
      else if (dynamicMembers.ContainsKey("@FrameBase"))
        planeObj = dynamicMembers["@FrameBase"];
      else if (dynamicMembers.ContainsKey("@Plane"))
        planeObj = dynamicMembers["@Plane"];
      if (planeObj == null)
        throw new ArgumentException("The Speckle object does not contain a valid plane definition.");

      RhinoPlane frameBase;
      SpecklePlane sp = planeObj as SpecklePlane;
      if (sp != null)
      {
        frameBase = converter.PlaneToNative(sp);
      }
      else
      {
        throw new Exception("Plane conversion failed: unrecognized type.");
      }

      // Process known optional properties.
      Rhino.Geometry.Curve path = null;
      if (dynamicMembers.ContainsKey("@Path"))
      {
        object pathObj = dynamicMembers["@Path"];
        SpeckleLine sLine = pathObj as SpeckleLine;
        if (sLine != null)
        {
          RhinoLine nativeLine = converter.LineToNative(sLine).Line;
          path = new LineCurve(nativeLine);
        }
      }
      double offsetPositive = 0.0;
      double offsetNegative = 0.0;
      if (dynamicMembers.ContainsKey("@OffsetPositive"))
        offsetPositive = Convert.ToDouble(dynamicMembers["@OffsetPositive"]);
      if (dynamicMembers.ContainsKey("@OffsetNegative"))
        offsetNegative = Convert.ToDouble(dynamicMembers["@OffsetNegative"]);

      // Create the SolidOperator instance using the appropriate constructor.
      SolidOperator solidOp;
      if (path != null)
        solidOp = new SolidOperator(name, opType, frameBase, path, offsetPositive, offsetNegative);
      else
        solidOp = new SolidOperator(name, opType, frameBase);

      solidOp.Name = name;

      // Prepare a set of keys that have been explicitly processed.
      HashSet<string> processedKeys = new HashSet<string>
        {
          "@Name", "@Type", "FrameBase", "@FrameBase", "Plane", "Path", "OffsetPositive", "OffsetNegative"
          };

      // Special handling: if the Speckle object contains the "Geo" key,
      // convert and assign its value to the Geometry property using a classic cast.
      if (dynamicMembers.ContainsKey("@Geo"))
      {

        object geoObj = dynamicMembers["@Geo"];
        var sGeo = geoObj as Objects.Geometry.Brep;
        if (sGeo != null)
        {
          List<string> notes = new List<string>();
          solidOp.Geometry = converter.BrepToNative(sGeo, out notes);
        }
        else
        {
          throw new Exception("Geo conversion failed: unrecognized type.");
        }
        processedKeys.Add("Geo");
      }

      // Use reflection to process any additional dynamic properties.
      Type solidOpType = solidOp.GetType();
      foreach (string key in dynamicMembers.Keys)
      {
        if (processedKeys.Contains(key))
          continue;

        // Remove any "@" prefix.
        string dictKey = key.StartsWith("@") ? key.Substring(1) : key;
        if (dictKey == "Geo") continue;
        object value = dynamicMembers[key];
        if (value == null)
          continue;

        // Check if a settable property exists on SolidOperator.
        PropertyInfo prop = solidOpType.GetProperty(dictKey, BindingFlags.IgnoreCase | BindingFlags.Public | BindingFlags.Instance);
        if (prop != null && prop.CanWrite)
        {
          try
          {
            object converted = ConvertPropertyValue(prop.PropertyType, value, converter);
            if (converted == null)
              throw new Exception("Conversion returned null.");
            prop.SetValue(solidOp, converted, null);
          }
          catch (Exception ex)
          {
            RhinoApp.WriteLine("Failed to assign property " + dictKey + ": " + ex.Message);
          }
          continue;
        }

        // Fallback: add unrecognized members to the CustomData dictionary,
        // converting them to native Rhino types if possible.
        if (solidOp.CustomData == null)
          solidOp.CustomData = new Dictionary<string, object>();

        object nativeValue = ConvertCustomData(value, converter);
        if (!solidOp.CustomData.ContainsKey(dictKey))
          solidOp.CustomData[dictKey] = nativeValue;
      }

      return solidOp;
    }

    public static object ConvertPropertyValue(Type targetType, object value, ConverterRhinoGh converter)
    {
      if (targetType == typeof(string))
        return value.ToString();
      if (targetType == typeof(int))
        return Convert.ToInt32(value);
      if (targetType == typeof(double))
        return Convert.ToDouble(value);
      if (targetType == typeof(bool))
        return Convert.ToBoolean(value);
      if (targetType == typeof(RhinoPlane))
      {
        SpecklePlane sp = value as SpecklePlane;
        if (sp != null)
          return converter.PlaneToNative(sp);
      }
      if (targetType == typeof(RhinoBrep))
      {
        if (value is SpeckleBrep)
        {
          SpeckleBrep sb = value as SpeckleBrep;
          List<string> notes;
          RhinoBrep brep = converter.BrepToNative(sb, out notes);
          if (brep == null)
            throw new Exception("Brep conversion returned null. Notes: " + string.Join(", ", notes));
          return brep;
        }
        else if (value is SpeckleBox)
        {
          SpeckleBox sbox = value as SpeckleBox;
          RhinoBox box = converter.BoxToNative(sbox).BoundingBox;
          RhinoBrep brep = box.ToBrep();
          return brep;
        }
      }
      if (targetType == typeof(RhinoBox))
      {
        SpeckleBox sbox = value as SpeckleBox;
        if (sbox != null)
          return converter.BoxToNative(sbox);
      }
      if (targetType == typeof(Point3d))
      {
        SpecklePoint spt = value as SpecklePoint;
        if (spt != null)
        {
          RhinoPoint pt = converter.PointToNative(spt);
          return pt.Location;
        }
      }
      if (targetType == typeof(RhinoVector3d))
      {
        SpeckleVector sv = value as SpeckleVector;
        if (sv != null)
          return converter.VectorToNative(sv);
      }
      if (targetType == typeof(RhinoLine))
      {
        SpeckleLine sl = value as SpeckleLine;
        if (sl != null)
          return converter.LineToNative(sl).Line;
      }
      return value;
    }

    // Helper method to convert custom dynamic data to native Rhino types when possible.
    public static object ConvertCustomData(object value, ConverterRhinoGh converter)
    {
      SpecklePlane sp = value as SpecklePlane;
      if (sp != null)
      {
        return converter.PlaneToNative(sp);
      }

      SpeckleLine sl = value as SpeckleLine;
      if (sl != null)
      {
        return converter.LineToNative(sl).Line;
      }

      SpeckleBrep sb = value as SpeckleBrep;
      if (sb != null)
      {
        List<string> notes;
        RhinoBrep brep = converter.BrepToNative(sb, out notes);
        return brep;
      }

      SpeckleBox sbox = value as SpeckleBox;
      if (sbox != null)
      {
        return converter.BoxToNative(sbox);
      }

      SpecklePoint spt = value as SpecklePoint;
      if (spt != null)
      {
        return converter.PointToNative(spt);
      }

      SpeckleVector sv = value as SpeckleVector;
      if (sv != null)
      {
        return converter.VectorToNative(sv);
      }

      // If the value is not a recognized Speckle geometry type, return it as is.
      return value;
    }
  }
# ---------- end c_script_54 ----------
c_script_55 = CSharpScript(
    iSolidOperator_Speckle=merge_71,
    Reference=["C:\Users\Lasat\AppData\Roaming\Grasshopper\Libraries\ABxM.PlateStructures\LCRL.Core.dll", "C:\USERS\LASAT\APPDATA\ROAMING\GRASSHOPPER\LIBRARIES\ABXM.PLATESTRUCTURES\ElementBase.dll", "C:\USERS\LASAT\APPDATA\ROAMING\GRASSHOPPER\LIBRARIES\FABFRAMEWORK\Fab.Core.dll", "C:\USERS\LASAT\APPDATA\ROAMING\MCNEEL\RHINOCEROS\7.0\PLUG-INS\SPECKLERHINO2 (8DD5F30B-A13D-4A24-ABDC-3E05C8C87143)\SpeckleCore2.dll", "C:\Windows\Microsoft.NET\assembly\GAC_MSIL\netstandard\v4.0_2.0.0.0__cc7b13ffcd2ddd51\netstandard.dll", "C:\USERS\LASAT\APPDATA\ROAMING\MCNEEL\RHINOCEROS\7.0\PLUG-INS\SPECKLERHINO2 (8DD5F30B-A13D-4A24-ABDC-3E05C8C87143)\SpeckleConnectorGrasshopper.gha", "C:\USERS\LASAT\APPDATA\ROAMING\SPECKLE\KITS\OBJECTS\Objects.Converter.Grasshopper7.dll", "C:\USERS\LASAT\APPDATA\ROAMING\SPECKLE\KITS\OBJECTS\Objects.dll"])  # -> out, A; disabled
# ---------- c_script_55: C# usings ----------
using Fab.Core.FabCollection;
using Fab.Core.DesignElement;
using System.Linq;
using Grasshopper.Kernel.Components;
using System.Net.NetworkInformation;
using ABxM.PlateStructures.Development;
using Speckle.Core.Models;
using Objects.Converter.RhinoGh;
using Objects.Geometry;
using Speckle.Core.Kits;
using System.Reflection;

// Alias definitions for convenience.
using RhinoPlane = Rhino.Geometry.Plane;
using RhinoLine = Rhino.Geometry.Line;
using RhinoBrep = Rhino.Geometry.Brep;
using RhinoBox = Rhino.Geometry.BoundingBox;
using RhinoPoint = Rhino.Geometry.Point;
using RhinoVector3d = Rhino.Geometry.Vector3d;
using SpecklePlane = Objects.Geometry.Plane;
using SpeckleLine = Objects.Geometry.Line;
using SpeckleBrep = Objects.Geometry.Brep;
using SpeckleBox = Objects.Geometry.Box;
using SpecklePoint = Objects.Geometry.Point;
using SpeckleVector = Objects.Geometry.Vector;
// Aliases to disambiguate Polyline, Mesh, ICurve, and PolylineCurve.
using RhinoPolyline = Rhino.Geometry.Polyline;
using SpecklePolyline = Objects.Geometry.Polyline;
using RhinoMesh = Rhino.Geometry.Mesh;
using SpeckleMesh = Objects.Geometry.Mesh;
using SpeckleICurve = Objects.ICurve;
using RhinoPolylineCurve = Rhino.Geometry.PolylineCurve;  // Explicit alias
# ---------- c_script_55: C# ----------
    // Cast the input to a Speckle Base object.
    Base speckleObj = iSolidOperator_Speckle as Base;
    if (speckleObj == null)
    {
      Print("Input is not a valid Speckle object.");
      return;
    }
    A = ConverterHelper.PopulateSolidOperator(speckleObj);
# ---------- c_script_55: C# additional code ----------
  public static class ConverterHelper
  {
    public static SolidOperator PopulateSolidOperator(Base speckleObj)
    {
      // Retrieve required properties.
      string name = speckleObj["@Name"] as string;
      string typeStr = speckleObj["@Type"] as string;
      if (string.IsNullOrEmpty(name))
      {
        throw new ArgumentException("The Speckle object is missing the '@Name' property.");
      }
      if (string.IsNullOrEmpty(typeStr))
      {
        throw new ArgumentException("The Speckle object is missing the '@Type' property.");
      }

      // Convert the type string to the SolidOperatorType enum.
      SolidOperatorType opType;
      if (!Enum.TryParse(typeStr, true, out opType))
      {
        throw new ArgumentException("Invalid SolidOperatorType: " + typeStr);
      }

      // Create a converter instance and set the active Rhino document.
      ConverterRhinoGh converter = new ConverterRhinoGh();
      converter.SetContextDocument(RhinoDoc.ActiveDoc);

      // Retrieve dynamic members from the Speckle object.
      IDictionary<string, object> dynamicMembers = speckleObj.GetMembers(DynamicBaseMemberType.Dynamic);

      // Retrieve the plane (FrameBase/Plane) for the operator.
      object planeObj = null;
      if (dynamicMembers.ContainsKey("FrameBase"))
      {
        planeObj = dynamicMembers["FrameBase"];
      }
      else if (dynamicMembers.ContainsKey("@FrameBase"))
      {
        planeObj = dynamicMembers["@FrameBase"];
      }
      else if (dynamicMembers.ContainsKey("@Plane"))
      {
        planeObj = dynamicMembers["@Plane"];
      }
      if (planeObj == null)
      {
        throw new ArgumentException("The Speckle object does not contain a valid plane definition.");
      }

      RhinoPlane frameBase;
      SpecklePlane sp = planeObj as SpecklePlane;
      if (sp != null)
      {
        frameBase = converter.PlaneToNative(sp);
      }
      else
      {
        throw new Exception("Plane conversion failed: unrecognized type.");
      }

      // Process known optional properties.
      Rhino.Geometry.Curve path = null;
      if (dynamicMembers.ContainsKey("@Path"))
      {
        object pathObj = dynamicMembers["@Path"];
        SpeckleLine sLine = pathObj as SpeckleLine;
        if (sLine != null)
        {
          RhinoLine nativeLine = converter.LineToNative(sLine).Line;
          path = new LineCurve(nativeLine);
        }
      }
      double offsetPositive = 0.0;
      double offsetNegative = 0.0;
      if (dynamicMembers.ContainsKey("@OffsetPositive"))
      {
        offsetPositive = Convert.ToDouble(dynamicMembers["@OffsetPositive"]);
      }
      if (dynamicMembers.ContainsKey("@OffsetNegative"))
      {
        offsetNegative = Convert.ToDouble(dynamicMembers["@OffsetNegative"]);
      }

      // Create the SolidOperator instance using the appropriate constructor.
      SolidOperator solidOp;
      if (path != null)
      {
        solidOp = new SolidOperator(name, opType, frameBase, path, offsetPositive, offsetNegative);
      }
      else
      {
        solidOp = new SolidOperator(name, opType, frameBase);
      }

      solidOp.Name = name;

      // Prepare a set of keys that have been explicitly processed.
      HashSet<string> processedKeys = new HashSet<string>
        {
          "@Name", "@Type", "FrameBase", "@FrameBase", "Plane", "Path", "OffsetPositive", "OffsetNegative"
          };

      // Special handling: if the Speckle object contains the "Geo" key,
      // convert and assign its value to the Geometry property.
      if (dynamicMembers.ContainsKey("@Geo"))
      {
        object geoObj = dynamicMembers["@Geo"];
        Objects.Geometry.Brep sGeo = geoObj as Objects.Geometry.Brep;
        if (sGeo != null)
        {
          List<string> notes = new List<string>();
          solidOp.Geometry = converter.BrepToNative(sGeo, out notes);
        }
        else
        {
          throw new Exception("Geo conversion failed: unrecognized type.");
        }
        processedKeys.Add("Geo");
      }

      // Use reflection to process any additional dynamic properties.
      Type solidOpType = solidOp.GetType();
      foreach (string key in dynamicMembers.Keys)
      {
        if (processedKeys.Contains(key))
        {
          continue;
        }

        // Remove any "@" prefix.
        string dictKey = key.StartsWith("@") ? key.Substring(1) : key;
        if (dictKey == "Geo")
        {
          continue;
        }
        object value = dynamicMembers[key];
        if (value == null)
        {
          continue;
        }

        // Check if a settable property exists on SolidOperator.
        PropertyInfo prop = solidOpType.GetProperty(dictKey, BindingFlags.IgnoreCase | BindingFlags.Public | BindingFlags.Instance);
        if (prop != null && prop.CanWrite)
        {
          try
          {
            object converted = ConvertPropertyValue(prop.PropertyType, value, converter);
            if (converted == null)
            {
              throw new Exception("Conversion returned null.");
            }
            prop.SetValue(solidOp, converted, null);
          }
          catch (Exception ex)
          {
            RhinoApp.WriteLine("Failed to assign property " + dictKey + ": " + ex.Message);
          }
          continue;
        }

        // Fallback: add unrecognized members to the CustomData dictionary.
        if (solidOp.CustomData == null)
        {
          solidOp.CustomData = new Dictionary<string, object>();
        }
        object nativeValue = ConvertCustomData(value, converter);
        if (!solidOp.CustomData.ContainsKey(dictKey))
        {
          solidOp.CustomData[dictKey] = nativeValue;
        }
      }

      return solidOp;
    }

    public static object ConvertPropertyValue(Type targetType, object value, ConverterRhinoGh converter)
    {
      if (targetType == typeof(string))
      {
        return value.ToString();
      }
      if (targetType == typeof(int))
      {
        return Convert.ToInt32(value);
      }
      if (targetType == typeof(double))
      {
        return Convert.ToDouble(value);
      }
      if (targetType == typeof(bool))
      {
        return Convert.ToBoolean(value);
      }
      if (targetType == typeof(RhinoPlane))
      {
        SpecklePlane sp = value as SpecklePlane;
        if (sp != null)
        {
          return converter.PlaneToNative(sp);
        }
      }
      if (targetType == typeof(RhinoBrep))
      {
        SpeckleBrep sb = value as SpeckleBrep;
        if (sb != null)
        {
          List<string> notes;
          RhinoBrep brep = converter.BrepToNative(sb, out notes);
          if (brep == null)
          {
            throw new Exception("Brep conversion returned null. Notes: " + string.Join(", ", notes));
          }
          return brep;
        }
        else
        {
          SpeckleBox sbox = value as SpeckleBox;
          if (sbox != null)
          {
            RhinoBox box = converter.BoxToNative(sbox).BoundingBox;
            RhinoBrep brep = box.ToBrep();
            return brep;
          }
        }
      }
      if (targetType == typeof(RhinoBox))
      {
        SpeckleBox sbox = value as SpeckleBox;
        if (sbox != null)
        {
          return converter.BoxToNative(sbox);
        }
      }
      if (targetType == typeof(Point3d))
      {
        SpecklePoint spt = value as SpecklePoint;
        if (spt != null)
        {
          RhinoPoint pt = converter.PointToNative(spt);
          return pt.Location;
        }
      }
      if (targetType == typeof(RhinoVector3d))
      {
        SpeckleVector sv = value as SpeckleVector;
        if (sv != null)
        {
          return converter.VectorToNative(sv);
        }
      }
      if (targetType == typeof(RhinoLine))
      {
        SpeckleLine sl = value as SpeckleLine;
        if (sl != null)
        {
          return converter.LineToNative(sl).Line;
        }
      }
      if (targetType == typeof(RhinoPolyline))
      {
        SpecklePolyline spPolyline = value as SpecklePolyline;
        if (spPolyline != null)
        {
          return converter.PolylineToNative(spPolyline);
        }
        else if (value is RhinoPolyline)
        {
          return (RhinoPolyline) value;
        }
      }
      if (targetType == typeof(RhinoPolylineCurve))
      {
        SpecklePolyline spPolyline = value as SpecklePolyline;
        if (spPolyline != null)
        {
          return new RhinoPolylineCurve(converter.PolylineToNative(spPolyline));
        }
        else if (value is RhinoPolylineCurve)
        {
          return (RhinoPolylineCurve) value;
        }
      }
      if (targetType == typeof(RhinoMesh))
      {
        SpeckleMesh spMesh = value as SpeckleMesh;
        if (spMesh != null)
        {
          return converter.MeshToNative(spMesh);
        }
      }
      if (targetType == typeof(Rhino.Geometry.Curve))
      {
        SpeckleICurve spCurve = value as SpeckleICurve;
        if (spCurve != null)
        {
          return converter.CurveToNative(spCurve);
        }
      }
      if (targetType == typeof(Rhino.Geometry.Surface))
      {
        Objects.Geometry.Surface spSurface = value as Objects.Geometry.Surface;
        if (spSurface != null)
        {
          return converter.SurfaceToNative(spSurface);
        }
      }
      // Removed Nurbs conversions due to missing implementations.
      return value;
    }

    public static object ConvertCustomData(object value, ConverterRhinoGh converter)
    {
      SpecklePlane sp = value as SpecklePlane;
      if (sp != null)
      {
        return converter.PlaneToNative(sp);
      }
      SpeckleLine sl = value as SpeckleLine;
      if (sl != null)
      {
        return converter.LineToNative(sl).Line;
      }
      SpeckleBrep sb = value as SpeckleBrep;
      if (sb != null)
      {
        List<string> notes;
        RhinoBrep brep = converter.BrepToNative(sb, out notes);
        return brep;
      }
      SpeckleBox sbox = value as SpeckleBox;
      if (sbox != null)
      {
        return converter.BoxToNative(sbox);
      }
      SpecklePoint spt = value as SpecklePoint;
      if (spt != null)
      {
        return converter.PointToNative(spt);
      }
      SpeckleVector sv = value as SpeckleVector;
      if (sv != null)
      {
        return converter.VectorToNative(sv);
      }
      SpecklePolyline spPolyline = value as SpecklePolyline;
      if (spPolyline != null)
      {
        return converter.PolylineToNative(spPolyline);
      }
      else if (value is RhinoPolyline)
      {
        return (RhinoPolyline) value;
      }
      if (value is RhinoPolylineCurve)
      {
        return (RhinoPolylineCurve) value;
      }
      SpeckleMesh spMesh = value as SpeckleMesh;
      if (spMesh != null)
      {
        return converter.MeshToNative(spMesh);
      }
      SpeckleICurve spCurve = value as SpeckleICurve;
      if (spCurve != null)
      {
        return converter.CurveToNative(spCurve);
      }
      Objects.Geometry.Surface spSurface = value as Objects.Geometry.Surface;
      if (spSurface != null)
      {
        return converter.SurfaceToNative(spSurface);
      }
      // If the value is not a recognized Speckle geometry type, return it as is.
      return value;
    }
  }
# ---------- end c_script_55 ----------

c_script_56 = CSharpScript(
    iSolidOperator_Speckle=merge_71,
    Reference=["C:\Users\Lasat\AppData\Roaming\Grasshopper\Libraries\ABxM.PlateStructures\LCRL.Core.dll", "C:\USERS\LASAT\APPDATA\ROAMING\GRASSHOPPER\LIBRARIES\ABXM.PLATESTRUCTURES\ElementBase.dll", "C:\USERS\LASAT\APPDATA\ROAMING\GRASSHOPPER\LIBRARIES\FABFRAMEWORK\Fab.Core.dll", "C:\USERS\LASAT\APPDATA\ROAMING\MCNEEL\RHINOCEROS\7.0\PLUG-INS\SPECKLERHINO2 (8DD5F30B-A13D-4A24-ABDC-3E05C8C87143)\SpeckleCore2.dll", "C:\Windows\Microsoft.NET\assembly\GAC_MSIL\netstandard\v4.0_2.0.0.0__cc7b13ffcd2ddd51\netstandard.dll", "C:\USERS\LASAT\APPDATA\ROAMING\MCNEEL\RHINOCEROS\7.0\PLUG-INS\SPECKLERHINO2 (8DD5F30B-A13D-4A24-ABDC-3E05C8C87143)\SpeckleConnectorGrasshopper.gha", "C:\USERS\LASAT\APPDATA\ROAMING\SPECKLE\KITS\OBJECTS\Objects.Converter.Grasshopper7.dll", "C:\USERS\LASAT\APPDATA\ROAMING\SPECKLE\KITS\OBJECTS\Objects.dll"])  # -> out, A
# ---------- c_script_56: C# ----------
    // Cast the input to a Speckle Base object.
    Base speckleObj = iSolidOperator_Speckle as Base;
    if (speckleObj == null)
    {
      Print("Input is not a valid Speckle object.");
      return;
    }
    A = ConverterHelper.PopulateSolidOperator(speckleObj);
# ---------- c_script_56: C# additional code ----------
 
  public static class ConverterHelper
  {
    public static SolidOperator PopulateSolidOperator(Base speckleObj)
    {
      // Retrieve required properties.
      string name = speckleObj["@Name"] as string;
      string typeStr = speckleObj["@Type"] as string;
      if (string.IsNullOrEmpty(name))
      {
        throw new ArgumentException("The Speckle object is missing the '@Name' property.");
      }
      if (string.IsNullOrEmpty(typeStr))
      {
        throw new ArgumentException("The Speckle object is missing the '@Type' property.");
      }

      // Convert the type string to the SolidOperatorType enum.
      SolidOperatorType opType;
      if (!Enum.TryParse(typeStr, true, out opType))
      {
        throw new ArgumentException("Invalid SolidOperatorType: " + typeStr);
      }

      // Create a converter instance and set the active Rhino document.
      ConverterRhinoGh converter = new ConverterRhinoGh();
      converter.SetContextDocument(RhinoDoc.ActiveDoc);

      // Retrieve dynamic members from the Speckle object.
      IDictionary<string, object> dynamicMembers = speckleObj.GetMembers(DynamicBaseMemberType.Dynamic);

      // Retrieve the plane (FrameBase/Plane) for the operator.
      object planeObj = null;
      if (dynamicMembers.ContainsKey("FrameBase"))
      {
        planeObj = dynamicMembers["FrameBase"];
      }
      else if (dynamicMembers.ContainsKey("@FrameBase"))
      {
        planeObj = dynamicMembers["@FrameBase"];
      }
      else if (dynamicMembers.ContainsKey("@Plane"))
      {
        planeObj = dynamicMembers["@Plane"];
      }
      if (planeObj == null)
      {
        throw new ArgumentException("The Speckle object does not contain a valid plane definition.");
      }

      RhinoPlane frameBase;
      SpecklePlane sp = planeObj as SpecklePlane;
      if (sp != null)
      {
        frameBase = converter.PlaneToNative(sp);
      }
      else
      {
        throw new Exception("Plane conversion failed: unrecognized type.");
      }

      // Process known optional properties.
      Rhino.Geometry.Curve path = null;
      if (dynamicMembers.ContainsKey("@Path"))
      {
        object pathObj = dynamicMembers["@Path"];
        SpeckleLine sLine = pathObj as SpeckleLine;
        if (sLine != null)
        {
          RhinoLine nativeLine = converter.LineToNative(sLine).Line;
          path = new LineCurve(nativeLine);
        }
      }
      double offsetPositive = 0.0;
      double offsetNegative = 0.0;
      if (dynamicMembers.ContainsKey("@OffsetPositive"))
      {
        offsetPositive = Convert.ToDouble(dynamicMembers["@OffsetPositive"]);
      }
      if (dynamicMembers.ContainsKey("@OffsetNegative"))
      {
        offsetNegative = Convert.ToDouble(dynamicMembers["@OffsetNegative"]);
      }

      // Create the SolidOperator instance using the appropriate constructor.
      SolidOperator solidOp;
      if (path != null)
      {
        solidOp = new SolidOperator(name, opType, frameBase, path, offsetPositive, offsetNegative);
      }
      else
      {
        solidOp = new SolidOperator(name, opType, frameBase);
      }

      solidOp.Name = name;

      // Prepare a set of keys that have been explicitly processed.
      HashSet<string> processedKeys = new HashSet<string>
        {
          "@Name", "@Type", "FrameBase", "@FrameBase", "Plane", "Path", "OffsetPositive", "OffsetNegative"
          };

      // Special handling: if the Speckle object contains the "Geo" key,
      // convert and assign its value to the Geometry property.
      if (dynamicMembers.ContainsKey("@Geo"))
      {
        object geoObj = dynamicMembers["@Geo"];

        // Try Brep first
        SpeckleBrep sGeoBrep = geoObj as SpeckleBrep;
        if (sGeoBrep != null)
        {
          List<string> notes = new List<string>();
          RhinoBrep brep = converter.BrepToNative(sGeoBrep, out notes);
          if (brep == null)
          {
            throw new Exception("Geo Brep conversion returned null. Notes: " + string.Join(", ", notes));
          }
          solidOp.Geometry = brep;
        }
        else
        {
          // Then try Mesh
          SpeckleMesh sGeoMesh = geoObj as SpeckleMesh;
          if (sGeoMesh != null)
          {
            RhinoMesh mesh = converter.MeshToNative(sGeoMesh);
            if (mesh == null)
            {
              throw new Exception("Geo Mesh conversion returned null.");
            }
            solidOp.Geometry = mesh;
          }
          else
          {
            throw new Exception("Geo conversion failed: unrecognized type: " + geoObj.GetType().FullName);
          }
        }

        processedKeys.Add("@Geo");
      }

      // Use reflection to process any additional dynamic properties.
      Type solidOpType = solidOp.GetType();
      foreach (string key in dynamicMembers.Keys)
      {
        if (processedKeys.Contains(key))
        {
          continue;
        }

        // Remove any "@" prefix.
        string dictKey = key.StartsWith("@") ? key.Substring(1) : key;
        if (dictKey == "Geo")
        {
          continue;
        }
        object value = dynamicMembers[key];
        if (value == null)
        {
          continue;
        }

        // Check if a settable property exists on SolidOperator.
        PropertyInfo prop = solidOpType.GetProperty(dictKey, BindingFlags.IgnoreCase | BindingFlags.Public | BindingFlags.Instance);
        if (prop != null && prop.CanWrite)
        {
          try
          {
            object converted = ConvertPropertyValue(prop.PropertyType, value, converter);
            if (converted == null)
            {
              throw new Exception("Conversion returned null.");
            }
            prop.SetValue(solidOp, converted, null);
          }
          catch (Exception ex)
          {
            RhinoApp.WriteLine("Failed to assign property " + dictKey + ": " + ex.Message);
          }
          continue;
        }

        // Fallback: add unrecognized members to the CustomData dictionary.
        if (solidOp.CustomData == null)
        {
          solidOp.CustomData = new Dictionary<string, object>();
        }
        object nativeValue = ConvertCustomData(value, converter);
        if (!solidOp.CustomData.ContainsKey(dictKey))
        {
          solidOp.CustomData[dictKey] = nativeValue;
        }
      }

      return solidOp;
    }

    public static object ConvertPropertyValue(Type targetType, object value, ConverterRhinoGh converter)
    {
      if (targetType == typeof(string))
      {
        return value.ToString();
      }
      if (targetType == typeof(int))
      {
        return Convert.ToInt32(value);
      }
      if (targetType == typeof(double))
      {
        return Convert.ToDouble(value);
      }
      if (targetType == typeof(bool))
      {
        return Convert.ToBoolean(value);
      }
      if (targetType == typeof(RhinoPlane))
      {
        SpecklePlane sp = value as SpecklePlane;
        if (sp != null)
        {
          return converter.PlaneToNative(sp);
        }
      }
      if (targetType == typeof(RhinoBrep))
      {
        SpeckleBrep sb = value as SpeckleBrep;
        if (sb != null)
        {
          List<string> notes;
          RhinoBrep brep = converter.BrepToNative(sb, out notes);
          if (brep == null)
          {
            throw new Exception("Brep conversion returned null. Notes: " + string.Join(", ", notes));
          }
          return brep;
        }
        else
        {
          SpeckleBox sbox = value as SpeckleBox;
          if (sbox != null)
          {
            RhinoBox box = converter.BoxToNative(sbox).BoundingBox;
            RhinoBrep brep = box.ToBrep();
            return brep;
          }
        }
      }
      if (targetType == typeof(RhinoBox))
      {
        SpeckleBox sbox = value as SpeckleBox;
        if (sbox != null)
        {
          return converter.BoxToNative(sbox);
        }
      }
      if (targetType == typeof(Point3d))
      {
        SpecklePoint spt = value as SpecklePoint;
        if (spt != null)
        {
          RhinoPoint pt = converter.PointToNative(spt);
          return pt.Location;
        }
      }
      if (targetType == typeof(RhinoVector3d))
      {
        SpeckleVector sv = value as SpeckleVector;
        if (sv != null)
        {
          return converter.VectorToNative(sv);
        }
      }
      if (targetType == typeof(RhinoLine))
      {
        SpeckleLine sl = value as SpeckleLine;
        if (sl != null)
        {
          return converter.LineToNative(sl).Line;
        }
      }
      if (targetType == typeof(RhinoPolyline))
      {
        SpecklePolyline spPolyline = value as SpecklePolyline;
        if (spPolyline != null)
        {
          return converter.PolylineToNative(spPolyline);
        }
        else if (value is RhinoPolyline)
        {
          return (RhinoPolyline) value;
        }
      }
      if (targetType == typeof(RhinoPolylineCurve))
      {
        SpecklePolyline spPolyline = value as SpecklePolyline;
        if (spPolyline != null)
        {
          return new RhinoPolylineCurve(converter.PolylineToNative(spPolyline));
        }
        else if (value is RhinoPolylineCurve)
        {
          return (RhinoPolylineCurve) value;
        }
      }
      if (targetType == typeof(RhinoMesh))
      {
        SpeckleMesh spMesh = value as SpeckleMesh;
        if (spMesh != null)
        {
          return converter.MeshToNative(spMesh);
        }
      }
      if (targetType == typeof(Rhino.Geometry.Curve))
      {
        SpeckleICurve spCurve = value as SpeckleICurve;
        if (spCurve != null)
        {
          return converter.CurveToNative(spCurve);
        }
      }
      if (targetType == typeof(Rhino.Geometry.Surface))
      {
        Objects.Geometry.Surface spSurface = value as Objects.Geometry.Surface;
        if (spSurface != null)
        {
          return converter.SurfaceToNative(spSurface);
        }
      }
      // Removed Nurbs conversions due to missing implementations.
      return value;
    }

    public static object ConvertCustomData(object value, ConverterRhinoGh converter)
    {
      SpecklePlane sp = value as SpecklePlane;
      if (sp != null)
      {
        return converter.PlaneToNative(sp);
      }
      SpeckleLine sl = value as SpeckleLine;
      if (sl != null)
      {
        return converter.LineToNative(sl).Line;
      }
      SpeckleBrep sb = value as SpeckleBrep;
      if (sb != null)
      {
        List<string> notes;
        RhinoBrep brep = converter.BrepToNative(sb, out notes);
        return brep;
      }
      SpeckleBox sbox = value as SpeckleBox;
      if (sbox != null)
      {
        return converter.BoxToNative(sbox);
      }
      SpecklePoint spt = value as SpecklePoint;
      if (spt != null)
      {
        return converter.PointToNative(spt);
      }
      SpeckleVector sv = value as SpeckleVector;
      if (sv != null)
      {
        return converter.VectorToNative(sv);
      }
      SpecklePolyline spPolyline = value as SpecklePolyline;
      if (spPolyline != null)
      {
        return converter.PolylineToNative(spPolyline);
      }
      else if (value is RhinoPolyline)
      {
        return (RhinoPolyline) value;
      }
      if (value is RhinoPolylineCurve)
      {
        return (RhinoPolylineCurve) value;
      }
      SpeckleMesh spMesh = value as SpeckleMesh;
      if (spMesh != null)
      {
        return converter.MeshToNative(spMesh);
      }
      SpeckleICurve spCurve = value as SpeckleICurve;
      if (spCurve != null)
      {
        return converter.CurveToNative(spCurve);
      }
      Objects.Geometry.Surface spSurface = value as Objects.Geometry.Surface;
      if (spSurface != null)
      {
        return converter.SurfaceToNative(spSurface);
      }
      // If the value is not a recognized Speckle geometry type, return it as is.
      return value;
    }
  }
# ---------- end c_script_56 ----------
to_json_2 = ToJSON(Elements=c_script_56.A)

cso_24 = CreateSpeckleObject(
    Plane=merge_69,
    Length=nail_length,
    Diameter=nail_diameter,
    Mesh=merge_68,
    Name="LIGNOLOC 5.3 Plastic Sheel Coil Wood Nails",
    selectedKitName="Objects")
trim_35 = TrimTree(Tree=cso_24, Depth=1)
lng_11 = ListLength(List=flatten(merge_69))

lng_12 = ListLength(List=geo_103)
extremes = MinMax(Number=flatten(lng_12))  # -> Minimum, Maximum
gradient_3 = Gradient(
    LowerLimit=extremes.Maximum,
    UpperLimit=extremes.Minimum,
    Parameter=lng_12,
    stops=[0: RGB(234, 38, 0), 0.25: RGB(234, 126, 0), 0.5: RGB(254, 244, 84), 0.75: RGB(173, 203, 249), 1: RGB(75, 107, 169)])

end_4 = EndPoints(Curve=c_script_52.E)  # -> Start, End

preview_22 = CustomPreview(Geometry=merge_70, Material=ColourSwatch(SwatchColor=RGB(227, 168, 225)))
total_wood_nails = Panel(lng_11)
tag_10 = TextTag(Location=area_53.Centroid, Text=lng_12, Colour=gradient_3)
dots = DotDisplay(Point=[end_4.Start, end_4.End], Colour=swatch_8, Size=Slider(0.04, range=0..0.1))
preview_23 = CustomPreview(Geometry=geo_98, Material=ColourSwatch(SwatchColor=RGBA(117, 117, 117, 11)))

# ---- group: Beams
cso_25 = CreateSpeckleObject(
    Geometry=eso_7,
    Raw=cso_18,
    Material=c_script_46.A,
    OutlineUpper=crv_20,
    OutlineLower=crv_19,
    StartPlane=cluster_40,
    EndPlane=cluster_38,
    BasePlane=cluster_42,
    InteriorPlane=cluster_43,
    MitrePlane=cluster_39,
    WoodNails=trim_35,
    selectedKitName="Objects")

# ----
cluster_53 = Cluster_20(T=cso_25)
panel_76 = Panel(cluster_53)
dso_46 = DeconstructSpeckleObject(SpeckleObject=cso_25, selectedKitName="Objects")  # -> BasePlane, EndPlane, simplify(Geometry), InteriorPlane, Material, MitrePlane, OutlineLower, OutlineUpper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
cluster_54 = Cluster_20(T=dso_46.StartPlane)
panel_77 = Panel(cluster_54)
trim_36 = TrimTree(Tree=simplify(dso_46.Geometry), Depth=1)
panel_78 = Panel(dso_46.OutlineUpper)
cluster_55 = Cluster_18(geo=trim_36, geo_2=cluster_18.M_2)  # -> C, unique, i, i_2
preview_24 = CustomPreview(Geometry=cluster_55.i, Material=cluster_55.C)
tag_11 = TextTag(Location=cluster_55.i_2, Text=graft(cluster_55.unique))
panel_79 = Panel(cluster_55.unique)

cso_26 = CreateSpeckleObject(Id=dso_28.Id, SolidOperators=merge_71, JSON=to_json_2, selectedKitName="Objects")
eso_8 = ExtendSpeckleObject(SpeckleObject=cso_26, RenderMaterial=sso, selectedKitName="Objects")

tstat_80 = TreeStatistics(Tree=simplify(eso_8))  # -> Paths, Length, Count
panel_80 = Panel(tstat_80.Paths)

cso_27 = CreateSpeckleObject(FabricationDesignData=flatten(eso_8), GH_Path=panel_80, Parent=concat_4, ReleaseNotes=note, selectedKitName="Objects")  # -> flatten(SpeckleObject)
send_2 = Send(
    Stream=panel_55,
    Message=panel_54,
    Data=cso_27,
    AutoSend=False,
    BaseId="087d39724ad219e6ab87dd8326b8a293",
    CurrentComponentState="up_to_date",
    KitName="Objects",
    OutputWrappers="https://app.speckle.systems\tfa2b5c68c0\t4e820694c0",
    UseDefaultCache=True,
    selectedKitName="Objects")
panel_81 = Panel(send_2)

# ---- group: Acoustic
dso_47 = DeconstructSpeckleObject(SpeckleObject=data_29, selectedKitName="Objects")  # -> Battens, Padding, Panel
cso_28 = CreateSpeckleObject(Geometry=tree_17, Material=dso_47.Panel, Outline=clean_50, FrameBase=clean_49, selectedKitName="Objects")  # -> simplify(SpeckleObject)

# ----
cluster_56 = Cluster_20(T=cso_28)
panel_82 = Panel(cluster_56)

cso_29 = CreateSpeckleObject(Solid=cso_22, selectedKitName="Objects")  # -> simplify(SpeckleObject)
txt_5 = Text(simplify(dso_28.Id))
sso_3 = RenderMaterial(
    Opacity=1,
    Metalness=0,
    Roughness=1,
    Diffuse=c_script_37.A,
    SelectedConstructorName="Objects.Other.RenderMaterial.ctor(System.Double,System.Double,System.Double,System.Nullable`1[System.Drawing.Color],System.Nullable`1[System.Drawing.Color])",
    SelectedTypeName="Objects.Other.RenderMaterial",
    UseSchemaTag=False,
    UserSetSchemaTag=False,
    seed="2441410a84a7694f9160")
panel_83 = Panel("- Fixed Raw Solids where 4 Valent edges were over cutting")
manual = BooleanToggle(False)
filter_14 = StreamFilter(Gate=manual, Stream0=note_2, Stream1=panel_83)
c_script_57 = CSharpScript(x=filter_14, y=panel_83)  # -> out, A
# ---------- c_script_57: C# ----------
    if (y == null || y == "") A = x;
    else A = x + " & " + y;
# ---------- end c_script_57 ----------
c_script_58 = CSharpScript(x=panel_52, y=panel_83)  # -> out, A; same code as c_script_57
panel_84 = Panel("https://speckle.xyz/streams/fa2b5c68c0/branches/02-development/4-detail_model")
filter_15 = StreamFilter(Gate=manual, Stream0=c_script_58.A, Stream1=panel_83)
panel_85 = Panel(filter_15)

cso_30 = CreateSpeckleObject(Line=ungroup_3, Diameter=diameter, selectedKitName="Objects")
trim_37 = TrimTree(Tree=simplify(cso_30), Depth=1)
tstat_81 = TreeStatistics(Tree=trim_37)  # -> Paths, Length, Count
panel_86 = Panel(tstat_81.Paths)
cso_31 = CreateSpeckleObject(GH_Path=panel_86, BattenScrews=flatten(cso_30), ObjectJSON=flatten(cso_17), selectedKitName="Objects")
send_3 = Send(
    Stream=panel_18,
    Message=c_script_58.A,
    Data=cso_31,
    AutoSend=False,
    BaseId="b8f91422a301687cb923c097c610bbaa",
    CurrentComponentState="up_to_date",
    KitName="Objects",
    OutputWrappers="https://app.speckle.systems\tfa2b5c68c0\t3c18913de8",
    UseDefaultCache=True,
    selectedKitName="Objects")
panel_87 = Panel(send_3)

# ---- group: Acoustic (continued)
cso_32 = CreateSpeckleObject(GH_Path=tree_16, Geometry=tree_19, Screw=panel_87, Material=dso_47.Battens, selectedKitName="Objects")  # -> simplify(SpeckleObject)

# ----
cluster_57 = Cluster_20(T=cso_32)
panel_88 = Panel(cluster_57)

cso_33 = CreateSpeckleObject(Beams=cso_25, TopPlate=cso_19, BottomPlate=cso_21, Acoustic=cso_28, AcousticBattens=cso_32, selectedKitName="Objects")  # -> simplify(SpeckleObject)
merge_72 = Merge(Data1=cso_29, Data2=cso_33)
cso_34 = CreateSpeckleObject(Segments=merge_72, Id=txt_5, Type=txt_3, BasePlane=move_3.Geometry, selectedKitName="Objects")  # -> simplify(SpeckleObject)
eso_9 = ExtendSpeckleObject(SpeckleObject=cso_34, RenderMaterial=sso_3, selectedKitName="Objects")
trim_38 = TrimTree(Tree=eso_9, Depth=1)
cso_35 = CreateSpeckleObject(DetailModel=trim_38, Parent=concat_4, ReleaseNotes=c_script_57.A, selectedKitName="Objects")  # -> flatten(SpeckleObject)
send_4 = Send(
    Stream=panel_84,
    Message=filter_15,
    Data=cso_35,
    AutoSend=False,
    BaseId="f07bdcca41bbc31dd757d6f305428b78",
    CurrentComponentState="expired",
    KitName="Objects",
    OutputWrappers="https://app.speckle.systems\tfa2b5c68c0\t00104ce63d",
    UseDefaultCache=True,
    selectedKitName="Objects")
panel_89 = Panel(send_4)

string_filter_7 = StringFilter(Text=txt_3, Object=merge_72, Key="B1")  # -> Text, Object
panel_90 = Panel(txt_5)

clean_54 = CleanTree(RemoveNulls=True, RemoveInvalid=True, RemoveEmpty=True, Tree=string_filter_7.Object)

dso_48 = DeconstructSpeckleObject(SpeckleObject=clean_54, selectedKitName="Objects")  # -> Acoustic, AcousticBattens, Beams, BottomPlate, TopPlate
dso_49 = DeconstructSpeckleObject(SpeckleObject=dso_48.Beams, selectedKitName="Objects")  # -> BasePlane, EndPlane, Geometry, InteriorPlane, Material, MitrePlane, OutlineLower, OutlineUpper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
dso_50 = DeconstructSpeckleObject(SpeckleObject=dso_48.TopPlate, selectedKitName="Objects")  # -> Geometry, GeometryPreCut, Material, OutlineLower, OutlineUpper, Raw
dso_51 = DeconstructSpeckleObject(SpeckleObject=dso_48.BottomPlate, selectedKitName="Objects")  # -> BottomHole, BottomHoleCutout, BottomHoleCutoutWithTabs, Geometry, Material, OutlineLower, OutlineUpper, Raw
dso_52 = DeconstructSpeckleObject(SpeckleObject=dso_49.Raw, selectedKitName="Objects")  # -> BoundingBox, simplify(Raw), RawBoundingBox, RawWidth
pln_28 = Plane(dso_50.OutlineUpper)
pln_29 = Plane(dso_51.OutlineUpper)
bbox_8 = BoundingBox(Content=simplify(dso_50.Geometry), Plane=pln_28)  # -> Box, Box_2
bbox_9 = BoundingBox(Content=simplify(dso_51.Geometry), Plane=pln_29)  # -> Box, Box_2
bbox_10 = BoundingBox(Content=simplify(dso_50.Raw), Plane=pln_28)  # -> Box, Box_2
bbox_11 = BoundingBox(Content=simplify(dso_51.Raw), Plane=pln_29)  # -> Box, Box_2
bbox_12 = BoundingBox(Content=simplify(dso_49.Geometry), Plane=dso_49.BasePlane)  # -> Box, Box_2
debox_4 = DeconstructBox(Box=bbox_8.Box)  # -> Plane, X, Y, Z
debox_5 = DeconstructBox(Box=bbox_9.Box)  # -> Plane, X, Y, Z
debox_6 = DeconstructBox(Box=bbox_10.Box)  # -> Plane, X, Y, Z
debox_7 = DeconstructBox(Box=bbox_11.Box)  # -> Plane, X, Y, Z
bbox_13 = BoundingBox(Content=simplify(dso_52.Raw), Plane=dso_49.BasePlane)  # -> Box, Box_2
debox_8 = DeconstructBox(Box=bbox_12.Box)  # -> Plane, X, Y, Z
debox_9 = DeconstructBox(Box=bbox_13.Box)  # -> Plane, X, Y, Z
num_15 = Number([debox_4.Z, debox_6.Z])
num_16 = Number([debox_5.Z, debox_7.Z])
avr_6 = Average(Input=flatten(num_15))
avr_7 = Average(Input=flatten(num_16))
num_17 = Number([debox_8.Z, debox_9.Z])
avr_8 = Average(Input=flatten(num_17))
roundd_5 = RoundToDecimalPlace(NumberX=avr_6, DecimalPlace=4, RoundType=0)  # -> Rounded, Difference
roundd_6 = RoundToDecimalPlace(NumberX=avr_7, DecimalPlace=4, RoundType=0)  # -> Rounded, Difference
roundd_7 = RoundToDecimalPlace(NumberX=avr_8, DecimalPlace=4, RoundType=0)  # -> Rounded, Difference
panel_91 = Panel(roundd_5.Rounded)
panel_92 = Panel(roundd_6.Rounded)
panel_93 = Panel(roundd_7.Rounded)
addition_9 = Addition(A=panel_93, B=panel_91, C=panel_92)
panel_94 = Panel(addition_9)

# ----
# Onsite Assembly Data
split_111 = SplitTree(Data=geo_68, Masks=flatten(tstat.Paths))  # -> Positive, Negative
geo_105 = Geometry(item)
sdiff_22 = SolidDifference(BrepsA=split_111.Positive, BrepsB=geo_105)
split_112 = SplitTree(Data=merge_72, Masks=flatten(tstat_61.Paths))  # -> Positive, Negative
split_113 = SplitTree(Data=move_9.Geometry, Masks=flatten(tstat_61.Paths))  # -> Positive, Negative
split_114 = SplitTree(Data=generate_mitre_planes_between_segments.Neighbours, Masks=flatten(tstat_61.Paths))  # -> Positive, Negative
split_115 = SplitTree(Data=cluster_22.geo_5, Masks=flatten(tstat_61.Paths))  # -> Positive, Negative
dso_53 = DeconstructSpeckleObject(SpeckleObject=split_112.Positive, selectedKitName="Objects")  # -> Acoustic, AcousticBattens, Beams, BottomPlate, TopPlate
dso_54 = DeconstructSpeckleObject(SpeckleObject=dso_53.BottomPlate, selectedKitName="Objects")  # -> BottomHole, BottomHoleCutout, BottomHoleCutoutWithTabs, Geometry, Material, OutlineLower, OutlineUpper, Raw
split_116 = SplitTree(Data=split_111.Negative, Masks=flatten("{0,1;*}"))  # -> Positive, Negative
dso_55 = DeconstructSpeckleObject(SpeckleObject=dso_53.Beams, selectedKitName="Objects")  # -> BasePlane, EndPlane, Geometry, InteriorPlane, Material, MitrePlane, OutlineLower, OutlineUpper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
dso_56 = DeconstructSpeckleObject(SpeckleObject=dso_53.TopPlate, selectedKitName="Objects")  # -> Geometry, GeometryPreCut, Material, OutlineLower, OutlineUpper, Raw
dso_57 = DeconstructSpeckleObject(SpeckleObject=dso_53.Acoustic, selectedKitName="Objects")  # -> FrameBase, Geometry, Material, Outline
dso_58 = DeconstructSpeckleObject(SpeckleObject=dso_53.AcousticBattens, selectedKitName="Objects")  # -> Geometry, GH_Path, Material, Screw
_3s_plate_3 = _3SPlate(ActiveMaterialIndex=0)
python_5 = GhPythonScript(x=_3s_plate)  # -> out, a
# ---------- python_5: Python ----------
a = x.Density
# ---------- end python_5 ----------
python_6 = GhPythonScript(x=_3s_plate_2)  # -> out, a; same code as python_5
python_7 = GhPythonScript(x=_3s_plate_3)  # -> out, a; same code as python_5
division_20 = Division(A=Slider(2800, range=0..10000), B=1000)
tstat_82 = TreeStatistics(Tree=split_116.Positive)  # -> Paths, Length, Count
match_44 = MatchTree(Tree=graft(tstat_82.Paths), Guide=split_116.Positive)
panel_95 = Panel(match_44)

cluster_58 = Cluster_33(x=division_20, G=dso_57.Geometry)
cluster_59 = Cluster_33(x=Slider(350, range=0..1000), G=dso_58.Geometry)
cluster_60 = Cluster_33(x=python_5.a, G=dso_55.Geometry)
cluster_61 = Cluster_33(x=python_7.a, G=dso_54.Geometry)
cluster_62 = Cluster_33(x=python_6.a, G=dso_56.Geometry)
trim_39 = TrimTree(Tree=cluster_60, Depth=1)
dpath_2 = DeconstructPath(Branch=match_44)
item_71 = ListItem(List=dpath_2, Index=1, Wrap=True)  # -> simplify(Item)
panel_96 = Panel(item_71)

merge_73 = Merge(Data1=cluster_58, Data2=cluster_59, Data3=trim_39, Data4=cluster_61, Data5=cluster_62)
ma_8 = MassAddition(Input=merge_73)  # -> Result, PartialResults
match_45 = MatchTree(Tree=ma_8.Result, Guide=split_112.Positive)
tstat_83 = TreeStatistics(Tree=match_45)  # -> Paths, Length, Count
match_46 = MatchTree(Tree=graft(tstat_83.Paths), Guide=split_112.Positive)
panel_97 = Panel(match_46)
cso_36 = CreateSpeckleObject(Id=item_71, Name=panel_95, Geometry=split_116.Positive, Type=split_99.Positive, selectedKitName="Objects")

tstat_84 = TreeStatistics(Tree=simplify(match_45))  # -> Paths, Length, Count
match_47 = MatchTree(Tree=graft(tstat_84.Paths), Guide=split_112.Positive)
eso_10 = ExtendSpeckleObject(SpeckleObject=sdiff_22, Weight=match_45, selectedKitName="Objects")
eso_11 = ExtendSpeckleObject(SpeckleObject=cso_36, RenderMaterial=split_98.Positive, selectedKitName="Objects")

dpath_3 = DeconstructPath(Branch=match_47)
match_48 = MatchTree(Tree=dpath_3, Guide=split_112.Positive)
cso_37 = CreateSpeckleObject(
    Name=panel_97,
    Id=match_48,
    Geometry=eso_10,
    MitrePlanes=split_113.Positive,
    ApproxWeight=match_45,
    CentrePlane=split_115.Positive,
    Neighbours=split_114.Positive,
    Type=split_97.Positive,
    selectedKitName="Objects")

eso_12 = ExtendSpeckleObject(SpeckleObject=cso_37, RenderMaterial=split_96.Positive, selectedKitName="Objects")

cso_38 = CreateSpeckleObject(ContextSegments=flatten(eso_11), OnsiteSegments=flatten(eso_12), selectedKitName="Objects")

panel_98 = Panel(panel_52)
send_5 = Send(
    Stream="https://speckle.xyz/projects/fa2b5c68c0/models/6b0d00be57",
    Message=panel_98,
    Data=flatten(cso_38),
    AutoSend=False,
    BaseId="b03ee2be7a2b645471457a515a8ce336",
    CurrentComponentState="up_to_date",
    KitName="Objects",
    OutputWrappers="https://app.speckle.systems\tfa2b5c68c0\te71ba12570",
    UseDefaultCache=True,
    selectedKitName="Objects")

panel_99 = Panel(send_5)

# ==== cluster Cluster
V = ClusterInput()
P = ClusterInput()
O = ClusterInput()
O_2 = ClusterInput()
generate_offset_polylines = GenerateOffsetPolylines(
    Polyline=P,
    Offset=O,
    OptionalEdgeVectorOverride=V,
    AngleTolerance=degrees(1),
    OffsetMethod=2,
    nonPlanar=False,
    virtual4Valent=False)  # -> OffsetPolylines, FourValenceNodes
generate_offset_polylines_2 = GenerateOffsetPolylines(
    Polyline=P,
    Offset=O_2,
    OptionalEdgeVectorOverride=V,
    AngleTolerance=degrees(1),
    OffsetMethod=2,
    nonPlanar=False,
    virtual4Valent=False)  # -> OffsetPolylines, FourValenceNodes
boundary = BoundarySurfaces(Edges=graft(generate_offset_polylines.OffsetPolylines))
boundary_2 = BoundarySurfaces(Edges=graft(generate_offset_polylines_2.OffsetPolylines))
merge = Merge(Data1=simplify(graft(boundary)), Data2=simplify(graft(boundary_2)))
loft = Loft(Curves=merge, Options={Adjust=False, Closed=False, LoftEnds=0, LoftSimp=0, LoftType=0, Rebuild=10, Refit=0.01})
match = MatchTree(Tree=generate_offset_polylines.OffsetPolylines, Guide=P)
cap = CapHoles(Brep=loft)
match_2 = MatchTree(Tree=generate_offset_polylines_2.OffsetPolylines, Guide=P)
match_3 = MatchTree(Tree=cap, Guide=P)
T = ClusterOutput(match)
T_2 = ClusterOutput(match_3)
T_3 = ClusterOutput(match_2)

# ==== cluster Cluster_2
G = ClusterInput()
P = ClusterInput()
V = ClusterInput()
M = ClusterInput()
L = ClusterInput()
L_2 = ClusterInput()
item = ListItem(List=L, Index=0, Wrap=True)  # -> Item, Item1, Item2, Item3
item_2 = ListItem(List=L_2, Index=0, Wrap=True)  # -> Item, Item1, Item2, Item3
generate_offset_polylines = GenerateOffsetPolylines(
    Polyline=P,
    Offset=item.Item,
    OptionalEdgeVectorOverride=V,
    AngleTolerance=degrees(1),
    OffsetMethod=2,
    nonPlanar=False,
    virtual4Valent=False)  # -> OffsetPolylines, FourValenceNodes
generate_offset_polylines_2 = GenerateOffsetPolylines(
    Polyline=P,
    Offset=item.Item1,
    OptionalEdgeVectorOverride=V,
    AngleTolerance=degrees(1),
    OffsetMethod=2,
    nonPlanar=False,
    virtual4Valent=False)  # -> OffsetPolylines, FourValenceNodes
generate_offset_polylines_3 = GenerateOffsetPolylines(
    Polyline=P,
    Offset=item_2.Item1,
    OptionalEdgeVectorOverride=V,
    AngleTolerance=degrees(1),
    OffsetMethod=2,
    nonPlanar=False,
    virtual4Valent=False)  # -> OffsetPolylines, FourValenceNodes
match = MatchTree(Tree=generate_offset_polylines_2.OffsetPolylines, Guide=P)
match_2 = MatchTree(Tree=generate_offset_polylines_3.OffsetPolylines, Guide=P)
split = SplitTree(Data=simplify(match), Masks=flatten(M))  # -> Positive, Negative
split_2 = SplitTree(Data=simplify(match_2), Masks=flatten(M))  # -> Positive, Negative
merge = Merge(Data1=split_2.Positive, Data2=split.Negative)
filter = StreamFilter(Gate=G, Stream0=match, Stream1=merge)
boundary = BoundarySurfaces(Edges=generate_offset_polylines.OffsetPolylines)
boundary_2 = BoundarySurfaces(Edges=filter)
merge_2 = Merge(Data1=simplify(graft(boundary)), Data2=simplify(graft(boundary_2)))
match_3 = MatchTree(Tree=generate_offset_polylines.OffsetPolylines, Guide=P)
loft = Loft(Curves=merge_2, Options={Adjust=False, Closed=False, LoftEnds=0, LoftSimp=0, LoftType=0, Rebuild=10, Refit=0.01})
cap = CapHoles(Brep=loft)
match_4 = MatchTree(Tree=cap, Guide=P)
T = ClusterOutput(match_3)
T_2 = ClusterOutput(match_4)
s_1 = ClusterOutput(filter)

# ==== cluster Cluster_3
Z = UnitZ(Factor=1)
P = ClusterInput()
D = ClusterInput()
unify_polylines = UnifyPolylines(Polylines=P, Direction=D)  # -> simplify(Polylines)
trim = TrimTree(Tree=unify_polylines, Depth=1)  # -> simplify(Tree)
generate_mitre_planes_between_segments = GenerateMitrePlanesBetweenSegments(Polyline=simplify(trim), NakedEdgeGuideVector=Z)  # -> MitrePlanes, Neighbours, PolylinePlanes, BoundingRectangle
M = ClusterInput()
split = SplitTree(Data=simplify(graft(generate_mitre_planes_between_segments.PolylinePlanes)), Masks=flatten(M))  # -> Positive, Negative
split_2 = SplitTree(Data=simplify(unify_polylines), Masks=flatten(M))  # -> Positive, Negative
split_3 = SplitTree(Data=simplify(generate_mitre_planes_between_segments.MitrePlanes), Masks=flatten(M))  # -> Positive, Negative

geo = Geometry(split_2.Positive)
geo_2 = Geometry(split.Positive)
geo_3 = Geometry(split_3.Positive)

geo_4 = ClusterOutput(geo)
geo_5 = ClusterOutput(geo_2)
geo_6 = ClusterOutput(geo_3)
M_2 = ClusterOutput(generate_mitre_planes_between_segments.MitrePlanes)

# ==== cluster Cluster_4
pln = ClusterInput()
num = ClusterInput()
geo = ClusterInput()
geo_2 = ClusterInput()
geo_3 = ClusterInput()
num_2 = ClusterInput()
geo_4 = ClusterInput()
geo_5 = ClusterInput()
D = ClusterInput()
D_2 = ClusterInput()
num_3 = Number(num)
pln_2 = Plane(pln)
geo_6 = Geometry(geo)
geo_7 = Geometry(geo_2)
geo_8 = Geometry(geo_3)
num_4 = Number(num_2)
geo_9 = Geometry(geo_4)
geo_10 = Geometry(geo_5)
group = Group(Objects=pln_2)
split = SplitTree(Data=num_3, Masks=flatten("{*;*;1}"))  # -> Positive, Negative

c_script = CSharpScript(x=num_4, y=geo_7)  # -> out, A, B, C, D; inputs x: list of Double, y: list
# ---------- c_script: C# ----------
    List<bool> output = new List<bool>();
    List<object> prevs = new List<object>();
    List<object> nexts = new List<object>();
    List<int> indices = new List<int>();

    for (int i = 0; i < x.Count; i++)
    {
      int next = i == x.Count - 1 ? 0 : i + 1;
      int prev = i == 0 ? x.Count - 1 : i - 1;

      if(Math.Round(x[i], 2) == 0)
      {
        prevs.Add(y[prev]);
        nexts.Add(y[next]);
        indices.Add(i);
        output.Add(true);
      }
      else
      {
        output.Add(false);
      }
    }

    A = output;
    B = prevs;
    C = nexts;
    D = indices;
# ---------- end c_script ----------
polyline_interior_angles = PolylineInteriorAngles(Polyline=geo_9)  # -> Angles, Points
c_script_2 = CSharpScript(check=c_script.A, angle=polyline_interior_angles.Angles, point=polyline_interior_angles.Points)  # -> out, A, B, C; inputs check: list of Boolean, angle: list of Double, point: list of Point3d
# ---------- c_script_2: C# ----------
    if(check.Count != angle.Count) this.Component.AddRuntimeMessage(GH_RuntimeMessageLevel.Error, "WTF");

    List<int> outputCheck = new List<int>();
    List<int> outputCheck2 = new List<int>();

    List<Point3d> outputPt = new List<Point3d>();

    for (int i = 0; i < check.Count; i++)
    {
      if(check[i])
      {
        int next = i == check.Count - 1 ? 0 : i + 1;
        int prev = i == 0 ? check.Count - 1 : i - 1;
        int index = angle[i] < angle[next] ? 0 : 1;
        int index2 = angle[i] < angle[next] ? next : prev;
        outputCheck.Add(index);
        outputCheck2.Add(index2);
        if(index == 0) outputPt.Add(point[i]);
        else outputPt.Add(point[next]);
      }
    }

    A = outputCheck;
    B = outputPt;
    C = outputCheck2;
# ---------- end c_script_2 ----------

trim = TrimTree(Tree=group, Depth=1)
trim_2 = TrimTree(Tree=split.Positive, Depth=1)

cull = CullPattern(List=graft(geo_7), CullPattern=graft(c_script.A))
clean = CleanTree(RemoveNulls=True, RemoveInvalid=True, RemoveEmpty=True, Tree=simplify(cull))
tstat = TreeStatistics(Tree=clean)  # -> Paths, Length, Count

rev = ReverseList(List=trim_2)

merge = Merge(Data1=c_script.B, Data2=c_script.C)
item = ListItem(List=merge, Index=c_script_2.A, Wrap=True)  # -> Item, Item1

split_2 = SplitTree(Data=geo_10, Masks=flatten(tstat.Paths))  # -> Positive, Negative
trim_3 = TrimTree(Tree=split_2.Positive, Depth=1)

clean_2 = CleanTree(RemoveNulls=True, RemoveInvalid=True, RemoveEmpty=True, Tree=simplify(item.Item1))
debrep = DeconstructBrep(Brep=clean_2)  # -> Faces, Edges, Vertices

cull_2 = CullPattern(List=geo_10, CullPattern=graft(c_script.A))
clean_3 = CleanTree(RemoveNulls=True, RemoveInvalid=True, RemoveEmpty=True, Tree=simplify(cull_2))

clean_4 = CleanTree(RemoveNulls=True, RemoveInvalid=True, RemoveEmpty=True, Tree=simplify(c_script_2.A))
item_2 = ListItem(List=trim_3, Index=clean_4, Wrap=True)

area = Area(Geometry=debrep.Faces)  # -> Area, Centroid
cp = ClosestPoint(Point=item_2, Cloud=area.Centroid)  # -> ClosestPoint, CPIndex, Distance
cull_i = CullIndex(List=debrep.Faces, Indices=cp.CPIndex, Wrap=True)
item_3 = ListItem(List=debrep.Faces, Index=cp.CPIndex, Wrap=True)

item_4 = ListItem(List=clean_3, Index=cp.CPIndex, Wrap=True)
trim_4 = TrimTree(Tree=item_4, Depth=1)
clean_5 = CleanTree(RemoveNulls=True, RemoveInvalid=True, RemoveEmpty=True, Tree=simplify(trim_4))

geo_11 = Geometry(geo_8)
tstat_2 = TreeStatistics(Tree=trim_3)  # -> Paths, Length, Count
clean_6 = CleanTree(RemoveNulls=True, RemoveInvalid=True, RemoveEmpty=True, Tree=simplify(c_script_2.C))
split_3 = SplitTree(Data=geo_11, Masks=flatten(tstat_2.Paths))  # -> Positive, Negative
item_5 = ListItem(List=split_3.Positive, Index=clean_6, Wrap=True)
deplane = DeconstructPlane(Plane=item_5)  # -> Origin, XAxis, YAxis, ZAxis

c_script_3 = CSharpScript(x=deplane.XAxis, y=clean_4)  # -> out, A; inputs x: Vector3d, y: Int32
# ---------- c_script_3: C# ----------
    if(y == 1) A = x;
    else
    {
      x.Reverse();
      A = x;
    }
# ---------- end c_script_3 ----------
amp = Amplitude(Vector=c_script_3.A, Amplitude=Slider(5, range=0..10))
move = Move(Geometry=item_3, Motion=amp)  # -> Geometry, Transform
merge_2 = Merge(Data1=item_3, Data2=move.Geometry)
crv = Curve(merge_2)
loft = Loft(Curves=crv, Options={Adjust=False, Closed=False, LoftEnds=0, LoftSimp=0, LoftType=0, Rebuild=10, Refit=0.01})

merge_3 = Merge(Data1=simplify(loft), Data2=simplify(move.Geometry), Data3=simplify(cull_i))
join = BrepJoin(Breps=merge_3)  # -> Breps, Closed
fmerge = MergeFaces(Brep=join.Breps)  # -> Breps, Before, After

match = MatchTree(Tree=geo_6, Guide=c_script.A)  # -> graft(Tree)
split_4 = SplitTree(Data=match, Masks=flatten(tstat.Paths))  # -> Positive, Negative

sec = BrepPlane(Brep=fmerge.Breps, Plane=clean_5)  # -> Curves, Points
split_5 = SplitBrep(Brep=fmerge.Breps, Cutter=sec.Curves)
area_2 = Area(Geometry=split_5)  # -> Area, Centroid
sort = SortList(Keys=area_2.Area, ValuesA=split_5)  # -> Keys, ValuesA
item_6 = ListItem(List=sort.ValuesA, Index=0, Wrap=True)
cap = CapHoles(Brep=item_6)

sec_2 = BrepPlane(Brep=cap, Plane=split_4.Positive)  # -> Curves, Points
split_6 = SplitBrep(Brep=cap, Cutter=sec_2.Curves)
area_3 = Area(Geometry=split_6)  # -> Area, Centroid
sort_2 = SortList(Keys=area_3.Area, ValuesA=split_6)  # -> Keys, reverse(ValuesA)
item_7 = ListItem(List=sort_2.ValuesA, Index=0, Wrap=True)
cap_2 = CapHoles(Brep=item_7)  # -> simplify(Brep)

bbox = BoundingBox(Content=cap_2, Plane=item_5)  # -> Box, Box_2
split_7 = SplitTree(Data=D_2, Masks=flatten(tstat_2.Paths))  # -> Positive, Negative

clean_7 = CleanTree(RemoveNulls=True, RemoveInvalid=True, RemoveEmpty=True, Tree=simplify(c_script.D))
split_8 = SplitTree(Data=geo_7, Masks=flatten(tstat_2.Paths))  # -> Positive, Negative
replace = ReplaceItems(List=split_8.Positive, Item=cap_2, Indices=clean_6, Wrap=False)
cull_i_2 = CullIndex(List=replace, Indices=clean_7, Wrap=True)  # -> simplify(List)
merge_4 = Merge(Data1=cull_i_2, Data2=split_8.Negative)

match_2 = MatchTree(Tree=rev, Guide=merge_4)
split_9 = SplitTree(Data=simplify(match_2), Masks=flatten(tstat_2.Paths))  # -> Positive, Negative
cull_i_3 = CullIndex(List=split_9.Positive, Indices=clean_7, Wrap=True)  # -> simplify(List)
merge_5 = Merge(Data1=cull_i_3, Data2=split_9.Negative)

replace_2 = ReplaceItems(List=split_7.Positive, Item=bbox.Box, Indices=clean_6, Wrap=False)
cull_i_4 = CullIndex(List=replace_2, Indices=clean_7, Wrap=True)  # -> simplify(List)
merge_6 = Merge(Data1=cull_i_4, Data2=split_7.Negative)
R = ClusterOutput(merge_4)
R_2 = ClusterOutput(merge_5)
R_3 = ClusterOutput(merge_6)
P = ClusterOutput(tstat_2.Paths)
T = ClusterOutput(clean_7)

match_3 = MatchTree(Tree=trim, Guide=merge_4)
split_10 = SplitTree(Data=simplify(match_3), Masks=flatten(tstat_2.Paths))  # -> Positive, Negative

item_8 = ListItem(List=split_10.Positive, Index=clean_6, Wrap=True)
ungroup = Ungroup(Group=item_8)
geo_12 = Geometry(clean_5)
cp_2 = ClosestPoint(Point=geo_12, Cloud=ungroup)  # -> ClosestPoint, CPIndex, Distance
replace_3 = ReplaceItems(List=ungroup, Item=geo_12, Indices=cp_2.CPIndex, Wrap=False)
group_2 = Group(Objects=replace_3)  # -> simplify(Group)
replace_4 = ReplaceItems(List=split_10.Positive, Item=group_2, Indices=clean_6, Wrap=False)
cull_i_5 = CullIndex(List=replace_4, Indices=clean_7, Wrap=True)  # -> simplify(List)

merge_7 = Merge(Data1=cull_i_5, Data2=split_10.Negative)

ungroup_2 = Ungroup(Group=merge_7)
O = ClusterOutput(ungroup_2)

# ==== cluster Cluster_5
crv = ClusterInput()
pln = ClusterInput()
min_batten_width = ClusterInput()
crv_2 = Curve(crv)
pln_2 = Plane(pln)
deplane = DeconstructPlane(Plane=pln_2)  # -> Origin, XAxis, YAxis, ZAxis
pl = ConstructPlane(Origin=deplane.Origin, XAxis=deplane.XAxis, YAxis=deplane.ZAxis)
min_batten_width_2 = Number(min_batten_width)
project = Project(Geometry=crv_2, Plane=pl)  # -> Geometry, Transform
top_plate_thickness = ClusterInput()
brep = ClusterInput()
beam_depth = ClusterInput()
brep_2 = Brep(brep)
top_plate_thickness_2 = Number(top_plate_thickness)
beam_depth_2 = Number(beam_depth)
len = Length(Curve=project.Geometry)
smaller = SmallerThan(FirstNumber=len, SecondNumber=min_batten_width_2)  # -> SmallerThan, OrEqualTo
cull = CullPattern(List=project.Geometry, CullPattern=invert(smaller.SmallerThan))
cull_2 = CullPattern(List=pln_2, CullPattern=invert(smaller.SmallerThan))  # -> graft(List)
A = ClusterInput()
iedgeoffsetfactor = ClusterInput()
ispacing = ClusterInput()
deplane_2 = DeconstructPlane(Plane=cull_2)  # -> Origin, XAxis, YAxis, ZAxis
line = Line(cull)
division = Division(A=A, B=1000)
rot3d = Rotate3D(Geometry=cull_2, Angle=1.570796327, Center=deplane_2.Origin, Axis=deplane_2.XAxis)  # -> Geometry, Transform
multiplication = Multiplication(A=iedgeoffsetfactor, B=division)

c_script = CSharpScript(brep=brep_2, distance=multiplication, solid=Toggle(False), extend=Toggle(True))  # -> out, A; inputs brep: Brep, distance: Double, solid: Boolean, extend: Boolean
# ---------- c_script: C# ----------
    if (null != brep)
    {
      //double tol = RhinoDoc.ActiveDoc.ModelAbsoluteTolerance;
      Brep[] out_blends = null;
      Brep[] out_walls = null;
      Brep[] out_breps = Brep.CreateOffsetBrep(brep, distance, solid, extend, RhinoDoc.ActiveDoc.ModelAbsoluteTolerance, out out_blends, out out_walls);
      if (null != out_breps)
        A = out_breps;
      else
        this.Component.AddRuntimeMessage(GH_RuntimeMessageLevel.Error, "Failed");
    }
    else
      this.Component.AddRuntimeMessage(GH_RuntimeMessageLevel.Error, "Brep Null");
# ---------- end c_script ----------

c_script_2 = CSharpScript(iLine=graft(line), iSpacing=ispacing, iEdgeOffsetFactor=iedgeoffsetfactor, iDiameter=division)  # -> out, A, B; inputs iLine: Line, iSpacing: Double, iEdgeOffsetFactor: Double, iDiameter: Double
# ---------- c_script_2: C# ----------
    double count = Math.Floor(iLine.Length / iSpacing);
    double buffer = iDiameter * iEdgeOffsetFactor;
    double offsetDistance = iLine.Length - (count * iSpacing) - (buffer * 2);
    if(offsetDistance < 0)
    {
      count -= 1;
      offsetDistance = iLine.Length - (count * iSpacing) - (buffer * 2);
    }
    offsetDistance /= 2;
    Line newLine = new Line(iLine.PointAtLength(offsetDistance), iLine.PointAtLength(iLine.Length - offsetDistance));

    List<Point3d> pts = new List<Point3d>();
    for (int i = 0; i < count + 1; i++)
    {
      pts.Add(newLine.PointAtLength(i * iSpacing + buffer));
    }
    A = newLine;
    B = pts;
# ---------- end c_script_2 ----------
pl_2 = ConstructPlane(Origin=c_script_2.B, XAxis=deplane_2.XAxis, YAxis=deplane_2.ZAxis)
pl_origin = PlaneOrigin(Base=simplify(rot3d.Geometry), Origin=simplify(c_script_2.B))
B = ClusterInput()
addition = Addition(A=top_plate_thickness_2, B=beam_depth_2)
division_2 = Division(A=beam_depth_2, B=2)
L = ClusterInput()
lng = ListLength(List=line)
flippln = FlipPlane(Plane=pl_origin, FlipX=False, FlipY=False, FlipZ=True)  # -> Flipped, R
division_3 = Division(A=L, B=2)
subtraction = Subtraction(A=addition, B=B)  # -> simplify(Result)
division_4 = Division(A=L, B=2)
brepsinc = PointInBreps(Brep=flatten(c_script.A), Point=flippln.Flipped, Strict=True)  # -> Inside, Index
listdexs = ListIndices(List=flippln.Flipped)
dup = DuplicateData(Data=subtraction, Number=lng, Order=True)  # -> simplify(graft(Data))
dup_2 = DuplicateData(Data=division_2, Number=lng, Order=True)  # -> simplify(graft(Data))
cull_3 = CullPattern(List=flippln.Flipped, CullPattern=invert(brepsinc.Inside))
cull_4 = CullPattern(List=listdexs, CullPattern=invert(brepsinc.Inside))
pl_offset = PlaneOffset(BasePlane=cull_3, Offset=division_4)
c_script_3 = CSharpScript(
    x=pl_offset,
    y=cull_4,
    z=dup,
    u=dup_2,
    Reference=["C:\USERS\LASAT\APPDATA\ROAMING\GRASSHOPPER\LIBRARIES\ABXM.PLATESTRUCTURES\LCRL.Core.dll", "C:\USERS\LASAT\APPDATA\ROAMING\GRASSHOPPER\LIBRARIES\ABXM.PLATESTRUCTURES\ElementBase.dll"])  # -> out, A; inputs x: Plane, y: Int32, z: Double, u: Double
# ---------- c_script_3: C# usings ----------
using ABxM.PlateStructures.Development;
# ---------- c_script_3: C# ----------
    Screw screw = new Screw(y, x);
    screw.Length = u;
    screw.Diameter = z;
    A = screw;
# ---------- end c_script_3 ----------
cs = CreateScrews(BasePlane=pl_offset, ScrewIndex=cull_4, ScrewDiameter=division, ScrewLength=L, TopOffset=dup_2)
panel = Panel(c_script_3.A)
c_script_4 = CSharpScript(
    x=c_script_3.A,
    Reference=["C:\Users\Lasat\AppData\Roaming\Grasshopper\Libraries\ABxM.PlateStructures\LCRL.Core.dll", "C:\USERS\LASAT\APPDATA\ROAMING\GRASSHOPPER\LIBRARIES\ABXM.PLATESTRUCTURES\ElementBase.dll"])  # -> out, A, B, C, D
# ---------- c_script_4: C# ----------
    if(x != null)
    {
      Screw screw = x as Screw;
      Line ln = screw.PreviewLine;
      A = ln;
      B = screw.FrameBase;
      C = screw.ConnectedSegmentHeadPlane;
      D = screw.Centerline;
    }
# ---------- end c_script_4 ----------
geo = Geometry(c_script_4.D)
geo_2 = Geometry(c_script_4.B)
geo_3 = Geometry(c_script_4.A)
geo_4 = Geometry(c_script_4.C)
geo_5 = ClusterOutput(geo)
geo_6 = ClusterOutput(geo_2)
geo_7 = ClusterOutput(geo_4)
A_2 = ClusterOutput(c_script_3.A)

# ==== cluster Cluster_6
D = ClusterInput()
D_2 = ClusterInput()
lng = ListLength(List=D_2)
dup = DuplicateData(Data=D, Number=lng, Order=True)
tree = CreateTree(Data=flatten(D_2), Path=flatten(dup))
D_3 = ClusterOutput(tree)

# ==== cluster Cluster_14

offset_distance = Slider(0.003, range=0..0.01)
offset_shadow_gap = GetNumber(
    offset_distance,
    {"0.003"}, selected=[],
    AtLeast=1,
    AtMost=1,
    Maximum=1.797693135e+308,
    Minimum=-1.797693135e+308,
    Prompt="Shadaw Gap through offset of Plate",
    TreeAccess=False)

factor = Slider(1, range=0..1)
min_area_of_hole = Slider(0.1, range=0..1)
min_area_of_hole_2 = GetNumber(
    min_area_of_hole,
    AtLeast=1,
    AtMost=1,
    Maximum=1.797693135e+308,
    Minimum=-1.797693135e+308,
    Prompt="Cull areas small than",
    TreeAccess=False)
weight_of_holes = GetNumber(
    factor,
    AtLeast=1,
    AtMost=1,
    Maximum=1.797693135e+308,
    Minimum=-1.797693135e+308,
    Prompt="Weight of Hole Size (0 is none, 1 is full)",
    TreeAccess=False)

list = ValueList({"Z Height": 0, "Normal Angle": 1}, selected="Z Height")
hole_gradient_method = GetInteger(
    list,
    {"0"}, selected=[],
    AtLeast=1,
    AtMost=1,
    Maximum=2147483647,
    Minimum=-2147483648,
    Prompt="Z Height  = 0, Normal Angle = 1",
    TreeAccess=False)

clear_height = Slider(0, range=0..10)
offset_north_south_edge = GetNumber(
    Slider(3, range=0..100),
    AtLeast=1,
    AtMost=1,
    Maximum=1.797693135e+308,
    Minimum=-1.797693135e+308,
    Prompt="Offset from the Roof Edge",
    TreeAccess=False)
offset_clear_height = GetNumber(
    clear_height,
    AtLeast=1,
    AtMost=1,
    Maximum=1.797693135e+308,
    Minimum=-1.797693135e+308,
    Prompt="Height above ridge to be clear of holes",
    TreeAccess=False)

height_based_gradient_max_offset = GetNumber(
    Slider(0.6, range=0..1),
    AtLeast=1,
    AtMost=1,
    Maximum=1.797693135e+308,
    Minimum=-1.797693135e+308,
    Prompt="Max Offset from Boundary",
    TreeAccess=False)
height_based_gradient_min_offset = GetNumber(
    Slider(0.3, range=0..1),
    AtLeast=1,
    AtMost=1,
    Maximum=1.797693135e+308,
    Minimum=-1.797693135e+308,
    Prompt="Min Offset from Boundary",
    TreeAccess=False)

normal_angle_max_angle = GetInteger(
    Slider(45, range=0..100),
    AtLeast=1,
    AtMost=1,
    Maximum=2147483647,
    Minimum=-2147483648,
    Prompt="Remaps angles based on Max Angle",
    TreeAccess=False)

list_2 = ValueList({"Interpolate Hole": 0, "Filleted Hex": 1}, selected="Filleted Hex")
hex_fillet = Slider(0.15, range=0..1)
hole_type = GetInteger(
    list_2,
    AtLeast=1,
    AtMost=1,
    Maximum=2147483647,
    Minimum=-2147483648,
    Prompt="Interpolate Hole = 0, Filleted Hex     = 1",
    TreeAccess=False)
hex_fillet_2 = GetNumber(hex_fillet, AtLeast=1, AtMost=1, Maximum=1.797693135e+308, Minimum=-1.797693135e+308, TreeAccess=False)

beam_width = ClusterInput()

list_3 = ValueList({"Gradient": 0, "Constant": 1, "Structural": 2, "Struct/Grad": 3}, selected="Struct/Grad")
hole_gradient_method_2 = GetInteger(
    beam_width,
    {"0"}, selected=[],
    AtLeast=1,
    AtMost=1,
    Maximum=2147483647,
    Minimum=-2147483648,
    Prompt="Z Height  = 0, Normal Angle = 1",
    TreeAccess=False)
constant_offset = GetNumber(
    Slider(0.24, range=0..1),
    AtLeast=1,
    AtMost=1,
    Maximum=1.797693135e+308,
    Minimum=-1.797693135e+308,
    Prompt="Max Offset from Boundary",
    TreeAccess=False)

number_slider = Slider(0.0045, range=0.001..0.01)

number_slider_2 = Slider(0.0029, range=0.001..0.01)

# ----
# - Bottom Plate Holes -
crv = ClusterInput()
structural_offset = ClusterInput()
split = SplitTree(Data=structural_offset, Masks=flatten("{6,7;*}"))  # -> Positive, Negative
subtraction = Subtraction(A=split.Negative, B=number_slider_2)
subtraction_2 = Subtraction(A=split.Positive, B=number_slider)
crv_2 = Curve(Tree({0;0;0;0}: [], {0;0;1;0}: [], {0;0;2;0}: [], {0;1;0;0}: [], {0;1;1;0}: [], {0;1;2;0}: []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))
beam_width_2 = ClusterInput()

crv_3 = Curve(simplify(crv))

fabrication_offset = ClusterInput()
merge = Merge(Data1=simplify(subtraction_2), Data2=simplify(subtraction))
addition = Addition(A=beam_width_2, B=fabrication_offset)
num = Number(simplify(merge))
area = Area(Geometry=crv_3)  # -> Area, Centroid
tstat = TreeStatistics(Tree=crv_3)  # -> Paths, Length, Count
Z = UnitZ(Factor=-0.1)

tstat_2 = TreeStatistics(Tree=simplify(crv_3))  # -> Paths, Length, Count
tstat_3 = TreeStatistics(Tree=addition)  # -> Paths, Length, Count
tree = CreateTree(Data=flatten(addition), Path=tstat_3.Paths, Ensure=tstat_2.Paths)

area_2 = Area(Geometry=crv_2)  # -> Area, Centroid

tstat_4 = TreeStatistics(Tree=simplify(crv_3))  # -> Paths, Length, Count
tstat_5 = TreeStatistics(Tree=num)  # -> Paths, Length, Count
tree_2 = CreateTree(Data=flatten(num), Path=tstat_5.Paths, Ensure=tstat_4.Paths)

move = Move(Geometry=area.Centroid, Motion=Z)  # -> Geometry, Transform
clean = CleanTree(RemoveNulls=True, RemoveInvalid=True, RemoveEmpty=True, Tree=area_2.Area)
split_2 = SplitTree(Data=simplify(clean), Masks=flatten("{6,7;*}"))  # -> Positive, Negative
tag = TextTag(Location=flatten(move.Geometry), Text=tstat.Paths)

tstat_6 = TreeStatistics(Tree=crv_3)  # -> Paths, Length, Count
lng = ListLength(List=tstat_6.Paths)
larger = LargerThan(FirstNumber=lng, SecondNumber=1)  # -> LargerThan, OrEqualTo

ma = MassAddition(Input=flatten(split_2.Positive))  # -> Result, PartialResults
ma_2 = MassAddition(Input=flatten(split_2.Negative))  # -> Result, PartialResults
previewlw = CustomPreviewLineweights(Geometry=crv_2, Shader=ColourSwatch(SwatchColor=RGB(98, 255, 0)), Absolute=False)
panel = Panel(ma.Result)
panel_2 = Panel(ma_2.Result)
boundary = BoundarySurfaces(Edges=crv_3)

# ---- group: Shadow Gap of Bottom Plate
planar = Planar(Curve=crv_3)  # -> Planar, Plane, Deviation
polyoffset = PolylineOffset(
    Polylines=graft(crv_3),
    Distance=offset_shadow_gap,
    Plane=simplify(graft(planar.Plane)),
    Tolerance=0.001,
    ClosedFillet=1,
    OpenFillet=2,
    Miter=2)  # -> Contour, Holes
match = MatchTree(Tree=polyoffset.Holes, Guide=graft(crv_3))

# ----
cluster = Cluster_7(G=larger.LargerThan, _1=match)
area_3 = Area(Geometry=cluster)  # -> Area, Centroid
pdecon = Deconstruct(Point=area_3.Centroid)  # -> XComponent, YComponent, ZComponent
cluster_2 = Cluster_10(G=larger.LargerThan, _0=simplify(pdecon.ZComponent))
c_script = CSharpScript(x=cluster_2)  # -> Min, Max; inputs x: list of Double
# ---------- c_script: C# usings ----------
using System.Linq;
# ---------- c_script: C# ----------
    Max = x.Max();
    Min = x.Min();
# ---------- end c_script ----------
dom = ConstructDomain(DomainStart=c_script.Min, DomainEnd=c_script.Max)
cluster_3 = Cluster_11(G=larger.LargerThan, _0=simplify(dom), L=cluster_2)
remap = RemapNumbers(Value=pdecon.ZComponent, Source=cluster_3, Target=Domain(0, 1))  # -> Mapped, Clipped
cluster_4 = Cluster_10(G=larger.LargerThan, _0=simplify(remap.Mapped))
c_script_2 = CSharpScript(x=remap.Mapped)  # -> out, A; inputs x: Double
# ---------- c_script_2: C# ----------
    if(x == 0)
      A = 0;
    else A = 1 - x;
# ---------- end c_script_2 ----------
c_script_3 = CSharpScript(x=cluster_4)  # -> Min, Max; inputs x: list of Double; same code as c_script
dom_2 = ConstructDomain(DomainStart=height_based_gradient_min_offset, DomainEnd=height_based_gradient_max_offset)
dom_3 = ConstructDomain(DomainStart=c_script_3.Min, DomainEnd=c_script_3.Max)
remap_2 = RemapNumbers(Value=c_script_2.A, Source=dom_3, Target=dom_2)  # -> simplify(Mapped), Clipped

cluster_5 = Cluster_8(G=larger.LargerThan, _0=boundary)
brep_cp = BrepClosestPoint(Point=area_3.Centroid, Brep=cluster_5)  # -> Point, Normal, Distance
Z_2 = UnitZ(Factor=1)
dprod = DotProduct(VectorA=brep_cp.Normal, VectorB=Z_2, Unitize=False)
smaller = SmallerThan(FirstNumber=dprod, SecondNumber=0)  # -> SmallerThan, OrEqualTo
c_script_4 = CSharpScript(x=brep_cp.Normal, y=smaller.SmallerThan)  # -> out, A; inputs x: Vector3d, y: Boolean
# ---------- c_script_4: C# ----------
    if(y)
    {
      x.Reverse();
      double angle = Vector3d.VectorAngle(x, Vector3d.ZAxis);
      if(angle < 0) angle = 0;
      A = angle;
    }
    else
    {
      double angle = Vector3d.VectorAngle(x, Vector3d.ZAxis);
      if(angle < 0) angle = 0;
      A = angle;
    }
# ---------- end c_script_4 ----------
deg = Degrees(Radians=c_script_4.A)
c_script_5 = CSharpScript(x=deg, y=normal_angle_max_angle)  # -> out, A; inputs x: Double, y: Double
# ---------- c_script_5: C# ----------
    if(x > y) A = y;
    else A = x;
# ---------- end c_script_5 ----------
cluster_6 = Cluster_10(G=larger.LargerThan, _0=c_script_5.A)
c_script_6 = CSharpScript(x=cluster_6)  # -> Min, Max; inputs x: list of Double; same code as c_script
dom_4 = ConstructDomain(DomainStart=c_script_6.Min, DomainEnd=c_script_6.Max)
remap_3 = RemapNumbers(Value=c_script_5.A, Source=dom_4, Target=dom_2)  # -> Mapped, Clipped

pt = ConstructPoint(XCoordinate=0, YCoordinate=0, ZCoordinate=0)
boundary_2 = BoundarySurfaces(Edges=match)
evalsrf = EvaluateSurface(Surface=boundary_2, Point=pt)  # -> Point, Normal, UDirection, VDirection, Frame
pl = PlaneNormal(Origin=evalsrf.Point, ZAxis=evalsrf.Normal)

polyoffset_2 = PolylineOffset(
    Polylines=simplify(graft(match)),
    Distance=graft(tree_2),
    Plane=simplify(graft(pl)),
    Tolerance=0.001,
    ClosedFillet=2,
    OpenFillet=1,
    Miter=2)  # -> Contour, simplify(Holes)

join = BrepJoin(Breps=flatten(boundary))  # -> Breps, Closed
edges = BrepEdges(Brep=join.Breps)  # -> Naked, Interior, NonManifold
join_2 = JoinCurves(Curves=edges.Naked, Preserve=False)
len = Length(Curve=join_2)
sort = SortList(Keys=len, ValuesA=join_2)  # -> Keys, reverse(ValuesA)
item = ListItem(List=sort.ValuesA, Index=0, Wrap=True)
disc = Discontinuity(Curve=item, Level=1)  # -> Points, Parameters
c_script_7 = CSharpScript(x=disc.Points, y=offset_north_south_edge, z=offset_clear_height)  # -> yMin, yMax, zMin; inputs x: list of Point3d, y: Double, z: Double
# ---------- c_script_7: C# ----------
    List<double> yVal = x.Select(o => o.Y).ToList();
    List<double> zVal = x.Select(o => o.Z).ToList();
    yMax = yVal.Max() - y;
    yMin = yVal.Min() + y;
    zMin = zVal.Min() + z;
# ---------- end c_script_7 ----------

filter = StreamFilter(Gate=hole_gradient_method, Stream0=remap_2.Mapped, Stream1=remap_3.Mapped)
multiplication = Multiplication(A=filter, B=weight_of_holes)
c_script_8 = CSharpScript(u=multiplication, x=area_3.Centroid, yMin=c_script_7.yMin, yMax=c_script_7.yMax, zMin=c_script_7.zMin)  # -> out, simplify(A); inputs x: Point3d, yMin: Double, yMax: Double, zMin: Double
# ---------- c_script_8: C# ----------
    if(x.Z > zMin && x.Y < yMax && x.Y > yMin) A = u;
    else A = 0;
# ---------- end c_script_8 ----------

md_slider = MDSlider(
    SliderMode=0,
    slider_value=Point(0.4847358452, 0.5509033203, 0.5),
    x_domain=Domain(0, 1),
    y_domain=Domain(0, 1),
    z_domain=Domain(0, 1))
number_slider_3 = Slider(0.6694, range=0.1..0.8)
number_slider_4 = Slider(0.3035, range=0.3..0.7)
number_slider_5 = Slider(0.6159, range=0.4..0.7)
number_slider_6 = Slider(0.401, range=0.4..0.7)
md_slider_2 = MDSlider(
    SliderMode=0,
    slider_value=Point(0.5482513092, 0.6442990187, 0.5),
    x_domain=Domain(0, 1),
    y_domain=Domain(0, 1),
    z_domain=Domain(0, 1))

area_4 = Area(Geometry=match)  # -> Area, Centroid
match_2 = MatchTree(Tree=c_script_8.A, Guide=multiplication)
cp = ClosestPoint(Point=area_4.Centroid, Cloud=area_3.Centroid)  # -> ClosestPoint, CPIndex, Distance
item_2 = ListItem(List=match_2, Index=cp.CPIndex, Wrap=True)

pt_2 = ConstructPoint(XCoordinate=number_slider_5, YCoordinate=number_slider_3, ZCoordinate=0)
pt_3 = ConstructPoint(XCoordinate=number_slider_6, YCoordinate=number_slider_4, ZCoordinate=0)
filter_2 = StreamFilter(Gate=Toggle(False), Stream0=pt_2, Stream1=md_slider_2)
filter_3 = StreamFilter(Gate=Toggle(False), Stream0=pt_3, Stream1=md_slider)
pdecon_2 = Deconstruct(Point=filter_2)  # -> XComponent, YComponent, ZComponent
pdecon_3 = Deconstruct(Point=filter_3)  # -> XComponent, YComponent, ZComponent
number_slider_7 = Slider(0.1, range=0..0.1)
c_script_9 = CSharpScript(x=item_2, y=constant_offset)  # -> out, A; inputs x: Double, y: Double
# ---------- c_script_9: C# ----------
    if(x == 0) A = x;
    else A = y;
# ---------- end c_script_9 ----------
graph = GraphMapper(
    c_script_9.A,
    x0=0,
    x1=1,
    y0=0,
    y1=1,
    container_name="Bezier",
    cpx=[0, 0.3851548433, 0.75, 1],
    cpy=[0, 0.09435856342, 0.75, 1])
graph_2 = GraphMapper(item_2, x0=0, x1=1, y0=0, y1=1, container_name="Bezier", cpx=[0, 0.3851548433, 0.75, 1], cpy=[0, 0.09435856342, 0.75, 1])
c_script_10 = CSharpScript(x=graph_2, y=tree)  # -> out, A; inputs x: Double, y: Double
# ---------- c_script_10: C# ----------
    if(x> 0  && y > 0)
    {
      if( y > x) A = y;
      else A = x;
    }
# ---------- end c_script_10 ----------
split_3 = SplitTree(Data=c_script_10.A, Masks=flatten("{6,7;*}"))  # -> Positive, Negative
cluster_7 = Cluster_12(X=pdecon_2.XComponent, Y=pdecon_2.YComponent, X_2=split_3.Negative)
cluster_8 = Cluster_12(X=pdecon_3.XComponent, Y=pdecon_3.YComponent, X_2=split_3.Positive)
panel_3 = Panel(cluster_8)
genes = GenePool(
    Decimals=4,
    Maximum=0.8,
    Minimum=0.4,
    Value=[0.665742, 0.65892, 0.663244, 0.659726, 0.658435, 0.663277, 0.663978, 0.539541, 0.660237, 0.665176, 0.539847, 0.53595, 0.545603, 0.538125])
trim = TrimTree(Tree=split_3.Positive, Depth=1)
trim_2 = TrimTree(Tree=split_3.Negative, Depth=1)
graph_3 = GraphMapper(trim, x0=0, x1=1, y0=0, y1=1, Cx=0.5044915676, Cy=0.4825386405, container_name="Conic")
graph_4 = GraphMapper(trim_2, x0=0, x1=1, y0=0, y1=1, Cx=0.4831001759, Cy=0.6187028885, container_name="Conic")
merge_2 = Merge(Data1=cluster_8, Data2=simplify(cluster_7))
graft = GraftTree(Tree=graph_4, IncludeEmptyLists=True, IncludeNullItems=True)
graft_2 = GraftTree(Tree=graph_3, IncludeEmptyLists=True, IncludeNullItems=True)
match_3 = MatchTree(Tree=graft_2, Guide=split_3.Positive)
match_4 = MatchTree(Tree=graft, Guide=split_3.Negative)
cluster_9 = Cluster_13(L=genes, D=c_script_10.A)
merge_3 = Merge(Data1=match_3, Data2=match_4)
clean_2 = CleanTree(RemoveNulls=True, RemoveInvalid=True, RemoveEmpty=False, Tree=merge_3)
filter_4 = StreamFilter(Gate=Toggle(True), Stream0=clean_2, Stream1=merge_2)
match_5 = MatchTree(Tree=filter_4, Guide=c_script_10.A)
movopossum_3_0_0 = Opossum(
    OpossumData_OptimizationType=2,
    OpossumData_ResultSerializationStatus=0,
    OpossumData_objective=num_4,
    OpossumData_variable=[genes, number_slider])
c_script_11 = CSharpScript(x=match_5, y=tree)  # -> out, A; inputs x: Double, y: Double; same code as c_script_10

hall_acoustic_area_min = Slider(590, range=0..1000)
office_acoustic_area_min = Slider(188, range=0..1000)

filter_5 = StreamFilter(Gate=hole_gradient_method_2, Stream0=graph_2, Stream1=graph, Stream2=tree, Stream3=c_script_11.A)

tstat_7 = TreeStatistics(Tree=num)  # -> Paths, Length, Count
split_4 = SplitTree(Data=filter_5, Masks=flatten(tstat_7.Paths))  # -> Positive, Negative
split_5 = SplitTree(Data=num, Masks=flatten(tstat_7.Paths))  # -> Positive, Negative
max = Maximum(A=split_4.Positive, B=split_5.Positive)
merge_4 = Merge(Data1=max, Data2=split_4.Negative)

movopossum_3_0_0_2 = Opossum(
    OpossumData_OptimizationType=2,
    OpossumData_ResultSerializationStatus=0,
    OpossumData_objective=num_2,
    OpossumData_variable=[number_slider_4, number_slider_6, number_slider_8])
movopossum_3_0_0_3 = Opossum(
    OpossumData_OptimizationType=0,
    OpossumData_ResultSerializationStatus=0,
    OpossumData_objective=num_3,
    OpossumData_variable=[number_slider_3, number_slider_5, number_slider_2])
shell_7_swap = ClusterInput()
filter_6 = StreamFilter(Gate=shell_7_swap, Stream0="{*}", Stream1="{1;15,16,17,18,19}")
split_6 = SplitTree(Data=c_script_10.A, Masks=flatten(filter_6))  # -> Positive, Negative
split_7 = SplitTree(Data=merge_4, Masks=flatten(filter_6))  # -> Positive, Negative
merge_5 = Merge(Data1=split_6.Positive, Data2=split_7.Positive)
avr = Average(Input=merge_5)
merge_6 = Merge(Data1=avr, Data2=split_7.Negative)

M = ClusterInput()
split_8 = SplitTree(Data=merge_6, Masks=flatten(M))  # -> Positive, Negative
c_script_12 = CSharpScript(x=split_8.Positive, y=constant_offset)  # -> out, A
# ---------- c_script_12: C# ----------
    A = y;
# ---------- end c_script_12 ----------
merge_7 = Merge(Data1=c_script_12.A, Data2=split_8.Negative)

split_9 = SplitTree(Data=tree, Masks=flatten(M))  # -> Positive, Negative
c_script_13 = CSharpScript(x=split_9.Positive, y=constant_offset)  # -> out, A; same code as c_script_12
merge_8 = Merge(Data1=c_script_13.A, Data2=split_9.Negative)
polyoffset_3 = PolylineOffset(
    Polylines=simplify(graft(match)),
    Distance=graft(merge_8),
    Plane=simplify(graft(pl)),
    Tolerance=0.001,
    ClosedFillet=2,
    OpenFillet=1,
    Miter=2)  # -> Contour, simplify(Holes); disabled
filter_7 = StreamFilter(Gate=Toggle(True), Stream0=polyoffset_3.Holes, Stream1=polyoffset_2.Holes)
crv_4 = Curve(filter_7)  # disabled
area_5 = Area(Geometry=polyoffset_3.Holes)  # -> Area, Centroid

number_slider_8 = Slider(-0.0142, range=-0.015..0.005)
office_extra_acoustic_area = ClusterInput()  # Office Extra Acoustic Area
split_10 = SplitTree(Data=simplify(merge_7), Masks=flatten(office_extra_acoustic_area))  # -> Positive, Negative
addition_2 = Addition(A=split_10.Positive, B=number_slider_8)
merge_9 = Merge(Data1=simplify(split_10.Negative), Data2=addition_2)

polyoffset_4 = PolylineOffset(
    Polylines=simplify(graft(match)),
    Distance=graft(merge_9),
    Plane=simplify(graft(pl)),
    Tolerance=0.001,
    ClosedFillet=2,
    OpenFillet=1,
    Miter=2)  # -> Contour, simplify(Holes)
crv_5 = Curve(polyoffset_4.Holes)
area_6 = Area(Geometry=crv_5)  # -> Area, Centroid
smaller_2 = SmallerThan(FirstNumber=area_5.Area, SecondNumber=area_6.Area)  # -> SmallerThan, OrEqualTo
c_script_14 = CSharpScript(
    x=smaller_2.SmallerThan,
    y=ColourSwatch(SwatchColor=RGBA(25, 97, 207, 43)),
    z=ColourSwatch(SwatchColor=RGBA(235, 19, 19, 90)))  # -> out, A; inputs x: Boolean
# ---------- c_script_14: C# ----------
    if(!x) A = y;
    else A = z;
# ---------- end c_script_14 ----------
x = ClusterInput()
M_2 = ClusterInput()
crvprox = CurveProximity()  # -> PointA, PointB, Distance

smoothpline = SmoothPolyline(Polyline=crv_4, Strength=0.25, Times=1)  # disabled
disc_2 = Discontinuity(Curve=crv_4, Level=1)  # -> simplify(Points), Parameters; disabled
cluster_10 = Cluster_9(I=disc_2.Points)  # -> B, B_2; disabled
pline = PolyLine(Vertices=cluster_10.B, Closed=True)  # disabled
intcrv = Interpolate(Vertices=cluster_10.B, Degree=3, Periodic=True, KnotStyle=2)  # -> Curve, Length, Domain; disabled

disc_3 = Discontinuity(Curve=pline, Level=1)  # -> Points, Parameters
cullpt = CullDuplicates(Points=disc_3.Points, Tolerance=Slider(0.05, range=0..0.1), CullMode=3)  # -> Points, Indices, Valence
pline_2 = PolyLine(Vertices=cullpt.Points, Closed=True)  # disabled

fillet = FilletDistance(Curve=pline_2, Distance=hex_fillet_2)  # disabled

filter_8 = StreamFilter(Gate=hole_type, Stream0=intcrv.Curve, Stream1=fillet)  # disabled
merge_10 = Merge(Data1=simplify(filter_8), Data2=simplify(cluster_10.B_2))  # -> simplify(Result); disabled
area_7 = Area(Geometry=merge_10)  # -> Area, Centroid; disabled
smaller_3 = SmallerThan(FirstNumber=area_7.Area, SecondNumber=min_area_of_hole_2)  # -> SmallerThan, OrEqualTo; disabled
cull = CullPattern(List=merge_10, CullPattern=invert(smaller_3.SmallerThan))  # disabled
clean_3 = CleanTree(RemoveNulls=True, RemoveInvalid=True, RemoveEmpty=False, Tree=cull)  # disabled

merge_11 = Merge(Data1=simplify(clean_3), Data2=simplify(crv_2))  # -> simplify(Result)
clean_4 = CleanTree(RemoveNulls=True, RemoveInvalid=True, RemoveEmpty=True, Tree=merge_11)
alicrvseams = AlignCurveSeams(Curves=clean_4, Snap=False, Iterative=True)  # -> Aligned, Points, R
loft = Loft(
    Curves=alicrvseams.Aligned,
    Options={Adjust=False, Closed=False, LoftEnds=0, LoftSimp=0, LoftType=0, Rebuild=10, Refit=0.01})  # -> flatten(Loft); disabled
preview = CustomPreview(Geometry=loft, Material=ColourSwatch(SwatchColor=RGB(255, 0, 0)))
boundary_3 = BoundarySurfaces(Edges=clean_3)
preview_2 = CustomPreview(Geometry=boundary_3, Material=c_script_14.A)

area_8 = Area(Geometry=match)  # -> Area, Centroid
Z_3 = UnitZ(Factor=0.1)
move_2 = Move(Geometry=area_8.Centroid, Motion=expr("2*x", Z_3))  # -> Geometry, Transform
move_3 = Move(Geometry=area_8.Centroid, Motion=Z_3)  # -> Geometry, Transform
tag_2 = TextTag(Location=area_8.Centroid, Text=addition, Colour=RGB(157, 0, 255))
tag_3 = TextTag(Location=move_3.Geometry, Text=merge_4, Colour=RGB(22, 72, 222))

smoothpline_2 = SmoothPolyline(Polyline=crv_5, Strength=0.25, Times=1)
disc_4 = Discontinuity(Curve=crv_5, Level=1)  # -> simplify(Points), Parameters
cluster_11 = Cluster_9(I=disc_4.Points)  # -> B, B_2
pline_3 = PolyLine(Vertices=cluster_11.B, Closed=True)
intcrv_2 = Interpolate(Vertices=cluster_11.B, Degree=3, Periodic=True, KnotStyle=2)  # -> Curve, Length, Domain

disc_5 = Discontinuity(Curve=pline_3, Level=1)  # -> Points, Parameters
cullpt_2 = CullDuplicates(Points=disc_5.Points, Tolerance=Slider(0.05, range=0..0.1), CullMode=3)  # -> Points, Indices, Valence
pline_4 = PolyLine(Vertices=cullpt_2.Points, Closed=True)

fillet_2 = FilletDistance(Curve=pline_4, Distance=hex_fillet_2)

filter_9 = StreamFilter(Gate=hole_type, Stream0=intcrv_2.Curve, Stream1=fillet_2)
merge_12 = Merge(Data1=simplify(filter_9), Data2=simplify(cluster_11.B_2))  # -> simplify(Result)
area_9 = Area(Geometry=merge_12)  # -> Area, Centroid
smaller_4 = SmallerThan(FirstNumber=area_9.Area, SecondNumber=min_area_of_hole_2)  # -> SmallerThan, OrEqualTo
cull_2 = CullPattern(List=merge_12, CullPattern=invert(smaller_4.SmallerThan))
clean_5 = CleanTree(RemoveNulls=True, RemoveInvalid=True, RemoveEmpty=False, Tree=cull_2)

split_11 = SplitTree(Data=clean_5, Masks=flatten(M_2))  # -> Positive, Negative
c_script_15 = CSharpScript(X=split_11.Positive)  # -> Out, A
merge_13 = Merge(Data1=c_script_15.A, Data2=split_11.Negative)
clean_6 = CleanTree(RemoveNulls=True, RemoveInvalid=True, RemoveEmpty=False, Tree=merge_13)

c_script_16 = CSharpScript(x=clean_6, y=clean_5)  # -> out, A; inputs x: tree, y: tree
# ---------- c_script_16: C# ----------
    if(x.DataCount == 0) A = y;
    else A = x;
# ---------- end c_script_16 ----------

c_script_17 = CSharpScript(x=simplify(x))  # -> out, A; inputs x: String
# ---------- c_script_17: C# ----------
    if(x != null || x != "")
    {
      if(x.Contains("solid")) A = true;
      else A = false;
    }
    else A = false;
# ---------- end c_script_17 ----------
cull_3 = CullPattern(List=c_script_16.A, CullPattern=invert(graft(c_script_17.A)))  # -> simplify(List)

# ---- group: RH_OUT:Holes
crv_6 = Curve(cull_3)

# ----
split_12 = SplitTree(Data=crv_6, Masks=flatten("{6,7;*}"))  # -> Positive, Negative
area_10 = Area(Geometry=split_12.Positive)  # -> flatten(Area), Centroid
area_11 = Area(Geometry=split_12.Negative)  # -> flatten(Area), Centroid
ma_3 = MassAddition(Input=area_10.Area)  # -> Result, PartialResults
panel_4 = Panel(ma_3.Result)
subtraction_3 = Subtraction(A=office_acoustic_area_min, B=panel_4)
c_script_18 = CSharpScript(x=subtraction_3)  # -> out, A; inputs x: Double
# ---------- c_script_18: C# ----------
    if(x < 0) A = x * 2;
    else A = x;
# ---------- end c_script_18 ----------
abs = Absolute(Value=subtraction_3)
num_2 = Number(abs)
ma_4 = MassAddition(Input=area_11.Area)  # -> Result, PartialResults
panel_5 = Panel(ma_4.Result)
subtraction_4 = Subtraction(A=hall_acoustic_area_min, B=panel_5)
c_script_19 = CSharpScript(x=subtraction_4)  # -> out, A; inputs x: Double
# ---------- c_script_19: C# ----------
    if(x > 0) A = x * 2;
    else A = x;
# ---------- end c_script_19 ----------
abs_2 = Absolute(Value=c_script_19.A)
num_3 = Number(abs_2)
addition_3 = Addition(A=num_3, B=num_2)
num_4 = Number(addition_3)

swatch = ColourSwatch(SwatchColor=RGB(0, 255, 13))
previewlw_2 = CustomPreviewLineweights(Geometry=crv_6, Shader=swatch, Absolute=False)

tag_4 = TextTag(Location=move_2.Geometry, Text=merge_9, Colour=swatch)

pframe = PerpFrame(Curve=crv_6, Parameter=0.5)
L = ClusterOutput(cull_3)
crv_cp = CurveClosestPoint(Point=pframe, Curve=crv_3)  # -> Point, Parameter, Distance
ln = Line(StartPoint=crv_cp.Point, EndPoint=pframe)
polyboolean = PolylineBoolean(
    A=simplify(graft(match)),
    B=cull_3,
    BooleanType=2,
    Plane=simplify(Plane(origin=(0, 0, 0), x=(0, 0, 0), y=(0, 0, 0))),
    Tolerance=0.001,
    EvenOdd=True)  # -> simplify(Result); disabled
c_script_20 = CSharpScript(x=x, y=cull_3)  # -> out, simplify(A); inputs x: String
# ---------- c_script_20: C# ----------
    if(x.Contains("hollow"))
    {
      if(y == null)
      {
        if(!x.Contains("closed"))
        {
          if(!x.Contains("open"))
            A = x.Replace("hollow", "hollow_closed");
          else
            A = x.Replace("hollow_open", "hollow_closed");
        }
        else
          A = x;
      }
      else
      {

        if(!x.Contains("open"))
        {
          if(!x.Contains("closed"))
            A = x.Replace("hollow", "hollow_open");
          else
            A = x.Replace("hollow_closed", "hollow_open");
        }
        else
          A = x;
      }
    }
    else
    {
      A = x;
    }
# ---------- end c_script_20 ----------
boundary_4 = BoundarySurfaces(Edges=polyboolean)  # disabled
A = ClusterOutput(c_script_20.A)
linedim = LineDimension(Line=ln, Text="{0:0.00}", Size=0.3)
sort_val = SortDuplicateValues(ValueList=flatten(c_script_20.A))  # -> UniqueValues, Indices
R = ClusterOutput(polyboolean)  # disabled
panel_6 = Panel(cull_3)

# ==== cluster Cluster_15
D = ClusterInput()
M = ClusterInput()
I = ClusterInput()
split = SplitTree(Data=D, Masks=flatten(M))  # -> Positive, Negative
cull_i = CullIndex(List=split.Positive, Indices=I, Wrap=True)
merge = Merge(Data1=cull_i, Data2=split.Negative)
R = ClusterOutput(merge)

# ==== cluster Cluster_16
L = ClusterInput()
split = SplitList(List=L, Index=2)  # -> ListA, ListB
area = Area(Geometry=split.ListA)  # -> Area, Centroid
pdecon = Deconstruct(Point=area.Centroid)  # -> XComponent, YComponent, ZComponent
sort = SortList(Keys=pdecon.ZComponent, ValuesA=split.ListA)  # -> Keys, reverse(ValuesA)
item = ListItem(List=sort.ValuesA, Index=0, Wrap=True)
edges = BrepEdges(Brep=item)  # -> Naked, Interior, NonManifold
crv = Curve(edges.Naked)
join = JoinCurves(Curves=crv, Preserve=False)  # -> simplify(Curves)
area_2 = Area(Geometry=join)  # -> Area, Centroid
pln = ClusterInput()
sort_2 = SortList(Keys=area_2.Area, ValuesA=join)  # -> Keys, reverse(ValuesA)
M = ClusterInput()
pln_2 = Plane(pln)
split_2 = SplitTree(Data=simplify(pln_2), Masks=flatten(M))  # -> Positive, Negative
item_2 = ListItem(List=sort_2.ValuesA, Index=0, Wrap=True)
area_3 = Area(Geometry=item_2)  # -> Area, Centroid
unify_polylines = UnifyPolylines(Polylines=item_2, Direction=True)
split_3 = SplitList(List=sort_2.ValuesA, Index=1)  # -> ListA, ListB
pl_origin = PlaneOrigin(Base=split_2.Positive, Origin=area_3.Centroid)
boundary = BoundarySurfaces(Edges=split_3.ListB)
P = ClusterOutput(unify_polylines)
c_script = CSharpScript(x=pl_origin)  # -> out, A; inputs x: Plane
# ---------- c_script: C# ----------
    if(Vector3d.Multiply(x.ZAxis,Vector3d.ZAxis) < 0)
      A = new Plane(x.Origin, x.XAxis, -1*x.YAxis);
    else 
      A = x;
# ---------- end c_script ----------
offsrf = OffsetSurface(Surface=boundary, Distance=1, BothSides=-1, CreateSolid=True)  # -> simplify(Offset)
rotate = Rotate(Geometry=c_script.A, Angle=1.570796327, Plane=c_script.A)  # -> Geometry, Transform
brec = BoundingRectangle(Geometry=unify_polylines, Plane=rotate.Geometry, Axis=0, Slide=0, Union=True)  # -> Bounding, DimensionX, DimensionY
clean = CleanTree(RemoveNulls=True, RemoveInvalid=True, RemoveEmpty=True, Tree=offsrf)
trim = TrimTree(Tree=clean, Depth=1)
B = ClusterOutput(brec.Bounding)
Y = ClusterOutput(brec.DimensionY)
T = ClusterOutput(trim)

# ==== cluster Cluster_17
data = ClusterInput()
data_2 = ClusterInput()
D = ClusterInput()
data_3 = Data(data)
data_4 = Data(data_2)
panel = Panel(data_4)
split = SplitTree(Data=D, Masks=flatten(data_3))  # -> Positive, Negative
split_2 = SplitTree(Data=data_4, Masks=flatten(data_3))  # -> Positive, Negative
merge = Merge(Data1=split.Positive, Data2=split_2.Negative)
G = ClusterInput()
filter = StreamFilter(Gate=G, Stream0=data_4, Stream1=merge)
s_1 = ClusterOutput(filter)

# ==== cluster Cluster_18
geo = ClusterInput()
geo_2 = ClusterInput()
geo_3 = Geometry(geo)
geo_4 = Geometry(geo_2)
clean = CleanTree(RemoveNulls=True, RemoveInvalid=True, RemoveEmpty=False, Tree=geo_3)  # -> simplify(Tree)
tstat = TreeStatistics(Tree=clean)  # -> Paths, Length, Count
split = SplitTree(Data=simplify(geo_4), Masks=flatten(tstat.Paths))  # -> Positive, Negative
pt = Point(split.Positive)
avr = Average(Input=pt)
plfit = PlaneFit(Points=pt)  # -> Plane, Deviation
geo_5 = Geometry(clean)
pl_origin = PlaneOrigin(Base=plfit.Plane, Origin=avr)
area = Area(Geometry=geo_5)  # -> Area, Centroid
bbox = BoundingBox(Content=geo_5, Plane=pl_origin)  # -> Box, Box_2
debox = DeconstructBox(Box=bbox.Box_2)  # -> Plane, X, Y, Z
num = Number(debox.Z)
roundd = RoundToDecimalPlace(NumberX=num, DecimalPlace=4, RoundType=0)  # -> Rounded, Difference
sort_val = SortDuplicateValues(ValueList=flatten(roundd.Rounded))  # -> UniqueValues, Indices
item = ListItem(List=flatten(geo_5), Index=sort_val.Indices, Wrap=True)
item_2 = ListItem(List=flatten(area.Centroid), Index=sort_val.Indices, Wrap=True)
unique = ClusterOutput(sort_val.UniqueValues)
randcol = RandomColor(Data=sort_val.UniqueValues, Seed=2, FastMode=False)  # -> graft(Colors)
i = ClusterOutput(item)
i_2 = ClusterOutput(item_2)
C = ClusterOutput(randcol)

# ==== cluster Cluster_19
L = ClusterInput()
A = ClusterInput()

dso = DeconstructSpeckleObject(SpeckleObject=L, selectedKitName="Objects")  # -> FrameBase, Geo, Name, OffsetNegative, OffsetPositive, Type
geo = Geometry(flatten(dso.Geo))
clash = Clash(FirstSet=A, SecondSet=geo, Distance=0, L=100)  # -> ClashCount, ClashPoints, ClashRadii, FirstIndex, simplify(SecondIndex)
item = ListItem(List=L, Index=clash.SecondIndex, Wrap=True)

match = MatchTree(Tree=item, Guide=A)

clean = CleanTree(RemoveNulls=True, RemoveInvalid=True, RemoveEmpty=True, Tree=match)
tstat = TreeStatistics(Tree=clean)  # -> Paths, Length, Count
split = SplitTree(Data=match, Masks=flatten(tstat.Paths))  # -> Positive, Negative

P = ClusterOutput(split.Positive)

# ==== cluster Cluster_20
T = ClusterInput()
lng = ListLength(List=flatten(T))
clean = CleanTree(RemoveNulls=True, RemoveInvalid=True, RemoveEmpty=False, Tree=T)
lng_2 = ListLength(List=flatten(clean))
c_script = CSharpScript(x=lng_2, y=lng)  # -> out, A; inputs x: Int32, y: Int32
# ---------- c_script: C# ----------
    if(Math.Abs((x - y)) != 0)  {A = "ERROR";this.Component.AddRuntimeMessage(GH_RuntimeMessageLevel.Error, "ERROR");}
    else A = "PASS";
# ---------- end c_script ----------
A = ClusterOutput(c_script.A)

# ==== cluster Cluster_21
_0 = ClusterInput()
_1 = ClusterInput()
weave = Weave(Pattern=[0, 1], Stream0=_0, Stream1=_1, NullGaps=False)
A = ClusterInput()
ppx = PlanePlane(PlaneA=A, PlaneB=weave)
midpt = CurveMiddle(Curve=ppx)  # disabled
shift = ShiftList(List=ppx, Shift=1, Wrap=True)  # -> simplify(List)
llx = LineLine(Line1=ppx, Line2=shift)  # -> ParamA, ParamB, PointA, PointB
points = PointList(Points=midpt, Size=0.2)  # disabled
pline = PolyLine(Vertices=llx.PointA, Closed=True)
explode = Explode(Curve=pline, Recursive=True)  # -> Segments, Vertices
len = Length(Curve=explode.Segments)
smaller = SmallerThan(FirstNumber=len, SecondNumber=0.1)  # -> SmallerThan, OrEqualTo
cull = CullPattern(List=explode.Segments, CullPattern=invert(smaller.SmallerThan))
shift_2 = ShiftList(List=cull, Shift=1, Wrap=True)  # -> simplify(List)
llx_2 = LineLine(Line1=cull, Line2=shift_2)  # -> ParamA, ParamB, PointA, PointB
pline_2 = PolyLine(Vertices=llx_2.PointA, Closed=True)
pl = ClusterOutput(pline_2)

# ==== cluster Cluster_22
B = ClusterInput()
L = ClusterInput()
geo = ClusterInput()
debrep = DeconstructBrep(Brep=B)  # -> Faces, Edges, Vertices
lng = ListLength(List=B)
item = ListItem(List=L, Index=0, Wrap=True)
geo_2 = Geometry(geo)
area = Area(Geometry=debrep.Faces)  # -> Area, Centroid
dup = DuplicateData(Data=geo_2, Number=lng, Order=True)  # -> simplify(graft(Data))
cp = PlaneClosestPoint(Point=area.Centroid, Plane=dup)  # -> Point, UVPoint, Distance
sort = SortList(Keys=cp.Distance, ValuesA=debrep.Faces)  # -> Keys, reverse(ValuesA)
item_2 = ListItem(List=sort.ValuesA, Index=[0, -1], Wrap=True)
area_2 = Area(Geometry=item_2)  # -> Area, Centroid
pdecon = Deconstruct(Point=area_2.Centroid)  # -> XComponent, YComponent, ZComponent
sort_2 = SortList(Keys=pdecon.ZComponent, ValuesA=item_2)  # -> Keys, ValuesA
alicrvseams = AlignCurveSeams(Curves=sort_2.ValuesA, Guide=item, Snap=False, Iterative=True)  # -> Aligned, Points, R
item_3 = ListItem(List=alicrvseams.Aligned, Index=0, Wrap=True)  # -> Item, Item1
i = ClusterOutput(item_3.Item)
item_1 = ClusterOutput(item_3.Item1)

# ==== cluster Cluster_23
D = ClusterInput()
d1 = ClusterInput()
d2 = ClusterInput()
D_2 = ClusterInput()

split = SplitTree(Data=D, Masks=flatten("{6;*}"))  # -> Positive, Negative
merge = Merge(Data1=simplify(d1), Data2=simplify(d2))
clean = CleanTree(RemoveNulls=True, RemoveInvalid=True, RemoveEmpty=True, Tree=merge)
cullpt = CullDuplicates(Points=clean, Tolerance=0.001, CullMode=1)  # -> simplify(Points), Indices, Valence
tstat = TreeStatistics(Tree=cullpt.Points)  # -> Paths, Length, Count
split_2 = SplitTree(Data=simplify(graft(D_2)), Masks=flatten(tstat.Paths))  # -> Positive, Negative

N = ClusterOutput(split.Negative)

debrep = DeconstructBrep(Brep=split_2.Positive)  # -> Faces, Edges, Vertices
area = Area(Geometry=debrep.Faces)  # -> Area, Centroid
cp = ClosestPoint(Point=simplify(cullpt.Points), Cloud=simplify(area.Centroid))  # -> ClosestPoint, CPIndex, Distance

larger = LargerThan(FirstNumber=cp.Distance, SecondNumber=0.2)  # -> LargerThan, OrEqualTo
cull = CullPattern(List=cp.CPIndex, CullPattern=invert(larger.LargerThan))
item = ListItem(List=area.Centroid, Index=cull, Wrap=True)

brep_cp = BrepClosestPoint(Point=item, Brep=split_2.Positive)  # -> Point, Normal, Distance
pl = PlaneNormal(Origin=brep_cp.Point, ZAxis=brep_cp.Normal)  # -> simplify(Plane)

tstat_2 = TreeStatistics(Tree=D)  # -> Paths, Length, Count
tstat_3 = TreeStatistics(Tree=pl)  # -> Paths, Length, Count
lng = ListLength(List=pl)
dup = DuplicateData(Data=graft(tstat_3.Paths), Number=lng, Order=True)  # -> flatten(Data)
tree = CreateTree(Data=flatten(pl), Path=dup, Ensure=tstat_2.Paths)

D_3 = ClusterOutput(tree)

# ==== cluster Cluster_32
L = ClusterInput()
crv = ClusterInput()
poly_topo_edge = PolygonTopologyEdge(ListOfPolylines=crv, Tolerance=0.001)  # -> ListOfEdges, LoopEdgeStructure, EdgeLoopStructure
O = ClusterInput()

item = ListItem(List=flatten(L), Index=6, Wrap=True)
cluster = Cluster_25(L=item, crv=crv, G=Toggle(False))  # -> A, flatten(s_0), pln_6, L_2, B
generate_offset_polylines = GenerateOffsetPolylines(
    Polyline=cluster.s_0,
    Offset=expr("-x", O),
    OptionalMitrePlane=cluster.A,
    AngleTolerance=degrees(1),
    OffsetMethod=2,
    nonPlanar=False,
    virtual4Valent=False)  # -> OffsetPolylines, simplify(FourValenceNodes)
generate_offset_polylines_2 = GenerateOffsetPolylines(
    Polyline=cluster.s_0,
    Offset=O,
    OptionalMitrePlane=cluster.A,
    AngleTolerance=degrees(1),
    OffsetMethod=2,
    nonPlanar=False,
    virtual4Valent=False)  # -> OffsetPolylines, simplify(FourValenceNodes)

geo = Geometry(generate_offset_polylines.FourValenceNodes)
poly_topo_edge_filter = PolygonTopologyEdgeFilter(EdgeList=poly_topo_edge.ListOfEdges, EdgeLoopStructure=poly_topo_edge.EdgeLoopStructure, ValencyFilter=1)  # -> ListOfEdgeIDs, ListOfEdges
join = JoinCurves(Curves=poly_topo_edge_filter.ListOfEdges, Preserve=False)
tstat = TreeStatistics(Tree=geo)  # -> Paths, Length, Count
len = Length(Curve=join)
sort = SortList(Keys=len, ValuesA=join)  # -> Keys, reverse(flatten(ValuesA))
cullpt = CullDuplicates(Points=geo, Tolerance=0.01, CullMode=1)  # -> Points, Indices, Valence
cluster_2 = Cluster_27(pln=cluster.A, int=poly_topo_edge.EdgeLoopStructure, crv=generate_offset_polylines.OffsetPolylines, pln_2=cluster.pln_6)
crv_2 = Curve(cluster_2)
split = SplitTree(Data=simplify(graft(crv_2)), Masks=flatten(tstat.Paths))  # -> Positive, Negative
cluster_3 = Cluster_27(
    pln=cluster.A,
    int=poly_topo_edge.EdgeLoopStructure,
    crv=generate_offset_polylines_2.OffsetPolylines,
    pln_2=cluster.pln_6)
item_2 = ListItem(List=sort.ValuesA, Index=0, Wrap=True)

simplify = SimplifyCurve(Curve=item_2)  # -> Curve, Simplified
project = Project(Geometry=simplify.Curve, Plane=PlaneXY(0, 0, 0))  # -> Geometry, Transform
disc = Discontinuity(Curve=simplify.Curve, Level=1)  # -> Points, Parameters
shatter = Shatter(Curve=simplify.Curve, Parameters=disc.Parameters)
end = EndPoints(Curve=shatter)  # -> Start, End
vec2pt = Vector2Pt(PointA=end.Start, PointB=end.End, Unitize=False)  # -> Vector, Length
c_script = CSharpScript(x=vec2pt.Vector)  # -> out, A; inputs x: Vector3d
# ---------- c_script: C# ----------
    if(x.IsParallelTo(Vector3d.XAxis, Math.PI / 4) == 0) A = true;
    else A = false;
# ---------- end c_script ----------
cull = CullPattern(List=shatter, CullPattern=c_script.A)
ext = ExtendCurve(Curve=cull, Type=0, Start=4, End=4)
connect = ConnectCurves(Curves=ext, Continuity=2, Close=True, Bulge=0)

crv_cp = CurveClosestPoint(Point=cullpt.Points, Curve=split.Positive)  # -> Point, Parameter, Distance
merge = Merge(Data1=simplify(graft(cullpt.Points)), Data2=simplify(graft(crv_cp.Point)))
avr = Average(Input=merge)
cluster_4 = Cluster_28(top=graft(cluster_3), bottom=graft(cluster_2))

number_slider = Slider(0.04, range=0..1)
geo_2 = Geometry(flatten(cluster.L_2))
box = CenterBox(Base=geo_2, X=number_slider, Y=number_slider, Z=Slider(0.12, range=0..1))
clash = Clash(FirstSet=cluster_4, SecondSet=box, Distance=0, L=100)  # -> ClashCount, ClashPoints, ClashRadii, FirstIndex, SecondIndex
larger = LargerThan(FirstNumber=clash.ClashCount, SecondNumber=0)  # -> LargerThan, OrEqualTo

trim = TrimTree(Tree=avr, Depth=1)

cull_2 = CullPattern(List=cluster_4, CullPattern=larger.LargerThan)
clean = CleanTree(RemoveNulls=True, RemoveInvalid=True, RemoveEmpty=True, Tree=cull_2)
sdiff = SolidDifference(BrepsA=clean, BrepsB=cluster.B)  # -> simplify(Result)
tstat_2 = TreeStatistics(Tree=sdiff)  # -> Paths, Length, Count
split_2 = SplitTree(Data=cluster_4, Masks=flatten(tstat_2.Paths))  # -> Positive, Negative
merge_2 = Merge(Data1=split_2.Negative, Data2=sdiff)

debrep = DeconstructBrep(Brep=sdiff)  # -> Faces, Edges, Vertices
area = Area(Geometry=debrep.Faces)  # -> Area, Centroid
sort_2 = SortList(Keys=area.Area, ValuesA=debrep.Faces)  # -> Keys, reverse(ValuesA)
split_3 = SplitList(List=sort_2.ValuesA, Index=2)  # -> ListA, ListB
crv_3 = Curve(split_3.ListA)
area_2 = Area(Geometry=crv_3)  # -> Area, Centroid
pdecon = Deconstruct(Point=area_2.Centroid)  # -> XComponent, YComponent, ZComponent
sort_3 = SortList(Keys=pdecon.ZComponent, ValuesA=crv_3)  # -> Keys, ValuesA
item_3 = ListItem(List=sort_3.ValuesA, Index=0, Wrap=True)  # -> simplify(Item), Item1
tstat_3 = TreeStatistics(Tree=simplify(item_3.Item))  # -> Paths, Length, Count
dpath = DeconstructPath(Branch=tstat_3.Paths)  # -> flatten(Indices)
cluster_5 = Cluster_29(I=item_3.Item1, i=dpath, crv=generate_offset_polylines_2.OffsetPolylines)
cluster_6 = Cluster_29(I=item_3.Item, i=dpath, crv=generate_offset_polylines.OffsetPolylines)

cluster_7 = Cluster_26(S=crv, geo=merge_2, T=generate_offset_polylines_2.FourValenceNodes)  # -> min, max, R
R = ClusterOutput(cluster_7.R)
L_2 = ClusterOutput(cluster_5)
L_3 = ClusterOutput(cluster_6)
R_2 = ClusterOutput(cluster.A)

geo_3 = Geometry(cluster_7.R)
split_4 = SplitTree(Data=simplify(graft(geo_3)), Masks=flatten(tstat.Paths))  # -> Positive, Negative
debrep_2 = DeconstructBrep(Brep=split_4.Positive)  # -> Faces, Edges, Vertices
area_3 = Area(Geometry=debrep_2.Faces)  # -> Area, Centroid
cp = ClosestPoint(Point=simplify(trim), Cloud=simplify(area_3.Centroid))  # -> ClosestPoint, CPIndex, Distance
brep_cp = BrepClosestPoint(Point=cp.ClosestPoint, Brep=split_4.Positive)  # -> Point, Normal, Distance
amp = Amplitude(Vector=brep_cp.Normal, Amplitude=Slider(0.4, range=0..1))
unit = UnitVector(Vector=brep_cp.Normal)
pl = PlaneNormal(Origin=brep_cp.Point, ZAxis=brep_cp.Normal)
move = Move(Geometry=brep_cp.Point, Motion=amp)  # -> Geometry, Transform
crv_cp_2 = CurveClosestPoint(Point=move.Geometry, Curve=connect)  # -> Point, Parameter, Distance
larger_2 = LargerThan(FirstNumber=crv_cp_2.Distance, SecondNumber=Slider(0.2, range=0..1))  # -> LargerThan, OrEqualTo
cull_3 = CullPattern(List=pl, CullPattern=invert(larger_2.LargerThan))
randcol = RandomColor(Data=flatten(geo_3), Seed=2, FastMode=False)  # -> simplify(graft(Colors))
clean_2 = CleanTree(RemoveNulls=True, RemoveInvalid=True, RemoveEmpty=True, Tree=cull_3)  # -> simplify(Tree)
tstat_4 = TreeStatistics(Tree=clean_2)  # -> Paths, Length, Count
split_5 = SplitTree(Data=simplify(graft(randcol)), Masks=flatten(tstat_4.Paths))  # -> Positive, Negative
concat = Concatenate(FragmentA=split_5.Positive, FragmentB=",10")
T = ClusterOutput(clean_2)
split_6 = SplitTree(Data=simplify(graft(geo_3)), Masks=flatten(tstat_4.Paths))  # -> Positive, Negative
split_7 = SplitTree(Data=randcol, Masks=flatten(tstat_4.Paths))  # -> Positive, Negative
deplane = DeconstructPlane(Plane=clean_2)  # -> Origin, XAxis, YAxis, ZAxis
vdisex = VectorDisplayEx(Point=deplane.Origin, Vector=deplane.ZAxis, Colour=split_7.Positive, Width=2)
preview = CustomPreview(Geometry=flatten(split_6.Positive), Material=flatten(concat))
cluster_8 = Cluster_31(C=cluster_5, C_2=cluster_6, A=cluster_7.min, B=cluster_7.max, x=cluster_7.R)
R_3 = ClusterOutput(cluster_8)

# ==== cluster Cluster_33
G = ClusterInput()
x = ClusterInput()
volume = Volume(Geometry=G)  # -> Volume, Centroid
c_script = CSharpScript(x=x, y=volume.Volume)  # -> out, A; inputs x: Double, y: list of Double
# ---------- c_script: C# usings ----------
using System.Linq;
# ---------- c_script: C# ----------
    if(y.Count == 0) A = 0;
    else A = y.Sum(f => f * x);
# ---------- end c_script ----------
ma = MassAddition(Input=c_script.A)  # -> simplify(Result), PartialResults
R = ClusterOutput(ma.Result)

# ==== cluster Cluster_34
D = ClusterInput()
M = ClusterInput()
split = SplitTree(Data=simplify(D), Masks=flatten(M))  # -> Positive, Negative
C = ClusterInput()
split_2 = SplitBrep(Brep=split.Positive, Cutter=C)
cap = CapHoles(Brep=split_2)
merge = Merge(Data1=simplify(cap), Data2=split.Negative)
R = ClusterOutput(merge)

# ==== cluster Cluster_35
data = ClusterInput()
data_2 = Data(data)
d2 = ClusterInput()
explode = Explode(Curve=data_2, Recursive=True)  # -> Segments, Vertices
merge = Merge(Data1=simplify(graft(data_2)), Data2=d2)
item = ListItem(List=explode.Vertices, Index=0, Wrap=True)
alicrvseams = AlignCurveSeams(Curves=merge, Guide=item, Snap=True, Iterative=True)  # -> Aligned, Points, R
item_2 = ListItem(List=alicrvseams.Aligned, Index=1, Wrap=True)
i = ClusterOutput(item_2)

# ==== cluster Cluster_36
D = ClusterInput()
split = SplitTree(Data=D, Masks=flatten("{0,8;*}"))  # -> Positive, Negative
xy = XYPlane(Origin=Point(0, 0, 0))
boundary = BoundarySurfaces(Edges=split.Positive)
explode = Explode(Curve=boundary, Recursive=True)  # -> Segments, Vertices
A = ClusterInput()
len = Length(Curve=explode.Segments)
B = ClusterInput()
A_2 = ClusterInput()
sort = SortList(Keys=len, ValuesA=explode.Segments)  # -> Keys, reverse(ValuesA)
pln = Plane(graft(boundary))
item = ListItem(List=sort.ValuesA, Index=0, Wrap=True)
c_script = CSharpScript(x=item)  # -> out, A; inputs x: Line
# ---------- c_script: C# ----------
  if(x.PointAt(0).Y > x.PointAt(1).Y)
      x.Flip();
    A = x;
# ---------- end c_script ----------
end = EndPoints(Curve=c_script.A)  # -> Start, End
pl_origin = PlaneOrigin(Base=pln, Origin=end.Start)
align = AlignPlanes(Planes=pl_origin, Master=xy)
Z = UnitZ(Factor=1)
deplane = DeconstructPlane(Plane=align)  # -> Origin, XAxis, YAxis, ZAxis
angle = Angle(VectorA=deplane.ZAxis, VectorB=Z)  # -> Angle, Reflex
cos = Cosine(Value=angle.Angle)
division = Division(A=A_2, B=cos)
subtraction = Subtraction(A=division, B=B)
neg = Negative(Value=subtraction)
pl_offset = PlaneOffset(BasePlane=align, Offset=neg)
pl_origin_2 = PlaneOrigin(Base=xy, Origin=pl_offset)
multiplication = Multiplication(B=2)
deplane_2 = DeconstructPlane(Plane=pl_origin_2)  # -> Origin, XAxis, YAxis, ZAxis
amp = Amplitude(Vector=deplane_2.XAxis, Amplitude=A)  # -> simplify(Vector)
Z_2 = UnitZ(Factor=expr("-2*x", A_2))
split_2 = SplitTree(Data=simplify(amp), Masks=flatten("{0;*}"))  # -> Positive, Negative
neg_2 = Negative(Value=split_2.Negative)
merge = Merge(Data1=split_2.Positive, Data2=neg_2)
move = Move(Geometry=deplane_2.Origin, Motion=Z_2)  # -> Geometry, Transform
Z_3 = UnitZ(Factor=1)
neg_3 = Negative(Value=merge)
neg_4 = Negative(Value=neg_3)
move_2 = Move(Geometry=move.Geometry, Motion=neg_3)  # -> Geometry, Transform
move_3 = Move(Geometry=move_2.Geometry, Motion=expr("-3*x", Z_2))  # -> Geometry, Transform
move_4 = Move(Geometry=deplane_2.Origin, Motion=neg_4)  # -> Geometry, Transform
c_script_2 = CSharpScript(x=move_4.Geometry, y=move_3.Geometry)  # -> out, A; inputs x: Point3d, y: Point3d
# ---------- c_script_2: C# ----------
    A = new Point3d(x.X, x.Y, y.Z);
# ---------- end c_script_2 ----------
number_slider = Slider(0.1, range=0..0.1)
merge_2 = Merge(
    Data1=deplane_2.Origin,
    Data2=move.Geometry,
    Data3=move_2.Geometry,
    Data4=move_3.Geometry,
    Data5=c_script_2.A,
    Data6=move_4.Geometry)
crv = Curve(c_script.A)
pline = PolyLine(Vertices=merge_2, Closed=True)
amp_2 = Amplitude(Vector=crv, Amplitude=number_slider)
boundary_2 = BoundarySurfaces(Edges=pline)
neg_5 = Negative(Value=amp_2)
ext = ExtendCurve(Curve=crv, Type=0, Start=number_slider, End=number_slider)
move_5 = Move(Geometry=boundary_2, Motion=neg_5)  # -> Geometry, Transform
extrcrv = ExtrudeAlong(Base=move_5.Geometry, Curve=ext)
E = ClusterOutput(extrcrv)

# ==== cluster Cluster_7
_1 = ClusterInput()
trim = TrimTree(Tree=_1, Depth=1)
G = ClusterInput()
filter = StreamFilter(Gate=G, Stream0=trim, Stream1=_1)  # -> simplify(Stream)
s_1 = ClusterOutput(filter)

# ==== cluster Cluster_8
_0 = ClusterInput()
graft = GraftTree(Tree=_0, IncludeEmptyLists=True, IncludeNullItems=True)
G = ClusterInput()
filter = StreamFilter(Gate=G, Stream0=_0, Stream1=graft)  # -> simplify(Stream)
s_1 = ClusterOutput(filter)

# ==== cluster Cluster_9
I = ClusterInput()
tstat = TreeStatistics(Tree=I)  # -> Paths, Length, Count
null = NullItem(Item=I)  # -> NullFlags, InvalidFlags, Description
item = ListItem(List=null.NullFlags, Index=0, Wrap=True)
dispatch = Dispatch(List=tstat.Paths, DispatchPattern=flatten(item))  # -> ListA, ListB
branch = TreeBranch(Tree=simplify(I), Path=dispatch.ListB, MaintainPaths=True)
branch_2 = TreeBranch(Tree=I, Path=dispatch.ListA, MaintainPaths=True)
B = ClusterOutput(branch)
B_2 = ClusterOutput(branch_2)

# ==== cluster Cluster_10
_0 = ClusterInput()
trim = TrimTree(Tree=_0, Depth=1)
G = ClusterInput()
filter = StreamFilter(Gate=G, Stream0=_0, Stream1=trim)  # -> simplify(Stream)
s_1 = ClusterOutput(filter)

# ==== cluster Cluster_11
L = ClusterInput()
_0 = ClusterInput()
lng = ListLength(List=L)
dup = DuplicateData(Data=_0, Number=lng, Order=True)  # -> graft(Data)
G = ClusterInput()
filter = StreamFilter(Gate=G, Stream0=_0, Stream1=dup)  # -> simplify(Stream)
s_1 = ClusterOutput(filter)

# ==== cluster Cluster_12
X = ClusterInput()
Y = ClusterInput()
X_2 = ClusterInput()
pt = ConstructPoint(XCoordinate=X, YCoordinate=Y, ZCoordinate=0)
merge = Merge(Data1="0,0,0", Data2=pt, Data3="1,1,0")
pt_2 = ConstructPoint(XCoordinate=X_2, YCoordinate=0, ZCoordinate=0)
intcrv = Interpolate(Vertices=merge, Degree=3, Periodic=False, KnotStyle=1)  # -> Curve, Length, Domain
yz = YZPlane(Origin=pt_2)
pcx = CurvePlane(Curve=intcrv.Curve, Plane=yz)  # -> Points, ParamsC, ParamsP
pdecon = Deconstruct(Point=pcx.Points)  # -> XComponent, YComponent, ZComponent
Y_2 = ClusterOutput(pdecon.YComponent)

# ==== cluster Cluster_13
L = ClusterInput()
dispatch = Dispatch(List=L, DispatchPattern=[True, False])  # -> ListA, ListB
D = ClusterInput()
pt = ConstructPoint(XCoordinate=graft(dispatch.ListA), YCoordinate=graft(dispatch.ListB), ZCoordinate=0)
clean = CleanTree(RemoveNulls=True, RemoveInvalid=True, RemoveEmpty=True, Tree=D)
lng = ListLength(List=dispatch.ListA)
tstat = TreeStatistics(Tree=clean)  # -> Paths, Length, Count
dup = DuplicateData(Data="0,0,0", Number=lng, Order=True)
split = SplitTree(Data=D, Masks=flatten(tstat.Paths))  # -> Positive, Negative
dup_2 = DuplicateData(Data="1,1,0", Number=lng, Order=True)
merge = Merge(Data1=simplify(graft(dup)), Data2=simplify(pt), Data3=simplify(graft(dup_2)))
pt_2 = ConstructPoint(XCoordinate=split.Positive, YCoordinate=0, ZCoordinate=0)
trim = TrimTree(Tree=pt_2, Depth=1)
match = MatchTree(Tree=merge, Guide=trim)
intcrv = Interpolate(Vertices=match, Degree=3, Periodic=False, KnotStyle=1)  # -> Curve, Length, Domain
yz = YZPlane(Origin=trim)
pcx = CurvePlane(Curve=intcrv.Curve, Plane=yz)  # -> Points, ParamsC, ParamsP
pdecon = Deconstruct(Point=pcx.Points)  # -> XComponent, YComponent, ZComponent
match_2 = MatchTree(Tree=pdecon.YComponent, Guide=pt_2)
merge_2 = Merge(Data1=match_2, Data2=split.Negative)
subtraction = Subtraction(A=split.Positive, B=match_2)
R = ClusterOutput(merge_2)

# ==== cluster Cluster_25
receive = Receive(
    AutoReceive=False,
    CurrentComponentState="expired",
    ExpandOutput=True,
    LastInfoMessage="Lasath @ 02/22/2024 09:01:18: Updated Acoustics based on A610 V DD12 (id:2c90bcf47d)",
    ReceiveOnOpen=True,
    ReceivedCommitId="2c90bcf47d",
    StreamWrapper="https://speckle.xyz/projects/fa2b5c68c0/models/globals",
    selectedKitName="Objects")  # -> Info, ArchicadMiddleTopOfGrid1, Cassette, Material, Steel
crv = ClusterInput()
crv_2 = Curve(crv)
L = ClusterInput()

# ---- group: Get Skylight Plane
item = ListItem(List=flatten(L), Index=6, Wrap=True)
edges = BrepEdges(Brep=item)  # -> Naked, Interior, NonManifold
join = JoinCurves(Curves=edges.Naked, Preserve=False)
item_2 = ListItem(List=join, Index=1, Wrap=True)
explode = Explode(Curve=item_2, Recursive=True)  # -> Segments, Vertices
boundary = BoundarySurfaces(Edges=item_2)
len = Length(Curve=explode.Segments)
disc = Discontinuity(Curve=boundary, Level=1)  # -> Points, Parameters
c_script = CSharpScript(x=boundary)  # -> out, A, B, C, D; inputs x: Brep
# ---------- c_script: C# ----------
    var amp = AreaMassProperties.Compute(x);
    Point3d center = amp.Centroid;

    Point3d pt;
    double s,t;
    ComponentIndex ci;
    Vector3d normal;
    x.ClosestPoint(center, out pt, out ci, out s, out t, 1, out normal);
    if(Vector3d.Multiply(normal, Vector3d.ZAxis) < 0)
      normal.Reverse();
    A = normal;
    B = pt;
    C = Vector3d.VectorAngle(normal, Vector3d.ZAxis);
    D = new Plane(center, normal);
# ---------- end c_script ----------
sort = SortList(Keys=len, ValuesA=explode.Segments)  # -> Keys, ValuesA
item_3 = ListItem(List=sort.ValuesA, Index=0, Wrap=True)
vec = Vector(item_3)
rev = Reverse(Vector=vec)
align = AlignPlane(Plane=c_script.D, Direction=rev)  # -> Plane, Angle

# ----
Z = UnitZ(Factor=1)
generate_mitre_planes_between_segments = GenerateMitrePlanesBetweenSegments(Polyline=crv_2, NakedEdgeGuideVector=Z)  # -> MitrePlanes, Neighbours, PolylinePlanes, BoundingRectangle

poly_topo_edge = PolygonTopologyEdge(ListOfPolylines=crv_2, Tolerance=0.001)  # -> ListOfEdges, LoopEdgeStructure, EdgeLoopStructure
flip_data_edge_to_loop = FlipDataEdgeToLoop(
    LoopEdgeStructure=simplify(poly_topo_edge.LoopEdgeStructure),
    EdgeLoopStructure=simplify(poly_topo_edge.EdgeLoopStructure),
    ObjectsInLoopStructure=simplify(generate_mitre_planes_between_segments.MitrePlanes))  # -> EdgeLoopStructure, ObjectsInEdgeStructure

poly_topo_edge_filter = PolygonTopologyEdgeFilter(EdgeList=poly_topo_edge.ListOfEdges, EdgeLoopStructure=poly_topo_edge.EdgeLoopStructure, ValencyFilter=1)  # -> ListOfEdgeIDs, ListOfEdges
join_2 = JoinCurves(Curves=poly_topo_edge_filter.ListOfEdges, Preserve=False)
len_2 = Length(Curve=join_2)
sort_2 = SortList(Keys=len_2, ValuesA=join_2)  # -> Keys, ValuesA
item_4 = ListItem(List=sort_2.ValuesA, Index=0, Wrap=True)
ccx = CurveCurve(CurveA=item_4, CurveB=poly_topo_edge_filter.ListOfEdges)  # -> Points, ParamsA, ParamsB
lng = ListLength(List=ccx.Points)
cull = CullPattern(List=poly_topo_edge_filter.ListOfEdgeIDs, CullPattern=flatten(lng))
path = ConstructPath(Indices=graft(cull))  # -> flatten(Branch)

line_topo = LineTopology(ListOfLines=poly_topo_edge.ListOfEdges, Tolerance=0.001)  # -> ListOfPoints, LinePointStructure, PointPointStructure, PointLineStructure, PointLineStructureIndex
explode_2 = Explode(Curve=item_4, Recursive=True)  # -> Segments, Vertices
c_script_2 = CSharpScript(x=explode_2.Segments)  # -> out, A, B; inputs x: list of Line
# ---------- c_script_2: C# ----------
    List<Line> output = new List<Line>();
    List<Point3d> output2 = new List<Point3d>();

    for (int i = 0; i < x.Count; i++)
    {
      if(x[i].Length < 0.5)
      {
        output.Add(x[i]);
        if(x[i].PointAt(0).Z > x[i].PointAt(1).Z)
          output2.Add(x[i].PointAt(1));
        else
          output2.Add(x[i].PointAt(0));

      }

    }

    A = output;
    B = output2;
# ---------- end c_script_2 ----------
midpt = CurveMiddle(Curve=poly_topo_edge.ListOfEdges)
midpt_2 = CurveMiddle(Curve=c_script_2.A)
cp = ClosestPoint(Point=c_script_2.B, Cloud=line_topo.ListOfPoints)  # -> ClosestPoint, CPIndex, Distance
cp_2 = ClosestPoint(Point=midpt_2, Cloud=midpt)  # -> ClosestPoint, CPIndex, Distance
c_script_3 = CSharpScript(P=cp.CPIndex, L=cp_2.CPIndex, PL=line_topo.PointLineStructureIndex)  # -> out, A; inputs P: Int32, L: list of Int32, PL: tree of Int32
# ---------- c_script_3: C# ----------
    var edges = PL.Branch(P);
    edges = edges.Except(L).ToList();
    A = edges;
# ---------- end c_script_3 ----------

pln = Plane(align.Plane)
deplane = DeconstructPlane(Plane=pln)  # -> Origin, XAxis, YAxis, ZAxis
vdis = VectorDisplay(Anchor=deplane.Origin, Vector=deplane.ZAxis)

number_slider = Slider(0.21, range=0..1)
G = ClusterInput()

item_5 = ListItem(List=flatten(generate_mitre_planes_between_segments.PolylinePlanes), Index=poly_topo_edge.EdgeLoopStructure, Wrap=True)  # -> simplify(Item)
lng_2 = ListLength(List=item_5)
tstat = TreeStatistics(Tree=item_5)  # -> Paths, Length, Count
equals = Equality(FirstNumber=lng_2, SecondNumber="2")  # -> Equality, Inequality
c_script_4 = CSharpScript(y=cull, z=flatten(equals.Equality))  # -> out, A; inputs y: list of Int32, z: list of Boolean
# ---------- c_script_4: C# ----------
    List<bool> outputList = new List<bool>();


    List<int> checkList = new List<int>(y);
    checkList.Distinct();

    for (int i = 0; i < z.Count; i++)
    {
      if(checkList.Contains(i))
      {
        outputList.Add(!z[i]);

      }
      else outputList.Add(z[i]);
    }

    A = outputList;
# ---------- end c_script_4 ----------

cull_2 = CullPattern(List=tstat.Paths, CullPattern=c_script_4.A)

split = SplitTree(Data=flip_data_edge_to_loop.ObjectsInEdgeStructure, Masks=flatten(cull_2))  # -> Positive, Negative

split_2 = SplitTree(Data=split.Positive, Masks=flatten(path))  # -> Positive, Negative
deplane_2 = DeconstructPlane(Plane=split_2.Positive)  # -> Origin, XAxis, YAxis, ZAxis
pl = ConstructPlane(Origin=deplane_2.Origin, XAxis=deplane_2.XAxis, YAxis=deplane.ZAxis)
merge = Merge(Data1=simplify(pl), Data2=split_2.Negative)

pln_2 = Plane(merge)

path_2 = ConstructPath(Indices=graft(c_script_3.A))
split_3 = SplitTree(Data=pln_2, Masks=flatten(path_2))  # -> Positive, Negative

c_script_5 = CSharpScript(x=c_script_3.A, y=split_3.Positive)  # -> out, simplify(A); inputs x: list of Int32, y: tree of Plane
# ---------- c_script_5: C# ----------
    if(x.Count == 2)
    {
      Plane plnA = y.Branch(new GH_Path(x[0]))[0];
      Plane plnB = y.Branch(new GH_Path(x[1]))[0];
      Line ln;
      Rhino.Geometry.Intersect.Intersection.PlanePlane(plnA, plnB, out ln);
      A = ln;

    }
# ---------- end c_script_5 ----------
vec_2 = Vector(c_script_5.A)

item_6 = ListItem(List=line_topo.ListOfPoints, Index=cp.CPIndex, Wrap=True)
pl_2 = PlaneNormal(Origin=graft(item_6), ZAxis=vec_2)

path_3 = ConstructPath(Indices=graft(cp_2.CPIndex))
split_4 = SplitTree(Data=simplify(merge), Masks=flatten(path_3))  # -> Positive, Negative

split_5 = SplitTree(Data=simplify(graft(poly_topo_edge.ListOfEdges)), Masks=flatten(path_3))  # -> Positive, Negative
vec_3 = Vector(split_5.Positive)
align_2 = AlignPlane(Plane=pl_2, Direction=vec_3)  # -> Plane, Angle
deplane_3 = DeconstructPlane(Plane=align_2.Plane)  # -> Origin, XAxis, YAxis, ZAxis
pl_3 = ConstructPlane(Origin=deplane_3.Origin, XAxis=deplane_3.XAxis, YAxis=deplane_3.ZAxis)  # -> simplify(flatten(Plane))
tree = CreateTree(Data=pl_3, Path=cp_2.CPIndex)

merge_2 = Merge(Data1=split_4.Negative, Data2=tree, Data3=split.Negative)

explode_3 = Explode(Curve=item_4, Recursive=True)  # -> Segments, Vertices
cp_3 = PlaneClosestPoint(Point=explode_3.Vertices, Plane=item_2)  # -> Point, UVPoint, Distance
smaller = SmallerThan(FirstNumber=cp_3.Distance, SecondNumber=0.01)  # -> SmallerThan, OrEqualTo
cull_3 = CullPattern(List=explode_3.Vertices, CullPattern=smaller.SmallerThan)
midpt_3 = CurveMiddle(Curve=explode_3.Segments)
pline = PolyLine(Vertices=cull_3, Closed=False)

smaller_2 = SmallerThan(FirstNumber=cp_3.Distance, SecondNumber=0.01)  # -> SmallerThan, OrEqualTo
cull_4 = CullPattern(List=explode_3.Vertices, CullPattern=invert(smaller_2.SmallerThan))

cp_4 = ClosestPoint(Point=cull_4, Cloud=midpt_3)  # -> ClosestPoint, CPIndex, Distance
cull_i = CullIndex(List=midpt_3, Indices=cp_4.CPIndex, Wrap=True)

cp_5 = ClosestPoint(Point=graft(merge_2), Cloud=cull_i)  # -> ClosestPoint, CPIndex, Distance
smaller_3 = SmallerThan(FirstNumber=cp_5.Distance, SecondNumber=0.01)  # -> SmallerThan, OrEqualTo
cull_5 = CullPattern(List=graft(merge_2), CullPattern=smaller_3.SmallerThan)
clean = CleanTree(RemoveNulls=True, RemoveInvalid=True, RemoveEmpty=True, Tree=cull_5)  # -> simplify(Tree)
pl_offset = PlaneOffset(BasePlane=clean, Offset=0.1)

pdecon = Deconstruct(Point=clean)  # -> XComponent, YComponent, ZComponent
roundd = RoundToDecimalPlace(NumberX=pdecon.ZComponent, DecimalPlace=1, RoundType=0)  # -> Rounded, Difference
extremums = MinMax(Number=flatten(roundd.Rounded))  # -> Minimum, Maximum
larger = LargerThan(FirstNumber=extremums.Minimum, SecondNumber=roundd.Rounded)  # -> LargerThan, OrEqualTo
cull_6 = CullPattern(List=clean, CullPattern=invert(larger.OrEqualTo))
clean_2 = CleanTree(RemoveNulls=True, RemoveInvalid=True, RemoveEmpty=True, Tree=cull_6)  # -> simplify(Tree)
sort_pt = SortPoints(Points=flatten(clean_2))  # -> Points, Indices
item_7 = ListItem(List=sort_pt.Indices, Index=[0, -1], Wrap=True)
tstat_2 = TreeStatistics(Tree=clean_2)  # -> Paths, Length, Count
item_8 = ListItem(List=tstat_2.Paths, Index=item_7, Wrap=True)
split_6 = SplitTree(Data=clean_2, Masks=flatten(item_8))  # -> Positive, Negative
int = Integer(poly_topo_edge.EdgeLoopStructure)
pln_3 = Plane(split_6.Negative)
crv_3 = Curve(crv_2)
pl_offset_2 = PlaneOffset(BasePlane=pln_3, Offset=0.1)
tstat_3 = TreeStatistics(Tree=pln_3)  # -> Paths, Length, Count
split_7 = SplitTree(Data=simplify(int), Masks=flatten(tstat_3.Paths))  # -> Positive, Negative
path_4 = ConstructPath(Indices=split_7.Positive)
split_8 = SplitTree(Data=simplify(graft(crv_3)), Masks=flatten(path_4))  # -> Positive, Negative
boundary_2 = BoundarySurfaces(Edges=split_8.Positive)
pln_4 = Plane(boundary_2)

tstat_4 = TreeStatistics(Tree=pln_3)  # -> Paths, Length, Count
split_9 = SplitTree(Data=merge_2, Masks=flatten(tstat_4.Paths))  # -> Positive, Negative
merge_3 = Merge(Data1=split_9.Negative, Data2=pl_offset_2)

filter = StreamFilter(Gate=G, Stream0=merge_2, Stream1=merge_3)
c_script_6 = CSharpScript(iEL=simplify(poly_topo_edge.EdgeLoopStructure), iLE=simplify(poly_topo_edge.LoopEdgeStructure), x=simplify(filter))  # -> out, A; inputs iEL: tree of Int32, iLE: tree of Int32, x: tree of Plane
# ---------- c_script_6: C# ----------
    DataTree<object> sortedData = new DataTree<object>();

    for (int i = 0; i < iLE.BranchCount; i++)
    {
      for (int j = 0; j < iLE.Branch(i).Count; j++)
      {
        int index = iEL.Branch(iLE.Branch(i)[j]).IndexOf(i);
        sortedData.Add(x.Branch(iLE.Branch(i)[j])[index], iLE.Paths[i]);
      }
    }
    A = sortedData;
# ---------- end c_script_6 ----------

pln_5 = Plane(c_script_6.A)
split_10 = SplitTree(Data=simplify(pln_5), Masks=flatten(path_4))  # -> Positive, Negative
cp_6 = ClosestPoint(Point=split_10.Positive, Cloud=flatten(pln_3))  # -> ClosestPoint, CPIndex, Distance
cp_7 = ClosestPoint(Point=flatten(pln_3), Cloud=split_10.Positive)  # -> ClosestPoint, CPIndex, Distance
smaller_4 = SmallerThan(FirstNumber=cp_6.Distance, SecondNumber=0.01)  # -> SmallerThan, OrEqualTo
smaller_5 = SmallerThan(FirstNumber=cp_7.Distance, SecondNumber=0.01)  # -> SmallerThan, OrEqualTo
cull_7 = CullPattern(List=cp_6.CPIndex, CullPattern=smaller_4.SmallerThan)
cull_8 = CullPattern(List=cp_7.CPIndex, CullPattern=smaller_5.SmallerThan)
item_9 = ListItem(List=flatten(pl_offset_2), Index=cull_7, Wrap=True)
replace = ReplaceItems(List=split_10.Positive, Item=item_9, Indices=cull_8, Wrap=False)
ppx = PlanePlane(PlaneA=replace, PlaneB=pln_4)
shift = ShiftList(List=ppx, Shift=1, Wrap=True)
llx = LineLine(Line1=ppx, Line2=shift)  # -> ParamA, ParamB, PointA, PointB
pline_2 = PolyLine(Vertices=llx.PointA, Closed=True)  # -> simplify(Polyline)
merge_4 = Merge(Data1=split_8.Negative, Data2=pline_2)

cp_8 = ClosestPoint(Point=midpt_3, Cloud=flatten(pln_5))  # -> ClosestPoint, CPIndex, Distance
item_10 = ListItem(List=flatten(pln_5), Index=cp_8.CPIndex, Wrap=True)
crv_cp = CurveClosestPoint(Point=item_10, Curve=item_4)  # -> Point, Parameter, Distance
sort_3 = SortList(Keys=crv_cp.Parameter, ValuesA=item_10)  # -> Keys, ValuesA
cluster = Cluster_24(A=sort_3.ValuesA, P=align.Plane, O=expr("-x", number_slider))
cluster_2 = Cluster_24(A=sort_3.ValuesA, P=align.Plane, O=number_slider)
crv_4 = Curve(cluster_2)
disc_2 = Discontinuity(Curve=crv_4, Level=1)  # -> Points, Parameters
crv_5 = Curve(cluster)
item_11 = ListItem(List=disc_2.Points, Index=Slider(8, range=0..10), Wrap=True)
points = PointList(Points=disc_2.Points)
explode_4 = Explode(Curve=crv_4, Recursive=True)  # -> Segments, Vertices
merge_5 = Merge(Data1=crv_4, Data2=crv_5)
explode_5 = Explode(Curve=crv_5, Recursive=True)  # -> Segments, Vertices
alicrvseams = AlignCurveSeams(Curves=merge_5, Guide=item_11, Seam=0.5, Snap=False, Iterative=True)  # -> Aligned, Points, R
item_12 = ListItem(List=alicrvseams.Aligned, Index=0, Wrap=True)  # -> Item, Item1
flip = FlipCurve(Curve=item_12.Item, Guide=item_12.Item1)  # -> Curve, Flag
merge_6 = Merge(Data1=simplify(flip.Curve), Data2=simplify(item_12.Item1))
item_13 = ListItem(List=merge_6, Index=0, Wrap=True)  # -> Item, Item1
loft = Loft(Curves=merge_6, Options={Adjust=False, Closed=False, LoftEnds=0, LoftSimp=0, LoftType=3, Rebuild=10, Refit=0.01})
A = ClusterOutput(c_script_6.A)
cap = CapHoles(Brep=loft)
B = ClusterOutput(cap)
filter_2 = StreamFilter(Gate=G, Stream0=crv_2, Stream1=flatten(merge_4))
s_0 = ClusterOutput(filter_2)
pln_6 = ClusterOutput(pln_3)
L_2 = ClusterOutput(cull_6)

# ==== cluster Cluster_26
geo = ClusterInput()
geo_2 = Geometry(geo)
T = ClusterInput()
fmerge = MergeFaces(Brep=geo_2)  # -> Breps, Before, After
clean = CleanTree(RemoveNulls=True, RemoveInvalid=True, RemoveEmpty=True, Tree=T)
tstat = TreeStatistics(Tree=clean)  # -> Paths, Length, Count
split = SplitTree(Data=fmerge.Breps, Masks=flatten(tstat.Paths))  # -> Positive, Negative

debrep = DeconstructBrep(Brep=split.Positive)  # -> Faces, Edges, Vertices
area = Area(Geometry=debrep.Faces)  # -> Area, Centroid
cp = ClosestPoint(Point=clean, Cloud=area.Centroid)  # -> ClosestPoint, CPIndex, Distance

cull_i = CullIndex(List=debrep.Faces, Indices=cp.CPIndex, Wrap=True)
item = ListItem(List=debrep.Faces, Index=cp.CPIndex, Wrap=True)
explode = Explode(Curve=item, Recursive=True)  # -> simplify(Segments), Vertices
c_script = CSharpScript(x=explode.Segments, y=graft(clean))  # -> out, A; inputs x: Line, y: Point3d
# ---------- c_script: C# ----------
    Polyline poly = new Polyline();
    poly.Add(x.From);
    poly.Add(x.To);
    poly.Add(y);
    poly.Add(x.From);
    A = poly;
# ---------- end c_script ----------
boundary = BoundarySurfaces(Edges=c_script.A)
join = BrepJoin(Breps=boundary)  # -> simplify(Breps), Closed
trim = TrimTree(Tree=join.Breps, Depth=1)
merge = Merge(Data1=simplify(trim), Data2=simplify(cull_i))
join_2 = BrepJoin(Breps=merge)  # -> Breps, Closed
cap = CapHoles(Brep=join_2.Breps)
fmerge_2 = MergeFaces(Brep=cap)  # -> Breps, Before, After
S = ClusterInput()
clean_2 = CleanTree(RemoveNulls=True, RemoveInvalid=True, RemoveEmpty=True, Tree=fmerge_2.Breps)
planar = IsPlanar(Surface=S, Interior=True)  # -> Planar, Plane
tstat_2 = TreeStatistics(Tree=clean_2)  # -> Paths, Length, Count
split_2 = SplitTree(Data=fmerge.Breps, Masks=flatten(tstat_2.Paths))  # -> Positive, Negative
merge_2 = Merge(Data1=simplify(split_2.Negative), Data2=simplify(clean_2))  # -> flatten(Result)
bbox = BoundingBox(Content=graft(merge_2), Plane=graft(planar.Plane))  # -> Box, Box_2
debox = DeconstructBox(Box=bbox.Box_2)  # -> Plane, X, Y, Z
R = ClusterOutput(merge_2)
dedomain = DeconstructDomain(Domain=debox.Z)  # -> Start, End
subtraction = Subtraction(A=dedomain.End, B=dedomain.Start)
extremums = MinMax(Number=flatten(subtraction))  # -> Minimum, Maximum
equals = Equality(FirstNumber=flatten(subtraction), SecondNumber=extremums.Minimum)  # -> Equality, Inequality
min = ClusterOutput(extremums.Minimum)
max = ClusterOutput(extremums.Maximum)

# ==== cluster Cluster_27
pln = ClusterInput()
int = ClusterInput()
crv = ClusterInput()
pln_2 = ClusterInput()
pln_3 = Plane(pln)
int_2 = Integer(int)
crv_2 = Curve(crv)
pln_4 = Plane(pln_2)
pl_offset = PlaneOffset(BasePlane=pln_4, Offset=0.1)
tstat = TreeStatistics(Tree=pln_4)  # -> Paths, Length, Count
split = SplitTree(Data=simplify(int_2), Masks=flatten(tstat.Paths))  # -> Positive, Negative
path = ConstructPath(Indices=split.Positive)
split_2 = SplitTree(Data=simplify(graft(crv_2)), Masks=flatten(path))  # -> Positive, Negative
split_3 = SplitTree(Data=simplify(pln_3), Masks=flatten(path))  # -> Positive, Negative
boundary = BoundarySurfaces(Edges=split_2.Positive)
cp = ClosestPoint(Point=split_3.Positive, Cloud=flatten(pln_4))  # -> ClosestPoint, CPIndex, Distance
cp_2 = ClosestPoint(Point=flatten(pln_4), Cloud=split_3.Positive)  # -> ClosestPoint, CPIndex, Distance
smaller = SmallerThan(FirstNumber=cp.Distance, SecondNumber=0.01)  # -> SmallerThan, OrEqualTo
smaller_2 = SmallerThan(FirstNumber=cp_2.Distance, SecondNumber=0.01)  # -> SmallerThan, OrEqualTo
cull = CullPattern(List=cp.CPIndex, CullPattern=smaller.SmallerThan)
cull_2 = CullPattern(List=cp_2.CPIndex, CullPattern=smaller_2.SmallerThan)
item = ListItem(List=flatten(pl_offset), Index=cull, Wrap=True)
pln_5 = Plane(boundary)
replace = ReplaceItems(List=split_3.Positive, Item=item, Indices=cull_2, Wrap=False)
ppx = PlanePlane(PlaneA=replace, PlaneB=pln_5)
shift = ShiftList(List=ppx, Shift=1, Wrap=True)
llx = LineLine(Line1=ppx, Line2=shift)  # -> ParamA, ParamB, PointA, PointB
pline = PolyLine(Vertices=llx.PointA, Closed=True)  # -> simplify(Polyline)
merge = Merge(Data1=split_2.Negative, Data2=pline)
R = ClusterOutput(merge)

# ==== cluster Cluster_28
pi = Pi(Factor=1)
top = ClusterInput()  # Top
polyline_interior_angles = PolylineInteriorAngles(Polyline=top)  # -> Angles, Points
subtraction = Subtraction(A=polyline_interior_angles.Angles, B=pi)
bottom = ClusterInput()  # Bottom
abs = Absolute(Value=subtraction)
sort = SortList(Keys=abs, ValuesA=polyline_interior_angles.Points)  # -> Keys, ValuesA
merge = Merge(Data1=simplify(bottom), Data2=simplify(top))
item = ListItem(List=sort.ValuesA, Index=0, Wrap=True)
flip = FlipCurve(Curve=merge, Guide=bottom)  # -> Curve, Flag
path = ConstructPath(Indices=Slider(163, range=0..1000))
alicrvseams = AlignCurveSeams(Curves=flip.Curve, Guide=item, Snap=True, Iterative=True)  # -> Aligned, Points, R
len = Length(Curve=alicrvseams.Aligned)
larger = LargerThan(FirstNumber=len, SecondNumber=Slider(0, range=0..100))  # -> LargerThan, OrEqualTo
cull = CullPattern(List=alicrvseams.Aligned, CullPattern=larger.LargerThan)
python = GhPythonScript(iCurve=cull)  # -> out, simplify(a); inputs iCurve: Curve
# ---------- python: Python ----------
import Rhino.Geometry as rg



if not iCurve.IsClosed:
    iCurve.MakeClosed(0.0001)

a = iCurve
# ---------- end python ----------
loft = Loft(Curves=python.a, Options={Adjust=False, Closed=False, LoftEnds=0, LoftSimp=0, LoftType=0, Rebuild=10, Refit=0.01})
clean = CleanTree(RemoveNulls=True, RemoveInvalid=True, RemoveEmpty=False, Tree=loft)
cap = CapHoles(Brep=clean)
python_2 = GhPythonScript(x=cap)  # -> out, a; inputs x: Brep
# ---------- python_2: Python ----------
a = x.IsSolid
# ---------- end python_2 ----------
dispatch = Dispatch(List=cap, DispatchPattern=python_2.a)  # -> ListA, ListB
dispatch_2 = Dispatch(List=python.a, DispatchPattern=python_2.a)  # -> ListA, ListB
area = Area(Geometry=dispatch_2.ListB)  # -> Area, Centroid
smaller = SmallerThan(FirstNumber=area.Area, SecondNumber=0.1)  # -> SmallerThan, OrEqualTo
cull_2 = CullPattern(List=dispatch_2.ListB, CullPattern=smaller.SmallerThan)
dispatch_3 = Dispatch(List=dispatch_2.ListB, DispatchPattern=smaller.SmallerThan)  # -> ListA, ListB
disc = Discontinuity(Curve=dispatch_3.ListA, Level=1)  # -> Points, Parameters
duppt = RemoveDuplicatePts(Points=disc.Points, Tolerance=0.001)
plfit = PlaneFit(Points=disc.Points)  # -> Plane, Deviation
c_script = CSharpScript(x=duppt)  # -> out, A; inputs x: list of Point3d
# ---------- c_script: C# ----------
    A = ArePointsCollinear(x);
# ---------- c_script: C# additional code ----------
  public bool ArePointsCollinear(List<Point3d> points)
  {
    // You need at least three points to check for collinearity
    if (points.Count < 3)
      return true;

    for (int i = 0; i < points.Count - 2; i++)
    {
      Point3d p1 = points[i];
      Point3d p2 = points[i + 1];
      Point3d p3 = points[i + 2];

      // Create vectors
      Vector3d v1 = p2 - p1;
      Vector3d v2 = p3 - p1;

      // The cross product of two vectors is a vector that's perpendicular to the two original vectors.
      // If the two original vectors are parallel (and thus the points are collinear), the cross product will be a zero vector.
      Vector3d crossProduct = Vector3d.CrossProduct(v1, v2);

      // If the cross product is not approximately zero, the points are not collinear
      if (crossProduct.Length > 1e-4) // 1e-10 is a small tolerance value
        return false;
    }

    return true;
  }
# ---------- end c_script ----------
brec = BoundingRectangle(Geometry=cull_2, Plane=plfit.Plane, Axis=0, Slide=0, Union=True)  # -> Bounding, DimensionX, DimensionY
dispatch_4 = Dispatch(List=duppt, DispatchPattern=c_script.A)  # -> ListA, ListB
sort_pt = SortPoints(Points=dispatch_4.ListA)  # -> Points, Indices
del = DelaunayMesh(Points=dispatch_4.ListB, Plane=plfit.Plane)
clean_2 = CleanTree(RemoveNulls=True, RemoveInvalid=True, RemoveEmpty=False, Tree=del)
geo = Geometry(dispatch_4.ListA)
duppt_2 = RemoveDuplicatePts(Points=sort_pt.Points, Tolerance=0.001)
medges = MeshEdges(Mesh=del)  # -> NakedEdges, InteriorEdges, NonManifoldEdges
pline = PolyLine(Vertices=duppt_2, Closed=False)
join = JoinCurves(Curves=medges.NakedEdges, Preserve=False)
merge_2 = Merge(Data1=simplify(pline), Data2=simplify(join))
clean_3 = CleanTree(RemoveNulls=True, RemoveInvalid=True, RemoveEmpty=False, Tree=merge_2)
merge_3 = Merge(Data1=simplify(clean_3), Data2=simplify(dispatch_3.ListB))
item_2 = ListItem(List=merge_3, Index=0, Wrap=True)  # -> Item, Item1
c_script_2 = CSharpScript(x=merge_3)  # -> out, A, B; inputs x: list of Polyline; disabled
# ---------- c_script_2: C# ----------
    if(x.Count > 0)
      if(x[0].IsClosed && x[1].IsClosed )
        A = LoftPolylines(x);
      else
        B = x;
# ---------- c_script_2: C# additional code ----------
  public List<Line> LoftPolylines(List<Polyline> polylines)
  {
    // Check if the polylines are not null
    if (polylines == null || polylines.Count == 0)
      throw new Exception("The list of polylines must be defined and cannot be empty.");

    // Determine the polyline with the most points
    int maxIndex = 0;
    int minIndex = 0;
    for (int i = 1; i < polylines.Count; i++)
    {
      if (polylines[i].Count > polylines[maxIndex].Count)
      {
        maxIndex = i;
      }
    }
    if(maxIndex == 0) minIndex = 1;

    Polyline maxPolyline = polylines[maxIndex];
    Polyline minPolyline = polylines[minIndex];

    Plane fitPlane;
    Plane.FitPlaneToPoints(maxPolyline.ToList(), out fitPlane);

    // Create a list to hold the loft surfaces
    List<Line> lines = new List<Line>();

    // Cycle through the points of the polyline with the most points
    for (int i = 0; i < maxPolyline.Count; i++)
    {
      Point3d pt1 = maxPolyline[i];
      List<Point3d> points = minPolyline.ToList();
      List<Point3d> projectedPoints = points.Select(x => fitPlane.ClosestPoint(x)).ToList();
      int index;
      Point3d pt2 = ComputeClosestPoint(projectedPoints, pt1, out index);
      pt2 = points[index];
      // Create a line between the two points and convert it to a curve
      Line line = new Line(pt1, pt2);

      lines.Add(line);



    }
    return lines;
  }

  private Point3d ComputeClosestPoint(List<Point3d> points, Point3d testPoint, out int index)
  {
    int outputIndex = -1;
    // Initialize RTree
    RTree rTree = new RTree();
    for (int i = 0; i < points.Count; i++)
    {
      rTree.Insert(points[i], i);
    }

    Point3d closestPoint = new Point3d();
    double closestDistance = Double.MaxValue;
    EventHandler<RTreeEventArgs> closestPointCallback =
      (object sender, RTreeEventArgs args) =>
      {
      double distance = points[args.Id].DistanceTo(testPoint);
      if (distance < closestDistance)
      {
        closestDistance = distance;
        closestPoint = points[args.Id];
        outputIndex = args.Id;
      }
      };

    rTree.Search(new Sphere(testPoint, closestDistance), closestPointCallback);

    if (outputIndex == -1)
      RhinoApp.WriteLine("Help");

    index = outputIndex;
    return closestPoint;
  }
# ---------- end c_script_2 ----------
explode = Explode(Curve=item_2.Item1, Recursive=True)  # -> Segments, Vertices
disc_2 = Discontinuity(Curve=item_2.Item, Level=1)  # -> Points, Parameters
boundary = BoundarySurfaces(Edges=item_2.Item1)
cull_i = CullIndex(List=explode.Vertices, Indices=-1, Wrap=True)
duppt_3 = RemoveDuplicatePts(Points=disc_2.Points, Tolerance=0.01)
plfit_2 = PlaneFit(Points=cull_i)  # -> Plane, Deviation
project = Project(Geometry=duppt_3, Plane=plfit_2.Plane)  # -> Geometry, Transform
cp = ClosestPoint(Point=cull_i, Cloud=project.Geometry)  # -> ClosestPoint, CPIndex, Distance
item_3 = ListItem(List=duppt_3, Index=cp.CPIndex, Wrap=True)
ln = Line(StartPoint=item_3, EndPoint=cull_i)  # -> simplify(Line)
shift = ShiftList(List=ln, Shift=1, Wrap=True)
c_script_3 = CSharpScript(x=ln, y=shift)  # -> out, simplify(A); inputs x: Line, y: Line
# ---------- c_script_3: C# ----------
    if(x.PointAt(0).DistanceTo(y.PointAt(1)) > y.PointAt(0).DistanceTo(x.PointAt(1)))
    {
      Polyline polyA = new Polyline{x.PointAt(0),x.PointAt(1),y.PointAt(0),x.PointAt(0)};
      Polyline polyB = new Polyline{y.PointAt(0),y.PointAt(1),x.PointAt(1),y.PointAt(0)};
      A = new List<Polyline>{polyA,polyB};
    }
    else
    {
      Polyline polyA = new Polyline{x.PointAt(0),x.PointAt(1),y.PointAt(1),x.PointAt(0)};
      Polyline polyB = new Polyline{y.PointAt(0),y.PointAt(1),x.PointAt(0),y.PointAt(0)};
      A = new List<Polyline>{polyA,polyB};

    }
# ---------- end c_script_3 ----------
boundary_2 = BoundarySurfaces(Edges=c_script_3.A)
trim = TrimTree(Tree=boundary_2, Depth=1)
merge_4 = Merge(Data1=simplify(trim), Data2=simplify(boundary))  # -> simplify(Result)
clean_4 = CleanTree(RemoveNulls=True, RemoveInvalid=True, RemoveEmpty=True, Tree=merge_4)
poly_topo_point = PolygonTopologyPoint(ListOfPolylines=clean_4, Tolerance=0.001)  # -> ListOfPoints, LoopPointStructure, PointLoopStructure
trim_2 = TrimTree(Tree=poly_topo_point.LoopPointStructure, Depth=1)
lng = ListLength(List=poly_topo_point.LoopPointStructure)
item_4 = ListItem(List=poly_topo_point.ListOfPoints, Index=trim_2, Wrap=True)
trim_3 = TrimTree(Tree=lng, Depth=1)
partition = PartitionList(List=item_4, Size=trim_3)
pline_2 = PolyLine(Vertices=partition, Closed=False)
boundary_3 = BoundarySurfaces(Edges=pline_2)
trim_4 = TrimTree(Tree=boundary_3, Depth=1)
join_2 = BrepJoin(Breps=trim_4)  # -> Breps, Closed
cap_2 = CapHoles(Brep=join_2.Breps)
match = MatchTree(Tree=cap_2, Guide=clean_4)
fmerge = MergeFaces(Brep=match)  # -> Breps, Before, After
merge_5 = Merge(Data1=dispatch.ListA, Data2=fmerge.Breps)

alicrvseams_2 = AlignCurveSeams(Curves=flip.Curve, Snap=True, Iterative=True)  # -> Aligned, Points, R

tstat = TreeStatistics(Tree=alicrvseams_2.Aligned)  # -> Paths, Length, Count
area_2 = Area(Geometry=alicrvseams_2.Aligned)  # -> Area, Centroid
item_5 = ListItem(List=area_2.Centroid, Index=0, Wrap=True)
c_script_4 = CSharpScript(x=alicrvseams_2.Aligned)  # -> out, A; inputs x: list of Polyline
# ---------- c_script_4: C# ----------
    A = LoftPolylines(x);
# ---------- c_script_4: C# additional code ----------
  public List<Line> LoftPolylines(List<Polyline> polylines)
  {
    if (polylines == null || polylines.Count == 0)
      return new List<Line>();  // Return an empty list instead of throwing an exception

    int maxIndex = 0;
    for (int i = 1; i < polylines.Count; i++)
    {
      if (polylines[i].Count > polylines[maxIndex].Count)
      {
        maxIndex = i;
      }
    }

    Polyline maxPolyline = polylines[maxIndex];

    Plane fitPlane;
    Plane.FitPlaneToPoints(maxPolyline.ToList(), out fitPlane);

    List<Line> lines = new List<Line>();
    foreach (var pt1 in maxPolyline)
    {
      double t;
      Curve crv = new PolylineCurve(maxPolyline);
      crv.ClosestPoint(pt1, out t);

      Point3d pt2 = ComputeClosestPointOnOtherPolylines(pt1, polylines, maxIndex);
      lines.Add(new Line(pt1, pt2));
    }
    return lines;
  }
  private Point3d ComputeClosestPointOnOtherPolylines(Point3d point, List<Polyline> polylines, int excludeIndex)
  {
    Point3d closestPoint = new Point3d();
    double closestDistance = double.MaxValue;

    for (int i = 0; i < polylines.Count; i++)
    {
      if (i == excludeIndex) continue; // Skip the polyline at excludeIndex

      var polyline = polylines[i];
      foreach (var pt in polyline)
      {
        double distance = point.DistanceTo(pt);
        if (distance < closestDistance)
        {
          closestDistance = distance;
          closestPoint = pt;
        }
      }
    }

    if (closestDistance == double.MaxValue)
    {
      throw new InvalidOperationException("No closest point found on other polylines.");
    }

    return closestPoint;
  }
  
  private Point3d ComputeClosestPoint(List<Point3d> points, Point3d testPoint, out int outputIndex)
  {
    // Initialize RTree
    RTree rTree = new RTree();
    int index = -1;
    for (int i = 0; i < points.Count; i++)
    {
      rTree.Insert(points[i], i);
    }

    Point3d closestPoint = new Point3d();
    double closestDistance = Double.MaxValue;
    EventHandler<RTreeEventArgs> closestPointCallback =
      (object sender, RTreeEventArgs args) =>
      {
      double distance = points[args.Id].DistanceTo(testPoint);
      if (distance < closestDistance)
      {
        closestDistance = distance;
        closestPoint = points[args.Id];
        index = args.Id;
      }
      };

    rTree.Search(new Sphere(testPoint, closestDistance), closestPointCallback);
    outputIndex = index;

    return closestPoint;
  }

  public static Point3d GetClosestEndPoint(Point3d point, List<Line> lines, List<Line> lines2)
  {
    if (lines == null || lines.Count == 0)
    {
      throw new ArgumentException("The list of lines must be defined and cannot be empty.");
    }

    int closestLineIndex = -1;
    double closestDistance = double.MaxValue;

    for (int i = 0; i < lines.Count; i++)
    {
      double t;
      double distance = point.DistanceTo(lines[i].ClosestPoint(point, true));
      if (distance < closestDistance)
      {
        closestDistance = distance;
        closestLineIndex = i;
      }
    }

    if (closestLineIndex != -1)
    {
      Point3d closestEndPoint;
      double distanceToStart = point.DistanceTo(lines[closestLineIndex].From);
      double distanceToEnd = point.DistanceTo(lines[closestLineIndex].To);

      if (distanceToStart < distanceToEnd)
      {
        closestEndPoint = lines2[closestLineIndex].From;
      }
      else
      {
        closestEndPoint = lines2[closestLineIndex].To;
      }

      return closestEndPoint;
    }

    throw new InvalidOperationException("No closest line found.");
  }
# ---------- end c_script_4 ----------
tag = TextTag(Location=flatten(item_5), Text=tstat.Paths)
dupln = RemoveDuplicateLines(Lines=c_script_4.A, Tolerance=0.01)  # -> simplify(UniqueLines)
line_topo = LineTopology(ListOfLines=dupln, Tolerance=0.001)  # -> ListOfPoints, LinePointStructure, PointPointStructure, PointLineStructure, PointLineStructureIndex
split = SplitTree(Data=simplify(dupln), Masks=flatten(path))  # -> Positive, Negative
c_script_5 = CSharpScript(x=dupln, y=line_topo.LinePointStructure, z=line_topo.ListOfPoints)  # -> out, A; inputs x: tree of Line, y: tree of Int32, z: tree of Point3d
# ---------- c_script_5: C# ----------
    DataTree<Polyline> output = new DataTree<Polyline>();

    for (int i = 0; i < x.BranchCount; i++)
    {
      for (int j = 0; j < x.Branch(i).Count; j++)
      {
        List<int> ptsList = new List<int>();
        int currentIndex = j;
        int nextIndex = currentIndex + 1 >= x.Branch(i).Count ? 0 : currentIndex + 1;

        if (y.Branch(new GH_Path(i, currentIndex)).Intersect(y.Branch(new GH_Path(i, nextIndex))).Any())
          ptsList = y.Branch(new GH_Path(i, currentIndex)).Union(y.Branch(new GH_Path(i, nextIndex))).ToList();
        else
        {
          List<int> nextBranch = y.Branch(new GH_Path(i, nextIndex));
          nextBranch.Reverse();
          ptsList = y.Branch(new GH_Path(i, currentIndex)).Concat(nextBranch).ToList();
        }

        List<Point3d> pts = new List<Point3d>();

        for (int k = 0; k < ptsList.Count; k++)
        {
          pts.Add(z.Branch(i)[ptsList[k]]);
        }
        pts.Add(pts[0]);
        if(pts.Count == 5)
        {
          Line lineA = new Line(pts[1], pts[2]);
          Line lineB = new Line(pts[0], pts[3]);
          double a,b;
          if(Rhino.Geometry.Intersect.Intersection.LineLine(lineA, lineB, out a, out b))
            pts = new List<Point3d>{pts[0],pts[1],pts[3],pts[2],pts[0]};

        }
        output.Add(new Polyline(pts), new GH_Path(i));
      }
    }

    A = output;
# ---------- end c_script_5 ----------

loft_2 = Loft(Curves=dupln, Options={Adjust=False, Closed=True, LoftEnds=0, LoftSimp=0, LoftType=3, Rebuild=10, Refit=0.01})  # -> simplify(Loft)

boundary_4 = BoundarySurfaces(Edges=simplify(graft(c_script_5.A)))
trim_5 = TrimTree(Tree=boundary_4, Depth=1)
join_3 = BrepJoin(Breps=trim_5)  # -> Breps, Closed
cap_3 = CapHoles(Brep=join_3.Breps)
clean_5 = CleanTree(RemoveNulls=True, RemoveInvalid=True, RemoveEmpty=False, Tree=cap_3)
c_script_6 = CSharpScript(x=clean_5, y=merge_5)  # -> out, A
# ---------- c_script_6: C# ----------
    if( x == null) A = y;
    else A = x;
# ---------- end c_script_6 ----------
A = ClusterOutput(c_script_6.A)

# ==== cluster Cluster_29
crv = ClusterInput()
crv_2 = Curve(flatten(crv))
I = ClusterInput()
item = ListItem(List=crv_2, Index=I, Wrap=True)
explode = Explode(Curve=item, Recursive=True)  # -> Segments, Vertices
item_2 = ListItem(List=explode.Vertices, Index=0, Wrap=True)
crv_cp = CurveClosestPoint(Point=item_2, Curve=I)  # -> Point, Parameter, Distance
seam = Seam(Curve=I, Seam=crv_cp.Parameter)  # -> flatten(Curve)
i = ClusterInput()
replace = ReplaceItems(List=crv_2, Item=flatten(I), Indices=i, Wrap=False)
L = ClusterOutput(replace)

# ==== cluster Cluster_31
C = ClusterInput()
C_2 = ClusterInput()
cluster = Cluster_30(C=C)  # -> min, max
cluster_2 = Cluster_30(C=C_2)  # -> min, max
x = ClusterInput()
A = ClusterInput()
B = ClusterInput()

c_script = CSharpScript(x=x)  # -> out, A; inputs x: Brep
# ---------- c_script: C# ----------
    A = x.IsSolid;
# ---------- end c_script ----------
ma = MassAddition(Input=c_script.A)  # -> Result, PartialResults
lng = ListLength(List=c_script.A)
subtraction = Subtraction(A=lng, B=ma.Result)
equals = Equality(FirstNumber=subtraction, SecondNumber=0)  # -> Equality, Inequality

concat = Concatenate(FragmentD="Bottom Poly Planarity: Min = ", FragmentA=cluster_2.min, FragmentC=", Max = ", FragmentB=cluster_2.max)
concat_2 = Concatenate(FragmentD="Top Poly Planarity: Min = ", FragmentA=cluster.min, FragmentC=", Max = ", FragmentB=cluster.max)
concat_3 = Concatenate(FragmentD="Thickness: Min = ", FragmentA=A, FragmentC=", Max = ", FragmentB=B)
concat_4 = Concatenate(FragmentD="Open Breps = ", FragmentA=equals.Inequality)
merge = Merge(Data1=concat_3, Data2=concat_2, Data3=concat, Data4=concat_4)
R = ClusterOutput(merge)

# ==== cluster Cluster_24
P = ClusterInput()
O = ClusterInput()
A = ClusterInput()
pl_offset = PlaneOffset(BasePlane=P, Offset=O)
pln = Plane(A)
ppx = PlanePlane(PlaneA=A, PlaneB=pl_offset)
shift = ShiftList(List=ppx, Shift=1, Wrap=True)
midpt = CurveMiddle(Curve=shift)
llx = LineLine(Line1=ppx, Line2=shift)  # -> ParamA, ParamB, PointA, PointB
c_script = CSharpScript(x=llx.PointA, y=midpt)  # -> out, A
# ---------- c_script: C# ----------
    if(x == null) A = y;
    else A = x;
# ---------- end c_script ----------
pline = PolyLine(Vertices=c_script.A, Closed=True)
simplify = Simplify(Curve=pline)
explode = Explode(Curve=simplify, Recursive=True)  # -> Segments, Vertices
cullpt = CullDuplicates(Points=explode.Vertices, Tolerance=0.1, CullMode=1)  # -> Points, Indices, Valence
pline_2 = PolyLine(Vertices=explode.Vertices, Closed=True)
P_2 = ClusterOutput(simplify)

# ==== cluster Cluster_30
C = ClusterInput()
explode = Explode(Curve=C, Recursive=True)  # -> Segments, Vertices
plfit = PlaneFit(Points=explode.Vertices)  # -> Plane, flatten(Deviation)
extremums = MinMax(Number=plfit.Deviation)  # -> Minimum, Maximum
min = ClusterOutput(extremums.Minimum)
max = ClusterOutput(extremums.Maximum)
